# Grasshopper definition NonLinearOptimisationCases.gh (Grasshopper 1.0.7)
# plug-ins: Galapagos, Alpaca4d

# ---- group: 1 - Rosenbrock - BOBYQA
# What to expect: BOBYQA, local, minimising Rosenbrock's banana valley from (-1.2, 1).
# Expect 0 at x = 1, y = 1, in about 200 evaluations.
# Then try Nelder-Mead, Sbplx and COBYLA from the same start: all reach (1, 1), COBYLA slowest. Ctrl+Z after a run puts the sliders back at the start.
x = Slider(-1.2, range=-2..2)
y = Slider(1, range=-2..2)
expression = Expression(x=x, y=y, Expression="(1-x)^2+100*(y-x^2)^2")
nl_opt = NonLinearOptimisationAlpaca4d(
    NonLinearOptimisation_objective=expression,
    NonLinearOptimisation_variable=[x, y],
    NonLinearOptimisation_Settings_algorithm="Bobyqa",
    NonLinearOptimisation_Settings_max_evaluations=1000,
    NonLinearOptimisation_Settings_max_time=0,
    NonLinearOptimisation_Settings_maximise=False,
    NonLinearOptimisation_Settings_objective_absolute_tolerance=0,
    NonLinearOptimisation_Settings_objective_tolerance=0.0001,
    NonLinearOptimisation_Settings_seed=1,
    NonLinearOptimisation_Settings_stop_value=0,
    NonLinearOptimisation_Settings_use_stop_value=False,
    NonLinearOptimisation_Settings_variable_tolerance=0.0001)

# ---- group: 2 - Branin - DIRECT-L
# What to expect: DIRECT-L, global, on Branin: three valleys of the same depth.
# Expect 0.3979 at one of (-3.142, 12.275), (3.142, 2.275) or (9.425, 2.475). DIRECT-L is deterministic: running it again gives the same run. The chart shows it sampling the whole range before closing in.
x_2 = Slider(2.5, range=-5..10)
y_2 = Slider(7.5, range=0..15)
expression_2 = Expression(x=x_2, y=y_2, Expression="(y-5.1/(4*Pi^2)*x^2+5/Pi*x-6)^2+10*(1-1/(8*Pi))*Cos(x)+10")
nl_opt_2 = NonLinearOptimisationAlpaca4d(
    NonLinearOptimisation_objective=expression_2,
    NonLinearOptimisation_variable=[x_2, y_2],
    NonLinearOptimisation_Settings_algorithm="DirectL",
    NonLinearOptimisation_Settings_max_evaluations=500,
    NonLinearOptimisation_Settings_max_time=0,
    NonLinearOptimisation_Settings_maximise=False,
    NonLinearOptimisation_Settings_objective_absolute_tolerance=0,
    NonLinearOptimisation_Settings_objective_tolerance=0.0001,
    NonLinearOptimisation_Settings_seed=1,
    NonLinearOptimisation_Settings_stop_value=0,
    NonLinearOptimisation_Settings_use_stop_value=False,
    NonLinearOptimisation_Settings_variable_tolerance=0.0001)

# ---- group: 3 - A hill - Nelder-Mead, maximising
# What to expect: Nelder-Mead, local, MAXIMISING a hill.
# Expect 5 at x = 2, y = -1.
# Switch Goal to Minimise and run again: it ends in a corner of the sliders' range, where the hill is lowest.
x_3 = Slider(-3, range=-5..5)
y_3 = Slider(4, range=-5..5)
expression_3 = Expression(x=x_3, y=y_3, Expression="5-(x-2)^2-2*(y+1)^2")
nl_opt_3 = NonLinearOptimisationAlpaca4d(
    NonLinearOptimisation_objective=expression_3,
    NonLinearOptimisation_variable=[x_3, y_3],
    NonLinearOptimisation_Settings_algorithm="NelderMead",
    NonLinearOptimisation_Settings_max_evaluations=500,
    NonLinearOptimisation_Settings_max_time=0,
    NonLinearOptimisation_Settings_maximise=True,
    NonLinearOptimisation_Settings_objective_absolute_tolerance=0,
    NonLinearOptimisation_Settings_objective_tolerance=0.0001,
    NonLinearOptimisation_Settings_seed=1,
    NonLinearOptimisation_Settings_stop_value=0,
    NonLinearOptimisation_Settings_use_stop_value=False,
    NonLinearOptimisation_Settings_variable_tolerance=0.0001)

# ---- group: 4 - NLopt's tutorial - COBYLA, two constraints
# What to expect: COBYLA, local, with TWO CONSTRAINTS: NLopt's tutorial. Minimise sqrt(y) with y above two cubics, written as (2x)^3 - y <= 0 and (1-x)^3 - y <= 0.
# Expect 0.5443 at x = 0.3333, y = 0.2963, where both constraints are 0.
# Try DIRECT-L: Start refuses, as it takes no constraints.
x_4 = Slider(1.234, range=-1..2)
y_4 = Slider(5.678, range=0.001..8)
expression_4 = Expression(x=x_4, y=y_4, Expression="(2*x)^3-y")
expression_5 = Expression(x=x_4, y=y_4, Expression="(1-x)^3-y")
expression_6 = Expression(x=x_4, y=y_4, Expression="Sqrt(y)")
nl_opt_4 = NonLinearOptimisationAlpaca4d(
    NonLinearOptimisation_objective=expression_6,
    NonLinearOptimisation_constraint=[expression_4, expression_5],
    NonLinearOptimisation_variable=[x_4, y_4],
    NonLinearOptimisation_Settings_algorithm="Cobyla",
    NonLinearOptimisation_Settings_max_evaluations=500,
    NonLinearOptimisation_Settings_max_time=0,
    NonLinearOptimisation_Settings_maximise=False,
    NonLinearOptimisation_Settings_objective_absolute_tolerance=0,
    NonLinearOptimisation_Settings_objective_tolerance=0.0001,
    NonLinearOptimisation_Settings_seed=1,
    NonLinearOptimisation_Settings_stop_value=0,
    NonLinearOptimisation_Settings_use_stop_value=False,
    NonLinearOptimisation_Settings_variable_tolerance=0.0001)

# ---- group: 5 - Outside the circle - ISRES, constrained
# What to expect: ISRES, global, with a constraint: the lowest x + y outside the unit circle (1 - x^2 - y^2 <= 0).
# Expect about -1.414 at about (-0.707, -0.707). Orange dots in the chart break the constraint. The same seed gives the same run; another seed, a slightly different end.
# Set 20000 evaluations to try Stop, and Esc, part way.
x_5 = Slider(1.5, range=-2..2)
y_5 = Slider(1.5, range=-2..2)
expression_7 = Expression(x=x_5, y=y_5, Expression="1-x^2-y^2")
expression_8 = Expression(x=x_5, y=y_5, Expression="x+y")
nl_opt_5 = NonLinearOptimisationAlpaca4d(
    NonLinearOptimisation_objective=expression_8,
    NonLinearOptimisation_constraint=expression_7,
    NonLinearOptimisation_variable=[x_5, y_5],
    NonLinearOptimisation_Settings_algorithm="Isres",
    NonLinearOptimisation_Settings_max_evaluations=3000,
    NonLinearOptimisation_Settings_max_time=0,
    NonLinearOptimisation_Settings_maximise=False,
    NonLinearOptimisation_Settings_objective_absolute_tolerance=0,
    NonLinearOptimisation_Settings_objective_tolerance=0.0001,
    NonLinearOptimisation_Settings_seed=1,
    NonLinearOptimisation_Settings_stop_value=0,
    NonLinearOptimisation_Settings_use_stop_value=False,
    NonLinearOptimisation_Settings_variable_tolerance=0.0001)

# ---- group: 6 - Rastrigin - CRS2-LM
# What to expect: CRS2-LM, global, on Rastrigin: a valley at every whole number.
# Expect 0 at (0, 0). CRS2-LM is random: if it ends in a neighbouring valley (1 or 2), try another seed.
# Then try Sbplx, local, from the same start: it stops in a nearer valley, around (3, -3), which is the point of a global algorithm.
x_6 = Slider(3.3, range=-5.12..5.12)
y_6 = Slider(-2.7, range=-5.12..5.12)
expression_9 = Expression(x=x_6, y=y_6, Expression="20+x^2-10*Cos(2*Pi*x)+y^2-10*Cos(2*Pi*y)")
nl_opt_6 = NonLinearOptimisationAlpaca4d(
    NonLinearOptimisation_objective=expression_9,
    NonLinearOptimisation_variable=[x_6, y_6],
    NonLinearOptimisation_Settings_algorithm="Crs2Lm",
    NonLinearOptimisation_Settings_max_evaluations=1500,
    NonLinearOptimisation_Settings_max_time=0,
    NonLinearOptimisation_Settings_maximise=False,
    NonLinearOptimisation_Settings_objective_absolute_tolerance=0,
    NonLinearOptimisation_Settings_objective_tolerance=0.0001,
    NonLinearOptimisation_Settings_seed=1,
    NonLinearOptimisation_Settings_stop_value=0,
    NonLinearOptimisation_Settings_use_stop_value=False,
    NonLinearOptimisation_Settings_variable_tolerance=0.0001)

# ---- group: 7 - A gene pool of 12 - Sbplx
# What to expect: Sbplx, local, on 12 variables from a Galapagos gene pool: one variable per gene.
# Expect 0 with every gene at 0.3 (the gene pool's own display shows them).
# This checks that gene pools are read and moved; the objective is the sum of the 12 squares, through Mass Addition.
genes = GenePool(Decimals=4, Maximum=1, Minimum=0, Value=[0.5, 0.5, 0.5, 0.5, 0.5, 0.5, 0.5, 0.5, 0.5, 0.5, 0.5, 0.5])
expression_10 = Expression(x=genes, Expression="(x-0.3)^2")
nl_opt_7 = NonLinearOptimisationAlpaca4d(
    NonLinearOptimisation_objective=ma,
    NonLinearOptimisation_variable=genes,
    NonLinearOptimisation_Settings_algorithm="Sbplx",
    NonLinearOptimisation_Settings_max_evaluations=3000,
    NonLinearOptimisation_Settings_max_time=0,
    NonLinearOptimisation_Settings_maximise=False,
    NonLinearOptimisation_Settings_objective_absolute_tolerance=0,
    NonLinearOptimisation_Settings_objective_tolerance=0.0001,
    NonLinearOptimisation_Settings_seed=1,
    NonLinearOptimisation_Settings_stop_value=0,
    NonLinearOptimisation_Settings_use_stop_value=False,
    NonLinearOptimisation_Settings_variable_tolerance=0.0001)
ma = MassAddition(Input=expression_10)  # -> Result, PartialResults

# ---- group: 8 - What must be refused or warned about
# What to expect: Three set-ups the optimiser must not run quietly. Start each:
# - left, BOBYQA on a whole-number slider: runs, but warns that the slider is too coarse for a local algorithm; it ends near n = 3.
# - middle, DIRECT-L with a constraint: refuses, as DIRECT-L takes no constraints.
# - right, objective linked to the 12 values of case 7: refuses, as an objective must be one number.
n = Slider(8, range=0..10)
expression_11 = Expression(n=n, Expression="(n-3.4)^2")
expression_12 = Expression(n=n, Expression="n-5")
nl_opt_8 = NonLinearOptimisationAlpaca4d(
    NonLinearOptimisation_objective=expression_11,
    NonLinearOptimisation_variable=n,
    NonLinearOptimisation_Settings_algorithm="Bobyqa",
    NonLinearOptimisation_Settings_max_evaluations=200,
    NonLinearOptimisation_Settings_max_time=0,
    NonLinearOptimisation_Settings_maximise=False,
    NonLinearOptimisation_Settings_objective_absolute_tolerance=0,
    NonLinearOptimisation_Settings_objective_tolerance=0.0001,
    NonLinearOptimisation_Settings_seed=1,
    NonLinearOptimisation_Settings_stop_value=0,
    NonLinearOptimisation_Settings_use_stop_value=False,
    NonLinearOptimisation_Settings_variable_tolerance=0.0001)
nl_opt_9 = NonLinearOptimisationAlpaca4d(
    NonLinearOptimisation_objective=expression_11,
    NonLinearOptimisation_constraint=expression_12,
    NonLinearOptimisation_variable=n,
    NonLinearOptimisation_Settings_algorithm="DirectL",
    NonLinearOptimisation_Settings_max_evaluations=200,
    NonLinearOptimisation_Settings_max_time=0,
    NonLinearOptimisation_Settings_maximise=False,
    NonLinearOptimisation_Settings_objective_absolute_tolerance=0,
    NonLinearOptimisation_Settings_objective_tolerance=0.0001,
    NonLinearOptimisation_Settings_seed=1,
    NonLinearOptimisation_Settings_stop_value=0,
    NonLinearOptimisation_Settings_use_stop_value=False,
    NonLinearOptimisation_Settings_variable_tolerance=0.0001)
nl_opt_10 = NonLinearOptimisationAlpaca4d(
    NonLinearOptimisation_objective=expression_10,
    NonLinearOptimisation_variable=n,
    NonLinearOptimisation_Settings_algorithm="NelderMead",
    NonLinearOptimisation_Settings_max_evaluations=200,
    NonLinearOptimisation_Settings_max_time=0,
    NonLinearOptimisation_Settings_maximise=False,
    NonLinearOptimisation_Settings_objective_absolute_tolerance=0,
    NonLinearOptimisation_Settings_objective_tolerance=0.0001,
    NonLinearOptimisation_Settings_seed=1,
    NonLinearOptimisation_Settings_stop_value=0,
    NonLinearOptimisation_Settings_use_stop_value=False,
    NonLinearOptimisation_Settings_variable_tolerance=0.0001)
