# Grasshopper definition BeamGridOptimiser.gh (Grasshopper 1.0.7)
# plug-ins: Galapagos, Kangaroo2 Components, Alpaca4d

# ---- group: 1 - The grid
size_m = Slider(20, range=4..40)
bays = Slider(10, range=2..20)
starting_section = ValueList({"RHS 300x200x10": "300x200x10", "RHS 400x200x10": "400x200x10", "HEA300"}, selected="RHS 300x200x10")
grade = ValueList({"S235", "S275", "S355"}, selected="S355")
supports_corner_to_centre = Slider(0, range=0..1)
node_load_kn = Slider(7.5, range=0..100)

# ---- group: 2 - Geometry
bay = Expression(L=size_m, n=bays, Expression="L/n")
grid_lines = Expression(n=bays, Expression="n+1")
grid_line_positions = Series(Start=0, Step=bay, Count=grid_lines)
west_ends = ConstructPoint(XCoordinate=0, YCoordinate=grid_line_positions, ZCoordinate=0)
east_ends = ConstructPoint(XCoordinate=size_m, YCoordinate=grid_line_positions, ZCoordinate=0)
south_ends = ConstructPoint(XCoordinate=grid_line_positions, YCoordinate=0, ZCoordinate=0)
north_ends = ConstructPoint(XCoordinate=grid_line_positions, YCoordinate=size_m, ZCoordinate=0)
along_x = Line(StartPoint=west_ends, EndPoint=east_ends)
along_y = Line(StartPoint=south_ends, EndPoint=north_ends)
nodes = DivideCurve(Curve=along_x, Count=bays, Kinks=False)  # -> Points, Tangents, Parameters
cut_y = DivideCurve(Curve=along_y, Count=bays, Kinks=False)  # -> Points, Tangents, Parameters
pline = PolyLine(Vertices=nodes.Points, Closed=False)
pline_2 = PolyLine(Vertices=cut_y.Points, Closed=False)
beams_x = Explode(Curve=pline, Recursive=True)  # -> Segments, Vertices
beams_y = Explode(Curve=pline_2, Recursive=True)  # -> Segments, Vertices

# ---- group: 4 - Supports
bays_in = Expression(t=supports_corner_to_centre, n=bays, Expression="Round(t*(Floor(n/2)-1))")
near = Expression(k=bays_in, L=size_m, n=bays, Expression="k*L/n")
far = Expression(k=bays_in, L=size_m, n=bays, Expression="L-k*L/n")
south_west = ConstructPoint(XCoordinate=near, YCoordinate=near, ZCoordinate=0)
south_east = ConstructPoint(XCoordinate=far, YCoordinate=near, ZCoordinate=0)
north_west = ConstructPoint(XCoordinate=near, YCoordinate=far, ZCoordinate=0)
north_east = ConstructPoint(XCoordinate=far, YCoordinate=far, ZCoordinate=0)
held = BooleanToggle(True)
free = BooleanToggle(False)
pinned = SupportAlpaca4d(
    Position=[south_west, south_east, north_west, north_east],
    Tx=held,
    Ty=held,
    Tz=held,
    Rx=free,
    Ry=free,
    Rz=free,
    mode="Support Rigid (Alpaca4d)")

# ---- group: 5 - Loads
downwards = Expression(P=node_load_kn, Expression="-P")
down = UnitZ(Factor=downwards)
node_loads = PointLoadAlpaca4d(Point=flatten(nodes.Points), Force=down, Moment=Vector(0, 0, 0))
self_weight = GravityLoadAlpaca4d(Factor=1)
load_pattern = LoadPatternAlpaca4d(Loads=flatten([node_loads, self_weight]), Factor=1, mode="PlainPattern (Alpaca4d)")

# ---- group: 3 - Beams
elementid = Panel("Grid")
material_library_elastic = MaterialLibraryElasticAlpaca4d(
    MaterialName=grade,
    MaterialPresetElastic_Grade="S235",
    MaterialPresetElastic_Model="Uniaxial",
    MaterialPresetElastic_Type="Steel",
    menu=[dropdown(0), dropdown(1), dropdown(0)])
starting_section_2 = SteelSectionLibraryAlpaca4d(SectionName=starting_section, Material=material_library_elastic, menu=[dropdown(0), dropdown(1)])
forcebeamcolumn = ForceBeamColumnAlpaca4d(
    Line=flatten([beams_x.Segments, beams_y.Segments]),
    Section=starting_section_2,
    Colour=RGB(1, 30, 254),
    ElementId=elementid,
    mode="ForceBeamColumn (Alpaca4d)")

# ---- group: 6 - Every element on its own, within its family
assemble_model = AssembleModelAlpaca4d(Elements=forcebeamcolumn, Supports=pinned, LoadPatterns=load_pattern, Tolerance=0.01)  # -> AlpacaModel, Mass
maxutilisation = Slider(1, range=0.5..1)
iterations = Slider(40, range=1..100)
# Beam grid: Beam grid - a Section Optimiser example.
# 
# A 20 m square grid of steel beams, 10 bays each way, carries its own weight and a load at every node, as a slab on it would bring. Four pinned supports start at the corners.
# 
# Slide 'Supports, corner to centre' to walk them in along the diagonals, a bay at a time. At the corners the grid spans between them as a slab does, and the beams along the edges and through the middle work hardest. Near the centre it cantilevers out to its edges: the material gathers over the supports and the edges go light.
# 
# The Section Optimiser has no design group, so every element is sized on its own, within the family of the section it starts with - every RHS, for an RHS 300x200x10 - smallest area first, over up to 40 iterations. Model View draws the sections it chose; switch it off, and the Model View named Displacement and Legend on, for how far the grid moves. It checks strength only, not deflection.
# 
# Why hollow sections: joined rigidly at every node, each beam twists as the beams across it bend. A closed section takes that torsion; an open one, such as the HEA300 in the list, cannot at any size, and the optimiser never settles.
# 
# The sections are only a start: choose your own, or give lines of beams a Design Group each so that every line ends up with one section.
every_element = SectionOptimiserAlpaca4d(
    AlpacaModel=assemble_model.AlpacaModel,
    MaxUtilisation=maxutilisation,
    Iterations=iterations,
    Fabrication="Rolled",
    ΓM0=1,
    ΓM1=1,
    System="Auto",
    Algorithm="Newton")  # -> AlpacaModel, Section, Utilisation, Element, Mass, Converged, Governing, Group, History, Log
modelview = ModelViewAlpaca4d(AlpacaModel=every_element.AlpacaModel, Step=0, FittedLoads=True)  # -> AlpacaModel, Geometry, Info, Values, Colors
displacement = ModelViewAlpaca4d(AlpacaModel=every_element.AlpacaModel, Step=0, FittedLoads=True)  # -> AlpacaModel, Geometry, Info, Values, Colors
mass = Panel(every_element.Mass)
converged = Panel(every_element.Converged)
history = Panel(every_element.History)
legend = LegendAlpaca4d(Title="Displacement [mm]", Values=displacement.Values, Colors=displacement.Colors, Position=1, Scale=1.5)
