# Grasshopper definition BrickSolverSpeed.gh (Grasshopper 1.0.7)
# plug-ins: Galapagos, Kangaroo2 Components, Alpaca4d

# ---- group: 1 - Size: drag Bricks per metre
# How to test the solver: Solver speed test: a concrete block of bricks.
# 
# An 8 x 8 m block 6 m deep, pinned all along its bottom, four 5000 kN columns on top and its own weight. Bricks per metre n sets the mesh: 8n x 8n x 6n bricks.
# 
# The solve alone, in OpenSees, on an Apple M2 Pro (Run Analysis adds writing, building and recording):
#   n   bricks   unknowns   BandSPD          UmfPack   Mumps, all cores
#   2    3 072     10 404   0.4 s            0.3 s     0.1 s
#   3   10 368     33 750   3.7 s            2.2 s     0.5 s
#   4   24 576     78 408   29 s, 4 GB       fails     1.6 s, 2 GB
#   5   48 000    151 290   over 6 GB        fails     4.2 s, 5 GB
# 
# 1. Display > Canvas Widgets > Profiler: each component shows how long it took.
# 2. Run Analysis and the Model View it feeds are disabled, so that dragging the slider never starts OpenSees. Right-click > Enable both to solve.
# 3. System: Auto and Mumps solve with Mumps on every core (right-click Analysis Settings > Cores for Mumps to use fewer); BandSPD and UmfPack on one. Auto needs an OpenSees with Mumps - Alpaca4d > Settings > Set OpenSees Executable - and says in the log when it has to use BandSPD instead.
# 4. Compare Run Analysis's time. Mind BandSPD from n = 4, and n = 5 with any System on a machine with less than 16 GB.
bricks_per_metre = Slider(3, range=1..5)
bricks_across = Expression(n=bricks_per_metre, Expression="8*n")
layer_depth = Expression(n=bricks_per_metre, Expression="-1/n")
layer_faces = Expression(n=bricks_per_metre, Expression="6*n+1")

# ---- group: 2 - The block, 8 x 8 m and 6 m deep, in layers of bricks
levels_top_down = Series(Start=6, Step=layer_depth, Count=layer_faces)
plan = Rectangle3Pt(PointA=Point(0, 0, 0), PointB=Point(8, 0, 0), PointC=Point(8, 8, 0))  # -> Rectangle, Length
up_to_each_level = UnitZ(Factor=levels_top_down)
plan_mesh = MeshPlane(Boundary=plan.Rectangle, WidthCount=bricks_across, HeightCount=bricks_across)  # -> Mesh, Area
level_meshes = Move(Geometry=plan_mesh.Mesh, Motion=up_to_each_level)  # -> Geometry, Transform
mesh_series_to_brick = MeshSeriesToBrickAlpaca4d(Meshes=level_meshes.Geometry, Closed=False)

# ---- group: 4 - Pinned bottom, four columns and the self weight
column_feet = ConstructPoint(XCoordinate=[2, 6], YCoordinate=graft([2, 6]), ZCoordinate=6)
bottom_nodes = DeconstructMesh(Mesh=plan_mesh.Mesh)  # -> Vertices, Faces, Colours, Normals
held = BooleanToggle(True)
free = BooleanToggle(False)
pinned_bottom = SupportAlpaca4d(Position=bottom_nodes.Vertices, Tx=held, Ty=held, Tz=held, Rx=free, Ry=free, Rz=free, mode="Support Rigid (Alpaca4d)")
_5000_kn_down = UnitZ(Factor=-5000)
column_loads = PointLoadAlpaca4d(Point=flatten(column_feet), Force=_5000_kn_down, Moment=Vector(0, 0, 0))
gravity_load = GravityLoadAlpaca4d(Factor=1)
load_pattern = LoadPatternAlpaca4d(Loads=flatten([column_loads, gravity_load]), Factor=1, mode="PlainPattern (Alpaca4d)")

# ---- group: 3 - Concrete
concrete = Panel("C30/37")
e_kn_m2 = Panel("33000000")
g_kn_m2 = Panel("13750000")
poisson = Panel("0.2")
density_kg_m3 = Panel("2500")
concrete_2 = ND(MaterialName=concrete, E=e_kn_m2, G=g_kn_m2, Ν=poisson, Rho=density_kg_m3, mode="ElasticIsotropic (Alpaca4d)")
block = SSPBrickAlpaca4d(Mesh=mesh_series_to_brick, Material=concrete_2)

# ---- group: 5 - Assemble Model, and how big the model is
assemble_model = AssembleModelAlpaca4d(Elements=flatten(block), Supports=flatten(pinned_bottom), LoadPatterns=flatten(load_pattern), Tolerance=0.01)  # -> AlpacaModel, Mass
modelview = ModelViewAlpaca4d(AlpacaModel=assemble_model.AlpacaModel, Step=0, FittedLoads=True)  # -> AlpacaModel, Geometry, Info, Values, Colors
bricks = ListLength(List=flatten(block))
unknowns = Expression(n=bricks_per_metre, Expression="3*(8*n+1)^2*6*n")
unknowns_dof = Panel(unknowns)

# ---- group: 6 - Solve: pick the System, right-click Analysis Settings for the cores, then Enable Run Analysis
system = ValueList({"Auto", "Mumps", "BandSPD", "UmfPack"}, selected="Auto")
analysis_settings = AnalysisSettingsAlpaca4d(Constraint="Transformation", Numberer="RCM", System=system, Algorithm="Newton", AnalysisType="Static", Cores=0)
run_analysis = RunAnalysisAlpaca4d(AlpacaModel=assemble_model.AlpacaModel, Settings=analysis_settings, settings=True)  # -> AlpacaModel, Log; disabled
modelview_2 = ModelViewAlpaca4d(AlpacaModel=run_analysis.AlpacaModel, Step=0, FittedLoads=True)  # -> AlpacaModel, Geometry, Info, Values, Colors; disabled
opensees_log = Panel(run_analysis.Log)
