# Grasshopper definition MixedModelSpeed.gh (Grasshopper 1.0.7)
# plug-ins: Galapagos, Kangaroo2 Components, Alpaca4d

# ---- group: 1 - Size: drag Divisions
# How to watch the speed: Mixed model speed test.
# 
# A 12 x 8 m concrete slab of shells on a 4 m grid of IPE 400 beams and HEB 300 columns, standing on a concrete raft of bricks. The beams and columns are cut at every node of the slab's mesh and the raft is meshed on the same spacing, so slab, steel and raft are one connected model. One load pattern: a point load in every bay, a line load on the beams along X, a slab load and gravity.
# 
# 1. Display > Canvas Widgets > Profiler: each component shows how long it took.
# 2. Drag Divisions per 4 m. At 10 the model has a few thousand elements; at 48, tens of thousands. The counts and the mass are next to Assemble Model.
# 3. Run Analysis and the Model View it feeds are disabled, so the slider never starts OpenSees. Right-click > Enable both to solve the model you have.
divisions_per_4_m = Slider(10, range=2..48)
storey_height_m = Slider(4, range=3..6)
raft_thickness_m = Slider(1, range=0.5..2)
raft_layers = Slider(2, range=1..4)
elements_along_x = Expression(n=divisions_per_4_m, Expression="3*n")
elements_along_y = Expression(n=divisions_per_4_m, Expression="2*n")
layer_depth = Expression(t=raft_thickness_m, k=raft_layers, Expression="-t/k")
layer_faces = Expression(k=raft_layers, Expression="k+1")
raft_bottom = Expression(t=raft_thickness_m, Expression="-t")

# ---- group: 2 - Geometry: slab and raft meshed on one spacing, steel cut on it
grid_y = Series(Start=0, Step=4, Count=3)
grid_x = Series(Start=0, Step=4, Count=4)
layer_offsets = Series(Start=0, Step=layer_depth, Count=layer_faces)
column_feet = ConstructPoint(XCoordinate=grid_x, YCoordinate=graft(grid_y), ZCoordinate=0)
plan = Rectangle3Pt(PointA=Point(0, 0, 0), PointB=Point(12, 0, 0), PointC=Point(12, 8, 0))  # -> Rectangle, Length
up_a_storey = UnitZ(Factor=storey_height_m)
beam_starts_x = ConstructPoint(XCoordinate=0, YCoordinate=grid_y, ZCoordinate=storey_height_m)
along = UnitX(Factor=1)
beam_starts_y = ConstructPoint(XCoordinate=grid_x, YCoordinate=0, ZCoordinate=storey_height_m)
along_2 = UnitY(Factor=1)
along_3 = UnitZ(Factor=1)
down_by_layer = UnitZ(Factor=layer_offsets)
down_to_the_bottom = UnitZ(Factor=raft_bottom)
plan_mesh = MeshPlane(Boundary=plan.Rectangle, WidthCount=elements_along_x, HeightCount=elements_along_y)  # -> Mesh, Area
slab_mesh = Move(Geometry=plan_mesh.Mesh, Motion=up_a_storey)  # -> Geometry, Transform
beams_x_lines = LineSDL(Start=beam_starts_x, Direction=along, Length=12)
beams_y_lines = LineSDL(Start=beam_starts_y, Direction=along_2, Length=8)
columns_lines = LineSDL(Start=column_feet, Direction=along_3, Length=storey_height_m)
raft_faces = Move(Geometry=plan_mesh.Mesh, Motion=down_by_layer)  # -> Geometry, Transform
raft_bottom_2 = Move(Geometry=plan_mesh.Mesh, Motion=down_to_the_bottom)  # -> Geometry, Transform
cut_beams_x = DivideCurve(Curve=beams_x_lines, Count=elements_along_x, Kinks=False)  # -> Points, Tangents, Parameters
cut_beams_y = DivideCurve(Curve=beams_y_lines, Count=elements_along_y, Kinks=False)  # -> Points, Tangents, Parameters
cut_columns = DivideCurve(Curve=columns_lines, Count=divisions_per_4_m, Kinks=False)  # -> Points, Tangents, Parameters
mesh_series_to_brick = MeshSeriesToBrickAlpaca4d(Meshes=raft_faces.Geometry, Closed=False)
raft_bottom_nodes = DeconstructMesh(Mesh=raft_bottom_2.Geometry)  # -> Vertices, Faces, Colours, Normals
beams_x_polylines = PolyLine(Vertices=cut_beams_x.Points, Closed=False)
beams_y_polylines = PolyLine(Vertices=cut_beams_y.Points, Closed=False)
columns_polylines = PolyLine(Vertices=cut_columns.Points, Closed=False)
beams_x_pieces = Explode(Curve=beams_x_polylines, Recursive=True)  # -> Segments, Vertices
beams_y_pieces = Explode(Curve=beams_y_polylines, Recursive=True)  # -> Segments, Vertices
columns_pieces = Explode(Curve=columns_polylines, Recursive=True)  # -> Segments, Vertices

# ---- group: 3 - Materials and sections
concrete = Panel("C30/37")
e_kn_m2 = Panel("33000000")
g_kn_m2 = Panel("13750000")
poisson = Panel("0.2")
density_kg_m3 = Panel("2500")
steel_grade = Panel("S355")
material_library_elastic = MaterialLibraryElasticAlpaca4d(
    MaterialName=steel_grade,
    MaterialPresetElastic_Grade="S235",
    MaterialPresetElastic_Model="Uniaxial",
    MaterialPresetElastic_Type="Steel",
    menu=[dropdown(0), dropdown(1), dropdown(0)])
beams = Panel("IPE400")
columns = Panel("HEB300")
beam_section = SteelSectionLibraryAlpaca4d(SectionName=beams, Material=material_library_elastic, menu=[dropdown(0), dropdown(1)])
column_section = SteelSectionLibraryAlpaca4d(SectionName=columns, Material=material_library_elastic, menu=[dropdown(0), dropdown(1)])
concrete_2 = ND(MaterialName=concrete, E=e_kn_m2, G=g_kn_m2, Ν=poisson, Rho=density_kg_m3, mode="ElasticIsotropic (Alpaca4d)")
slab_name = Panel("Slab 250")
slab_m = Panel("0.25")
slab_section = PlateFiberSectionAlpaca4d(SectionName=slab_name, Thickness=slab_m, Material=concrete_2)

# ---- group: 4 - Elements, bearings and one load pattern
bay_middles_x = Series(Start=2, Step=4, Count=3)
bay_middles_y = Series(Start=2, Step=4, Count=2)
bay_middles = ConstructPoint(XCoordinate=bay_middles_x, YCoordinate=graft(bay_middles_y), ZCoordinate=storey_height_m)
held = BooleanToggle(True)
free = BooleanToggle(False)
beams_x = ForceBeamColumnAlpaca4d(Line=flatten(beams_x_pieces.Segments), Section=beam_section, Colour=RGB(1, 30, 254), mode="ForceBeamColumn (Alpaca4d)")
beams_y = ForceBeamColumnAlpaca4d(Line=flatten(beams_y_pieces.Segments), Section=beam_section, Colour=RGB(1, 30, 254), mode="ForceBeamColumn (Alpaca4d)")
columns_2 = ForceBeamColumnAlpaca4d(Line=flatten(columns_pieces.Segments), Section=column_section, Colour=RGB(1, 30, 254), mode="ForceBeamColumn (Alpaca4d)")
slab = ASDShellAlpaca4d(Mesh=slab_mesh.Geometry, Section=slab_section, IsCorotational=False)
_3_kn_m2_down = UnitZ(Factor=-3)
_10_kn_m_down = UnitZ(Factor=-10)
raft = SSPBrickAlpaca4d(Mesh=mesh_series_to_brick, Material=concrete_2)
pinned_raft = SupportAlpaca4d(
    Position=raft_bottom_nodes.Vertices,
    Tx=held,
    Ty=held,
    Tz=held,
    Rx=free,
    Ry=free,
    Rz=free,
    mode="Support Rigid (Alpaca4d)")
_50_kn_down = UnitZ(Factor=-50)
slab_load = MeshLoadAlpaca4d(Force=_3_kn_m2_down)
beam_loads = LinearLoadAlpaca4d(BeamId=beams_x, Force=_10_kn_m_down)
bay_loads = PointLoadAlpaca4d(Point=bay_middles, Force=_50_kn_down, Moment=Vector(0, 0, 0))
gravity_load = GravityLoadAlpaca4d(Factor=1)
load_pattern = LoadPatternAlpaca4d(Loads=flatten([bay_loads, beam_loads, slab_load, gravity_load]), Factor=1, mode="PlainPattern (Alpaca4d)")

# ---- group: 5 - Assemble Model: the time to watch
assemble_model = AssembleModelAlpaca4d(
    Elements=flatten([beams_x, beams_y, columns_2, slab, raft]),
    Supports=flatten(pinned_raft),
    LoadPatterns=flatten(load_pattern),
    Tolerance=0.01)  # -> AlpacaModel, Mass
modelview = ModelViewAlpaca4d(AlpacaModel=assemble_model.AlpacaModel, Step=0, FittedLoads=True)  # -> AlpacaModel, Geometry, Info, Values, Colors
beam_elements = ListLength(List=flatten([beams_x, beams_y, columns_2]))
shells = ListLength(List=flatten(slab))
bricks = ListLength(List=flatten(raft))
mass_kg = Panel(assemble_model.Mass)

# ---- group: 6 - Analysis: disabled, right-click > Enable to solve in OpenSees
analysis_settings = AnalysisSettingsAlpaca4d(Constraint="Transformation", Numberer="RCM", System="Auto", Algorithm="Newton", AnalysisType="Static", Cores=0)
run_analysis = RunAnalysisAlpaca4d(AlpacaModel=assemble_model.AlpacaModel, Settings=analysis_settings, settings=True)  # -> AlpacaModel, Log; disabled
modelview_2 = ModelViewAlpaca4d(AlpacaModel=run_analysis.AlpacaModel, Step=0, FittedLoads=True)  # -> AlpacaModel, Geometry, Info, Values, Colors; disabled
