# Grasshopper definition StressLinesBenchmarks.gh (Grasshopper 1.0.8)
# plug-ins: Alpaca4d

# ---- group: A1 - Timoshenko's cantilever: 8 x 2 m, 32 x 8 quads, steel 100 mm
material = Panel("Steel")
e_kn_m2 = Panel("210000000")
g_kn_m2 = Panel("80769231")
poisson = Panel("0.3")
density_kg_m3 = Panel("7850")
# Principal Stress Lines against closed-form solutions: Principal Stress Lines against three closed-form solutions.
# 
# Each model is solved by OpenSees, and its lines are drawn in Rhino's Top view beside one another: single lines through six seeds, with the exact trajectories through the same seeds dashed, and a field of lines from one seed. Red is SL1, the largest principal direction; blue is SL2.
# 
# A - Timoshenko and Goodier's cantilever, loaded by the exact tractions at both ends: in-plane lines.
# B - Navier's simply supported slab under a uniform load: bending lines. Turn a third of the shells over to see the lines carry on across shells that face the other way.
# C - Kirsch's plate with a hole, pulled along X: in-plane lines.
# 
# The exact trajectories are worked out when the definition is built and kept in it: move a seed and its dashed line stays where it was. Alpaca4d.Test/PrincipalStressLines measures the same lines against the same solutions.
_8_x_2_m = Rectangle3Pt(PointA=Point(0, -1, 0), PointB=Point(8, -1, 0), PointC=Point(8, 1, 0))  # -> Rectangle, Length
steel = ND(MaterialName=material, E=e_kn_m2, G=g_kn_m2, Ν=poisson, Rho=density_kg_m3, mode="ElasticIsotropic (Alpaca4d)")
_32_x_8_quads = MeshPlane(Boundary=_8_x_2_m.Rectangle, WidthCount=32, HeightCount=8)  # -> Mesh, Area
plate = PlateFiberSectionAlpaca4d(Thickness=0.1, Material=steel)
asdq4_asdt3 = ASDShellAlpaca4d(Mesh=_32_x_8_quads.Mesh, Section=plate, IsCorotational=False)

# ---- group: A3 - Loaded at both ends by the exact tractions, lumped to the nodes
end_nodes = Point([Point(0, -1, 0), Point(0, -0.75, 0), Point(0, -0.5, 0), Point(0, -0.25, 0), Point(0, 0, 0), Point(0, 0.25, 0), Point(0, 0.5, 0), Point(0, 0.75, 0), Point(0, 1, 0), Point(8, -1, 0), Point(8, -0.75, 0), Point(8, -0.5, 0), Point(8, -0.25, 0), Point(8, 0, 0), Point(8, 0.25, 0), Point(8, 0.5, 0), Point(8, 0.75, 0), Point(8, 1, 0)])
end_forces_kn = Vector([Vector(0, 0.146484375, 0), Vector(0, 0.80078125, 0), Vector(0, 1.38671875, 0), Vector(0, 1.73828125, 0), Vector(0, 1.85546875, 0), Vector(0, 1.73828125, 0), Vector(0, 1.38671875, 0), Vector(0, 0.80078125, 0), Vector(0, 0.146484375, 0), Vector(13.75, -0.146484375, 0), Vector(22.5, -0.80078125, 0), Vector(15, -1.38671875, 0), Vector(7.5, -1.73828125, 0), Vector(0, -1.85546875, 0), Vector(-7.5, -1.73828125, 0), Vector(-15, -1.38671875, 0), Vector(-22.5, -0.80078125, 0), Vector(-13.75, -0.146484375, 0)])
end_loads = PointLoadAlpaca4d(Point=end_nodes, Force=end_forces_kn, Moment=Vector(0, 0, 0))

# ---- group: A6 - Exact trajectories through the six seeds, from the closed form
exact_trajectories = Point(Tree({0}: [Point(1.585157347, 1, 0), Point(1.585701374, 0.9586087898, 0), Point(1.587864152, 0.9086579263, 0), Point(1.591729574, 0.8588100838, 0), Point(1.597348258, 0.8091294553, 0), Point(1.604755156, 0.759683913, 0)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], {1}: [Point(1.585157347, -1, 0), Point(1.585701374, -0.9586087898, 0), Point(1.587864152, -0.9086579263, 0), Point(1.591729574, -0.8588100838, 0), Point(1.597348258, -0.8091294553, 0), Point(1.604755156, -0.759683913, 0)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], {2}: [Point(4.760562007, 1, 0), Point(4.76074745, 0.9580978281, 0), Point(4.761476283, 0.908103405, 0), Point(4.762784954, 0.8581208313, 0), Point(4.764709202, 0.8081582092, 0), Point(4.767290316, 0.7582252615, 0)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], {3}: [Point(4.760562007, -1, 0), Point(4.76074745, -0.9580978281, 0), Point(4.761476283, -0.908103405, 0), Point(4.762784954, -0.8581208313, 0), Point(4.764709202, -0.8081582092, 0), Point(4.767290316, -0.7582252615, 0)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], {4}: [Point(3.012483876, 1, 0), Point(3.012882723, 0.9512702271, 0), Point(3.014155392, 0.9012870947, 0), Point(3.01634718, 0.8513359017, 0), Point(3.01950925, 0.8014368228, 0), Point(3.02369771, 0.7516135031, 0)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], {5}: [Point(2.082106036, -1, 0), Point(2.082676392, -0.9515270881, 0), Point(2.084508061, -0.9015620359, 0), Point(2.087657709, -0.851662859, 0), Point(2.09218319, -0.8018697436, 0), Point(2.098140305, -0.752227696, 0)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], {6}: [Point(3.173118926, 1, 0), Point(3.173470938, 0.9528957397, 0), Point(3.174651746, 0.9029102852, 0), Point(3.176704305, 0.8529531031, 0), Point(3.179678016, 0.803042363, 0), Point(3.183627557, 0.7531994457, 0)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], {7}: [Point(5.276597931, -1, 0), Point(5.276757603, -0.9591403292, 0), Point(5.277404623, -0.9091447307, 0), Point(5.278574415, -0.8591586583, 0), Point(5.280299552, -0.8091887025, 0), Point(5.282617884, -0.7592427933, 0)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], {8}: [Point(1.182190058, 1, 0), Point(1.182908335, 0.958944656, 0), Point(1.185783011, 0.9090314926, 0), Point(1.190897207, 0.8592980252, 0), Point(1.198259944, 0.8098474125, 0), Point(1.207836861, 0.7607773621, 0)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], {9}: [Point(0, 0.08271908438, 0), Point(0.03396979747, 0.1166278352, 0), Point(0.06945182531, 0.1518559959, 0), Point(0.1050771812, 0.1869391722, 0), Point(0.1408952082, 0.2218255704, 0), Point(0.1769578034, 0.2564590286, 0)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], {10}: [Point(6.406845218, 1, 0), Point(6.407008672, 0.9543251216, 0), Point(6.407582036, 0.9043285567, 0), Point(6.408588711, 0.8543388579, 0), Point(6.410056425, 0.8043605937, 0), Point(6.412017696, 0.754399293, 0)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], {11}: [Point(6.921613564, -1, 0), Point(6.921769218, -0.9536980572, 0), Point(6.922304851, -0.903701053, 0), Point(6.923241965, -0.8537099783, 0), Point(6.924606424, -0.8037287619, 0), Point(6.926428636, -0.7537621656, 0)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]))
exact = PolyLine(Vertices=exact_trajectories, Closed=False)
dashed = DashPattern(Curve=exact, Pattern=[0.08, 0.06])  # -> Dashes, Gaps

# ---- group: B1 - Navier's slab: 10 x 10 m, 20 x 20 quads, concrete 100 mm. The toggle turns a third of its shells over
turn_a_third_of_the_shells_over = BooleanToggle(False)
material_2 = Panel("Concrete")
e_kn_m2_2 = Panel("30000000")
g_kn_m2_2 = Panel("12500000")
poisson_2 = Panel("0.2")
density_kg_m3_2 = Panel("2500")
_10_x_10_m = Rectangle3Pt(PointA=Point(0, 0, 0), PointB=Point(10, 0, 0), PointC=Point(10, 10, 0))  # -> Rectangle, Length
concrete = ND(MaterialName=material_2, E=e_kn_m2_2, G=g_kn_m2_2, Ν=poisson_2, Rho=density_kg_m3_2, mode="ElasticIsotropic (Alpaca4d)")
_20_x_20_quads = MeshPlane(Boundary=_10_x_10_m.Rectangle, WidthCount=20, HeightCount=20)  # -> Mesh, Area
nodes_and_faces = DeconstructMesh(Mesh=_20_x_20_quads.Mesh)  # -> Vertices, Faces, Colours, Normals
corners = DeconstructFace(Face=nodes_and_faces.Faces)  # -> CornerA, CornerB, CornerC, CornerD
every_third = Modulus(A=corners.CornerA, B=3)
plate_2 = PlateFiberSectionAlpaca4d(Thickness=0.1, Material=concrete)
corner_b = Expression(
    b=corners.CornerB,
    d=corners.CornerD,
    m=every_third,
    t=turn_a_third_of_the_shells_over,
    Expression="If(t,If(m<0.5,d,b),b)")
corner_d = Expression(
    b=corners.CornerB,
    d=corners.CornerD,
    m=every_third,
    t=turn_a_third_of_the_shells_over,
    Expression="If(t,If(m<0.5,b,d),d)")
faces = MeshQuad(CornerA=corners.CornerA, CornerB=corner_b, CornerC=corners.CornerC, CornerD=corner_d)
slab = ConstructMesh(Vertices=nodes_and_faces.Vertices, Faces=faces)
asdq4_asdt3_2 = ASDShellAlpaca4d(Mesh=slab, Section=plate_2, IsCorotational=False)

# ---- group: B3 - 10 kN/m2 down
_10_kn_m2_down = Vector(Vector(0, 0, -10))
uniform_load = MeshLoadAlpaca4d(Force=_10_kn_m2_down)

# ---- group: B6 - Exact trajectories through the six seeds, from Navier's series
exact_trajectories_2 = Point(Tree({0}: [Point(0.2803270292, 0, 0), Point(0.2981641205, 0.01783647644, 0), Point(0.3264506685, 0.04611847071, 0), Point(0.3547399209, 0.07439775998, 0), Point(0.383032415, 0.1026738059, 0), Point(0.4113285144, 0.130946244, 0)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], {1}: [Point(4.465120691, 0, 0), Point(4.443534668, 0.0217385579, 0), Point(4.415607819, 0.05037558802, 0), Point(4.387936411, 0.07925955688, 0), Point(4.360497137, 0.1083641716, 0), Point(4.333267782, 0.1376652985, 0)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], {2}: [Point(0, 2.893431281, 0), Point(0.02280989794, 2.916277954, 0), Point(0.05101180856, 2.944644334, 0), Point(0.0791484599, 2.973075446, 0), Point(0.1072182593, 3.001572562, 0), Point(0.1352199735, 3.030136582, 0)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], {3}: [Point(4.79901313, 0, 0), Point(4.775314788, 0.02419433376, 0), Point(4.747966074, 0.05338320431, 0), Point(4.72116856, 0.08307925642, 0), Point(4.69482673, 0.1131804642, 0), Point(4.668863764, 0.1436091882, 0)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], {4}: [Point(0, 10, 0), Point(0.01600938339, 9.983990617, 0), Point(0.04429365464, 9.955706345, 0), Point(0.07257792589, 9.927422074, 0), Point(0.1008621971, 9.899137803, 0), Point(0.1291464684, 9.870853532, 0)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], {5}: [Point(0.1564471956, 5.045112136, 0), Point(0.1944020325, 5.057738113, 0), Point(0.2322231363, 5.07075925, 0), Point(0.2699095136, 5.084165341, 0), Point(0.3074589073, 5.097950465, 0), Point(0.3448691178, 5.112108964, 0)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], {6}: [Point(0.9626942905, 0, 0), Point(0.9880202813, 0.02531674, 0), Point(1.016321968, 0.05358358498, 0), Point(1.04463683, 0.0818372315, 0), Point(1.07296519, 0.110077345, 0), Point(1.101307149, 0.1383038099, 0)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], {7}: [Point(6.10793148, 0, 0), Point(6.126680875, 0.01880188256, 0), Point(6.154809329, 0.04724106852, 0), Point(6.182811341, 0.07580476632, 0), Point(6.210694449, 0.1044845529, 0), Point(6.23846649, 0.1332719088, 0)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], {8}: [Point(0, 0.3970383741, 0), Point(0.01729316541, 0.414332706, 0), Point(0.04557321289, 0.4426212003, 0), Point(0.073848783, 0.47091417, 0), Point(0.1021194356, 0.4992120532, 0), Point(0.1303849548, 0.527515064, 0)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], {9}: [Point(4.999877399, 0.1896044337, 0), Point(4.999842907, 0.2296044188, 0), Point(4.999805839, 0.2696044016, 0), Point(4.999766117, 0.3096043819, 0), Point(4.999723636, 0.3496043593, 0), Point(4.999678283, 0.3896043336, 0)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], {10}: [Point(2.508534534, 10, 0), Point(2.527681987, 9.980871519, 0), Point(2.556022555, 9.952643664, 0), Point(2.584412307, 9.924465276, 0), Point(2.612852147, 9.896337441, 0), Point(2.641342658, 9.868260932, 0)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], {11}: [Point(10, 5.370647823, 0), Point(9.983749827, 5.38677302, 0), Point(9.955037624, 5.414622362, 0), Point(9.925981188, 5.44211246, 0), Point(9.896627379, 5.469284875, 0), Point(9.867016586, 5.496177075, 0)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]))
exact_2 = PolyLine(Vertices=exact_trajectories_2, Closed=False)
dashed_2 = DashPattern(Curve=exact_2, Pattern=[0.12, 0.08])  # -> Dashes, Gaps

# ---- group: C1 - Kirsch's plate with a hole: a 10 x 10 m window round a 2 m hole, 64 x 20 quads, steel 100 mm
material_3 = Panel("Steel")
e_kn_m2_3 = Panel("210000000")
g_kn_m2_3 = Panel("80769231")
poisson_3 = Panel("0.3")
density_kg_m3_3 = Panel("7850")
steel_2 = ND(MaterialName=material_3, E=e_kn_m2_3, G=g_kn_m2_3, Ν=poisson_3, Rho=density_kg_m3_3, mode="ElasticIsotropic (Alpaca4d)")
_64_x_20_quads = Mesh(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)
plate_3 = PlateFiberSectionAlpaca4d(Thickness=0.1, Material=steel_2)
asdq4_asdt3_3 = ASDShellAlpaca4d(Mesh=_64_x_20_quads, Section=plate_3, IsCorotational=False)

# ---- group: C3 - The infinite plate's stress on the window's edge, lumped to the nodes: 10 MPa along X far away
edge_nodes = Point([Point(-5, -5, 0), Point(-5, -4.103393954, 0), Point(-5, -3.34089319, 0), Point(-5, -2.67255568, 0), Point(-5, -2.071067812, 0), Point(-5, -1.516733418, 0)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])
edge_forces_kn = Vector([Vector(-452.9260302, 14.73247847, 0), Vector(-841.2391764, 16.70291854, 0), Vector(-717.4458202, 22.17773716, 0), Vector(-625.7610301, 25.24443018, 0), Vector(-557.1946464, 25.36800327, 0), Vector(-506.8299975, 22.4238512, 0)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])
edge_loads = PointLoadAlpaca4d(Point=edge_nodes, Force=edge_forces_kn, Moment=Vector(0, 0, 0))

# ---- group: C6 - Exact trajectories through the six seeds, from the closed form
exact_trajectories_3 = Point(Tree({0}: [Point(-5, 0.7999698078, 0), Point(-4.957178472, 0.8013053933, 0), Point(-4.907204203, 0.8029092157, 0), Point(-4.857231571, 0.8045632358, 0), Point(-4.807260695, 0.8062694934, 0), Point(-4.757291705, 0.8080301256, 0)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], {1}: [Point(0.04252293137, 0.9990954906, 0), Point(0.04417007936, 1.040074908, 0), Point(0.04590578159, 1.090044696, 0), Point(0.04733714785, 1.140024127, 0), Point(0.04846970232, 1.190011227, 0), Point(0.04931943847, 1.240003944, 0)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], {2}: [Point(-5, 1.164922587, 0), Point(-4.950320722, 1.166926131, 0), Point(-4.900363608, 1.168996499, 0), Point(-4.850408909, 1.171124364, 0), Point(-4.800456776, 1.173311632, 0), Point(-4.750507369, 1.175560268, 0)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], {3}: [Point(1.441930929, -5, 0), Point(1.442853785, -4.957592792, 0), Point(1.443961907, -4.907605073, 0), Point(1.445092229, -4.857617852, 0), Point(1.446245105, -4.807631145, 0), Point(1.447420877, -4.757644972, 0)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], {4}: [Point(-5, 0.4146794294, 0), Point(-4.956420817, 0.4154445476, 0), Point(-4.906429017, 0.4163499867, 0), Point(-4.856437783, 0.417286182, 0), Point(-4.806447162, 0.4182545558, 0), Point(-4.756457205, 0.4192566138, 0)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], {5}: [Point(3.224002808, -5, 0), Point(3.224297563, -4.957971912, 0), Point(3.224634287, -4.907973046, 0), Point(3.224954996, -4.857974075, 0), Point(3.225258664, -4.807974998, 0), Point(3.225544224, -4.757975813, 0)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], {6}: [Point(-5, 2.918731435, 0), Point(-4.958612766, 2.920258967, 0), Point(-4.908647228, 2.922115017, 0), Point(-4.858682151, 2.923983465, 0), Point(-4.808717515, 2.925863661, 0), Point(-4.758753296, 2.927754905, 0)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], {7}: [Point(-1.957757272, -5, 0), Point(-1.958673901, -4.955684288, 0), Point(-1.959719444, -4.905695221, 0), Point(-1.960776955, -4.855706406, 0), Point(-1.961846171, -4.80571784, 0), Point(-1.962926789, -4.755729518, 0)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], {8}: [Point(-5, 4.033499413, 0), Point(-4.959063664, 4.03434456, 0), Point(-4.90907415, 4.03536853, 0), Point(-4.859084441, 4.036382905, 0), Point(-4.809094522, 4.03738689, 0), Point(-4.759104379, 4.038379664, 0)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], {9}: [Point(0.3265955812, 0.945164179, 0), Point(0.339869621, 0.9863408633, 0), Point(0.3529832683, 1.034585241, 0), Point(0.3637345335, 1.083410867, 0), Point(0.3722545021, 1.132675644, 0), Point(0.3787528212, 1.182248469, 0)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], {10}: [Point(-5, -0.07273248294, 0), Point(-4.954337388, -0.07287748031, 0), Point(-4.904337657, -0.07304152997, 0), Point(-4.854337946, -0.07321132443, 0), Point(-4.804338255, -0.07338714204, 0), Point(-4.754338587, -0.07356927856, 0)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], {11}: [Point(-1.404838389, -5, 0), Point(-1.405916323, -4.95031704, 0), Point(-1.407023166, -4.900329293, 0), Point(-1.40815275, -4.850342055, 0), Point(-1.40930547, -4.800355345, 0), Point(-1.410481711, -4.750369182, 0)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]))
exact_3 = PolyLine(Vertices=exact_trajectories_3, Closed=False)
dashed_3 = DashPattern(Curve=exact_3, Pattern=[0.12, 0.08])  # -> Dashes, Gaps

# ---- group: A2 - Held against rigid-body motion only
nodes = DeconstructMesh(Mesh=_32_x_8_quads.Mesh)  # -> Vertices, Faces, Colours, Normals
node_x_y = Deconstruct(Point=nodes.Vertices)  # -> XComponent, YComponent, ZComponent
held = BooleanToggle(True)
free = BooleanToggle(False)
tx_8_0_and_8_1 = Expression(x=node_x_y.XComponent, y=node_x_y.YComponent, Expression="Abs(x-8)+Min(Abs(y),Abs(y-1))<0.001")
ty_8_0 = Expression(x=node_x_y.XComponent, y=node_x_y.YComponent, Expression="Abs(x-8)+Abs(y)<0.001")
supports = SupportAlpaca4d(Position=nodes.Vertices, Tx=tx_8_0_and_8_1, Ty=ty_8_0, Tz=held, Rx=held, Ry=held, Rz=free)

# ---- group: C2 - Held against rigid-body motion only
nodes_2 = DeconstructMesh(Mesh=_64_x_20_quads)  # -> Vertices, Faces, Colours, Normals
node_x_y_2 = Deconstruct(Point=nodes_2.Vertices)  # -> XComponent, YComponent, ZComponent
held_2 = BooleanToggle(True)
free_2 = BooleanToggle(False)
tx_5_0 = Expression(x=node_x_y_2.XComponent, y=node_x_y_2.YComponent, Expression="Abs(x-5)+Abs(y)<0.001")
ty_5_0_and_5_0 = Expression(x=node_x_y_2.XComponent, y=node_x_y_2.YComponent, Expression="Abs(Abs(x)-5)+Abs(y)<0.001")
supports_2 = SupportAlpaca4d(Position=nodes_2.Vertices, Tx=tx_5_0, Ty=ty_5_0_and_5_0, Tz=held_2, Rx=held_2, Ry=held_2, Rz=free_2)

# ---- group: B2 - Simply supported: edges held up, and their rotation along the edge
nodes_3 = DeconstructMesh(Mesh=_20_x_20_quads.Mesh)  # -> Vertices, Faces, Colours, Normals
node_x_y_3 = Deconstruct(Point=nodes_3.Vertices)  # -> XComponent, YComponent, ZComponent
held_3 = BooleanToggle(True)
free_3 = BooleanToggle(False)
tz_on_an_edge = Expression(x=node_x_y_3.XComponent, y=node_x_y_3.YComponent, Expression="Max(Abs(x-5),Abs(y-5))>4.999")
rx_on_an_edge_along_y = Expression(x=node_x_y_3.XComponent, y=node_x_y_3.YComponent, Expression="Abs(x-5)>4.999")
ry_on_an_edge_along_x = Expression(x=node_x_y_3.XComponent, y=node_x_y_3.YComponent, Expression="Abs(y-5)>4.999")
supports_3 = SupportAlpaca4d(
    Position=nodes_3.Vertices,
    Tx=held_3,
    Ty=held_3,
    Tz=tz_on_an_edge,
    Rx=rx_on_an_edge_along_y,
    Ry=ry_on_an_edge_along_x,
    Rz=held_3)

# ---- group: C4 - One load pattern, assembled and solved
load_pattern = LoadPatternAlpaca4d(Loads=flatten(edge_loads), Factor=1, mode="PlainPattern (Alpaca4d)")
analysis_settings = AnalysisSettingsAlpaca4d(Constraint="Transformation", Numberer="RCM", System="Auto", Algorithm="Newton", AnalysisType="Static", Cores=0)
assemble_model = AssembleModelAlpaca4d(Elements=flatten(asdq4_asdt3_3), Supports=flatten(supports_2), LoadPatterns=flatten(load_pattern), Tolerance=0.01)  # -> AlpacaModel, Mass
run_analysis = RunAnalysisAlpaca4d(AlpacaModel=assemble_model.AlpacaModel, Settings=analysis_settings, settings=True)  # -> AlpacaModel, Log

# ---- group: C5 - Principal Stress Lines: six single lines, and a field from one seed with Test Dist.
seeds = Point([Point(0.05, 1.3, 0), Point(1.5, 1.5, 0), Point(3, 0.5, 0), Point(-2, 3, 0), Point(0.3, 4, 0), Point(-1.2, -0.4, 0)])
field_seed = Point(Point(0.3, 1.8, 0))
step_tolerance = Slider(0.1, range=0.01..0.5)
single_lines = PrincipalStressLinesAlpaca4d(
    AlpacaModel=run_analysis.AlpacaModel,
    Step=0,
    Seed=seeds,
    StepTolerance=step_tolerance,
    SingleLine=True,
    PoissonsRatio=0,
    BendingStressLines=False,
    Separation=0,
    TestDist=0)  # -> StressLinesDir1, StressLinesDir2
separation = Slider(0.4, range=0.05..1)
test_dist = Slider(0.2, range=0..1)
field = PrincipalStressLinesAlpaca4d(
    AlpacaModel=run_analysis.AlpacaModel,
    Step=0,
    Seed=field_seed,
    StepTolerance=step_tolerance,
    SingleLine=False,
    PoissonsRatio=0,
    BendingStressLines=False,
    Separation=separation,
    TestDist=test_dist)  # -> StressLinesDir1, StressLinesDir2

# ---- group: A4 - One load pattern, assembled and solved
load_pattern_2 = LoadPatternAlpaca4d(Loads=flatten(end_loads), Factor=1, mode="PlainPattern (Alpaca4d)")
analysis_settings_2 = AnalysisSettingsAlpaca4d(Constraint="Transformation", Numberer="RCM", System="Auto", Algorithm="Newton", AnalysisType="Static", Cores=0)
assemble_model_2 = AssembleModelAlpaca4d(Elements=flatten(asdq4_asdt3), Supports=flatten(supports), LoadPatterns=flatten(load_pattern_2), Tolerance=0.01)  # -> AlpacaModel, Mass
run_analysis_2 = RunAnalysisAlpaca4d(AlpacaModel=assemble_model_2.AlpacaModel, Settings=analysis_settings_2, settings=True)  # -> AlpacaModel, Log

# ---- group: A5 - Principal Stress Lines: six single lines, and a field from one seed
seeds_2 = Point([Point(2, 0, 0), Point(5, 0, 0), Point(3.1, 0.37, 0), Point(5.3, -0.55, 0), Point(1.2, 0.8, 0), Point(7, -0.2, 0)])
field_seed_2 = Point(Point(4.1, 0.13, 0))
step_tolerance_2 = Slider(0.1, range=0.01..0.5)
single_lines_2 = PrincipalStressLinesAlpaca4d(
    AlpacaModel=run_analysis_2.AlpacaModel,
    Step=0,
    Seed=seeds_2,
    StepTolerance=step_tolerance_2,
    SingleLine=True,
    PoissonsRatio=0,
    BendingStressLines=False,
    Separation=0,
    TestDist=0)  # -> StressLinesDir1, StressLinesDir2
separation_2 = Slider(0.25, range=0.05..1)
field_2 = PrincipalStressLinesAlpaca4d(
    AlpacaModel=run_analysis_2.AlpacaModel,
    Step=0,
    Seed=field_seed_2,
    StepTolerance=step_tolerance_2,
    SingleLine=False,
    PoissonsRatio=0,
    BendingStressLines=False,
    Separation=separation_2,
    TestDist=0)  # -> StressLinesDir1, StressLinesDir2

# ---- group: B4 - One load pattern, assembled and solved
load_pattern_3 = LoadPatternAlpaca4d(Loads=flatten(uniform_load), Factor=1, mode="PlainPattern (Alpaca4d)")
analysis_settings_3 = AnalysisSettingsAlpaca4d(Constraint="Transformation", Numberer="RCM", System="Auto", Algorithm="Newton", AnalysisType="Static", Cores=0)
assemble_model_3 = AssembleModelAlpaca4d(Elements=flatten(asdq4_asdt3_2), Supports=flatten(supports_3), LoadPatterns=flatten(load_pattern_3), Tolerance=0.01)  # -> AlpacaModel, Mass
run_analysis_3 = RunAnalysisAlpaca4d(AlpacaModel=assemble_model_3.AlpacaModel, Settings=analysis_settings_3, settings=True)  # -> AlpacaModel, Log

# ---- group: B5 - Bending stress lines: six single lines, a field, and a field with Test Dist.
seeds_3 = Point([Point(2.5, 2.2, 0), Point(1, 4, 0), Point(3, 7, 0), Point(7.5, 1.5, 0), Point(4, 4.6, 0), Point(6.3, 8.9, 0)])
field_seed_3 = Point(Point(2.6, 3.1, 0))
step_tolerance_3 = Slider(0.2, range=0.01..1)
single_lines_3 = PrincipalStressLinesAlpaca4d(
    AlpacaModel=run_analysis_3.AlpacaModel,
    Step=0,
    Seed=seeds_3,
    StepTolerance=step_tolerance_3,
    SingleLine=True,
    PoissonsRatio=0,
    BendingStressLines=True,
    Separation=0,
    TestDist=0)  # -> StressLinesDir1, StressLinesDir2
separation_3 = Slider(0.8, range=0.1..2)
field_3 = PrincipalStressLinesAlpaca4d(
    AlpacaModel=run_analysis_3.AlpacaModel,
    Step=0,
    Seed=field_seed_3,
    StepTolerance=step_tolerance_3,
    SingleLine=False,
    PoissonsRatio=0,
    BendingStressLines=True,
    Separation=separation_3,
    TestDist=0)  # -> StressLinesDir1, StressLinesDir2
test_dist_2 = Slider(0.4, range=0..1)
field_test_dist = PrincipalStressLinesAlpaca4d(
    AlpacaModel=run_analysis_3.AlpacaModel,
    Step=0,
    Seed=field_seed_3,
    StepTolerance=step_tolerance_3,
    SingleLine=False,
    PoissonsRatio=0,
    BendingStressLines=True,
    Separation=separation_3,
    TestDist=test_dist_2)  # -> StressLinesDir1, StressLinesDir2

# ---- group: C7 - Drawn side by side in Rhino's Top view
medges = MeshEdges(Mesh=_64_x_20_quads)  # -> NakedEdges, InteriorEdges, NonManifoldEdges
places = Vector([Vector(5, 22, -0.05), Vector(17, 22, -0.05)])
mesh_under_each = Move(Geometry=flatten([medges.NakedEdges, medges.InteriorEdges]), Motion=graft(places))  # -> Geometry, Transform
sl1_to_its_place = Move(Geometry=single_lines.StressLinesDir1, Motion=Vector(5, 22, 0))  # -> Geometry, Transform
sl1_to_its_place_2 = Move(Geometry=field.StressLinesDir1, Motion=Vector(17, 22, 0))  # -> Geometry, Transform
sl2_to_its_place = Move(Geometry=single_lines.StressLinesDir2, Motion=Vector(5, 22, 0))  # -> Geometry, Transform
sl2_to_its_place_2 = Move(Geometry=field.StressLinesDir2, Motion=Vector(17, 22, 0))  # -> Geometry, Transform
exact_to_its_place = Move(Geometry=dashed_3.Dashes, Motion=Vector(5, 22, 0.05))  # -> Geometry, Transform
sl1 = ColourSwatch(SwatchColor=RGB(214, 39, 40))
sl2 = ColourSwatch(SwatchColor=RGB(31, 119, 180))
exact_4 = ColourSwatch(SwatchColor=RGB(0, 0, 0))
mesh = ColourSwatch(SwatchColor=RGB(205, 205, 205))
sl1_2 = CustomPreview(Geometry=flatten([sl1_to_its_place.Geometry, sl1_to_its_place_2.Geometry]), Material=sl1)
sl2_2 = CustomPreview(Geometry=flatten([sl2_to_its_place.Geometry, sl2_to_its_place_2.Geometry]), Material=sl2)
exact_5 = CustomPreview(Geometry=flatten(exact_to_its_place.Geometry), Material=exact_4)
mesh_2 = CustomPreview(Geometry=flatten(mesh_under_each.Geometry), Material=mesh)
labels = TextTag3D(
    Location=[PlaneXY(0, 16.2, 0), PlaneXY(12, 16.2, 0)],
    Text=["Plate with a hole: single lines (dashed: exact)", "Plate with a hole: field from one seed, Test Dist."],
    Size=0.35,
    Colour=RGB(0, 0, 0),
    Justification=7)

# ---- group: A7 - Drawn side by side in Rhino's Top view
medges_2 = MeshEdges(Mesh=_32_x_8_quads.Mesh)  # -> NakedEdges, InteriorEdges, NonManifoldEdges
places_2 = Vector([Vector(0, 0, -0.05), Vector(10, 0, -0.05)])
mesh_under_each_2 = Move(Geometry=flatten([medges_2.NakedEdges, medges_2.InteriorEdges]), Motion=graft(places_2))  # -> Geometry, Transform
sl1_to_its_place_3 = Move(Geometry=single_lines_2.StressLinesDir1, Motion=Vector(0, 0, 0))  # -> Geometry, Transform
sl1_to_its_place_4 = Move(Geometry=field_2.StressLinesDir1, Motion=Vector(10, 0, 0))  # -> Geometry, Transform
sl2_to_its_place_3 = Move(Geometry=single_lines_2.StressLinesDir2, Motion=Vector(0, 0, 0))  # -> Geometry, Transform
sl2_to_its_place_4 = Move(Geometry=field_2.StressLinesDir2, Motion=Vector(10, 0, 0))  # -> Geometry, Transform
exact_to_its_place_2 = Move(Geometry=dashed.Dashes, Motion=Vector(0, 0, 0.05))  # -> Geometry, Transform
sl1_3 = ColourSwatch(SwatchColor=RGB(214, 39, 40))
sl2_3 = ColourSwatch(SwatchColor=RGB(31, 119, 180))
exact_6 = ColourSwatch(SwatchColor=RGB(0, 0, 0))
mesh_3 = ColourSwatch(SwatchColor=RGB(205, 205, 205))
sl1_4 = CustomPreview(Geometry=flatten([sl1_to_its_place_3.Geometry, sl1_to_its_place_4.Geometry]), Material=sl1_3)
sl2_4 = CustomPreview(Geometry=flatten([sl2_to_its_place_3.Geometry, sl2_to_its_place_4.Geometry]), Material=sl2_3)
exact_7 = CustomPreview(Geometry=flatten(exact_to_its_place_2.Geometry), Material=exact_6)
mesh_4 = CustomPreview(Geometry=flatten(mesh_under_each_2.Geometry), Material=mesh_3)
labels_2 = TextTag3D(
    Location=[PlaneXY(0, -1.6, 0), PlaneXY(10, -1.6, 0)],
    Text=["Cantilever: single lines (dashed: exact)", "Cantilever: field from one seed"],
    Size=0.3,
    Colour=RGB(0, 0, 0),
    Justification=7)

# ---- group: B7 - Drawn side by side in Rhino's Top view
medges_3 = MeshEdges(Mesh=slab)  # -> NakedEdges, InteriorEdges, NonManifoldEdges
places_3 = Vector([Vector(0, 4, -0.05), Vector(12, 4, -0.05), Vector(24, 4, -0.05)])
mesh_under_each_3 = Move(Geometry=flatten([medges_3.NakedEdges, medges_3.InteriorEdges]), Motion=graft(places_3))  # -> Geometry, Transform
sl1_to_its_place_5 = Move(Geometry=single_lines_3.StressLinesDir1, Motion=Vector(0, 4, 0))  # -> Geometry, Transform
sl1_to_its_place_6 = Move(Geometry=field_3.StressLinesDir1, Motion=Vector(12, 4, 0))  # -> Geometry, Transform
sl1_to_its_place_7 = Move(Geometry=field_test_dist.StressLinesDir1, Motion=Vector(24, 4, 0))  # -> Geometry, Transform
sl2_to_its_place_5 = Move(Geometry=single_lines_3.StressLinesDir2, Motion=Vector(0, 4, 0))  # -> Geometry, Transform
sl2_to_its_place_6 = Move(Geometry=field_3.StressLinesDir2, Motion=Vector(12, 4, 0))  # -> Geometry, Transform
sl2_to_its_place_7 = Move(Geometry=field_test_dist.StressLinesDir2, Motion=Vector(24, 4, 0))  # -> Geometry, Transform
exact_to_its_place_3 = Move(Geometry=dashed_2.Dashes, Motion=Vector(0, 4, 0.05))  # -> Geometry, Transform
sl1_5 = ColourSwatch(SwatchColor=RGB(214, 39, 40))
sl2_5 = ColourSwatch(SwatchColor=RGB(31, 119, 180))
exact_8 = ColourSwatch(SwatchColor=RGB(0, 0, 0))
mesh_5 = ColourSwatch(SwatchColor=RGB(205, 205, 205))
sl1_6 = CustomPreview(
    Geometry=flatten([sl1_to_its_place_5.Geometry, sl1_to_its_place_6.Geometry, sl1_to_its_place_7.Geometry]),
    Material=sl1_5)
sl2_6 = CustomPreview(
    Geometry=flatten([sl2_to_its_place_5.Geometry, sl2_to_its_place_6.Geometry, sl2_to_its_place_7.Geometry]),
    Material=sl2_5)
exact_9 = CustomPreview(Geometry=flatten(exact_to_its_place_3.Geometry), Material=exact_8)
mesh_6 = CustomPreview(Geometry=flatten(mesh_under_each_3.Geometry), Material=mesh_5)
labels_3 = TextTag3D(
    Location=[PlaneXY(0, 3.2, 0), PlaneXY(12, 3.2, 0), PlaneXY(24, 3.2, 0)],
    Text=["Slab, bending: single lines (dashed: exact)", "Slab, bending: field from one seed", "Slab, bending: field, Test Dist."],
    Size=0.35,
    Colour=RGB(0, 0, 0),
    Justification=7)
