# Grasshopper definition ColumnDomain.gh (Grasshopper 1.0.7)
# plug-ins: Galapagos, Alpaca4d

# ---- group: 1 - Design materials
# Column domain: Column domain - the Alpaca4d Interaction Domain example.
# 
# A 400 x 600 column of C30/37, 4 phi 25 at the corners and 2 phi 20 at mid-height, in design values: Concrete01 with fcu = fco is Eurocode 2's parabola-rectangle, Steel01 with b = 0 is elastic-perfectly plastic. Interaction Domain holds the concrete to 3.5 per mille (2 per mille at point C in full compression) and the bars to eud = 1 %.
# 
# Axial resistance: -5117 kN in compression (fcd Ac + 400 MPa As), 1127 kN in tension.
# 
# Domain Check, N held:
#   N -2000, My 250, Mz 80: SF 1.59
#   N -1000, My 400, Mz 150: SF 0.89 - it fails
#   N -3000, My 100, Mz 60: SF 2.74
# Switch Method to Proportional: 1.42, 0.88, 1.44 - the third is axial-dominated, and N grows with the moments.
# 
# In Rhino: the section at the origin, then Domain 3D, the N-M diagram (turn Angle) and the My-Mz diagrams at the checks' N, with each check in black and where it meets the boundary in red.
c30_37_design = Concrete01Alpaca4d(MaterialName="C30/37 design", Fco=-17000, Fcu=-17000, EpsilonCo=-0.002, EpsilonCu=-0.0035, MinMax=False)
b500_design = Steel01Alpaca4d(MaterialName="B500 design", Fy=434782.6087, E0=200000000, B=0)

# ---- group: 2 - Concrete and bars
outline = Rectangle3Pt(PointA=Point(-0.2, -0.3, 0), PointB=Point(0.2, -0.3, 0), PointC=Point(0.2, 0.3, 0))  # -> Rectangle, Length
fibres = MeshPlane(Boundary=outline.Rectangle, WidthCount=16, HeightCount=24)  # -> Mesh, Area
concrete = PatchAlpaca4d(Mesh=fibres.Mesh, Material=c30_37_design)
bars = FiberPointAlpaca4d(
    Point=[Point(-0.15, -0.25, 0), Point(0.15, -0.25, 0), Point(-0.15, 0.25, 0), Point(0.15, 0.25, 0), Point(-0.15, 0, 0), Point(0.15, 0, 0)],
    AreaFiber=[0.0004908738521, 0.0004908738521, 0.0004908738521, 0.0004908738521, 0.0003141592654, 0.0003141592654],
    Material=b500_design)

# ---- group: 3 - Section and domain
fibersection = FiberSectionAlpaca4d(PointFiber=bars, Patch=concrete, GJ=100000000)
interaction_domain = InteractionDomainAlpaca4d(FiberSection=fibersection, Εud=0.01, Levels=20, Points=72)  # -> Domain, N, My, Mz, Nc, Nt, Centroid, Materials, Log
materials = Panel(interaction_domain.Materials)

# ---- group: 4 - Checks
method = ValueList({"Constant N", "Proportional"}, selected="Constant N")
domain_check = DomainCheckAlpaca4d(Domain=interaction_domain.Domain, N=[-2000, -1000, -3000], My=[250, 400, 100], Mz=[80, 150, 60], Method=method)  # -> SF, Utilisation, NRd, MyRd, MzRd, OK, Checks, Notes
sf = Panel(domain_check.SF)
ok = Panel(domain_check.OK)

# ---- group: 5 - Views
domain_3d_at_origin = ConstructPoint(XCoordinate=2, YCoordinate=0, ZCoordinate=0)
n_m_at_origin = ConstructPoint(XCoordinate=8, YCoordinate=0, ZCoordinate=0)
my_mz_at_origin = ConstructPoint(XCoordinate=14, YCoordinate=0, ZCoordinate=0)
domain_3d_at = XYPlane(Origin=domain_3d_at_origin)
n_m_at = XYPlane(Origin=n_m_at_origin)
angle_deg = Slider(0, range=0..90)
my_mz_at = XYPlane(Origin=my_mz_at_origin)
domain_3d = Domain3DAlpaca4d(Domain=interaction_domain.Domain, Plane=domain_3d_at, Size=4, Checks=domain_check.Checks)  # -> Mesh, Levels, Meridians, Axes, MomentScale, AxialScale
n_m_diagram_alpaca4d = NMDiagramAlpaca4d(Domain=interaction_domain.Domain, Angle=angle_deg, Plane=n_m_at, Size=4, Checks=domain_check.Checks)  # -> Curve, Axes, M, N, MomentScale, AxialScale
my_mz_diagram_alpaca4d = MyMzDiagramAlpaca4d(Domain=interaction_domain.Domain, N=[-2000, -1000, -3000], Plane=my_mz_at, Size=4, Checks=domain_check.Checks)  # -> Curves, Axes, My, Mz, Scale; "My-Mz"
