# Grasshopper definition CurvedBeamOptimiser.gh (Grasshopper 1.0.8)
# plug-ins: Alpaca4d

# ---- group: 1 - The beam
starting_section = ValueList({"IPE300", "HEA500", "HEB300"}, selected="HEA500")
# Section Optimiser: Curved beam - a Section Optimiser example.
# 
# A 12 m beam curves up and down in a vertical plane. It is built in at its start, held up at 15% and 33% of the way along, and free beyond: a continuous beam ending in a long cantilever, with 50 kN hanging near its far end and its own weight. It is cut into 30 elements, IPE300 in S355 to begin with.
# 
# 6 - Each element on its own. No design group: each element goes to the first section of the family it starts in - the IPEs for an IPE300 - that keeps it at or below MaxUtilisation, smallest area first. The beam grows over the third support, where the cantilever's moment is largest, and thins out towards the load and the built-in start. Switch the starting section to HEA300 and it stays among the HEAs.
# 
# 7 - One section for the whole beam: a design group over every element, from the list of IPEs in the panel, tried in the order it gives them.
# 
# Reshape the curve in the two panels of 2, and move the supports and the load with their sliders: each lands on the node nearest the fraction given. The top flange is held sideways every 0.5 m, wired into LengthLT in the Design menu; sized element by element, an unrestrained beam is only a rough guide, as lateral-torsional buckling belongs to the whole member.
length_m = Slider(12, range=4..30)
rise_m = Slider(2, range=0..5)
number_of_elements = Slider(30, range=4..80)
grade = ValueList({"S235", "S275", "S355"}, selected="S355")
second_support_at = Slider(0.11, range=0.05..0.95)
third_support_at = Slider(0.84, range=0.05..0.95)
load_at = Slider(0.69, range=0.05..1)
load_kn = Slider(50, range=0..200)

# ---- group: 2 - Geometry
along_of_the_length = Panel("""0
0.33
0.6
0.88
1""")
height_of_the_rise = Panel("""0
0.65
0.45
0.45
1""")
X = Expression(a=along_of_the_length, L=length_m, Expression="a*L")
Z = Expression(h=height_of_the_rise, R=rise_m, Expression="h*R")
through = ConstructPoint(XCoordinate=X, YCoordinate=Z, ZCoordinate=0)
beam = Interpolate(Vertices=through, Degree=3, Periodic=False, KnotStyle=1)  # -> Curve, Length, Domain
nodes = DivideCurve(Curve=beam.Curve, Count=number_of_elements, Kinks=False)  # -> Points, Tangents, Parameters
pline = PolyLine(Vertices=nodes.Points, Closed=False)
elements = Explode(Curve=pline, Recursive=True)  # -> Segments, Vertices

# ---- group: 3 - Member
material_library_elastic = MaterialLibraryElasticAlpaca4d(
    MaterialName=grade,
    MaterialPresetElastic_Grade="S355",
    MaterialPresetElastic_Model="Uniaxial",
    MaterialPresetElastic_Type="Steel",
    menu=[dropdown(0), dropdown(3), dropdown(0)])
elementid = Panel("Beam")
starting_section_2 = SteelSectionLibraryAlpaca4d(
    SectionName=starting_section,
    Material=material_library_elastic,
    SectionLibrary_Family="I",
    SectionLibrary_Section="HEA500",
    menu=[dropdown(0), dropdown(18)])
forcebeamcolumn = ForceBeamColumnAlpaca4d(
    Line=flatten(elements.Segments),
    Section=starting_section_2,
    Colour=RGB(1, 30, 254),
    ElementId=elementid,
    mode="ForceBeamColumn (Alpaca4d)")

# ----
nd = ND(E=210000000, G=80760000, Ν=0.3, Rho=7850, mode="ElasticIsotropic (Alpaca4d)")
plate_fiber_section_alpaca4d = PlateFiberSectionAlpaca4d(Thickness=0.15)
layered_shell_section_alpaca4d = LayeredShellSectionAlpaca4d()
circlecs_alpaca4d = CircleCSAlpaca4d(Diameter=0.15, Thickness=0.01)
moment_curvature_diagram_alpaca4d = MomentCurvatureDiagramAlpaca4d(Size=10)  # -> Curves, Axes, CurvatureScale, MomentScale
interaction_domain_alpaca4d = InteractionDomainAlpaca4d(Εud=0.01, Levels=20, Points=72)  # -> Domain, N, My, Mz, Nc, Nt, Centroid, Materials, Log
domain_check_alpaca4d = DomainCheckAlpaca4d(N=0, My=0, Mz=0, Method="Constant N")  # -> SF, Utilisation, NRd, MyRd, MzRd, OK, Checks, Notes
domain_3d_alpaca4d = Domain3DAlpaca4d(Size=10)  # -> Mesh, Levels, Meridians, Axes, MomentScale, AxialScale
n_m_diagram_alpaca4d = NMDiagramAlpaca4d(Angle=0, Size=10)  # -> Curve, Axes, M, N, MomentScale, AxialScale
my_mz_diagram_alpaca4d = MyMzDiagramAlpaca4d(N=0, Size=10)  # -> Curves, Axes, My, Mz, Scale

# ---- group: 4 - Supports and loads
held = BooleanToggle(True)
free = BooleanToggle(False)
support_nodes = Expression(t=[second_support_at, third_support_at], n=number_of_elements, Expression="Round(t*n)")
load_node = Expression(t=load_at, n=number_of_elements, Expression="Round(t*n)")
start = ListItem(List=nodes.Points, Index=0, Wrap=True)
downwards = Expression(P=load_kn, Expression="-P")
supported = ListItem(List=nodes.Points, Index=support_nodes, Wrap=True)
loaded = ListItem(List=nodes.Points, Index=load_node, Wrap=True)
down = UnitZ(Factor=downwards)
held_up = SupportAlpaca4d(Position=supported, Tx=free, Ty=free, Tz=held, Rx=free, Ry=free, Rz=free)
built_in = SupportAlpaca4d(Position=start, Tx=held, Ty=held, Tz=held, Rx=held, Ry=held, Rz=held)
self_weight = GravityLoadAlpaca4d(Factor=1)

# ----
vector_xyz = VectorXYZ(XComponent=downwards, YComponent=0, ZComponent=downwards)  # -> Vector, Length

# ---- group: 4 - Supports and loads (continued)
load = PointLoadAlpaca4d(Point=loaded, Force=vector_xyz.Vector, Moment=Vector(0, 0, 0))
load_pattern = LoadPatternAlpaca4d(Loads=[load, self_weight], Factor=1, mode="PlainPattern (Alpaca4d)")

# ---- group: 5 - Model
assemble_model = AssembleModelAlpaca4d(Elements=forcebeamcolumn, Supports=[built_in, held_up], LoadPatterns=flatten(load_pattern), Tolerance=0.01)  # -> AlpacaModel, Mass

# ---- group: 6 - Each element on its own, within its family
lateral_restraint_every_m = Slider(0.5, range=0.1..30)
maxutilisation = Slider(1, range=0.5..1)
each_element = SectionOptimiserAlpaca4d(
    AlpacaModel=assemble_model.AlpacaModel,
    MaxUtilisation=maxutilisation,
    Iterations="20",
    Fabrication="Rolled",
    ΓM0=1,
    ΓM1=1,
    LengthLT=lateral_restraint_every_m,
    System="BandSPD",
    Algorithm="Newton")  # -> AlpacaModel, Section, Utilisation, Element, Mass, Converged, Governing, Group, History, Log
section = Panel(each_element.Section)
governing = Panel(each_element.Governing)
utilisation = Panel(each_element.History)
modelview = ModelViewAlpaca4d(AlpacaModel=each_element.AlpacaModel)
mass = Panel(each_element.Mass)

# ----
view_results_wip_alpaca4d = ViewResults_WIPAlpaca4d(AlpacaModel=modelview, Step=0, ResultMenuOrder=1, ResultUnits=1)  # -> Info, Values, Colors
