# Grasshopper definition CompositeSections.gh (Grasshopper 1.0.7)
# plug-ins: Galapagos, Kangaroo2 Components, Alpaca4d

# ---- group: 1 - Laws: concrete, structural steel, bars and a carbon fibre laminate
slab_concrete02 = ConcreteAlpaca4d(
    MaterialName="Slab, Concrete02",
    Fpc=-38000,
    EpsC0=-0.002,
    Fpcu=-30400,
    EpsU=-0.0035,
    Lambda=0.2,
    Ft=3000,
    Ets=2000000,
    MinMax=False,
    mode="Concrete02")
hea_steel02 = SteelAlpaca4d(MaterialName="HEA, Steel02", Fy=355000, E0=210000000, B=0.01, R0=18, CR1=0.925, CR2=0.15, mode="Steel02")
slab_bars = SteelAlpaca4d(
    MaterialName="Slab bars",
    Fy=500000,
    Fu=540000,
    Es=200000000,
    Esh=2000000,
    Esh_2=0.008,
    Eult=0.075,
    MinMax=False,
    mode="ReinforcingSteel")
encasing_concrete04 = ConcreteAlpaca4d(
    MaterialName="Encasing, Concrete04",
    Fc=-38000,
    EpsC=-0.002,
    EpsCu=-0.0035,
    Ec=38000000,
    Fct=3000,
    Et=0.0001,
    MinMax=False,
    mode="Concrete04")
hea_steel02_2 = SteelAlpaca4d(MaterialName="HEA, Steel02", Fy=355000, E0=210000000, B=0.01, R0=18, CR1=0.925, CR2=0.15, mode="Steel02")
corner_bars = SteelAlpaca4d(
    MaterialName="Corner bars",
    Fy=500000,
    Fu=540000,
    Es=200000000,
    Esh=2000000,
    Esh_2=0.008,
    Eult=0.075,
    MinMax=False,
    mode="ReinforcingSteel")
rc_beam_with_cfrp_concrete = ConcreteAlpaca4d(
    MaterialName="RC beam with CFRP concrete",
    Fpc=-38000,
    EpsC0=-0.002,
    Fpcu=-30400,
    EpsU=-0.0035,
    Lambda=0.2,
    Ft=3000,
    Ets=2000000,
    MinMax=False,
    mode="Concrete02")
rc_beam_with_cfrp_bars = SteelAlpaca4d(
    MaterialName="RC beam with CFRP bars",
    Fy=500000,
    Fu=540000,
    Es=200000000,
    Esh=2000000,
    Esh_2=0.008,
    Eult=0.075,
    MinMax=False,
    mode="ReinforcingSteel")
cfrp_laminate = OtherLawsAlpaca4d(MaterialName="CFRP laminate", E=160000000, RuptureTension=0.017, mode="Elastic")
rc_beam_concrete = ConcreteAlpaca4d(
    MaterialName="RC beam concrete",
    Fpc=-38000,
    EpsC0=-0.002,
    Fpcu=-30400,
    EpsU=-0.0035,
    Lambda=0.2,
    Ft=3000,
    Ets=2000000,
    MinMax=False,
    mode="Concrete02")
rc_beam_bars = SteelAlpaca4d(
    MaterialName="RC beam bars",
    Fy=500000,
    Fu=540000,
    Es=200000000,
    Esh=2000000,
    Esh_2=0.008,
    Eult=0.075,
    MinMax=False,
    mode="ReinforcingSteel")

# ---- group: 2 - Four sections in fibres: composite beam, encased column, RC beam with and without CFRP
hea_240_top_flange = Rectangle3Pt(PointA=Point(-0.12, 0.103, 0), PointB=Point(0.12, 0.103, 0), PointC=Point(0.12, 0.115, 0))  # -> Rectangle, Length
hea_240_bottom_flange = Rectangle3Pt(PointA=Point(-0.12, -0.115, 0), PointB=Point(0.12, -0.115, 0), PointC=Point(0.12, -0.103, 0))  # -> Rectangle, Length
hea_240_web = Rectangle3Pt(PointA=Point(-0.00375, -0.103, 0), PointB=Point(0.00375, -0.103, 0), PointC=Point(0.00375, 0.103, 0))  # -> Rectangle, Length
slab_1200_x_120 = Rectangle3Pt(PointA=Point(-0.6, 0.115, 0), PointB=Point(0.6, 0.115, 0), PointC=Point(0.6, 0.235, 0))  # -> Rectangle, Length
hea_200_top_flange = Rectangle3Pt(PointA=Point(-0.1, 0.085, 0), PointB=Point(0.1, 0.085, 0), PointC=Point(0.1, 0.095, 0))  # -> Rectangle, Length
hea_200_bottom_flange = Rectangle3Pt(PointA=Point(-0.1, -0.095, 0), PointB=Point(0.1, -0.095, 0), PointC=Point(0.1, -0.085, 0))  # -> Rectangle, Length
hea_200_web = Rectangle3Pt(PointA=Point(-0.00325, -0.085, 0), PointB=Point(0.00325, -0.085, 0), PointC=Point(0.00325, 0.085, 0))  # -> Rectangle, Length
encasing_cover_above = Rectangle3Pt(PointA=Point(-0.1, 0.095, 0), PointB=Point(0.1, 0.095, 0), PointC=Point(0.1, 0.2, 0))  # -> Rectangle, Length
encasing_cover_below = Rectangle3Pt(PointA=Point(-0.1, -0.2, 0), PointB=Point(0.1, -0.2, 0), PointC=Point(0.1, -0.095, 0))  # -> Rectangle, Length
encasing_left_of_the_flanges = Rectangle3Pt(PointA=Point(-0.2, -0.2, 0), PointB=Point(-0.1, -0.2, 0), PointC=Point(-0.1, 0.2, 0))  # -> Rectangle, Length
encasing_right_of_the_flanges = Rectangle3Pt(PointA=Point(0.1, -0.2, 0), PointB=Point(0.2, -0.2, 0), PointC=Point(0.2, 0.2, 0))  # -> Rectangle, Length
encasing_left_chamber = Rectangle3Pt(PointA=Point(-0.1, -0.085, 0), PointB=Point(-0.00325, -0.085, 0), PointC=Point(-0.00325, 0.085, 0))  # -> Rectangle, Length
encasing_right_chamber = Rectangle3Pt(PointA=Point(0.00325, -0.085, 0), PointB=Point(0.1, -0.085, 0), PointC=Point(0.1, 0.085, 0))  # -> Rectangle, Length
rc_beam_with_cfrp_concrete_2 = Rectangle3Pt(PointA=Point(-0.15, -0.25, 0), PointB=Point(0.15, -0.25, 0), PointC=Point(0.15, 0.25, 0))  # -> Rectangle, Length
laminate_below = Rectangle3Pt(PointA=Point(-0.15, -0.253, 0), PointB=Point(0.15, -0.253, 0), PointC=Point(0.15, -0.25, 0))  # -> Rectangle, Length
laminate_above = Rectangle3Pt(PointA=Point(-0.15, 0.25, 0), PointB=Point(0.15, 0.25, 0), PointC=Point(0.15, 0.253, 0))  # -> Rectangle, Length
rc_beam_concrete_2 = Rectangle3Pt(PointA=Point(-0.15, -0.25, 0), PointB=Point(0.15, -0.25, 0), PointC=Point(0.15, 0.25, 0))  # -> Rectangle, Length
# Composite sections: Composite sections - fibres of different materials in one section.
# 
# 1 Composite beam: a HEA 240 in S355 under a 1200 x 120 slab of Concrete02 with 8 phi 12 bars, bent so that the slab is in compression, full interaction.
# 2 Encased column: a HEA 200 in a 400 x 400 section of Concrete04, 4 phi 20 corner bars, 1500 kN of compression; concrete between the flanges and all round them, the steel's own fibres left out of it.
# 3 A 300 x 500 RC beam with a 3 mm carbon fibre laminate along its bottom and its top (Other Laws, Elastic: E 160 GPa, ruptures at 1.7 %), and the same beam without them in the last row.
# 
# Moment Curvature draws every curve on one diagram, with what failed first in each. The laminate stiffens and strengthens the beam, and the section ends when it ruptures or the concrete crushes.
# 
# Try: the laminate's thickness, its rupture strain; the slab's width; Axial in the column.
hea_240_top_flange_fibres = MeshPlane(Boundary=hea_240_top_flange.Rectangle, WidthCount=19, HeightCount=2)  # -> Mesh, Area
hea_240_bottom_flange_fibres = MeshPlane(Boundary=hea_240_bottom_flange.Rectangle, WidthCount=19, HeightCount=2)  # -> Mesh, Area
hea_240_web_fibres = MeshPlane(Boundary=hea_240_web.Rectangle, WidthCount=2, HeightCount=16)  # -> Mesh, Area
slab_1200_x_120_fibres = MeshPlane(Boundary=slab_1200_x_120.Rectangle, WidthCount=30, HeightCount=6)  # -> Mesh, Area
hea_200_top_flange_fibres = MeshPlane(Boundary=hea_200_top_flange.Rectangle, WidthCount=16, HeightCount=2)  # -> Mesh, Area
hea_200_bottom_flange_fibres = MeshPlane(Boundary=hea_200_bottom_flange.Rectangle, WidthCount=16, HeightCount=2)  # -> Mesh, Area
hea_200_web_fibres = MeshPlane(Boundary=hea_200_web.Rectangle, WidthCount=2, HeightCount=14)  # -> Mesh, Area
encasing_cover_above_fibres = MeshPlane(Boundary=encasing_cover_above.Rectangle, WidthCount=10, HeightCount=5)  # -> Mesh, Area
encasing_cover_below_fibres = MeshPlane(Boundary=encasing_cover_below.Rectangle, WidthCount=10, HeightCount=5)  # -> Mesh, Area
encasing_left_of_the_flanges_fibres = MeshPlane(Boundary=encasing_left_of_the_flanges.Rectangle, WidthCount=5, HeightCount=20)  # -> Mesh, Area
encasing_right_of_the_flanges_fibres = MeshPlane(Boundary=encasing_right_of_the_flanges.Rectangle, WidthCount=5, HeightCount=20)  # -> Mesh, Area
encasing_left_chamber_fibres = MeshPlane(Boundary=encasing_left_chamber.Rectangle, WidthCount=5, HeightCount=9)  # -> Mesh, Area
encasing_right_chamber_fibres = MeshPlane(Boundary=encasing_right_chamber.Rectangle, WidthCount=5, HeightCount=9)  # -> Mesh, Area
rc_beam_with_cfrp_concrete_fibres = MeshPlane(Boundary=rc_beam_with_cfrp_concrete_2.Rectangle, WidthCount=12, HeightCount=20)  # -> Mesh, Area
laminate_below_fibres = MeshPlane(Boundary=laminate_below.Rectangle, WidthCount=12, HeightCount=1)  # -> Mesh, Area
laminate_above_fibres = MeshPlane(Boundary=laminate_above.Rectangle, WidthCount=12, HeightCount=1)  # -> Mesh, Area
rc_beam_concrete_fibres = MeshPlane(Boundary=rc_beam_concrete_2.Rectangle, WidthCount=12, HeightCount=20)  # -> Mesh, Area
composite_beam_patch_1 = PatchAlpaca4d(Mesh=hea_240_top_flange_fibres.Mesh, Material=hea_steel02)
composite_beam_patch_2 = PatchAlpaca4d(Mesh=hea_240_bottom_flange_fibres.Mesh, Material=hea_steel02)
composite_beam_patch_3 = PatchAlpaca4d(Mesh=hea_240_web_fibres.Mesh, Material=hea_steel02)
composite_beam_patch_4 = PatchAlpaca4d(Mesh=slab_1200_x_120_fibres.Mesh, Material=slab_concrete02)
composite_beam_bars_1 = FiberPointAlpaca4d(
    Point=[Point(-0.55, 0.155, 0), Point(-0.3928571429, 0.155, 0), Point(-0.2357142857, 0.155, 0), Point(-0.07857142857, 0.155, 0), Point(0.07857142857, 0.155, 0), Point(0.2357142857, 0.155, 0), Point(0.3928571429, 0.155, 0), Point(0.55, 0.155, 0)],
    AreaFiber=[0.0001130973355, 0.0001130973355, 0.0001130973355, 0.0001130973355, 0.0001130973355, 0.0001130973355, 0.0001130973355, 0.0001130973355],
    Material=slab_bars)
encased_column_patch_1 = PatchAlpaca4d(Mesh=hea_200_top_flange_fibres.Mesh, Material=hea_steel02_2)
encased_column_patch_2 = PatchAlpaca4d(Mesh=hea_200_bottom_flange_fibres.Mesh, Material=hea_steel02_2)
encased_column_patch_3 = PatchAlpaca4d(Mesh=hea_200_web_fibres.Mesh, Material=hea_steel02_2)
encased_column_patch_4 = PatchAlpaca4d(Mesh=encasing_cover_above_fibres.Mesh, Material=encasing_concrete04)
encased_column_patch_5 = PatchAlpaca4d(Mesh=encasing_cover_below_fibres.Mesh, Material=encasing_concrete04)
encased_column_patch_6 = PatchAlpaca4d(Mesh=encasing_left_of_the_flanges_fibres.Mesh, Material=encasing_concrete04)
encased_column_patch_7 = PatchAlpaca4d(Mesh=encasing_right_of_the_flanges_fibres.Mesh, Material=encasing_concrete04)
encased_column_patch_8 = PatchAlpaca4d(Mesh=encasing_left_chamber_fibres.Mesh, Material=encasing_concrete04)
encased_column_patch_9 = PatchAlpaca4d(Mesh=encasing_right_chamber_fibres.Mesh, Material=encasing_concrete04)
encased_column_bars_1 = FiberPointAlpaca4d(
    Point=[Point(-0.16, -0.16, 0), Point(0.16, -0.16, 0), Point(-0.16, 0.16, 0), Point(0.16, 0.16, 0)],
    AreaFiber=[0.0003141592654, 0.0003141592654, 0.0003141592654, 0.0003141592654],
    Material=corner_bars)
rc_beam_with_cfrp_patch_1 = PatchAlpaca4d(Mesh=rc_beam_with_cfrp_concrete_fibres.Mesh, Material=rc_beam_with_cfrp_concrete)
rc_beam_with_cfrp_patch_2 = PatchAlpaca4d(Mesh=laminate_below_fibres.Mesh, Material=cfrp_laminate)
rc_beam_with_cfrp_patch_3 = PatchAlpaca4d(Mesh=laminate_above_fibres.Mesh, Material=cfrp_laminate)
rc_beam_with_cfrp_bars_1 = FiberPointAlpaca4d(
    Point=[Point(-0.1, -0.2, 0), Point(0, -0.2, 0), Point(0.1, -0.2, 0)],
    AreaFiber=[0.0003141592654, 0.0003141592654, 0.0003141592654],
    Material=rc_beam_with_cfrp_bars)
rc_beam_with_cfrp_bars_2 = FiberPointAlpaca4d(
    Point=[Point(-0.1, 0.2, 0), Point(0.1, 0.2, 0)],
    AreaFiber=[0.0002010619298, 0.0002010619298],
    Material=rc_beam_with_cfrp_bars)
rc_beam_patch_1 = PatchAlpaca4d(Mesh=rc_beam_concrete_fibres.Mesh, Material=rc_beam_concrete)
rc_beam_bars_1 = FiberPointAlpaca4d(
    Point=[Point(-0.1, -0.2, 0), Point(0, -0.2, 0), Point(0.1, -0.2, 0)],
    AreaFiber=[0.0003141592654, 0.0003141592654, 0.0003141592654],
    Material=rc_beam_bars)
rc_beam_bars_2 = FiberPointAlpaca4d(Point=[Point(-0.1, 0.2, 0), Point(0.1, 0.2, 0)], AreaFiber=[0.0002010619298, 0.0002010619298], Material=rc_beam_bars)
composite_beam = FiberSectionAlpaca4d(
    PointFiber=composite_beam_bars_1,
    Patch=[composite_beam_patch_1, composite_beam_patch_2, composite_beam_patch_3, composite_beam_patch_4],
    GJ=100000000)
encased_column = FiberSectionAlpaca4d(
    PointFiber=encased_column_bars_1,
    Patch=[encased_column_patch_1, encased_column_patch_2, encased_column_patch_3, encased_column_patch_4, encased_column_patch_5, encased_column_patch_6, encased_column_patch_7, encased_column_patch_8, encased_column_patch_9],
    GJ=100000000)
rc_beam_with_cfrp = FiberSectionAlpaca4d(
    PointFiber=[rc_beam_with_cfrp_bars_1, rc_beam_with_cfrp_bars_2],
    Patch=[rc_beam_with_cfrp_patch_1, rc_beam_with_cfrp_patch_2, rc_beam_with_cfrp_patch_3],
    GJ=100000000)
rc_beam = FiberSectionAlpaca4d(PointFiber=[rc_beam_bars_1, rc_beam_bars_2], Patch=rc_beam_patch_1, GJ=100000000)

# ---- group: 3 - Moment Curvature and the domain of each
composite_beam_2 = MomentCurvatureAlpaca4d(FiberSection=composite_beam, Axial=0, Direction=180, NumIncr=200, Εud=0.05, StopAtUltimate=True)  # -> Log, N, My, Mz, Ε, Κy, Κz, FiberStressStrain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
encased_column_2 = MomentCurvatureAlpaca4d(FiberSection=encased_column, Axial=-1500, Direction=0, NumIncr=200, Εud=0.05, StopAtUltimate=True)  # -> Log, N, My, Mz, Ε, Κy, Κz, FiberStressStrain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
rc_beam_with_cfrp_2 = MomentCurvatureAlpaca4d(FiberSection=rc_beam_with_cfrp, Axial=0, Direction=180, NumIncr=200, Εud=0.05, StopAtUltimate=True)  # -> Log, N, My, Mz, Ε, Κy, Κz, FiberStressStrain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
rc_beam_2 = MomentCurvatureAlpaca4d(FiberSection=rc_beam, Axial=0, Direction=180, NumIncr=200, Εud=0.05, StopAtUltimate=True)  # -> Log, N, My, Mz, Ε, Κy, Κz, FiberStressStrain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
composite_beam_3 = InteractionDomainAlpaca4d(FiberSection=composite_beam, Εud=0.05, Levels=20, Points=72)  # -> Domain, N, My, Mz, Nc, Nt, Centroid, Materials, Log
encased_column_3 = InteractionDomainAlpaca4d(FiberSection=encased_column, Εud=0.05, Levels=20, Points=72)  # -> Domain, N, My, Mz, Nc, Nt, Centroid, Materials, Log
rc_beam_with_cfrp_3 = InteractionDomainAlpaca4d(FiberSection=rc_beam_with_cfrp, Εud=0.05, Levels=20, Points=72)  # -> Domain, N, My, Mz, Nc, Nt, Centroid, Materials, Log
rc_beam_3 = InteractionDomainAlpaca4d(FiberSection=rc_beam, Εud=0.05, Levels=20, Points=72)  # -> Domain, N, My, Mz, Nc, Nt, Centroid, Materials, Log

# ---- group: 4 - Curves on one diagram, N-M diagrams, ultimate moments and what failed
composite_beam_ultimatemoment = Panel(composite_beam_2.UltimateMoment)
composite_beam_ductility = Panel(composite_beam_2.Ductility)
composite_beam_failure = Panel(composite_beam_2.Failure)
encased_column_ultimatemoment = Panel(encased_column_2.UltimateMoment)
encased_column_ductility = Panel(encased_column_2.Ductility)
encased_column_failure = Panel(encased_column_2.Failure)
rc_beam_with_cfrp_ultimatemoment = Panel(rc_beam_with_cfrp_2.UltimateMoment)
rc_beam_with_cfrp_ductility = Panel(rc_beam_with_cfrp_2.Ductility)
rc_beam_with_cfrp_failure = Panel(rc_beam_with_cfrp_2.Failure)
rc_beam_ultimatemoment = Panel(rc_beam_2.UltimateMoment)
rc_beam_ductility = Panel(rc_beam_2.Ductility)
rc_beam_failure = Panel(rc_beam_2.Failure)
n_m_at = ConstructPoint(XCoordinate=3, YCoordinate=0, ZCoordinate=0)
n_m_plane = XYPlane(Origin=n_m_at)
composite_beam_4 = NMDiagramAlpaca4d(Domain=composite_beam_3.Domain, Angle=0, Plane=n_m_plane, Size=0.5)  # -> Curve, Axes, M, N, MomentScale, AxialScale
diagram_at = ConstructPoint(XCoordinate=1, YCoordinate=0, ZCoordinate=0)
diagram_plane = XYPlane(Origin=diagram_at)
n_m_at_2 = ConstructPoint(XCoordinate=3, YCoordinate=0, ZCoordinate=0)
n_m_plane_2 = XYPlane(Origin=n_m_at_2)
encased_column_4 = NMDiagramAlpaca4d(Domain=encased_column_3.Domain, Angle=0, Plane=n_m_plane_2, Size=0.5)  # -> Curve, Axes, M, N, MomentScale, AxialScale
n_m_at_3 = ConstructPoint(XCoordinate=3, YCoordinate=0, ZCoordinate=0)
n_m_plane_3 = XYPlane(Origin=n_m_at_3)
rc_beam_with_cfrp_4 = NMDiagramAlpaca4d(Domain=rc_beam_with_cfrp_3.Domain, Angle=0, Plane=n_m_plane_3, Size=0.5)  # -> Curve, Axes, M, N, MomentScale, AxialScale
n_m_at_4 = ConstructPoint(XCoordinate=3, YCoordinate=0, ZCoordinate=0)
n_m_plane_4 = XYPlane(Origin=n_m_at_4)
rc_beam_4 = NMDiagramAlpaca4d(Domain=rc_beam_3.Domain, Angle=0, Plane=n_m_plane_4, Size=0.5)  # -> Curve, Axes, M, N, MomentScale, AxialScale
moment_curvature_diagram_alpaca4d = MomentCurvatureDiagramAlpaca4d(
    Results=[composite_beam_2.Result, encased_column_2.Result, rc_beam_with_cfrp_2.Result, rc_beam_2.Result],
    Plane=diagram_plane,
    Size=0.6)  # -> Curves, Axes, CurvatureScale, MomentScale
