# Grasshopper definition ConnectionDesign.gh (Grasshopper 1.0.7)
# plug-ins: Galapagos, Kangaroo2 Components, Alpaca4d

# ---- group: 1 - Geometry: a sphere and the tubes welded to it, joined, open at the tube ends
# Tree column node: Tree column node - a cast steel node in shells, to see how the stress flows through a connection.
# 
# A trunk tube 323.9 mm across splits at a steel sphere 500 mm across into three branches 219.1 mm across, each leaning 35 degrees out. The GhPython component joins the sphere and the tubes into one solid and cuts away the tubes' flat ends: what is left is the steel's surface, its welds kept as edges. Mesh Brep meshes it in quads of about Mesh size, and ASD Shells of S355, Wall thickness thick, are the node.
# 
# A second GhPython component finds the mesh's nodes round the end of each tube. The trunk's are built in. Each branch carries Load on a branch kN down and Sideways on a branch kN along +x - the roof it holds up - shared out over the nodes round its end.
# 
# Model View colours the node by Von Mises stress at the shells' top face - its Layer menu picks top, middle or bottom - drawn 50 times its deformation: the stress gathers where the branches meet the sphere, on the side facing the other branches, and less where the trunk does.
# 
# Try: Mesh size 0.02 m, and see how the peak at the welds rises as the mesh refines - a sign of a stress concentration, which a design check reads at a distance from the weld; Branch lean 50 degrees; Wall thickness 16 mm, and see the peak pass the steel's yield.
trunk_diameter_m = Slider(0.3239, range=0.2..0.6)
trunk_length_m = Slider(0.8, range=0.4..2)
branch_diameter_m = Slider(0.2191, range=0.1..0.5)
branch_length_m = Slider(0.8, range=0.4..2)
branch_lean_deg = Slider(35, range=10..60)
branches = Slider(3, range=2..5)
sphere_diameter_m = Slider(0.5, range=0.3..1)
tree_column_node = GhPythonScript(
    TrunkDiameter=trunk_diameter_m,
    TrunkLength=trunk_length_m,
    BranchDiameter=branch_diameter_m,
    BranchLength=branch_length_m,
    Lean=branch_lean_deg,
    Branches=branches,
    Sphere=sphere_diameter_m)  # -> out, Surface, Ends; inputs Lean: Int32, Branches: Int32
# ---------- tree_column_node: Python ----------
#! python3
# The geometry of the connection (ConnectionDesign.py): the cast steel node of a tree column, where a trunk tube
# splits into branches, as the surface its shell elements are meshed on - and, once it is meshed, the nodes at the
# end of each tube, where it is held and loaded.
#
# The node is a sphere with a tube welded on for the trunk, down, and one for each branch, up and out. The
# solids are joined into one, and the flat ends of the tubes are cut away: what is left is the steel's surface,
# open at the tube ends, its edges where tube meets sphere kept as the weld lines.
#
# The definition's GhPython components run node() and ends().
#
# Written for both Python 3 (Rhino 8) and IronPython 2.7 (Rhino 7): no f-strings, ASCII only.

from __future__ import division

import math

import Rhino
import Rhino.Geometry as rg


def _axes(trunk, branch, lean, branches):
    """The tubes' axes from the node's centre, as (direction, length, radius): the trunk straight down, the
    branches lean degrees off vertical, evenly round."""
    out = [(rg.Vector3d(0, 0, -1), trunk[0], trunk[1])]
    a = math.radians(lean)
    for k in range(branches):
        b = 2.0 * math.pi * k / branches
        out.append((rg.Vector3d(math.sin(a) * math.cos(b), math.sin(a) * math.sin(b), math.cos(a)), branch[0], branch[1]))
    return out


def node(TrunkDiameter, TrunkLength, BranchDiameter, BranchLength, Lean, Branches, Sphere):
    """The GhPython component's code: the node's surface, a Brep open at the tubes' ends, and a plane at the
    end of each tube - the trunk's first - square to it, facing out."""
    # In metres, as the model is, whatever units the Rhino document is in.
    tol = 0.0001
    angle = math.radians(1.0)
    axes = _axes((TrunkLength, TrunkDiameter / 2.0), (BranchLength, BranchDiameter / 2.0), Lean, int(Branches))
    solids = [rg.Brep.CreateFromSphere(rg.Sphere(rg.Point3d.Origin, Sphere / 2.0))]
    ends = []
    for direction, length, radius in axes:
        end = rg.Point3d.Origin + direction * length
        # Each tube starts inside the sphere, so that their joins are clean circles round it.
        rail = rg.LineCurve(rg.Point3d.Origin + direction * (0.25 * Sphere), end)
        pipe = rg.Brep.CreatePipe(rail, radius, False, rg.PipeCapMode.Flat, True, tol, angle)[0]
        solids.append(pipe)
        ends.append(rg.Plane(end, direction))
    joined = rg.Brep.CreateBooleanUnion(solids, tol)
    if not joined:
        raise Exception("The tubes and the sphere could not be joined: try other sizes or angles.")
    solid = joined[0]
    # The flat ends of the tubes, cut away: a planar face lying on one of the ends' planes.
    keep = []
    for f in solid.Faces:
        centre = rg.AreaMassProperties.Compute(f.DuplicateFace(False)).Centroid
        cap = f.IsPlanar(tol) and any(abs(p.DistanceTo(centre)) < tol * 10 for p in ends)
        if not cap:
            keep.append(f.FaceIndex)
    surface = solid.DuplicateSubBrep(keep)
    return surface, ends


def ends(Mesh, Ends, Load, Sideways, Tolerance):
    """The GhPython component's code: the mesh's nodes at the end of each tube. The trunk's are where the node is
    held; the branches' share the load on each branch - Load down and Sideways along +x - out evenly."""
    held, loaded, forces = [], [], []
    points = [rg.Point3d(v) for v in Mesh.Vertices]
    for k, plane in enumerate(Ends):
        at = [p for p in points if abs(plane.DistanceTo(p)) < Tolerance]
        if k == 0:
            held += at
        elif at:
            share = rg.Vector3d(Sideways, 0, -Load) / len(at)
            loaded += at
            forces += [share] * len(at)
    info = "{0} nodes held at the trunk, {1} loaded at {2} branch ends".format(len(held), len(loaded), len(Ends) - 1)
    return held, loaded, forces, info


Surface, Ends = node(TrunkDiameter, TrunkLength, BranchDiameter, BranchLength, Lean, Branches, Sphere)
# ---------- end tree_column_node ----------

# ---- group: 4 - Loads: each branch's load shared over the nodes round its end
load_on_a_branch_kn = Slider(250, range=0..1000)
sideways_on_a_branch_kn = Slider(25, range=0..200)
wall_thickness_mm = Slider(25, range=6..40)
mesh_size_m = Slider(0.04, range=0.02..0.1)
within_m = Expression(e=mesh_size_m, Expression="e/4")

# ---- group: 2 - Steel: meshed in quads by Mesh Brep, ASD Shells of S355
quads = MeshBrepAlpaca4d(Breps=tree_column_node.Surface, EdgeLength=mesh_size_m)
s355 = ND(
    MaterialName="S355",
    E=210000000,
    G=81000000,
    Ν=0.3,
    Rho=7850,
    Colour=RGB(190, 194, 199),
    mode="ElasticIsotropic (Alpaca4d)")
thickness_m = Expression(t=wall_thickness_mm, Expression="t/1000")
wall = PlateFiberSectionAlpaca4d(Thickness=thickness_m, Material=s355)
node = ASDShellAlpaca4d(Mesh=quads, Section=wall, IsCorotational=False)

# ---- group: 4 - Loads: each branch's load shared over the nodes round its end (continued)
tube_ends = GhPythonScript(Mesh=quads, Ends=tree_column_node.Ends, Load=load_on_a_branch_kn, Sideways=sideways_on_a_branch_kn, Tolerance=within_m)  # -> out, Held, Loaded, Forces, Info; inputs Mesh: Mesh, Ends: list of Plane
# ---------- tube_ends: Python ----------
#! python3
# The geometry of the connection (ConnectionDesign.py): the cast steel node of a tree column, where a trunk tube
# splits into branches, as the surface its shell elements are meshed on - and, once it is meshed, the nodes at the
# end of each tube, where it is held and loaded.
#
# The node is a sphere with a tube welded on for the trunk, down, and one for each branch, up and out. The
# solids are joined into one, and the flat ends of the tubes are cut away: what is left is the steel's surface,
# open at the tube ends, its edges where tube meets sphere kept as the weld lines.
#
# The definition's GhPython components run node() and ends().
#
# Written for both Python 3 (Rhino 8) and IronPython 2.7 (Rhino 7): no f-strings, ASCII only.

from __future__ import division

import math

import Rhino
import Rhino.Geometry as rg


def _axes(trunk, branch, lean, branches):
    """The tubes' axes from the node's centre, as (direction, length, radius): the trunk straight down, the
    branches lean degrees off vertical, evenly round."""
    out = [(rg.Vector3d(0, 0, -1), trunk[0], trunk[1])]
    a = math.radians(lean)
    for k in range(branches):
        b = 2.0 * math.pi * k / branches
        out.append((rg.Vector3d(math.sin(a) * math.cos(b), math.sin(a) * math.sin(b), math.cos(a)), branch[0], branch[1]))
    return out


def node(TrunkDiameter, TrunkLength, BranchDiameter, BranchLength, Lean, Branches, Sphere):
    """The GhPython component's code: the node's surface, a Brep open at the tubes' ends, and a plane at the
    end of each tube - the trunk's first - square to it, facing out."""
    # In metres, as the model is, whatever units the Rhino document is in.
    tol = 0.0001
    angle = math.radians(1.0)
    axes = _axes((TrunkLength, TrunkDiameter / 2.0), (BranchLength, BranchDiameter / 2.0), Lean, int(Branches))
    solids = [rg.Brep.CreateFromSphere(rg.Sphere(rg.Point3d.Origin, Sphere / 2.0))]
    ends = []
    for direction, length, radius in axes:
        end = rg.Point3d.Origin + direction * length
        # Each tube starts inside the sphere, so that their joins are clean circles round it.
        rail = rg.LineCurve(rg.Point3d.Origin + direction * (0.25 * Sphere), end)
        pipe = rg.Brep.CreatePipe(rail, radius, False, rg.PipeCapMode.Flat, True, tol, angle)[0]
        solids.append(pipe)
        ends.append(rg.Plane(end, direction))
    joined = rg.Brep.CreateBooleanUnion(solids, tol)
    if not joined:
        raise Exception("The tubes and the sphere could not be joined: try other sizes or angles.")
    solid = joined[0]
    # The flat ends of the tubes, cut away: a planar face lying on one of the ends' planes.
    keep = []
    for f in solid.Faces:
        centre = rg.AreaMassProperties.Compute(f.DuplicateFace(False)).Centroid
        cap = f.IsPlanar(tol) and any(abs(p.DistanceTo(centre)) < tol * 10 for p in ends)
        if not cap:
            keep.append(f.FaceIndex)
    surface = solid.DuplicateSubBrep(keep)
    return surface, ends


def ends(Mesh, Ends, Load, Sideways, Tolerance):
    """The GhPython component's code: the mesh's nodes at the end of each tube. The trunk's are where the node is
    held; the branches' share the load on each branch - Load down and Sideways along +x - out evenly."""
    held, loaded, forces = [], [], []
    points = [rg.Point3d(v) for v in Mesh.Vertices]
    for k, plane in enumerate(Ends):
        at = [p for p in points if abs(plane.DistanceTo(p)) < Tolerance]
        if k == 0:
            held += at
        elif at:
            share = rg.Vector3d(Sideways, 0, -Load) / len(at)
            loaded += at
            forces += [share] * len(at)
    info = "{0} nodes held at the trunk, {1} loaded at {2} branch ends".format(len(held), len(loaded), len(Ends) - 1)
    return held, loaded, forces, info


Held, Loaded, Forces, Info = ends(Mesh, Ends, Load, Sideways, Tolerance)
# ---------- end tube_ends ----------
about_the_ends = Panel(tube_ends.Info)
the_roof_on_the_branches = PointLoadAlpaca4d(Point=tube_ends.Loaded, Force=tube_ends.Forces, Moment=Vector(0, 0, 0))
roof = LoadPatternAlpaca4d(Loads=flatten(the_roof_on_the_branches), Factor=1, mode="PlainPattern (Alpaca4d)")

# ---- group: 3 - Supports: every node round the trunk's end built in
trunk_built_in = SupportAlpaca4d(Position=tube_ends.Held, Tx=True, Ty=True, Tz=True, Rx=True, Ry=True, Rz=True, mode="Support Rigid (Alpaca4d)")

# ---- group: 5 - Analysis
tree_column_node_2 = AssembleModelAlpaca4d(Elements=flatten(node), Supports=flatten(trunk_built_in), LoadPatterns=flatten(roof), Tolerance=0.01)  # -> AlpacaModel, Mass
analysis_settings = AnalysisSettingsAlpaca4d(Constraint="Transformation", Numberer="RCM", System="Auto", Algorithm="Newton", AnalysisType="Static", Cores=0)
run_analysis = RunAnalysisAlpaca4d(AlpacaModel=tree_column_node_2.AlpacaModel, Settings=analysis_settings, settings=True)  # -> AlpacaModel, Log

# ---- group: 6 - Results: Von Mises stress, deformed 50 times, and the loads
von_mises = ModelViewAlpaca4d(
    AlpacaModel=run_analysis.AlpacaModel,
    Step=0,
    Colors=[RGB(212, 227, 253), RGB(157, 193, 251), RGB(103, 159, 249), RGB(78, 126, 243), RGB(112, 95, 233), RGB(147, 63, 222), RGB(177, 67, 179), RGB(206, 87, 121), RGB(235, 108, 63)],
    FittedLoads=True)  # -> AlpacaModel, Geometry, Info, Values, Colors
tree_column_node_loads = ModelViewAlpaca4d(AlpacaModel=tree_column_node_2.AlpacaModel, Step=0, FittedLoads=True)  # -> AlpacaModel, Geometry, Info, Values, Colors
legend_title = Panel("Von Mises [MPa]")
node_legend = LegendAlpaca4d(Title=legend_title, Values=von_mises.Values, Colors=von_mises.Colors, Position=0, Scale=2.4)
