# Grasshopper definition FibreLaws.gh (Grasshopper 1.0.7)
# plug-ins: Galapagos, Kangaroo2 Components, Alpaca4d

# ---- group: 1 - Laws: concrete and steel, one law each
concrete01 = ConcreteAlpaca4d(MaterialName="Concrete01", Fco=-38000, Fcu=-30400, EpsilonCo=-0.002, EpsilonCu=-0.0035, MinMax=False, mode="Concrete01")
steel01 = SteelAlpaca4d(MaterialName="Steel01", Fy=500000, E0=200000000, B=0.01, mode="Steel01")
concrete02 = ConcreteAlpaca4d(
    MaterialName="Concrete02",
    Fpc=-38000,
    EpsC0=-0.002,
    Fpcu=-30400,
    EpsU=-0.0035,
    Lambda=0.2,
    Ft=3000,
    Ets=2000000,
    MinMax=False,
    mode="Concrete02")
steel01_2 = SteelAlpaca4d(MaterialName="Steel01", Fy=500000, E0=200000000, B=0.01, mode="Steel01")
concrete04 = ConcreteAlpaca4d(
    MaterialName="Concrete04",
    Fc=-38000,
    EpsC=-0.002,
    EpsCu=-0.0035,
    Ec=38000000,
    Fct=3000,
    Et=0.0001,
    MinMax=False,
    mode="Concrete04")
steel01_3 = SteelAlpaca4d(MaterialName="Steel01", Fy=500000, E0=200000000, B=0.01, mode="Steel01")
concrete01_2 = ConcreteAlpaca4d(MaterialName="Concrete01", Fco=-38000, Fcu=-30400, EpsilonCo=-0.002, EpsilonCu=-0.0035, MinMax=False, mode="Concrete01")
steel02 = SteelAlpaca4d(MaterialName="Steel02", Fy=500000, E0=200000000, B=0.01, R0=18, CR1=0.925, CR2=0.15, mode="Steel02")
concrete01_3 = ConcreteAlpaca4d(MaterialName="Concrete01", Fco=-38000, Fcu=-30400, EpsilonCo=-0.002, EpsilonCu=-0.0035, MinMax=False, mode="Concrete01")
elasticpp = OtherLawsAlpaca4d(MaterialName="ElasticPP", E=200000000, EpsyP=0.0025, mode="ElasticPP")
concrete01_4 = ConcreteAlpaca4d(MaterialName="Concrete01", Fco=-38000, Fcu=-30400, EpsilonCo=-0.002, EpsilonCu=-0.0035, MinMax=False, mode="Concrete01")
hysteretic = OtherLawsAlpaca4d(
    MaterialName="Hysteretic",
    E1p=0.0025,
    S1p=500000,
    E2p=0.02,
    S2p=540000,
    E3p=0.08,
    S3p=575000,
    PinchX=1,
    PinchY=1,
    Damage1=0,
    Damage2=0,
    mode="Hysteretic")

# ---- group: 2 - The section, six times: 300 x 500, 3 phi 20 below, 2 phi 16 above
# Fibre laws: Fibre laws - one reinforced concrete section, six sets of laws.
# 
# A 300 x 500 section of 240 concrete fibres with 3 phi 20 bars below and 2 phi 16 above, bent about y under 1000 kN of compression, Direction 180 so that the three bars are in tension. Each row takes another concrete or steel law from the Concrete, Steel and Other Laws components: Concrete01, Concrete02 and Concrete04 with Steel01; then Steel02, ElasticPP and a three point Hysteretic backbone with Concrete01. Right click a law component, Law, to change it.
# 
# Concrete decides the ultimate moment, steel the yield and the tension: the six curves lie close, ElasticPP, with no hardening, lowest. Each N-M diagram is drawn to fit its own size.
# 
# Try: Axial from -1000 to 0; Concrete02's ft to 0; the bars' strength in Steel.
_300_x_500 = Rectangle3Pt(PointA=Point(-0.15, -0.25, 0), PointB=Point(0.15, -0.25, 0), PointC=Point(0.15, 0.25, 0))  # -> Rectangle, Length
_300_x_500_fibres = MeshPlane(Boundary=_300_x_500.Rectangle, WidthCount=12, HeightCount=20)  # -> Mesh, Area
concrete01_steel01_patch_1 = PatchAlpaca4d(Mesh=_300_x_500_fibres.Mesh, Material=concrete01)
concrete01_steel01_bars_1 = FiberPointAlpaca4d(
    Point=[Point(-0.1, -0.2, 0), Point(0, -0.2, 0), Point(0.1, -0.2, 0)],
    AreaFiber=[0.0003141592654, 0.0003141592654, 0.0003141592654],
    Material=steel01)
concrete01_steel01_bars_2 = FiberPointAlpaca4d(Point=[Point(-0.1, 0.2, 0), Point(0.1, 0.2, 0)], AreaFiber=[0.0002010619298, 0.0002010619298], Material=steel01)
concrete02_steel01_patch_1 = PatchAlpaca4d(Mesh=_300_x_500_fibres.Mesh, Material=concrete02)
concrete02_steel01_bars_1 = FiberPointAlpaca4d(
    Point=[Point(-0.1, -0.2, 0), Point(0, -0.2, 0), Point(0.1, -0.2, 0)],
    AreaFiber=[0.0003141592654, 0.0003141592654, 0.0003141592654],
    Material=steel01_2)
concrete02_steel01_bars_2 = FiberPointAlpaca4d(Point=[Point(-0.1, 0.2, 0), Point(0.1, 0.2, 0)], AreaFiber=[0.0002010619298, 0.0002010619298], Material=steel01_2)
concrete04_steel01_patch_1 = PatchAlpaca4d(Mesh=_300_x_500_fibres.Mesh, Material=concrete04)
concrete04_steel01_bars_1 = FiberPointAlpaca4d(
    Point=[Point(-0.1, -0.2, 0), Point(0, -0.2, 0), Point(0.1, -0.2, 0)],
    AreaFiber=[0.0003141592654, 0.0003141592654, 0.0003141592654],
    Material=steel01_3)
concrete04_steel01_bars_2 = FiberPointAlpaca4d(Point=[Point(-0.1, 0.2, 0), Point(0.1, 0.2, 0)], AreaFiber=[0.0002010619298, 0.0002010619298], Material=steel01_3)
concrete01_steel02_patch_1 = PatchAlpaca4d(Mesh=_300_x_500_fibres.Mesh, Material=concrete01_2)
concrete01_steel02_bars_1 = FiberPointAlpaca4d(
    Point=[Point(-0.1, -0.2, 0), Point(0, -0.2, 0), Point(0.1, -0.2, 0)],
    AreaFiber=[0.0003141592654, 0.0003141592654, 0.0003141592654],
    Material=steel02)
concrete01_steel02_bars_2 = FiberPointAlpaca4d(Point=[Point(-0.1, 0.2, 0), Point(0.1, 0.2, 0)], AreaFiber=[0.0002010619298, 0.0002010619298], Material=steel02)
concrete01_elasticpp_patch_1 = PatchAlpaca4d(Mesh=_300_x_500_fibres.Mesh, Material=concrete01_3)
concrete01_elasticpp_bars_1 = FiberPointAlpaca4d(
    Point=[Point(-0.1, -0.2, 0), Point(0, -0.2, 0), Point(0.1, -0.2, 0)],
    AreaFiber=[0.0003141592654, 0.0003141592654, 0.0003141592654],
    Material=elasticpp)
concrete01_elasticpp_bars_2 = FiberPointAlpaca4d(Point=[Point(-0.1, 0.2, 0), Point(0.1, 0.2, 0)], AreaFiber=[0.0002010619298, 0.0002010619298], Material=elasticpp)
concrete01_hysteretic_patch_1 = PatchAlpaca4d(Mesh=_300_x_500_fibres.Mesh, Material=concrete01_4)
concrete01_hysteretic_bars_1 = FiberPointAlpaca4d(
    Point=[Point(-0.1, -0.2, 0), Point(0, -0.2, 0), Point(0.1, -0.2, 0)],
    AreaFiber=[0.0003141592654, 0.0003141592654, 0.0003141592654],
    Material=hysteretic)
concrete01_hysteretic_bars_2 = FiberPointAlpaca4d(Point=[Point(-0.1, 0.2, 0), Point(0.1, 0.2, 0)], AreaFiber=[0.0002010619298, 0.0002010619298], Material=hysteretic)
concrete01_steel01 = FiberSectionAlpaca4d(PointFiber=[concrete01_steel01_bars_1, concrete01_steel01_bars_2], Patch=concrete01_steel01_patch_1, GJ=100000000)
concrete02_steel01 = FiberSectionAlpaca4d(PointFiber=[concrete02_steel01_bars_1, concrete02_steel01_bars_2], Patch=concrete02_steel01_patch_1, GJ=100000000)
concrete04_steel01 = FiberSectionAlpaca4d(PointFiber=[concrete04_steel01_bars_1, concrete04_steel01_bars_2], Patch=concrete04_steel01_patch_1, GJ=100000000)
concrete01_steel02 = FiberSectionAlpaca4d(PointFiber=[concrete01_steel02_bars_1, concrete01_steel02_bars_2], Patch=concrete01_steel02_patch_1, GJ=100000000)
concrete01_elasticpp = FiberSectionAlpaca4d(PointFiber=[concrete01_elasticpp_bars_1, concrete01_elasticpp_bars_2], Patch=concrete01_elasticpp_patch_1, GJ=100000000)
concrete01_hysteretic = FiberSectionAlpaca4d(
    PointFiber=[concrete01_hysteretic_bars_1, concrete01_hysteretic_bars_2],
    Patch=concrete01_hysteretic_patch_1,
    GJ=100000000)

# ---- group: 3 - Moment Curvature under 1000 kN of compression, and the domain of each
concrete01_steel01_2 = MomentCurvatureAlpaca4d(FiberSection=concrete01_steel01, Axial=-1000, Direction=180, NumIncr=200, Εud=0.05, StopAtUltimate=True)  # -> Log, N, My, Mz, Ε, Κy, Κz, FiberStressStrain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
concrete02_steel01_2 = MomentCurvatureAlpaca4d(FiberSection=concrete02_steel01, Axial=-1000, Direction=180, NumIncr=200, Εud=0.05, StopAtUltimate=True)  # -> Log, N, My, Mz, Ε, Κy, Κz, FiberStressStrain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
concrete04_steel01_2 = MomentCurvatureAlpaca4d(FiberSection=concrete04_steel01, Axial=-1000, Direction=180, NumIncr=200, Εud=0.05, StopAtUltimate=True)  # -> Log, N, My, Mz, Ε, Κy, Κz, FiberStressStrain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
concrete01_steel02_2 = MomentCurvatureAlpaca4d(FiberSection=concrete01_steel02, Axial=-1000, Direction=180, NumIncr=200, Εud=0.05, StopAtUltimate=True)  # -> Log, N, My, Mz, Ε, Κy, Κz, FiberStressStrain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
concrete01_elasticpp_2 = MomentCurvatureAlpaca4d(FiberSection=concrete01_elasticpp, Axial=-1000, Direction=180, NumIncr=200, Εud=0.05, StopAtUltimate=True)  # -> Log, N, My, Mz, Ε, Κy, Κz, FiberStressStrain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
concrete01_hysteretic_2 = MomentCurvatureAlpaca4d(FiberSection=concrete01_hysteretic, Axial=-1000, Direction=180, NumIncr=200, Εud=0.05, StopAtUltimate=True)  # -> Log, N, My, Mz, Ε, Κy, Κz, FiberStressStrain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
concrete01_steel01_3 = InteractionDomainAlpaca4d(FiberSection=concrete01_steel01, Εud=0.05, Levels=20, Points=72)  # -> Domain, N, My, Mz, Nc, Nt, Centroid, Materials, Log
concrete02_steel01_3 = InteractionDomainAlpaca4d(FiberSection=concrete02_steel01, Εud=0.05, Levels=20, Points=72)  # -> Domain, N, My, Mz, Nc, Nt, Centroid, Materials, Log
concrete04_steel01_3 = InteractionDomainAlpaca4d(FiberSection=concrete04_steel01, Εud=0.05, Levels=20, Points=72)  # -> Domain, N, My, Mz, Nc, Nt, Centroid, Materials, Log
concrete01_steel02_3 = InteractionDomainAlpaca4d(FiberSection=concrete01_steel02, Εud=0.05, Levels=20, Points=72)  # -> Domain, N, My, Mz, Nc, Nt, Centroid, Materials, Log
concrete01_elasticpp_3 = InteractionDomainAlpaca4d(FiberSection=concrete01_elasticpp, Εud=0.05, Levels=20, Points=72)  # -> Domain, N, My, Mz, Nc, Nt, Centroid, Materials, Log
concrete01_hysteretic_3 = InteractionDomainAlpaca4d(FiberSection=concrete01_hysteretic, Εud=0.05, Levels=20, Points=72)  # -> Domain, N, My, Mz, Nc, Nt, Centroid, Materials, Log

# ---- group: 4 - Curves on one diagram, domains in the N-M diagram, ultimate moments
concrete01_steel01_ultimatemoment = Panel(concrete01_steel01_2.UltimateMoment)
concrete01_steel01_ductility = Panel(concrete01_steel01_2.Ductility)
concrete01_steel01_failure = Panel(concrete01_steel01_2.Failure)
concrete02_steel01_ultimatemoment = Panel(concrete02_steel01_2.UltimateMoment)
concrete02_steel01_ductility = Panel(concrete02_steel01_2.Ductility)
concrete02_steel01_failure = Panel(concrete02_steel01_2.Failure)
concrete04_steel01_ultimatemoment = Panel(concrete04_steel01_2.UltimateMoment)
concrete04_steel01_ductility = Panel(concrete04_steel01_2.Ductility)
concrete04_steel01_failure = Panel(concrete04_steel01_2.Failure)
concrete01_steel02_ultimatemoment = Panel(concrete01_steel02_2.UltimateMoment)
concrete01_steel02_ductility = Panel(concrete01_steel02_2.Ductility)
concrete01_steel02_failure = Panel(concrete01_steel02_2.Failure)
concrete01_elasticpp_ultimatemoment = Panel(concrete01_elasticpp_2.UltimateMoment)
concrete01_elasticpp_ductility = Panel(concrete01_elasticpp_2.Ductility)
concrete01_elasticpp_failure = Panel(concrete01_elasticpp_2.Failure)
concrete01_hysteretic_ultimatemoment = Panel(concrete01_hysteretic_2.UltimateMoment)
concrete01_hysteretic_ductility = Panel(concrete01_hysteretic_2.Ductility)
concrete01_hysteretic_failure = Panel(concrete01_hysteretic_2.Failure)
n_m_at = ConstructPoint(XCoordinate=2, YCoordinate=0, ZCoordinate=0)
n_m_plane = XYPlane(Origin=n_m_at)
concrete01_steel01_4 = NMDiagramAlpaca4d(Domain=concrete01_steel01_3.Domain, Angle=0, Plane=n_m_plane, Size=0.5)  # -> Curve, Axes, M, N, MomentScale, AxialScale
concrete02_steel01_4 = NMDiagramAlpaca4d(Domain=concrete02_steel01_3.Domain, Angle=0, Plane=n_m_plane, Size=0.5)  # -> Curve, Axes, M, N, MomentScale, AxialScale
concrete04_steel01_4 = NMDiagramAlpaca4d(Domain=concrete04_steel01_3.Domain, Angle=0, Plane=n_m_plane, Size=0.5)  # -> Curve, Axes, M, N, MomentScale, AxialScale
concrete01_steel02_4 = NMDiagramAlpaca4d(Domain=concrete01_steel02_3.Domain, Angle=0, Plane=n_m_plane, Size=0.5)  # -> Curve, Axes, M, N, MomentScale, AxialScale
concrete01_elasticpp_4 = NMDiagramAlpaca4d(Domain=concrete01_elasticpp_3.Domain, Angle=0, Plane=n_m_plane, Size=0.5)  # -> Curve, Axes, M, N, MomentScale, AxialScale
concrete01_hysteretic_4 = NMDiagramAlpaca4d(Domain=concrete01_hysteretic_3.Domain, Angle=0, Plane=n_m_plane, Size=0.5)  # -> Curve, Axes, M, N, MomentScale, AxialScale
diagram_at = ConstructPoint(XCoordinate=0.4, YCoordinate=0, ZCoordinate=0)
diagram_plane = XYPlane(Origin=diagram_at)
moment_curvature_diagram_alpaca4d = MomentCurvatureDiagramAlpaca4d(
    Results=[concrete01_steel01_2.Result, concrete02_steel01_2.Result, concrete04_steel01_2.Result, concrete01_steel02_2.Result, concrete01_elasticpp_2.Result, concrete01_hysteretic_2.Result],
    Plane=diagram_plane,
    Size=0.5)  # -> Curves, Axes, CurvatureScale, MomentScale
