# Grasshopper definition HeaSection.gh (Grasshopper 1.0.7)
# plug-ins: Galapagos, Kangaroo2 Components, Alpaca4d

# ---- group: 1 - Steel: Steel02, Steel01 and Hysteretic
steel02 = SteelAlpaca4d(MaterialName="Steel02", Fy=355000, E0=210000000, B=0.01, R0=18, CR1=0.925, CR2=0.15, mode="Steel02")
steel01 = SteelAlpaca4d(MaterialName="Steel01", Fy=355000, E0=210000000, B=0.01, mode="Steel01")
hysteretic = OtherLawsAlpaca4d(
    MaterialName="Hysteretic",
    E1p=0.00169047619,
    S1p=355000,
    E2p=0.02,
    S2p=383400,
    E3p=0.08,
    S3p=408250,
    PinchX=1,
    PinchY=1,
    Damage1=0,
    Damage2=0,
    mode="Hysteretic")

# ---- group: 2 - HEA 300 in fibres: two flanges and a web
hea_300_top_flange = Rectangle3Pt(PointA=Point(-0.15, 0.131, 0), PointB=Point(0.15, 0.131, 0), PointC=Point(0.15, 0.145, 0))  # -> Rectangle, Length
hea_300_bottom_flange = Rectangle3Pt(PointA=Point(-0.15, -0.145, 0), PointB=Point(0.15, -0.145, 0), PointC=Point(0.15, -0.131, 0))  # -> Rectangle, Length
hea_300_web = Rectangle3Pt(PointA=Point(-0.00425, -0.131, 0), PointB=Point(0.00425, -0.131, 0), PointC=Point(0.00425, 0.131, 0))  # -> Rectangle, Length
# HEA 300: HEA 300 in fibres - a rolled steel section under three laws.
# 
# Two flanges (300 x 14) and a web (8.5 x 262), the root radii left out, meshed in 600 fibres each way, S355. Moment Curvature bends it about the strong axis, Direction 0, without axial force, in Steel02 (smooth knee, 1 % hardening), Steel01 (sharp knee, 1 %) and a Hysteretic backbone rising to 1.15 fy; the last row bends Steel02 about the weak axis, Direction 90. The curves show the plastic reserve: the ultimate moment against the moment at first yield. Every law here hardens: a perfectly plastic one (ElasticPP) leaves a bare section with no stiffness once it is fully yielded, and the analysis cannot go on.
# 
# The N-M diagrams are cut along My; the My-Mz diagram is the first law's domain at N = 0 and at 1000 kN of compression.
# 
# Try: Direction between 0 and 90; Axial from 0 to -2000; the steel strength in the Steel components.
hea_300_top_flange_fibres = MeshPlane(Boundary=hea_300_top_flange.Rectangle, WidthCount=24, HeightCount=2)  # -> Mesh, Area
hea_300_bottom_flange_fibres = MeshPlane(Boundary=hea_300_bottom_flange.Rectangle, WidthCount=24, HeightCount=2)  # -> Mesh, Area
hea_300_web_fibres = MeshPlane(Boundary=hea_300_web.Rectangle, WidthCount=2, HeightCount=21)  # -> Mesh, Area
hea_300_steel02_patch_1 = PatchAlpaca4d(Mesh=hea_300_top_flange_fibres.Mesh, Material=steel02)
hea_300_steel02_patch_2 = PatchAlpaca4d(Mesh=hea_300_bottom_flange_fibres.Mesh, Material=steel02)
hea_300_steel02_patch_3 = PatchAlpaca4d(Mesh=hea_300_web_fibres.Mesh, Material=steel02)
hea_300_steel01_patch_1 = PatchAlpaca4d(Mesh=hea_300_top_flange_fibres.Mesh, Material=steel01)
hea_300_steel01_patch_2 = PatchAlpaca4d(Mesh=hea_300_bottom_flange_fibres.Mesh, Material=steel01)
hea_300_steel01_patch_3 = PatchAlpaca4d(Mesh=hea_300_web_fibres.Mesh, Material=steel01)
hea_300_hysteretic_patch_1 = PatchAlpaca4d(Mesh=hea_300_top_flange_fibres.Mesh, Material=hysteretic)
hea_300_hysteretic_patch_2 = PatchAlpaca4d(Mesh=hea_300_bottom_flange_fibres.Mesh, Material=hysteretic)
hea_300_hysteretic_patch_3 = PatchAlpaca4d(Mesh=hea_300_web_fibres.Mesh, Material=hysteretic)
hea_300_steel02_weak_axis_patch_1 = PatchAlpaca4d(Mesh=hea_300_top_flange_fibres.Mesh, Material=steel02)
hea_300_steel02_weak_axis_patch_2 = PatchAlpaca4d(Mesh=hea_300_bottom_flange_fibres.Mesh, Material=steel02)
hea_300_steel02_weak_axis_patch_3 = PatchAlpaca4d(Mesh=hea_300_web_fibres.Mesh, Material=steel02)
hea_300_steel02 = FiberSectionAlpaca4d(Patch=[hea_300_steel02_patch_1, hea_300_steel02_patch_2, hea_300_steel02_patch_3], GJ=100000000)
hea_300_steel01 = FiberSectionAlpaca4d(Patch=[hea_300_steel01_patch_1, hea_300_steel01_patch_2, hea_300_steel01_patch_3], GJ=100000000)
hea_300_hysteretic = FiberSectionAlpaca4d(Patch=[hea_300_hysteretic_patch_1, hea_300_hysteretic_patch_2, hea_300_hysteretic_patch_3], GJ=100000000)
hea_300_steel02_weak_axis = FiberSectionAlpaca4d(
    Patch=[hea_300_steel02_weak_axis_patch_1, hea_300_steel02_weak_axis_patch_2, hea_300_steel02_weak_axis_patch_3],
    GJ=100000000)

# ---- group: 3 - Moment Curvature about both axes, and the domain
hea_300_steel02_2 = MomentCurvatureAlpaca4d(FiberSection=hea_300_steel02, Axial=0, Direction=0, NumIncr=200, Εud=0.05, StopAtUltimate=True)  # -> Log, N, My, Mz, Ε, Κy, Κz, FiberStressStrain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
hea_300_steel01_2 = MomentCurvatureAlpaca4d(FiberSection=hea_300_steel01, Axial=0, Direction=0, NumIncr=200, Εud=0.05, StopAtUltimate=True)  # -> Log, N, My, Mz, Ε, Κy, Κz, FiberStressStrain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
hea_300_hysteretic_2 = MomentCurvatureAlpaca4d(FiberSection=hea_300_hysteretic, Axial=0, Direction=0, NumIncr=200, Εud=0.05, StopAtUltimate=True)  # -> Log, N, My, Mz, Ε, Κy, Κz, FiberStressStrain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
hea_300_steel02_weak_axis_2 = MomentCurvatureAlpaca4d(FiberSection=hea_300_steel02_weak_axis, Axial=0, Direction=90, NumIncr=200, Εud=0.05, StopAtUltimate=True)  # -> Log, N, My, Mz, Ε, Κy, Κz, FiberStressStrain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
hea_300_steel02_3 = InteractionDomainAlpaca4d(FiberSection=hea_300_steel02, Εud=0.05, Levels=20, Points=72)  # -> Domain, N, My, Mz, Nc, Nt, Centroid, Materials, Log
hea_300_steel01_3 = InteractionDomainAlpaca4d(FiberSection=hea_300_steel01, Εud=0.05, Levels=20, Points=72)  # -> Domain, N, My, Mz, Nc, Nt, Centroid, Materials, Log
hea_300_hysteretic_3 = InteractionDomainAlpaca4d(FiberSection=hea_300_hysteretic, Εud=0.05, Levels=20, Points=72)  # -> Domain, N, My, Mz, Nc, Nt, Centroid, Materials, Log
hea_300_steel02_weak_axis_3 = InteractionDomainAlpaca4d(FiberSection=hea_300_steel02_weak_axis, Εud=0.05, Levels=20, Points=72)  # -> Domain, N, My, Mz, Nc, Nt, Centroid, Materials, Log

# ---- group: 4 - Curves, N-M and My-Mz diagrams, ultimate moments
hea_300_steel02_ultimatemoment = Panel(hea_300_steel02_2.UltimateMoment)
hea_300_steel02_ductility = Panel(hea_300_steel02_2.Ductility)
hea_300_steel02_failure = Panel(hea_300_steel02_2.Failure)
hea_300_steel01_ultimatemoment = Panel(hea_300_steel01_2.UltimateMoment)
hea_300_steel01_ductility = Panel(hea_300_steel01_2.Ductility)
hea_300_steel01_failure = Panel(hea_300_steel01_2.Failure)
hea_300_hysteretic_ultimatemoment = Panel(hea_300_hysteretic_2.UltimateMoment)
hea_300_hysteretic_ductility = Panel(hea_300_hysteretic_2.Ductility)
hea_300_hysteretic_failure = Panel(hea_300_hysteretic_2.Failure)
hea_300_steel02_weak_axis_ultimatemoment = Panel(hea_300_steel02_weak_axis_2.UltimateMoment)
hea_300_steel02_weak_axis_ductility = Panel(hea_300_steel02_weak_axis_2.Ductility)
hea_300_steel02_weak_axis_failure = Panel(hea_300_steel02_weak_axis_2.Failure)
n_m_at = ConstructPoint(XCoordinate=1.2, YCoordinate=0, ZCoordinate=0)
n_m_plane = XYPlane(Origin=n_m_at)
hea_300_steel02_4 = NMDiagramAlpaca4d(Domain=hea_300_steel02_3.Domain, Angle=0, Plane=n_m_plane, Size=0.5)  # -> Curve, Axes, M, N, MomentScale, AxialScale
hea_300_steel01_4 = NMDiagramAlpaca4d(Domain=hea_300_steel01_3.Domain, Angle=0, Plane=n_m_plane, Size=0.5)  # -> Curve, Axes, M, N, MomentScale, AxialScale
hea_300_hysteretic_4 = NMDiagramAlpaca4d(Domain=hea_300_hysteretic_3.Domain, Angle=0, Plane=n_m_plane, Size=0.5)  # -> Curve, Axes, M, N, MomentScale, AxialScale
hea_300_steel02_weak_axis_4 = NMDiagramAlpaca4d(Domain=hea_300_steel02_weak_axis_3.Domain, Angle=0, Plane=n_m_plane, Size=0.5)  # -> Curve, Axes, M, N, MomentScale, AxialScale
my_mz_diagram_alpaca4d = MyMzDiagramAlpaca4d(Domain=hea_300_steel02_3.Domain, N=[0, -1000], Plane=n_m_plane, Size=10, Checks=0.5)  # -> Curves, Axes, My, Mz, Scale; "My-Mz"
diagram_at = ConstructPoint(XCoordinate=0.35, YCoordinate=0, ZCoordinate=0)
diagram_plane = XYPlane(Origin=diagram_at)
moment_curvature_diagram_alpaca4d = MomentCurvatureDiagramAlpaca4d(
    Results=[hea_300_steel02_2.Result, hea_300_steel01_2.Result, hea_300_hysteretic_2.Result, hea_300_steel02_weak_axis_2.Result],
    Plane=diagram_plane,
    Size=0.5)  # -> Curves, Axes, CurvatureScale, MomentScale
