# Grasshopper definition MomentCurvature.gh (Grasshopper 1.0.7)
# plug-ins: Galapagos, Kangaroo2 Components, Alpaca4d

# ---- group: 1 - Materials
# Moment curvature: Moment curvature - a reinforced concrete section bent until it fails.
# 
# A 300 x 500 section, Concrete01 in 240 fibres, with phi 24 bars of ReinforcingSteel 30 mm in from its short faces: eight along the bottom, three along the top. 400 kN of compression is held while the curvature about y grows, in 200 increments, until the first fibre reaches its ultimate strain, bent with Direction 180 so that the eight bars are in tension.
# 
# Moment Curvature Diagram draws the curve beside the section: first yield and the ultimate state marked. The panels give the moment at first yield, the ultimate moment and curvature, the curvature ductility, the cracked stiffness to first yield, and which fibre failed.
# 
# Try: Axial from -400 to -1500 and watch the ductility fall; Direction 0 to bend it the other way, the three bars in tension; the bar counts at the top of the script.
concrete = Concrete01Alpaca4d(MaterialName="C25/30", Fco=-25000, Fcu=-20000, EpsilonCo=-0.002, EpsilonCu=-0.0035, MinMax=False)
bars = ReinforcingSteelAlpaca4d(MaterialName="B450C", Fy=450000, Fu=540000, Es=200000000, Esh=2000000, Esh_2=0.008, Eult=0.075, MinMax=False)

# ---- group: 2 - The section: concrete in fibres, a fibre a bar
_300_x_500 = Rectangle3Pt(PointA=Point(-0.15, -0.25, 0), PointB=Point(0.15, -0.25, 0), PointC=Point(0.15, 0.25, 0))  # -> Rectangle, Length
fibres = MeshPlane(Boundary=_300_x_500.Rectangle, WidthCount=12, HeightCount=20)  # -> Mesh, Area
concrete_2 = PatchAlpaca4d(Mesh=fibres.Mesh, Material=concrete)
phi_24_bars = FiberPointAlpaca4d(
    Point=[Point(-0.12, -0.22, 0), Point(-0.08571428571, -0.22, 0), Point(-0.05142857143, -0.22, 0), Point(-0.01714285714, -0.22, 0), Point(0.01714285714, -0.22, 0), Point(0.05142857143, -0.22, 0), Point(0.08571428571, -0.22, 0), Point(0.12, -0.22, 0), Point(-0.12, 0.22, 0), Point(0, 0.22, 0), Point(0.12, 0.22, 0)],
    AreaFiber=[0.0004523893421, 0.0004523893421, 0.0004523893421, 0.0004523893421, 0.0004523893421, 0.0004523893421, 0.0004523893421, 0.0004523893421, 0.0004523893421, 0.0004523893421, 0.0004523893421],
    Material=bars)
fibersection = FiberSectionAlpaca4d(PointFiber=phi_24_bars, Patch=concrete_2, GJ=100000000)

# ---- group: 3 - Moment Curvature, under 400 kN of compression
mc = MomentCurvatureAlpaca4d(FiberSection=fibersection, Axial=-400, Direction=180, NumIncr=200, Εud=0.01, StopAtUltimate=True)  # -> Log, N, My, Mz, Ε, Κy, Κz, FiberStressStrain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

# ---- group: 4 - Yield, ultimate state, and the curve beside the section
diagram_at = ConstructPoint(XCoordinate=0.4, YCoordinate=-0.25, ZCoordinate=0)
yieldmoment = Panel(mc.YieldMoment)
ultimatecurvature = Panel(mc.UltimateCurvature)
ultimatemoment = Panel(mc.UltimateMoment)
ductility = Panel(mc.Ductility)
yieldstiffness = Panel(mc.YieldStiffness)
failure = Panel(mc.Failure)
diagram_plane = XYPlane(Origin=diagram_at)
moment_curvature_diagram_alpaca4d = MomentCurvatureDiagramAlpaca4d(Results=mc.Result, Plane=diagram_plane, Size=0.5)  # -> Curves, Axes, CurvatureScale, MomentScale
