# Grasshopper definition SteelCantilever.gh (Grasshopper 1.0.7)
# plug-ins: Galapagos, Kangaroo2 Components, Alpaca4d

# ---- group: 1 - The cantilever
length_m = Slider(4, range=1..8)
section = ValueList({"IPE300", "HEA200", "HEA240"}, selected="HEA200")
grade = ValueList({"S235", "S275", "S355"}, selected="S355")
tip_load_kn = Slider(15, range=0..40)

# ---- group: 2 - Geometry
tip = ConstructPoint(XCoordinate=length_m, YCoordinate=0, ZCoordinate=0)
root = ConstructPoint(XCoordinate=0, YCoordinate=0, ZCoordinate=0)
downwards = Expression(p=tip_load_kn, Expression="-p")

# ---- group: 3 - Member
cantilever = Line(StartPoint=root, EndPoint=tip)
material_library_elastic = MaterialLibraryElasticAlpaca4d(
    MaterialName=grade,
    MaterialPresetElastic_Grade="S235",
    MaterialPresetElastic_Model="Uniaxial",
    MaterialPresetElastic_Type="Steel",
    menu=[dropdown(0), dropdown(1), dropdown(0)])
tip_force = UnitZ(Factor=downwards)
section_library = SteelSectionLibraryAlpaca4d(SectionName=section, Material=material_library_elastic, menu=[dropdown(0), dropdown(1)])
forcebeamcolumn = ForceBeamColumnAlpaca4d(Line=cantilever, Section=section_library, Colour=RGB(1, 30, 254), mode="ForceBeamColumn (Alpaca4d)")

# ---- group: 4 - Support and loads
restrained = BooleanToggle(True)
built_in = SupportAlpaca4d(
    Position=root,
    Tx=restrained,
    Ty=restrained,
    Tz=restrained,
    Rx=restrained,
    Ry=restrained,
    Rz=restrained,
    mode="Support Rigid (Alpaca4d)")
tip_load = PointLoadAlpaca4d(Point=tip, Force=tip_force, Moment=Vector(0, 0, 0))
gravity_load = GravityLoadAlpaca4d(Factor=1)
load_pattern = LoadPatternAlpaca4d(Loads=[tip_load, gravity_load], Factor=1, mode="PlainPattern (Alpaca4d)")

# ---- group: 5 - Analysis
assemble_model = AssembleModelAlpaca4d(Elements=forcebeamcolumn, Supports=built_in, LoadPatterns=load_pattern, Tolerance=0.01)  # -> AlpacaModel, Mass
analysis_settings = AnalysisSettingsAlpaca4d(Constraint="Transformation", Numberer="RCM", System="Auto", Algorithm="Newton", AnalysisType="Static", Cores=0)
run_analysis = RunAnalysisAlpaca4d(AlpacaModel=assemble_model.AlpacaModel, Settings=analysis_settings, settings=True)  # -> AlpacaModel, Log
modelview = ModelViewAlpaca4d(AlpacaModel=run_analysis.AlpacaModel, Step=0, FittedLoads=True)  # -> AlpacaModel, Geometry, Info, Values, Colors

# ---- group: 6 - Utilisation
cantilever_lengths = Expression(L=length_m, Expression="2*L")
report = BooleanToggle(True)
# Steel cantilever: Steel cantilever - the Alpaca4d Utilisation example.
# 
# A 4 m cantilever, built in at the root, carries its own weight and 15 kN at the tip. Utilisation checks it to EN 1993-1-1: 1 is exactly at the limit.
# 
# The buckling lengths are the point of it. Left empty, Utilisation takes each beam's own length, held at both ends - but a cantilever's tip is free. Here LengthY, LengthZ and LengthLT are twice the length, and the root moment is taken as uniform over it: on the safe side for a root built in sideways and against twist.
# 
# HEA 200: bending 0.48, but lateral-torsional buckling 0.89 - LTB governs.
# Switch Section to IPE300, the same weight: bending only 0.30, LTB 1.11 - it fails. With the lengths left empty it would have read 0.38.
# 
# Open the Report panel to follow the check by hand.
utilisation = UtilisationAlpaca4d(
    AlpacaModel=run_analysis.AlpacaModel,
    Step=0,
    LengthY=cantilever_lengths,
    Fabrication="Rolled",
    ΓM0=1,
    ΓM1=1,
    Report=report,
    LengthZ=cantilever_lengths,
    LengthLT=cantilever_lengths)  # -> Axial, ShearY, ShearZ, Torsion, BendingY, BendingZ, Combined, BucklingY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
max = Panel(utilisation.Max)
governing = Panel(utilisation.Governing)
ltb = Panel(utilisation.LTB)
bendingz = Panel(utilisation.BendingZ)
class = Panel(utilisation.Class)
report_2 = Panel(utilisation.Report)
