# Grasshopper definition InigoTheDragon.gh (Grasshopper 1.0.7)
# plug-ins: Galapagos, Alpaca4d

# ---- group: 1 - Inigo the dragon in tetrahedra: nodes, and four nodes per tetrahedron
# Inigo the dragon: Inigo the dragon, in tetrahedra, and how it vibrates.
# 
# A solid concrete dragon 5.5 m tall, standing on its two feet: 10903 tetrahedra on 3511 corners, 11.4 m3 or 28.5 t. Inigo is Keenan Crane's dragon, in the public domain (CC0); its wings were thickened by 9 cm, so that they could be meshed.
# 
# 1. Grasshopper has no tetrahedral mesher, so the tetrahedra come as a mesher writes them: the nodes, and four node numbers per tetrahedron. List Item and Construct Mesh make each into a four vertex mesh. They were made with gmsh; TetGen, gmsh or any other mesher's output goes in the same way.
# 2. Ten Node Tetrahedron: four corners and a node in the middle of each edge, so it bends. It needs an OpenSees built from the master branch since 16 October 2026 (Alpaca4d > Settings > Set OpenSees Executable).
# 3. A support holds only the node at its point, so the soles are held at every node on the ground, the edge nodes too: Points gives every element's ten.
# 4. No load: Natural Vibration takes the mass from the concrete's density.
# 5. Mode picks the mode to draw, 0 being the first. The dragon sways forward and back at 7.7 Hz (0), side to side at 22 Hz (1), wags its tail at 42 Hz (2), and flaps its wings together at 59 Hz (3) and against each other at 60 Hz (4). Tick Animate under View Results' Display to watch it move. A mode has no size of its own: it is drawn as OpenSees scales it, to a modal mass of one, so its numbers say where the dragon moves most, not by how much.
nodes = Point([Point(-0.5865, 0.8521, 1.4494), Point(-0.648, 0.9358, 1.6562), Point(-0.4922, 0.8582, 1.7099), Point(-0.6059, 1.0437, 1.5875), Point(-0.1342, 1.6114, 1.4213), Point(-0.0333, 1.697, 1.3936)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])
tetrahedra = Integer(Tree({0}: [0, 1, 2, 3], {1}: [4, 5, 6, 7], {2}: [8, 9, 10, 11], {3}: [12, 13, 14, 15], {4}: [16, 17, 18, 19], {5}: [20, 21, 22, 23]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))
four_faces = MeshFace([{A=0, B=1, C=2, D=2}, {A=0, B=3, C=1, D=1}, {A=1, B=3, C=2, D=2}, {A=2, B=3, C=0, D=0}])
corners = ListItem(List=nodes, Index=tetrahedra, Wrap=True)
tetrahedra_2 = ConstructMesh(Vertices=corners, Faces=four_faces)

# ---- group: 2 - Concrete, and Ten Node Tetrahedra: they need an OpenSees from master
concrete = Panel("C30/37")
e_kn_m2 = Panel("33000000")
g_kn_m2 = Panel("13750000")
poisson = Panel("0.2")
density_kg_m3 = Panel("2500")
concrete_2 = ND(MaterialName=concrete, E=e_kn_m2, G=g_kn_m2, Ν=poisson, Rho=density_kg_m3, mode="ElasticIsotropic (Alpaca4d)")
ten_node_tetrahedron = TenNodeTetrahedronAlpaca4d(Mesh=tetrahedra_2, Material=concrete_2)  # -> Element, Points

# ---- group: 3 - Held at every node on the soles, edge nodes included
element_nodes = Point(flatten(ten_node_tetrahedron.Points))
height = Deconstruct(Point=element_nodes)  # -> XComponent, YComponent, ZComponent
on_the_ground = SmallerThan(FirstNumber=height.ZComponent, SecondNumber=0.001)  # -> SmallerThan, OrEqualTo
sole_nodes = CullPattern(List=element_nodes, CullPattern=on_the_ground.SmallerThan)
once_each = CullDuplicates(Points=sole_nodes, Tolerance=0.001, CullMode=3)  # -> Points, Indices, Valence
held = BooleanToggle(True)
free = BooleanToggle(False)
held_soles = SupportAlpaca4d(Position=once_each.Points, Tx=held, Ty=held, Tz=held, Rx=free, Ry=free, Rz=free)

# ---- group: 4 - Assemble Model: no load, the mass is the concrete's
assemble_model = AssembleModelAlpaca4d(Elements=flatten(ten_node_tetrahedron.Element), Supports=flatten(held_soles), Tolerance=0.01)  # -> AlpacaModel, Mass
modelview = ModelViewAlpaca4d(AlpacaModel=assemble_model.AlpacaModel)

# ---- group: 5 - The first 12 modes, and the one picked drawn over the dragon
natural_vibration = NaturalVibrationAnalysisAlpaca4d(AlpacaModel=assemble_model.AlpacaModel, VibrationModes=12, Solver="-genBandArpack")  # -> AlpacaModel, Eigenvalues, Period, Frequencies, Log, EigenValueAnalysis, TotalMassOfStructure, TotalFreeMass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
mode_from_0 = Slider(3, range=0..11)
view_results_wip = ViewResults_WIPAlpaca4d(AlpacaModel=natural_vibration.AlpacaModel, Step=mode_from_0, BeamStressSigmaX=1, ResultMenuOrder=1, ResultUnits=1)  # -> Info, Values, Colors
title = Panel("Mode shape, mass-normalised")
legend = LegendAlpaca4d(Title=title, Values=view_results_wip.Values, Colors=view_results_wip.Colors, Position=0, Scale=1.5)
frequencies_hz = Panel(natural_vibration.Frequencies)
what_is_drawn = Panel(view_results_wip.Info)
opensees_log = Panel(natural_vibration.Log)
