# Grasshopper definition PerforatedBeam.gh (Grasshopper 1.0.8)
# plug-ins: Alpaca4d

# ---- group: 1 - The beam in tetrahedra: nodes, and four nodes per tetrahedron
# Beam with holes: A steel beam with holes, pushed past the load at which it starts to yield.
# 
# A simply supported S355 beam 2.4 m long, 300 mm deep and 80 mm thick, with six round holes 180 mm across, loaded at midspan: 7478 ten node tetrahedra on 2526 corners.
# 
# 1. The tetrahedra come as gmsh wrote them: the nodes, and four node numbers per tetrahedron.
# 2. The steel is the nD component's J2Plasticity unit: elastic until the Von Mises stress reaches Fy = 355 MPa, then it yields and the load moves to the steel around it.
# 3. It rests on its end faces, which carry the shear and turn; one node holds it along.
# 4. 740 kN on a strip across the top at midspan, in a Load Pattern with a Linear Time Series, so that it grows step by step.
# 6. Newton and 20 steps of Load Control: a material that yields needs the load in steps.
# 7. Model View draws the Von Mises stress in Alpaca4d's colours, with the steel at or near yield orange. Move Step to watch the yielding start at the holes next to midspan and spread.
# 8. The load-deflection curve leaves the straight line where the steel starts to yield and flattens as the yielding spreads: the beam is pushed well past first yield.
nodes = Point([Point(0.35, 0.08, 0.24), Point(0.35, 0, 0.24), Point(0.69, 0.08, 0.24), Point(0.69, 0, 0.24), Point(1.03, 0.08, 0.24), Point(1.03, 0, 0.24)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])
tetrahedra = Integer(Tree({0}: [1281, 779, 151, 1069], {1}: [2299, 2260, 2300, 2212], {2}: [2299, 2301, 2274, 1138], {3}: [2300, 866, 844, 877], {4}: [2300, 1482, 1423, 2212], {5}: [2300, 817, 1125, 855]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))
four_faces = MeshFace([{A=0, B=1, C=2, D=2}, {A=0, B=3, C=1, D=1}, {A=1, B=3, C=2, D=2}, {A=2, B=3, C=0, D=0}])
corners = ListItem(List=nodes, Index=tetrahedra, Wrap=True)
tetrahedra_2 = ConstructMesh(Vertices=corners, Faces=four_faces)

# ---- group: 2 - S355 that yields - J2Plasticity - in Ten Node Tetrahedra
steel = Panel("S355")
e_kn_m2 = Panel("210000000")
poisson = Panel("0.3")
fy_kn_m2 = Panel("355000")
h_kn_m2 = Panel("0")
density_kg_m3 = Panel("7850")
s355_yielding = ND(MaterialName=steel, E=e_kn_m2, Ν=poisson, Fy=fy_kn_m2, H=h_kn_m2, Rho=density_kg_m3, mode="J2Plasticity (Alpaca4d)")
ten_node_tetrahedron = TenNodeTetrahedronAlpaca4d(Mesh=tetrahedra_2, Material=s355_yielding)  # -> Element, Points

# ---- group: 3 - Simply supported on its end faces; one node holds it along
element_nodes = Point(flatten(ten_node_tetrahedron.Points))
x_y_z = Deconstruct(Point=element_nodes)  # -> XComponent, YComponent, ZComponent
midspan_underside = Point(Point(1.2, 0.04, 0))
at_either_end = Expression(x=x_y_z.XComponent, Expression="Abs(x-1.2)>1.1995")
end_faces = CullPattern(List=element_nodes, CullPattern=at_either_end)
its_node = ClosestPoint(Point=midspan_underside, Cloud=element_nodes)  # -> ClosestPoint, CPIndex, Distance
once_each = CullDuplicates(Points=end_faces, Tolerance=0.0001, CullMode=3)  # -> Points, Indices, Valence
held = BooleanToggle(True)
free = BooleanToggle(False)
end_faces_y_and_z = SupportAlpaca4d(Position=once_each.Points, Tx=free, Ty=held, Tz=held, Rx=free, Ry=free, Rz=free, mode="Support Rigid (Alpaca4d)")
midspan_x = SupportAlpaca4d(Position=its_node.ClosestPoint, Tx=held, Ty=free, Tz=free, Rx=free, Ry=free, Rz=free, mode="Support Rigid (Alpaca4d)")

# ---- group: 4 - 740 kN on a strip across the top at midspan, growing with the steps
in_the_load_strip = Expression(x=x_y_z.XComponent, z=x_y_z.ZComponent, Expression="(Abs(x-1.2)<0.0501) And (z>0.2999)")
strip = CullPattern(List=element_nodes, CullPattern=in_the_load_strip)
once_each_2 = CullDuplicates(Points=strip, Tolerance=0.0001, CullMode=3)  # -> Points, Indices, Valence
how_many = ListLength(List=once_each_2.Points)
load_kn = Panel("740")
each_node_s_share = Expression(p=load_kn, n=how_many, Expression="-p/n")
down = Multiply(Vector=Vector(0, 0, 1), Factor=each_node_s_share)  # -> Vector, Length
grows_with_the_steps = LinearTimeSeriesAlpaca4d(LinearFactor=1)  # -> TimeSeries, Graph
load_strip = PointLoadAlpaca4d(Point=once_each_2.Points, Force=down.Vector, Moment=Vector(0, 0, 0))
load_pattern = LoadPatternAlpaca4d(TimeSeries=grows_with_the_steps.TimeSeries, Loads=flatten(load_strip), Factor=1, mode="PlainPattern (Alpaca4d)")

# ---- group: 5 - Assemble Model
assemble_model = AssembleModelAlpaca4d(
    Elements=flatten(ten_node_tetrahedron.Element),
    Supports=flatten([end_faces_y_and_z, midspan_x]),
    LoadPatterns=flatten(load_pattern),
    Tolerance=0.001)  # -> AlpacaModel, Mass
beam_at_rest = ModelViewAlpaca4d(AlpacaModel=assemble_model.AlpacaModel, Step=0, FittedLoads=True)  # -> AlpacaModel, Geometry, Info, Values, Colors

# ---- group: 6 - Pushed in 20 steps of 37 kN, past the load it starts to yield at
test = TestAlpaca4d(Tolerance=1e-08, Iteration=30, Flag=0, Norm=2, mode="NormDispIncr")
load_control = IntegratorAlpaca4d(Lambda=0.05, mode="LoadControl")
_20_steps = AnalysisStepAlpaca4d(NumIncr=20)
analysis_settings = AnalysisSettingsAlpaca4d(
    Constraint="Transformation",
    Numberer="RCM",
    System="Auto",
    Test=test,
    Algorithm="Newton",
    Integrator=load_control,
    AnalysisType="Static",
    AnalysisSteps=_20_steps,
    Cores=0)
run_analysis = RunAnalysisAlpaca4d(AlpacaModel=assemble_model.AlpacaModel, Settings=analysis_settings, settings=True)  # -> AlpacaModel, Log

# ---- group: 8 - The load-deflection curve: blue while elastic, orange after
nodal_displacements = NodalDisplacementsAlpaca4d(AlpacaModel=run_analysis.AlpacaModel, History=True, Step=0)  # -> Position, Displacement, Rotation, port, Velocity, AngularVelocity, Acceleration, AngularAcceleration
brick_stresses = BrickStressesAlpaca4d(AlpacaModel=run_analysis.AlpacaModel, History=True, Step=0, Axes=0)  # -> Sigma11, Sigma22, Sigma33, Sigma12, Sigma23, Sigma13, VonMises, Element, Plane
load_deflection = GhPythonScript(
    Positions=nodal_displacements.Position,
    Displacements=nodal_displacements.Displacement,
    VonMises=brick_stresses.VonMises,
    Load=load_kn,
    Lambda=0.05,
    Fy=355000,
    Origin=Point(0, 0, -1),
    Width=2.4,
    Height=0.7)  # -> out, Elastic, Yielding, Axes, Summary, Deflection, Load, YieldDeflection, YieldLoad; inputs Positions: tree of Point3d, Displacements: tree of Vector3d, VonMises: tree, Origin: Point3d
# ---------- load_deflection: Python ----------
"""The load-deflection curve of the PerforatedBeam.py example, in a GhPython component.

Reads the deflection at the middle of the beam's underside at every step, and the largest Von Mises
stress at every step, and draws the curve: blue while every point is elastic, orange from the step
the steel starts to yield. Written for both Python 3 (Rhino 8) and IronPython 2.7 (Rhino 7)."""
import Rhino.Geometry as rg

# The beam: where its midspan underside is, m.
MIDSPAN = rg.Point3d(1.2, 0.04, 0.0)


def branches(tree):
    """A tree's branches as lists, in path order."""
    return [list(tree.Branch(i)) for i in range(tree.BranchCount)]


def load_deflection(Positions, Displacements, VonMises, Load, Lambda, Fy, Origin, Width, Height):
    positions = branches(Positions)
    displacements = branches(Displacements)
    stresses = branches(VonMises)
    if not positions or not displacements:
        return None, None, None, "Run the analysis first.", [], [], None, None

    # The node nearest the middle of the underside, the same at every step.
    nodes = positions[0]
    node = min(range(len(nodes)), key=lambda i: nodes[i].DistanceTo(MIDSPAN))

    steps = len(displacements)
    deflection = [0.0] + [-1000.0 * displacements[s][node].Z for s in range(steps)]        # mm
    load = [0.0] + [(s + 1) * Lambda * Load for s in range(steps)]                         # kN
    peak = [0.0] + [max(stresses[s]) if s < len(stresses) and stresses[s] else 0.0 for s in range(steps)]

    # The first step any point reaches Fy, and where between it and the step before the first
    # point got there: the stresses grow with the load until then, so the last elastic step scales.
    first = next((s for s in range(1, steps + 1) if peak[s] >= 0.999 * Fy), None)

    origin = Origin if Origin is not None else rg.Point3d(0.0, 0.0, -1.0)
    sx = Width / max(deflection)
    sy = Height / max(load)

    def point(d, p):
        return rg.Point3d(origin.X + d * sx, origin.Y, origin.Z + p * sy)

    axes = [rg.Line(origin, point(max(deflection) * 1.08, 0.0)), rg.Line(origin, point(0.0, max(load) * 1.08))]

    if first is None:
        elastic = rg.PolylineCurve([point(d, p) for d, p in zip(deflection, load)])
        return (elastic, None, axes, "Elastic all the way to {0:.0f} kN: no point reached Fy.".format(load[-1]),
                deflection, load, None, None)

    before = first - 1
    scale = Fy / peak[before] if peak[before] > 0 else 1.0
    yield_load = load[before] * scale if before > 0 else load[first]
    yield_deflection = deflection[before] * scale if before > 0 else deflection[first]
    elastic = rg.PolylineCurve([point(deflection[s], load[s]) for s in range(first)] + [point(yield_deflection, yield_load)])
    # Curves, not Polylines: GhPython hands a Polyline out as its list of points.
    plastic = rg.PolylineCurve([point(yield_deflection, yield_load)] + [point(deflection[s], load[s]) for s in range(first, steps + 1)])

    summary = ("First yield at {0:.0f} kN, {1:.1f} mm, between steps {2} and {3}.\n"
               "Pushed on to {4:.0f} kN, {5:.0%} more, where it sags {6:.1f} mm: {7:.1f} times as far as at first yield, "
               "{8:.1f} times as far as it would if it stayed elastic.").format(
        yield_load, yield_deflection, before, first, load[-1], load[-1] / yield_load - 1.0, deflection[-1],
        deflection[-1] / yield_deflection, deflection[-1] / (yield_deflection * load[-1] / yield_load))
    return elastic, plastic, axes, summary, deflection, load, yield_deflection, yield_load


Elastic, Yielding, Axes, Summary, Deflection, Load, YieldDeflection, YieldLoad = load_deflection(Positions, Displacements, VonMises, Load, Lambda, Fy, Origin, Width, Height)
# ---------- end load_deflection ----------
elastic = CustomPreview(
    Geometry=load_deflection.Elastic,
    Material={diffuse=RGB(66, 136, 247), emission=RGB(20, 41, 74), shine=0.5, specular=RGB(255, 254, 255), transparency=0})
yielding = CustomPreview(
    Geometry=load_deflection.Yielding,
    Material={diffuse=RGB(235, 108, 63), emission=RGB(70, 32, 19), shine=0.5, specular=RGB(255, 254, 255), transparency=0})
axes = CustomPreview(
    Geometry=load_deflection.Axes,
    Material={diffuse=RGB(42, 45, 49), emission=RGB(13, 14, 15), shine=0.5, specular=RGB(255, 254, 255), transparency=0})
summary = Panel(load_deflection.Summary)

# ---- group: 7 - Von Mises, step by step: orange where the steel yields
step = Slider(19, range=0..19)
range_mpa = Panel("0 To 355")
beam_pushed = ModelViewAlpaca4d(
    AlpacaModel=run_analysis.AlpacaModel,
    Step=step,
    Colors=[RGB(228, 238, 254), RGB(196, 218, 253), RGB(163, 197, 251), RGB(131, 177, 250), RGB(98, 156, 248), RGB(66, 136, 247), RGB(84, 119, 241), RGB(103, 103, 235), RGB(121, 86, 230), RGB(140, 70, 224), RGB(158, 53, 218), RGB(235, 108, 63)],
    Range=range_mpa,
    FittedLoads=True)  # -> AlpacaModel, Geometry, Info, Values, Colors
title = Panel("Von Mises [MPa], orange: yielding")
beam_pushed_legend = LegendAlpaca4d(Title=title, Values=beam_pushed.Values, Colors=beam_pushed.Colors, Position=0, Scale=1.5)
what_is_drawn = Panel(beam_pushed.Info)
opensees_log = Panel(run_analysis.Log)
