# Grasshopper definition PlasticityTJoint.gh (Grasshopper 1.0.8)
# plug-ins: Alpaca4d

# ---- group: 1 - Pipe T-joint: the mesh, as gmsh wrote it
nodes = Point([Point(0.971, 0, 0.145), Point(1.8, 0, 0.145), Point(0.829, 0, 0.145), Point(0, 0, 0.145), Point(0.971, 0, 0.54), Point(0.971, 0, 0.6)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])
chord_300_x_10_faces = MeshFace([{A=233, B=235, C=137, D=234}, {A=251, B=93, C=94, D=252}, {A=265, B=73, C=72, D=266}, {A=267, B=269, C=270, D=268}, {A=277, B=276, C=278, D=275}, {A=272, B=274, C=279, D=273}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])
brace_150_x_8_faces = MeshFace([{A=1930, B=1931, C=170, D=169}, {A=1943, B=2292, C=1944, D=1942}, {A=1940, B=1941, C=1948, D=2355}, {A=1962, B=1964, C=162, D=1963}, {A=1952, B=1950, C=154, D=153}, {A=1979, B=152, C=153, D=1980}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])
brace_end_elastic_faces = MeshFace([{A=226, B=168, C=227, D=227}, {A=168, B=226, C=4, D=4}, {A=206, B=173, C=174, D=174}, {A=173, B=206, C=172, D=172}, {A=210, B=179, C=180, D=180}, {A=179, B=210, C=178, D=178}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])
chord_300_x_10 = ConstructMesh(Vertices=nodes, Faces=chord_300_x_10_faces)
brace_150_x_8 = ConstructMesh(Vertices=nodes, Faces=brace_150_x_8_faces)
brace_end_elastic = ConstructMesh(Vertices=nodes, Faces=brace_end_elastic_faces)

# ---- group: 2 - S355 that yields - J2Plasticity
steel = Panel("S355")
e_kn_m2 = Panel("210000000")
poisson = Panel("0.3")
fy_kn_m2 = Panel("355000")
h_kn_m2 = Panel("0")
density_kg_m3 = Panel("7850")
# Pipe T-joint: A T-joint of two steel tubes, pushed past the load at which it starts to yield.
# 
# A brace 150 x 8 mm stands on a chord 300 x 10 mm, 1.8 m long, both S355, as 2434 ASD Shells through the middle of their walls. The chord's wall runs on inside the brace's foot, as a welded joint's does.
# 
# 1. The shells as gmsh wrote them: the nodes, and the corners of each face, by part.
# 2. J2Plasticity, in a Layered Shell of ten layers for each tube; the brace's top 60 mm stays elastic and 30 mm thick, as the end plate the load comes in through makes it. Each part its own Local X, along its tube.
# 3. The chord's two ends held, every node of the ring.
# 4. 640 kN down the brace, shared among the nodes of its top, on a Linear Time Series.
# 6. Newton and 20 steps of Load Control.
# 7. The chord's wall yields first at the brace's saddles and crowns, then round its whole foot.
# 8. EN 1993-1-8 gives this joint 388 kN for chord face failure; its limit is a deformation, 3% of the chord's diameter, 9 mm.
s355_yielding = ND(MaterialName=steel, E=e_kn_m2, Ν=poisson, Fy=fy_kn_m2, H=h_kn_m2, Rho=density_kg_m3, mode="J2Plasticity (Alpaca4d)")
chord_300_x_10_2 = LayeredShellSectionAlpaca4d(
    SectionName="Chord 300 x 10",
    Material=s355_yielding,
    Thickness=[0.001, 0.001, 0.001, 0.001, 0.001, 0.001, 0.001, 0.001, 0.001, 0.001])
brace_150_x_8_2 = LayeredShellSectionAlpaca4d(
    SectionName="Brace 150 x 8",
    Material=s355_yielding,
    Thickness=[0.0008, 0.0008, 0.0008, 0.0008, 0.0008, 0.0008, 0.0008, 0.0008, 0.0008, 0.0008])
steel_elastic = ND(E=210000000, G=80770000, Ν=0.3, Rho=7850, mode="ElasticIsotropic (Alpaca4d)")
brace_end_elastic_2 = PlateFiberSectionAlpaca4d(SectionName="Brace end, elastic", Thickness=0.03, Material=steel_elastic)
chord_300_x_10_3 = ASDShellAlpaca4d(Mesh=chord_300_x_10, Section=chord_300_x_10_2, LocalXAxis=Vector(1, 0, 0), IsCorotational=False)
brace_150_x_8_3 = ASDShellAlpaca4d(Mesh=brace_150_x_8, Section=brace_150_x_8_2, LocalXAxis=Vector(0, 0, 1), IsCorotational=False)
brace_end_elastic_3 = ASDShellAlpaca4d(Mesh=brace_end_elastic, Section=brace_end_elastic_2, LocalXAxis=Vector(0, 0, 1), IsCorotational=False)

# ---- group: 3 - Supports
x_y_z = Deconstruct(Point=nodes)  # -> XComponent, YComponent, ZComponent
chord_ends = Expression(x=x_y_z.XComponent, Expression="(x<1e-06) Or (x>1.799999)")
chord_ends_2 = CullPattern(List=nodes, CullPattern=chord_ends)
held = BooleanToggle(True)
free = BooleanToggle(False)
chord_ends_x_y_z = SupportAlpaca4d(Position=chord_ends_2, Tx=held, Ty=held, Tz=held, Rx=free, Ry=free, Rz=free, mode="Support Rigid (Alpaca4d)")

# ---- group: 4 - The load, growing with the steps
on_the_brace_s_top = Expression(z=x_y_z.ZComponent, Expression="z>0.599999")
brace_top = CullPattern(List=nodes, CullPattern=on_the_brace_s_top)
load_kn = Panel("640")
how_many = ListLength(List=brace_top)
each_node_s_share = Expression(p=load_kn, n=how_many, Expression="-p/n")
down = Multiply(Vector=Vector(0, 0, 1), Factor=each_node_s_share)  # -> Vector, Length
grows_with_the_steps = LinearTimeSeriesAlpaca4d(LinearFactor=1)  # -> TimeSeries, Graph
brace_top_2 = PointLoadAlpaca4d(Point=brace_top, Force=down.Vector, Moment=Vector(0, 0, 0))
load_pattern = LoadPatternAlpaca4d(TimeSeries=grows_with_the_steps.TimeSeries, Loads=flatten(brace_top_2), Factor=1, mode="PlainPattern (Alpaca4d)")

# ---- group: 5 - Assemble Model
assemble_model = AssembleModelAlpaca4d(
    Elements=flatten([chord_300_x_10_3, brace_150_x_8_3, brace_end_elastic_3]),
    Supports=flatten(chord_ends_x_y_z),
    LoadPatterns=flatten(load_pattern),
    Tolerance=0.0005)  # -> AlpacaModel, Mass
model_at_rest = ModelViewAlpaca4d(AlpacaModel=assemble_model.AlpacaModel, Step=0, FittedLoads=True)  # -> AlpacaModel, Geometry, Info, Values, Colors

# ---- group: 6 - Pushed in 20 steps, past the load it starts to yield at
test = TestAlpaca4d(Tolerance=1e-06, Iteration=50, Flag=0, Norm=2, mode="NormDispIncr")
load_control = IntegratorAlpaca4d(Lambda=0.05, mode="LoadControl")
_20_steps = AnalysisStepAlpaca4d(NumIncr=20)
analysis_settings = AnalysisSettingsAlpaca4d(
    Constraint="Transformation",
    Numberer="RCM",
    System="Auto",
    Test=test,
    Algorithm="Newton",
    Integrator=load_control,
    AnalysisType="Static",
    AnalysisSteps=_20_steps,
    Cores=0)
run_analysis = RunAnalysisAlpaca4d(AlpacaModel=assemble_model.AlpacaModel, Settings=analysis_settings, settings=True)  # -> AlpacaModel, Log

# ---- group: 8 - The load-displacement curve: blue while elastic, orange after
nodal_displacements = NodalDisplacementsAlpaca4d(AlpacaModel=run_analysis.AlpacaModel, History=True, Step=0)  # -> Position, Displacement, Rotation, port, Velocity, AngularVelocity, Acceleration, AngularAcceleration
shell_stresses = ShellStressesAlpaca4d(AlpacaModel=run_analysis.AlpacaModel, History=True, Step=0)  # -> Sigma11, Sigma22, Sigma12, Sigma23, Sigma31, VonMises, Layer, Element
load_displacement = GhPythonScript(
    Positions=nodal_displacements.Position,
    Displacements=nodal_displacements.Displacement,
    VonMises=shell_stresses.VonMises,
    Load=load_kn,
    Lambda=0.05,
    Fy=355000,
    Origin=Point(2.1, 0, -0.145),
    XAxis=Vector(1, 0, 0),
    YAxis=Vector(0, 0, 1),
    Width=1,
    Height=0.75,
    Point=Point(0.9, 0, 0.6),
    Direction=Vector(0, 0, -1),
    Unit="kN",
    Scale=1)  # -> out, Elastic, Yielding, Axes, Summary, Deflection, Load, YieldDeflection, YieldLoad; inputs Positions: tree of Point3d, Displacements: tree of Vector3d, VonMises: tree, Origin: Point3d, XAxis: Vector3d, YAxis: Vector3d, Point: Point3d, Direction: Vector3d, Unit: String
# ---------- load_displacement: Python ----------
"""The load-displacement curve of the Plasticity.py examples, in a GhPython component.

Reads, at every step, how far one node has moved along a direction and the largest Von Mises
stress, and draws the curve in a plane: blue while every point is elastic, orange from the step the
steel starts to yield, in the plane through Origin along XAxis and YAxis. Shell stresses come a branch per {step; element; layer} and brick stresses a
branch per {step}: the stresses are grouped by the first number of their path. It also hands out the
numbers - the displacement (mm) and the load at rest and at every step, in Unit, and first yield's -
for a chart. Written for both Python 3 (Rhino 8) and IronPython 2.7 (Rhino 7)."""
import Rhino.Geometry as rg


def load_displacement(Positions, Displacements, VonMises, Load, Lambda, Fy, Origin, XAxis, YAxis, Width, Height, Point, Direction, Unit, Scale):
    if Positions is None or Positions.BranchCount == 0 or Displacements is None or Displacements.BranchCount == 0:
        return None, None, None, "Run the analysis first.", [], [], None, None
    scale = Scale if Scale else 1.0
    unit = Unit or "kN"

    # The node nearest Point, the same at every step, and how far it moves along Direction.
    nodes = list(Positions.Branch(0))
    node = min(range(len(nodes)), key=lambda i: nodes[i].DistanceTo(Point))
    along = rg.Vector3d(Direction)
    along.Unitize()
    steps = Displacements.BranchCount
    moved = [0.0] + [1000.0 * (Displacements.Branch(s)[node] * along) for s in range(steps)]       # mm
    load = [0.0] + [(s + 1) * Lambda * Load * scale for s in range(steps)]

    # The largest stress at each step, whatever else the path holds after the step.
    peak = [0.0] * (steps + 1)
    for i in range(VonMises.BranchCount):
        s = VonMises.Paths[i].Indices[0]
        values = list(VonMises.Branch(i))
        if values and s < steps:
            peak[s + 1] = max(peak[s + 1], max(values))

    first = next((s for s in range(1, steps + 1) if peak[s] >= 0.999 * Fy), None)

    # Made here, in Rhino: a Plane takes Rhino's own geometry code to be made.
    plane = rg.Plane(Origin, XAxis, YAxis) if Origin is not None and XAxis is not None and YAxis is not None else rg.Plane.WorldZX
    sx = Width / max(max(moved), 1e-12)
    sy = Height / max(max(load), 1e-12)

    def at(d, p):
        return plane.PointAt(d * sx, p * sy)

    axes = [rg.Line(at(0.0, 0.0), at(max(moved) * 1.08, 0.0)), rg.Line(at(0.0, 0.0), at(0.0, max(load) * 1.08))]

    if first is None:
        elastic = rg.PolylineCurve([at(d, p) for d, p in zip(moved, load)])
        return (elastic, None, axes, "Elastic all the way to {0:.4g} {1}: no point reached Fy.".format(load[-1], unit),
                moved, load, None, None)

    before = first - 1
    k = Fy / peak[before] if before > 0 and peak[before] > 0 else 1.0
    yield_load = load[before] * k if before > 0 else load[first]
    yield_moved = moved[before] * k if before > 0 else moved[first]
    # Curves, not Polylines: GhPython hands a Polyline out as its list of points.
    elastic = rg.PolylineCurve([at(moved[s], load[s]) for s in range(first)] + [at(yield_moved, yield_load)])
    plastic = rg.PolylineCurve([at(yield_moved, yield_load)] + [at(moved[s], load[s]) for s in range(first, steps + 1)])

    summary = ("First yield at {0:.4g} {9}, {1:.3g} mm, between steps {2} and {3}.\n"
               "Pushed on to {4:.4g} {9}, {5:.0%} more, where it has moved {6:.3g} mm: {7:.1f} times as far as at first "
               "yield, {8:.1f} times as far as it would if it stayed elastic.").format(
        yield_load, yield_moved, before, first, load[-1], load[-1] / yield_load - 1.0, moved[-1],
        moved[-1] / yield_moved, moved[-1] / (yield_moved * load[-1] / yield_load), unit)
    return elastic, plastic, axes, summary, moved, load, yield_moved, yield_load


Elastic, Yielding, Axes, Summary, Deflection, Load, YieldDeflection, YieldLoad = load_displacement(Positions, Displacements, VonMises, Load, Lambda, Fy, Origin, XAxis, YAxis, Width, Height, Point, Direction, Unit, Scale)
# ---------- end load_displacement ----------
elastic = CustomPreview(
    Geometry=load_displacement.Elastic,
    Material={diffuse=RGB(66, 136, 247), emission=RGB(20, 41, 74), shine=0.5, specular=RGB(255, 254, 255), transparency=0})
yielding = CustomPreview(
    Geometry=load_displacement.Yielding,
    Material={diffuse=RGB(235, 108, 63), emission=RGB(70, 32, 19), shine=0.5, specular=RGB(255, 254, 255), transparency=0})
axes = CustomPreview(
    Geometry=load_displacement.Axes,
    Material={diffuse=RGB(42, 45, 49), emission=RGB(13, 14, 15), shine=0.5, specular=RGB(255, 254, 255), transparency=0})
summary = Panel(load_displacement.Summary)

# ---- group: 7 - Von Mises, step by step: orange where the steel yields
step = Slider(19, range=0..19)
range_mpa = Panel("0 To 355")
steel_pushed = ModelViewAlpaca4d(
    AlpacaModel=run_analysis.AlpacaModel,
    Step=step,
    Colors=[RGB(228, 238, 254), RGB(196, 218, 253), RGB(163, 197, 251), RGB(131, 177, 250), RGB(98, 156, 248), RGB(66, 136, 247), RGB(84, 119, 241), RGB(103, 103, 235), RGB(121, 86, 230), RGB(140, 70, 224), RGB(158, 53, 218), RGB(235, 108, 63)],
    Range=range_mpa,
    FittedLoads=True)  # -> AlpacaModel, Geometry, Info, Values, Colors
title = Panel("Von Mises [MPa], orange: yielding")
steel_pushed_legend = LegendAlpaca4d(Title=title, Values=steel_pushed.Values, Colors=steel_pushed.Colors, Position=0, Scale=1.5)
what_is_drawn = Panel(steel_pushed.Info)
opensees_log = Panel(run_analysis.Log)
