# Grasshopper definition PlaygroundBarnStart.gh (Grasshopper 1.0.7)
# plug-ins: Galapagos, Kangaroo2 Components, Alpaca4d

# ---- group: 1 - The frame
span = Slider(6, range=1..12)
height = Slider(4, range=1..8)
# The Barn - start: The Barn - lesson 4 of the Alpaca4d docs, the start.
# 
# The portal frame's three lines, two posts 4 m tall and a beam 6 m long, and their section, C24 timber 200 x 300 mm. Add the elements, the footings, the knees, the wind and the analysis as the lesson's steps say.
base_a = ConstructPoint(XCoordinate=0, YCoordinate=0, ZCoordinate=0)
top_a = ConstructPoint(XCoordinate=0, YCoordinate=0, ZCoordinate=height)
top_b = ConstructPoint(XCoordinate=span, YCoordinate=0, ZCoordinate=height)
base_b = ConstructPoint(XCoordinate=span, YCoordinate=0, ZCoordinate=0)
post_a = Line(StartPoint=base_a, EndPoint=top_a)
beam_line = Line(StartPoint=top_a, EndPoint=top_b)
post_b = Line(StartPoint=base_b, EndPoint=top_b)

# ---- group: 2 - The section
width = Slider(0.2, range=0..1)
depth = Slider(0.3, range=0..1)
grade = Panel("C24")
material_library_elastic = MaterialLibraryElasticAlpaca4d(
    MaterialName=grade,
    MaterialPresetElastic_Grade="S235",
    MaterialPresetElastic_Model="Uniaxial",
    MaterialPresetElastic_Type="Steel",
    menu=[dropdown(0), dropdown(1), dropdown(0)])
rectanglecs = RectangleCSAlpaca4d(Width=width, Height=depth, Material=material_library_elastic)
