# Grasshopper definition PlaygroundCliffStart.gh (Grasshopper 1.0.7)
# plug-ins: Galapagos, Kangaroo2 Components, Alpaca4d

# ---- group: 1 - The balcony
# The Cliff - start: The Cliff - lesson 2 of the Alpaca4d docs, the start.
# 
# The balcony: the River's C24 plank, 300 x 50 mm lying flat, as one element from the Root at the cliff's edge to the Tip, 4 m out along X. Add the support, the alpaca, the model and the analysis as the lesson's steps say.
span = Slider(4, range=-8..8)
plank_width = Slider(0.3, range=0..1)
plank_thickness = Slider(0.05, range=0..1)
grade = Panel("C24")
root = ConstructPoint(XCoordinate=0, YCoordinate=0, ZCoordinate=0)
tip = ConstructPoint(XCoordinate=span, YCoordinate=0, ZCoordinate=0)
material_library_elastic = MaterialLibraryElasticAlpaca4d(
    MaterialName=grade,
    MaterialPresetElastic_Grade="S235",
    MaterialPresetElastic_Model="Uniaxial",
    MaterialPresetElastic_Type="Steel",
    menu=[dropdown(0), dropdown(1), dropdown(0)])
balcony_line = Line(StartPoint=root, EndPoint=tip)
rectanglecs = RectangleCSAlpaca4d(Width=plank_width, Height=plank_thickness, Material=material_library_elastic)
balcony = ForceBeamColumnAlpaca4d(Line=balcony_line, Section=rectanglecs, Colour=RGB(1, 30, 254), mode="ForceBeamColumn (Alpaca4d)")
