# Grasshopper definition PlaygroundFootbridge.gh (Grasshopper 1.0.7)
# plug-ins: Galapagos, Kangaroo2 Components, Alpaca4d

# ---- group: 1 - The deck
# The Footbridge: The Footbridge - lesson 8 of the Alpaca4d Playground.
# 
# A C24 timber deck, 1.2 m wide and 120 mm deep, across 10 m, on a pin and a roller, with a herd of alpacas on it, 60 kg every metre. As built it bounces at 1.94 Hz, the pace of walking; the pier at mid-span makes it 7.75 Hz.
# 
# Check it by hand: f = pi / (2 L^2) x sqrt(EI / m), with EI = 1 814 kN m2 and m = 410 x 1.2 x 0.12 + 60 = 119 kg/m: 1.94 Hz for L = 10 m, four times that for 5 m.
# 
# Try: unwire the pier from Assemble Model, make the deck deeper, or move Alpaca mass.
deck_width = Slider(1.2, range=0..3)
deck_depth = Slider(0.12, range=0..1)
grade = Panel("C24")
material_library_elastic = MaterialLibraryElasticAlpaca4d(
    MaterialName=grade,
    MaterialPresetElastic_Grade="S235",
    MaterialPresetElastic_Model="Uniaxial",
    MaterialPresetElastic_Type="Steel",
    menu=[dropdown(0), dropdown(1), dropdown(0)])
rectanglecs = RectangleCSAlpaca4d(Width=deck_width, Height=deck_depth, Material=material_library_elastic)

# ---- group: 2 - The span
span = Slider(10, range=1..20)
bank_a = ConstructPoint(XCoordinate=0, YCoordinate=0, ZCoordinate=0)
bank_b = ConstructPoint(XCoordinate=span, YCoordinate=0, ZCoordinate=0)
deck_line = Line(StartPoint=bank_a, EndPoint=bank_b)
elements = Slider(10, range=1..20)
divide = DivideCurve(Curve=deck_line, Count=elements, Kinks=False)  # -> Points, Tangents, Parameters
shatter = Shatter(Curve=deck_line, Parameters=divide.Parameters)
deck = ForceBeamColumnAlpaca4d(Line=shatter, Section=rectanglecs, Colour=RGB(1, 30, 254), mode="ForceBeamColumn (Alpaca4d)")

# ---- group: 3 - The abutments
free = BooleanToggle(False)
pin = SupportAlpaca4d(Position=bank_a, Tx=True, Ty=True, Tz=True, Rx=True, Ry=free, Rz=free, mode="Support Rigid (Alpaca4d)")
roller = SupportAlpaca4d(Position=bank_b, Tx=free, Ty=True, Tz=True, Rx=True, Ry=free, Rz=free, mode="Support Rigid (Alpaca4d)")

# ---- group: 4 - The herd
alpaca_mass = Slider(60, range=0..200)
each_alpaca = VectorXYZ(XComponent=alpaca_mass, YComponent=alpaca_mass, ZComponent=alpaca_mass)  # -> Vector, Length
herd = MassPointAlpaca4d(Point=divide.Points, TransMass=each_alpaca.Vector, RotationalMass=Vector(0, 0, 0))

# ---- group: 7 - The pier
mid_span = CurveMiddle(Curve=deck_line)
pier = SupportAlpaca4d(Position=mid_span, Tx=free, Ty=True, Tz=True, Rx=True, Ry=free, Rz=free, mode="Support Rigid (Alpaca4d)")

# ---- group: 5 - Assemble
assemble_model = AssembleModelAlpaca4d(Elements=deck, Supports=[pin, roller, pier], LoadPatterns=herd, Tolerance=0.01)  # -> AlpacaModel, Mass

# ---- group: 6 - Natural vibration
modes = Slider(3, range=1..10)
natural_vibration = NaturalVibrationAnalysisAlpaca4d(AlpacaModel=assemble_model.AlpacaModel, VibrationModes=modes, Solver="-genBandArpack")  # -> AlpacaModel, Eigenvalues, Period, Frequencies, Log, EigenValueAnalysis, TotalMassOfStructure, TotalFreeMass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
frequencies = Panel(natural_vibration.Frequencies)
the_deck = ModelViewAlpaca4d(AlpacaModel=natural_vibration.AlpacaModel, Step=0, FittedLoads=True)  # -> AlpacaModel, Geometry, Info, Values, Colors
