# Grasshopper definition PlaygroundRiverStart.gh (Grasshopper 1.0.7)
# plug-ins: Galapagos, Kangaroo2 Components, Alpaca4d

# ---- group: 1 - The line
# The River - start: The River - lesson 1 of the Alpaca4d docs, the start.
# 
# The plank's line, 4 m along X from Bank A to Bank B, and its section, C24 timber 300 x 50 mm lying flat. Add the beam, the supports, the alpaca and the analysis as the lesson's steps say.
span = Slider(4, range=1..8)
bank_a = ConstructPoint(XCoordinate=0, YCoordinate=0, ZCoordinate=0)
bank_b = ConstructPoint(XCoordinate=span, YCoordinate=0, ZCoordinate=0)
plank_line = Line(StartPoint=bank_a, EndPoint=bank_b)

# ---- group: 2 - The section
plank_width = Slider(0.3, range=0..1)
plank_thickness = Slider(0.05, range=0..1)
grade = Panel("C24")
material_library_elastic = MaterialLibraryElasticAlpaca4d(
    MaterialName=grade,
    MaterialPresetElastic_Grade="S235",
    MaterialPresetElastic_Model="Uniaxial",
    MaterialPresetElastic_Type="Steel",
    menu=[dropdown(0), dropdown(1), dropdown(0)])
rectanglecs = RectangleCSAlpaca4d(Width=plank_width, Height=plank_thickness, Material=material_library_elastic)
