# Grasshopper definition PlaygroundRoofStart.gh (Grasshopper 1.0.7)
# plug-ins: Galapagos, Kangaroo2 Components, Alpaca4d

# ---- group: The section
# The Snowy roof - start: The Snowy roof - lesson 3 of the Alpaca4d docs, the start.
# 
# A C24 rafter of a flat roof, 75 x 100 mm, 4 m from Wall A to Wall B on a pin and a roller. Add the snow, its own weight and the analysis as the lesson's steps say, then find how deep it must be.
width = Slider(0.075, range=0..0.3)
depth = Slider(0.1, range=0..0.3)
grade = Panel("C24")
material_library_elastic = MaterialLibraryElasticAlpaca4d(
    MaterialName=grade,
    MaterialPresetElastic_Grade="S235",
    MaterialPresetElastic_Model="Uniaxial",
    MaterialPresetElastic_Type="Steel",
    menu=[dropdown(0), dropdown(1), dropdown(0)])
rectanglecs = RectangleCSAlpaca4d(Width=width, Height=depth, Material=material_library_elastic)

# ---- group: The rafter
span = Slider(4, range=1..8)
wall_a = ConstructPoint(XCoordinate=0, YCoordinate=0, ZCoordinate=0)
wall_b = ConstructPoint(XCoordinate=span, YCoordinate=0, ZCoordinate=0)
rafter_line = Line(StartPoint=wall_a, EndPoint=wall_b)
elements = Slider(4, range=1..10)
free = BooleanToggle(False)
divide = DivideCurve(Curve=rafter_line, Count=elements, Kinks=False)  # -> Points, Tangents, Parameters
shatter = Shatter(Curve=rafter_line, Parameters=divide.Parameters)
rafter = ForceBeamColumnAlpaca4d(Line=shatter, Section=rectanglecs, Colour=RGB(1, 30, 254), mode="ForceBeamColumn (Alpaca4d)")
pin = SupportAlpaca4d(Position=wall_a, Tx=True, Ty=True, Tz=True, Rx=True, Ry=free, Rz=free, mode="Support Rigid (Alpaca4d)")
roller = SupportAlpaca4d(Position=wall_b, Tx=free, Ty=True, Tz=True, Rx=True, Ry=free, Rz=free, mode="Support Rigid (Alpaca4d)")
