# Grasshopper definition PlaygroundTower.gh (Grasshopper 1.0.7)
# plug-ins: Galapagos, Kangaroo2 Components, Alpaca4d

# ---- group: 1 - The leg
# The Watchtower: The Watchtower - lesson 7 of the Alpaca4d Playground.
# 
# One leg of a steel watchtower: a tube 60.3 x 3.2 mm, S235, 6 m tall, pinned at the base, held sideways by the bracing at mid-height and by the platform at the top, which puts 8 kN on it.
# 
# Check it by hand: each half is 3 m, pinned at both ends. P_cr = pi^2 EI / L^2 = pi^2 x 210 000 000 x 2.347e-7 / 3^2 = 54.0 kN, 6.76 times 8 kN. Linear Buckling gives 6.83: with 8 pieces to a half wave it is 1.2 % high.
# 
# Try: let the bracing go (wire Free into the Brace's Tx and Ty) and the factor drops to a quarter, or set Divisions to 1 and nothing buckles at all.
height = Slider(6, range=1..10)
foot = ConstructPoint(XCoordinate=0, YCoordinate=0, ZCoordinate=0)
head = ConstructPoint(XCoordinate=0, YCoordinate=0, ZCoordinate=height)
leg_line = Line(StartPoint=foot, EndPoint=head)

# ---- group: 2 - The tube
outside_diameter = Slider(0.0603, range=0..0.2)
wall = Slider(0.0032, range=0..0.02)
grade = Panel("S235")
material_library_elastic = MaterialLibraryElasticAlpaca4d(
    MaterialName=grade,
    MaterialPresetElastic_Grade="S235",
    MaterialPresetElastic_Model="Uniaxial",
    MaterialPresetElastic_Type="Steel",
    menu=[dropdown(0), dropdown(1), dropdown(0)])
circlecs = CircleCSAlpaca4d(Diameter=outside_diameter, Thickness=wall, Material=material_library_elastic)

# ---- group: 3 - The beam
elements = Slider(2, range=1..10)
divide = DivideCurve(Curve=leg_line, Count=elements, Kinks=False)  # -> Points, Tangents, Parameters
shatter = Shatter(Curve=leg_line, Parameters=divide.Parameters)
leg = ForceBeamColumnAlpaca4d(Line=shatter, Section=circlecs, Colour=RGB(1, 30, 254), mode="ForceBeamColumn (Alpaca4d)")

# ---- group: 4 - The supports
free = BooleanToggle(False)
mid_height = CurveMiddle(Curve=leg_line)
top = SupportAlpaca4d(Position=head, Tx=True, Ty=True, Tz=free, Rx=free, Ry=free, Rz=free, mode="Support Rigid (Alpaca4d)")
brace = SupportAlpaca4d(Position=mid_height, Tx=True, Ty=True, Tz=free, Rx=free, Ry=free, Rz=free, mode="Support Rigid (Alpaca4d)")
base = SupportAlpaca4d(Position=foot, Tx=True, Ty=True, Tz=True, Rx=free, Ry=free, Rz=True, mode="Support Rigid (Alpaca4d)")

# ---- group: 5 - The platform
platform = Slider(-8, range=-10..10)
weight = UnitZ(Factor=platform)
the_platform = PointLoadAlpaca4d(Point=head, Force=weight, Moment=Vector(0, 0, 0))
load_pattern = LoadPatternAlpaca4d(Loads=the_platform, Factor=1, mode="PlainPattern (Alpaca4d)")

# ---- group: 6 - Assemble
assemble_model = AssembleModelAlpaca4d(Elements=leg, Supports=[top, brace, base], LoadPatterns=load_pattern, Tolerance=0.01)  # -> AlpacaModel, Mass

# ---- group: 7 - Buckle
divisions = Slider(8, range=1..16)
linear_buckling = LinearBucklingAnalysisAlpaca4d(AlpacaModel=assemble_model.AlpacaModel, BucklingModes=1, Divisions=divisions)  # -> AlpacaModel, LoadFactors, Log
load_factor = Panel(linear_buckling.LoadFactors)
the_leg = ModelViewAlpaca4d(AlpacaModel=linear_buckling.AlpacaModel, Step=0, FittedLoads=True)  # -> AlpacaModel, Geometry, Info, Values, Colors
