# Grasshopper definition PlaygroundWallStart.gh (Grasshopper 1.0.7)
# plug-ins: Galapagos, Kangaroo2 Components, Alpaca4d

# ---- group: 1 - The wall
length = Slider(5.5, range=1..10)
height = Slider(4, range=1..10)
# The Wall with a window - start: The Wall with a window - lesson 9 of the Alpaca4d docs, the start.
# 
# A concrete wall 5.5 m long, 4 m tall and 200 mm thick, with a window 1.5 m square: meshed into quads 0.25 m across, with a node on each point 0.5 m apart along its base and its top, and made of shells. Add the supports, the floor, the analysis and the stress lines as the lesson's steps say.
corner = ConstructPoint(XCoordinate=0, YCoordinate=0, ZCoordinate=0)
along = ConstructPoint(XCoordinate=length, YCoordinate=0, ZCoordinate=0)
up = ConstructPoint(XCoordinate=length, YCoordinate=0, ZCoordinate=height)
wall_outline = Rectangle3Pt(PointA=corner, PointB=along, PointC=up)  # -> Rectangle, Length
window = Rectangle3Pt(PointA=Point(2, 0, 1), PointB=Point(3.5, 0, 1), PointC=Point(3.5, 0, 2.5))  # -> Rectangle, Length
wall_surface = BoundarySurfaces(Edges=flatten([wall_outline.Rectangle, window.Rectangle]))

# ---- group: 2 - The mesh
explode = Explode(Curve=wall_outline.Rectangle, Recursive=True)  # -> Segments, Vertices
base_edge = ListItem(List=explode.Segments, Index=0, Wrap=True)
top_edge = ListItem(List=explode.Segments, Index=2, Wrap=True)
divisions = Slider(11, range=1..22)
base_points = DivideCurve(Curve=base_edge, Count=divisions, Kinks=False)  # -> Points, Tangents, Parameters
top_points = DivideCurve(Curve=top_edge, Count=divisions, Kinks=False)  # -> Points, Tangents, Parameters
edge_length = Slider(0.25, range=0..2)
mesh_brep = MeshBrepAlpaca4d(Breps=wall_surface, EdgeLength=edge_length, Points=flatten([base_points.Points, top_points.Points]))

# ---- group: 3 - The shell
concrete = ND(MaterialName="Concrete", E=33000000, G=13750000, Ν=0.2, Rho=2500, mode="ElasticIsotropic (Alpaca4d)")
thickness = Slider(0.2, range=0..1)
along_the_wall = UnitX(Factor=1)
_200_mm = PlateFiberSectionAlpaca4d(Thickness=thickness, Material=concrete)
wall = ASDShellAlpaca4d(Mesh=mesh_brep, Section=_200_mm, LocalXAxis=along_the_wall, IsCorotational=False)
