# Grasshopper definition PlaygroundBarn.gh (Grasshopper 1.0.7)
# plug-ins: Galapagos, Kangaroo2 Components, Alpaca4d

# ---- group: 1 - The frame
span = Slider(6, range=1..12)
height = Slider(4, range=1..8)
# The Barn: The Barn - lesson 4 of the Alpaca4d Playground.
# 
# A C24 timber portal frame, two posts 4 m tall and a beam 6 m long, 200 x 300 mm: the posts set in concrete footings, the beam bolted across their tops, so hinged at the knees, and 3 kN of wind at the top of the first post.
# 
# Check it by hand: each post is a cantilever pushed by half the wind, so the sway is H h^3 / 6EI = 3 x 4^3 / (6 x 10 500 000 x 0.2 x 0.3^3 / 12) = 6.8 mm. OpenSees gives 6.8 mm too; Model View draws it a hundred times bigger.
# 
# Try: unwire Free from the Knee, so that the knees are rigid, and the sway drops to 2.8 mm; or wire Free into both footings' Ry as well, and watch the frame fold.
base_a = ConstructPoint(XCoordinate=0, YCoordinate=0, ZCoordinate=0)
top_a = ConstructPoint(XCoordinate=0, YCoordinate=0, ZCoordinate=height)
top_b = ConstructPoint(XCoordinate=span, YCoordinate=0, ZCoordinate=height)
base_b = ConstructPoint(XCoordinate=span, YCoordinate=0, ZCoordinate=0)
post_a = Line(StartPoint=base_a, EndPoint=top_a)
beam_line = Line(StartPoint=top_a, EndPoint=top_b)
post_b = Line(StartPoint=base_b, EndPoint=top_b)

# ---- group: 2 - The posts
width = Slider(0.2, range=0..1)
depth = Slider(0.3, range=0..1)
grade = Panel("C24")
material_library_elastic = MaterialLibraryElasticAlpaca4d(
    MaterialName=grade,
    MaterialPresetElastic_Grade="S235",
    MaterialPresetElastic_Model="Uniaxial",
    MaterialPresetElastic_Type="Steel",
    menu=[dropdown(0), dropdown(1), dropdown(0)])
rectanglecs = RectangleCSAlpaca4d(Width=width, Height=depth, Material=material_library_elastic)
posts = ForceBeamColumnAlpaca4d(Line=[post_a, post_b], Section=rectanglecs, Colour=RGB(1, 30, 254), mode="ForceBeamColumn (Alpaca4d)")

# ---- group: 3 - The beam
free = BooleanToggle(False)
knee = HingeReleaseAlpaca4d(Tx=True, Ty=True, Tz=True, Rx=True, Ry=True, Rz=free)
beam = ForceBeamColumnAlpaca4d(
    Line=beam_line,
    Section=rectanglecs,
    ReleaseI=knee,
    ReleaseJ=knee,
    Colour=RGB(235, 108, 63),
    mode="WithHinges (Alpaca4d)")

# ---- group: 5 - The wind
wind = Slider(3, range=-10..10)
push = VectorXYZ(XComponent=wind, YComponent=0, ZComponent=0)  # -> Vector, Length
gust = PointLoadAlpaca4d(Point=top_a, Force=push.Vector, Moment=Vector(0, 0, 0))
wind_load = LoadPatternAlpaca4d(Loads=gust, Factor=1, mode="PlainPattern (Alpaca4d)")

# ---- group: 4 - The footings
footing_a = SupportAlpaca4d(Position=base_a, Tx=True, Ty=True, Tz=True, Rx=True, Ry=True, Rz=True, mode="Support Rigid (Alpaca4d)")
footing_b = SupportAlpaca4d(Position=base_b, Tx=True, Ty=True, Tz=True, Rx=True, Ry=True, Rz=True, mode="Support Rigid (Alpaca4d)")

# ---- group: 6 - Assemble
assemble_model = AssembleModelAlpaca4d(Elements=[posts, beam], Supports=[footing_a, footing_b], LoadPatterns=wind_load, Tolerance=0.01)  # -> AlpacaModel, Mass

# ---- group: 7 - Run
analysis_settings = AnalysisSettingsAlpaca4d(Constraint="Transformation", Numberer="RCM", System="Auto", Algorithm="Newton", AnalysisType="Static", Cores=0)
run_analysis = RunAnalysisAlpaca4d(AlpacaModel=assemble_model.AlpacaModel, Settings=analysis_settings, settings=True)  # -> AlpacaModel, Log
the_barn = ModelViewAlpaca4d(AlpacaModel=run_analysis.AlpacaModel, Step=0, FittedLoads=True)  # -> AlpacaModel, Geometry, Info, Values, Colors
