# Grasshopper definition PlaygroundCliff.gh (Grasshopper 1.0.7)
# plug-ins: Galapagos, Kangaroo2 Components, Alpaca4d

# ---- group: 1 - The balcony
# The Cliff: The Cliff - lesson 2 of the Alpaca4d Playground.
# 
# The River's plank, C24 300 x 50 mm, built into the cliff and sticking out 4 m over the drop, with the alpaca, 0.6 kN, standing at its tip.
# 
# Check it by hand: PL^3 / 3EI = 0.6 x 4^3 / (3 x 10 500 000 x 0.3 x 0.05^3 / 12) = 390 mm, 16 times the River's 24.4 mm. The panel Z in m reads it; Model View draws it true to scale.
# 
# Try: wire a toggle set to False into the Support's Ry, and see Run Analysis fail; or move the load to End Points' S.
span = Slider(4, range=-8..8)
plank_width = Slider(0.3, range=0..1)
plank_thickness = Slider(0.05, range=0..1)
grade = Panel("C24")
root = ConstructPoint(XCoordinate=0, YCoordinate=0, ZCoordinate=0)
tip = ConstructPoint(XCoordinate=span, YCoordinate=0, ZCoordinate=0)
material_library_elastic = MaterialLibraryElasticAlpaca4d(
    MaterialName=grade,
    MaterialPresetElastic_Grade="S235",
    MaterialPresetElastic_Model="Uniaxial",
    MaterialPresetElastic_Type="Steel",
    menu=[dropdown(0), dropdown(1), dropdown(0)])
balcony_line = Line(StartPoint=root, EndPoint=tip)
rectanglecs = RectangleCSAlpaca4d(Width=plank_width, Height=plank_thickness, Material=material_library_elastic)
balcony = ForceBeamColumnAlpaca4d(Line=balcony_line, Section=rectanglecs, Colour=RGB(1, 30, 254), mode="ForceBeamColumn (Alpaca4d)")

# ---- group: 3 - The alpaca
alpaca = Slider(-0.6, range=-1..1)
ends = EndPoints(Curve=balcony_line)  # -> Start, End
weight = UnitZ(Factor=alpaca)
the_alpaca = PointLoadAlpaca4d(Point=ends.End, Force=weight, Moment=Vector(0, 0, 0))
load_pattern = LoadPatternAlpaca4d(Loads=the_alpaca, Factor=1, mode="PlainPattern (Alpaca4d)")

# ---- group: 2 - The support
support = SupportAlpaca4d(Position=root, Tx=True, Ty=True, Tz=True, Rx=True, Ry=True, Rz=True, mode="Support Rigid (Alpaca4d)")

# ---- group: 4 - Assemble
assemble_model = AssembleModelAlpaca4d(Elements=balcony, Supports=support, LoadPatterns=load_pattern, Tolerance=0.01)  # -> AlpacaModel, Mass

# ---- group: 5 - Run
analysis_settings = AnalysisSettingsAlpaca4d(Constraint="Transformation", Numberer="RCM", System="Auto", Algorithm="Newton", AnalysisType="Static", Cores=0)
run_analysis = RunAnalysisAlpaca4d(AlpacaModel=assemble_model.AlpacaModel, Settings=analysis_settings, settings=True)  # -> AlpacaModel, Log
the_balcony = ModelViewAlpaca4d(AlpacaModel=run_analysis.AlpacaModel, Step=0, FittedLoads=True)  # -> AlpacaModel, Geometry, Info, Values, Colors
nodal_displacements = NodalDisplacementsAlpaca4d(AlpacaModel=run_analysis.AlpacaModel, History=False, Step=0)  # -> Position, Displacement, Rotation, port, Velocity, AngularVelocity, Acceleration, AngularAcceleration
devec = DeconstructVector(Vector=nodal_displacements.Displacement)  # -> XComponent, YComponent, ZComponent
z_in_m = Panel(devec.ZComponent)
