# Grasshopper definition PlaygroundFootbridgeStart.gh (Grasshopper 1.0.7)
# plug-ins: Galapagos, Kangaroo2 Components, Alpaca4d

# ---- group: 1 - The deck
# The Footbridge - start: The Footbridge - lesson 8 of the Alpaca4d docs, the start.
# 
# A C24 timber deck, 1.2 m wide and 120 mm deep, across 10 m in ten elements, on a pin and a roller. Add the herd's mass, the natural vibration analysis and the pier as the lesson's steps say.
deck_width = Slider(1.2, range=0..3)
deck_depth = Slider(0.12, range=0..1)
grade = Panel("C24")
material_library_elastic = MaterialLibraryElasticAlpaca4d(
    MaterialName=grade,
    MaterialPresetElastic_Grade="S235",
    MaterialPresetElastic_Model="Uniaxial",
    MaterialPresetElastic_Type="Steel",
    menu=[dropdown(0), dropdown(1), dropdown(0)])
rectanglecs = RectangleCSAlpaca4d(Width=deck_width, Height=deck_depth, Material=material_library_elastic)

# ---- group: 2 - The span
span = Slider(10, range=1..20)
bank_a = ConstructPoint(XCoordinate=0, YCoordinate=0, ZCoordinate=0)
bank_b = ConstructPoint(XCoordinate=span, YCoordinate=0, ZCoordinate=0)
deck_line = Line(StartPoint=bank_a, EndPoint=bank_b)
elements = Slider(10, range=1..20)
divide = DivideCurve(Curve=deck_line, Count=elements, Kinks=False)  # -> Points, Tangents, Parameters
shatter = Shatter(Curve=deck_line, Parameters=divide.Parameters)
deck = ForceBeamColumnAlpaca4d(Line=shatter, Section=rectanglecs, Colour=RGB(1, 30, 254), mode="ForceBeamColumn (Alpaca4d)")

# ---- group: 3 - The abutments
free = BooleanToggle(False)
pin = SupportAlpaca4d(Position=bank_a, Tx=True, Ty=True, Tz=True, Rx=True, Ry=free, Rz=free, mode="Support Rigid (Alpaca4d)")
roller = SupportAlpaca4d(Position=bank_b, Tx=free, Ty=True, Tz=True, Rx=True, Ry=free, Rz=free, mode="Support Rigid (Alpaca4d)")
