# Grasshopper definition PlaygroundMarket.gh (Grasshopper 1.0.7)
# plug-ins: Galapagos, Kangaroo2 Components, Alpaca4d

# ---- group: 1 - The stall
length = Slider(4, range=1..8)
plank_width = Slider(0.3, range=0..1)
plank_thickness = Slider(0.05, range=0..1)
grade = Panel("C24")
trestle_b_at = Slider(3, range=0..4)
crate_at = Slider(1.5, range=0..4)
# The Market: The Market - lesson 6 of the Alpaca4d Playground.
# 
# A C24 plank, 300 x 50 mm and 4 m long, on two trestles 3 m apart: a 1 kN crate half way between them, and the alpaca, 0.6 kN, on the metre that sticks out.
# 
# Check it by hand: moments about trestle A, R_B x 3 = 1 x 1.5 + 0.6 x 4, so R_B = 1.3 kN and R_A = 0.3 kN. Under the crate M = 0.3 x 1.5 = 0.45 kNm, sagging; over trestle B M = 0.6 x 1 = 0.6 kNm, hogging - the largest.
# 
# Try: move Trestle B at to 2 and watch Trestle A pull down; or make the plank twice as thick, and see that the reactions and moments stay the same.
start = ConstructPoint(XCoordinate=0, YCoordinate=0, ZCoordinate=0)
end = ConstructPoint(XCoordinate=length, YCoordinate=0, ZCoordinate=0)
material_library_elastic = MaterialLibraryElasticAlpaca4d(
    MaterialName=grade,
    MaterialPresetElastic_Grade="S235",
    MaterialPresetElastic_Model="Uniaxial",
    MaterialPresetElastic_Type="Steel",
    menu=[dropdown(0), dropdown(1), dropdown(0)])
trestle_b = ConstructPoint(XCoordinate=trestle_b_at, YCoordinate=0, ZCoordinate=0)
crate_point = ConstructPoint(XCoordinate=crate_at, YCoordinate=0, ZCoordinate=0)
shelf_line = Line(StartPoint=start, EndPoint=end)
rectanglecs = RectangleCSAlpaca4d(Width=plank_width, Height=plank_thickness, Material=material_library_elastic)
elements = Slider(8, range=1..16)
free = BooleanToggle(False)
crate = Slider(-1, range=-2..2)
alpaca = Slider(-0.6, range=-1..1)
divide = DivideCurve(Curve=shelf_line, Count=elements, Kinks=False)  # -> Points, Tangents, Parameters
crate_weight = UnitZ(Factor=crate)
alpaca_weight = UnitZ(Factor=alpaca)
shatter = Shatter(Curve=shelf_line, Parameters=divide.Parameters)
shelf = ForceBeamColumnAlpaca4d(Line=shatter, Section=rectanglecs, Colour=RGB(1, 30, 254), mode="ForceBeamColumn (Alpaca4d)")
pin = SupportAlpaca4d(Position=start, Tx=True, Ty=True, Tz=True, Rx=True, Ry=free, Rz=free, mode="Support Rigid (Alpaca4d)")
roller = SupportAlpaca4d(Position=trestle_b, Tx=free, Ty=True, Tz=True, Rx=True, Ry=free, Rz=free, mode="Support Rigid (Alpaca4d)")
the_crate = PointLoadAlpaca4d(Point=crate_point, Force=crate_weight, Moment=Vector(0, 0, 0))
the_alpaca = PointLoadAlpaca4d(Point=end, Force=alpaca_weight, Moment=Vector(0, 0, 0))
load_pattern = LoadPatternAlpaca4d(Loads=[the_crate, the_alpaca], Factor=1, mode="PlainPattern (Alpaca4d)")
assemble_model = AssembleModelAlpaca4d(Elements=shelf, Supports=[pin, roller], LoadPatterns=load_pattern, Tolerance=0.01)  # -> AlpacaModel, Mass
analysis_settings = AnalysisSettingsAlpaca4d(Constraint="Transformation", Numberer="RCM", System="Auto", Algorithm="Newton", AnalysisType="Static", Cores=0)
run_analysis = RunAnalysisAlpaca4d(AlpacaModel=assemble_model.AlpacaModel, Settings=analysis_settings, settings=True)  # -> AlpacaModel, Log

# ---- group: 5 - The largest moment
# Largest moment: 0.6 kNm, hogging,
# over trestle B
the_moments = ModelViewAlpaca4d(AlpacaModel=run_analysis.AlpacaModel, Step=0, FittedLoads=True)  # -> AlpacaModel, Geometry, Info, Values, Colors

# ---- group: 3 - The reactions
reaction_forces = ReactionForcesAlpaca4d(AlpacaModel=run_analysis.AlpacaModel, History=False, Step=0)  # -> SupportPosition, ReactionForce, ReactionMoment, NodeTag
# Prediction: Trestle A: 0.3 kN up
# Trestle B: 1.3 kN up
reactions = Panel(reaction_forces.ReactionForce)

# ---- group: 4 - The bending
beam_forces = BeamForcesAlpaca4d(AlpacaModel=run_analysis.AlpacaModel, History=False, Step=0)  # -> N, Vy, Vz, Mx, My, Mz, Element
bending = Panel(beam_forces.Mz)
