# Grasshopper definition PlaygroundRiver.gh (Grasshopper 1.0.7)
# plug-ins: Galapagos, Kangaroo2 Components, Alpaca4d

# ---- group: 1 - The line
# The River: The River - lesson 1 of the Alpaca4d Playground.
# 
# A C24 timber plank, 300 x 50 mm, across a 4 m river: a pin at one end, a roller at the other, and the alpaca, 0.6 kN, standing in the middle.
# 
# Check it by hand: PL^3 / 48EI = 0.6 x 4^3 / (48 x 10 500 000 x 0.3 x 0.05^3 / 12) = 24.4 mm. Model View draws it eight times bigger.
# 
# Try: stand the plank on its edge (swap Plank width and Plank thickness), or wire Free into nothing, so that both ends are built in.
span = Slider(4, range=1..8)
bank_a = ConstructPoint(XCoordinate=0, YCoordinate=0, ZCoordinate=0)
bank_b = ConstructPoint(XCoordinate=span, YCoordinate=0, ZCoordinate=0)
plank_line = Line(StartPoint=bank_a, EndPoint=bank_b)

# ---- group: 2 - The section
plank_width = Slider(0.3, range=0..1)
plank_thickness = Slider(0.05, range=0..1)
grade = Panel("C24")
material_library_elastic = MaterialLibraryElasticAlpaca4d(
    MaterialName=grade,
    MaterialPresetElastic_Grade="S235",
    MaterialPresetElastic_Model="Uniaxial",
    MaterialPresetElastic_Type="Steel",
    menu=[dropdown(0), dropdown(1), dropdown(0)])
rectanglecs = RectangleCSAlpaca4d(Width=plank_width, Height=plank_thickness, Material=material_library_elastic)

# ---- group: 3 - The beam
elements = Slider(2, range=1..10)
divide = DivideCurve(Curve=plank_line, Count=elements, Kinks=False)  # -> Points, Tangents, Parameters
shatter = Shatter(Curve=plank_line, Parameters=divide.Parameters)
plank = ForceBeamColumnAlpaca4d(Line=shatter, Section=rectanglecs, Colour=RGB(1, 30, 254), mode="ForceBeamColumn (Alpaca4d)")

# ---- group: 4 - The supports
free = BooleanToggle(False)
pin = SupportAlpaca4d(Position=bank_a, Tx=True, Ty=True, Tz=True, Rx=True, Ry=free, Rz=free, mode="Support Rigid (Alpaca4d)")
roller = SupportAlpaca4d(Position=bank_b, Tx=free, Ty=True, Tz=True, Rx=True, Ry=free, Rz=free, mode="Support Rigid (Alpaca4d)")

# ---- group: 5 - The alpaca
alpaca = Slider(-0.6, range=-1..1)
mid_span = CurveMiddle(Curve=plank_line)
weight = UnitZ(Factor=alpaca)
the_alpaca = PointLoadAlpaca4d(Point=mid_span, Force=weight, Moment=Vector(0, 0, 0))
load_pattern = LoadPatternAlpaca4d(Loads=the_alpaca, Factor=1, mode="PlainPattern (Alpaca4d)")

# ---- group: 6 - Assemble
assemble_model = AssembleModelAlpaca4d(Elements=plank, Supports=[pin, roller], LoadPatterns=load_pattern, Tolerance=0.01)  # -> AlpacaModel, Mass

# ---- group: 7 - Run
analysis_settings = AnalysisSettingsAlpaca4d(Constraint="Transformation", Numberer="RCM", System="Auto", Algorithm="Newton", AnalysisType="Static", Cores=0)
run_analysis = RunAnalysisAlpaca4d(AlpacaModel=assemble_model.AlpacaModel, Settings=analysis_settings, settings=True)  # -> AlpacaModel, Log
the_plank = ModelViewAlpaca4d(AlpacaModel=run_analysis.AlpacaModel, Step=0, FittedLoads=True)  # -> AlpacaModel, Geometry, Info, Values, Colors
