# Grasshopper definition PlaygroundRoof.gh (Grasshopper 1.0.7)
# plug-ins: Galapagos, Kangaroo2 Components, Alpaca4d

# ---- group: 4 - How deep
# The Snowy roof: The Snowy roof - lesson 3 of the Alpaca4d Playground.
# 
# A C24 rafter of a flat roof, 75 mm wide, 4 m from wall to wall on a pin and a roller, under 1.5 kN/m2 of snow. The rafters are 0.6 m apart, so each carries 0.9 kN/m, and its own weight.
# 
# Check it by hand: 5wL^4 / 384EI = 5 x 0.945 x 4^4 / (384 x 10 500 000 x 0.075 x 0.15^3 / 12) = 14.2 mm, under L/250 = 16 mm. Model View draws it twenty times bigger.
# 
# Try: Depth 0.1 sags 47 mm; 0.2, twice as deep, sags 6 mm - eight times as stiff.
width = Slider(0.075, range=0..0.3)
depth = Slider(0.15, range=0..0.3)
grade = Panel("C24")
material_library_elastic = MaterialLibraryElasticAlpaca4d(
    MaterialName=grade,
    MaterialPresetElastic_Grade="S235",
    MaterialPresetElastic_Model="Uniaxial",
    MaterialPresetElastic_Type="Steel",
    menu=[dropdown(0), dropdown(1), dropdown(0)])
rectanglecs = RectangleCSAlpaca4d(Width=width, Height=depth, Material=material_library_elastic)

# ---- group: The rafter
span = Slider(4, range=1..8)
wall_a = ConstructPoint(XCoordinate=0, YCoordinate=0, ZCoordinate=0)
wall_b = ConstructPoint(XCoordinate=span, YCoordinate=0, ZCoordinate=0)
rafter_line = Line(StartPoint=wall_a, EndPoint=wall_b)
elements = Slider(4, range=1..10)
free = BooleanToggle(False)
divide = DivideCurve(Curve=rafter_line, Count=elements, Kinks=False)  # -> Points, Tangents, Parameters
shatter = Shatter(Curve=rafter_line, Parameters=divide.Parameters)
rafter = ForceBeamColumnAlpaca4d(Line=shatter, Section=rectanglecs, Colour=RGB(1, 30, 254), mode="ForceBeamColumn (Alpaca4d)")
pin = SupportAlpaca4d(Position=wall_a, Tx=True, Ty=True, Tz=True, Rx=True, Ry=free, Rz=free, mode="Support Rigid (Alpaca4d)")
roller = SupportAlpaca4d(Position=wall_b, Tx=free, Ty=True, Tz=True, Rx=True, Ry=free, Rz=free, mode="Support Rigid (Alpaca4d)")

# ---- group: 1 - The snow
snow = Slider(-1.5, range=-3..0)
spacing = Slider(0.6, range=0..1.2)
per_metre = Multiplication(A=snow, B=spacing)
down = UnitZ(Factor=per_metre)
snow_load = LinearLoadAlpaca4d(Force=down)

# ---- group: 2 - Its own weight
weight_factor = Slider(1, range=-2..10)
gravity_load = GravityLoadAlpaca4d(Factor=weight_factor)

# ---- group: 3 - The load pattern
load_pattern = LoadPatternAlpaca4d(Loads=[snow_load, gravity_load], Factor=1, mode="PlainPattern (Alpaca4d)")

# ---- group: 5 - Run
assemble_model = AssembleModelAlpaca4d(Elements=rafter, Supports=[pin, roller], LoadPatterns=load_pattern, Tolerance=0.01)  # -> AlpacaModel, Mass
analysis_settings = AnalysisSettingsAlpaca4d(Constraint="Transformation", Numberer="RCM", System="Auto", Algorithm="Newton", AnalysisType="Static", Cores=0)
run_analysis = RunAnalysisAlpaca4d(AlpacaModel=assemble_model.AlpacaModel, Settings=analysis_settings, settings=True)  # -> AlpacaModel, Log
the_roof = ModelViewAlpaca4d(AlpacaModel=run_analysis.AlpacaModel, Step=0, FittedLoads=True)  # -> AlpacaModel, Geometry, Info, Values, Colors
