# Grasshopper definition PlaygroundSummitStart.gh (Grasshopper 1.0.7)
# plug-ins: Galapagos, Kangaroo2 Components, Alpaca4d

# ---- group: 1 - The block
# The Summit bridge - start: The Summit bridge - lesson 10 of the Alpaca4d docs, the start.
# 
# A block of concrete 12 m across the chasm, 4 m deep and 1.2 m wide, in 30 x 10 bricks; its top row is the deck. Both ends of its bottom are pinned to the rock, and the walkway, 5 kN/m2, stands on the deck. Assemble it, and add Topology Optimisation as the lesson's steps say.
span = Slider(12, range=4..20)
width = Slider(1.2, range=0.4..3)
depth = Slider(4, range=0.4..8)
along = Slider(30, range=1..80)
up = Slider(10, range=1..30)
layer = Expression(d=depth, u=up, Expression="d/u")
level_count = Expression(u=up, Expression="u+1")
far_end = ConstructPoint(XCoordinate=span, YCoordinate=0, ZCoordinate=0)
far_corner = ConstructPoint(XCoordinate=span, YCoordinate=width, ZCoordinate=0)
plan = Rectangle3Pt(PointA=Point(0, 0, 0), PointB=far_end, PointC=far_corner)  # -> Rectangle, Length
plan_mesh = MeshPlane(Boundary=plan.Rectangle, WidthCount=along, HeightCount=1)  # -> Mesh, Area
heights = Series(Start=0, Step=layer, Count=level_count)
up_to_each_level = UnitZ(Factor=heights)
levels = Move(Geometry=plan_mesh.Mesh, Motion=up_to_each_level)  # -> Geometry, Transform
bricks = MeshSeriesToBrickAlpaca4d(Meshes=levels.Geometry, Closed=False)

# ---- group: 4 - The walkway
walkway = Slider(5, range=0..10)
up_to_the_deck = UnitZ(Factor=depth)
deck_top = Move(Geometry=plan_mesh.Mesh, Motion=up_to_the_deck)  # -> Geometry, Transform
deck_nodes = DeconstructMesh(Mesh=deck_top.Geometry)  # -> Vertices, Faces, Colours, Normals
how_many = ListLength(List=deck_nodes.Vertices)
each_node_s_share = Expression(w=walkway, s=span, b=width, n=how_many, Expression="-w*s*b/n")
down = UnitZ(Factor=each_node_s_share)
the_walkway = PointLoadAlpaca4d(Point=deck_nodes.Vertices, Force=down, Moment=Vector(0, 0, 0))
load_pattern = LoadPatternAlpaca4d(Loads=the_walkway, Factor=1, mode="PlainPattern (Alpaca4d)")

# ---- group: 3 - The rocks
across = Series(Start=0, Step=width, Count=2)
foot_a = ConstructPoint(XCoordinate=0, YCoordinate=across, ZCoordinate=0)
foot_b = ConstructPoint(XCoordinate=span, YCoordinate=across, ZCoordinate=0)
free = BooleanToggle(False)
rock_a = SupportAlpaca4d(Position=foot_a, Tx=True, Ty=True, Tz=True, Rx=free, Ry=free, Rz=free, mode="Support Rigid (Alpaca4d)")
rock_b = SupportAlpaca4d(Position=foot_b, Tx=True, Ty=True, Tz=True, Rx=free, Ry=free, Rz=free, mode="Support Rigid (Alpaca4d)")

# ---- group: 2 - Concrete
deck_starts = Expression(a=along, u=up, Expression="a*(u-1)")
split = SplitList(List=bricks, Index=deck_starts)  # -> ListA, ListB
concrete = Panel("C30/37")
e_kn_m2 = Panel("33000000")
g_kn_m2 = Panel("13750000")
poisson = Panel("0.2")
density_kg_m3 = Panel("2500")
c30_37 = ND(MaterialName=concrete, E=e_kn_m2, G=g_kn_m2, Ν=poisson, Rho=density_kg_m3, mode="ElasticIsotropic (Alpaca4d)")
domain_name = Panel("Domain")
deck_name = Panel("Deck")
domain = SSPBrickAlpaca4d(Mesh=split.ListA, Material=c30_37, ElementId=domain_name)
deck = SSPBrickAlpaca4d(Mesh=split.ListB, Material=c30_37, ElementId=deck_name)
