# Grasshopper definition PlaygroundTowerStart.gh (Grasshopper 1.0.7)
# plug-ins: Galapagos, Kangaroo2 Components, Alpaca4d

# ---- group: 1 - The leg
# The Watchtower - start: The Watchtower - lesson 7 of the Alpaca4d docs, the start.
# 
# One leg's line, 6 m up Z from its foot, and its section, a steel tube 60.3 mm across with 3.2 mm walls. Add the beam, the supports, the platform's load and the buckling analysis as the lesson's steps say.
height = Slider(6, range=1..10)
foot = ConstructPoint(XCoordinate=0, YCoordinate=0, ZCoordinate=0)
head = ConstructPoint(XCoordinate=0, YCoordinate=0, ZCoordinate=height)
leg_line = Line(StartPoint=foot, EndPoint=head)

# ---- group: 2 - The tube
outside_diameter = Slider(0.0603, range=0..0.2)
wall = Slider(0.0032, range=0..0.02)
grade = Panel("S235")
material_library_elastic = MaterialLibraryElasticAlpaca4d(
    MaterialName=grade,
    MaterialPresetElastic_Grade="S235",
    MaterialPresetElastic_Model="Uniaxial",
    MaterialPresetElastic_Type="Steel",
    menu=[dropdown(0), dropdown(1), dropdown(0)])
circlecs = CircleCSAlpaca4d(Diameter=outside_diameter, Thickness=wall, Material=material_library_elastic)
