# Grasshopper definition PlaygroundValley.gh (Grasshopper 1.0.7)
# plug-ins: Galapagos, Kangaroo2 Components, Alpaca4d

# ---- group: 1 - The deck
# The Valley: The Valley - lesson 5 of the Alpaca4d Playground.
# 
# A Warren truss bridge across a 12 m gorge: six panels of 2 m, 2 m deep, steel tubes 100 x 5 mm as Truss bars, a pin at Bank A, a roller at Bank B, every other joint held sideways, and the alpaca, 0.6 kN, on the deck in the middle.
# 
# Check it by hand, cutting through the middle panel: the top chord carries 0.3 x 6 / 2 = 0.9 kN, pushed (blue); the bottom chord 0.3 x 5 / 2 = 0.75 kN, pulled (red); each diagonal 0.3 / (2 / sqrt 5) = 0.335 kN.
# 
# Try: halve Depth and watch the chords' forces double, or set Alpaca to +0.6 and watch every bar change colour.
span = Slider(12, range=4..24)
panels = Slider(6, range=2..12)
bank_a = ConstructPoint(XCoordinate=0, YCoordinate=0, ZCoordinate=0)
bank_b = ConstructPoint(XCoordinate=span, YCoordinate=0, ZCoordinate=0)
deck_line = Line(StartPoint=bank_a, EndPoint=bank_b)
divide = DivideCurve(Curve=deck_line, Count=panels, Kinks=False)  # -> Points, Tangents, Parameters
bottom_chord = Shatter(Curve=deck_line, Parameters=divide.Parameters)

# ---- group: 2 - The triangles
depth = Slider(2, range=0.5..4)
panel_ends = EndPoints(Curve=bottom_chord)  # -> Start, End
panel_middles = CurveMiddle(Curve=bottom_chord)
lift = UnitZ(Factor=depth)
top_joints = Move(Geometry=panel_middles, Motion=lift)  # -> Geometry, Transform
up_diagonals = Line(StartPoint=panel_ends.Start, EndPoint=top_joints.Geometry)
down_diagonals = Line(StartPoint=top_joints.Geometry, EndPoint=panel_ends.End)
top_chord = PolyLine(Vertices=top_joints.Geometry, Closed=False)
top_bars = Explode(Curve=top_chord, Recursive=True)  # -> Segments, Vertices

# ---- group: 3 - The bars
tube_diameter = Slider(0.1, range=0..0.5)
tube_wall = Slider(0.005, range=0..0.05)
grade = Panel("S355")
material_library_elastic = MaterialLibraryElasticAlpaca4d(
    MaterialName=grade,
    MaterialPresetElastic_Grade="S235",
    MaterialPresetElastic_Model="Uniaxial",
    MaterialPresetElastic_Type="Steel",
    menu=[dropdown(0), dropdown(1), dropdown(0)])
tube = CircleCSAlpaca4d(Diameter=tube_diameter, Thickness=tube_wall, Material=material_library_elastic)
truss = ForceBeamColumnAlpaca4d(
    Line=[bottom_chord, up_diagonals, down_diagonals, top_bars.Segments],
    Section=tube,
    WorksIn="Both",
    Prestress=0,
    Colour=RGB(1, 30, 254),
    mode="Truss (Alpaca4d)")

# ---- group: 4 - The supports
free = BooleanToggle(False)
wrap = BooleanToggle(False)
deck_joints = ShiftList(List=panel_ends.Start, Shift=1, Wrap=wrap)
pin = SupportAlpaca4d(Position=bank_a, Tx=True, Ty=True, Tz=True, Rx=True, Ry=True, Rz=True, mode="Support Rigid (Alpaca4d)")
roller = SupportAlpaca4d(Position=bank_b, Tx=free, Ty=True, Tz=True, Rx=True, Ry=True, Rz=True, mode="Support Rigid (Alpaca4d)")
side_support = SupportAlpaca4d(
    Position=[deck_joints, top_joints.Geometry],
    Tx=free,
    Ty=True,
    Tz=free,
    Rx=True,
    Ry=True,
    Rz=True,
    mode="Support Rigid (Alpaca4d)")

# ---- group: 5 - The alpaca
alpaca = Slider(-0.6, range=-1..1)
mid_span = CurveMiddle(Curve=deck_line)
weight = UnitZ(Factor=alpaca)
the_alpaca = PointLoadAlpaca4d(Point=mid_span, Force=weight, Moment=Vector(0, 0, 0))
load_pattern = LoadPatternAlpaca4d(Loads=the_alpaca, Factor=1, mode="PlainPattern (Alpaca4d)")

# ---- group: 6 - Assemble
assemble_model = AssembleModelAlpaca4d(Elements=flatten(truss), Supports=flatten([pin, roller, side_support]), LoadPatterns=load_pattern, Tolerance=0.01)  # -> AlpacaModel, Mass

# ---- group: 7 - Run
analysis_settings = AnalysisSettingsAlpaca4d(Constraint="Transformation", Numberer="RCM", System="Auto", Algorithm="Newton", AnalysisType="Static", Cores=0)
run_analysis = RunAnalysisAlpaca4d(AlpacaModel=assemble_model.AlpacaModel, Settings=analysis_settings, settings=True)  # -> AlpacaModel, Log
the_bridge = ModelViewAlpaca4d(AlpacaModel=run_analysis.AlpacaModel, Step=0, FittedLoads=True)  # -> AlpacaModel, Geometry, Info, Values, Colors
