# Grasshopper definition PlaygroundValleyStart.gh (Grasshopper 1.0.7)
# plug-ins: Galapagos, Kangaroo2 Components, Alpaca4d

# ---- group: 1 - The deck
# The Valley - start: The Valley - lesson 5 of the Alpaca4d docs, the start.
# 
# The truss's lines: the deck, 12 m along X in six panels of 2 m, and the triangles over it, 2 m deep - the bottom chord's bars, the diagonals and the top chord's bars. Make them Truss bars, then add the supports, the alpaca and the analysis as the lesson's steps say.
span = Slider(12, range=4..24)
panels = Slider(6, range=2..12)
bank_a = ConstructPoint(XCoordinate=0, YCoordinate=0, ZCoordinate=0)
bank_b = ConstructPoint(XCoordinate=span, YCoordinate=0, ZCoordinate=0)
deck_line = Line(StartPoint=bank_a, EndPoint=bank_b)
divide = DivideCurve(Curve=deck_line, Count=panels, Kinks=False)  # -> Points, Tangents, Parameters
bottom_chord = Shatter(Curve=deck_line, Parameters=divide.Parameters)

# ---- group: 2 - The triangles
depth = Slider(2, range=0.5..4)
panel_ends = EndPoints(Curve=bottom_chord)  # -> Start, End
panel_middles = CurveMiddle(Curve=bottom_chord)
lift = UnitZ(Factor=depth)
top_joints = Move(Geometry=panel_middles, Motion=lift)  # -> Geometry, Transform
up_diagonals = Line(StartPoint=panel_ends.Start, EndPoint=top_joints.Geometry)
down_diagonals = Line(StartPoint=top_joints.Geometry, EndPoint=panel_ends.End)
top_chord = PolyLine(Vertices=top_joints.Geometry, Closed=False)
top_bars = Explode(Curve=top_chord, Recursive=True)  # -> Segments, Vertices
