# Grasshopper definition PlaygroundWall.gh (Grasshopper 1.0.7)
# plug-ins: Galapagos, Kangaroo2 Components, Alpaca4d

# ---- group: 1 - The wall
length = Slider(5.5, range=1..10)
height = Slider(4, range=1..10)
# The Wall with a window: The Wall with a window - lesson 9 of the Alpaca4d Playground.
# 
# A concrete wall 5.5 m long, 4 m tall and 200 mm thick, standing on its foundation, with a window 1.5 m square and a floor bearing on its top: 50 kN on each of the 12 points along it, 600 kN in all.
# 
# Check it by hand: beside the window the piers are 5.5 - 1.5 = 4 m long, so they carry 600 / (4 x 0.2) = 750 kN/m2 = 0.75 MPa on average, where the wall far from the window carries 600 / (5.5 x 0.2) = 0.55 MPa.
# 
# Try: type other corners into the Window, make it wider, or push the floor along the wall with a Unit X in place of Unit Z, as wind or an earthquake would.
corner = ConstructPoint(XCoordinate=0, YCoordinate=0, ZCoordinate=0)
along = ConstructPoint(XCoordinate=length, YCoordinate=0, ZCoordinate=0)
up = ConstructPoint(XCoordinate=length, YCoordinate=0, ZCoordinate=height)
wall_outline = Rectangle3Pt(PointA=corner, PointB=along, PointC=up)  # -> Rectangle, Length
window = Rectangle3Pt(PointA=Point(2, 0, 1), PointB=Point(3.5, 0, 1), PointC=Point(3.5, 0, 2.5))  # -> Rectangle, Length
wall_surface = BoundarySurfaces(Edges=flatten([wall_outline.Rectangle, window.Rectangle]))

# ---- group: 2 - The mesh
explode = Explode(Curve=wall_outline.Rectangle, Recursive=True)  # -> Segments, Vertices
base_edge = ListItem(List=explode.Segments, Index=0, Wrap=True)
top_edge = ListItem(List=explode.Segments, Index=2, Wrap=True)
divisions = Slider(11, range=1..22)
base_points = DivideCurve(Curve=base_edge, Count=divisions, Kinks=False)  # -> Points, Tangents, Parameters
top_points = DivideCurve(Curve=top_edge, Count=divisions, Kinks=False)  # -> Points, Tangents, Parameters
edge_length = Slider(0.25, range=0..2)
mesh_brep = MeshBrepAlpaca4d(Breps=wall_surface, EdgeLength=edge_length, Points=flatten([base_points.Points, top_points.Points]))

# ---- group: 3 - The shell
concrete = ND(MaterialName="Concrete", E=33000000, G=13750000, Ν=0.2, Rho=2500, mode="ElasticIsotropic (Alpaca4d)")
thickness = Slider(0.2, range=0..1)
along_the_wall = UnitX(Factor=1)
_200_mm = PlateFiberSectionAlpaca4d(Thickness=thickness, Material=concrete)
wall = ASDShellAlpaca4d(Mesh=mesh_brep, Section=_200_mm, LocalXAxis=along_the_wall, IsCorotational=False)

# ---- group: 5 - The floor
floor = Slider(-50, range=-100..0)
down = UnitZ(Factor=floor)
the_floor = PointLoadAlpaca4d(Point=flatten(top_points.Points), Force=down, Moment=Vector(0, 0, 0))
load_pattern = LoadPatternAlpaca4d(Loads=the_floor, Factor=1, mode="PlainPattern (Alpaca4d)")

# ---- group: 4 - The supports
foundation = SupportAlpaca4d(
    Position=flatten(base_points.Points),
    Tx=True,
    Ty=True,
    Tz=True,
    Rx=True,
    Ry=True,
    Rz=True,
    mode="Support Rigid (Alpaca4d)")

# ---- group: 6 - Assemble
assemble_model = AssembleModelAlpaca4d(Elements=flatten(wall), Supports=flatten(foundation), LoadPatterns=load_pattern, Tolerance=0.01)  # -> AlpacaModel, Mass

# ---- group: 7 - Run
analysis_settings = AnalysisSettingsAlpaca4d(Constraint="Transformation", Numberer="RCM", System="Auto", Algorithm="Newton", AnalysisType="Static", Cores=0)
run_analysis = RunAnalysisAlpaca4d(AlpacaModel=assemble_model.AlpacaModel, Settings=analysis_settings, settings=True)  # -> AlpacaModel, Log
stresses = ModelViewAlpaca4d(AlpacaModel=run_analysis.AlpacaModel, Step=0, FittedLoads=True)  # -> AlpacaModel, Geometry, Info, Values, Colors
seed = Point(Point(1, 0, 1.75))
flow = PrincipalStressLinesAlpaca4d(
    AlpacaModel=run_analysis.AlpacaModel,
    Step=0,
    Seed=seed,
    StepTolerance=0,
    SingleLine=False,
    PoissonsRatio=0,
    BendingStressLines=False,
    Separation=0,
    TestDist=0,
    mode="PrincipalStressLines")  # -> StressLinesDir1, StressLinesDir2
