# Grasshopper definition PrintedCylinder.gh (Grasshopper 1.0.7)
# plug-ins: Galapagos, Kangaroo2 Components, Alpaca4d

# ---- group: 1 - The print path
# A printed cylinder: A 3D printed cylinder, checked for buckling while it is printed.
# 
# TU/e's cylinder (Wolfs, Bos and Salet 2018): radius 250 mm, layers 40 x 10 mm, 5 m/min, a mortar whose stiffness grows with age, E = 0.078 + 0.0012 t MPa. Move Time: more layers are printed, the bottom ones older and stiffer, and the load factor on the concrete's own weight falls. It reaches 1 - the wall buckles - at about 47 layers.
# 
# Their lab cylinders fell at 25 to 31 layers, by buckling and by the concrete yielding at the base; this is the elastic buckling.
# 
# Printed Layers, Fresh Concrete and Surface Connection are GhPython components: open them to see, and change, how the bricks are cut, how the concrete stiffens and what a joint is.
# 
# Try: Joint 1 mm and a lower Ks lets the layers slip; Round 0 squares the filament; Speed lower gives each layer time to stiffen.
radius = Slider(0.25, range=0.1..1)
centre = ConstructPoint(XCoordinate=0, YCoordinate=0, ZCoordinate=0)
print_path = CircleCNR(Center=centre, Normal=Vector(0, 0, 1), Radius=radius)

# ---- group: 6 - Self-weight
gravity_load = GravityLoadAlpaca4d(Factor=1)
self_weight = LoadPatternAlpaca4d(Loads=gravity_load, Factor=1, mode="PlainPattern (Alpaca4d)")

# ---- group: 2 - Printing
layers = Slider(60, range=1..100)
width = Slider(0.04, range=0.01..0.1)
height = Slider(0.01, range=0.005..0.03)
round = Slider(1, range=0..1)
across = Slider(1, range=1..4)
up = Slider(2, range=1..4)
segment = Slider(0.04, range=0.01..0.1)
speed_m_min = Slider(5, range=1..20)
time_min = Slider(9.42, range=0.5..20)

# ---- group: 4 - The joint and the bricks
joint = Slider(0, range=0..0.002)
ks_kn_m3 = Slider(10000, range=1000..50000)

# ---- group: 2 - Printing (continued)
printed_layers = GhPythonScript(
    Path=print_path,
    Layers=layers,
    Width=width,
    Height=height,
    Round=round,
    Across=across,
    Up=up,
    Segment=segment,
    Joint=joint,
    Speed=speed_m_min,
    Time=time_min)  # -> out, Mesh, Age, InJoint, Colour, Base, Nozzle, Printed, Duration; inputs Path: list of Curve, Layers: Int32, Across: Int32, Up: Int32
# ---------- printed_layers: Python ----------
# Printed Layers, the GhPython component of PrintedCylinder.gh: a 3D printed object as bricks, as far
# as it is printed at a given time.
#
# Each layer is a filament swept along its print path, its section an oval - flat where it rests on
# the layer below and carries the one above, round at the sides where the nozzle let it bulge - cut
# into bricks across, up and along the path. The nozzle runs the paths one after the other at a
# constant speed: a brick is printed once the nozzle has passed its far end, and its age is the time
# since the nozzle passed its middle. With Joint above 0, the bottom of every layer above the first
# is a band that thick, its bricks flagged in InJoint for the joint's material.
#
# PrintedCylinder.py puts this file's text in the component, followed by the call to printed_layers.
# Written for IronPython 2.7, which GhPython runs in Rhino 7 and 8: no f-strings.

import math

import Rhino.Geometry as rg
import System.Drawing as sd

# Orange as it is printed, purple half way, blue for the oldest: Alpaca4d's colours.
ORANGE, PURPLE, BLUE = (235, 108, 63), (158, 53, 218), (66, 136, 247)


def _half_width(v, width, height, rounding):
    """Half the filament's width at v above the bottom of its layer: the sides are half ellipses that
    reach in rounding x height / 2."""
    c, h = rounding * height / 2.0, height / 2.0
    s = max(0.0, 1.0 - ((v - h) / h) ** 2)
    return width / 2.0 - c + c * math.sqrt(s)


def _rows(band, height, up, joint):
    """The heights of a layer's rows of nodes from its bottom; the joint band, when it has one, first."""
    start = joint if band else 0.0
    rows = [0.0] + ([start] if band else [])
    for j in range(1, up + 1):
        rows.append(start + (height - start) * j / float(up))
    return rows


def _left(a, b):
    """The horizontal unit vector to the left of going from a to b."""
    x, y = b.X - a.X, b.Y - a.Y
    length = math.sqrt(x * x + y * y)
    if length < 1e-12:
        raise ValueError("A print path runs straight up, or two of its points are in one place: a layer is printed flat.")
    return (-y / length, x / length)


def _frames(points, closed):
    """At each point, the direction across the filament - square to the path at its ends, along the
    bisector at a corner - and how much a corner widens the section: 1 / cos of half the turn, so that
    the wall keeps its width, up to three times at the sharpest corners."""
    n, frames = len(points), []
    for k in range(n):
        first, last = k == 0 and not closed, k == n - 1 and not closed
        before = None if first else _left(points[(k - 1) % n], points[k])
        after = None if last else _left(points[k], points[(k + 1) % n])
        if first or last:
            frames.append((after if first else before, 1.0))
            continue
        bx, by = before[0] + after[0], before[1] + after[1]
        size = math.sqrt(bx * bx + by * by)
        out = (bx / size, by / size) if size > 1e-9 else after
        cos = out[0] * after[0] + out[1] * after[1]
        frames.append((out, min(3.0, 1.0 / max(cos, 1.0 / 3.0))))
    return frames


def _hexahedron(corners):
    """A closed eight-vertex mesh: four corners at the bottom, then the four above them."""
    mesh = rg.Mesh()
    for p in corners:
        mesh.Vertices.Add(p)
    for a, b, c, d in ((0, 3, 2, 1), (4, 5, 6, 7), (0, 1, 5, 4), (3, 7, 6, 2), (1, 2, 6, 5), (0, 4, 7, 3)):
        mesh.Faces.AddFace(a, b, c, d)
    mesh.Normals.ComputeNormals()
    return mesh


def _colour(age, oldest):
    t = max(0.0, min(1.0, age / oldest)) if oldest > 0 else 0.0
    a, b, s = (ORANGE, PURPLE, 2 * t) if t < 0.5 else (PURPLE, BLUE, 2 * t - 1)
    return sd.Color.FromArgb(*[int(round(a[i] + s * (b[i] - a[i]))) for i in range(3)])


def printed_layers(paths, layers, width, height, rounding, across, up, segment, joint, speed, time):
    """The bricks printed by time [min] along paths, one per layer in the order printed - or, with a
    single path, layers of it each height above the last - at speed [length/min]. Returns the meshes,
    their ages [min], whether each is in a joint band, its colour by age, the base points on the print
    bed, the nozzle, the layers printed and the minutes the whole print takes."""
    layers = layers or 1
    width = width or 0.04
    height = height or 0.01
    rounding = 1.0 if rounding is None else rounding
    across, up = across or 2, up or 2
    segment, joint, speed = segment or 0.04, joint or 0.0, speed or 5.0
    if width <= 0 or height <= 0:
        raise ValueError("The filament needs a width and a layer height greater than zero.")
    if not 0 <= rounding <= 1 or rounding * height >= width:
        raise ValueError("Round is a share of half the layer height, 0 to 1, and the round sides may not meet.")
    if not 0 <= joint < height:
        raise ValueError("The joint band has to be thinner than the layer, or 0 for none.")

    # Each path divided into equal segments no longer than Segment, at the height its layer rests on.
    divided = []
    for curve in [c for c in paths if c is not None]:
        count = max(3 if curve.IsClosed else 1, int(math.ceil(curve.GetLength() / segment - 1e-9)))
        points = [curve.PointAt(t) for t in curve.DivideByCount(count, True)]
        divided.append((points, curve.IsClosed))
    if len(divided) == 1 and layers > 1:
        points, closed = divided[0]
        divided = [([p + rg.Vector3d(0, 0, l * height) for p in points], closed) for l in range(layers)]

    def segments(points, closed):
        return [(points[s], points[(s + 1) % len(points)]) for s in range(len(points) if closed else len(points) - 1)]

    lengths = [sum(a.DistanceTo(b) for a, b in segments(p, c)) for p, c in divided]
    duration = sum(lengths) / speed
    if time is None:
        time = duration

    bricks, base, seen = [], [], set()
    nozzle, printed = divided[0][0][0] + rg.Vector3d(0, 0, height), 0.0
    started, done = 0.0, False
    for l, (points, closed) in enumerate(divided):
        if time <= started or done:
            break
        band = l > 0 and joint > 0
        rows = _rows(band, height, up, joint)
        frames = _frames(points, closed)
        along = 0.0
        for s, (start, end) in enumerate(segments(points, closed)):
            length = start.DistanceTo(end)
            if started + (along + length) / speed > time + 1e-12:
                # The nozzle is in this segment.
                share = max(0.0, (time - started) * speed - along) / length if length > 0 else 0.0
                nozzle = start + share * (end - start) + rg.Vector3d(0, 0, height)
                printed = l + (along + share * length) / lengths[l]
                done = True
                break
            age = time - (started + (along + length / 2.0) / speed)
            (a, fa), (b, fb) = frames[s], frames[(s + 1) % len(frames)]

            def at(o, f, scale, i, j):
                v = rows[j]
                u = _half_width(v, width, height, rounding) * (-1.0 + 2.0 * i / across) * scale
                return rg.Point3d(o.X + u * f[0], o.Y + u * f[1], o.Z + v)

            for j in range(len(rows) - 1):
                for i in range(across):
                    corners = [at(start, a, fa, i, j), at(end, b, fb, i, j), at(end, b, fb, i + 1, j), at(start, a, fa, i + 1, j)]
                    corners += [at(start, a, fa, i, j + 1), at(end, b, fb, i, j + 1), at(end, b, fb, i + 1, j + 1), at(start, a, fa, i + 1, j + 1)]
                    bricks.append((corners, age, band and j == 0))
                    if l == 0 and j == 0:
                        for p in corners[:4]:
                            key = (round(p.X, 7), round(p.Y, 7), round(p.Z, 7))
                            if key not in seen:
                                seen.add(key)
                                base.append(p)
            along += length
        if not done:
            started += lengths[l] / speed
            nozzle, printed = points[-1 if not closed else 0] + rg.Vector3d(0, 0, height), l + 1.0

    oldest = max([age for _, age, _ in bricks] or [0.0])
    meshes = [_hexahedron(c) for c, _, _ in bricks]
    ages = [age for _, age, _ in bricks]
    in_joint = [j for _, _, j in bricks]
    colours = [_colour(age, oldest) for age in ages]
    return meshes, ages, in_joint, colours, base, nozzle, printed, duration


Mesh, Age, InJoint, Colour, Base, Nozzle, Printed, Duration = printed_layers(Path, Layers, Width, Height, Round, Across, Up, Segment, Joint, Speed, Time)
# ---------- end printed_layers ----------
layers_printed = Panel(printed_layers.Printed)

# ---- group: 3 - Fresh concrete
fresh_concrete = GhPythonScript(Age=printed_layers.Age)  # -> out, Material, E; inputs Age: list
# ---------- fresh_concrete: Python ----------
# Fresh Concrete, the GhPython component of PrintedCylinder.gh and PrintedStructure.gh: concrete minutes after it is printed,
# as an elastic material whose stiffness grows with its age - one material per age.
#
# Wolfs, Bos and Salet ("Early age mechanical behaviour of 3D printed concrete", Cement and Concrete
# Research 106, 2018) measured a printable mortar over its first 90 minutes: its Young's modulus grows
# in a straight line, E(t) = 0.078 + 0.0012 t MPa with t in minutes, its Poisson's ratio stays at 0.3,
# and it weighs 2070 kg/m3. Those are the defaults. A Final stiffness makes it level off instead, as
# an accelerated concrete does (Suiker, Int. J. Mech. Sci. 137, 2018), starting at the same rate:
# E(t) = Final - (Final - E0) exp(-Rate t / (Final - E0)).
#
# PrintedCylinder.py and PrintedStructure.py put this file's text in the component, followed by the call to fresh_concrete.
# Written for IronPython 2.7, which GhPython runs in Rhino 7 and 8.

import math

import clr
clr.AddReference("Alpaca4d.Core")
from Alpaca4d import ModelStress
from Alpaca4d.Material import ElasticIsotropicMaterial


def modulus(age, e0, rate, final):
    """Young's modulus at age minutes [MPa]."""
    if age < 0:
        raise ValueError("An age below zero: concrete not yet printed has no stiffness to give.")
    if final is None:
        return e0 + rate * age
    span = final - e0
    return final - span * math.exp(-rate / span * age)


def fresh_concrete(ages, e0, rate, final, nu, rho):
    """An elastic isotropic material for each age [min], in the model's units, and its E [MPa]."""
    e0 = 0.078 if e0 is None else e0
    rate = 0.0012 if rate is None else rate
    nu = 0.3 if nu is None else nu
    rho = 2070.0 if rho is None else rho
    if final is not None and final <= e0:
        raise ValueError("The final stiffness has to be greater than E0: it is what the concrete stiffens towards.")
    materials, moduli = [], []
    for age in ages:
        mpa = modulus(age, e0, rate, final)
        e = ModelStress.FromMPa(mpa)
        materials.append(ElasticIsotropicMaterial("Fresh concrete, %.2f min" % age, e, e / (2.0 * (1.0 + nu)), nu, rho))
        moduli.append(mpa)
    return materials, moduli


Material, E = fresh_concrete(Age, E0, Rate, Final, Nu, Rho)
# ---------- end fresh_concrete ----------

# ---- group: 4 - The joint and the bricks (continued)
surface_connection = GhPythonScript(Material=fresh_concrete.Material, Joint=printed_layers.InJoint, Thickness=joint, Ks=ks_kn_m3)  # -> out, Materials, KnUsed, KsUsed; inputs Material: list, Joint: list of Boolean
# ---------- surface_connection: Python ----------
# Surface Connection, the GhPython component of PrintedCylinder.gh and PrintedStructure.gh: the joint between two printed
# layers, given a stiffness per area normal to it (Kn) and along it (Ks), as the material of the thin
# band of bricks Printed Layers puts at the bottom of every layer above the first.
#
# A band t thick given Ez = Kn t and Gxz = Gyz = Ks t closes by s / Kn under a pressure s across it and
# slips by tau / Ks under a shear stress tau along it, as springs spread over the joint would; in its
# own plane it is the concrete it joins. The joint is horizontal, as a printed layer is: a solid's
# material has the global axes. Left empty, Kn and Ks are the concrete's own, E / t and G / t.
#
# The band's material is marked as a surface connection (IsSurfaceConnection), for Linear Buckling to
# give the band the stress stiffness of a joint rather than of a band: a band t thick under a pressure
# s would also soften against slip by s / t, which springs of no thickness never do, and buckle in
# shear at s = Ks t, a pressure that vanishes as the band is made thinner.
#
# PrintedCylinder.py and PrintedStructure.py put this file's text in the component, followed by the call to
# surface_connection. Written for IronPython 2.7, which GhPython runs in Rhino 7 and 8.

import clr
clr.AddReference("Alpaca4d.Core")
from Alpaca4d.Material import ElasticIsotropicMaterial, ElasticOrthotropicMaterial


def surface_connection(materials, joints, thickness, kn, ks):
    """For each material, the joint's where its Joint flag is true and the material itself where it is
    false; and the Kn and Ks used [force/length3], None outside the joint."""
    thickness = thickness or 0.001
    out, kns, kss = [], [], []
    for k, material in enumerate(materials):
        if not (k < len(joints) and joints[k]):
            out.append(material)
            kns.append(None)
            kss.append(None)
            continue
        if not isinstance(material, ElasticIsotropicMaterial):
            raise ValueError("The joint is made from an elastic isotropic material, such as Fresh Concrete gives.")
        if thickness <= 0:
            raise ValueError("The joint band needs a thickness greater than zero.")
        normal = kn if kn else material.E / thickness
        shear = ks if ks else material.G / thickness
        ez, gz = normal * thickness, shear * thickness
        # Poisson's effect across the joint only while the band is as stiff across it as the concrete:
        # a softer band with it would not be positive definite.
        across = material.Nu if abs(ez - material.E) <= 1e-9 * material.E else 0.0
        joint = ElasticOrthotropicMaterial("Surface connection, kn %.4g ks %.4g" % (normal, shear),
                                           material.E, material.E, ez, material.G, gz, gz,
                                           material.Nu, across, across, material.Rho)
        joint.IsSurfaceConnection = True
        joint.Color = material.Color
        out.append(joint)
        kns.append(normal)
        kss.append(shear)
    return out, kns, kss


Materials, KnUsed, KsUsed = surface_connection(Material, Joint, Thickness, Kn, Ks)
# ---------- end surface_connection ----------
bricks = SSPBrickAlpaca4d(Mesh=printed_layers.Mesh, Material=surface_connection.Materials, Colour=printed_layers.Colour)

# ---- group: 5 - The print bed
print_bed = SupportAlpaca4d(Position=printed_layers.Base, Tx=True, Ty=True, Tz=True, Rx=True, Ry=True, Rz=True, mode="Support Rigid (Alpaca4d)")

# ---- group: 7 - Assemble
tolerance = Slider(0.0005, range=0.0001..0.001)
assemble_model = AssembleModelAlpaca4d(Elements=bricks, Supports=print_bed, LoadPatterns=self_weight, Tolerance=tolerance)  # -> AlpacaModel, Mass

# ---- group: 8 - Buckle
buckling = LinearBucklingAnalysisAlpaca4d(AlpacaModel=assemble_model.AlpacaModel, BucklingModes=1, Divisions=1)  # -> AlpacaModel, LoadFactors, Log
load_factor = Panel(buckling.LoadFactors)
the_wall = ModelViewAlpaca4d(AlpacaModel=buckling.AlpacaModel, Step=0, FittedLoads=True)  # -> AlpacaModel, Geometry, Info, Values, Colors
the_print = ModelViewAlpaca4d(AlpacaModel=assemble_model.AlpacaModel, Step=0, FittedLoads=True)  # -> AlpacaModel, Geometry, Info, Values, Colors
