# Grasshopper definition ReportBricks.gh (Grasshopper 1.0.7)
# plug-ins: Galapagos, Kangaroo2 Components, Alpaca4d

# ---- group: 1 - Geometry: the vault as polylines, a branch a surface, inside to outside
# Vault of bricks: Vault of bricks - Mesh Loft and Mesh Series to Brick, from polylines to a solid.
# 
# A concrete barrel vault 8 m across, 2.5 m high, 6 m long and 400 mm thick. The GhPython component draws it as polylines: Layers + 1 surfaces through its thickness, inside to outside, each a branch of polylines across the vault, one every brick along it, all with the same number of points - Mesh Loft needs that.
# 
# Mesh Loft lofts each branch into one mesh of quads. The meshes match face for face, so Mesh Series to Brick, taking them in order, makes a layer of bricks between each two: hexahedra, eight nodes each. SSP Brick turns them into elements of C30/37; both springings are held, every node along them.
# 
# Under its own weight the vault pushes outwards at its feet, and Model View colours it by Von Mises stress, drawn 2000 times its deformation: it works in compression, the stress highest along the feet, where its weight and its thrust meet the ground.
# 
# Try: Rise 4 m, Layers of bricks 8, Thickness 0.25 m, and see how the stress moves.
span_m = Slider(8, range=4..16)
rise_m = Slider(2.5, range=1..6)
length_m = Slider(6, range=2..16)
thickness_m = Slider(0.4, range=0.2..1)
bricks_round_the_arc = Slider(24, range=8..48)
bricks_along_it = Slider(12, range=2..32)
layers_of_bricks = Slider(5, range=1..10)
vault_of_bricks = GhPythonScript(
    Span=span_m,
    Rise=rise_m,
    Length=length_m,
    Thickness=thickness_m,
    Around=bricks_round_the_arc,
    Along=bricks_along_it,
    Layers=layers_of_bricks)  # -> out, Layers, Feet, Info; inputs Around: Int32, Along: Int32, Layers: Int32
# ---------- vault_of_bricks: Python ----------
#! python3
# The geometry of the vault of bricks (MeshLoftBricks.py): the polylines Mesh Loft lofts, layer by layer through
# the vault's thickness, and the nodes it stands on.
#
# The vault is an arc of a circle through its feet and its crown, swept along its length. Each layer is a
# surface of the vault at one depth of it, from its inside to its outside: a row of polylines across the vault,
# one every step along it, all with the same number of points - which Mesh Loft needs - lofted into a mesh. The
# layers' meshes then match face for face, which Mesh Series to Brick needs, and each pair of neighbours makes a
# layer of bricks.
#
# The definition's GhPython component runs layers(). Everything before it is plain Python, Rhino or not, so that
# it can be tried outside Rhino too.
#
# Written for both Python 3 (Rhino 8) and IronPython 2.7 (Rhino 7): no f-strings, ASCII only.

from __future__ import division

import math

try:
    import Rhino.Geometry as rg
    from Grasshopper import DataTree
    from Grasshopper.Kernel.Data import GH_Path
except ImportError:
    rg = None


def arcs(span, rise, length, thickness, around, along, layers):
    """The polylines as plain tuples: a list per layer, inside first, of along + 1 polylines of around + 1
    points each; and the points at the vault's two springings, where it stands."""
    radius = (span * span / 4.0 + rise * rise) / (2.0 * rise)
    centre = rise - radius                     # the circle's centre, on the axis, below the crown
    sweep = math.asin(span / 2.0 / radius)     # half the angle the vault spans
    if rise > radius:                          # more than a half circle: the feet curl back in
        sweep = math.pi - sweep
    out = []
    feet = []
    for k in range(layers + 1):
        r = radius - thickness / 2.0 + thickness * k / layers
        rows = []
        for j in range(along + 1):
            y = length * j / along
            row = []
            for i in range(around + 1):
                a = -sweep + 2.0 * sweep * i / around
                row.append((r * math.sin(a), y, centre + r * math.cos(a)))
            rows.append(row)
            feet += [row[0], row[-1]]
        out.append(rows)
    return out, feet


def layers(Span, Rise, Length, Thickness, Around, Along, Layers):
    """The GhPython component's code: a branch of polylines per layer, inside first, and the springings'
    points, for Rhino and Grasshopper."""
    around, along, count = max(2, int(Around)), max(1, int(Along)), max(1, int(Layers))
    polylines, feet = arcs(Span, Rise, Length, Thickness, around, along, count)
    tree = DataTree[object]()
    for k, rows in enumerate(polylines):
        for row in rows:
            tree.Add(rg.PolylineCurve([rg.Point3d(*p) for p in row]), GH_Path(k))
    info = "{0} layers of {1} x {2} bricks, {3} in all".format(count, around, along, count * around * along)
    return tree, [rg.Point3d(*p) for p in feet], info


if __name__ == "__main__":
    p, f = arcs(8.0, 2.5, 6.0, 0.4, 24, 12, 2)
    print(len(p), "layers,", len(p[0]), "polylines of", len(p[0][0]), "points,", len(f), "feet")
    print(p[0][0][0], p[-1][0][len(p[0][0]) // 2])


Layers, Feet, Info = layers(Span, Rise, Length, Thickness, Around, Along, Layers)
# ---------- end vault_of_bricks ----------
about_the_vault = Panel(vault_of_bricks.Info)

# ---- group: 2 - Bricks: Mesh Loft a mesh a surface, Mesh Series to Brick a layer between each two, SSP Bricks of C30/37
a_mesh_a_surface = MeshLoftAlpaca4d(Polylines=vault_of_bricks.Layers)
bricks = MeshSeriesToBrickAlpaca4d(Meshes=flatten(a_mesh_a_surface), Closed=False)
c30_37 = ND(
    MaterialName="C30/37",
    E=33000000,
    G=13750000,
    Ν=0.2,
    Rho=2500,
    Colour=RGB(190, 194, 199),
    mode="ElasticIsotropic (Alpaca4d)")
vault = SSPBrickAlpaca4d(Mesh=bricks, Material=c30_37)

# ---- group: 3 - Supports: every node of both springings held
springings = SupportAlpaca4d(Position=vault_of_bricks.Feet, Tx=True, Ty=True, Tz=True, Rx=False, Ry=False, Rz=False, mode="Support Rigid (Alpaca4d)")

# ---- group: 4 - Loads: its own weight
own_weight = GravityLoadAlpaca4d(Factor=1)
own_weight_2 = LoadPatternAlpaca4d(Loads=flatten(own_weight), Factor=1, mode="PlainPattern (Alpaca4d)")

# ---- group: 5 - Analysis
vault_of_bricks_2 = AssembleModelAlpaca4d(Elements=flatten(vault), Supports=flatten(springings), LoadPatterns=flatten(own_weight_2), Tolerance=0.01)  # -> AlpacaModel, Mass
analysis_settings = AnalysisSettingsAlpaca4d(Constraint="Transformation", Numberer="RCM", System="Auto", Algorithm="Newton", AnalysisType="Static", Cores=0)
run_analysis = RunAnalysisAlpaca4d(AlpacaModel=vault_of_bricks_2.AlpacaModel, Settings=analysis_settings, settings=True)  # -> AlpacaModel, Log

# ---- group: 8 - For the report: loads and analyses
natural_vibration = NaturalVibrationAnalysisAlpaca4d(AlpacaModel=vault_of_bricks_2.AlpacaModel, VibrationModes=6, Solver="-genBandArpack")  # -> AlpacaModel, Eigenvalues, Period, Frequencies, Log, EigenValueAnalysis, TotalMassOfStructure, TotalFreeMass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

# ---- group: 6 - Results: Von Mises stress on the vault, deformed 2000 times
von_mises = ModelViewAlpaca4d(
    AlpacaModel=run_analysis.AlpacaModel,
    Step=0,
    Colors=[RGB(212, 227, 253), RGB(157, 193, 251), RGB(103, 159, 249), RGB(78, 126, 243), RGB(112, 95, 233), RGB(147, 63, 222), RGB(177, 67, 179), RGB(206, 87, 121), RGB(235, 108, 63)],
    FittedLoads=True)  # -> AlpacaModel, Geometry, Info, Values, Colors
legend_title = Panel("Von Mises [MPa]")
vault_legend = LegendAlpaca4d(Title=legend_title, Values=von_mises.Values, Colors=von_mises.Colors, Position=0, Scale=2.4)

# ---- group: 9 - The page: A4, its title block drawn by a script
title_block_drawing = GhPythonScript()  # -> out, Curves, Text
# ---------- title_block_drawing: Python ----------
import Rhino
import Rhino.Geometry as rg
from Rhino.DocObjects import TextHorizontalAlignment as H, TextVerticalAlignment as V

doc = Rhino.RhinoDoc.ActiveDoc
k = Rhino.RhinoMath.UnitScale(Rhino.UnitSystem.Millimeters, doc.ModelUnitSystem) if doc else 1.0

def at(x, y):
    return rg.Point3d(x * k, y * k, 0.0)

Curves = [rg.LineCurve(at(20, 282), at(190, 282)), rg.LineCurve(at(20, 17), at(190, 17))]
Text = []
for words, x, y, height, align, bold in [
        ("{title}", 20, 285, 3.6, H.Left, True),
        ("Alpaca4d example report - bricks", 190, 285, 3.0, H.Right, False),
        ("Alpaca4d - {date}", 20, 10, 2.8, H.Left, False),
        ("Alpaca4d", 105, 10, 2.8, H.Center, True),
        ("Page {page} of {pages}", 190, 10, 2.8, H.Right, False)]:
    text = rg.TextEntity.Create(words, rg.Plane(at(x, y), rg.Vector3d.ZAxis), doc.DimStyles.Current, False, 0.0, 0.0)
    text.TextHeight = height * k
    text.TextHorizontalAlignment = align
    text.TextVerticalAlignment = V.Bottom
    try:
        text.SetBold(bold)
    except Exception:
        pass
    Text.append(text)
# ---------- end title_block_drawing ----------
titleblock = ReportTitleBlockAlpaca4d(Curves=title_block_drawing.Curves, Text=title_block_drawing.Text)
reportpage = ReportPageAlpaca4d(
    Width=210,
    Height=297,
    Top=24,
    Bottom=22,
    Left=20,
    Right=20,
    TitleBlock=titleblock,
    Numbered=True,
    menu=[dropdown(0), dropdown(0)])

# ---- group: 10 - The content, a chapter a column, in order
reporttext = ReportTextAlpaca4d(Text=["Vault of bricks", "Static and natural vibration analysis of a solid concrete vault"], menu=[dropdown(0)])
reporttext_2 = ReportTextAlpaca4d(Text="The model", menu=[dropdown(1)])
reporttext_3 = ReportTextAlpaca4d(
    Text="A concrete barrel vault 8 m across, 2.5 m high, 6 m long and 400 mm thick, held at its feet. It is all solids: SSP bricks of C30/37, five layers through its thickness, lofted from polylines and turned into bricks by Mesh Series to Brick. It has {model.nodes} nodes and {model.elements} elements, and weighs {model.mass:N0} kg.",
    menu=[dropdown(4)])
reporttext_4 = ReportTextAlpaca4d(Text="The solid", menu=[dropdown(2)])
reporttext_5 = ReportTextAlpaca4d(Text="Loads", menu=[dropdown(2)])
reporttext_6 = ReportTextAlpaca4d(Text="Its own weight alone.", menu=[dropdown(4)])
model_summary = ReportResultTableAlpaca4d(menu=[dropdown(0), checkbox(on), checkbox(on), checkbox(on), checkbox(on), checkbox(on), checkbox(on), checkbox(on), checkbox(on), checkbox(on), checkbox(on), checkbox(on), checkbox(on), checkbox(on), checkbox(on), checkbox(on), checkbox(on), checkbox(on), checkbox(on), checkbox(on), checkbox(on), checkbox(on), checkbox(on), checkbox(on), checkbox(on), checkbox(on), checkbox(on), checkbox(on), checkbox(on), checkbox(on), checkbox(on), checkbox(on), checkbox(on), checkbox(on), checkbox(on), checkbox(on), checkbox(on), checkbox(on), checkbox(on), checkbox(on), checkbox(on), checkbox(on), checkbox(on), checkbox(on), checkbox(on), checkbox(on), checkbox(on), checkbox(on), checkbox(on), checkbox(on), checkbox(on), checkbox(on), checkbox(on), checkbox(on), checkbox(on), checkbox(on), checkbox(on), checkbox(on), checkbox(on), checkbox(on), checkbox(on), checkbox(on)])
the_vault = ReportViewAlpaca4d(
    Caption="The vault of bricks, with its supports",
    View="Iso south-east",
    Zoom=1,
    Width=1,
    Aspect=0.62,
    Legend=False,
    mode="Report View Model")  # -> flatten(Figure)
reporttext_7 = ReportTextAlpaca4d(Text="Static analysis", menu=[dropdown(1)])
reporttext_8 = ReportTextAlpaca4d(
    Text="Under its own weight, the vault moves {static.maxDisplacement:F3} mm at most, at node {static.maxNode}.",
    menu=[dropdown(4)])
reporttext_9 = ReportTextAlpaca4d(Text="Displacement", menu=[dropdown(2)])
reporttext_10 = ReportTextAlpaca4d(Text="Stresses", menu=[dropdown(2)])
reporttext_11 = ReportTextAlpaca4d(Text="Reactions", menu=[dropdown(2)])
displacement = ReportViewAlpaca4d(
    Caption="Displacement, drawn 200 times larger",
    View="Iso south-east",
    Zoom=1,
    Width=1,
    Aspect=0.62,
    Legend=True,
    mode="Report View Static")  # -> flatten(Figure)
stresses = ReportViewAlpaca4d(
    Caption="Von Mises stress [{unit}]",
    View="Iso south-east",
    Zoom=1,
    Width=1,
    Aspect=0.62,
    Legend=True,
    mode="Report View Static")  # -> flatten(Figure)
reactions = ReportViewAlpaca4d(View="Iso south-east", Zoom=1, Width=1, Aspect=0.62, Legend=True, mode="Report View Static")  # -> flatten(Figure)
pagebreak = ReportPageBreakAlpaca4d()
modes = ReportViewAlpaca4d(
    Modes="6",
    Columns=2,
    Scale=1,
    View="Iso south-east",
    Zoom=1,
    Width=1,
    Aspect=0.62,
    Legend=False,
    mode="Report View Natural Vibration")  # -> flatten(Figure)
reporttext_12 = ReportTextAlpaca4d(Text="Natural vibration", menu=[dropdown(1)])
reporttext_13 = ReportTextAlpaca4d(
    Text="The vault's first mode, its own weight the mass that swings, is at {vibration.frequency[1]:F2} Hz.",
    menu=[dropdown(4)])

# ---- group: 11 - The report: set Write the report to True, then click Open report
content = Merge(
    Data1=reporttext,
    Data2=reporttext_2,
    Data3=reporttext_3,
    Data4=reporttext_4,
    Data5=model_summary,
    Data6=the_vault,
    Data7=reporttext_5,
    Data8=reporttext_6,
    Data9=reporttext_7,
    Data10=reporttext_8,
    Data11=reporttext_9,
    Data12=displacement,
    Data13=reporttext_10,
    Data14=stresses,
    Data15=reporttext_11,
    Data16=reactions,
    Data17=pagebreak,
    Data18=reporttext_12,
    Data19=reporttext_13,
    Data20=modes)
write_the_report = BooleanToggle(False)
report = ReportAlpaca4d(
    AlpacaModel=flatten([vault_of_bricks_2.AlpacaModel, run_analysis.AlpacaModel, natural_vibration.AlpacaModel]),
    Page=reportpage,
    Content=flatten(content),
    Run=write_the_report)  # -> File, Log, Template
pdf = Panel(report.File)
log = Panel(report.Log)
