# Grasshopper definition ReportFrame.gh (Grasshopper 1.0.7)
# plug-ins: Galapagos, Kangaroo2 Components, Alpaca4d

# ---- group: 1 - Geometry
columns = Line([Line((0, 0, 0), (0, 0, 1.166666667)), Line((0, 0, 1.166666667), (0, 0, 2.333333333)), Line((0, 0, 2.333333333), (0, 0, 3.5)), Line((0, 0, 3.5), (0, 0, 4.666666667)), Line((0, 0, 4.666666667), (0, 0, 5.833333333)), Line((0, 0, 5.833333333), (0, 0, 7))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])
beams_x = Line([Line((0, 0, 3.5), (2, 0, 3.5)), Line((2, 0, 3.5), (4, 0, 3.5)), Line((4, 0, 3.5), (6, 0, 3.5)), Line((0, 4, 3.5), (2, 4, 3.5)), Line((2, 4, 3.5), (4, 4, 3.5)), Line((4, 4, 3.5), (6, 4, 3.5)), Line((0, 0, 7), (2, 0, 7)), Line((2, 0, 7), (4, 0, 7)), Line((4, 0, 7), (6, 0, 7)), Line((0, 4, 7), (2, 4, 7)), Line((2, 4, 7), (4, 4, 7)), Line((4, 4, 7), (6, 4, 7))])
beams_y = Line([Line((0, 0, 3.5), (0, 1.333333333, 3.5)), Line((0, 1.333333333, 3.5), (0, 2.666666667, 3.5)), Line((0, 2.666666667, 3.5), (0, 4, 3.5)), Line((6, 0, 3.5), (6, 1.333333333, 3.5)), Line((6, 1.333333333, 3.5), (6, 2.666666667, 3.5)), Line((6, 2.666666667, 3.5), (6, 4, 3.5)), Line((0, 0, 7), (0, 1.333333333, 7)), Line((0, 1.333333333, 7), (0, 2.666666667, 7)), Line((0, 2.666666667, 7), (0, 4, 7)), Line((6, 0, 7), (6, 1.333333333, 7)), Line((6, 1.333333333, 7), (6, 2.666666667, 7)), Line((6, 2.666666667, 7), (6, 4, 7))])

# ---- group: 3 - Supports
feet = Point([Point(0, 0, 0), Point(6, 0, 0), Point(6, 4, 0), Point(0, 4, 0)])
fixed_feet = SupportAlpaca4d(Position=feet, Tx=True, Ty=True, Tz=True, Rx=True, Ry=True, Rz=True, mode="Support Rigid (Alpaca4d)")

# ---- group: 4 - Loads
first_floor_corners = Point([Point(0, 0, 3.5), Point(6, 0, 3.5), Point(6, 4, 3.5), Point(0, 4, 3.5)])
roof_corners = Point([Point(0, 0, 7), Point(6, 0, 7), Point(6, 4, 7), Point(0, 4, 7)])
own_weight = GravityLoadAlpaca4d(Factor=1)
first_floor = PointLoadAlpaca4d(Point=first_floor_corners, Force=Vector(0, 0, -120), Moment=Vector(0, 0, 0))
roof = PointLoadAlpaca4d(Point=roof_corners, Force=Vector(0, 0, -80), Moment=Vector(0, 0, 0))
wind = PointLoadAlpaca4d(Point=roof_corners, Force=Vector(10, 0, 0), Moment=Vector(0, 0, 0))
load_pattern = LoadPatternAlpaca4d(Loads=flatten([own_weight, first_floor, roof, wind]), Factor=1, mode="PlainPattern (Alpaca4d)")

# ---- group: 2 - Members
s355 = MaterialLibraryElasticAlpaca4d(
    MaterialName="S355",
    MaterialPresetElastic_Grade="S235",
    MaterialPresetElastic_Model="Uniaxial",
    MaterialPresetElastic_Type="Steel",
    menu=[dropdown(0), dropdown(1), dropdown(0)])
heb200 = SteelSectionLibraryAlpaca4d(SectionName="HEB200", Material=s355, menu=[dropdown(0), dropdown(1)])
ipe300 = SteelSectionLibraryAlpaca4d(SectionName="IPE300", Material=s355, menu=[dropdown(0), dropdown(1)])
ipe240 = SteelSectionLibraryAlpaca4d(SectionName="IPE240", Material=s355, menu=[dropdown(0), dropdown(1)])
columns_2 = ForceBeamColumnAlpaca4d(Line=columns, Section=heb200, Colour=RGB(1, 30, 254), mode="ForceBeamColumn (Alpaca4d)")
beams_x_2 = ForceBeamColumnAlpaca4d(Line=beams_x, Section=ipe300, Colour=RGB(1, 30, 254), mode="ForceBeamColumn (Alpaca4d)")
beams_y_2 = ForceBeamColumnAlpaca4d(Line=beams_y, Section=ipe240, Colour=RGB(1, 30, 254), mode="ForceBeamColumn (Alpaca4d)")

# ---- group: 5 - Assemble
assemble_model = AssembleModelAlpaca4d(
    Elements=flatten([columns_2, beams_x_2, beams_y_2]),
    Supports=flatten(fixed_feet),
    LoadPatterns=flatten(load_pattern),
    Tolerance=0.01)  # -> AlpacaModel, Mass
analysis_settings = AnalysisSettingsAlpaca4d(Constraint="Transformation", Numberer="RCM", System="Auto", Algorithm="Newton", AnalysisType="Static", Cores=0)

# ---- group: 6 - Analyses
natural_vibration = NaturalVibrationAnalysisAlpaca4d(AlpacaModel=assemble_model.AlpacaModel, VibrationModes=6, Solver="-genBandArpack")  # -> AlpacaModel, Eigenvalues, Period, Frequencies, Log, EigenValueAnalysis, TotalMassOfStructure, TotalFreeMass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
floor_nodes = Point([Point(0, 0, 3.5), Point(0, 0, 7), Point(0, 1.333333333, 3.5), Point(0, 1.333333333, 7), Point(0, 2.666666667, 3.5), Point(0, 2.666666667, 7), Point(0, 4, 3.5), Point(0, 4, 7), Point(2, 0, 3.5), Point(2, 0, 7), Point(2, 4, 3.5), Point(2, 4, 7), Point(4, 0, 3.5), Point(4, 0, 7), Point(4, 4, 3.5), Point(4, 4, 7), Point(6, 0, 3.5), Point(6, 0, 7), Point(6, 1.333333333, 3.5), Point(6, 1.333333333, 7), Point(6, 2.666666667, 3.5), Point(6, 2.666666667, 7), Point(6, 4, 3.5), Point(6, 4, 7)])
footfall = FootfallAnalysisAlpaca4d(
    AlpacaModel=natural_vibration.AlpacaModel,
    Walk=floor_nodes,
    WalkerMass=76,
    FrequencyWeighting="Wb",
    Activity="Walking",
    MinimumFrequency=1.8,
    MaximumFrequency=2.2,
    FrequencySteps=41,
    CutOff=10,
    Damping=0.03,
    mode="SelfExcitation")  # -> ResponseFactor, Point, CriticalFrequency, Report, SteadyStateFactor, TransientFactor, SteadyStateAcceleration, TransientAcceleration, AlpacaModel
run_analysis = RunAnalysisAlpaca4d(AlpacaModel=assemble_model.AlpacaModel, Settings=analysis_settings, settings=True)  # -> AlpacaModel, Log
linear_buckling = LinearBucklingAnalysisAlpaca4d(AlpacaModel=assemble_model.AlpacaModel, BucklingModes=4, Divisions=1)  # -> AlpacaModel, LoadFactors, Log

# ---- group: 7 - Page
title_block_drawing = GhPythonScript()  # -> out, Curves, Text
# ---------- title_block_drawing: Python ----------
import Rhino
import Rhino.Geometry as rg
from Rhino.DocObjects import TextHorizontalAlignment as H, TextVerticalAlignment as V

doc = Rhino.RhinoDoc.ActiveDoc
k = Rhino.RhinoMath.UnitScale(Rhino.UnitSystem.Millimeters, doc.ModelUnitSystem) if doc else 1.0

def at(x, y):
    return rg.Point3d(x * k, y * k, 0.0)

Curves = [rg.LineCurve(at(20, 282), at(190, 282)), rg.LineCurve(at(20, 17), at(190, 17))]
Text = []
for words, x, y, height, align, bold in [
        ("{title}", 20, 285, 3.6, H.Left, True),
        ("Report component test", 190, 285, 3.0, H.Right, False),
        ("Alpaca4d - {date}", 20, 10, 2.8, H.Left, False),
        ("Alpaca4d", 105, 10, 2.8, H.Center, True),
        ("Page {page} of {pages}", 190, 10, 2.8, H.Right, False)]:
    text = rg.TextEntity.Create(words, rg.Plane(at(x, y), rg.Vector3d.ZAxis), doc.DimStyles.Current, False, 0.0, 0.0)
    text.TextHeight = height * k
    text.TextHorizontalAlignment = align
    text.TextVerticalAlignment = V.Bottom
    try:
        text.SetBold(bold)
    except Exception:
        pass
    Text.append(text)
# ---------- end title_block_drawing ----------
titleblock = ReportTitleBlockAlpaca4d(Curves=title_block_drawing.Curves, Text=title_block_drawing.Text)
reportpage = ReportPageAlpaca4d(
    Width=210,
    Height=297,
    Top=24,
    Bottom=22,
    Left=20,
    Right=20,
    TitleBlock=titleblock,
    Numbered=True,
    menu=[dropdown(0), dropdown(0)])

# ---- group: 8 - Content
reporttext = ReportTextAlpaca4d(Text=["Two-storey steel frame", "Static, natural vibration and linear buckling analysis"], menu=[dropdown(0)])
reporttext_2 = ReportTextAlpaca4d(Text="The model", menu=[dropdown(1)])
reporttext_3 = ReportTextAlpaca4d(
    Text="A steel frame of two storeys, 6 m by 4 m on plan and 3.5 m a storey, fixed at its four feet. The columns are HEB200 and the beams IPE300 along X and IPE240 along Y, all S355. It has {model.nodes} nodes and {model.elements} elements, and weighs {model.mass:N0} kg.",
    menu=[dropdown(4)])
reporttext_4 = ReportTextAlpaca4d(Text="Members", menu=[dropdown(2)])
reporttext_5 = ReportTextAlpaca4d(Text="Loads", menu=[dropdown(2)])
model_summary = ReportResultTableAlpaca4d(menu=[dropdown(0), checkbox(on), checkbox(on), checkbox(on), checkbox(on), checkbox(on), checkbox(on), checkbox(on), checkbox(on), checkbox(on), checkbox(on), checkbox(on), checkbox(on), checkbox(on), checkbox(on), checkbox(on), checkbox(on), checkbox(on), checkbox(on), checkbox(on), checkbox(on), checkbox(on), checkbox(on), checkbox(on), checkbox(on), checkbox(on), checkbox(on), checkbox(on), checkbox(on), checkbox(on), checkbox(on), checkbox(on), checkbox(on), checkbox(on), checkbox(on), checkbox(on), checkbox(on), checkbox(on), checkbox(on), checkbox(on), checkbox(on), checkbox(on), checkbox(on), checkbox(on), checkbox(on), checkbox(on), checkbox(on), checkbox(on), checkbox(on), checkbox(on), checkbox(on), checkbox(on), checkbox(on), checkbox(on), checkbox(on), checkbox(on), checkbox(on), checkbox(on), checkbox(on), checkbox(on), checkbox(on), checkbox(on)])
beam_sections = ReportResultTableAlpaca4d(menu=[dropdown(1), checkbox(on), checkbox(on), checkbox(on), checkbox(on), checkbox(on), checkbox(on), checkbox(on), checkbox(on), checkbox(on), checkbox(off), checkbox(on), checkbox(on), checkbox(on), checkbox(on), checkbox(on), checkbox(on), checkbox(on), checkbox(on), checkbox(on), checkbox(on), checkbox(on), checkbox(on), checkbox(on), checkbox(on), checkbox(on), checkbox(on), checkbox(on), checkbox(on), checkbox(on), checkbox(on), checkbox(on), checkbox(on), checkbox(on), checkbox(on), checkbox(on), checkbox(on), checkbox(on), checkbox(on), checkbox(on), checkbox(on), checkbox(on), checkbox(on), checkbox(on), checkbox(on), checkbox(on), checkbox(on), checkbox(on), checkbox(on), checkbox(on), checkbox(on), checkbox(on), checkbox(on), checkbox(on), checkbox(on), checkbox(on), checkbox(on), checkbox(on), checkbox(on), checkbox(on), checkbox(on), checkbox(on)])
loads = ReportTableAlpaca4d(
    Caption="The loads, in one load pattern",
    Headers=["Load", "On", "Value"],
    Units=["", "", "kN"],
    Decimals=0,
    Column1=["Own weight", "First floor", "Roof", "Wind"],
    Column2=["every member", "each corner, down", "each corner, down", "each roof corner, along X"],
    Column3=["-", 120, 80, 10])
the_frame = ReportViewAlpaca4d(
    Caption="The frame, coloured by section, with its supports and loads",
    View="Iso south-east",
    Zoom=1,
    Width=1,
    Aspect=0.62,
    Legend=False,
    mode="Report View Model")  # -> flatten(Figure)
reporttext_6 = ReportTextAlpaca4d(Text="Static analysis", menu=[dropdown(1)])
reporttext_7 = ReportTextAlpaca4d(
    Text="Under its own weight, the floor loads and the wind, the frame moves {static.maxDisplacement:F1} mm at most, at node {static.maxNode}.",
    menu=[dropdown(4)])
reporttext_8 = ReportTextAlpaca4d(Text="Displacement", menu=[dropdown(2)])
reporttext_9 = ReportTextAlpaca4d(Text="Forces", menu=[dropdown(2)])
reporttext_10 = ReportTextAlpaca4d(Text="In the members", menu=[dropdown(3)])
reporttext_11 = ReportTextAlpaca4d(Text="At the supports", menu=[dropdown(3)])
displacement = ReportViewAlpaca4d(
    Caption="Displacement, drawn 50 times larger",
    View="Iso south-east",
    Zoom=1,
    Width=1,
    Aspect=0.62,
    Legend=True,
    mode="Report View Static")  # -> flatten(Figure)
member_forces = ReportViewAlpaca4d(View="Front", Zoom=1, Width=1, Aspect=0.62, Legend=True, mode="Report View Static")  # -> flatten(Figure)
reactions = ReportViewAlpaca4d(View="Front", Zoom=1, Width=1, Aspect=0.62, Legend=True, mode="Report View Static")  # -> flatten(Figure)
pagebreak = ReportPageBreakAlpaca4d()
modes = ReportViewAlpaca4d(
    Modes="6",
    Columns=2,
    Scale=1,
    Caption="Mode {mode}: f = {frequency:F2} Hz, T = {period:F3} s",
    View="Iso south-east",
    Zoom=1,
    Width=1,
    Aspect=0.62,
    Legend=False,
    mode="Report View Natural Vibration")  # -> flatten(Figure)
reporttext_12 = ReportTextAlpaca4d(Text="Natural vibration", menu=[dropdown(1)])
reporttext_13 = ReportTextAlpaca4d(
    Text="The first mode sways at {vibration.frequency[1]:F2} Hz. Their frequencies follow the pictures.",
    menu=[dropdown(4)])
reporttext_14 = ReportTextAlpaca4d(Text="Linear buckling", menu=[dropdown(1)])
reporttext_15 = ReportTextAlpaca4d(Text="The frame buckles first at {buckling.factor[1]:F2} times its loads.", menu=[dropdown(4)])
buckled_shapes = ReportViewAlpaca4d(
    Modes="4",
    Columns=2,
    Scale=1,
    View="Iso south-east",
    Zoom=1,
    Width=1,
    Aspect=0.62,
    Legend=False,
    mode="Report View Stability")  # -> flatten(Figure)
footfall_2 = ReportViewAlpaca4d(Range=Domain(0, 8), View="Iso south-east", Zoom=1, Width=1, Aspect=0.62, Legend=True, mode="Report View Footfall")  # -> flatten(Figure)
reporttext_16 = ReportTextAlpaca4d(Text="Footfall", menu=[dropdown(1)])
reporttext_17 = ReportTextAlpaca4d(
    Text="A person walking on the floors, after SCI P354, makes them respond up to R = {footfall.maxFactor:F1}, at node {footfall.maxNode}. The picture's top colour is 8, the limit for a general office.",
    menu=[dropdown(4)])

# ---- group: 9 - Report
content = Merge(
    Data1=reporttext,
    Data2=reporttext_2,
    Data3=reporttext_3,
    Data4=reporttext_4,
    Data5=model_summary,
    Data6=beam_sections,
    Data7=reporttext_5,
    Data8=loads,
    Data9=the_frame,
    Data10=reporttext_6,
    Data11=reporttext_7,
    Data12=reporttext_8,
    Data13=displacement,
    Data14=reporttext_9,
    Data15=reporttext_10,
    Data16=member_forces,
    Data17=reporttext_11,
    Data18=reactions,
    Data19=pagebreak,
    Data20=reporttext_12,
    Data21=reporttext_13,
    Data22=modes,
    Data23=reporttext_14,
    Data24=reporttext_15,
    Data25=buckled_shapes,
    Data26=reporttext_16,
    Data27=reporttext_17,
    Data28=footfall_2)
write_the_report = BooleanToggle(False)
report = ReportAlpaca4d(
    AlpacaModel=flatten([assemble_model.AlpacaModel, run_analysis.AlpacaModel, natural_vibration.AlpacaModel, linear_buckling.AlpacaModel, footfall.AlpacaModel]),
    Page=reportpage,
    Content=flatten(content),
    Run=write_the_report)  # -> File, Log, Template
pdf = Panel(report.File)
log = Panel(report.Log)
