# Grasshopper definition ReportStair.gh (Grasshopper 1.0.7)
# plug-ins: Galapagos, Kangaroo2 Components, Alpaca4d

# ---- group: 9 - The page: A4, its title block drawn by a script
title_block_drawing = GhPythonScript()  # -> out, Curves, Text
# ---------- title_block_drawing: Python ----------
import Rhino
import Rhino.Geometry as rg
from Rhino.DocObjects import TextHorizontalAlignment as H, TextVerticalAlignment as V

doc = Rhino.RhinoDoc.ActiveDoc
k = Rhino.RhinoMath.UnitScale(Rhino.UnitSystem.Millimeters, doc.ModelUnitSystem) if doc else 1.0

def at(x, y):
    return rg.Point3d(x * k, y * k, 0.0)

Curves = [rg.LineCurve(at(20, 282), at(190, 282)), rg.LineCurve(at(20, 17), at(190, 17))]
Text = []
for words, x, y, height, align, bold in [
        ("{title}", 20, 285, 3.6, H.Left, True),
        ("Alpaca4d example report - stair", 190, 285, 3.0, H.Right, False),
        ("Alpaca4d - {date}", 20, 10, 2.8, H.Left, False),
        ("Alpaca4d", 105, 10, 2.8, H.Center, True),
        ("Page {page} of {pages}", 190, 10, 2.8, H.Right, False)]:
    text = rg.TextEntity.Create(words, rg.Plane(at(x, y), rg.Vector3d.ZAxis), doc.DimStyles.Current, False, 0.0, 0.0)
    text.TextHeight = height * k
    text.TextHorizontalAlignment = align
    text.TextVerticalAlignment = V.Bottom
    try:
        text.SetBold(bold)
    except Exception:
        pass
    Text.append(text)
# ---------- end title_block_drawing ----------
titleblock = ReportTitleBlockAlpaca4d(Curves=title_block_drawing.Curves, Text=title_block_drawing.Text)
reportpage = ReportPageAlpaca4d(
    Width=210,
    Height=297,
    Top=24,
    Bottom=22,
    Left=20,
    Right=20,
    TitleBlock=titleblock,
    Numbered=True,
    menu=[dropdown(0), dropdown(0)])

# ---- group: 10 - The content, a chapter a column, in order
reporttext = ReportTextAlpaca4d(Text=["U-shaped stair", "Static, natural vibration and footfall analysis, after SCI P354"], menu=[dropdown(0)])
reporttext_2 = ReportTextAlpaca4d(Text="The model", menu=[dropdown(1)])
reporttext_3 = ReportTextAlpaca4d(
    Text="A U-shaped steel stair between floors 4.2 m apart: a long flight, a quarter landing, a short flight, a second quarter landing and a long flight back up, 1.2 m wide. Each flight hangs between two hollow section stringers, beams, 100 mm wide and 140 mm deep; its treads and the landings are 20 mm steel plates, shells; a landing rests on edge beams and a post under its free corner. It has {model.nodes} nodes and {model.elements} elements, and weighs {model.mass:N0} kg.",
    menu=[dropdown(4)])
reporttext_4 = ReportTextAlpaca4d(Text="Members", menu=[dropdown(2)])
reporttext_5 = ReportTextAlpaca4d(Text="Loads and mass", menu=[dropdown(2)])
reporttext_6 = ReportTextAlpaca4d(
    Text="For the static analysis, its own weight and 4.3 kN/m2 on the treads and landings: 0.3 of finishes and 4.0 imposed. For its vibration, as P354 has it, its own mass with the finishes and a tenth of the imposed load.",
    menu=[dropdown(4)])
model_summary = ReportResultTableAlpaca4d(menu=[dropdown(0), checkbox(on), checkbox(on), checkbox(on), checkbox(on), checkbox(on), checkbox(on), checkbox(on), checkbox(on), checkbox(on), checkbox(on), checkbox(on), checkbox(on), checkbox(on), checkbox(on), checkbox(on), checkbox(on), checkbox(on), checkbox(on), checkbox(on), checkbox(on), checkbox(on), checkbox(on), checkbox(on), checkbox(on), checkbox(on), checkbox(on), checkbox(on), checkbox(on), checkbox(on), checkbox(on), checkbox(on), checkbox(on), checkbox(on), checkbox(on), checkbox(on), checkbox(on), checkbox(on), checkbox(on), checkbox(on), checkbox(on), checkbox(on), checkbox(on), checkbox(on), checkbox(on), checkbox(on), checkbox(on), checkbox(on), checkbox(on), checkbox(on), checkbox(on), checkbox(on), checkbox(on), checkbox(on), checkbox(on), checkbox(on), checkbox(on), checkbox(on), checkbox(on), checkbox(on), checkbox(on), checkbox(on)])
beam_sections = ReportResultTableAlpaca4d(menu=[dropdown(1), checkbox(on), checkbox(on), checkbox(on), checkbox(on), checkbox(on), checkbox(on), checkbox(on), checkbox(on), checkbox(on), checkbox(on), checkbox(on), checkbox(on), checkbox(on), checkbox(on), checkbox(on), checkbox(on), checkbox(on), checkbox(on), checkbox(on), checkbox(on), checkbox(on), checkbox(on), checkbox(on), checkbox(on), checkbox(on), checkbox(on), checkbox(on), checkbox(on), checkbox(on), checkbox(on), checkbox(on), checkbox(on), checkbox(on), checkbox(on), checkbox(on), checkbox(on), checkbox(on), checkbox(on), checkbox(on), checkbox(on), checkbox(on), checkbox(on), checkbox(on), checkbox(on), checkbox(on), checkbox(on), checkbox(on), checkbox(on), checkbox(on), checkbox(on), checkbox(on), checkbox(on), checkbox(on), checkbox(on), checkbox(on), checkbox(on), checkbox(on), checkbox(on), checkbox(on), checkbox(on), checkbox(on)])
the_stair = ReportViewAlpaca4d(
    Caption="The stair, coloured by section, with its supports",
    View="Iso south-east",
    Zoom=1,
    Width=1,
    Aspect=0.62,
    Legend=False,
    mode="Report View Model")  # -> flatten(Figure)
reporttext_7 = ReportTextAlpaca4d(Text="Static analysis", menu=[dropdown(1)])
reporttext_8 = ReportTextAlpaca4d(
    Text="Under its own weight, the finishes and the imposed load, the stair moves {static.maxDisplacement:F1} mm at most, at node {static.maxNode}.",
    menu=[dropdown(4)])
reporttext_9 = ReportTextAlpaca4d(Text="Displacement", menu=[dropdown(2)])
reporttext_10 = ReportTextAlpaca4d(Text="Forces and stresses", menu=[dropdown(2)])
reporttext_11 = ReportTextAlpaca4d(Text="In the stringers", menu=[dropdown(3)])
reporttext_12 = ReportTextAlpaca4d(Text="In the plates", menu=[dropdown(3)])
reporttext_13 = ReportTextAlpaca4d(Text="Reactions", menu=[dropdown(2)])
displacement = ReportViewAlpaca4d(
    Caption="Displacement, drawn 100 times larger",
    View="Iso south-east",
    Zoom=1,
    Width=1,
    Aspect=0.62,
    Legend=True,
    mode="Report View Static")  # -> flatten(Figure)
stringer_forces = ReportViewAlpaca4d(View="Iso south-east", Zoom=1, Width=1, Aspect=0.62, Legend=True, mode="Report View Static")  # -> flatten(Figure)
plate_stresses = ReportViewAlpaca4d(
    Caption="Von Mises stress at the top of the plates [{unit}]",
    View="Iso south-east",
    Zoom=1,
    Width=1,
    Aspect=0.62,
    Legend=True,
    mode="Report View Static")  # -> flatten(Figure)
reactions = ReportViewAlpaca4d(View="Iso south-east", Zoom=1, Width=1, Aspect=0.62, Legend=True, mode="Report View Static")  # -> flatten(Figure)
pagebreak = ReportPageBreakAlpaca4d()
footfall = ReportViewAlpaca4d(Range=Domain(0, 32), View="Iso south-east", Zoom=1, Width=1, Aspect=0.62, Legend=True, mode="Report View Footfall")  # -> flatten(Figure)
modes = ReportViewAlpaca4d(
    Modes="6",
    Columns=2,
    Scale=1,
    View="Iso south-east",
    Zoom=1,
    Width=1,
    Aspect=0.62,
    Legend=False,
    mode="Report View Natural Vibration")  # -> flatten(Figure)
reporttext_14 = ReportTextAlpaca4d(Text="Natural vibration", menu=[dropdown(1)])
reporttext_15 = ReportTextAlpaca4d(
    Text="The stair's first mode, with the finishes and a tenth of the imposed load, is at {vibration.frequency[1]:F2} Hz.",
    menu=[dropdown(4)])
reporttext_16 = ReportTextAlpaca4d(Text="Footfall", menu=[dropdown(1)])
reporttext_17 = ReportTextAlpaca4d(
    Text="Someone walking up and down the stair at 1.2 to 4.5 steps a second, after SCI P354 with its coefficients for stairs, 0.5% damping and the 12 Hz cut-off, makes it respond up to R = {footfall.maxFactor:F1}, at node {footfall.maxNode}. P354 accepts 32 on a stair in light use: the picture's top colour.",
    menu=[dropdown(4)])
pagebreak_2 = ReportPageBreakAlpaca4d()

# ---- group: 1 - Geometry: three flights and two quarter landings between floors 4.2 m apart
width_m = Slider(1.2, range=0.9..1.8)
risers_long_flights = Slider(10, range=6..14)
risers_middle_flight = Slider(4, range=2..8)
rise_mm = Slider(175, range=150..190)
going_mm = Slider(275, range=250..320)
stringer_depth_mm = Slider(140, range=120..400)
plate_mm = Slider(20, range=6..40)

# ---- group: 4 - Mass: the finishes and a tenth of the imposed load, at the nodes of the plates
finishes_kn_m2 = Slider(0.3, range=0..2)
imposed_kn_m2 = Slider(4, range=0..5)

# ---- group: 1 - Geometry: three flights and two quarter landings between floors 4.2 m apart (continued)
footfall_stair = GhPythonScript(
    Width=width_m,
    LongRisers=risers_long_flights,
    MiddleRisers=risers_middle_flight,
    Rise=rise_mm,
    Going=going_mm,
    Finishes=finishes_kn_m2,
    Imposed=imposed_kn_m2)  # -> out, Stringers, Treads, Landings, LandingBeams, Posts, Feet, Tops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; inputs LongRisers: Int32, MiddleRisers: Int32, Rise: Int32, Going: Int32
# ---------- footfall_stair: Python ----------
# The code of FootfallStair.py's GhPython components: the stairs' geometry - a U-shaped stair (stair), a
# helical one of shells (helical) and a straight one of three flights (straight) - the map of the response
# factor Footfall Analysis finds where people walk, and the title of a mode.
#
# Written for both Python 3 (Rhino 8) and IronPython 2.7 (Rhino 7): no f-strings, ASCII only.

import math

import Rhino.Geometry as rg
import System.Drawing


def _key(p):
    """A point, to a tenth of a millimetre: the same node, whichever element it was made for. Not to the
    millimetre: a going of 275 mm puts the middle of a tread at 137.5 mm, on the edge between two
    millimetres, where the same point worked out two ways rounds either way."""
    return (int(round(p.X * 10000.0)), int(round(p.Y * 10000.0)), int(round(p.Z * 10000.0)))


def _quads(mesh, corners):
    """Adds a quad of four points to mesh, its vertices shared with the faces already there."""
    index = []
    for p in corners:
        index.append(mesh.Vertices.Add(p))
    mesh.Faces.AddFace(index[0], index[1], index[2], index[3])


def _grid(origin, u, v, nu, nv, us=None):
    """A mesh of quads over the parallelogram origin + a u + b v, a and b from 0 to 1, in nu by nv faces;
    us, when given, are the steps along u instead of even ones."""
    mesh = rg.Mesh()
    steps_u = us if us is not None else [i / float(nu) for i in range(nu + 1)]
    steps_v = [j / float(nv) for j in range(nv + 1)]
    for i in range(len(steps_u) - 1):
        for j in range(nv):
            a0, a1 = steps_u[i], steps_u[i + 1]
            b0, b1 = steps_v[j], steps_v[j + 1]
            _quads(mesh, [origin + u * a0 + v * b0, origin + u * a1 + v * b0,
                          origin + u * a1 + v * b1, origin + u * a0 + v * b1])
    mesh.Vertices.CombineIdentical(True, True)
    mesh.Normals.ComputeNormals()
    return mesh


def _segments(points):
    return [rg.Line(points[i], points[i + 1]) for i in range(len(points) - 1)]


def stair(Width, LongRisers, MiddleRisers, Rise, Going, Finishes, Imposed):
    """A U-shaped steel stair between two floors: a long flight up along X, a quarter landing, a short
    flight across along Y, a second quarter landing and a long flight back along -X to the floor
    above. Width in m; Rise and Going in mm; Finishes and Imposed in kN/m2.

    Each flight hangs between two stringers, straight lines through the middle of every tread's ends,
    so that each tread is fixed to them at the middle of its two ends. A short upright piece, half a
    rise, takes each stringer's end down or up to the landing or the floor. The treads are open, with
    no risers. A landing is a plate on a frame of four edge beams, with a post under its free corner."""
    w = float(Width)
    r = float(Rise) / 1000.0
    g = float(Going) / 1000.0
    n_long, n_mid = int(LongRisers), int(MiddleRisers)
    across = max(2, int(round(w / 0.3)))    # elements across a tread or a landing, about 300 mm

    stringers, treads, landings, landing_beams, posts = [], [], [], [], []
    feet, tops = [], []
    mass_area = {}

    def area(mesh):
        """Spreads each face's area over its four corners, for the mass of the finishes."""
        for f in range(mesh.Faces.Count):
            face = mesh.Faces[f]
            corners = [mesh.Vertices[face.A], mesh.Vertices[face.B], mesh.Vertices[face.C], mesh.Vertices[face.D]]
            p = [rg.Point3d(c) for c in corners]
            a = 0.5 * (rg.Vector3d.CrossProduct(p[1] - p[0], p[3] - p[0]).Length +
                       rg.Vector3d.CrossProduct(p[1] - p[2], p[3] - p[2]).Length)
            for c in p:
                k = _key(c)
                if k not in mass_area:
                    mass_area[k] = [c, 0.0]
                mass_area[k][1] += a / 4.0

    def flight(origin, d, s, z0, n, first=False, last=False):
        """n risers up from z0, going along d from origin, across s. Returns nothing; adds its
        stringers and treads."""
        run = (n - 1) * g
        for side in (0.0, w):
            base = origin + s * side
            # The stringer: through the middle of each tread's end, tread k at z0 + k r.
            line = [base + d * ((k - 0.5) * g) + rg.Vector3d(0, 0, z0 + k * r) for k in range(1, n)]
            start = base + d * (-0.5 * g) + rg.Vector3d(0, 0, z0) if first else base + rg.Vector3d(0, 0, z0)
            end = base + d * (run + 0.5 * g) + rg.Vector3d(0, 0, z0 + n * r) if last else base + d * run + rg.Vector3d(0, 0, z0 + n * r)
            points = [start]
            if not first:
                # Half a rise up from the landing to where the line starts.
                points.append(base + rg.Vector3d(0, 0, z0 + 0.5 * r))
            points += line
            if not last:
                points.append(base + d * run + rg.Vector3d(0, 0, z0 + (n - 0.5) * r))
            points.append(end)
            stringers.extend(_segments(points))
            if first:
                feet.append(start)
            if last:
                tops.append(end)
        for k in range(1, n):
            corner = origin + d * ((k - 1) * g) + rg.Vector3d(0, 0, z0 + k * r)
            mesh = _grid(corner, d * g, s * w, 2, across)
            treads.append(mesh)
            area(mesh)

    def landing(corner, size_u, size_v, z):
        """A square landing from corner, along size_u and size_v, at z: its plate and its edge beams."""
        origin = corner + rg.Vector3d(0, 0, z)
        mesh = _grid(origin, size_u, size_v, across, across)
        landings.append(mesh)
        area(mesh)
        for a, b in ((origin, size_u), (origin, size_v), (origin + size_u, size_v), (origin + size_v, size_u)):
            landing_beams.extend(_segments([a + b * (i / float(across)) for i in range(across + 1)]))

    x, y, z = rg.Vector3d(1, 0, 0), rg.Vector3d(0, 1, 0), rg.Vector3d(0, 0, 1)
    run_long, run_mid = (n_long - 1) * g, (n_mid - 1) * g
    z1 = n_long * r
    z2 = z1 + n_mid * r
    z3 = z2 + n_long * r

    # Up along X, onto the first landing.
    flight(rg.Point3d(0, 0, 0), x, y, 0.0, n_long, first=True)
    landing(rg.Point3d(run_long, 0, 0), x * w, y * w, z1)
    # Across along Y, onto the second.
    flight(rg.Point3d(run_long, w, 0), y, x, z1, n_mid)
    landing(rg.Point3d(run_long, w + run_mid, 0), x * w, y * w, z2)
    # Back along -X, to the floor above.
    flight(rg.Point3d(run_long, w + run_mid, 0), -x, y, z2, n_long, last=True)

    # A post under each landing's free corner, the one no stringer reaches.
    for corner, top in ((rg.Point3d(run_long + w, 0, 0), z1), (rg.Point3d(run_long + w, 2 * w + run_mid, 0), z2)):
        posts.append(rg.Line(corner, corner + z * top))
        feet.append(corner)

    # The finishes and a tenth of the imposed load, SCI P354's mass in use, at the nodes of the plates.
    per_area = (float(Finishes) + 0.1 * float(Imposed)) / 9.81 * 1000.0   # kg/m2
    mass_points, masses = [], []
    for k in sorted(mass_area):
        p, a = mass_area[k]
        m = per_area * a
        if m > 0.0:
            mass_points.append(p)
            masses.append(rg.Vector3d(m, m, m))

    steps = 2 * n_long + n_mid
    height = z3
    return stringers, treads, landings, landing_beams, posts, feet, tops, mass_points, masses, steps, height


# ---------------------------------------------------------------- a helical stair, all shells

def helical(Height, Risers, Turn, InnerRadius, Width, Parapet, Finishes, Imposed):
    """A helical stair of shells round an open well: a ribbon, the helicoid it climbs on, between two
    parapets, continuous curved walls Parapet tall that rise with it and carry it, the inner one round
    InnerRadius and the outer one Width further out. It turns Turn degrees as it climbs Height in Risers
    steps, and is built in at both ends: on the floor at its foot and into the floor it arrives at.

    The steps sit on the ribbon: drawn, for the map of the response factor, and their weight, with the
    finishes and a tenth of the imposed load, at the ribbon's nodes. Finishes and Imposed in kN/m2."""
    h = float(Height)
    n = int(Risers)
    turn = math.radians(float(Turn))
    ri, w, hp = float(InnerRadius), float(Width), float(Parapet)
    ro = ri + w
    rise = h / n
    pitch = h / turn                                   # height per radian
    per_step = 2
    na = n * per_step
    nr = max(2, int(round(w / 0.3)))
    nv = max(2, int(round(hp / 0.25)))
    angles = [turn * j / float(na) for j in range(na + 1)]
    radii = [ri + w * i / float(nr) for i in range(nr + 1)]

    def at(r, a, z):
        return rg.Point3d(r * math.cos(a), r * math.sin(a), z)

    def surface(rows, columns, point):
        """A mesh of quads over a grid of rows by columns, point(row, column) its nodes."""
        mesh = rg.Mesh()
        for i in range(rows):
            for j in range(columns):
                _quads(mesh, [point(i, j), point(i + 1, j), point(i + 1, j + 1), point(i, j + 1)])
        mesh.Vertices.CombineIdentical(True, True)
        mesh.Normals.ComputeNormals()
        return mesh

    ribbon = surface(nr, na, lambda i, j: at(radii[i], angles[j], pitch * angles[j]))
    inner = surface(nv, na, lambda i, j: at(ri, angles[j], pitch * angles[j] + hp * i / float(nv)))
    outer = surface(nv, na, lambda i, j: at(ro, angles[j], pitch * angles[j] + hp * i / float(nv)))

    # The steps, drawn only: tread k level at k rises, over its share of the turn, with its riser.
    steps = []
    da = turn / n
    for k in range(1, n + 1):
        a0, a1 = (k - 1) * da, k * da
        z = k * rise
        mesh = rg.Mesh()
        cuts = [a0 + (a1 - a0) * t / float(per_step) for t in range(per_step + 1)]
        for i in range(nr):
            for j in range(per_step):
                _quads(mesh, [at(radii[i], cuts[j], z), at(radii[i + 1], cuts[j], z),
                              at(radii[i + 1], cuts[j + 1], z), at(radii[i], cuts[j + 1], z)])
            # The riser, from the ribbon up to the tread.
            _quads(mesh, [at(radii[i], a0, pitch * a0), at(radii[i + 1], a0, pitch * a0),
                          at(radii[i + 1], a0, z), at(radii[i], a0, z)])
        mesh.Vertices.CombineIdentical(True, True)
        mesh.Normals.ComputeNormals()
        steps.append(mesh)

    # Built in at both ends: the ribbon's end and both parapets' end edges.
    supports = []
    for a in (0.0, turn):
        for r in radii:
            supports.append(at(r, a, pitch * a))
        for r in (ri, ro):
            for i in range(1, nv + 1):
                supports.append(at(r, a, pitch * a + hp * i / float(nv)))

    mass_points, masses = _masses([ribbon], Finishes, Imposed)
    return ribbon, inner, outer, steps, supports, mass_points, masses, n, h


# ---------------------------------------------------------------- a straight stair, three flights

def straight(Width, Risers, Flights, Rise, Going, Landing, Depth, Finishes, Imposed):
    """A straight stair of Flights flights of Risers risers each, in one line, with a landing Landing long
    between each two, held only at its two ends. Two steel plate stringers, Depth deep below the line
    through the middle of the treads and 100 mm above it, run its whole length; the treads, open, and the
    landings are plates between them. A tread is welded to the stringers along its ends: it shares the node
    at the middle of each end with them, and its four corners follow the stringer nodes half a rise below
    or above them, LinkRetained to LinkConstrained, through rigid links. Without them each tread would hang
    from one node a side, and the stringers, tall thin plates, would flap sideways.
    Width in m, Rise, Going and Depth in mm; Finishes and Imposed in kN/m2."""
    w = float(Width)
    n, flights = int(Risers), int(Flights)
    r, g = float(Rise) / 1000.0, float(Going) / 1000.0
    landing, depth = float(Landing), float(Depth) / 1000.0
    up = 0.1
    across = max(2, int(round(w / 0.3)))
    treads, landings = [], []
    retained, constrained = [], []

    # The stringers' line through the middle of the treads, station by station along X, with the
    # landings between the flights level on it.
    line = []
    x, z = 0.0, 0.0
    for f in range(flights):
        run = (n - 1) * g
        # From half a going before the first riser, at the level below, to half a going past the last,
        # at the level above: through the middle of every tread, and its ends.
        for k in range(0, 2 * n + 1):
            xs = x - 0.5 * g + 0.5 * k * g
            line.append((xs, z + r * ((xs - x) / g + 0.5)))
        for k in range(1, n):
            treads.append(_grid(rg.Point3d(x + (k - 1) * g, 0, z + k * r), rg.Vector3d(g, 0, 0), rg.Vector3d(0, w, 0), 2, across))
            for y in (0.0, w):
                # The front corner over the stringer node half a rise below it, the back one under the
                # node half a rise above.
                for xc, dz in ((x + (k - 1) * g, -0.5 * r), (x + k * g, 0.5 * r)):
                    retained.append(rg.Point3d(xc, y, z + k * r + dz))
                    constrained.append(rg.Point3d(xc, y, z + k * r))
        x_end, z = x + run, z + n * r
        if f < flights - 1:
            # The landing, its edges on the line between half a going in from either end.
            inner = landing - g
            count = max(1, int(round(inner / 0.3)))
            for k in range(1, count + 1):
                line.append((x_end + 0.5 * g + inner * k / float(count), z))
            steps_u = [0.0, 0.5 * g / landing] + [(0.5 * g + inner * k / float(count)) / landing for k in range(1, count)] + \
                      [(landing - 0.5 * g) / landing, 1.0]
            landings.append(_grid(rg.Point3d(x_end, 0, z), rg.Vector3d(landing, 0, 0), rg.Vector3d(0, w, 0), len(steps_u) - 1, across, steps_u))
            x = x_end + landing
        else:
            x = x_end
    # One station each, in order.
    stations = []
    for xs, zs in line:
        if not stations or abs(xs - stations[-1][0]) > 1e-6:
            stations.append((xs, zs))

    offsets = [-depth * (1.0 - k / float(max(1, int(round(depth / 0.15))))) for k in range(int(round(depth / 0.15)) + 1)] + [up]
    offsets = sorted(set(round(o, 6) for o in offsets))
    stringers = []
    for y in (0.0, w):
        mesh = rg.Mesh()
        for j in range(len(stations) - 1):
            (x0, z0), (x1, z1) = stations[j], stations[j + 1]
            for i in range(len(offsets) - 1):
                _quads(mesh, [rg.Point3d(x0, y, z0 + offsets[i]), rg.Point3d(x1, y, z1 + offsets[i]),
                              rg.Point3d(x1, y, z1 + offsets[i + 1]), rg.Point3d(x0, y, z0 + offsets[i + 1])])
        mesh.Vertices.CombineIdentical(True, True)
        mesh.Normals.ComputeNormals()
        stringers.append(mesh)

    # Held at the two ends of the stringers, every node of their end edges: on the floor and at the
    # floor above, and nowhere between.
    supports = []
    for xs, zs in (stations[0], stations[-1]):
        for y in (0.0, w):
            for o in offsets:
                supports.append(rg.Point3d(xs, y, zs + o))

    mass_points, masses = _masses(treads + landings, Finishes, Imposed)
    return stringers, treads, landings, supports, retained, constrained, mass_points, masses, flights * n, z


def _masses(meshes, Finishes, Imposed):
    """The finishes and a tenth of the imposed load as masses at the meshes' nodes, each node its share of
    the faces round it: SCI P354's mass in use. In kg, one per node."""
    per_area = (float(Finishes) + 0.1 * float(Imposed)) / 9.81 * 1000.0
    share = {}
    for mesh in meshes:
        for f in range(mesh.Faces.Count):
            face = mesh.Faces[f]
            p = [rg.Point3d(mesh.Vertices[k]) for k in (face.A, face.B, face.C, face.D)]
            a = 0.5 * (rg.Vector3d.CrossProduct(p[1] - p[0], p[3] - p[0]).Length +
                       rg.Vector3d.CrossProduct(p[1] - p[2], p[3] - p[2]).Length)
            for c in p:
                k = _key(c)
                if k not in share:
                    share[k] = [c, 0.0]
                share[k][1] += a / 4.0
    points, masses = [], []
    for k in sorted(share):
        m = per_area * share[k][1]
        if m > 0.0:
            points.append(share[k][0])
            masses.append(rg.Vector3d(m, m, m))
    return points, masses


# ---------------------------------------------------------------- the response map

# The response factor's colours, from still to the limit: a pale green, Alpaca4d's light green, a
# yellow and its orange; past the limit, red. Not the colours of the modes, which are blues.
SCALE = [(214, 236, 190), (175, 201, 48), (242, 201, 76), (235, 108, 63)]
# Past the limit, reds, light to dark, so that how far past it still shows.
OVER = [(229, 83, 61), (198, 40, 40), (122, 18, 28)]
DARK = (42, 45, 49)


def _ramp(stops, t):
    t = min(1.0, max(0.0, t))
    f = t * (len(stops) - 1)
    i = min(int(f), len(stops) - 2)
    u = f - i
    a, b = stops[i], stops[i + 1]
    return System.Drawing.Color.FromArgb(255, *[int(round(a[j] + (b[j] - a[j]) * u)) for j in range(3)])


def _colour(t):
    t = min(1.0, max(0.0, t))
    f = t * (len(SCALE) - 1)
    i = min(int(f), len(SCALE) - 2)
    u = f - i
    a, b = SCALE[i], SCALE[i + 1]
    return System.Drawing.Color.FromArgb(255, *[int(round(a[j] + (b[j] - a[j]) * u)) for j in range(3)])


def response_map(Surfaces, Shown, Points, Factors, Limit, Bands, Lift):
    """Where people walk, coloured by the response factor: Surfaces, the analysed meshes they walk on, read
    at their nodes; drawn on Shown, the steps of a stair drawn over its ribbon, from the nearest of those
    nodes, or on Surfaces themselves when Shown is empty, raised Lift. Bands colours over 0 to the largest,
    pale green to orange, and red past Limit, the response factor accepted. Gives what a Legend needs - the value at each colour's
    edge and the colours - the node that shakes the most, a label for it and a marker on it."""
    factor = {}
    for p, f in zip(Points, Factors):
        factor[_key(p)] = f
    nodes = {}
    for m in Surfaces:
        for v in range(m.Vertices.Count):
            p = rg.Point3d(m.Vertices[v])
            k = _key(p)
            if k in factor:
                nodes[k] = (p, factor[k])
    found = list(nodes.values())
    limit = float(Limit) if Limit else 32.0
    bands = max(2, int(Bands))
    top = max([f for p, f in found]) if found else 0.0
    lift = rg.Vector3d(0, 0, float(Lift or 0.0))

    # Even bands, so that the Legend, which labels its edges evenly between the smallest and the largest,
    # reads them right. Under the limit they span 0 to the largest, pale green to orange. Past it the limit
    # is an edge, with at least three bands under it, green to orange, and reds over it, darker further
    # past; the last band holds everything above it, however far past.
    if top > limit:
        under = min(bands - 1, max(3, int(round(bands * limit / top))))
        width = limit / float(under)
        edges = [width * k for k in range(bands + 1)]
        colours = [_colour((k + 0.5) / under) for k in range(under)] + \
                  [_ramp(OVER, (k + 0.5) / (bands - under)) for k in range(bands - under)]
    else:
        span = top if top > 0.0 else limit
        edges = [span * k / float(bands) for k in range(bands + 1)]
        colours = [_colour((k + 0.5) / bands) for k in range(bands)]

    def colour_of(f):
        for k in range(len(colours)):
            if f <= edges[k + 1] + 1e-9:
                return colours[k]
        return colours[-1]

    def nearest(p, count=3):
        """The response factor at p from the nearest nodes, each weighed by the inverse of its distance."""
        best = sorted(found, key=lambda q: q[0].DistanceToSquared(p))[:count]
        weights = [1.0 / max(1e-6, q[0].DistanceTo(p)) for q in best]
        return sum(wt * q[1] for wt, q in zip(weights, best)) / sum(weights)

    coloured = []
    shown = [m for m in (Shown or []) if m is not None]
    for m in (shown if shown else Surfaces):
        mesh = m.DuplicateMesh()
        mesh.VertexColors.Clear()
        for v in range(mesh.Vertices.Count):
            p = rg.Point3d(mesh.Vertices[v])
            f = nearest(p) if shown else factor.get(_key(p), 0.0)
            mesh.VertexColors.Add(colour_of(f))
        mesh.Translate(lift)
        coloured.append(mesh)

    peak = marker = None
    if found:
        # A pin on the node that shakes the most: a dark ball on it and a stalk up to the label, 1.2 m
        # above, clear of a parapet.
        at = max(found, key=lambda q: q[1])[0] + lift
        peak = at + rg.Vector3d(0, 0, 1.25)
        marker = rg.Mesh.CreateFromSphere(rg.Sphere(at, 0.06), 16, 12)
        stalk = rg.Mesh.CreateFromCylinder(rg.Cylinder(rg.Circle(rg.Plane(at, rg.Vector3d.ZAxis), 0.012), 1.2), 1, 12)
        if stalk is not None:
            marker.Append(stalk)
        marker.VertexColors.CreateMonotoneMesh(System.Drawing.Color.FromArgb(255, *DARK))
    label = "R = {0:.1f} {1} {2:g}".format(top, ">" if top > limit else "<=", limit)
    title = "Response factor R, limit {0:g}{1}".format(limit, ", largest {0:.0f}".format(top) if top > edges[-1] else "")
    return coloured, edges, colours, peak, label, marker, title


def mode_title(Frequencies, Mode):
    """The title of a mode's legend: its number and its frequency."""
    m = int(Mode or 0)
    if Frequencies and 0 <= m < len(Frequencies):
        return "Mode {0}: {1:.2f} Hz".format(m, float(Frequencies[m]))
    return "Mode {0}".format(m)


Stringers, Treads, Landings, LandingBeams, Posts, Feet, Tops, MassPoints, Masses, Steps, Height = stair(Width, LongRisers, MiddleRisers, Rise, Going, Finishes, Imposed)
# ---------- end footfall_stair ----------

# ---- group: 2 - Members: hollow section stringers of Stringer depth, RHS edge beams and CHS posts in S355, steel plate treads and landings as ASD Shells
s355 = MaterialLibraryElasticAlpaca4d(
    MaterialName="S355",
    Colour=RGB(42, 45, 49),
    MaterialPresetElastic_Grade="S235",
    MaterialPresetElastic_Model="Uniaxial",
    MaterialPresetElastic_Type="Steel",
    menu=[dropdown(0), dropdown(1), dropdown(0)])
_200x100x8 = SteelSectionLibraryAlpaca4d(SectionName="200x100x8", Material=s355, menu=[dropdown(0), dropdown(1)])
_139_7x8 = SteelSectionLibraryAlpaca4d(SectionName="139.7x8", Material=s355, menu=[dropdown(0), dropdown(1)])
depth_m = Expression(d=stringer_depth_mm, Expression="d/1000")
stringer = RectangleHollowAlpaca4d(
    SectionName="Stringer, 100 wide, 8 mm thick",
    Width=0.1,
    Height=depth_m,
    Web=0.008,
    TopFlange=0.008,
    BottomFlange=0.008,
    Material=s355)
plate_steel = ND(
    MaterialName="S355 plate",
    E=210000000,
    G=80769230.77,
    Ν=0.3,
    Rho=7850,
    Colour=RGB(222, 225, 229),
    mode="ElasticIsotropic (Alpaca4d)")
plate_m = Expression(t=plate_mm, Expression="t/1000")
tread_plate = PlateFiberSectionAlpaca4d(SectionName="Tread plate", Thickness=plate_m, Material=plate_steel)
treads = ASDShellAlpaca4d(Mesh=flatten(footfall_stair.Treads), Section=tread_plate, IsCorotational=False)
landings = ASDShellAlpaca4d(Mesh=flatten(footfall_stair.Landings), Section=tread_plate, IsCorotational=False)
stringers = ForceBeamColumnAlpaca4d(Line=footfall_stair.Stringers, Section=stringer, Colour=RGB(1, 30, 254), mode="ForceBeamColumn (Alpaca4d)")
landing_beams = ForceBeamColumnAlpaca4d(Line=footfall_stair.LandingBeams, Section=_200x100x8, Colour=RGB(1, 30, 254), mode="ForceBeamColumn (Alpaca4d)")
posts = ForceBeamColumnAlpaca4d(Line=footfall_stair.Posts, Section=_139_7x8, Colour=RGB(1, 30, 254), mode="ForceBeamColumn (Alpaca4d)")

# ---- group: 3 - Supports: pinned at the feet of the stringers and posts, and where the top flight meets the floor
pinned_feet = SupportAlpaca4d(Position=footfall_stair.Feet, Tx=True, Ty=True, Tz=True, Rx=False, Ry=False, Rz=False, mode="Support Rigid (Alpaca4d)")
floor_above = SupportAlpaca4d(Position=footfall_stair.Tops, Tx=True, Ty=True, Tz=True, Rx=False, Ry=False, Rz=False, mode="Support Rigid (Alpaca4d)")

# ---- group: 4 - Mass: the finishes and a tenth of the imposed load, at the nodes of the plates (continued)
finishes_and_10_imposed = MassPointAlpaca4d(Point=footfall_stair.MassPoints, TransMass=footfall_stair.Masses, RotationalMass=Vector(0, 0, 0))

# ---- group: 5 - Analysis: the first 12 modes, then Footfall Analysis with P354's stair coefficients
limit_r = Slider(32, range=1..64)

# ---- group: 6 - Results: the response factor on the treads and landings against Limit R, the stair, and the mode Mode picks
above_the_plate_m = Expression(t=plate_mm, Expression="t/2000+0.002")
bands = Slider(8, range=3..12)
mode = Slider(1, range=0..11)

# ---- group: 8 - For the report: loads and analyses
finishes_and_imposed_4_3_kn_m2 = MeshLoadAlpaca4d(ShellId=flatten([treads, landings]), Force=Vector(0, 0, -4.3))
own_weight = GravityLoadAlpaca4d(Factor=1)
own_weight_and_loads = LoadPatternAlpaca4d(Loads=flatten([own_weight, finishes_and_imposed_4_3_kn_m2]), Factor=1, mode="PlainPattern (Alpaca4d)")
analysis_settings = AnalysisSettingsAlpaca4d(Constraint="Transformation", Numberer="RCM", System="Auto", Algorithm="Newton", AnalysisType="Static", Cores=0)

# ---- group: 5 - Analysis: the first 12 modes, then Footfall Analysis with P354's stair coefficients (continued)
footfall_stair_2 = AssembleModelAlpaca4d(
    Elements=flatten([stringers, landing_beams, posts, treads, landings]),
    Supports=flatten([pinned_feet, floor_above]),
    LoadPatterns=flatten([finishes_and_10_imposed, own_weight_and_loads]),
    Tolerance=0.01)  # -> AlpacaModel, Mass
# Footfall stair: Footfall stair - how much a steel stair shakes when people walk up and down it, after SCI P354.
# 
# A U-shaped stair between two floors: a long flight up, a quarter landing, a short flight across, a second quarter landing and a long flight back up. Each flight hangs between two stringers, hollow sections 100 mm wide, their depth a slider; its open treads, steel plates, are fixed to them at the middle of their ends. A landing is a plate on four 200 x 100 x 8 edge beams, a 139.7 x 8 post under its free corner.
# 
# Natural Vibration finds its first 12 modes. Footfall Analysis then walks a 76 kg person up and down it at 1.2 to 4.5 steps a second, with P354's Fourier coefficients for stairs (Table 3.2), 0.5% damping for welded steel and the 12 Hz cut-off for stairs, the walker at each node in turn (self excitation), and the response building up over every step of the stair. The treads and landings are coloured by the response factor R, green to orange up to Limit R and red past it: P354 accepts 32 on a stair in light use, 24 in heavy use.
# 
# Try: Stringer depth down until the flights turn red; Plate thicker, or Width narrower; Finishes up, which adds mass; and Mode through the modes, their frequency in the legend.
natural_vibration = NaturalVibrationAnalysisAlpaca4d(AlpacaModel=footfall_stair_2.AlpacaModel, VibrationModes=12, Solver="-genBandArpack")  # -> AlpacaModel, Eigenvalues, Period, Frequencies, Log, EigenValueAnalysis, TotalMassOfStructure, TotalFreeMass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
footfall_2 = FootfallAnalysisAlpaca4d(
    AlpacaModel=natural_vibration.AlpacaModel,
    Footsteps=footfall_stair.Steps,
    WalkerMass=76,
    FrequencyWeighting="Wb",
    Activity="Stairs",
    MinimumFrequency=1.2,
    MaximumFrequency=4.5,
    FrequencySteps=331,
    CutOff=12,
    Damping=0.005,
    mode="SelfExcitation")  # -> ResponseFactor, Point, CriticalFrequency, Report, SteadyStateFactor, TransientFactor, SteadyStateAcceleration, TransientAcceleration, AlpacaModel
frequencies_hz = Panel(natural_vibration.Frequencies)
footfall_report = Panel(footfall_2.Report)

# ---- group: 6 - Results: the response factor on the treads and landings against Limit R, the stair, and the mode Mode picks (continued)
response_map = GhPythonScript(
    Surfaces=flatten([footfall_stair.Treads, footfall_stair.Landings]),
    Points=footfall_2.Point,
    Factors=footfall_2.ResponseFactor,
    Limit=limit_r,
    Bands=bands,
    Lift=above_the_plate_m)  # -> out, Map, Values, Colours, Peak, Label, Marker, Title; inputs Surfaces: list of Mesh, Shown: list of Mesh, Points: list of Point3d, Factors: list, Bands: Int32
# ---------- response_map: Python ----------
# The code of FootfallStair.py's GhPython components: the stairs' geometry - a U-shaped stair (stair), a
# helical one of shells (helical) and a straight one of three flights (straight) - the map of the response
# factor Footfall Analysis finds where people walk, and the title of a mode.
#
# Written for both Python 3 (Rhino 8) and IronPython 2.7 (Rhino 7): no f-strings, ASCII only.

import math

import Rhino.Geometry as rg
import System.Drawing


def _key(p):
    """A point, to a tenth of a millimetre: the same node, whichever element it was made for. Not to the
    millimetre: a going of 275 mm puts the middle of a tread at 137.5 mm, on the edge between two
    millimetres, where the same point worked out two ways rounds either way."""
    return (int(round(p.X * 10000.0)), int(round(p.Y * 10000.0)), int(round(p.Z * 10000.0)))


def _quads(mesh, corners):
    """Adds a quad of four points to mesh, its vertices shared with the faces already there."""
    index = []
    for p in corners:
        index.append(mesh.Vertices.Add(p))
    mesh.Faces.AddFace(index[0], index[1], index[2], index[3])


def _grid(origin, u, v, nu, nv, us=None):
    """A mesh of quads over the parallelogram origin + a u + b v, a and b from 0 to 1, in nu by nv faces;
    us, when given, are the steps along u instead of even ones."""
    mesh = rg.Mesh()
    steps_u = us if us is not None else [i / float(nu) for i in range(nu + 1)]
    steps_v = [j / float(nv) for j in range(nv + 1)]
    for i in range(len(steps_u) - 1):
        for j in range(nv):
            a0, a1 = steps_u[i], steps_u[i + 1]
            b0, b1 = steps_v[j], steps_v[j + 1]
            _quads(mesh, [origin + u * a0 + v * b0, origin + u * a1 + v * b0,
                          origin + u * a1 + v * b1, origin + u * a0 + v * b1])
    mesh.Vertices.CombineIdentical(True, True)
    mesh.Normals.ComputeNormals()
    return mesh


def _segments(points):
    return [rg.Line(points[i], points[i + 1]) for i in range(len(points) - 1)]


def stair(Width, LongRisers, MiddleRisers, Rise, Going, Finishes, Imposed):
    """A U-shaped steel stair between two floors: a long flight up along X, a quarter landing, a short
    flight across along Y, a second quarter landing and a long flight back along -X to the floor
    above. Width in m; Rise and Going in mm; Finishes and Imposed in kN/m2.

    Each flight hangs between two stringers, straight lines through the middle of every tread's ends,
    so that each tread is fixed to them at the middle of its two ends. A short upright piece, half a
    rise, takes each stringer's end down or up to the landing or the floor. The treads are open, with
    no risers. A landing is a plate on a frame of four edge beams, with a post under its free corner."""
    w = float(Width)
    r = float(Rise) / 1000.0
    g = float(Going) / 1000.0
    n_long, n_mid = int(LongRisers), int(MiddleRisers)
    across = max(2, int(round(w / 0.3)))    # elements across a tread or a landing, about 300 mm

    stringers, treads, landings, landing_beams, posts = [], [], [], [], []
    feet, tops = [], []
    mass_area = {}

    def area(mesh):
        """Spreads each face's area over its four corners, for the mass of the finishes."""
        for f in range(mesh.Faces.Count):
            face = mesh.Faces[f]
            corners = [mesh.Vertices[face.A], mesh.Vertices[face.B], mesh.Vertices[face.C], mesh.Vertices[face.D]]
            p = [rg.Point3d(c) for c in corners]
            a = 0.5 * (rg.Vector3d.CrossProduct(p[1] - p[0], p[3] - p[0]).Length +
                       rg.Vector3d.CrossProduct(p[1] - p[2], p[3] - p[2]).Length)
            for c in p:
                k = _key(c)
                if k not in mass_area:
                    mass_area[k] = [c, 0.0]
                mass_area[k][1] += a / 4.0

    def flight(origin, d, s, z0, n, first=False, last=False):
        """n risers up from z0, going along d from origin, across s. Returns nothing; adds its
        stringers and treads."""
        run = (n - 1) * g
        for side in (0.0, w):
            base = origin + s * side
            # The stringer: through the middle of each tread's end, tread k at z0 + k r.
            line = [base + d * ((k - 0.5) * g) + rg.Vector3d(0, 0, z0 + k * r) for k in range(1, n)]
            start = base + d * (-0.5 * g) + rg.Vector3d(0, 0, z0) if first else base + rg.Vector3d(0, 0, z0)
            end = base + d * (run + 0.5 * g) + rg.Vector3d(0, 0, z0 + n * r) if last else base + d * run + rg.Vector3d(0, 0, z0 + n * r)
            points = [start]
            if not first:
                # Half a rise up from the landing to where the line starts.
                points.append(base + rg.Vector3d(0, 0, z0 + 0.5 * r))
            points += line
            if not last:
                points.append(base + d * run + rg.Vector3d(0, 0, z0 + (n - 0.5) * r))
            points.append(end)
            stringers.extend(_segments(points))
            if first:
                feet.append(start)
            if last:
                tops.append(end)
        for k in range(1, n):
            corner = origin + d * ((k - 1) * g) + rg.Vector3d(0, 0, z0 + k * r)
            mesh = _grid(corner, d * g, s * w, 2, across)
            treads.append(mesh)
            area(mesh)

    def landing(corner, size_u, size_v, z):
        """A square landing from corner, along size_u and size_v, at z: its plate and its edge beams."""
        origin = corner + rg.Vector3d(0, 0, z)
        mesh = _grid(origin, size_u, size_v, across, across)
        landings.append(mesh)
        area(mesh)
        for a, b in ((origin, size_u), (origin, size_v), (origin + size_u, size_v), (origin + size_v, size_u)):
            landing_beams.extend(_segments([a + b * (i / float(across)) for i in range(across + 1)]))

    x, y, z = rg.Vector3d(1, 0, 0), rg.Vector3d(0, 1, 0), rg.Vector3d(0, 0, 1)
    run_long, run_mid = (n_long - 1) * g, (n_mid - 1) * g
    z1 = n_long * r
    z2 = z1 + n_mid * r
    z3 = z2 + n_long * r

    # Up along X, onto the first landing.
    flight(rg.Point3d(0, 0, 0), x, y, 0.0, n_long, first=True)
    landing(rg.Point3d(run_long, 0, 0), x * w, y * w, z1)
    # Across along Y, onto the second.
    flight(rg.Point3d(run_long, w, 0), y, x, z1, n_mid)
    landing(rg.Point3d(run_long, w + run_mid, 0), x * w, y * w, z2)
    # Back along -X, to the floor above.
    flight(rg.Point3d(run_long, w + run_mid, 0), -x, y, z2, n_long, last=True)

    # A post under each landing's free corner, the one no stringer reaches.
    for corner, top in ((rg.Point3d(run_long + w, 0, 0), z1), (rg.Point3d(run_long + w, 2 * w + run_mid, 0), z2)):
        posts.append(rg.Line(corner, corner + z * top))
        feet.append(corner)

    # The finishes and a tenth of the imposed load, SCI P354's mass in use, at the nodes of the plates.
    per_area = (float(Finishes) + 0.1 * float(Imposed)) / 9.81 * 1000.0   # kg/m2
    mass_points, masses = [], []
    for k in sorted(mass_area):
        p, a = mass_area[k]
        m = per_area * a
        if m > 0.0:
            mass_points.append(p)
            masses.append(rg.Vector3d(m, m, m))

    steps = 2 * n_long + n_mid
    height = z3
    return stringers, treads, landings, landing_beams, posts, feet, tops, mass_points, masses, steps, height


# ---------------------------------------------------------------- a helical stair, all shells

def helical(Height, Risers, Turn, InnerRadius, Width, Parapet, Finishes, Imposed):
    """A helical stair of shells round an open well: a ribbon, the helicoid it climbs on, between two
    parapets, continuous curved walls Parapet tall that rise with it and carry it, the inner one round
    InnerRadius and the outer one Width further out. It turns Turn degrees as it climbs Height in Risers
    steps, and is built in at both ends: on the floor at its foot and into the floor it arrives at.

    The steps sit on the ribbon: drawn, for the map of the response factor, and their weight, with the
    finishes and a tenth of the imposed load, at the ribbon's nodes. Finishes and Imposed in kN/m2."""
    h = float(Height)
    n = int(Risers)
    turn = math.radians(float(Turn))
    ri, w, hp = float(InnerRadius), float(Width), float(Parapet)
    ro = ri + w
    rise = h / n
    pitch = h / turn                                   # height per radian
    per_step = 2
    na = n * per_step
    nr = max(2, int(round(w / 0.3)))
    nv = max(2, int(round(hp / 0.25)))
    angles = [turn * j / float(na) for j in range(na + 1)]
    radii = [ri + w * i / float(nr) for i in range(nr + 1)]

    def at(r, a, z):
        return rg.Point3d(r * math.cos(a), r * math.sin(a), z)

    def surface(rows, columns, point):
        """A mesh of quads over a grid of rows by columns, point(row, column) its nodes."""
        mesh = rg.Mesh()
        for i in range(rows):
            for j in range(columns):
                _quads(mesh, [point(i, j), point(i + 1, j), point(i + 1, j + 1), point(i, j + 1)])
        mesh.Vertices.CombineIdentical(True, True)
        mesh.Normals.ComputeNormals()
        return mesh

    ribbon = surface(nr, na, lambda i, j: at(radii[i], angles[j], pitch * angles[j]))
    inner = surface(nv, na, lambda i, j: at(ri, angles[j], pitch * angles[j] + hp * i / float(nv)))
    outer = surface(nv, na, lambda i, j: at(ro, angles[j], pitch * angles[j] + hp * i / float(nv)))

    # The steps, drawn only: tread k level at k rises, over its share of the turn, with its riser.
    steps = []
    da = turn / n
    for k in range(1, n + 1):
        a0, a1 = (k - 1) * da, k * da
        z = k * rise
        mesh = rg.Mesh()
        cuts = [a0 + (a1 - a0) * t / float(per_step) for t in range(per_step + 1)]
        for i in range(nr):
            for j in range(per_step):
                _quads(mesh, [at(radii[i], cuts[j], z), at(radii[i + 1], cuts[j], z),
                              at(radii[i + 1], cuts[j + 1], z), at(radii[i], cuts[j + 1], z)])
            # The riser, from the ribbon up to the tread.
            _quads(mesh, [at(radii[i], a0, pitch * a0), at(radii[i + 1], a0, pitch * a0),
                          at(radii[i + 1], a0, z), at(radii[i], a0, z)])
        mesh.Vertices.CombineIdentical(True, True)
        mesh.Normals.ComputeNormals()
        steps.append(mesh)

    # Built in at both ends: the ribbon's end and both parapets' end edges.
    supports = []
    for a in (0.0, turn):
        for r in radii:
            supports.append(at(r, a, pitch * a))
        for r in (ri, ro):
            for i in range(1, nv + 1):
                supports.append(at(r, a, pitch * a + hp * i / float(nv)))

    mass_points, masses = _masses([ribbon], Finishes, Imposed)
    return ribbon, inner, outer, steps, supports, mass_points, masses, n, h


# ---------------------------------------------------------------- a straight stair, three flights

def straight(Width, Risers, Flights, Rise, Going, Landing, Depth, Finishes, Imposed):
    """A straight stair of Flights flights of Risers risers each, in one line, with a landing Landing long
    between each two, held only at its two ends. Two steel plate stringers, Depth deep below the line
    through the middle of the treads and 100 mm above it, run its whole length; the treads, open, and the
    landings are plates between them. A tread is welded to the stringers along its ends: it shares the node
    at the middle of each end with them, and its four corners follow the stringer nodes half a rise below
    or above them, LinkRetained to LinkConstrained, through rigid links. Without them each tread would hang
    from one node a side, and the stringers, tall thin plates, would flap sideways.
    Width in m, Rise, Going and Depth in mm; Finishes and Imposed in kN/m2."""
    w = float(Width)
    n, flights = int(Risers), int(Flights)
    r, g = float(Rise) / 1000.0, float(Going) / 1000.0
    landing, depth = float(Landing), float(Depth) / 1000.0
    up = 0.1
    across = max(2, int(round(w / 0.3)))
    treads, landings = [], []
    retained, constrained = [], []

    # The stringers' line through the middle of the treads, station by station along X, with the
    # landings between the flights level on it.
    line = []
    x, z = 0.0, 0.0
    for f in range(flights):
        run = (n - 1) * g
        # From half a going before the first riser, at the level below, to half a going past the last,
        # at the level above: through the middle of every tread, and its ends.
        for k in range(0, 2 * n + 1):
            xs = x - 0.5 * g + 0.5 * k * g
            line.append((xs, z + r * ((xs - x) / g + 0.5)))
        for k in range(1, n):
            treads.append(_grid(rg.Point3d(x + (k - 1) * g, 0, z + k * r), rg.Vector3d(g, 0, 0), rg.Vector3d(0, w, 0), 2, across))
            for y in (0.0, w):
                # The front corner over the stringer node half a rise below it, the back one under the
                # node half a rise above.
                for xc, dz in ((x + (k - 1) * g, -0.5 * r), (x + k * g, 0.5 * r)):
                    retained.append(rg.Point3d(xc, y, z + k * r + dz))
                    constrained.append(rg.Point3d(xc, y, z + k * r))
        x_end, z = x + run, z + n * r
        if f < flights - 1:
            # The landing, its edges on the line between half a going in from either end.
            inner = landing - g
            count = max(1, int(round(inner / 0.3)))
            for k in range(1, count + 1):
                line.append((x_end + 0.5 * g + inner * k / float(count), z))
            steps_u = [0.0, 0.5 * g / landing] + [(0.5 * g + inner * k / float(count)) / landing for k in range(1, count)] + \
                      [(landing - 0.5 * g) / landing, 1.0]
            landings.append(_grid(rg.Point3d(x_end, 0, z), rg.Vector3d(landing, 0, 0), rg.Vector3d(0, w, 0), len(steps_u) - 1, across, steps_u))
            x = x_end + landing
        else:
            x = x_end
    # One station each, in order.
    stations = []
    for xs, zs in line:
        if not stations or abs(xs - stations[-1][0]) > 1e-6:
            stations.append((xs, zs))

    offsets = [-depth * (1.0 - k / float(max(1, int(round(depth / 0.15))))) for k in range(int(round(depth / 0.15)) + 1)] + [up]
    offsets = sorted(set(round(o, 6) for o in offsets))
    stringers = []
    for y in (0.0, w):
        mesh = rg.Mesh()
        for j in range(len(stations) - 1):
            (x0, z0), (x1, z1) = stations[j], stations[j + 1]
            for i in range(len(offsets) - 1):
                _quads(mesh, [rg.Point3d(x0, y, z0 + offsets[i]), rg.Point3d(x1, y, z1 + offsets[i]),
                              rg.Point3d(x1, y, z1 + offsets[i + 1]), rg.Point3d(x0, y, z0 + offsets[i + 1])])
        mesh.Vertices.CombineIdentical(True, True)
        mesh.Normals.ComputeNormals()
        stringers.append(mesh)

    # Held at the two ends of the stringers, every node of their end edges: on the floor and at the
    # floor above, and nowhere between.
    supports = []
    for xs, zs in (stations[0], stations[-1]):
        for y in (0.0, w):
            for o in offsets:
                supports.append(rg.Point3d(xs, y, zs + o))

    mass_points, masses = _masses(treads + landings, Finishes, Imposed)
    return stringers, treads, landings, supports, retained, constrained, mass_points, masses, flights * n, z


def _masses(meshes, Finishes, Imposed):
    """The finishes and a tenth of the imposed load as masses at the meshes' nodes, each node its share of
    the faces round it: SCI P354's mass in use. In kg, one per node."""
    per_area = (float(Finishes) + 0.1 * float(Imposed)) / 9.81 * 1000.0
    share = {}
    for mesh in meshes:
        for f in range(mesh.Faces.Count):
            face = mesh.Faces[f]
            p = [rg.Point3d(mesh.Vertices[k]) for k in (face.A, face.B, face.C, face.D)]
            a = 0.5 * (rg.Vector3d.CrossProduct(p[1] - p[0], p[3] - p[0]).Length +
                       rg.Vector3d.CrossProduct(p[1] - p[2], p[3] - p[2]).Length)
            for c in p:
                k = _key(c)
                if k not in share:
                    share[k] = [c, 0.0]
                share[k][1] += a / 4.0
    points, masses = [], []
    for k in sorted(share):
        m = per_area * share[k][1]
        if m > 0.0:
            points.append(share[k][0])
            masses.append(rg.Vector3d(m, m, m))
    return points, masses


# ---------------------------------------------------------------- the response map

# The response factor's colours, from still to the limit: a pale green, Alpaca4d's light green, a
# yellow and its orange; past the limit, red. Not the colours of the modes, which are blues.
SCALE = [(214, 236, 190), (175, 201, 48), (242, 201, 76), (235, 108, 63)]
# Past the limit, reds, light to dark, so that how far past it still shows.
OVER = [(229, 83, 61), (198, 40, 40), (122, 18, 28)]
DARK = (42, 45, 49)


def _ramp(stops, t):
    t = min(1.0, max(0.0, t))
    f = t * (len(stops) - 1)
    i = min(int(f), len(stops) - 2)
    u = f - i
    a, b = stops[i], stops[i + 1]
    return System.Drawing.Color.FromArgb(255, *[int(round(a[j] + (b[j] - a[j]) * u)) for j in range(3)])


def _colour(t):
    t = min(1.0, max(0.0, t))
    f = t * (len(SCALE) - 1)
    i = min(int(f), len(SCALE) - 2)
    u = f - i
    a, b = SCALE[i], SCALE[i + 1]
    return System.Drawing.Color.FromArgb(255, *[int(round(a[j] + (b[j] - a[j]) * u)) for j in range(3)])


def response_map(Surfaces, Shown, Points, Factors, Limit, Bands, Lift):
    """Where people walk, coloured by the response factor: Surfaces, the analysed meshes they walk on, read
    at their nodes; drawn on Shown, the steps of a stair drawn over its ribbon, from the nearest of those
    nodes, or on Surfaces themselves when Shown is empty, raised Lift. Bands colours over 0 to the largest,
    pale green to orange, and red past Limit, the response factor accepted. Gives what a Legend needs - the value at each colour's
    edge and the colours - the node that shakes the most, a label for it and a marker on it."""
    factor = {}
    for p, f in zip(Points, Factors):
        factor[_key(p)] = f
    nodes = {}
    for m in Surfaces:
        for v in range(m.Vertices.Count):
            p = rg.Point3d(m.Vertices[v])
            k = _key(p)
            if k in factor:
                nodes[k] = (p, factor[k])
    found = list(nodes.values())
    limit = float(Limit) if Limit else 32.0
    bands = max(2, int(Bands))
    top = max([f for p, f in found]) if found else 0.0
    lift = rg.Vector3d(0, 0, float(Lift or 0.0))

    # Even bands, so that the Legend, which labels its edges evenly between the smallest and the largest,
    # reads them right. Under the limit they span 0 to the largest, pale green to orange. Past it the limit
    # is an edge, with at least three bands under it, green to orange, and reds over it, darker further
    # past; the last band holds everything above it, however far past.
    if top > limit:
        under = min(bands - 1, max(3, int(round(bands * limit / top))))
        width = limit / float(under)
        edges = [width * k for k in range(bands + 1)]
        colours = [_colour((k + 0.5) / under) for k in range(under)] + \
                  [_ramp(OVER, (k + 0.5) / (bands - under)) for k in range(bands - under)]
    else:
        span = top if top > 0.0 else limit
        edges = [span * k / float(bands) for k in range(bands + 1)]
        colours = [_colour((k + 0.5) / bands) for k in range(bands)]

    def colour_of(f):
        for k in range(len(colours)):
            if f <= edges[k + 1] + 1e-9:
                return colours[k]
        return colours[-1]

    def nearest(p, count=3):
        """The response factor at p from the nearest nodes, each weighed by the inverse of its distance."""
        best = sorted(found, key=lambda q: q[0].DistanceToSquared(p))[:count]
        weights = [1.0 / max(1e-6, q[0].DistanceTo(p)) for q in best]
        return sum(wt * q[1] for wt, q in zip(weights, best)) / sum(weights)

    coloured = []
    shown = [m for m in (Shown or []) if m is not None]
    for m in (shown if shown else Surfaces):
        mesh = m.DuplicateMesh()
        mesh.VertexColors.Clear()
        for v in range(mesh.Vertices.Count):
            p = rg.Point3d(mesh.Vertices[v])
            f = nearest(p) if shown else factor.get(_key(p), 0.0)
            mesh.VertexColors.Add(colour_of(f))
        mesh.Translate(lift)
        coloured.append(mesh)

    peak = marker = None
    if found:
        # A pin on the node that shakes the most: a dark ball on it and a stalk up to the label, 1.2 m
        # above, clear of a parapet.
        at = max(found, key=lambda q: q[1])[0] + lift
        peak = at + rg.Vector3d(0, 0, 1.25)
        marker = rg.Mesh.CreateFromSphere(rg.Sphere(at, 0.06), 16, 12)
        stalk = rg.Mesh.CreateFromCylinder(rg.Cylinder(rg.Circle(rg.Plane(at, rg.Vector3d.ZAxis), 0.012), 1.2), 1, 12)
        if stalk is not None:
            marker.Append(stalk)
        marker.VertexColors.CreateMonotoneMesh(System.Drawing.Color.FromArgb(255, *DARK))
    label = "R = {0:.1f} {1} {2:g}".format(top, ">" if top > limit else "<=", limit)
    title = "Response factor R, limit {0:g}{1}".format(limit, ", largest {0:.0f}".format(top) if top > edges[-1] else "")
    return coloured, edges, colours, peak, label, marker, title


def mode_title(Frequencies, Mode):
    """The title of a mode's legend: its number and its frequency."""
    m = int(Mode or 0)
    if Frequencies and 0 <= m < len(Frequencies):
        return "Mode {0}: {1:.2f} Hz".format(m, float(Frequencies[m]))
    return "Mode {0}".format(m)


Map, Values, Colours, Peak, Label, Marker, Title = response_map(Surfaces, Shown, Points, Factors, Limit, Bands, Lift)
# ---------- end response_map ----------
stair_at_rest = ModelViewAlpaca4d(AlpacaModel=footfall_stair_2.AlpacaModel, Step=0, FittedLoads=True)  # -> AlpacaModel, Geometry, Info, Values, Colors
stair_mode = ModelViewAlpaca4d(
    AlpacaModel=natural_vibration.AlpacaModel,
    Step=mode,
    Colors=[RGB(212, 227, 253), RGB(149, 188, 250), RGB(87, 149, 248), RGB(47, 106, 249), RGB(20, 60, 252), RGB(23, 33, 249), RGB(91, 43, 233), RGB(158, 53, 218)],
    FittedLoads=True)  # -> AlpacaModel, Geometry, Info, Values, Colors
response_factor_map = Mesh(response_map.Map)
peak_marker = Mesh(response_map.Marker)
response_factor = LegendAlpaca4d(Title=response_map.Title, Values=response_map.Values, Colors=response_map.Colours, Position=0, Scale=2.4)
largest_r = TextTag3D(Location=response_map.Peak, Text=response_map.Label, Size=0.25, Colour=RGB(42, 45, 49), Justification=7)
mode_title = GhPythonScript(Frequencies=natural_vibration.Frequencies, Mode=mode)  # -> out, Title; inputs Frequencies: list, Mode: Int32
# ---------- mode_title: Python ----------
# The code of FootfallStair.py's GhPython components: the stairs' geometry - a U-shaped stair (stair), a
# helical one of shells (helical) and a straight one of three flights (straight) - the map of the response
# factor Footfall Analysis finds where people walk, and the title of a mode.
#
# Written for both Python 3 (Rhino 8) and IronPython 2.7 (Rhino 7): no f-strings, ASCII only.

import math

import Rhino.Geometry as rg
import System.Drawing


def _key(p):
    """A point, to a tenth of a millimetre: the same node, whichever element it was made for. Not to the
    millimetre: a going of 275 mm puts the middle of a tread at 137.5 mm, on the edge between two
    millimetres, where the same point worked out two ways rounds either way."""
    return (int(round(p.X * 10000.0)), int(round(p.Y * 10000.0)), int(round(p.Z * 10000.0)))


def _quads(mesh, corners):
    """Adds a quad of four points to mesh, its vertices shared with the faces already there."""
    index = []
    for p in corners:
        index.append(mesh.Vertices.Add(p))
    mesh.Faces.AddFace(index[0], index[1], index[2], index[3])


def _grid(origin, u, v, nu, nv, us=None):
    """A mesh of quads over the parallelogram origin + a u + b v, a and b from 0 to 1, in nu by nv faces;
    us, when given, are the steps along u instead of even ones."""
    mesh = rg.Mesh()
    steps_u = us if us is not None else [i / float(nu) for i in range(nu + 1)]
    steps_v = [j / float(nv) for j in range(nv + 1)]
    for i in range(len(steps_u) - 1):
        for j in range(nv):
            a0, a1 = steps_u[i], steps_u[i + 1]
            b0, b1 = steps_v[j], steps_v[j + 1]
            _quads(mesh, [origin + u * a0 + v * b0, origin + u * a1 + v * b0,
                          origin + u * a1 + v * b1, origin + u * a0 + v * b1])
    mesh.Vertices.CombineIdentical(True, True)
    mesh.Normals.ComputeNormals()
    return mesh


def _segments(points):
    return [rg.Line(points[i], points[i + 1]) for i in range(len(points) - 1)]


def stair(Width, LongRisers, MiddleRisers, Rise, Going, Finishes, Imposed):
    """A U-shaped steel stair between two floors: a long flight up along X, a quarter landing, a short
    flight across along Y, a second quarter landing and a long flight back along -X to the floor
    above. Width in m; Rise and Going in mm; Finishes and Imposed in kN/m2.

    Each flight hangs between two stringers, straight lines through the middle of every tread's ends,
    so that each tread is fixed to them at the middle of its two ends. A short upright piece, half a
    rise, takes each stringer's end down or up to the landing or the floor. The treads are open, with
    no risers. A landing is a plate on a frame of four edge beams, with a post under its free corner."""
    w = float(Width)
    r = float(Rise) / 1000.0
    g = float(Going) / 1000.0
    n_long, n_mid = int(LongRisers), int(MiddleRisers)
    across = max(2, int(round(w / 0.3)))    # elements across a tread or a landing, about 300 mm

    stringers, treads, landings, landing_beams, posts = [], [], [], [], []
    feet, tops = [], []
    mass_area = {}

    def area(mesh):
        """Spreads each face's area over its four corners, for the mass of the finishes."""
        for f in range(mesh.Faces.Count):
            face = mesh.Faces[f]
            corners = [mesh.Vertices[face.A], mesh.Vertices[face.B], mesh.Vertices[face.C], mesh.Vertices[face.D]]
            p = [rg.Point3d(c) for c in corners]
            a = 0.5 * (rg.Vector3d.CrossProduct(p[1] - p[0], p[3] - p[0]).Length +
                       rg.Vector3d.CrossProduct(p[1] - p[2], p[3] - p[2]).Length)
            for c in p:
                k = _key(c)
                if k not in mass_area:
                    mass_area[k] = [c, 0.0]
                mass_area[k][1] += a / 4.0

    def flight(origin, d, s, z0, n, first=False, last=False):
        """n risers up from z0, going along d from origin, across s. Returns nothing; adds its
        stringers and treads."""
        run = (n - 1) * g
        for side in (0.0, w):
            base = origin + s * side
            # The stringer: through the middle of each tread's end, tread k at z0 + k r.
            line = [base + d * ((k - 0.5) * g) + rg.Vector3d(0, 0, z0 + k * r) for k in range(1, n)]
            start = base + d * (-0.5 * g) + rg.Vector3d(0, 0, z0) if first else base + rg.Vector3d(0, 0, z0)
            end = base + d * (run + 0.5 * g) + rg.Vector3d(0, 0, z0 + n * r) if last else base + d * run + rg.Vector3d(0, 0, z0 + n * r)
            points = [start]
            if not first:
                # Half a rise up from the landing to where the line starts.
                points.append(base + rg.Vector3d(0, 0, z0 + 0.5 * r))
            points += line
            if not last:
                points.append(base + d * run + rg.Vector3d(0, 0, z0 + (n - 0.5) * r))
            points.append(end)
            stringers.extend(_segments(points))
            if first:
                feet.append(start)
            if last:
                tops.append(end)
        for k in range(1, n):
            corner = origin + d * ((k - 1) * g) + rg.Vector3d(0, 0, z0 + k * r)
            mesh = _grid(corner, d * g, s * w, 2, across)
            treads.append(mesh)
            area(mesh)

    def landing(corner, size_u, size_v, z):
        """A square landing from corner, along size_u and size_v, at z: its plate and its edge beams."""
        origin = corner + rg.Vector3d(0, 0, z)
        mesh = _grid(origin, size_u, size_v, across, across)
        landings.append(mesh)
        area(mesh)
        for a, b in ((origin, size_u), (origin, size_v), (origin + size_u, size_v), (origin + size_v, size_u)):
            landing_beams.extend(_segments([a + b * (i / float(across)) for i in range(across + 1)]))

    x, y, z = rg.Vector3d(1, 0, 0), rg.Vector3d(0, 1, 0), rg.Vector3d(0, 0, 1)
    run_long, run_mid = (n_long - 1) * g, (n_mid - 1) * g
    z1 = n_long * r
    z2 = z1 + n_mid * r
    z3 = z2 + n_long * r

    # Up along X, onto the first landing.
    flight(rg.Point3d(0, 0, 0), x, y, 0.0, n_long, first=True)
    landing(rg.Point3d(run_long, 0, 0), x * w, y * w, z1)
    # Across along Y, onto the second.
    flight(rg.Point3d(run_long, w, 0), y, x, z1, n_mid)
    landing(rg.Point3d(run_long, w + run_mid, 0), x * w, y * w, z2)
    # Back along -X, to the floor above.
    flight(rg.Point3d(run_long, w + run_mid, 0), -x, y, z2, n_long, last=True)

    # A post under each landing's free corner, the one no stringer reaches.
    for corner, top in ((rg.Point3d(run_long + w, 0, 0), z1), (rg.Point3d(run_long + w, 2 * w + run_mid, 0), z2)):
        posts.append(rg.Line(corner, corner + z * top))
        feet.append(corner)

    # The finishes and a tenth of the imposed load, SCI P354's mass in use, at the nodes of the plates.
    per_area = (float(Finishes) + 0.1 * float(Imposed)) / 9.81 * 1000.0   # kg/m2
    mass_points, masses = [], []
    for k in sorted(mass_area):
        p, a = mass_area[k]
        m = per_area * a
        if m > 0.0:
            mass_points.append(p)
            masses.append(rg.Vector3d(m, m, m))

    steps = 2 * n_long + n_mid
    height = z3
    return stringers, treads, landings, landing_beams, posts, feet, tops, mass_points, masses, steps, height


# ---------------------------------------------------------------- a helical stair, all shells

def helical(Height, Risers, Turn, InnerRadius, Width, Parapet, Finishes, Imposed):
    """A helical stair of shells round an open well: a ribbon, the helicoid it climbs on, between two
    parapets, continuous curved walls Parapet tall that rise with it and carry it, the inner one round
    InnerRadius and the outer one Width further out. It turns Turn degrees as it climbs Height in Risers
    steps, and is built in at both ends: on the floor at its foot and into the floor it arrives at.

    The steps sit on the ribbon: drawn, for the map of the response factor, and their weight, with the
    finishes and a tenth of the imposed load, at the ribbon's nodes. Finishes and Imposed in kN/m2."""
    h = float(Height)
    n = int(Risers)
    turn = math.radians(float(Turn))
    ri, w, hp = float(InnerRadius), float(Width), float(Parapet)
    ro = ri + w
    rise = h / n
    pitch = h / turn                                   # height per radian
    per_step = 2
    na = n * per_step
    nr = max(2, int(round(w / 0.3)))
    nv = max(2, int(round(hp / 0.25)))
    angles = [turn * j / float(na) for j in range(na + 1)]
    radii = [ri + w * i / float(nr) for i in range(nr + 1)]

    def at(r, a, z):
        return rg.Point3d(r * math.cos(a), r * math.sin(a), z)

    def surface(rows, columns, point):
        """A mesh of quads over a grid of rows by columns, point(row, column) its nodes."""
        mesh = rg.Mesh()
        for i in range(rows):
            for j in range(columns):
                _quads(mesh, [point(i, j), point(i + 1, j), point(i + 1, j + 1), point(i, j + 1)])
        mesh.Vertices.CombineIdentical(True, True)
        mesh.Normals.ComputeNormals()
        return mesh

    ribbon = surface(nr, na, lambda i, j: at(radii[i], angles[j], pitch * angles[j]))
    inner = surface(nv, na, lambda i, j: at(ri, angles[j], pitch * angles[j] + hp * i / float(nv)))
    outer = surface(nv, na, lambda i, j: at(ro, angles[j], pitch * angles[j] + hp * i / float(nv)))

    # The steps, drawn only: tread k level at k rises, over its share of the turn, with its riser.
    steps = []
    da = turn / n
    for k in range(1, n + 1):
        a0, a1 = (k - 1) * da, k * da
        z = k * rise
        mesh = rg.Mesh()
        cuts = [a0 + (a1 - a0) * t / float(per_step) for t in range(per_step + 1)]
        for i in range(nr):
            for j in range(per_step):
                _quads(mesh, [at(radii[i], cuts[j], z), at(radii[i + 1], cuts[j], z),
                              at(radii[i + 1], cuts[j + 1], z), at(radii[i], cuts[j + 1], z)])
            # The riser, from the ribbon up to the tread.
            _quads(mesh, [at(radii[i], a0, pitch * a0), at(radii[i + 1], a0, pitch * a0),
                          at(radii[i + 1], a0, z), at(radii[i], a0, z)])
        mesh.Vertices.CombineIdentical(True, True)
        mesh.Normals.ComputeNormals()
        steps.append(mesh)

    # Built in at both ends: the ribbon's end and both parapets' end edges.
    supports = []
    for a in (0.0, turn):
        for r in radii:
            supports.append(at(r, a, pitch * a))
        for r in (ri, ro):
            for i in range(1, nv + 1):
                supports.append(at(r, a, pitch * a + hp * i / float(nv)))

    mass_points, masses = _masses([ribbon], Finishes, Imposed)
    return ribbon, inner, outer, steps, supports, mass_points, masses, n, h


# ---------------------------------------------------------------- a straight stair, three flights

def straight(Width, Risers, Flights, Rise, Going, Landing, Depth, Finishes, Imposed):
    """A straight stair of Flights flights of Risers risers each, in one line, with a landing Landing long
    between each two, held only at its two ends. Two steel plate stringers, Depth deep below the line
    through the middle of the treads and 100 mm above it, run its whole length; the treads, open, and the
    landings are plates between them. A tread is welded to the stringers along its ends: it shares the node
    at the middle of each end with them, and its four corners follow the stringer nodes half a rise below
    or above them, LinkRetained to LinkConstrained, through rigid links. Without them each tread would hang
    from one node a side, and the stringers, tall thin plates, would flap sideways.
    Width in m, Rise, Going and Depth in mm; Finishes and Imposed in kN/m2."""
    w = float(Width)
    n, flights = int(Risers), int(Flights)
    r, g = float(Rise) / 1000.0, float(Going) / 1000.0
    landing, depth = float(Landing), float(Depth) / 1000.0
    up = 0.1
    across = max(2, int(round(w / 0.3)))
    treads, landings = [], []
    retained, constrained = [], []

    # The stringers' line through the middle of the treads, station by station along X, with the
    # landings between the flights level on it.
    line = []
    x, z = 0.0, 0.0
    for f in range(flights):
        run = (n - 1) * g
        # From half a going before the first riser, at the level below, to half a going past the last,
        # at the level above: through the middle of every tread, and its ends.
        for k in range(0, 2 * n + 1):
            xs = x - 0.5 * g + 0.5 * k * g
            line.append((xs, z + r * ((xs - x) / g + 0.5)))
        for k in range(1, n):
            treads.append(_grid(rg.Point3d(x + (k - 1) * g, 0, z + k * r), rg.Vector3d(g, 0, 0), rg.Vector3d(0, w, 0), 2, across))
            for y in (0.0, w):
                # The front corner over the stringer node half a rise below it, the back one under the
                # node half a rise above.
                for xc, dz in ((x + (k - 1) * g, -0.5 * r), (x + k * g, 0.5 * r)):
                    retained.append(rg.Point3d(xc, y, z + k * r + dz))
                    constrained.append(rg.Point3d(xc, y, z + k * r))
        x_end, z = x + run, z + n * r
        if f < flights - 1:
            # The landing, its edges on the line between half a going in from either end.
            inner = landing - g
            count = max(1, int(round(inner / 0.3)))
            for k in range(1, count + 1):
                line.append((x_end + 0.5 * g + inner * k / float(count), z))
            steps_u = [0.0, 0.5 * g / landing] + [(0.5 * g + inner * k / float(count)) / landing for k in range(1, count)] + \
                      [(landing - 0.5 * g) / landing, 1.0]
            landings.append(_grid(rg.Point3d(x_end, 0, z), rg.Vector3d(landing, 0, 0), rg.Vector3d(0, w, 0), len(steps_u) - 1, across, steps_u))
            x = x_end + landing
        else:
            x = x_end
    # One station each, in order.
    stations = []
    for xs, zs in line:
        if not stations or abs(xs - stations[-1][0]) > 1e-6:
            stations.append((xs, zs))

    offsets = [-depth * (1.0 - k / float(max(1, int(round(depth / 0.15))))) for k in range(int(round(depth / 0.15)) + 1)] + [up]
    offsets = sorted(set(round(o, 6) for o in offsets))
    stringers = []
    for y in (0.0, w):
        mesh = rg.Mesh()
        for j in range(len(stations) - 1):
            (x0, z0), (x1, z1) = stations[j], stations[j + 1]
            for i in range(len(offsets) - 1):
                _quads(mesh, [rg.Point3d(x0, y, z0 + offsets[i]), rg.Point3d(x1, y, z1 + offsets[i]),
                              rg.Point3d(x1, y, z1 + offsets[i + 1]), rg.Point3d(x0, y, z0 + offsets[i + 1])])
        mesh.Vertices.CombineIdentical(True, True)
        mesh.Normals.ComputeNormals()
        stringers.append(mesh)

    # Held at the two ends of the stringers, every node of their end edges: on the floor and at the
    # floor above, and nowhere between.
    supports = []
    for xs, zs in (stations[0], stations[-1]):
        for y in (0.0, w):
            for o in offsets:
                supports.append(rg.Point3d(xs, y, zs + o))

    mass_points, masses = _masses(treads + landings, Finishes, Imposed)
    return stringers, treads, landings, supports, retained, constrained, mass_points, masses, flights * n, z


def _masses(meshes, Finishes, Imposed):
    """The finishes and a tenth of the imposed load as masses at the meshes' nodes, each node its share of
    the faces round it: SCI P354's mass in use. In kg, one per node."""
    per_area = (float(Finishes) + 0.1 * float(Imposed)) / 9.81 * 1000.0
    share = {}
    for mesh in meshes:
        for f in range(mesh.Faces.Count):
            face = mesh.Faces[f]
            p = [rg.Point3d(mesh.Vertices[k]) for k in (face.A, face.B, face.C, face.D)]
            a = 0.5 * (rg.Vector3d.CrossProduct(p[1] - p[0], p[3] - p[0]).Length +
                       rg.Vector3d.CrossProduct(p[1] - p[2], p[3] - p[2]).Length)
            for c in p:
                k = _key(c)
                if k not in share:
                    share[k] = [c, 0.0]
                share[k][1] += a / 4.0
    points, masses = [], []
    for k in sorted(share):
        m = per_area * share[k][1]
        if m > 0.0:
            points.append(share[k][0])
            masses.append(rg.Vector3d(m, m, m))
    return points, masses


# ---------------------------------------------------------------- the response map

# The response factor's colours, from still to the limit: a pale green, Alpaca4d's light green, a
# yellow and its orange; past the limit, red. Not the colours of the modes, which are blues.
SCALE = [(214, 236, 190), (175, 201, 48), (242, 201, 76), (235, 108, 63)]
# Past the limit, reds, light to dark, so that how far past it still shows.
OVER = [(229, 83, 61), (198, 40, 40), (122, 18, 28)]
DARK = (42, 45, 49)


def _ramp(stops, t):
    t = min(1.0, max(0.0, t))
    f = t * (len(stops) - 1)
    i = min(int(f), len(stops) - 2)
    u = f - i
    a, b = stops[i], stops[i + 1]
    return System.Drawing.Color.FromArgb(255, *[int(round(a[j] + (b[j] - a[j]) * u)) for j in range(3)])


def _colour(t):
    t = min(1.0, max(0.0, t))
    f = t * (len(SCALE) - 1)
    i = min(int(f), len(SCALE) - 2)
    u = f - i
    a, b = SCALE[i], SCALE[i + 1]
    return System.Drawing.Color.FromArgb(255, *[int(round(a[j] + (b[j] - a[j]) * u)) for j in range(3)])


def response_map(Surfaces, Shown, Points, Factors, Limit, Bands, Lift):
    """Where people walk, coloured by the response factor: Surfaces, the analysed meshes they walk on, read
    at their nodes; drawn on Shown, the steps of a stair drawn over its ribbon, from the nearest of those
    nodes, or on Surfaces themselves when Shown is empty, raised Lift. Bands colours over 0 to the largest,
    pale green to orange, and red past Limit, the response factor accepted. Gives what a Legend needs - the value at each colour's
    edge and the colours - the node that shakes the most, a label for it and a marker on it."""
    factor = {}
    for p, f in zip(Points, Factors):
        factor[_key(p)] = f
    nodes = {}
    for m in Surfaces:
        for v in range(m.Vertices.Count):
            p = rg.Point3d(m.Vertices[v])
            k = _key(p)
            if k in factor:
                nodes[k] = (p, factor[k])
    found = list(nodes.values())
    limit = float(Limit) if Limit else 32.0
    bands = max(2, int(Bands))
    top = max([f for p, f in found]) if found else 0.0
    lift = rg.Vector3d(0, 0, float(Lift or 0.0))

    # Even bands, so that the Legend, which labels its edges evenly between the smallest and the largest,
    # reads them right. Under the limit they span 0 to the largest, pale green to orange. Past it the limit
    # is an edge, with at least three bands under it, green to orange, and reds over it, darker further
    # past; the last band holds everything above it, however far past.
    if top > limit:
        under = min(bands - 1, max(3, int(round(bands * limit / top))))
        width = limit / float(under)
        edges = [width * k for k in range(bands + 1)]
        colours = [_colour((k + 0.5) / under) for k in range(under)] + \
                  [_ramp(OVER, (k + 0.5) / (bands - under)) for k in range(bands - under)]
    else:
        span = top if top > 0.0 else limit
        edges = [span * k / float(bands) for k in range(bands + 1)]
        colours = [_colour((k + 0.5) / bands) for k in range(bands)]

    def colour_of(f):
        for k in range(len(colours)):
            if f <= edges[k + 1] + 1e-9:
                return colours[k]
        return colours[-1]

    def nearest(p, count=3):
        """The response factor at p from the nearest nodes, each weighed by the inverse of its distance."""
        best = sorted(found, key=lambda q: q[0].DistanceToSquared(p))[:count]
        weights = [1.0 / max(1e-6, q[0].DistanceTo(p)) for q in best]
        return sum(wt * q[1] for wt, q in zip(weights, best)) / sum(weights)

    coloured = []
    shown = [m for m in (Shown or []) if m is not None]
    for m in (shown if shown else Surfaces):
        mesh = m.DuplicateMesh()
        mesh.VertexColors.Clear()
        for v in range(mesh.Vertices.Count):
            p = rg.Point3d(mesh.Vertices[v])
            f = nearest(p) if shown else factor.get(_key(p), 0.0)
            mesh.VertexColors.Add(colour_of(f))
        mesh.Translate(lift)
        coloured.append(mesh)

    peak = marker = None
    if found:
        # A pin on the node that shakes the most: a dark ball on it and a stalk up to the label, 1.2 m
        # above, clear of a parapet.
        at = max(found, key=lambda q: q[1])[0] + lift
        peak = at + rg.Vector3d(0, 0, 1.25)
        marker = rg.Mesh.CreateFromSphere(rg.Sphere(at, 0.06), 16, 12)
        stalk = rg.Mesh.CreateFromCylinder(rg.Cylinder(rg.Circle(rg.Plane(at, rg.Vector3d.ZAxis), 0.012), 1.2), 1, 12)
        if stalk is not None:
            marker.Append(stalk)
        marker.VertexColors.CreateMonotoneMesh(System.Drawing.Color.FromArgb(255, *DARK))
    label = "R = {0:.1f} {1} {2:g}".format(top, ">" if top > limit else "<=", limit)
    title = "Response factor R, limit {0:g}{1}".format(limit, ", largest {0:.0f}".format(top) if top > edges[-1] else "")
    return coloured, edges, colours, peak, label, marker, title


def mode_title(Frequencies, Mode):
    """The title of a mode's legend: its number and its frequency."""
    m = int(Mode or 0)
    if Frequencies and 0 <= m < len(Frequencies):
        return "Mode {0}: {1:.2f} Hz".format(m, float(Frequencies[m]))
    return "Mode {0}".format(m)


Title = mode_title(Frequencies, Mode)
# ---------- end mode_title ----------
stair_mode_legend = LegendAlpaca4d(Title=mode_title.Title, Values=stair_mode.Values, Colors=stair_mode.Colors, Position=0, Scale=2.4)

# ---- group: 8 - For the report: loads and analyses (continued)
run_analysis = RunAnalysisAlpaca4d(AlpacaModel=footfall_stair_2.AlpacaModel, Settings=analysis_settings, settings=True)  # -> AlpacaModel, Log

# ---- group: 11 - The report: set Write the report to True, then click Open report
content = Merge(
    Data1=reporttext,
    Data2=reporttext_2,
    Data3=reporttext_3,
    Data4=reporttext_4,
    Data5=model_summary,
    Data6=beam_sections,
    Data7=the_stair,
    Data8=reporttext_5,
    Data9=reporttext_6,
    Data10=reporttext_7,
    Data11=reporttext_8,
    Data12=reporttext_9,
    Data13=displacement,
    Data14=reporttext_10,
    Data15=reporttext_11,
    Data16=stringer_forces,
    Data17=reporttext_12,
    Data18=plate_stresses,
    Data19=reporttext_13,
    Data20=reactions,
    Data21=pagebreak,
    Data22=reporttext_14,
    Data23=reporttext_15,
    Data24=modes,
    Data25=pagebreak_2,
    Data26=reporttext_16,
    Data27=reporttext_17,
    Data28=footfall)
write_the_report = BooleanToggle(False)
report = ReportAlpaca4d(
    AlpacaModel=flatten([footfall_stair_2.AlpacaModel, run_analysis.AlpacaModel, natural_vibration.AlpacaModel, footfall_2.AlpacaModel]),
    Page=reportpage,
    Content=flatten(content),
    Run=write_the_report)  # -> File, Log, Template
pdf = Panel(report.File)
log = Panel(report.Log)
