# Grasshopper definition ResponseSpectrumFrame.gh (Grasshopper 1.0.7)
# plug-ins: Galapagos, Alpaca4d

# ---- group: 1 - The frame: bays and storeys
# Response spectrum frame: Response spectrum analysis - a concrete frame shaken by the NTC 2018 design spectrum.
# 
# Two bays by one, two storeys of 3.2 m: 35 x 35 cm columns, 30 x 50 cm beams and a 20 cm slab, all C30/37, fixed at the feet. The slab is one shell per bay and holds each floor together.
# 
# Mass: the concrete's own weight is mass already; Mass from Loads adds the finishes (G2, 2 kN/m2) in full and the floor load (Q, 2 kN/m2) at psi2 = 0.3.
# 
# Spectrum: NTC 2018, soil C, q = 3, for a site with ag = 0.20 g, Fo = 2.45, Tc* = 0.30 s. Put in the values of a real site from the hazard grid.
# 
# Response Spectrum Analysis shakes the frame along X and along Y with it, combines the modes by CQC and the directions by the 30% rule. MassRatio says how much of the mass the modes move: NTC asks for 85%. BaseShear is the total along each direction.
# 
# Pick a Result case for View Results: E, both directions together, or Ex or Ey alone. Every value is a peak, positive, so the drawn shape leans one way only. Nodal Displacements, Beam Forces and Reaction Forces read the same model, with Step 0, 1 or 2.
storey_m = Slider(3.2, range=2.5..5)
storeys = Slider(2, range=1..6)
bay_x_m = Slider(6, range=3..10)
bay_y_m = Slider(5, range=3..10)
column_lines_x = Series(Start=0, Step=bay_x_m, Count=3)
beam_starts_x = Series(Start=0, Step=bay_x_m, Count=2)
column_lines_y = Series(Start=0, Step=bay_y_m, Count=2)
length = Expression(b=bay_x_m, Expression="2*b")
floors = Series(Start=storey_m, Step=storey_m, Count=storeys)
column_feet = Series(Start=0, Step=storey_m, Count=storeys)

# ---- group: 2 - Geometry: columns, beams and a floor at every level
far_corner = ConstructPoint(XCoordinate=length, YCoordinate=0, ZCoordinate=0)
opposite_corner = ConstructPoint(XCoordinate=length, YCoordinate=bay_y_m, ZCoordinate=0)
plan = ConstructPoint(XCoordinate=column_lines_x, YCoordinate=graft(column_lines_y), ZCoordinate=0)
beam_starts_x_2 = ConstructPoint(XCoordinate=beam_starts_x, YCoordinate=graft(column_lines_y), ZCoordinate=0)
beam_starts_y = ConstructPoint(XCoordinate=column_lines_x, YCoordinate=0, ZCoordinate=0)
floor_outline = Rectangle3Pt(PointA=Point(0, 0, 0), PointB=far_corner, PointC=opposite_corner)  # -> Rectangle, Length
to_the_column_feet = UnitZ(Factor=column_feet)
to_the_floors = UnitZ(Factor=floors)
column_feet_2 = Move(Geometry=flatten(plan), Motion=graft(to_the_column_feet))  # -> Geometry, Transform
beam_starts_x_3 = Move(Geometry=flatten(beam_starts_x_2), Motion=graft(to_the_floors))  # -> Geometry, Transform
beam_starts_y_2 = Move(Geometry=flatten(beam_starts_y), Motion=graft(to_the_floors))  # -> Geometry, Transform
along = UnitZ(Factor=1)
along_2 = UnitX(Factor=1)
along_3 = UnitY(Factor=1)
floor_mesh = MeshPlane(Boundary=floor_outline.Rectangle, WidthCount=2, HeightCount=1)  # -> Mesh, Area
floors_2 = Move(Geometry=floor_mesh.Mesh, Motion=graft(to_the_floors))  # -> Geometry, Transform
columns = LineSDL(Start=column_feet_2.Geometry, Direction=along, Length=storey_m)
beams_x = LineSDL(Start=beam_starts_x_3.Geometry, Direction=along_2, Length=bay_x_m)
beams_y = LineSDL(Start=beam_starts_y_2.Geometry, Direction=along_3, Length=bay_y_m)

# ---- group: 3 - C30/37: sections and slab
concrete = Panel("C30_37")
material_library_elastic = MaterialLibraryElasticAlpaca4d(
    MaterialName=concrete,
    MaterialPresetElastic_Grade="S235",
    MaterialPresetElastic_Model="Uniaxial",
    MaterialPresetElastic_Type="Steel",
    menu=[dropdown(0), dropdown(1), dropdown(0)])
slab_concrete = Panel("C30_37")
e_kn_m2 = Panel("30000000")
g_kn_m2 = Panel("12500000")
poisson = Panel("0.2")
density_kg_m3 = Panel("2500")
columns_35x35 = RectangleCSAlpaca4d(Width=0.35, Height=0.35, Material=material_library_elastic)
beams_30x50 = RectangleCSAlpaca4d(Width=0.3, Height=0.5, Material=material_library_elastic)
slab_concrete_2 = ND(MaterialName=slab_concrete, E=e_kn_m2, G=g_kn_m2, Ν=poisson, Rho=density_kg_m3, mode="ElasticIsotropic (Alpaca4d)")
slab_20_cm = PlateFiberSectionAlpaca4d(Thickness=0.2, Material=slab_concrete_2)

# ---- group: 4 - Elements and fixed feet
fixed = BooleanToggle(True)
columns_2 = ForceBeamColumnAlpaca4d(Line=flatten(columns), Section=columns_35x35, Colour=RGB(1, 30, 254), mode="ForceBeamColumn (Alpaca4d)")
beams = ForceBeamColumnAlpaca4d(Line=flatten([beams_x, beams_y]), Section=beams_30x50, Colour=RGB(1, 30, 254), mode="ForceBeamColumn (Alpaca4d)")
fixed_feet = SupportAlpaca4d(Position=flatten(plan), Tx=fixed, Ty=fixed, Tz=fixed, Rx=fixed, Ry=fixed, Rz=fixed)
slabs = ASDShellAlpaca4d(Mesh=floors_2.Geometry, Section=slab_20_cm, IsCorotational=False)

# ---- group: 5 - Seismic mass: G2 in full, Q at psi2
g2_2_kn_m2_down = UnitZ(Factor=-2)
q_2_kn_m2_down = UnitZ(Factor=-2)
finishes_g2 = MeshLoadAlpaca4d(Force=g2_2_kn_m2_down)
floor_load_q = MeshLoadAlpaca4d(Force=q_2_kn_m2_down)
psi2 = Slider(0.3, range=0..1)
g2_in_full = MassFromLoadsAlpaca4d(Loads=finishes_g2, Factor=1)
q_at_psi2 = MassFromLoadsAlpaca4d(Loads=floor_load_q, Factor=psi2)

# ---- group: 6 - NTC 2018 spectrum of the site
ag_g = Slider(0.2, range=0.05..0.4)
fo = Slider(2.45, range=2.2..3)
tc_s = Slider(0.3, range=0.2..0.5)
soil = ValueList({"A", "B", "C", "D", "E"}, selected="C")
topography = ValueList({"T1", "T2", "T3", "T4"}, selected="T1")
q = Slider(3, range=1..6)
design_spectrum = DesignSpectrumAlpaca4d(
    Ag=ag_g,
    Fo=fo,
    Tc=tc_s,
    Soil=soil,
    Topography=topography,
    Component="Horizontal",
    Q=q,
    Damping=5,
    mode="Design Spectrum NTC 2018 (Alpaca4d)")  # -> Spectrum, Period, Acceleration, Curve, Parameters
spectrum = Panel(design_spectrum.Parameters)

# ---- group: 7 - Response Spectrum Analysis
assemble_model = AssembleModelAlpaca4d(
    Elements=flatten([columns_2, beams, slabs]),
    Supports=flatten(fixed_feet),
    LoadPatterns=flatten([g2_in_full, q_at_psi2]),
    Tolerance=0.01)  # -> AlpacaModel, Mass
mass_kg = Panel(assemble_model.Mass)
vibration_modes = Slider(9, range=1..30)
modal_combination = ValueList({"CQC", "SRSS"}, selected="CQC")
directional_combination = ValueList({"30%", "SRSS"}, selected="30%")
response_spectrum = ResponseSpectrumAnalysisAlpaca4d(
    AlpacaModel=assemble_model.AlpacaModel,
    SpectrumX=design_spectrum.Spectrum,
    SpectrumY=design_spectrum.Spectrum,
    VibrationModes=vibration_modes,
    ModalCombination=modal_combination,
    DirectionalCombination=directional_combination,
    Solver="-genBandArpack")  # -> AlpacaModel, Cases, Period, MassRatio, BaseShear, Log
cases = Panel(response_spectrum.Cases)
period_s = Panel(response_spectrum.Period)
massratio_x_y_z = Panel(response_spectrum.MassRatio)
baseshear_x_y_kn = Panel(response_spectrum.BaseShear)

# ---- group: 8 - A result case drawn
result_case = ValueList({"E: X and Y together": 0, "Ex: shaken along X": 1, "Ey: shaken along Y": 2}, selected="E: X and Y together")
view_results_wip = ViewResults_WIPAlpaca4d(AlpacaModel=response_spectrum.AlpacaModel, Step=result_case, ResultMenuOrder=1, ResultUnits=1)  # -> Info, Values, Colors
