# Grasshopper definition CustomScript.gh (Grasshopper 1.0.7)
# plug-ins: Galapagos, Kangaroo2 Components, Alpaca4d

# ---- group: 1 - The script, a line per item
# Custom script: Custom script - an OpenSees Tcl script of your own, run from Grasshopper.
# 
# The script is typed into the panel, a line per item: a steel portal frame 6 m wide and 4 m tall, HEB 300 columns built in at their feet, an IPE 400 beam, 20 kN/m on the beam and 30 kN pushing its top sideways.
# 
# Custom Code takes it with no model wired in, so the script is the whole model. Run Analysis has "Do not use settings" ticked in its right-click menu: it adds no recorders and no analysis, and runs the script as it stands. What the script prints with puts comes back in its log.
# 
# Paste your own script over this one to reach anything of OpenSees that Alpaca4d has no component for. To add a few lines to a model built with Alpaca4d's components instead, wire the model into Custom Code, and untick "Do not use settings": the lines go after the model, before the recorders and the analysis.
opensees_script = Panel("""wipe
model BasicBuilder -ndm 2 -ndf 3

# A portal frame 6 m wide and 4 m tall, in kN and m.
node 1 0.0 0.0
node 2 6.0 0.0
node 3 0.0 4.0
node 4 6.0 4.0
fix 1 1 1 1
fix 2 1 1 1

# HEB 300 columns: A 149.1 cm2, I 25 170 cm4. IPE 400 beam: A 84.46 cm2, I 23 130 cm4. Steel, E 210 GPa.
geomTransf PDelta 1
geomTransf Linear 2
element elasticBeamColumn 1 1 3 0.01491 2.1e8 2.517e-4 1
element elasticBeamColumn 2 2 4 0.01491 2.1e8 2.517e-4 1
element elasticBeamColumn 3 3 4 0.008446 2.1e8 2.313e-4 2

# 20 kN/m down on the beam, 30 kN along x at its left end.
timeSeries Linear 1
pattern Plain 1 1 {
    eleLoad -ele 3 -type -beamUniform -20.0
    load 3 30.0 0.0 0.0
}

constraints Plain
numberer RCM
system BandGeneral
test NormDispIncr 1.0e-8 10
algorithm Newton
integrator LoadControl 0.1
analysis Static
analyze 10

# What came out: puts prints to the log of Run Analysis.
reactions
puts "Sway at the top: [format %.2f [expr 1000.0 * [nodeDisp 3 1]]] mm"
puts "Base shear: [format %.1f [expr -([nodeReaction 1 1] + [nodeReaction 2 1])]] kN"
puts "Vertical reactions: [format %.1f [nodeReaction 1 2]] and [format %.1f [nodeReaction 2 2]] kN"
puts "Moments at the feet: [format %.1f [nodeReaction 1 3]] and [format %.1f [nodeReaction 2 3]] kNm"
wipe""")

# ---- group: 2 - Custom Code: no model wired in, so the script is the whole model; Run Analysis runs it as it stands
your_own_script = CustomCodeAlpaca4d(CustomCode=opensees_script)  # -> AlpacaModel, Tcl
run_it_as_it_stands = RunAnalysisAlpaca4d(AlpacaModel=your_own_script.AlpacaModel, settings=False)  # -> AlpacaModel, Log

# ---- group: 3 - What came back
what_opensees_printed = Panel(run_it_as_it_stands.Log)
the_script_opensees_ran = Panel(your_own_script.Tcl)
