# Grasshopper definition DeconstructAnything.gh (Grasshopper 1.0.7)
# plug-ins: Galapagos, Kangaroo2 Components, Alpaca4d

# ---- group: 1 - A cantilever: IPE 300 of S355, 4 m, built in, 10 kN at its tip
# Deconstruct anything: Deconstruct anything - look inside any object of Alpaca4d.
# 
# Deconstruct takes an object of Alpaca4d - an element, a section, a material, a load, a model, a result - and gives each of its fields and properties an output of its own, named after it. The first, Object Class, says what the object is.
# 
# Here a cantilever, an IPE 300 of S355 4 m long, built in and loaded at its tip, is opened up piece by piece: the beam, then the section it carries, then the section's material, each Deconstruct fed from the one before; the point load; and the assembled model, then every node in it - one Deconstruct takes a list of the same kind of object too.
# 
# Use it to check what reached a component, to read a number Alpaca4d keeps but shows nowhere else, or to pick objects out for filters and views of your own. Plug something else into any of them: its outputs change to fit, once it is solved.
root = ConstructPoint(XCoordinate=0, YCoordinate=0, ZCoordinate=0)
tip = ConstructPoint(XCoordinate=4, YCoordinate=0, ZCoordinate=0)
s355 = MaterialLibraryElasticAlpaca4d(
    MaterialName="S355",
    MaterialPresetElastic_Grade="S235",
    MaterialPresetElastic_Model="Uniaxial",
    MaterialPresetElastic_Type="Steel",
    menu=[dropdown(0), dropdown(1), dropdown(0)])
ipe300 = SteelSectionLibraryAlpaca4d(SectionName="IPE300", Material=s355, menu=[dropdown(0), dropdown(1)])
cantilever = Line(StartPoint=root, EndPoint=tip)
cantilever_2 = ForceBeamColumnAlpaca4d(Line=cantilever, Section=ipe300, Colour=RGB(1, 30, 254), mode="ForceBeamColumn (Alpaca4d)")
built_in = SupportAlpaca4d(Position=root, Tx=True, Ty=True, Tz=True, Rx=True, Ry=True, Rz=True, mode="Support Rigid (Alpaca4d)")

# ---- group: 2 - The load and the model
_10_kn_at_the_tip = PointLoadAlpaca4d(Point=tip, Force=Vector(0, 0, -10), Moment=Vector(0, 0, 0))
tip_load = LoadPatternAlpaca4d(Loads=flatten(_10_kn_at_the_tip), Factor=1, mode="PlainPattern (Alpaca4d)")
cantilever_3 = AssembleModelAlpaca4d(Elements=flatten(cantilever_2), Supports=flatten(built_in), LoadPatterns=flatten(tip_load), Tolerance=0.01)  # -> AlpacaModel, Mass

# ---- group: 3 - The beam opened, then its section, then the section's material
the_beam = DeconstructAlpaca4d(Object=cantilever_2)  # -> ObjectClass, Curve, Section, GeomTransf, BeamIntegration, LocalZAxis, Type, Id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
its_section = DeconstructAlpaca4d(Object=the_beam.Section)  # -> ObjectClass, Id, Material, SectionName, Color, TopWidth, BottomWidth, TopFlangeThickness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
area = Panel(its_section.Area)
iyy = Panel(its_section.Iyy)
izz = Panel(its_section.Izz)
its_material = DeconstructAlpaca4d(Object=its_section.Material)  # -> ObjectClass, Id, MatName, Color, E, Eneg, Eta, G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
E = Panel(its_material.E)
rho = Panel(its_material.Rho)

# ---- group: 4 - The load opened
the_load = DeconstructAlpaca4d(Object=_10_kn_at_the_tip)  # -> ObjectClass, Pos, Force, Moment, Ndf, Type, Id, PatternTag, TimeSeries

# ---- group: 5 - The model opened, then every node in it
the_model = DeconstructAlpaca4d(Object=cantilever_3.AlpacaModel)  # -> ObjectClass, Ndm, Ndf, UniquePoints, UniquePointsThreeNDF, UniquePointsSixNDF, NodeIndexThreeNDF, NodeIndexSixNDF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
its_nodes = DeconstructAlpaca4d(Object=the_model.Nodes)  # -> ObjectClass, Pos, Id, Ndf
pos = Panel(its_nodes.Pos)
id = Panel(its_nodes.Id)
ndf = Panel(its_nodes.Ndf)
