# Grasshopper definition Femur.gh (Grasshopper 1.0.8)
# plug-ins: Alpaca4d

# ---- group: 1 - The femur in tetrahedra: nodes, and four nodes per tetrahedron
nodes = Point([Point(0.00713, 0.00149, 0.37153), Point(0.00317, -0.00101, 0.35763), Point(0.00281, -0.00974, 0.3705), Point(-0.00332, 0.00458, 0.36431), Point(0.00508, -0.01183, 0.39226), Point(0.01249, 0.00157, 0.39296)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])
tetrahedra = Integer(Tree({0}: [0, 1, 2, 3], {1}: [4, 5, 6, 7], {2}: [8, 9, 10, 11], {3}: [12, 13, 14, 15], {4}: [16, 17, 18, 19], {5}: [20, 16, 18, 19]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))
four_faces = MeshFace([{A=0, B=1, C=2, D=2}, {A=0, B=3, C=1, D=1}, {A=1, B=3, C=2, D=2}, {A=2, B=3, C=0, D=0}])
corners = ListItem(List=nodes, Index=tetrahedra, Wrap=True)
tetrahedra_2 = ConstructMesh(Vertices=corners, Faces=four_faces)

# ---- group: 2 - Bone, and Ten Node Tetrahedra: they need an OpenSees from master
bone = Panel("Cortical bone")
e_kn_m2 = Panel("17000000")
g_kn_m2 = Panel("6540000")
poisson = Panel("0.3")
density_kg_m3 = Panel("1900")
bone_2 = ND(MaterialName=bone, E=e_kn_m2, G=g_kn_m2, Ν=poisson, Rho=density_kg_m3, mode="ElasticIsotropic (Alpaca4d)")
ten_node_tetrahedron = TenNodeTetrahedronAlpaca4d(Mesh=tetrahedra_2, Material=bone_2)  # -> Element, Points

# ---- group: 3 - Held at the knee: every node in the bottom 2 cm, edge nodes included
element_nodes = Point(flatten(ten_node_tetrahedron.Points))
height = Deconstruct(Point=element_nodes)  # -> XComponent, YComponent, ZComponent
bottom_2_cm = SmallerThan(FirstNumber=height.ZComponent, SecondNumber=0.02)  # -> SmallerThan, OrEqualTo
knee_nodes = CullPattern(List=element_nodes, CullPattern=bottom_2_cm.SmallerThan)
once_each = CullDuplicates(Points=knee_nodes, Tolerance=0.0001, CullMode=3)  # -> Points, Indices, Valence
held = BooleanToggle(True)
free = BooleanToggle(False)

# ----
# Femur: A femur, in tetrahedra.
# 
# The Standardised Femur, 449 mm long: the reference geometry for finite element studies of the femur (Viceconti et al., J. Biomech. 1996), from the University of Sheffield, CC BY 4.0. 3813 tetrahedra on 1297 corners, 427 cm3, all of it cortical bone.
# 
# 1. Grasshopper has no tetrahedral mesher, so the tetrahedra come as a mesher writes them: the nodes, and four node numbers per tetrahedron. List Item and Construct Mesh make each into a four vertex mesh. They were made with gmsh; TetGen, gmsh or any other mesher's output goes in the same way.
# 2. Ten Node Tetrahedron: four corners and a node in the middle of each edge, so it bends. It needs an OpenSees built from the master branch since 16 October 2026 (Alpaca4d > Settings > Set OpenSees Executable).
# 3. Held at the knee: every node in the bottom 2 cm, as a bone potted in cement for a test. A support holds only the node at its point, so the edge nodes are held too: Points gives every element's ten.
# 4. The hip pushes on the head with about 2.5 times the body's weight when walking: 2 kN, leaning 13 degrees from the shaft, shared among the nodes within 15 mm of the top of the head.
# 5. View Results draws the displacement, 20 times: the head moves most, and the bone bends over the knee. Pick another result from its Result menu.
held_at_the_knee = SupportAlpaca4d(Position=once_each.Points, Tx=held, Ty=held, Tz=held, Rx=free, Ry=free, Rz=free, mode="Support Rigid (Alpaca4d)")

# ---- group: 4 - The hip's force, 2 kN, shared among the nodes on the top of the head
by_height = SortList(Keys=height.ZComponent, ValuesA=element_nodes)  # -> Keys, ValuesA
top_of_the_head = ListItem(List=by_height.ValuesA, Index=-1, Wrap=True)
from_the_top = Distance(PointA=element_nodes, PointB=top_of_the_head)
within_15_mm = SmallerThan(FirstNumber=from_the_top, SecondNumber=0.015)  # -> SmallerThan, OrEqualTo
head_nodes = CullPattern(List=element_nodes, CullPattern=within_15_mm.SmallerThan)
once_each_2 = CullDuplicates(Points=head_nodes, Tolerance=0.0001, CullMode=3)  # -> Points, Indices, Valence
how_many = ListLength(List=once_each_2.Points)
share = Division(A=1, B=how_many)
hip_force_2_kn = VectorXYZ(XComponent=0.45, YComponent=0, ZComponent=-1.949)  # -> Vector, Length
on_each_node = Multiply(Vector=hip_force_2_kn.Vector, Factor=share)  # -> Vector, Length
hip = PointLoadAlpaca4d(Point=once_each_2.Points, Force=on_each_node.Vector, Moment=Vector(0, 0, 0))
load_pattern = LoadPatternAlpaca4d(Loads=flatten(hip), Factor=1, mode="PlainPattern (Alpaca4d)")

# ---- group: 5 - Assemble Model
assemble_model = AssembleModelAlpaca4d(
    Elements=flatten(ten_node_tetrahedron.Element),
    Supports=flatten(held_at_the_knee),
    LoadPatterns=flatten(load_pattern),
    Tolerance="0.0001")  # -> AlpacaModel, Mass

# ----
modelview = ModelViewAlpaca4d(AlpacaModel=assemble_model.AlpacaModel, Step=0, FittedLoads=True)  # -> AlpacaModel, Geometry, Info, Values, Colors
natural_vibration_analysis_alpaca4d = NaturalVibrationAnalysisAlpaca4d(AlpacaModel=assemble_model.AlpacaModel, VibrationModes="5", Solver="-genBandArpack")  # -> AlpacaModel, Eigenvalues, Period, Frequencies, Log, EigenValueAnalysis, TotalMassOfStructure, TotalFreeMass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
view_results_wip = ModelViewAlpaca4d(AlpacaModel=natural_vibration_analysis_alpaca4d.AlpacaModel, Step=Slider(2, range=0..4), FittedLoads=True)  # -> AlpacaModel, Geometry, Info, Values, Colors

# ---- group: 6 - Solve, and the displacement over the bone, 20 times
analysis_settings = AnalysisSettingsAlpaca4d(Constraint="Transformation", Numberer="RCM", System="Auto", Algorithm="Newton", AnalysisType="Static", Cores=0)
run_analysis = RunAnalysisAlpaca4d(AlpacaModel=assemble_model.AlpacaModel, Settings=analysis_settings, settings=True)  # -> AlpacaModel, Log
title = Panel("Displacement [mm]")
opensees_log = Panel(run_analysis.Log)

# ----
view_results_wip_2 = ModelViewAlpaca4d(AlpacaModel=run_analysis.AlpacaModel, Step=0, FittedLoads=True)  # -> AlpacaModel, Geometry, Info, Values, Colors

# ---- group: 6 - Solve, and the displacement over the bone, 20 times (continued)
legend = LegendAlpaca4d(Title=title, Values=view_results_wip_2.Values, Colors=view_results_wip_2.Colors, Position=0, Scale=1.5)
what_is_drawn = Panel(view_results_wip_2.Info)

# ----
principal_stress_lines_alpaca4d = PrincipalStressLinesAlpaca4d(
    AlpacaModel=run_analysis.AlpacaModel,
    Step=0,
    Seed=flatten(corners),
    StepTolerance=0,
    SingleLine=True,
    Separation=0,
    TestDist=0,
    mode="PrincipalStressLines3D")  # -> StressLinesDir1, StressLinesDir2, StressLinesDir3
custom_preview = CustomPreview(Geometry=principal_stress_lines_alpaca4d.StressLinesDir1, Material=ColourSwatch(SwatchColor=RGB(255, 0, 255)))
custom_preview_2 = CustomPreview(Geometry=principal_stress_lines_alpaca4d.StressLinesDir2, Material=ColourSwatch(SwatchColor=RGB(255, 0, 0)))
custom_preview_3 = CustomPreview(Geometry=principal_stress_lines_alpaca4d.StressLinesDir3, Material=ColourSwatch(SwatchColor=RGB(77, 255, 0)))
