# Grasshopper definition RebelliousSlave.gh (Grasshopper 1.0.7)
# plug-ins: Galapagos, Kangaroo2 Components, Alpaca4d

# ---- group: 1 - The Rebellious Slave in tetrahedra: nodes, and four nodes per tetrahedron
# The Rebellious Slave: Michelangelo's Rebellious Slave, in tetrahedra.
# 
# A marble figure 2.13 m tall on its plinth, under its own weight: 28119 tetrahedra on 8406 corners, 0.32 m3 or 875 kg. Michelangelo carved it about 1513 for the tomb of Pope Julius II; it is in the Louvre. The shape is the SMK's (Statens Museum for Kunst) scan of its plaster cast KAS86, in the public domain.
# 
# 1. Grasshopper has no tetrahedral mesher, so the tetrahedra come as a mesher writes them: the nodes, and four node numbers per tetrahedron. List Item and Construct Mesh make each into a four vertex mesh. They were made with gmsh; TetGen, gmsh or any other mesher's output goes in the same way.
# 2. Ten Node Tetrahedron: four corners and a node in the middle of each edge, so it bends. It needs an OpenSees built from the master branch since 16 October 2026 (Alpaca4d > Settings > Set OpenSees Executable).
# 3. A support holds only the node at its point, so the plinth is held at every node of its underside, the edge nodes too: Points gives every element's ten.
# 4. Its own weight, from the marble's density.
# 5. The vertical stress, in iso-surfaces of 0.05 MPa, over -0.4 to 0: its weight comes down through the legs and the rough stone behind them into the plinth, in compression. Clear Range to see all of it, and pick another result from the Results menu.
# 6. Its first six modes: Mode picks one, 0 being the first. Show that Model View's preview, and hide the stress's, to see it.
nodes = Point([Point(-0.1268, 0.2812, 0.6453), Point(-0.1704, 0.3066, 0.6265), Point(-0.1791, 0.2774, 0.6415), Point(-0.157, 0.3132, 0.6483), Point(-0.2483, 0.1379, 1.3615), Point(-0.2482, 0.1468, 1.393)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])
tetrahedra = Integer(Tree({0}: [0, 1, 2, 3], {1}: [4, 5, 6, 7], {2}: [8, 9, 10, 11], {3}: [12, 13, 14, 15], {4}: [16, 17, 18, 19], {5}: [20, 21, 22, 23]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))
four_faces = MeshFace([{A=0, B=1, C=2, D=2}, {A=0, B=3, C=1, D=1}, {A=1, B=3, C=2, D=2}, {A=2, B=3, C=0, D=0}])
corners = ListItem(List=nodes, Index=tetrahedra, Wrap=True)
tetrahedra_2 = ConstructMesh(Vertices=corners, Faces=four_faces)

# ---- group: 2 - Marble, and Ten Node Tetrahedra: they need an OpenSees from master
marble = Panel("Carrara marble")
e_kn_m2 = Panel("50000000")
g_kn_m2 = Panel("20000000")
poisson = Panel("0.25")
density_kg_m3 = Panel("2700")
marble_2 = ND(MaterialName=marble, E=e_kn_m2, G=g_kn_m2, Ν=poisson, Rho=density_kg_m3, mode="ElasticIsotropic (Alpaca4d)")
ten_node_tetrahedron = TenNodeTetrahedronAlpaca4d(Mesh=tetrahedra_2, Material=marble_2)  # -> Element, Points

# ---- group: 3 - Held at every node under the plinth, edge nodes included
element_nodes = Point(flatten(ten_node_tetrahedron.Points))
height = Deconstruct(Point=element_nodes)  # -> XComponent, YComponent, ZComponent
on_the_ground = SmallerThan(FirstNumber=height.ZComponent, SecondNumber=0.001)  # -> SmallerThan, OrEqualTo
sole_nodes = CullPattern(List=element_nodes, CullPattern=on_the_ground.SmallerThan)
once_each = CullDuplicates(Points=sole_nodes, Tolerance=0.001, CullMode=3)  # -> Points, Indices, Valence
held = BooleanToggle(True)
free = BooleanToggle(False)
held_plinth = SupportAlpaca4d(Position=once_each.Points, Tx=held, Ty=held, Tz=held, Rx=free, Ry=free, Rz=free, mode="Support Rigid (Alpaca4d)")

# ---- group: 4 - Its own weight
gravity_load = GravityLoadAlpaca4d(Factor=1)
load_pattern = LoadPatternAlpaca4d(Loads=flatten(gravity_load), Factor=1, mode="PlainPattern (Alpaca4d)")

# ---- group: 5 - Assemble Model, solve, and the vertical stress over the statue
assemble_model = AssembleModelAlpaca4d(
    Elements=flatten(ten_node_tetrahedron.Element),
    Supports=flatten(held_plinth),
    LoadPatterns=flatten(load_pattern),
    Tolerance=0.0001)  # -> AlpacaModel, Mass
analysis_settings = AnalysisSettingsAlpaca4d(Constraint="Transformation", Numberer="RCM", System="Auto", Algorithm="Newton", AnalysisType="Static", Cores=0)
run_analysis = RunAnalysisAlpaca4d(AlpacaModel=assemble_model.AlpacaModel, Settings=analysis_settings, settings=True)  # -> AlpacaModel, Log
range_mpa = Panel("-0.4 To 0")
modelview = ModelViewAlpaca4d(AlpacaModel=assemble_model.AlpacaModel, Step=0, FittedLoads=True)  # -> AlpacaModel, Geometry, Info, Values, Colors
vertical_stress = ModelViewAlpaca4d(
    AlpacaModel=run_analysis.AlpacaModel,
    Step=0,
    Colors=[RGB(235, 108, 63), RGB(202, 84, 129), RGB(169, 61, 196), RGB(132, 77, 226), RGB(92, 112, 239), RGB(83, 146, 247), RGB(134, 177, 246), RGB(185, 208, 246)],
    Range=range_mpa,
    FittedLoads=True)  # -> AlpacaModel, Geometry, Info, Values, Colors
title = Panel("Vertical stress [MPa]")
vertical_stress_legend = LegendAlpaca4d(Title=title, Values=vertical_stress.Values, Colors=vertical_stress.Colors, Position=0, Scale=1.5)
what_is_drawn = Panel(vertical_stress.Info)
opensees_log = Panel(run_analysis.Log)

# ---- group: 6 - Its first six modes, and the one picked drawn over the statue
natural_vibration = NaturalVibrationAnalysisAlpaca4d(AlpacaModel=assemble_model.AlpacaModel, VibrationModes=6, Solver="-genBandArpack")  # -> AlpacaModel, Eigenvalues, Period, Frequencies, Log, EigenValueAnalysis, TotalMassOfStructure, TotalFreeMass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
mode_from_0 = Slider(0, range=0..5)
mode_shape = ModelViewAlpaca4d(
    AlpacaModel=natural_vibration.AlpacaModel,
    Step=mode_from_0,
    Colors=[RGB(185, 208, 246), RGB(140, 181, 246), RGB(96, 154, 247), RGB(78, 126, 243), RGB(112, 95, 233), RGB(147, 63, 222), RGB(177, 67, 179), RGB(206, 87, 121), RGB(235, 108, 63)],
    FittedLoads=True)  # -> AlpacaModel, Geometry, Info, Values, Colors
mode_title = Panel("Mode shape, largest movement 1")
mode_shape_legend = LegendAlpaca4d(Title=mode_title, Values=mode_shape.Values, Colors=mode_shape.Colors, Position=0, Scale=1.5)
frequencies_hz = Panel(natural_vibration.Frequencies)
