# Grasshopper definition SpotTheCow.gh (Grasshopper 1.0.7)
# plug-ins: Galapagos, Kangaroo2 Components, Alpaca4d

# ---- group: 1 - Spot the cow in tetrahedra: nodes, and four nodes per tetrahedron
# Spot the cow: Spot the cow, in tetrahedra.
# 
# A solid concrete cow 2.4 m long, standing on its four hooves under its own weight: 5030 tetrahedra on 1431 corners, 1.9 m3 or 4.8 t. Spot is Keenan Crane's cow, a mesh used throughout geometry processing, in the public domain (CC0).
# 
# 1. Grasshopper has no tetrahedral mesher, so the tetrahedra come as a mesher writes them: the nodes, and four node numbers per tetrahedron. List Item and Construct Mesh make each into a four vertex mesh. They were made with gmsh; TetGen, gmsh or any other mesher's output goes in the same way.
# 2. Ten Node Tetrahedron: four corners and a node in the middle of each edge, so it bends. It needs an OpenSees built from the master branch since 16 October 2026 (Alpaca4d > Settings > Set OpenSees Executable).
# 3. A support holds only the node at its point, so the hooves are held at every node on the ground, the edge nodes too: Points gives every element's ten.
# 4. The Model View after Run Analysis shows the vertical stress between -0.15 and +0.15 MPa: the legs in compression, the top of the neck in tension, where the head hangs out past the front legs. Where the hooves are pinned it reaches -1.4 MPa, beyond the range; clear Range to see all of it. Pick another result from its Results menu.
nodes = Point([Point(1.162, 0.1692, 0.8821), Point(1.2543, -0.0291, 0.8817), Point(1.1801, 0.026, 0.6975), Point(1.2679, 0.1293, 0.8036), Point(0.2817, 0.3785, 0.5632), Point(0.4914, 0.3842, 0.577)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])
tetrahedra = Integer(Tree({0}: [0, 1, 2, 3], {1}: [4, 5, 6, 7], {2}: [8, 9, 10, 11], {3}: [0, 2, 1, 12], {4}: [13, 14, 15, 16], {5}: [17, 18, 19, 20]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))
four_faces = MeshFace([{A=0, B=1, C=2, D=2}, {A=0, B=3, C=1, D=1}, {A=1, B=3, C=2, D=2}, {A=2, B=3, C=0, D=0}])
corners = ListItem(List=nodes, Index=tetrahedra, Wrap=True)
tetrahedra_2 = ConstructMesh(Vertices=corners, Faces=four_faces)

# ---- group: 2 - Concrete, and Ten Node Tetrahedra: they need an OpenSees from master
concrete = Panel("C30/37")
e_kn_m2 = Panel("33000000")
g_kn_m2 = Panel("13750000")
poisson = Panel("0.2")
density_kg_m3 = Panel("2500")
concrete_2 = ND(MaterialName=concrete, E=e_kn_m2, G=g_kn_m2, Ν=poisson, Rho=density_kg_m3, mode="ElasticIsotropic (Alpaca4d)")
ten_node_tetrahedron = TenNodeTetrahedronAlpaca4d(Mesh=tetrahedra_2, Material=concrete_2)  # -> Element, Points

# ---- group: 3 - Pinned at every node on the ground, edge nodes included
element_nodes = Point(flatten(ten_node_tetrahedron.Points))
height = Deconstruct(Point=element_nodes)  # -> XComponent, YComponent, ZComponent
on_the_ground = SmallerThan(FirstNumber=height.ZComponent, SecondNumber=0.001)  # -> SmallerThan, OrEqualTo
sole_nodes = CullPattern(List=element_nodes, CullPattern=on_the_ground.SmallerThan)
once_each = CullDuplicates(Points=sole_nodes, Tolerance=0.001, CullMode=3)  # -> Points, Indices, Valence
held = BooleanToggle(True)
free = BooleanToggle(False)
pinned_hooves = SupportAlpaca4d(Position=once_each.Points, Tx=held, Ty=held, Tz=held, Rx=free, Ry=free, Rz=free, mode="Support Rigid (Alpaca4d)")

# ---- group: 4 - Its own weight
gravity_load = GravityLoadAlpaca4d(Factor=1)
load_pattern = LoadPatternAlpaca4d(Loads=flatten(gravity_load), Factor=1, mode="PlainPattern (Alpaca4d)")

# ---- group: 5 - Assemble Model
assemble_model = AssembleModelAlpaca4d(
    Elements=flatten(ten_node_tetrahedron.Element),
    Supports=flatten(pinned_hooves),
    LoadPatterns=flatten(load_pattern),
    Tolerance=0.01)  # -> AlpacaModel, Mass
modelview = ModelViewAlpaca4d(AlpacaModel=assemble_model.AlpacaModel, Step=0, FittedLoads=True)  # -> AlpacaModel, Geometry, Info, Values, Colors

# ---- group: 6 - Solve, and the vertical stress over the cow
analysis_settings = AnalysisSettingsAlpaca4d(Constraint="Transformation", Numberer="RCM", System="Auto", Algorithm="Newton", AnalysisType="Static", Cores=0)
run_analysis = RunAnalysisAlpaca4d(AlpacaModel=assemble_model.AlpacaModel, Settings=analysis_settings, settings=True)  # -> AlpacaModel, Log
range_mpa = Panel("-0.15 To 0.15")
modelview_2 = ModelViewAlpaca4d(AlpacaModel=run_analysis.AlpacaModel, Step=0, Range=range_mpa, FittedLoads=True)  # -> AlpacaModel, Geometry, Info, Values, Colors
title = Panel("Vertical stress [MPa]")
legend = LegendAlpaca4d(Title=title, Values=modelview_2.Values, Colors=modelview_2.Colors, Position=0, Scale=1.5)
what_is_drawn = Panel(modelview_2.Info)
opensees_log = Panel(run_analysis.Log)
