# Grasshopper definition HighTensionTower.gh (Grasshopper 1.0.7)
# plug-ins: Galapagos, Kangaroo2 Components, Alpaca4d

# ---- group: 1 - Geometry: a body tapering to a shaft, three pairs of arms
# High-tension tower: High-tension tower - a steel lattice pylon carrying four conductors and an earth wire.
# 
# A square body tapers from feet 8 m apart to a shaft 2.4 m wide at 22 m, and the shaft rises to 42 m. Two pairs of arms 7 m long carry the conductors, one at each tip, and a shorter pair at the top the earth wire. The legs and the arms' chords are beams, running unbroken through every node; every face is crossed by bracing, and struts go round each level - those are trusses, which only pull and push. The feet are pinned.
# 
# Each conductor hangs Weight of a conductor kN at the tip of its arm - the wire, its insulators and ice, over half the span either side - and the wind blowing across the line pushes it Wind on a conductor kN along +x. The earth wire takes half of both. The wind on the tower itself is typed in kN/m2 and falls on its windward legs, each taking half the face times a quarter of it, the share of a lattice that is steel.
# 
# Two Model Views: the tower deformed, drawn 40 times larger, coloured by how far it moves; and the axial force in every member as a diagram along it, red pulled, blue pushed, its range in the panel beside it - turn its preview on to see it. The windward legs are pulled, the leeward ones pushed, as the wind tips the tower over.
# 
# Try: Arm reach up to 9 m, and see the arms' chords take more; Base width down to 5 m, and see the legs work harder; Wind on a conductor at 0, and see what the wires' weight alone does.
height_m = Slider(42, range=30..60)
base_width_m = Slider(8, range=4..12)
shaft_width_m = Slider(2.4, range=1.5..4)
waist_height_m = Slider(22, range=10..30)
panels_in_the_body = Slider(7, range=3..12)
arm_spacing_m = Slider(6, range=3..9)
arm_reach_m = Slider(7, range=4..10)

# ---- group: 4 - Loads: its own weight and the wires', the wind on the wires and on the tower
weight_of_a_conductor_kn = Slider(20, range=0..50)
wind_on_a_conductor_kn = Slider(12, range=0..30)
wind_on_the_tower_kn_m2 = Slider(1, range=0..2)
own_weight = GravityLoadAlpaca4d(Factor=1)

# ---- group: 1 - Geometry: a body tapering to a shaft, three pairs of arms (continued)
high_tension_tower = GhPythonScript(
    Height=height_m,
    Base=base_width_m,
    Waist=shaft_width_m,
    WaistHeight=waist_height_m,
    Panels=panels_in_the_body,
    Spacing=arm_spacing_m,
    Arm=arm_reach_m,
    Weight=weight_of_a_conductor_kn,
    Wind=wind_on_a_conductor_kn)  # -> out, Legs, WindwardLegs, WindWidths, Bracing, Struts, Chords, Feet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; inputs Panels: Int32
# ---------- high_tension_tower: Python ----------
#! python3
# The geometry of the high-tension tower (HighTensionTower.py): a lattice pylon that carries four
# conductors, two a side, and an earth wire. A square body tapers from its feet to a waist, a straight shaft rises from
# there, and three pairs of arms stand out of the shaft, two for the conductors and one at the top for the
# earth wire.
#
# Every member is a line between two nodes of the lattice: the legs and the arms' chords run unbroken
# through the nodes, as beams; the rest - the faces' crossed bracing, the struts round each level, the
# arms' rings and diagonals - are bars between those nodes, as trusses. A bar never ends on another bar
# alone: a node only bars meet would be free to turn, and the model would not solve.
#
# The definition's GhPython component runs pylon(). Everything before it is plain Python, Rhino or not, so
# that it can be tried outside Rhino too.
#
# Written for both Python 3 (Rhino 8) and IronPython 2.7 (Rhino 7): no f-strings, ASCII only.

from __future__ import division

import math

try:
    import Rhino.Geometry as rg
except ImportError:
    rg = None


# How much of a face of the lattice the wind meets: the solidity ratio, about a fifth to a third for a
# tower of angles or tubes. The rest blows through.
SOLIDITY = 0.25


def _levels(bottom, top, most):
    """Levels from bottom to top, evenly spaced and no more than most apart."""
    n = max(1, int(math.ceil((top - bottom) / most - 1e-9)))
    return [bottom + (top - bottom) * k / n for k in range(n + 1)]


def _corners(half, z):
    """The four corners of a square level, half its width from the axis, counter-clockwise from -x -y."""
    return [(-half, -half, z), (half, -half, z), (half, half, z), (-half, half, z)]


def lattice(height, base, waist, waist_height, panels, spacing, arm):
    """The tower as plain tuples: a dict of lists of (start, end) members and of points, and its levels.

    height        to the top of the shaft [m]
    base          width of the square at the feet [m]
    waist         width of the shaft [m]
    waist_height  where the body stops tapering and the shaft begins [m]
    panels        panels in the body
    spacing       between the arms, level to level [m]
    arm           reach of a conductor arm, from the tower's axis [m]
    """
    depth = waist                      # an arm is as deep, at the shaft, as the shaft is wide
    top_arm = height - depth           # the earth wire's arms, their bottom chords
    arms = [top_arm - 2 * spacing, top_arm - spacing, top_arm]
    notes = []
    if arms[0] < waist_height + 0.5 * waist:
        # The lower arms would be in the body: lift them all, into the shaft.
        lift = waist_height + 0.5 * waist - arms[0]
        notes.append("Arms {0:.1f} m apart do not fit above the waist: spaced {1:.1f} m".format(
            spacing, spacing - lift / 2.0))
        spacing -= lift / 2.0
        arms = [top_arm - 2 * spacing, top_arm - spacing, top_arm]

    # The levels: the body's panels, then the shaft's, with a level at the bottom and top of every arm and
    # panels no taller than the shaft is wide.
    levels = [waist_height * k / panels for k in range(panels + 1)]
    marks = sorted(set([waist_height] + arms + [a + depth for a in arms] + [height]))
    for lo, hi in zip(marks[:-1], marks[1:]):
        levels += _levels(lo, hi, waist)[1:]

    def half_width(z):
        if z >= waist_height:
            return waist / 2.0
        return base / 2.0 + (waist - base) / 2.0 * z / waist_height

    rings = [_corners(half_width(z), z) for z in levels]
    m = {"Legs": [], "WindwardLegs": [], "WindWidths": [], "Bracing": [], "Struts": [], "Chords": [], "Feet": rings[0],
         "WirePoints": [], "EarthPoints": []}

    for k in range(len(levels) - 1):
        lo, hi = rings[k], rings[k + 1]
        # The windward face is at -x: its two legs, corners 0 and 3, take the wind on half the face each.
        face = (half_width(levels[k]) + half_width(levels[k + 1]))
        for c in range(4):
            leg = (lo[c], hi[c])
            if c in (0, 3):
                m["WindwardLegs"].append(leg)
                m["WindWidths"].append(SOLIDITY * face / 2.0)
            else:
                m["Legs"].append(leg)
        # Each face crossed: two bars from corner to corner, which pass each other without a node.
        for c in range(4):
            d = (c + 1) % 4
            m["Bracing"].append((lo[c], hi[d]))
            m["Bracing"].append((lo[d], hi[c]))
    # A strut round each level, and a diagonal across every arm's level to keep the square square.
    for k, ring in enumerate(rings):
        if k == 0:
            continue
        for c in range(4):
            m["Struts"].append((ring[c], ring[(c + 1) % 4]))
        if any(abs(levels[k] - x) < 1e-6 for x in marks):
            m["Struts"].append((ring[0], ring[2]))

    # The arms: on each side of the shaft, four chords from its corners - two level, two falling from the
    # level above - meeting at the tip; a ring of bars where they are divided, and a diagonal in each face.
    half = waist / 2.0
    for n, z in enumerate(arms):
        reach = arm if n < 2 else 0.6 * arm
        for side in (1, -1):
            tip = (side * reach, 0.0, z)
            roots = [(side * half, -half, z), (side * half, half, z), (side * half, half, z + depth),
                     (side * half, -half, z + depth)]
            count = max(2, int(round((reach - half) / (0.8 * waist))))
            points = []
            for root in roots:
                chord = [tuple(root[i] + (tip[i] - root[i]) * j / count for i in range(3)) for j in range(count + 1)]
                for a, b in zip(chord[:-1], chord[1:]):
                    m["Chords"].append((a, b))
                points.append(chord)
            for j in range(1, count):
                ring = [p[j] for p in points]
                for c in range(4):
                    m["Bracing"].append((ring[c], ring[(c + 1) % 4]))
            for j in range(count - 1):
                # One diagonal in each of the four faces of each panel, from the inner ring out.
                for c in range(4):
                    m["Bracing"].append((points[c][j], points[(c + 1) % 4][j + 1]))
            (m["EarthPoints"] if n == 2 else m["WirePoints"]).append(tip)

    notes.append("Arms at {0}".format(", ".join("{0:.1f} m".format(z) for z in arms)))
    return m, levels, notes


def _count(m):
    return sum(len(m[k]) for k in ("Legs", "WindwardLegs", "Bracing", "Struts", "Chords"))


def pylon(Height, Base, Waist, WaistHeight, Panels, Spacing, Arm, Weight, Wind):
    """The GhPython component's code: the tower's members, its feet, and the conductors' and earth wire's
    pull on the arms' tips - their Weight down, and the Wind on them across the line, along +x - as Rhino
    lines, points and vectors. The earth wire is lighter than a conductor and catches less wind: half of
    each."""
    m, levels, notes = lattice(Height, Base, Waist, WaistHeight, int(Panels), Spacing, Arm)

    def line(member):
        return rg.Line(rg.Point3d(*member[0]), rg.Point3d(*member[1]))

    def lines(key):
        return [line(x) for x in m[key]]

    def points(key):
        return [rg.Point3d(*p) for p in m[key]]

    wires = points("WirePoints") + points("EarthPoints")
    share = [1.0] * len(m["WirePoints"]) + [0.5] * len(m["EarthPoints"])
    weights = [rg.Vector3d(0, 0, -Weight * s) for s in share]
    winds = [rg.Vector3d(Wind * s, 0, 0) for s in share]
    info = "{0} members, {1} levels, {2:.1f} m tall\n{3}".format(_count(m), len(levels), Height, "\n".join(notes))
    return (lines("Legs"), lines("WindwardLegs"), m["WindWidths"], lines("Bracing"), lines("Struts"),
            lines("Chords"), points("Feet"), wires, weights, winds, info)


if __name__ == "__main__":
    m, levels, notes = lattice(42.0, 8.0, 2.4, 22.0, 7, 6.0, 7.0)
    print(_count(m), "members,", len(levels), "levels")
    for k in sorted(m):
        print(k, len(m[k]))
    print("\n".join(notes))


Legs, WindwardLegs, WindWidths, Bracing, Struts, Chords, Feet, WirePoints, WireWeights, WireWinds, Info = pylon(Height, Base, Waist, WaistHeight, Panels, Spacing, Arm, Weight, Wind)
# ---------- end high_tension_tower ----------
about_the_tower = Panel(high_tension_tower.Info)

# ---- group: 2 - Members: steel tubes, the legs and the arms' chords as beams, the bracing as trusses
s355 = MaterialLibraryElasticAlpaca4d(
    MaterialName="S355",
    Colour=RGB(190, 194, 199),
    MaterialPresetElastic_Grade="S235",
    MaterialPresetElastic_Model="Uniaxial",
    MaterialPresetElastic_Type="Steel",
    menu=[dropdown(0), dropdown(1), dropdown(0)])
_193_7x10 = SteelSectionLibraryAlpaca4d(SectionName="193.7x10", Material=s355, menu=[dropdown(0), dropdown(1)])
_193_7x10_2 = SteelSectionLibraryAlpaca4d(SectionName="193.7x10", Material=s355, menu=[dropdown(0), dropdown(1)])
_114_3x6_3 = SteelSectionLibraryAlpaca4d(SectionName="114.3x6.3", Material=s355, menu=[dropdown(0), dropdown(1)])
_76_1x4 = SteelSectionLibraryAlpaca4d(SectionName="76.1x4", Material=s355, menu=[dropdown(0), dropdown(1)])
_60_3x4 = SteelSectionLibraryAlpaca4d(SectionName="60.3x4", Material=s355, menu=[dropdown(0), dropdown(1)])
legs = ForceBeamColumnAlpaca4d(Line=high_tension_tower.Legs, Section=_193_7x10, Colour=RGB(1, 30, 254), mode="ForceBeamColumn (Alpaca4d)")
windward_legs = ForceBeamColumnAlpaca4d(Line=high_tension_tower.WindwardLegs, Section=_193_7x10_2, Colour=RGB(1, 30, 254), mode="ForceBeamColumn (Alpaca4d)")
arm_chords = ForceBeamColumnAlpaca4d(Line=high_tension_tower.Chords, Section=_114_3x6_3, Colour=RGB(1, 30, 254), mode="ForceBeamColumn (Alpaca4d)")
bracing = ForceBeamColumnAlpaca4d(
    Line=high_tension_tower.Bracing,
    Section=_76_1x4,
    WorksIn="Both",
    Prestress=0,
    Colour=RGB(1, 30, 254),
    mode="Truss (Alpaca4d)")
struts = ForceBeamColumnAlpaca4d(
    Line=high_tension_tower.Struts,
    Section=_60_3x4,
    WorksIn="Both",
    Prestress=0,
    Colour=RGB(1, 30, 254),
    mode="Truss (Alpaca4d)")

# ---- group: 3 - Supports: each foot pinned
pinned_feet = SupportAlpaca4d(
    Position=high_tension_tower.Feet,
    Tx=True,
    Ty=True,
    Tz=True,
    Rx=False,
    Ry=False,
    Rz=False,
    mode="Support Rigid (Alpaca4d)")

# ---- group: 4 - Loads: its own weight and the wires', the wind on the wires and on the tower (continued)
wind_on_the_tower_kn_m = Expression(q=wind_on_the_tower_kn_m2, w=high_tension_tower.WindWidths, Expression="q*w")
wind_on_the_tower = UnitX(Factor=wind_on_the_tower_kn_m)
wind_on_the_tower_2 = LinearLoadAlpaca4d(BeamId=flatten(windward_legs), Force=flatten(wind_on_the_tower))
wires_weight = PointLoadAlpaca4d(Point=high_tension_tower.WirePoints, Force=high_tension_tower.WireWeights, Moment=Vector(0, 0, 0))
wind_on_the_wires = PointLoadAlpaca4d(Point=high_tension_tower.WirePoints, Force=high_tension_tower.WireWinds, Moment=Vector(0, 0, 0))
permanent = LoadPatternAlpaca4d(Loads=flatten([own_weight, wires_weight]), Factor=1, mode="PlainPattern (Alpaca4d)")
wind = LoadPatternAlpaca4d(Loads=flatten([wind_on_the_wires, wind_on_the_tower_2]), Factor=1, mode="PlainPattern (Alpaca4d)")

# ---- group: 5 - Analysis
high_tension_tower_2 = AssembleModelAlpaca4d(
    Elements=flatten([legs, windward_legs, arm_chords, bracing, struts]),
    Supports=flatten(pinned_feet),
    LoadPatterns=flatten([permanent, wind]),
    Tolerance=0.01)  # -> AlpacaModel, Mass
analysis_settings = AnalysisSettingsAlpaca4d(Constraint="Transformation", Numberer="RCM", System="Auto", Algorithm="Newton", AnalysisType="Static", Cores=0)
run_analysis = RunAnalysisAlpaca4d(AlpacaModel=high_tension_tower_2.AlpacaModel, Settings=analysis_settings, settings=True)  # -> AlpacaModel, Log

# ---- group: 6 - Results: the deformed shape, drawn 40 times, and the axial forces
tower_deformed = ModelViewAlpaca4d(
    AlpacaModel=run_analysis.AlpacaModel,
    Step=0,
    Colors=[RGB(0, 0, 128), RGB(0, 0, 255), RGB(0, 128, 255), RGB(0, 255, 255), RGB(128, 255, 128), RGB(255, 255, 0), RGB(255, 128, 0), RGB(255, 0, 0), RGB(128, 0, 0)],
    FittedLoads=True)  # -> AlpacaModel, Geometry, Info, Values, Colors
axial_forces = ModelViewAlpaca4d(AlpacaModel=run_analysis.AlpacaModel, Step=0, FittedLoads=True)  # -> AlpacaModel, Geometry, Info, Values, Colors
high_tension_tower_at_rest = ModelViewAlpaca4d(AlpacaModel=high_tension_tower_2.AlpacaModel, Step=0, FittedLoads=True)  # -> AlpacaModel, Geometry, Info, Values, Colors
high_tension_tower_loads = ModelViewAlpaca4d(AlpacaModel=high_tension_tower_2.AlpacaModel, Step=0, FittedLoads=True)  # -> AlpacaModel, Geometry, Info, Values, Colors
tower_deformed_title = Panel("Displacement [mm]")
tower_deformed_legend = LegendAlpaca4d(Title=tower_deformed_title, Values=tower_deformed.Values, Colors=tower_deformed.Colors, Position=0, Scale=2.4)
axial_forces_2 = Panel(axial_forces.Info)
