# Grasshopper definition MultiStoreyBuilding.gh (Grasshopper 1.0.7)
# plug-ins: Galapagos, Kangaroo2 Components, Alpaca4d

# ---- group: 1 - Geometry: a grid of bays, storeys, and a slab a floor meshed onto the beams
# Multi-storey building: Multi-storey building - a reinforced concrete frame with a slab on every floor.
# 
# A column at every crossing of the grid, built in at the ground; a beam along every line of the grid at every floor; a 200 mm slab on the beams, as ASD Shells. The slab is meshed Slab quads a bay times a bay each way and the beams are cut at the same points, so that slab and beams share their nodes and bend together.
# 
# The loads are typed in kN/m2 and are as they are, not factored, for the deflections: the finishes and the people on every slab, as Mesh Loads, and the wind on the face at x = 0, which its columns take over the width of wall each carries. Factor the Load Patterns for the ultimate limit state.
# 
# Run Analysis solves all three patterns at once; Natural Vibration Analysis gives the first six modes, from the concrete's own mass alone - the finishes and people are loads, not masses, here. Model View draws the building deformed, 200 times larger, coloured by how far it moves, and the first mode - turn its preview on.
# 
# Try: Storeys up to 10, and see the first frequency fall; Bays along y down to 1, and see which way the first mode sways it; Wind up to 1.5 kN/m2.
bays_along_x = Slider(5, range=1..8)
bays_along_y = Slider(3, range=1..6)
bay_along_x_m = Slider(6, range=4..9)
bay_along_y_m = Slider(5, range=4..9)
storeys = Slider(5, range=1..12)
storey_height_m = Slider(3.5, range=2.8..4.5)
slab_quads_a_bay = Slider(4, range=2..6)
multi_storey_building = GhPythonScript(
    BaysX=bays_along_x,
    BaysY=bays_along_y,
    BayX=bay_along_x_m,
    BayY=bay_along_y_m,
    Storeys=storeys,
    StoreyHeight=storey_height_m,
    Split=slab_quads_a_bay)  # -> out, Columns, WindwardColumns, WindWidths, Beams, Slabs, Feet, Info; inputs BaysX: Int32, BaysY: Int32, Storeys: Int32, Split: Int32
# ---------- multi_storey_building: Python ----------
#! python3
# The geometry of the multi-storey building (MultiStoreyBuilding.py): a reinforced concrete frame on a grid of
# bays, a column at every corner of the grid and a beam along every line of it at every floor, and a slab on
# each floor.
#
# Every member is a straight line between two nodes. The beams are cut where the slab's mesh has a node on
# them, so that slab and beams share their nodes and work together; the columns run storey to storey.
#
# The definition's GhPython component runs building(). Everything before it is plain Python, Rhino or not, so
# that it can be tried outside Rhino too.
#
# Written for both Python 3 (Rhino 8) and IronPython 2.7 (Rhino 7): no f-strings, ASCII only.

from __future__ import division

try:
    import Rhino.Geometry as rg
except ImportError:
    rg = None


def frame(bays_x, bays_y, bay_x, bay_y, storeys, storey, split):
    """The building as plain tuples: columns, the windward columns and the width of wall each one catches the
    wind on, beams, each floor's quads, and the feet.

    The wind blows along +x, onto the face at x = 0: a column there takes the wall halfway to its
    neighbours, half a bay at a corner and a whole one between."""
    def at(i, j, k):
        return (i * bay_x, j * bay_y, k * storey)

    m = {"Columns": [], "WindwardColumns": [], "WindWidths": [], "Beams": [], "Floors": [], "Feet": []}
    for i in range(bays_x + 1):
        for j in range(bays_y + 1):
            m["Feet"].append(at(i, j, 0))
            for k in range(storeys):
                column = (at(i, j, k), at(i, j, k + 1))
                if i == 0:
                    m["WindwardColumns"].append(column)
                    m["WindWidths"].append(bay_y / (2.0 if j in (0, bays_y) else 1.0))
                else:
                    m["Columns"].append(column)

    def step(a, b, n):
        """The points from a to b in n equal steps, both ends included."""
        return [tuple(a[c] + (b[c] - a[c]) * s / n for c in range(3)) for s in range(n + 1)]

    for k in range(1, storeys + 1):
        # Beams along x on every line of y, and along y on every line of x, each bay in split pieces.
        for j in range(bays_y + 1):
            for i in range(bays_x):
                points = step(at(i, j, k), at(i + 1, j, k), split)
                m["Beams"] += list(zip(points[:-1], points[1:]))
        for i in range(bays_x + 1):
            for j in range(bays_y):
                points = step(at(i, j, k), at(i, j + 1, k), split)
                m["Beams"] += list(zip(points[:-1], points[1:]))
        # The floor: split by split quads a bay, their corners on the beams' cuts.
        xs = [i * bay_x / split for i in range(bays_x * split + 1)]
        ys = [j * bay_y / split for j in range(bays_y * split + 1)]
        m["Floors"].append((xs, ys, k * storey))
    return m


def _mesh(xs, ys, z):
    """A mesh of quads over xs by ys at height z."""
    mesh = rg.Mesh()
    for y in ys:
        for x in xs:
            mesh.Vertices.Add(x, y, z)
    cols = len(xs)
    for r in range(len(ys) - 1):
        for c in range(cols - 1):
            a = r * cols + c
            mesh.Faces.AddFace(a, a + 1, a + cols + 1, a + cols)
    return mesh


def building(BaysX, BaysY, BayX, BayY, Storeys, StoreyHeight, Split):
    """The GhPython component's code: the frame's columns - the windward ones apart, with the width of wall
    each catches the wind on - its beams, a slab mesh a floor and the feet, as Rhino lines, meshes and
    points."""
    bays_x, bays_y, storeys, split = max(1, int(BaysX)), max(1, int(BaysY)), max(1, int(Storeys)), max(1, int(Split))
    m = frame(bays_x, bays_y, BayX, BayY, storeys, StoreyHeight, split)

    def lines(key):
        return [rg.Line(rg.Point3d(*a), rg.Point3d(*b)) for a, b in m[key]]

    slabs = [_mesh(*floor) for floor in m["Floors"]]
    quads = sum(s.Faces.Count for s in slabs)
    info = "{0} x {1} m, {2:.1f} m tall\n{3} columns, {4} beams, {5} slab quads".format(
        bays_x * BayX, bays_y * BayY, storeys * StoreyHeight, len(m["Columns"]) + len(m["WindwardColumns"]),
        len(m["Beams"]), quads)
    return (lines("Columns"), lines("WindwardColumns"), m["WindWidths"], lines("Beams"), slabs,
            [rg.Point3d(*p) for p in m["Feet"]], info)


if __name__ == "__main__":
    m = frame(5, 3, 6.0, 5.0, 5, 3.5, 4)
    for k in sorted(m):
        print(k, len(m[k]))


Columns, WindwardColumns, WindWidths, Beams, Slabs, Feet, Info = building(BaysX, BaysY, BayX, BayY, Storeys, StoreyHeight, Split)
# ---------- end multi_storey_building ----------
about_the_building = Panel(multi_storey_building.Info)

# ---- group: 2 - Members: C30/37 columns 400 x 400, beams 300 x 500, 200 mm slabs as ASD Shells
c30_37 = MaterialLibraryElasticAlpaca4d(
    MaterialName="C30_37",
    Colour=RGB(190, 194, 199),
    MaterialPresetElastic_Grade="S235",
    MaterialPresetElastic_Model="Uniaxial",
    MaterialPresetElastic_Type="Steel",
    menu=[dropdown(0), dropdown(1), dropdown(0)])
column_400_x_400 = RectangleCSAlpaca4d(SectionName="Column 400 x 400", Width=0.4, Height=0.4, Material=c30_37)
beam_300_x_500 = RectangleCSAlpaca4d(SectionName="Beam 300 x 500", Width=0.3, Height=0.5, Material=c30_37)
slab_concrete = ND(
    MaterialName="Concrete",
    E=30000000,
    G=12500000,
    Ν=0.2,
    Rho=2500,
    Colour=RGB(190, 194, 199),
    mode="ElasticIsotropic (Alpaca4d)")
_200_mm = PlateFiberSectionAlpaca4d(Thickness=0.2, Material=slab_concrete)
slabs = ASDShellAlpaca4d(Mesh=flatten(multi_storey_building.Slabs), Section=_200_mm, IsCorotational=False)
columns = ForceBeamColumnAlpaca4d(Line=multi_storey_building.Columns, Section=column_400_x_400, Colour=RGB(1, 30, 254), mode="ForceBeamColumn (Alpaca4d)")
windward_columns = ForceBeamColumnAlpaca4d(
    Line=multi_storey_building.WindwardColumns,
    Section=column_400_x_400,
    Colour=RGB(1, 30, 254),
    mode="ForceBeamColumn (Alpaca4d)")
beams = ForceBeamColumnAlpaca4d(Line=multi_storey_building.Beams, Section=beam_300_x_500, Colour=RGB(1, 30, 254), mode="ForceBeamColumn (Alpaca4d)")

# ---- group: 4 - Loads: own weight and finishes, people on the floors, wind on one face
finishes_kn_m2 = Slider(1.5, range=0..3)
imposed_load_kn_m2 = Slider(3, range=0..5)
wind_kn_m2 = Slider(0.8, range=0..2)
finishes_kn_m2_2 = Expression(q=finishes_kn_m2, Expression="-q")
imposed_kn_m2 = Expression(q=imposed_load_kn_m2, Expression="-q")
wind_kn_m = Expression(q=wind_kn_m2, w=multi_storey_building.WindWidths, Expression="q*w")
finishes = UnitZ(Factor=finishes_kn_m2_2)
imposed = UnitZ(Factor=imposed_kn_m2)
wind = UnitX(Factor=wind_kn_m)
finishes_2 = MeshLoadAlpaca4d(ShellId=flatten(slabs), Force=flatten(finishes))
imposed_2 = MeshLoadAlpaca4d(ShellId=flatten(slabs), Force=flatten(imposed))
wind_2 = LinearLoadAlpaca4d(BeamId=flatten(windward_columns), Force=flatten(wind))
own_weight = GravityLoadAlpaca4d(Factor=1)
permanent = LoadPatternAlpaca4d(Loads=flatten([own_weight, finishes_2]), Factor=1, mode="PlainPattern (Alpaca4d)")
imposed_3 = LoadPatternAlpaca4d(Loads=flatten(imposed_2), Factor=1, mode="PlainPattern (Alpaca4d)")
wind_3 = LoadPatternAlpaca4d(Loads=flatten(wind_2), Factor=1, mode="PlainPattern (Alpaca4d)")

# ---- group: 3 - Supports: every column built in at the ground
built_in = SupportAlpaca4d(
    Position=multi_storey_building.Feet,
    Tx=True,
    Ty=True,
    Tz=True,
    Rx=True,
    Ry=True,
    Rz=True,
    mode="Support Rigid (Alpaca4d)")

# ---- group: 5 - Analysis: static, and the first six natural modes
multi_storey_building_2 = AssembleModelAlpaca4d(
    Elements=flatten([columns, windward_columns, beams, slabs]),
    Supports=flatten(built_in),
    LoadPatterns=flatten([permanent, imposed_3, wind_3]),
    Tolerance=0.01)  # -> AlpacaModel, Mass
natural_vibration = NaturalVibrationAnalysisAlpaca4d(AlpacaModel=multi_storey_building_2.AlpacaModel, VibrationModes=6, Solver="-genBandArpack")  # -> AlpacaModel, Eigenvalues, Period, Frequencies, Log, EigenValueAnalysis, TotalMassOfStructure, TotalFreeMass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
analysis_settings = AnalysisSettingsAlpaca4d(Constraint="Transformation", Numberer="RCM", System="Auto", Algorithm="Newton", AnalysisType="Static", Cores=0)
run_analysis = RunAnalysisAlpaca4d(AlpacaModel=multi_storey_building_2.AlpacaModel, Settings=analysis_settings, settings=True)  # -> AlpacaModel, Log
frequencies_hz = Panel(natural_vibration.Frequencies)

# ---- group: 6 - Results: the deformed shape, drawn 200 times, the first mode and the loads
building_deformed = ModelViewAlpaca4d(
    AlpacaModel=run_analysis.AlpacaModel,
    Step=0,
    Colors=[RGB(0, 0, 128), RGB(0, 18, 255), RGB(0, 164, 255), RGB(55, 255, 201), RGB(201, 255, 55), RGB(255, 164, 0), RGB(255, 18, 0), RGB(128, 0, 0)],
    FittedLoads=True)  # -> AlpacaModel, Geometry, Info, Values, Colors
first_mode = ModelViewAlpaca4d(
    AlpacaModel=natural_vibration.AlpacaModel,
    Step=0,
    Colors=[RGB(42, 45, 49), RGB(48, 68, 99), RGB(54, 91, 148), RGB(60, 113, 198), RGB(66, 136, 247), RGB(93, 152, 197), RGB(121, 169, 148), RGB(148, 185, 98), RGB(175, 201, 48)],
    FittedLoads=True)  # -> AlpacaModel, Geometry, Info, Values, Colors
multi_storey_building_loads = ModelViewAlpaca4d(AlpacaModel=multi_storey_building_2.AlpacaModel, Step=0, FittedLoads=True)  # -> AlpacaModel, Geometry, Info, Values, Colors
building_deformed_title = Panel("Displacement [mm]")
building_deformed_legend = LegendAlpaca4d(Title=building_deformed_title, Values=building_deformed.Values, Colors=building_deformed.Colors, Position=0, Scale=2.4)
first_mode_title = Panel("First mode")
first_mode_legend = LegendAlpaca4d(Title=first_mode_title, Values=first_mode.Values, Colors=first_mode.Colors, Position=0, Scale=2.4)
