# Grasshopper definition PushoverBuilding.gh (Grasshopper 1.0.7)
# plug-ins: Galapagos, Kangaroo2 Components, Alpaca4d

# ---- group: 1 - Geometry: an L of three bays, a tall ground storey, a top storey set back; the push on every node
# Irregular building: Irregular building - a small concrete building that is not regular, pushed sideways until its ground storey gives way.
# 
# An L in plan, bays of 6 and 5 m by two of 5 m; a ground storey 4 m tall under a second of 3.2 m, and a third storey set back over one corner. Every member is a ForceBeamColumn on a Fiber Section: concrete in fibres, a Concrete01 C25/30, and phi 20 bars of ReinforcingSteel B450C - eight in a 400 x 400 column, three at the top and three at the bottom of a 500 x 300 beam, drawn with its depth along x: on a horizontal beam a fibre section's y points up. Their GJ is a cracked section's, 3000 kN m2: Fiber Section's 1e8 would have the beams hold the columns' tops against turning.
# 
# It carries its own weight and 20 kN/m on every beam, ramped up and then held. Pushover Analysis then pushes it along X with a load on every node that grows with its height, and controls the top storey's roof, up to Drift % of the height, with P-Delta. Point on the curve picks a point of the Capacity curve beside it, and Model View draws the building there with its plastic hinges: a ball where the bars have yielded, orange, or the concrete crushed, purple. Hinges lists them in the order they formed.
# 
# What it shows: the tall ground storey takes most of the sway, its columns hinging top and bottom - a soft storey - and the L twists as it goes.
# 
# Try: Ground storey down to 3.2 m, and see the sway spread more evenly up the building; P-Delta off on Pushover, and see the curve keep climbing; Floor load up.
bay_along_x_m = Slider(6, range=4..8)
second_bay_along_x_m = Slider(5, range=4..8)
bays_along_y_m = Slider(5, range=4..8)
ground_storey_m = Slider(4, range=2.8..5)
storeys_above_m = Slider(3.2, range=2.8..4.5)
irregular_building = GhPythonScript(
    BayX=bay_along_x_m,
    SecondBayX=second_bay_along_x_m,
    BayY=bays_along_y_m,
    GroundStorey=ground_storey_m,
    Storey=storeys_above_m)  # -> out, Columns, Beams, Feet, Floors, Forces, Roof
# ---------- irregular_building: Python ----------
"""The geometry of the conventional structures of Structures.py, one function a structure.

Structures.py puts one of them into a GhPython component, whose inputs are the function's arguments
and whose outputs are what it returns, in order: lines for each kind of member, the points the
structure is held at, and the widths its loads are worked out from. Every member is a straight line
between two nodes, cut wherever another member meets it, so that the elements share their nodes.

Runs in GhPython (Rhino 7 and 8) and in Rhino 8's Python 3 component alike.
"""
from __future__ import division

import math
import Rhino.Geometry as rg
from Grasshopper import DataTree
from Grasshopper.Kernel.Data import GH_Path


def P(x, y, z):
    return rg.Point3d(x, y, z)


def L(a, b):
    return rg.Line(a, b)


def pieces(a, b, n):
    """The line from a to b in n pieces."""
    n = max(1, int(n))
    return [L(a + (b - a) * (i / n), a + (b - a) * ((i + 1) / n)) for i in range(n)]


def chain(points):
    """The lines between one point and the next."""
    return [L(points[k], points[k + 1]) for k in range(len(points) - 1)]


def grid_mesh(xs, ys, z):
    """A mesh of quads over xs by ys at height z, its vertices where the lines of xs and ys cross."""
    mesh = rg.Mesh()
    for y in ys:
        for x in xs:
            mesh.Vertices.Add(P(x, y, z))
    cols = len(xs)
    for r in range(len(ys) - 1):
        for c in range(cols - 1):
            a = r * cols + c
            mesh.Faces.AddFace(a, a + 1, a + cols + 1, a + cols)
    return mesh


# ---------------------------------------------------------------- 1 - a steel hall roofed by trusses

def hall(Span, Bays, Spacing, Eaves, Depth, Panels):
    """Frames of a Pratt truss on two columns, Spacing apart, joined by purlins at the truss's top nodes.
    The columns rise to the top chord, the bottom chord meeting them at the eaves, so that each frame
    stands on pinned feet. The two end bays are braced: crosses in the roof, between the top chords,
    and in the long walls, with a strut along each wall at the eaves. PurlinWidths: the width of roof
    each purlin carries, a panel, or half of one at the eaves."""
    n = max(2, int(Panels) // 2 * 2)
    bays = max(1, int(Bays))
    dx = Span / n
    top = Eaves + Depth
    Columns, Chords, Webs, Purlins, PurlinWidths, Bracing, Struts, Feet = [], [], [], [], [], [], [], []
    for i in range(bays + 1):
        y = i * Spacing
        for x in (0.0, Span):
            Columns += [L(P(x, y, 0), P(x, y, Eaves)), L(P(x, y, Eaves), P(x, y, top))]
            Feet.append(P(x, y, 0))
        for k in range(n):
            x0, x1 = k * dx, (k + 1) * dx
            Chords += [L(P(x0, y, Eaves), P(x1, y, Eaves)), L(P(x0, y, top), P(x1, y, top))]
            # Pratt: the diagonals fall towards the middle, in tension under the roof's weight.
            if k < n // 2:
                Webs.append(L(P(x0, y, top), P(x1, y, Eaves)))
            else:
                Webs.append(L(P(x0, y, Eaves), P(x1, y, top)))
        Webs += [L(P(k * dx, y, Eaves), P(k * dx, y, top)) for k in range(1, n)]
    for i in range(bays):
        y0, y1 = i * Spacing, (i + 1) * Spacing
        for k in range(n + 1):
            Purlins.append(L(P(k * dx, y0, top), P(k * dx, y1, top)))
            PurlinWidths.append(dx / 2 if k in (0, n) else dx)
        for x in (0.0, Span):
            Struts.append(L(P(x, y0, Eaves), P(x, y1, Eaves)))
        if i in (0, bays - 1):
            for k in range(n):
                Bracing += [L(P(k * dx, y0, top), P((k + 1) * dx, y1, top)),
                            L(P((k + 1) * dx, y0, top), P(k * dx, y1, top))]
            for x in (0.0, Span):
                Bracing += [L(P(x, y0, 0), P(x, y1, Eaves)), L(P(x, y1, 0), P(x, y0, Eaves))]
    return Columns, Chords, Webs, Purlins, PurlinWidths, Bracing, Struts, Feet


# ---------------------------------------------------------------- 2 - a steel tower with a stair

def tower(Width, Levels, Storey):
    """Four legs Width apart, a landing at every level and a crossed bracing on every face of every
    storey. A straight flight of stairs climbs each storey along a strip a metre wide across the
    middle, turning back at each landing: two stringers, from one side of the landing below to the
    other side of the landing above. A landing is its four edge beams and two cross beams along the
    strip, its Strip, which the stringers start and end on. The legs on the windward side, x = 0, are
    WindwardLegs, for the wind."""
    levels = max(1, int(Levels))
    w = Width
    y1, y2 = 0.5 * w - 0.5, 0.5 * w + 0.5
    corners = [(0, 0), (w, 0), (w, w), (0, w)]
    Legs, WindwardLegs, Bracing, Landings, Strip, Stringers, Feet = [], [], [], [], [], [], []
    for x, y in corners:
        Feet.append(P(x, y, 0))
        legs = pieces(P(x, y, 0), P(x, y, levels * Storey), levels)
        (WindwardLegs if x == 0 else Legs).extend(legs)
    for j in range(levels):
        z0, z1 = j * Storey, (j + 1) * Storey
        for k in range(4):
            (ax, ay), (bx, by) = corners[k], corners[(k + 1) % 4]
            Bracing += [L(P(ax, ay, z0), P(bx, by, z1)), L(P(bx, by, z0), P(ax, ay, z1))]
        # The landing at the top of the storey: the sides along y cut where the strip meets them.
        Landings += [L(P(0, 0, z1), P(w, 0, z1)), L(P(0, w, z1), P(w, w, z1))]
        for x in (0.0, w):
            Landings += [L(P(x, 0, z1), P(x, y1, z1)), L(P(x, y1, z1), P(x, y2, z1)), L(P(x, y2, z1), P(x, w, z1))]
        Strip += [L(P(0, y1, z1), P(w, y1, z1)), L(P(0, y2, z1), P(w, y2, z1))]
        # The flight: up along +x in even storeys, back along -x in odd ones.
        a, b = (0.0, w) if j % 2 == 0 else (w, 0.0)
        Stringers += [L(P(a, y, z0), P(b, y, z1)) for y in (y1, y2)]
    # The ground has no landing beams: the first flight starts on its own footing.
    Feet += [P(0.0, y, 0) for y in (y1, y2)]
    return Legs, WindwardLegs, Bracing, Landings, Strip, Stringers, Feet


# ---------------------------------------------------------------- 3 - a canopy on T-shaped frames

def canopy(Frames, Spacing, Height, Cantilever, Rise, Purlins):
    """A row of frames, Spacing apart: a column built in at its foot and an arm cantilevering each way
    from its head, rising Rise to its tip. Purlins join the frames at the head and at Purlins points
    along each arm. A cross between two columns in the middle bay holds the row lengthways.
    LeftWidths and RightWidths: the width of roof, on plan, each purlin carries on the left (-x) and
    the right (+x) of the frames, nothing on the other side: a purlin's share, or half at a tip or the
    head."""
    frames = max(2, int(Frames))
    m = max(1, int(Purlins))
    s = Cantilever / m
    Columns, Arms, Purlins, LeftWidths, RightWidths, Bracing, Feet = [], [], [], [], [], [], []
    for i in range(frames):
        y = i * Spacing
        Columns.append(L(P(0, y, 0), P(0, y, Height)))
        Feet.append(P(0, y, 0))
        for side in (-1, 1):
            Arms += pieces(P(0, y, Height), P(side * Cantilever, y, Height + Rise), m)
    for i in range(frames - 1):
        y0, y1 = i * Spacing, (i + 1) * Spacing
        Purlins.append(L(P(0, y0, Height), P(0, y1, Height)))
        LeftWidths.append(s / 2)
        RightWidths.append(s / 2)
        for side in (-1, 1):
            for k in range(1, m + 1):
                Purlins.append(L(P(side * k * s, y0, Height + k * Rise / m), P(side * k * s, y1, Height + k * Rise / m)))
                width = s / 2 if k == m else s
                LeftWidths.append(width if side < 0 else 0.0)
                RightWidths.append(width if side > 0 else 0.0)
    middle = (frames - 1) // 2
    y0, y1 = middle * Spacing, (middle + 1) * Spacing
    Bracing += [L(P(0, y0, 0), P(0, y1, Height)), L(P(0, y1, 0), P(0, y0, Height))]
    return Columns, Arms, Purlins, LeftWidths, RightWidths, Bracing, Feet


# ---------------------------------------------------------------- 4 - a facade stiffened by vertical trusses

def facade(Bays, BayWidth, Height, Levels, Depth, TrussEvery):
    """A glass wall Height tall in the plane y = 0, held only at its foot and its top, as a lobby's is:
    mullions every BayWidth and transoms between them at Levels heights. Behind every TrussEvery-th
    mullion a vertical truss stiffens it against the wind: the mullion is its outer chord, a tube
    Depth behind it the inner chord, with a post at every transom and diagonals zig-zagging between.
    The mullions stand on their feet and are held across the wall at the top; the inner chords too,
    and along the wall at the top as well, which nothing else holds them in.
    MullionWidths: the width of wall each piece of mullion catches the wind over, a bay or half of one
    at the ends. PanelHeight: the height of glass each transom carries."""
    bays, levels, every = max(1, int(Bays)), max(2, int(Levels)), max(1, int(TrussEvery))
    dz = Height / levels
    Mullions, MullionWidths, Transoms, Chords, Posts, Diagonals = [], [], [], [], [], []
    Base, Tops, ChordBase, ChordTops = [], [], [], []
    for i in range(bays + 1):
        x = i * BayWidth
        Mullions += pieces(P(x, 0, 0), P(x, 0, Height), levels)
        MullionWidths += [BayWidth / 2 if i in (0, bays) else BayWidth] * levels
        Base.append(P(x, 0, 0))
        Tops.append(P(x, 0, Height))
        if i % every:
            continue
        Chords += pieces(P(x, Depth, 0), P(x, Depth, Height), levels)
        Posts += [L(P(x, 0, k * dz), P(x, Depth, k * dz)) for k in range(levels + 1)]
        for k in range(levels):
            z0, z1 = k * dz, (k + 1) * dz
            Diagonals.append(L(P(x, 0, z0), P(x, Depth, z1)) if k % 2 == 0 else L(P(x, Depth, z0), P(x, 0, z1)))
        ChordBase.append(P(x, Depth, 0))
        ChordTops.append(P(x, Depth, Height))
    for k in range(1, levels):
        Transoms += [L(P(i * BayWidth, 0, k * dz), P((i + 1) * BayWidth, 0, k * dz)) for i in range(bays)]
    PanelHeight = dz
    return Mullions, MullionWidths, Transoms, Chords, Posts, Diagonals, Base, Tops, ChordBase, ChordTops, PanelHeight


# ---------------------------------------------------------------- 5 - a barrel vault under wind

def vault(Span, Rise, Length, Strips, Divisions, Windward, Crown, Leeward):
    """A barrel vault spanning Span across x, Rise high, Length long along y: the arc of a circle
    through its two feet and its crown, cut into Strips strips along its length, each a mesh of quads
    Divisions long. A strip's faces all face the same way, so one pressure on a strip acts along one
    direction. The pressure coefficients of the windward quarter, the middle half and the leeward
    quarter, wind blowing along +x, are given to each strip by where its middle is, with the strip's
    outward Normal: a positive coefficient pushes on the vault, along -Normal, a negative one pulls it
    away. The feet are held along both long edges."""
    strips, divisions = max(4, int(Strips)), max(1, int(Divisions))
    r = (0.25 * Span * Span + Rise * Rise) / (2 * Rise)
    zc = Rise - r
    # Half the angle the arc spans, from the crown to a foot: past 90 degrees for more than a semicircle.
    half = math.atan2(0.5 * Span, r - Rise)

    def at(t, y):
        a = -half + 2 * half * t
        return P(0.5 * Span + r * math.sin(a), y, zc + r * math.cos(a))

    Strip, Names, Coefficients, Normals, Feet = [], [], [], [], []
    for s in range(strips):
        mesh = rg.Mesh()
        for k in range(divisions + 1):
            y = Length * k / divisions
            mesh.Vertices.Add(at(s / strips, y))
            mesh.Vertices.Add(at((s + 1) / strips, y))
        for k in range(divisions):
            mesh.Faces.AddFace(2 * k, 2 * k + 1, 2 * k + 3, 2 * k + 2)
        mesh.Normals.ComputeNormals()
        Strip.append(mesh)
        Names.append("Strip_{0}".format(s))
        middle = (s + 0.5) / strips
        Coefficients.append(Windward if middle < 0.25 else Leeward if middle > 0.75 else Crown)
        a = -half + 2 * half * middle
        Normals.append(rg.Vector3d(math.sin(a), 0, math.cos(a)))
    for k in range(divisions + 1):
        y = Length * k / divisions
        Feet += [at(0, y), at(1, y)]
    return Strip, Names, Coefficients, Normals, Feet


# ---------------------------------------------------------------- 6 - a facade held by wind trusses

def windtruss(Width, Height, Spacing, Depth, Trusses):
    """A tall glass facade Width wide and Height high in the plane y = 0, its mullions Spacing apart
    standing on their feet and held across the facade at the top, and at Trusses levels between by
    horizontal trusses behind it. Each truss spans the whole width between the building's columns at
    its two ends: its outer chord runs through the mullions, its inner chord Depth behind, with a
    post at every mullion and diagonals between, falling towards the middle. MullionWidths: the width
    of facade each piece of mullion catches the wind over, its spacing or half of it at the ends."""
    n = max(2, int(round(Width / Spacing)))
    s = Width / n
    trusses = max(1, int(Trusses))
    levels = [Height * (k + 1) / (trusses + 1) for k in range(trusses)]
    heights = [0.0] + levels + [Height]
    Mullions, MullionWidths, Chords, Posts, Diagonals, Base, Tops, TrussEnds = [], [], [], [], [], [], [], []
    for i in range(n + 1):
        x = i * s
        Mullions += [L(P(x, 0, heights[k]), P(x, 0, heights[k + 1])) for k in range(len(heights) - 1)]
        MullionWidths += [s / 2 if i in (0, n) else s] * (len(heights) - 1)
        Base.append(P(x, 0, 0))
        Tops.append(P(x, 0, Height))
    for z in levels:
        for i in range(n):
            x0, x1 = i * s, (i + 1) * s
            Chords += [L(P(x0, 0, z), P(x1, 0, z)), L(P(x0, Depth, z), P(x1, Depth, z))]
            if i < n // 2:
                Diagonals.append(L(P(x0, Depth, z), P(x1, 0, z)))
            else:
                Diagonals.append(L(P(x0, 0, z), P(x1, Depth, z)))
        Posts += [L(P(i * s, 0, z), P(i * s, Depth, z)) for i in range(n + 1)]
        TrussEnds += [P(0, 0, z), P(0, Depth, z), P(Width, 0, z), P(Width, Depth, z)]
    return Mullions, MullionWidths, Chords, Posts, Diagonals, Base, Tops, TrussEnds


# ---------------------------------------------------------------- 7 - a girder bridge on piers

def girder(SideSpan, MainSpan, PierHeight, Segment):
    """A continuous concrete deck over three spans - SideSpan, MainSpan, SideSpan - on two piers
    PierHeight tall. The deck is a slab 12 m wide on two girders 6 m apart, joined by a cross girder
    every other Segment; each pier is two round columns, one under each girder, braced by a strut
    halfway up and joined on top by a deeper cross girder, its cap. The deck is built into the piers
    and slides along on bearings at its two ends, held there across. Watch: the deck in the middle
    of the main span, whose movement the pictures plot."""
    H, g, w = PierHeight, 3.0, 6.0
    length = 2 * SideSpan + MainSpan
    piers = (SideSpan, SideSpan + MainSpan)
    xs = [0.0]
    for a, b in [(0.0, SideSpan), (SideSpan, SideSpan + MainSpan), (SideSpan + MainSpan, length)]:
        n = max(1, int(round((b - a) / Segment)))
        xs += [a + (b - a) * (i + 1) / n for i in range(n)]
    ys = [-w, -g, 0.0, g, w]
    Girders = []
    for y in (-g, g):
        Girders += chain([P(x, y, H) for x in xs])
    Slab = [grid_mesh(xs, ys, H)]
    CrossGirders, PierCaps = [], []
    for k, x in enumerate(xs):
        across = chain([P(x, y, H) for y in (-g, 0.0, g)])
        if any(abs(x - p) < 1e-6 for p in piers):
            PierCaps += across
        elif k % 2 == 0 or k == len(xs) - 1:
            CrossGirders += across
    Columns, Struts, Feet = [], [], []
    for x in piers:
        for y in (-g, g):
            Columns += pieces(P(x, y, 0), P(x, y, 0.5 * H), 3) + pieces(P(x, y, 0.5 * H), P(x, y, H), 3)
            Feet.append(P(x, y, 0))
        Struts += chain([P(x, y, 0.5 * H) for y in (-g, 0.0, g)])
    Bearings = [P(x, y, H) for x in (0.0, length) for y in (-g, g)]
    Watch = [P(0.5 * length, 0, H)]
    return Girders, CrossGirders, PierCaps, Columns, Struts, Slab, Feet, Bearings, Watch


# ---------------------------------------------------------------- 8 - a cable-stayed bridge

def cablestayed(Span, DeckHeight, PylonHeight, Width, Stays):
    """Two spans of Span each side of an H-shaped pylon: two legs Width apart, from the ground to
    PylonHeight above the deck, joined at the top. The deck is two edge girders joined by floor beams
    wherever a stay holds them, Stays a side in each span, the stays in two planes, fanning from the
    top quarter of each leg. The girders are built into the legs, and slide along their abutments.
    Watch: the deck in the middle of a span, and the top of the pylon."""
    n = max(2, int(Stays))
    w = 0.5 * Width
    top = DeckHeight + PylonHeight
    spacing = Span / (n + 1)
    xs = [-Span + k * spacing for k in range(2 * n + 3)]
    Girders, FloorBeams, Legs, CrossBeams, Cables, Feet, Bearings = [], [], [], [], [], [], []
    for y in (-w, w):
        Girders += [L(P(xs[k], y, DeckHeight), P(xs[k + 1], y, DeckHeight)) for k in range(len(xs) - 1)]
        Legs += pieces(P(0, y, 0), P(0, y, DeckHeight), 4)
        anchors = [DeckHeight + PylonHeight * (0.75 + 0.25 * j / (n - 1)) for j in range(n)]
        levels = [DeckHeight] + sorted(set(anchors))
        Legs += [L(P(0, y, levels[k]), P(0, y, levels[k + 1])) for k in range(len(levels) - 1)]
        Feet.append(P(0, y, 0))
        for side in (-1, 1):
            for j in range(n):
                # The outermost stay from the highest anchor, the innermost from the lowest.
                x = side * spacing * (j + 1)
                Cables.append(L(P(0, y, anchors[j]), P(x, y, DeckHeight)))
        Bearings += [P(-Span, y, DeckHeight), P(Span, y, DeckHeight)]
    FloorBeams += [L(P(x, -w, DeckHeight), P(x, w, DeckHeight)) for x in xs]
    CrossBeams += [L(P(0, -w, top), P(0, w, top))]
    Watch = [P(0.5 * Span, 0, DeckHeight), P(0, -w, top)]
    return Girders, FloorBeams, Legs, CrossBeams, Cables, Feet, Bearings, Watch


# ---------------------------------------------------------------- 9 - a deck arch bridge

def arch(Span, Rise, Columns, DeckAbove):
    """Two concrete arch ribs Span across and Rise high, parabolas springing from the ground 12 m
    apart and leaning in to 7 m apart at the crown, braced by a strut at every column. They carry a
    deck DeckAbove the crown on Columns pairs of spandrel columns, evenly spaced, built into both: a
    slab 11 m wide on two girders, joined by a floor beam on every pair of columns. The deck runs on
    to the abutments at its two ends, where it slides along, held across; the ribs are built in at
    their springings. Watch: the deck at the crown."""
    n = max(2, int(Columns))
    deck = Rise + DeckAbove
    spring, crown, g, w = 6.0, 3.5, 4.0, 5.5
    zs = lambda x: 4.0 * Rise * x * (Span - x) / (Span * Span)
    bs = lambda x: spring - (spring - crown) * zs(x) / Rise
    xs = [Span * k / (n + 1) for k in range(n + 2)]
    # The ribs and the deck, cut at every column and halfway between.
    ts = sorted(set([x for x in xs] + [0.5 * (xs[k] + xs[k + 1]) for k in range(len(xs) - 1)]))
    Ribs, Girders, SpandrelColumns = [], [], []
    for side in (-1, 1):
        Ribs += chain([P(t, side * bs(t), zs(t)) for t in ts])
        Girders += chain([P(t, side * g, deck) for t in ts])
        SpandrelColumns += [L(P(x, side * bs(x), zs(x)), P(x, side * g, deck)) for x in xs[1:-1]]
    Struts = [L(P(x, -bs(x), zs(x)), P(x, bs(x), zs(x))) for x in xs[1:-1]]
    FloorBeams = []
    for x in xs:
        FloorBeams += chain([P(x, y, deck) for y in (-g, 0.0, g)])
    Slab = [grid_mesh(ts, [-w, -g, 0.0, g, w], deck)]
    Springings = [P(x, y, 0) for x in (0.0, Span) for y in (-spring, spring)]
    Abutments = [P(x, y, deck) for x in (0.0, Span) for y in (-g, g)]
    Watch = [P(0.5 * Span, 0, deck)]
    return Ribs, Struts, Girders, FloorBeams, SpandrelColumns, Slab, Springings, Abutments, Watch


# ---------------------------------------------------------------- 10 - a building, and a tiny city of them

def _building(x0, y0, bay, height, floors, balconies=False, depth=1.5, split=1):
    """A steel frame on a grid of bay, x0, y0 its first corner: floors, from the first up, are the
    cells (i, j) each floor covers, every one inside the one under it, so that a column stands
    under every corner of a floor. Each floor has beams round its cells, cut split times a bay, and
    a slab mesh of quads on the beams' nodes; balconies: on every floor with the same floor over it,
    a slab depth deep along the south faces, on cantilevers at the columns and an edge beam."""
    Columns, Beams, Slabs, Feet = [], [], [], []
    n = max(1, int(split))
    pt = lambda i, j, k: P(x0 + i * bay, y0 + j * bay, k * height)
    corners = lambda cells: sorted(set((i + a, j + b) for (i, j) in cells for a in (0, 1) for b in (0, 1)))
    edges = lambda cells: sorted(set(e for (i, j) in cells for e in
                                     [((i, j), (i + 1, j)), ((i, j + 1), (i + 1, j + 1)), ((i, j), (i, j + 1)), ((i + 1, j), (i + 1, j + 1))]))
    Feet += [pt(i, j, 0) for (i, j) in corners(floors[0])]
    for k, cells in enumerate(floors, 1):
        Columns += [L(pt(i, j, k - 1), pt(i, j, k)) for (i, j) in corners(cells)]
        for a, b in edges(cells):
            Beams += pieces(pt(a[0], a[1], k), pt(b[0], b[1], k), n)
        mesh, at = rg.Mesh(), {}

        def v(point):
            key = (round(point.X, 6), round(point.Y, 6))
            if key not in at:
                at[key] = mesh.Vertices.Count
                mesh.Vertices.Add(point)
            return at[key]

        for (i, j) in sorted(cells):
            for a in range(n):
                for b in range(n):
                    q = [pt(i + (a + da) / n, j + (b + db) / n, k) for da, db in ((0, 0), (1, 0), (1, 1), (0, 1))]
                    mesh.Faces.AddFace(*[v(p) for p in q])
        if balconies and k < len(floors) and floors[k] == cells:
            out = rg.Vector3d(0, -depth, 0)
            south = [(i, j) for (i, j) in sorted(cells) if (i, j - 1) not in cells]
            for (i, j) in sorted(set(c for (i, j) in south for c in ((i, j), (i + 1, j)))):
                Beams.append(L(pt(i, j, k), pt(i, j, k) + out))
            for (i, j) in south:
                for a in range(n):
                    p, q = pt(i + a / n, j, k), pt(i + (a + 1) / n, j, k)
                    Beams.append(L(p + out, q + out))
                    mesh.Faces.AddFace(v(p + out), v(q + out), v(q), v(p))
        Slabs.append(mesh)
    return Columns, Beams, Slabs, Feet


def building(BaysX, BaysY, Bay, Storeys, StoreyHeight):
    """An office building: a steel frame BaysX by BaysY bays of Bay, Storeys storeys of StoreyHeight,
    columns built in at the ground, and a concrete slab at every floor on the beams, meshed twice a
    bay. Its mass is its members' and its slabs' own. Watch: a corner of the roof."""
    cells = _rect(max(1, int(BaysX)), max(1, int(BaysY)))
    storeys = max(1, int(Storeys))
    Columns, Beams, Slabs, Feet = _building(0.0, 0.0, Bay, StoreyHeight, [cells] * storeys, split=2)
    Watch = [P(0, 0, storeys * StoreyHeight)]
    return Columns, Beams, Slabs, Feet, Watch


def _rect(a, b):
    """The cells of a rectangle a bays by b."""
    return frozenset((i, j) for i in range(a) for j in range(b))


def _ell(a, b):
    """An L: the rectangle a by b without its far corner."""
    return _rect(a, b) - frozenset([(a - 1, b - 1)])


# The buildings of the city, row by row, low next to tall as a city grows: the footprint of each, in
# bays, its storeys, what tops it - a smaller footprint for its last few storeys - what it stands on
# - a wider one for its first few - and whether its south face has balconies.
CITY = [
    (_rect(3, 2), 2, None, None, False),
    (_ell(2, 2), 9, None, None, True),
    (_rect(2, 2), 4, (_rect(1, 1), 1), None, False),
    (_rect(2, 1), 16, None, None, True),
    (_ell(3, 2), 6, None, None, False),
    (_rect(2, 2), 12, None, None, True),
    (_rect(3, 1), 3, None, None, False),
    (_rect(2, 2), 20, (_rect(1, 1), 2), (_rect(3, 3), 2), False),
    (_rect(1, 2), 14, None, None, True),
    (_rect(2, 1), 5, (_rect(1, 1), 1), None, False),
    (_ell(2, 2), 10, (_rect(1, 1), 2), None, False),
    (_rect(2, 2), 2, None, None, False),
    (_rect(3, 1), 7, None, None, True),
    (_rect(2, 1), 18, None, (_rect(3, 2), 3), False),
    (_ell(2, 2), 3, None, None, False),
    (_rect(2, 2), 11, (_rect(2, 1), 2), None, True),
]


def city(Rows, ColumnsPerRow, Street, Bay, StoreyHeight):
    """A tiny city: Rows by ColumnsPerRow buildings of CITY, steel frames on a grid of Bay with a
    slab at every floor, Street between their plots of three bays square. Rectangles, Ls, towers
    on podiums and with penthouses, some with balconies: on the same ground each shakes in its own
    way, a low one stiff and quick, a tall one slow and soft, an L or a tower off its podium's
    middle twisting as it sways. Watch: a corner of each building's roof; Storeys: how many it has."""
    Columns, Beams, Slabs, Feet, Watch, Storeys = [], [], [], [], [], []
    rows, cols = max(1, int(Rows)), max(1, int(ColumnsPerRow))
    plot = 3 * Bay + Street
    for r in range(rows):
        for c in range(cols):
            cells, storeys, top, podium, balconies = CITY[(r * cols + c) % len(CITY)]
            low, high = podium[1] if podium else 0, top[1] if top else 0
            floors = ([podium[0]] * low if podium else []) + [cells] * (storeys - low - high) + \
                ([top[0]] * high if top else [])
            parts = _building(c * plot, r * plot, Bay, StoreyHeight, floors, balconies)
            Columns += parts[0]
            Beams += parts[1]
            Slabs += parts[2]
            Feet += parts[3]
            i, j = min(floors[-1])
            Watch.append(P(c * plot + i * Bay, r * plot + j * Bay, storeys * StoreyHeight))
            Storeys.append(storeys)
    return Columns, Beams, Slabs, Feet, Watch, Storeys


# ---------------------------------------------------------------- 12 - a footbridge's natural modes

def footbridge(Span, Width, Segment, Depth):
    """A footbridge of one span, Span long: a concrete deck Width wide and 200 mm thick on a steel box
    girder Depth deep down its middle, cut every Segment or so. The deck is meshed in quads, one
    across each half, its middle plane at Z = 0; the box's axis is under it, its top against the
    deck's underside, and each of its nodes is tied to the deck's node above by a rigid link, so that
    the two bend together. The box is held at both ends: a pinned bearing at the start, one sliding
    along at the far end. Box: its lines; Deck: the deck's mesh; Under and Over: each link's two
    nodes, the box's and the deck's; Pinned and Sliding: the box's two ends."""
    n = max(2, int(round(Span / Segment)))
    xs = [Span * i / n for i in range(n + 1)]
    z = -(0.1 + 0.5 * Depth)
    Box = chain([P(x, 0, z) for x in xs])
    Deck = [grid_mesh(xs, [-0.5 * Width, 0.0, 0.5 * Width], 0.0)]
    Under = [P(x, 0, z) for x in xs]
    Over = [P(x, 0, 0) for x in xs]
    return Box, Deck, Under, Over, [Under[0]], [Under[-1]]


# ---------------------------------------------------------------- 13 - sticks that draw a response spectrum

def sticks(Sticks, Shortest, Tallest, Spacing):
    """A row of Sticks steel sticks along x, Spacing apart, from Shortest to Tallest: each a
    cantilever from the ground to a mass at its top, an oscillator of one degree of freedom along
    the shaking. A cantilever's period goes as its height to the power 1.5, so their heights are
    spread for their periods to be spread evenly: along the row, x reads as the period axis of a
    response spectrum. Each stick is a model of its own, a branch of the trees: Lines, one line;
    Feet, where it is held; Tops, where its mass sits."""
    n = max(2, int(Sticks))
    low, high = Shortest ** 1.5, Tallest ** 1.5
    Lines, Feet, Tops = DataTree[object](), DataTree[object](), DataTree[object]()
    for i in range(n):
        h = (low + (high - low) * i / (n - 1)) ** (2.0 / 3.0)
        foot, top = P(i * Spacing, 0, 0), P(i * Spacing, 0, h)
        path = GH_Path(i)
        Lines.Add(L(foot, top), path)
        Feet.Add(foot, path)
        Tops.Add(top, path)
    return Lines, Feet, Tops


# How tall the spectrum stands behind the sticks: metres to 1 g of pseudo-acceleration.
SPECTRUM_SCALE = 8.0
# How far behind the sticks it stands, m.
SPECTRUM_BEHIND = 3.0


def spectrum(Periods, Displacements, Tops):
    """The response spectrum the sticks draw. Periods: each stick's, a branch each, from its Natural
    Vibration Analysis; Displacements: the sticks' displacements at every step of their
    transient analyses, from Nodal Displacements with History on, a branch a step. Sd is
    the most its top moved from the ground at any step, along x, in mm; PSa, its pseudo-acceleration, Sd times
    (2 pi / T) squared, in g. Spectrum and Grid draw them as a chart standing behind the sticks, its
    period axis along the row and its PSa SPECTRUM_SCALE m to the g: a line through each stick's
    PSa, and lines at every 0.25 g."""
    periods = [max(Periods.Branch(p)) for p in Periods.Paths if Periods.Branch(p).Count]
    n = len(periods)
    # Nodal Displacements gives a branch a step, every stick's nodes in it one after another, in the
    # order of the sticks; each stick's top moves the most.
    peaks = [0.0] * n
    for path in Displacements.Paths:
        moves = list(Displacements.Branch(path))
        each = len(moves) // n if n else 0
        for i in range(n if each else 0):
            peaks[i] = max([peaks[i]] + [abs(v.X) for v in moves[i * each:(i + 1) * each]])
    Period, Sd, PSa = [], [], []
    for T, peak in zip(periods, peaks):
        Period.append(T)
        Sd.append(1000.0 * peak)
        PSa.append((2 * math.pi / T) ** 2 * peak / 9.81)
    xs = [Tops.Branch(p)[0].X for p in Tops.Paths][:len(PSa)]
    y = SPECTRUM_BEHIND
    Spectrum = rg.Polyline([P(x, y, a * SPECTRUM_SCALE) for x, a in zip(xs, PSa)]).ToNurbsCurve()
    Grid = []
    if xs:
        for k in range(int(math.ceil(max(PSa) / 0.25)) + 1):
            z = 0.25 * k * SPECTRUM_SCALE
            Grid.append(L(P(xs[0], y, z), P(xs[-1], y, z)))
    return Period, Sd, PSa, Spectrum, Grid


# ---------------------------------------------------------------- 14 - a shell form-found to work in compression

# The plan of the shell, a cross of four legs 20 m from end to end, in 16 quads round its middle: the
# coarse net Kangaroo refines and pushes up. Its corners, from the middle out, x and y in m.
SHELL_QUADS = [
    ((-9.925, -1.207), (-9.925, 0.0), (-4.521, 0.0), (-5.356, -2.616)),
    ((-5.356, -2.616), (-4.521, 0.0), (0.0, -5.0), (-2.544, -5.451)),
    ((-2.544, -5.451), (0.0, -5.0), (0.0, -10.0), (-1.132, -10.0)),
    ((-4.521, 0.0), (-2.0, 0.0), (0.0, -2.0), (0.0, -5.0)),
]


def compressed_shell(Span):
    """A shell's net before it is form-found: a cross of four legs, Span from the end of one to the end
    of the one opposite, as one mesh of 16 quads, a quarter of them mirrored three ways. Ends: the
    straight edge at the end of each leg, where the shell stands."""
    k = Span / 20.0
    mesh, at = rg.Mesh(), {}

    def v(x, y):
        key = (round(x, 6), round(y, 6))
        if key not in at:
            at[key] = mesh.Vertices.Count
            mesh.Vertices.Add(P(k * x, k * y, 0.0))
        return at[key]

    for sx, sy in ((1, 1), (-1, 1), (1, -1), (-1, -1)):
        for quad in SHELL_QUADS:
            corners = [v(sx * x, sy * y) for x, y in quad]
            if sx * sy < 0:
                corners.reverse()
            mesh.Faces.AddFace(*corners)
    mesh.Normals.ComputeNormals()
    Ends = [L(P(-9.925 * k, -1.207 * k, 0), P(-9.925 * k, 1.207 * k, 0)),
            L(P(9.925 * k, -1.207 * k, 0), P(9.925 * k, 1.207 * k, 0)),
            L(P(-1.132 * k, -10 * k, 0), P(1.132 * k, -10 * k, 0)),
            L(P(-1.132 * k, 10 * k, 0), P(1.132 * k, 10 * k, 0))]
    return [mesh], Ends


# ---------------------------------------------------------------- the ground motion

# El Centro, 18 May 1940, the north-south component recorded at the Imperial Valley Irrigation District
# substation: a ground acceleration every 0.02 s, in g - the version OpenSees's examples use.
EL_CENTRO_DT = 0.02
EL_CENTRO = [
    0.00630, 0.00364, 0.00099, 0.00428, 0.00758, 0.01087, 0.00682, 0.00277, -0.00128, 0.00368,
    0.00864, 0.01360, 0.00727, 0.00094, 0.00420, 0.00221, 0.00021, 0.00444, 0.00867, 0.01290,
    0.01713, -0.00343, -0.02400, -0.00992, 0.00416, 0.00528, 0.01653, 0.02779, 0.03904, 0.02449,
    0.00995, 0.00961, 0.00926, 0.00892, -0.00486, -0.01864, -0.03242, -0.03365, -0.05723, -0.04534,
    -0.03346, -0.03201, -0.03056, -0.02911, -0.02766, -0.04116, -0.05466, -0.06816, -0.08166, -0.06846,
    -0.05527, -0.04208, -0.04259, -0.04311, -0.02428, -0.00545, 0.01338, 0.03221, 0.05104, 0.06987,
    0.08870, 0.04524, 0.00179, -0.04167, -0.08513, -0.12858, -0.17204, -0.12908, -0.08613, -0.08902,
    -0.09192, -0.09482, -0.09324, -0.09166, -0.09478, -0.09789, -0.12902, -0.07652, -0.02401, 0.02849,
    0.08099, 0.13350, 0.18600, 0.23850, 0.21993, 0.20135, 0.18277, 0.16420, 0.14562, 0.16143,
    0.17725, 0.13215, 0.08705, 0.04196, -0.00314, -0.04824, -0.09334, -0.13843, -0.18353, -0.22863,
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]


def elcentro(Duration, Scale):
    """The El Centro record's first Duration seconds, its accelerations times Scale, in m/s2: the
    Times and the Accelerations a Path Time Series takes, and how many steps of 0.02 s they make.
    Its peak, 0.32 g, comes 2.02 s in."""
    n = min(len(EL_CENTRO), int(round(Duration / EL_CENTRO_DT)) + 1)
    Times = [k * EL_CENTRO_DT for k in range(n)]
    Accelerations = [9.81 * Scale * a for a in EL_CENTRO[:n]]
    Steps = n - 1
    return Times, Accelerations, Steps


# ---------------------------------------------------------------- 15 - a tank's first hundred modes

def tank(Radius, Height, Around, Up, Modes, Columns, Spacing):
    """A cylindrical tank, Radius and Height, open at the top: a mesh of quads, Around round it and Up
    up it, standing on Z = 0, and the nodes of its base, where it is built in. Grid: one move a mode,
    Modes of them, Columns to a row, Spacing apart, that set each mode's copy of the tank in its place
    of a grid, the first at the back left, reading as a page does."""
    around, up = max(3, int(Around)), max(1, int(Up))
    mesh = rg.Mesh()
    for j in range(up + 1):
        for i in range(around):
            a = 2 * math.pi * i / around
            mesh.Vertices.Add(P(Radius * math.cos(a), Radius * math.sin(a), Height * j / up))
    for j in range(up):
        for i in range(around):
            k, n = j * around, (i + 1) % around
            mesh.Faces.AddFace(k + i, k + n, k + around + n, k + around + i)
    mesh.Normals.ComputeNormals()
    Base = [P(Radius * math.cos(2 * math.pi * i / around), Radius * math.sin(2 * math.pi * i / around), 0)
            for i in range(around)]
    columns = max(1, int(Columns))
    Grid = [rg.Vector3d(Spacing * (k % columns), -Spacing * (k // columns), 0) for k in range(max(1, int(Modes)))]
    return [mesh], Base, Grid


def mode_labels(Frequencies, Grid, Radius, Height):
    """A label over each mode's tank in the grid, its number and its frequency, from the tank's left
    edge, leaning back half way to lying flat, so that it reads from in front and from above, for
    Text Tag 3D."""
    Places, Texts = [], []
    for k, move in enumerate(Grid):
        if k >= len(Frequencies):
            break
        Places.append(rg.Plane(P(move.X - Radius, move.Y, Height + 1.0), rg.Vector3d.XAxis, rg.Vector3d(0, 1, 1)))
        Texts.append("{0}: {1:.1f} Hz".format(k + 1, Frequencies[k]))
    return Places, Texts


# ---------------------------------------------------------------- 16 - buildings that are not straight

def _key(p):
    return (round(p.X, 4), round(p.Y, 4), round(p.Z, 4))


class _Once(object):
    """Lines and points kept once each, however often they are drawn: round a ring, the last bay's
    far end is the first bay's near one."""

    def __init__(self):
        self.lines, self.points = set(), set()

    def line(self, into, a, b):
        k = frozenset([_key(a), _key(b)])
        if k not in self.lines and _key(a) != _key(b):
            self.lines.add(k)
            into.append(L(a, b))

    def point(self, into, p):
        if _key(p) not in self.points:
            self.points.add(_key(p))
            into.append(p)


def _unique(lines):
    """lines without the ones drawn twice, either way round."""
    kept, once = [], _Once()
    for line in lines:
        once.line(kept, line.From, line.To)
    return kept


def _mapped(floors, place, split):
    """A frame on a grid of cells, as _building, but with each point of the grid put where
    place(u, v, k) says on floor k, u and v the grid's coordinates: a building that twists, leans,
    curves or goes round as its floors go up. floors, from the first up, are the cells (i, j) each
    covers. Columns at every corner of a floor's cells, from the floor under it; beams round every
    cell, cut split times, following the grid's curves; a slab mesh of quads on the beams' nodes."""
    Columns, Beams, Slabs, Feet = [], [], [], []
    once = _Once()
    n = max(1, int(split))
    corners = lambda cells: sorted(set((i + a, j + b) for (i, j) in cells for a in (0, 1) for b in (0, 1)))
    edges = lambda cells: sorted(set(e for (i, j) in cells for e in
                                     [((i, j), (i + 1, j)), ((i, j + 1), (i + 1, j + 1)), ((i, j), (i, j + 1)), ((i + 1, j), (i + 1, j + 1))]))
    for (i, j) in corners(floors[0]):
        once.point(Feet, place(i, j, 0))
    for k, cells in enumerate(floors, 1):
        for (i, j) in corners(cells):
            once.line(Columns, place(i, j, k - 1), place(i, j, k))
        for a, b in edges(cells):
            for t in range(n):
                p = place(a[0] + (b[0] - a[0]) * t / n, a[1] + (b[1] - a[1]) * t / n, k)
                q = place(a[0] + (b[0] - a[0]) * (t + 1) / n, a[1] + (b[1] - a[1]) * (t + 1) / n, k)
                once.line(Beams, p, q)
        mesh, at = rg.Mesh(), {}

        def v(point):
            if _key(point) not in at:
                at[_key(point)] = mesh.Vertices.Count
                mesh.Vertices.Add(point)
            return at[_key(point)]

        for (i, j) in sorted(cells):
            for a in range(n):
                for b in range(n):
                    q = [place(i + (a + da) / n, j + (b + db) / n, k) for da, db in ((0, 0), (1, 0), (1, 1), (0, 1))]
                    mesh.Faces.AddFace(*[v(p) for p in q])
        mesh.Normals.ComputeNormals()
        Slabs.append(mesh)
    return Columns, Beams, Slabs, Feet


def twisting(Bays, Bay, Storeys, StoreyHeight, Twist):
    """A square tower Bays by Bays bays of Bay, each floor turned a little more than the one under it,
    Twist degrees in all from the ground to the roof: its columns lean round it from floor to floor,
    a concrete frame with a slab at every floor, meshed twice a bay. Watch: a corner of its roof."""
    b, s = max(1, int(Bays)), max(1, int(Storeys))

    def place(u, v, k):
        a = math.radians(Twist) * k / s
        x, y = (u - b / 2.0) * Bay, (v - b / 2.0) * Bay
        return P(x * math.cos(a) - y * math.sin(a), x * math.sin(a) + y * math.cos(a), k * StoreyHeight)

    Columns, Beams, Slabs, Feet = _mapped([_rect(b, b)] * s, place, 2)
    return Columns, Beams, Slabs, Feet, [place(0, 0, s)]


def leaning(BaysX, BaysY, Bay, Storeys, EastStoreys, StoreyHeight, Lean, Gap):
    """Two towers leaning towards each other over a street, Lean degrees off the vertical, their feet
    Gap apart across x: the west one Storeys tall, the east one EastStoreys, so that they sway out of
    step. Each BaysX by BaysY bays of Bay, a steel frame with a slab at every floor, meshed twice a
    bay, every floor moved over the one under it by the storey's height times the tangent of Lean.
    Watch: the top of each one's leaning face."""
    bx, by = max(1, int(BaysX)), max(1, int(BaysY))
    run = StoreyHeight * math.tan(math.radians(Lean))
    Columns, Beams, Slabs, Feet, Watch = [], [], [], [], []
    for side, storeys in ((-1, max(1, int(Storeys))), (1, max(1, int(EastStoreys)))):
        # The west tower leans east, the east one west: each one's inner face is at u = bx.
        def place(u, v, k, side=side):
            x = Gap / 2.0 + (bx - u) * Bay - k * run
            return P(side * x, (v - by / 2.0) * Bay, k * StoreyHeight)
        parts = _mapped([_rect(bx, by)] * storeys, place, 2)
        Columns += parts[0]
        Beams += parts[1]
        Slabs += parts[2]
        Feet += parts[3]
        Watch.append(place(bx, 0, storeys))
    return Columns, Beams, Slabs, Feet, Watch


def curving(Around, Radius, Core, Storeys, StoreyHeight, Bend):
    """A round tower whose floors move out along x and back as they go up, Bend at half its height:
    rings of columns at Core, half way and Radius, Around of each, a steel frame with ring and radial
    beams and a slab round the core at every floor. Watch: the roof's edge, on the side it bends to."""
    n, s = max(3, int(Around)), max(1, int(Storeys))
    height = s * StoreyHeight

    def place(u, v, k):
        a = 2 * math.pi * u / n
        r = Core + (Radius - Core) * v / 2.0
        z = k * StoreyHeight
        return P(Bend * math.sin(math.pi * z / height) + r * math.cos(a), r * math.sin(a), z)

    cells = frozenset((i, j) for i in range(n) for j in range(2))
    Columns, Beams, Slabs, Feet = _mapped([cells] * s, place, 1)
    return Columns, Beams, Slabs, Feet, [place(0, 2, s)]


def crescent(Bays, Depth, Bay, Radius, Sweep, Storeys, StoreyHeight):
    """A block curved in plan, Sweep degrees of a ring Radius across its inner face: Bays along it,
    Depth bays of Bay deep, a concrete frame with a slab at every floor, meshed twice a bay. Its
    middle is on the y axis, so that shaking along x twists it. Watch: a tip of its roof."""
    b, d, s = max(1, int(Bays)), max(1, int(Depth)), max(1, int(Storeys))

    def place(u, v, k):
        a = math.radians(Sweep) * (u / b - 0.5)
        r = Radius + v * Bay
        return P(r * math.sin(a), r * math.cos(a) - Radius, k * StoreyHeight)

    Columns, Beams, Slabs, Feet = _mapped([_rect(b, d)] * s, place, 2)
    return Columns, Beams, Slabs, Feet, [place(0, d, s)]


# ---------------------------------------------------------------- 17 - towers of a hundred storeys

def _floors(levels, masters, load, areas):
    """The trees a Rigid Diaphragm takes, a branch a floor - its nodes, and the one it is driven from -
    and the Mass Points that give each floor its mass, load kg/m2 of its area shared between its
    nodes."""
    Floors, Masters = DataTree[object](), DataTree[object]()
    MassPoints, Masses = [], []
    for k, (points, master, area) in enumerate(zip(levels, masters, areas)):
        Floors.AddRange(points, GH_Path(k))
        Masters.Add(master, GH_Path(k))
        m = load * area / len(points)
        for p in points:
            MassPoints.append(p)
            Masses.append(rg.Vector3d(m, m, m))
    return Floors, Masters, MassPoints, Masses


# Where each of the nine tubes stops, out of 108 storeys: (column, row) from the south-west, x east,
# y north. Two stop at the 50th floor, two at the 66th, three at the 90th; two go to the top.
BUNDLED_TOPS = {(0, 2): 50, (2, 0): 50, (0, 0): 66, (2, 2): 66, (1, 2): 90, (2, 1): 90, (1, 0): 90,
                (0, 1): 108, (1, 1): 108}
BUNDLED_BELTS = (29, 64, 88)


def bundled(Tube, Bays, Storeys, StoreyHeight, FloorMass):
    """A bundled tube, after the Willis Tower in Chicago: nine square tubes of Tube, three by three,
    each wall a frame of columns Bays to a side tied by deep spandrels, bundled up to the 50th floor
    and stopping at the 50th, 66th, 90th and the top of 108, as BUNDLED_TOPS, scaled to Storeys. Belt
    trusses, crossed braces in every bay of the walls, over two storeys at three floors. The floors are
    rigid diaphragms, FloorMass kg/m2 at their nodes. Watch: the roof, and the top of a 50-storey tube."""
    n, s = max(1, int(Bays)), max(1, int(Storeys))
    a = Tube / n
    top = dict((t, int(round(s * f / 108.0))) for t, f in BUNDLED_TOPS.items())
    belts = [int(round(s * f / 108.0)) for f in BUNDLED_BELTS]
    pt = lambda i, j, k: P(i * a, j * a, k * StoreyHeight)

    def walls(k):
        """The bays of the tubes' walls on floor k, as pairs of grid points."""
        bays = set()
        for (c, r), t in top.items():
            if t >= k:
                for m in range(n):
                    bays.add(((c * n + m, r * n), (c * n + m + 1, r * n)))
                    bays.add(((c * n + m, r * n + n), (c * n + m + 1, r * n + n)))
                    bays.add(((c * n, r * n + m), (c * n, r * n + m + 1)))
                    bays.add(((c * n + n, r * n + m), (c * n + n, r * n + m + 1)))
        return sorted(bays)

    Columns, Spandrels, Belts, Feet, levels, masters, areas = [], [], [], [], [], [], []
    for k in range(1, s + 1):
        bays = walls(k)
        nodes = sorted(set(p for bay in bays for p in bay))
        Columns += [L(pt(i, j, k - 1), pt(i, j, k)) for (i, j) in nodes]
        Spandrels += [L(pt(p[0], p[1], k), pt(q[0], q[1], k)) for p, q in bays]
        if any(b < k <= b + 2 for b in belts):
            for p, q in bays:
                Belts.append(L(pt(p[0], p[1], k - 1), pt(q[0], q[1], k)))
                Belts.append(L(pt(q[0], q[1], k - 1), pt(p[0], p[1], k)))
        if k == 1:
            Feet = [pt(i, j, 0) for (i, j) in nodes]
        levels.append([pt(i, j, k) for (i, j) in nodes])
        masters.append(pt(n, n, k))
        areas.append(sum(1 for t in top.values() if t >= k) * Tube * Tube)
    Floors, Masters, MassPoints, Masses = _floors(levels, masters, FloorMass, areas)
    Watch = [pt(n, n, s), pt(0, 3 * n, top[(0, 2)])]
    return Columns, Spandrels, Belts, Feet, Floors, Masters, MassPoints, Masses, Watch


def braced(Length, Width, TopLength, TopWidth, Storeys, StoreyHeight, XStoreys, FloorMass):
    """A braced tube, after the John Hancock Center in Chicago: a tapering box, Length by Width at the
    ground and TopLength by TopWidth at the roof, its four faces crossed by diagonals from corner to
    corner, an X every XStoreys storeys and half of one at the top, on columns eight bays along its
    long faces and five along its short ones, leaning in with it. The diagonals pass through every
    floor, where the spandrels meet them. The floors are rigid diaphragms, FloorMass kg/m2 at their
    nodes. Watch: a corner of the roof."""
    s, m = max(1, int(Storeys)), max(2, int(XStoreys))
    xs, rest = s // m, s - (s // m) * m
    hx = lambda k: (Length + (TopLength - Length) * k / float(s)) / 2.0
    hy = lambda k: (Width + (TopWidth - Width) * k / float(s)) / 2.0
    corner = lambda c, k: P((-1, 1, 1, -1)[c % 4] * hx(k), (-1, -1, 1, 1)[c % 4] * hy(k), k * StoreyHeight)
    face = lambda f, t, k: corner(f, k) + (corner(f + 1, k) - corner(f, k)) * t
    bays = (8, 5, 8, 5)

    def cross(k, x):
        """How far along a face, from its first corner, the X x's rising diagonal crosses floor k;
        the X above the last whole one is half an X, its diagonals meeting at the roof."""
        if x < xs:
            return (k - x * m) / float(m)
        return 0.5 * (k - xs * m) / rest if rest else 0.0

    Columns, Spandrels, Diagonals, Feet, levels, masters, areas = [], [], [], [], [], [], []
    for k in range(s + 1):
        t = cross(k, k // m)
        ring = []
        for f in range(4):
            stops = set(i / float(bays[f]) for i in range(bays[f])) | set(x for x in (t, 1 - t) if x < 1 - 1e-9)
            ring += [face(f, x, k) for x in sorted(round(x, 9) for x in stops)]
        if k == 0:
            Feet = [face(f, i / float(bays[f]), 0) for f in range(4) for i in range(bays[f])]
            continue
        for f in range(4):
            for i in range(bays[f]):
                Columns.append(L(face(f, i / float(bays[f]), k - 1), face(f, i / float(bays[f]), k)))
        Spandrels += [L(ring[i], ring[(i + 1) % len(ring)]) for i in range(len(ring))]
        # Each diagonal, floor by floor: from where it crosses the floor under to where it crosses this one.
        x = (k - 1) // m
        t0, t1 = cross(k - 1, x), cross(k, x)
        for f in range(4):
            Diagonals.append(L(face(f, t0, k - 1), face(f, t1, k)))
            Diagonals.append(L(face(f, 1 - t0, k - 1), face(f, 1 - t1, k)))
        levels.append(ring)
        masters.append(corner(0, k))
        areas.append(4 * hx(k) * hy(k))
    Floors, Masters, MassPoints, Masses = _floors(levels, masters, FloorMass, areas)
    return Columns, Spandrels, Diagonals, Feet, Floors, Masters, MassPoints, Masses, [corner(0, s)]


def _walls(pieces):
    """A mesh of wall panels, one quad a piece, each piece the pair of its foot's ends and the pair of
    its top's, its nodes shared where panels meet."""
    mesh, at = rg.Mesh(), {}

    def v(point):
        if _key(point) not in at:
            at[_key(point)] = mesh.Vertices.Count
            mesh.Vertices.Add(point)
        return at[_key(point)]

    for (a, b), (c, d) in pieces:
        mesh.Faces.AddFace(v(a), v(b), v(d), v(c))
    mesh.Normals.ComputeNormals()
    return mesh


def _level_points(lines, meshes, z):
    """Every end of lines and every vertex of meshes at height z, each once. A mesh keeps its
    vertices in single precision - 592 m up, one is 591.99998 - so heights match to a millimetre."""
    points, once = [], _Once()
    for line in lines:
        for p in (line.From, line.To):
            if abs(p.Z - z) < 1e-3:
                once.point(points, p)
    for mesh in meshes:
        for i in range(mesh.Vertices.Count):
            p = rg.Point3d(mesh.Vertices[i])
            if abs(p.Z - z) < 1e-3:
                once.point(points, P(p.X, p.Y, z))
    return points


def buttressed(Core, Corridor, WingWidth, Module, Modules, Storeys, StoreyHeight, Spire, FloorMass):
    """A buttressed core, after the Burj Khalifa in Dubai: three wings round a hexagonal core of
    concrete walls, Core from its middle to a corner, each wing two corridor walls Corridor apart
    running out Modules modules of Module, in panels two modules long, with a hammerhead wall across
    its end and columns down its faces, WingWidth wide, tied to the corridor walls by beams where
    two panels meet. The wings step back a module at a
    time, one wing after another round the tower, until only the core is left, which goes on to the
    roof of Storeys and carries a steel spire Spire tall. The floors are rigid diaphragms, FloorMass
    kg/m2 at their nodes. Watch: the spire's tip, and the roof."""
    s, m0, h = max(1, int(Storeys)), max(1, int(Modules)), StoreyHeight
    c, w = Corridor / 2.0, WingWidth / 2.0
    apothem = Core * math.cos(math.pi / 6)
    first, last = int(round(0.12 * s)), int(round(0.82 * s))
    steps = [first + int(round(i * (last - first) / float(max(1, 3 * m0 - 1)))) for i in range(3 * m0)]
    alive = lambda wing, k: m0 - sum(1 for i in range(wing, 3 * m0, 3) if steps[i] < k)
    hexagon = lambda i, k: P(Core * math.cos(math.pi * i / 3), Core * math.sin(math.pi * i / 3), k * h)

    def at(wing, along, across, k):
        a = math.radians(90 + 120 * wing)
        return P(along * math.cos(a) - across * math.sin(a), along * math.sin(a) + across * math.cos(a), k * h)

    station = lambda j: apothem + j * Module
    Walls, Columns, Beams, Spire_, Feet, levels, masters, areas = [], [], [], [], [], [], [], []
    for k in range(1, s + 1):
        plan = []   # the floor's wall pieces, as pairs of points at height 0
        for i in range(6):
            # The sides the wings meet - the 1st, 3rd and 5th - are cut where the corridor walls start.
            if i % 2 == 1:
                wing = (i // 2)
                cuts = [-Core / 2.0, -c, c, Core / 2.0]
                plan += [(at(wing, apothem, cuts[j], 0), at(wing, apothem, cuts[j + 1], 0)) for j in range(3)]
            else:
                plan.append((hexagon(i, 0), hexagon(i + 1, 0)))
        lines = []
        for wing in range(3):
            n = alive(wing, k)
            # The corridor walls in panels two modules long - a model of 160 storeys of walls is slow
            # enough as it is - and the beams across to the faces where two panels meet.
            for e in (-c, c):
                plan += [(at(wing, station(j), e, 0), at(wing, station(min(j + 2, n)), e, 0)) for j in range(0, n, 2)]
            if n > 0:
                cuts = [-w, -c, c, w]
                plan += [(at(wing, station(n), cuts[j], 0), at(wing, station(n), cuts[j + 1], 0)) for j in range(3)]
            for e in (-w, w):
                for j in range(1, n + 1):
                    Columns.append(L(at(wing, station(j), e, k - 1), at(wing, station(j), e, k)))
                    lines.append(Columns[-1])
                for j in range(1, n):
                    Beams.append(L(at(wing, station(j), e, k), at(wing, station(j + 1), e, k)))
                    lines.append(Beams[-1])
                    if j % 2 == 0:
                        Beams.append(L(at(wing, station(j), e, k), at(wing, station(j), e * c / w, k)))
                        lines.append(Beams[-1])
        up = rg.Vector3d(0, 0, h)
        panels = [((a + up * (k - 1), b + up * (k - 1)), (a + up * k, b + up * k)) for a, b in plan]
        Walls.append(_walls(panels))
        if k == 1:
            Feet = _level_points(lines, [Walls[0]], 0.0)
        levels.append(_level_points(lines, [Walls[-1]], k * h))
        masters.append(hexagon(0, k))
        areas.append(1.5 * math.sqrt(3) * Core * Core + sum(alive(i, k) * Module * WingWidth for i in range(3)))
    # The spire: a steel mast that starts eight storeys down inside the core, held at every floor by
    # spokes from the core's corners, and goes on over the roof in 10 m pieces.
    top, foot = P(0, 0, s * h), max(0, s - 8)
    for k in range(foot, s + 1):
        Beams += [L(hexagon(i, k), P(0, 0, k * h)) for i in range(6)]
    Spire_ = [L(P(0, 0, (k - 1) * h), P(0, 0, k * h)) for k in range(foot + 1, s + 1)] + \
        pieces(top, top + rg.Vector3d(0, 0, Spire), max(1, int(round(Spire / 10.0))))
    Floors, Masters, MassPoints, Masses = _floors(levels, masters, FloorMass, areas)
    Watch = [top + rg.Vector3d(0, 0, Spire), hexagon(0, s)]
    return Walls, Columns, Beams, Spire_, Feet, Floors, Masters, MassPoints, Masses, Watch


def outrigger(StoreyHeight, Width, Flare, DamperMass, DamperPeriod, DamperDamping, FloorMass):
    """Outriggers, after Taipei 101: a braced steel core of sixteen columns, 22 m square, and eight
    super columns, two on each face, 45 m apart across the tower, tied together by outrigger trusses
    two storeys deep at the foot of every one of eight modules of eight storeys. The modules flare
    out, from Width at the foot to Width plus Flare at the top, each on the one under it, over a base
    of 25 storeys that narrows as it rises and under a top of 12: 101 storeys in all. In the core, a
    damper - DamperMass tonnes hung from the 92nd floor, a spring and a dashpot that swing it at
    DamperPeriod with DamperDamping % of critical damping - sways against the tower. The floors are
    rigid diaphragms, FloorMass kg/m2 at their nodes. Watch: the roof, and the damper."""
    h, base, modules, height, top = StoreyHeight, 25, 8, 8, 12
    s = base + modules * height + top
    crown = base + modules * height
    C, F, T = 11.0, 22.5, 15.0
    xs = [-C, -C / 3, C / 3, C]
    z = lambda k: k * h

    def half(k, segment):
        """The half width of the tower's perimeter on floor k, of the segment it is drawn for: -1
        the base, 0 to 7 the modules, 8 the top."""
        if segment < 0:
            return Width + 10 - 10 * k / float(base)
        if segment < modules:
            return Width + Flare * (k - base - segment * height) / float(height)
        return T

    def ring(b, k):
        points = []
        for i in range(6):
            points.append(P(-b + 2 * b * i / 6.0, -b, z(k)))
        for i in range(6):
            points.append(P(b, -b + 2 * b * i / 6.0, z(k)))
        for i in range(6):
            points.append(P(b - 2 * b * i / 6.0, b, z(k)))
        for i in range(6):
            points.append(P(-b, b - 2 * b * i / 6.0, z(k)))
        return points

    def segments(k):
        """The segments a floor belongs to: two where one ends and the next begins."""
        if k < base:
            return [-1]
        if k >= crown:
            return [modules - 1, modules] if k == crown else [modules]
        j = (k - base) // height
        return [j - 1, j] if (k - base) % height == 0 and j > 0 else ([-1, 0] if k == base else [j])

    CoreColumns, CoreBeams, CoreBraces, Supers, Perimeter, Rings, Outriggers, Feet = [], [], [], [], [], [], [], []
    supers = [P(x, y, 0) for x in (-C, C) for y in (-F, F)] + [P(x, y, 0) for x in (-F, F) for y in (-C, C)]
    partner = lambda p: P(C if p.X > 0 else -C, C if p.Y > 0 else -C, 0)
    up = lambda p, k: P(p.X, p.Y, z(k))
    for k in range(1, s + 1):
        for x in xs:
            for y in xs:
                CoreColumns.append(L(P(x, y, z(k - 1)), P(x, y, z(k))))
        for line in range(4):
            for bay in range(3):
                for a, b in (((xs[bay], xs[line]), (xs[bay + 1], xs[line])), ((xs[line], xs[bay]), (xs[line], xs[bay + 1]))):
                    CoreBeams.append(L(P(a[0], a[1], z(k)), P(b[0], b[1], z(k))))
                    if (k + bay) % 2 == 0:
                        CoreBraces.append(L(P(a[0], a[1], z(k - 1)), P(b[0], b[1], z(k))))
                    else:
                        CoreBraces.append(L(P(b[0], b[1], z(k - 1)), P(a[0], a[1], z(k))))
        if k <= crown:
            Supers += [L(up(p, k - 1), up(p, k)) for p in supers]
        # The perimeter: columns from the floor under in the same segment, and a ring of beams on
        # every ring of the floor, with beams across where two segments meet.
        here = segments(k)
        below = segments(k - 1)
        for g in here:
            if g in below:
                Perimeter += [L(a, b) for a, b in zip(ring(half(k - 1, g), k - 1), ring(half(k, g), k))]
        rings = [ring(half(k, g), k) for g in here]
        for r in rings:
            Rings += [L(r[i], r[(i + 1) % 24]) for i in range(24)]
        if len(rings) == 2 and abs(half(k, here[0]) - half(k, here[1])) > 1e-6:
            Rings += [L(a, b) for a, b in zip(rings[0], rings[1])]
        # Outriggers: two storeys deep under the foot of every module but the first, and under the top.
        if any(k == base + j * height for j in range(1, modules + 1)):
            for p in supers:
                q = partner(p)
                mid = P((p.X + q.X) / 2, (p.Y + q.Y) / 2, 0)
                Outriggers += [L(up(q, k - 2), up(mid, k - 1)), L(up(mid, k - 1), up(p, k)),
                               L(up(p, k - 2), up(mid, k - 1)), L(up(mid, k - 1), up(q, k)),
                               L(up(q, k - 1), up(mid, k - 1)), L(up(mid, k - 1), up(p, k - 1)),
                               L(up(q, k), up(p, k)), L(up(q, k - 2), up(p, k - 2))]
    Feet = [P(x, y, 0) for x in xs for y in xs] + supers + ring(half(0, -1), 0)
    # The damper: hung from four beams across the core's middle bay on the 92nd floor, sitting half
    # a storey over the 88th, clear of every floor.
    hang = P(0, 0, z(92))
    mass = P(0, 0, z(88) + h / 2)
    Hangers = [L(P(x, y, z(92)), hang) for x in xs[1:3] for y in xs[1:3]]
    Damper = [L(hang, mass)]
    allLines = CoreColumns + CoreBeams + CoreBraces + Supers + Perimeter + Rings + Outriggers + Hangers
    byLevel = {}
    for line in allLines:
        for p in (line.From, line.To):
            k = int(round(p.Z / h))
            if k > 0 and abs(p.Z - z(k)) < 1e-6:
                byLevel.setdefault(k, {})[_key(p)] = p
    levels = [list(byLevel[k].values()) for k in range(1, s + 1)]
    masters = [P(C, C, z(k)) for k in range(1, s + 1)]
    areas = [max(4 * half(k, g) ** 2 for g in segments(k)) for k in range(1, s + 1)]
    Floors, Masters, MassPoints, Masses = _floors(levels, masters, FloorMass, areas)
    # The damper's spring and dashpot, from its mass and period: k = m w2, c = 2 zeta m w, in kN and t.
    omega = 2 * math.pi / DamperPeriod
    Stiffness = DamperMass * omega * omega
    Dashpot = 2 * DamperDamping / 100.0 * DamperMass * omega
    DamperMasses = rg.Vector3d(DamperMass * 1000, DamperMass * 1000, DamperMass * 1000)
    Watch = [P(C, C, z(s)), mass]
    CoreColumns, CoreBeams, CoreBraces, Supers, Perimeter, Rings, Outriggers, Hangers = [
        _unique(x) for x in (CoreColumns, CoreBeams, CoreBraces, Supers, Perimeter, Rings, Outriggers, Hangers)]
    return (CoreColumns, CoreBeams, CoreBraces, Supers, Perimeter, Rings, Outriggers, Hangers, Feet, Floors,
            Masters, MassPoints, Masses, Damper, mass, DamperMasses, Stiffness, Dashpot, Watch)


def diagrid(Radius, Bulge, Around, Storeys, StoreyHeight, NodeStoreys, Core, FloorMass):
    """A diagrid, after the Guangzhou International Finance Center: a tube of steel diagonals round a
    concrete core, its plan a triangle with rounded corners, Radius across at the ground and at the
    roof and Bulge times more half way up. The diagonals cross each other at nodes Around round it,
    every NodeStoreys storeys, and pass through every floor, where a ring beam meets them. The core
    is a hexagon of walls, Core from its middle to a corner. The floors are rigid diaphragms,
    FloorMass kg/m2 at their nodes. Watch: the roof."""
    n, s, m = max(3, int(Around)), max(1, int(Storeys)), max(1, int(NodeStoreys))
    h = StoreyHeight
    radius = lambda a, k: Radius * (1 + Bulge * math.sin(math.pi * k / float(s))) * (1 + 0.08 * math.cos(3 * a))
    on = lambda a, k: P(radius(a, k) * math.cos(a), radius(a, k) * math.sin(a), k * h)
    node = lambda i, x: 2 * math.pi * (i + 0.5 * (x % 2)) / n

    def angles(k, x):
        t = (k - x * m) / float(m)
        return [node(i, x) + d * t * math.pi / n for i in range(n) for d in (-1, 1)]

    hexagon = lambda i, k: P(Core * math.cos(math.pi * i / 3), Core * math.sin(math.pi * i / 3), k * h)
    Diagonals, Rings, Walls, levels, masters, areas = [], [], [], [], [], []
    for k in range(1, s + 1):
        x = (k - 1) // m
        for a0, a1 in zip(angles(k - 1, x), angles(k, x)):
            Diagonals.append(L(on(a0, k - 1), on(a1, k)))
        around = sorted(set(round(a % (2 * math.pi), 9) for a in angles(k, k // m)))
        ring = [on(a, k) for a in around]
        Rings += [L(ring[i], ring[(i + 1) % len(ring)]) for i in range(len(ring))]
        pieces_ = []
        for i in range(6):
            a, b, mid = hexagon(i, 0), hexagon(i + 1, 0), None
            mid = (a + b) / 2
            for p, q in ((a, mid), (mid, b)):
                pieces_.append(((p + rg.Vector3d(0, 0, (k - 1) * h), q + rg.Vector3d(0, 0, (k - 1) * h)),
                                (p + rg.Vector3d(0, 0, k * h), q + rg.Vector3d(0, 0, k * h))))
        Walls.append(_walls(pieces_))
        core = [hexagon(i, k) for i in range(6)] + [(hexagon(i, k) + hexagon(i + 1, k)) / 2 for i in range(6)]
        levels.append(ring + core)
        masters.append(hexagon(0, k))
        areas.append(0.5 * abs(sum(ring[i].X * ring[(i + 1) % len(ring)].Y - ring[(i + 1) % len(ring)].X * ring[i].Y
                                   for i in range(len(ring)))))
    Feet = [on(node(i, 0), 0) for i in range(n)] + [hexagon(i, 0) for i in range(6)] + \
        [(hexagon(i, 0) + hexagon(i + 1, 0)) / 2 for i in range(6)]
    Floors, Masters, MassPoints, Masses = _floors(levels, masters, FloorMass, areas)
    return Diagonals, Rings, Walls, Feet, Floors, Masters, MassPoints, Masses, [ring[0]]


def pushover(BayX, SecondBayX, BayY, GroundStorey, Storey):
    """A small concrete building that is not regular: an L in plan - three cells of a grid two bays by
    two, BayX and SecondBayX along x and BayY twice along y, without the cell at the back on the right -
    two storeys over the whole L, the ground one GroundStorey tall and taller than the rest, and a
    third storey, Storey tall like the second, over the front left cell only. Its columns are built in
    at the ground. Floors: every node above the ground; Forces: the push on each, along x at load
    factor 1, growing with its height, as a building sways in its first mode - every node standing for
    about the same mass, a floor's share is its number of nodes times its height; Roof: the corner of
    the top storey over the middle of the L, where the push is controlled."""
    xs = [0.0, BayX, BayX + SecondBayX]
    ys = [0.0, BayY, 2.0 * BayY]
    zs = [0.0, GroundStorey, GroundStorey + Storey, GroundStorey + 2.0 * Storey]
    ell = [(0, 0), (1, 0), (0, 1)]
    footprints = [ell, ell, [(0, 0)]]

    def corners(cells):
        seen = []
        for i, j in cells:
            for p in ((i, j), (i + 1, j), (i, j + 1), (i + 1, j + 1)):
                if p not in seen:
                    seen.append(p)
        return seen

    def edges(cells):
        seen = []
        for i, j in cells:
            for e in (((i, j), (i + 1, j)), ((i, j + 1), (i + 1, j + 1)), ((i, j), (i, j + 1)), ((i + 1, j), (i + 1, j + 1))):
                if e not in seen:
                    seen.append(e)
        return seen

    node = lambda p, k: P(xs[p[0]], ys[p[1]], zs[k])
    Columns, Beams, Floors, Forces = [], [], [], []
    for k, cells in enumerate(footprints):
        Columns += [L(node(p, k), node(p, k + 1)) for p in corners(cells)]
        Beams += [L(node(a, k + 1), node(b, k + 1)) for a, b in edges(cells)]
        Floors += [node(p, k + 1) for p in corners(cells)]
        Forces += [rg.Vector3d(2.0 * zs[k + 1] / zs[3], 0.0, 0.0) for p in corners(cells)]
    Feet = [node(p, 0) for p in corners(ell)]
    Roof = node((1, 1), 3)
    return Columns, Beams, Feet, Floors, Forces, Roof


def _nice(x):
    """A round number at or above x, for an axis: 1, 1.5, 2, 2.5, 3, 4, 5, 6 or 8 times a power of ten."""
    if x <= 0:
        return 1.0
    power = 10 ** math.floor(math.log10(x))
    for step in (1, 1.5, 2, 2.5, 3, 4, 5, 6, 8, 10):
        if step * power >= x - 1e-9:
            return step * power
    return 10 * power


def capacity_curve(Displacement, BaseShear, Steps, Point, Origin, Size):
    """The capacity curve, drawn in the XZ plane from Origin, Size across and Size high: base shear up,
    the control point's displacement along, in mm. Curve: the whole of it; SoFar: up to Point; Dot: a
    ring round Point on it; Axes: the two axes and their ticks; TagAt and Tags: where each label goes - a
    plane upright in the drawing's plane, so that Text Tag 3D stands the text up, facing whoever looks at
    the frame - and what it says; Step: Point's recorded step, for Model View."""
    n = len(Displacement)
    if n == 0 or len(BaseShear) != n:
        return None, None, None, [], [], [], 0
    i = max(0, min(n - 1, int(Point)))
    d = [x * 1000.0 for x in Displacement]
    top_d, top_v = _nice(max(abs(x) for x in d)), _nice(max(abs(v) for v in BaseShear))
    o = Origin
    at = lambda x, v: P(o.X + Size * x / top_d, o.Y, o.Z + Size * v / top_v)
    Curve = rg.Polyline([at(x, v) for x, v in zip(d, BaseShear)]).ToNurbsCurve()
    SoFar = rg.Polyline([at(x, v) for x, v in zip(d[:i + 1], BaseShear[:i + 1])]).ToNurbsCurve() if i > 0 else None
    tick = Size / 40.0
    Dot = rg.Circle(rg.Plane(at(d[i], BaseShear[i]), rg.Vector3d.XAxis, rg.Vector3d.ZAxis), tick).ToNurbsCurve()
    Axes = [L(at(0, 0), at(top_d, 0)), L(at(0, 0), at(0, top_v))]
    upright = lambda p: rg.Plane(p, rg.Vector3d.XAxis, rg.Vector3d.ZAxis)
    TagAt, Tags = [], []
    for k in range(5):
        x, v = top_d * k / 4, top_v * k / 4
        Axes += [L(at(x, 0), at(x, 0) + rg.Vector3d(0, 0, -tick)), L(at(0, v), at(0, v) + rg.Vector3d(-tick, 0, 0))]
        TagAt += [upright(at(x, 0) + rg.Vector3d(-tick, 0, -5 * tick)), upright(at(0, v) + rg.Vector3d(-9 * tick, 0, -tick))]
        Tags += ["{0:g}".format(round(x, 6)), "{0:g}".format(round(v, 6))]
    # The axes' names, and the point's values a line over the shear's, where they cannot run into it.
    TagAt += [upright(at(top_d * 0.3, 0) + rg.Vector3d(0, 0, -10 * tick)), upright(at(0, top_v) + rg.Vector3d(-tick, 0, 3 * tick)),
              upright(at(0, top_v) + rg.Vector3d(-tick, 0, 8 * tick))]
    shown = lambda x: 0 if abs(x) < 0.5 else x
    Tags += ["Roof displacement [mm]", "Base shear [kN]",
             "{0:.0f} mm, {1:.0f} kN".format(shown(d[i]), shown(BaseShear[i]))]
    Step = Steps[i] if i < len(Steps) else 0
    return Curve, SoFar, Dot, Axes, TagAt, Tags, Step


Columns, Beams, Feet, Floors, Forces, Roof = pushover(BayX, SecondBayX, BayY, GroundStorey, Storey)
# ---------- end irregular_building ----------

# ---- group: 2 - Members: fibre sections of Concrete01 and ReinforcingSteel, on ForceBeamColumns
c25_30 = Concrete01Alpaca4d(MaterialName="C25/30", Fco=-25000, Fcu=-20000, EpsilonCo=-0.002, EpsilonCu=-0.0035, MinMax=False)
b450c = ReinforcingSteelAlpaca4d(MaterialName="B450C", Fy=450000, Fu=540000, Es=200000000, Esh=2000000, Esh_2=0.008, Eult=0.075, MinMax=False)
column_400_x_400_outline = Rectangle3Pt(PointA=Point(-0.2, -0.2, 0), PointB=Point(0.2, -0.2, 0), PointC=Point(0.2, 0.2, 0))  # -> Rectangle, Length
beam_500_x_300_outline = Rectangle3Pt(PointA=Point(-0.25, -0.15, 0), PointB=Point(0.25, -0.15, 0), PointC=Point(0.25, 0.15, 0))  # -> Rectangle, Length
column_400_x_400_fibres = MeshPlane(Boundary=column_400_x_400_outline.Rectangle, WidthCount=10, HeightCount=10)  # -> Mesh, Area
beam_500_x_300_fibres = MeshPlane(Boundary=beam_500_x_300_outline.Rectangle, WidthCount=12, HeightCount=6)  # -> Mesh, Area
column_400_x_400_concrete = PatchAlpaca4d(Mesh=column_400_x_400_fibres.Mesh, Material=c25_30)
column_400_x_400_bars = FiberPointAlpaca4d(
    Point=[Point(-0.15, -0.15, 0), Point(0, -0.15, 0), Point(0.15, -0.15, 0), Point(-0.15, 0, 0), Point(0.15, 0, 0), Point(-0.15, 0.15, 0), Point(0, 0.15, 0), Point(0.15, 0.15, 0)],
    AreaFiber=[0.0003141592654, 0.0003141592654, 0.0003141592654, 0.0003141592654, 0.0003141592654, 0.0003141592654, 0.0003141592654, 0.0003141592654],
    Material=b450c)
beam_500_x_300_concrete = PatchAlpaca4d(Mesh=beam_500_x_300_fibres.Mesh, Material=c25_30)
beam_500_x_300_bars = FiberPointAlpaca4d(
    Point=[Point(-0.2, -0.1, 0), Point(-0.2, 0, 0), Point(-0.2, 0.1, 0), Point(0.2, -0.1, 0), Point(0.2, 0, 0), Point(0.2, 0.1, 0)],
    AreaFiber=[0.0003141592654, 0.0003141592654, 0.0003141592654, 0.0003141592654, 0.0003141592654, 0.0003141592654],
    Material=b450c)
column_400_x_400 = FiberSectionAlpaca4d(PointFiber=column_400_x_400_bars, Patch=column_400_x_400_concrete, GJ=3000)
beam_500_x_300 = FiberSectionAlpaca4d(PointFiber=beam_500_x_300_bars, Patch=beam_500_x_300_concrete, GJ=3000)
columns = ForceBeamColumnAlpaca4d(Line=irregular_building.Columns, Section=column_400_x_400, Colour=RGB(160, 168, 178), mode="ForceBeamColumn (Alpaca4d)")
beams = ForceBeamColumnAlpaca4d(Line=irregular_building.Beams, Section=beam_500_x_300, Colour=RGB(160, 168, 178), mode="ForceBeamColumn (Alpaca4d)")

# ---- group: 4 - Loads: its own weight and the floors, held; the push, growing with the height
floor_load_kn_m = Slider(20, range=0..60)
roof_drift = Slider(3, range=0.5..6)
steps = Slider(200, range=20..400)
floors_kn_m = Expression(q=floor_load_kn_m, Expression="-q")
floors = UnitZ(Factor=floors_kn_m)
floors_2 = LinearLoadAlpaca4d(BeamId=flatten(beams), Force=flatten(floors))
self_weight = GravityLoadAlpaca4d(Factor=1)
the_push_floor_by_floor = PointLoadAlpaca4d(Point=irregular_building.Floors, Force=irregular_building.Forces, Moment=Vector(0, 0, 0))
ramp = LinearTimeSeriesAlpaca4d(LinearFactor=1)  # -> TimeSeries, Graph
weight_and_floors = LoadPatternAlpaca4d(TimeSeries=ramp.TimeSeries, Loads=flatten([self_weight, floors_2]), Factor=1, mode="PlainPattern (Alpaca4d)")

# ---- group: 3 - Supports: every column built in at the ground
built_in = SupportAlpaca4d(Position=irregular_building.Feet, Tx=True, Ty=True, Tz=True, Rx=True, Ry=True, Rz=True, mode="Support Rigid (Alpaca4d)")

# ---- group: 5 - Pushover: the top storey's roof pushed to Drift % of the height along X, with P-Delta
irregular_building_2 = AssembleModelAlpaca4d(Elements=flatten([columns, beams]), Supports=flatten(built_in), LoadPatterns=flatten(weight_and_floors), Tolerance=0.01)  # -> AlpacaModel, Mass
height_m = Expression(g=ground_storey_m, h=storeys_above_m, Expression="g+2*h")
target_m = Expression(d=roof_drift, h=height_m, Expression="d/100*h")
pushover = PushoverAnalysisAlpaca4d(
    AlpacaModel=irregular_building_2.AlpacaModel,
    ControlPoint=irregular_building.Roof,
    Direction="X",
    Target=target_m,
    Steps=steps,
    LateralLoads=flatten(the_push_floor_by_floor),
    PDelta=True)  # -> AlpacaModel, Displacement, BaseShear, LoadFactor, Step, Hinges, HingePoints, YieldsAt, Log, Ductility

# ---- group: 6 - Results: the frame at a Point on the curve, drawn 2 times, its plastic hinges, and the capacity curve
irregular_building_at_rest = ModelViewAlpaca4d(AlpacaModel=irregular_building_2.AlpacaModel, Step=0, FittedLoads=True)  # -> AlpacaModel, Geometry, Info, Values, Colors
point_on_the_curve = Slider(200, range=0..400)
curve_at_x = Expression(a=bay_along_x_m, b=second_bay_along_x_m, Expression="a+b+4")
curve_origin = ConstructPoint(XCoordinate=curve_at_x, YCoordinate=0, ZCoordinate=0)
curve_size = Expression(h=height_m, Expression="h")
capacity_curve = GhPythonScript(
    Displacement=pushover.Displacement,
    BaseShear=pushover.BaseShear,
    Steps=pushover.Step,
    Point=point_on_the_curve,
    Origin=curve_origin,
    Size=curve_size)  # -> out, Curve, SoFar, Dot, Axes, TagAt, Tags, Step; inputs Displacement: list, BaseShear: list, Steps: list of Int32, Point: Int32, Origin: Point3d
# ---------- capacity_curve: Python ----------
"""The geometry of the conventional structures of Structures.py, one function a structure.

Structures.py puts one of them into a GhPython component, whose inputs are the function's arguments
and whose outputs are what it returns, in order: lines for each kind of member, the points the
structure is held at, and the widths its loads are worked out from. Every member is a straight line
between two nodes, cut wherever another member meets it, so that the elements share their nodes.

Runs in GhPython (Rhino 7 and 8) and in Rhino 8's Python 3 component alike.
"""
from __future__ import division

import math
import Rhino.Geometry as rg
from Grasshopper import DataTree
from Grasshopper.Kernel.Data import GH_Path


def P(x, y, z):
    return rg.Point3d(x, y, z)


def L(a, b):
    return rg.Line(a, b)


def pieces(a, b, n):
    """The line from a to b in n pieces."""
    n = max(1, int(n))
    return [L(a + (b - a) * (i / n), a + (b - a) * ((i + 1) / n)) for i in range(n)]


def chain(points):
    """The lines between one point and the next."""
    return [L(points[k], points[k + 1]) for k in range(len(points) - 1)]


def grid_mesh(xs, ys, z):
    """A mesh of quads over xs by ys at height z, its vertices where the lines of xs and ys cross."""
    mesh = rg.Mesh()
    for y in ys:
        for x in xs:
            mesh.Vertices.Add(P(x, y, z))
    cols = len(xs)
    for r in range(len(ys) - 1):
        for c in range(cols - 1):
            a = r * cols + c
            mesh.Faces.AddFace(a, a + 1, a + cols + 1, a + cols)
    return mesh


# ---------------------------------------------------------------- 1 - a steel hall roofed by trusses

def hall(Span, Bays, Spacing, Eaves, Depth, Panels):
    """Frames of a Pratt truss on two columns, Spacing apart, joined by purlins at the truss's top nodes.
    The columns rise to the top chord, the bottom chord meeting them at the eaves, so that each frame
    stands on pinned feet. The two end bays are braced: crosses in the roof, between the top chords,
    and in the long walls, with a strut along each wall at the eaves. PurlinWidths: the width of roof
    each purlin carries, a panel, or half of one at the eaves."""
    n = max(2, int(Panels) // 2 * 2)
    bays = max(1, int(Bays))
    dx = Span / n
    top = Eaves + Depth
    Columns, Chords, Webs, Purlins, PurlinWidths, Bracing, Struts, Feet = [], [], [], [], [], [], [], []
    for i in range(bays + 1):
        y = i * Spacing
        for x in (0.0, Span):
            Columns += [L(P(x, y, 0), P(x, y, Eaves)), L(P(x, y, Eaves), P(x, y, top))]
            Feet.append(P(x, y, 0))
        for k in range(n):
            x0, x1 = k * dx, (k + 1) * dx
            Chords += [L(P(x0, y, Eaves), P(x1, y, Eaves)), L(P(x0, y, top), P(x1, y, top))]
            # Pratt: the diagonals fall towards the middle, in tension under the roof's weight.
            if k < n // 2:
                Webs.append(L(P(x0, y, top), P(x1, y, Eaves)))
            else:
                Webs.append(L(P(x0, y, Eaves), P(x1, y, top)))
        Webs += [L(P(k * dx, y, Eaves), P(k * dx, y, top)) for k in range(1, n)]
    for i in range(bays):
        y0, y1 = i * Spacing, (i + 1) * Spacing
        for k in range(n + 1):
            Purlins.append(L(P(k * dx, y0, top), P(k * dx, y1, top)))
            PurlinWidths.append(dx / 2 if k in (0, n) else dx)
        for x in (0.0, Span):
            Struts.append(L(P(x, y0, Eaves), P(x, y1, Eaves)))
        if i in (0, bays - 1):
            for k in range(n):
                Bracing += [L(P(k * dx, y0, top), P((k + 1) * dx, y1, top)),
                            L(P((k + 1) * dx, y0, top), P(k * dx, y1, top))]
            for x in (0.0, Span):
                Bracing += [L(P(x, y0, 0), P(x, y1, Eaves)), L(P(x, y1, 0), P(x, y0, Eaves))]
    return Columns, Chords, Webs, Purlins, PurlinWidths, Bracing, Struts, Feet


# ---------------------------------------------------------------- 2 - a steel tower with a stair

def tower(Width, Levels, Storey):
    """Four legs Width apart, a landing at every level and a crossed bracing on every face of every
    storey. A straight flight of stairs climbs each storey along a strip a metre wide across the
    middle, turning back at each landing: two stringers, from one side of the landing below to the
    other side of the landing above. A landing is its four edge beams and two cross beams along the
    strip, its Strip, which the stringers start and end on. The legs on the windward side, x = 0, are
    WindwardLegs, for the wind."""
    levels = max(1, int(Levels))
    w = Width
    y1, y2 = 0.5 * w - 0.5, 0.5 * w + 0.5
    corners = [(0, 0), (w, 0), (w, w), (0, w)]
    Legs, WindwardLegs, Bracing, Landings, Strip, Stringers, Feet = [], [], [], [], [], [], []
    for x, y in corners:
        Feet.append(P(x, y, 0))
        legs = pieces(P(x, y, 0), P(x, y, levels * Storey), levels)
        (WindwardLegs if x == 0 else Legs).extend(legs)
    for j in range(levels):
        z0, z1 = j * Storey, (j + 1) * Storey
        for k in range(4):
            (ax, ay), (bx, by) = corners[k], corners[(k + 1) % 4]
            Bracing += [L(P(ax, ay, z0), P(bx, by, z1)), L(P(bx, by, z0), P(ax, ay, z1))]
        # The landing at the top of the storey: the sides along y cut where the strip meets them.
        Landings += [L(P(0, 0, z1), P(w, 0, z1)), L(P(0, w, z1), P(w, w, z1))]
        for x in (0.0, w):
            Landings += [L(P(x, 0, z1), P(x, y1, z1)), L(P(x, y1, z1), P(x, y2, z1)), L(P(x, y2, z1), P(x, w, z1))]
        Strip += [L(P(0, y1, z1), P(w, y1, z1)), L(P(0, y2, z1), P(w, y2, z1))]
        # The flight: up along +x in even storeys, back along -x in odd ones.
        a, b = (0.0, w) if j % 2 == 0 else (w, 0.0)
        Stringers += [L(P(a, y, z0), P(b, y, z1)) for y in (y1, y2)]
    # The ground has no landing beams: the first flight starts on its own footing.
    Feet += [P(0.0, y, 0) for y in (y1, y2)]
    return Legs, WindwardLegs, Bracing, Landings, Strip, Stringers, Feet


# ---------------------------------------------------------------- 3 - a canopy on T-shaped frames

def canopy(Frames, Spacing, Height, Cantilever, Rise, Purlins):
    """A row of frames, Spacing apart: a column built in at its foot and an arm cantilevering each way
    from its head, rising Rise to its tip. Purlins join the frames at the head and at Purlins points
    along each arm. A cross between two columns in the middle bay holds the row lengthways.
    LeftWidths and RightWidths: the width of roof, on plan, each purlin carries on the left (-x) and
    the right (+x) of the frames, nothing on the other side: a purlin's share, or half at a tip or the
    head."""
    frames = max(2, int(Frames))
    m = max(1, int(Purlins))
    s = Cantilever / m
    Columns, Arms, Purlins, LeftWidths, RightWidths, Bracing, Feet = [], [], [], [], [], [], []
    for i in range(frames):
        y = i * Spacing
        Columns.append(L(P(0, y, 0), P(0, y, Height)))
        Feet.append(P(0, y, 0))
        for side in (-1, 1):
            Arms += pieces(P(0, y, Height), P(side * Cantilever, y, Height + Rise), m)
    for i in range(frames - 1):
        y0, y1 = i * Spacing, (i + 1) * Spacing
        Purlins.append(L(P(0, y0, Height), P(0, y1, Height)))
        LeftWidths.append(s / 2)
        RightWidths.append(s / 2)
        for side in (-1, 1):
            for k in range(1, m + 1):
                Purlins.append(L(P(side * k * s, y0, Height + k * Rise / m), P(side * k * s, y1, Height + k * Rise / m)))
                width = s / 2 if k == m else s
                LeftWidths.append(width if side < 0 else 0.0)
                RightWidths.append(width if side > 0 else 0.0)
    middle = (frames - 1) // 2
    y0, y1 = middle * Spacing, (middle + 1) * Spacing
    Bracing += [L(P(0, y0, 0), P(0, y1, Height)), L(P(0, y1, 0), P(0, y0, Height))]
    return Columns, Arms, Purlins, LeftWidths, RightWidths, Bracing, Feet


# ---------------------------------------------------------------- 4 - a facade stiffened by vertical trusses

def facade(Bays, BayWidth, Height, Levels, Depth, TrussEvery):
    """A glass wall Height tall in the plane y = 0, held only at its foot and its top, as a lobby's is:
    mullions every BayWidth and transoms between them at Levels heights. Behind every TrussEvery-th
    mullion a vertical truss stiffens it against the wind: the mullion is its outer chord, a tube
    Depth behind it the inner chord, with a post at every transom and diagonals zig-zagging between.
    The mullions stand on their feet and are held across the wall at the top; the inner chords too,
    and along the wall at the top as well, which nothing else holds them in.
    MullionWidths: the width of wall each piece of mullion catches the wind over, a bay or half of one
    at the ends. PanelHeight: the height of glass each transom carries."""
    bays, levels, every = max(1, int(Bays)), max(2, int(Levels)), max(1, int(TrussEvery))
    dz = Height / levels
    Mullions, MullionWidths, Transoms, Chords, Posts, Diagonals = [], [], [], [], [], []
    Base, Tops, ChordBase, ChordTops = [], [], [], []
    for i in range(bays + 1):
        x = i * BayWidth
        Mullions += pieces(P(x, 0, 0), P(x, 0, Height), levels)
        MullionWidths += [BayWidth / 2 if i in (0, bays) else BayWidth] * levels
        Base.append(P(x, 0, 0))
        Tops.append(P(x, 0, Height))
        if i % every:
            continue
        Chords += pieces(P(x, Depth, 0), P(x, Depth, Height), levels)
        Posts += [L(P(x, 0, k * dz), P(x, Depth, k * dz)) for k in range(levels + 1)]
        for k in range(levels):
            z0, z1 = k * dz, (k + 1) * dz
            Diagonals.append(L(P(x, 0, z0), P(x, Depth, z1)) if k % 2 == 0 else L(P(x, Depth, z0), P(x, 0, z1)))
        ChordBase.append(P(x, Depth, 0))
        ChordTops.append(P(x, Depth, Height))
    for k in range(1, levels):
        Transoms += [L(P(i * BayWidth, 0, k * dz), P((i + 1) * BayWidth, 0, k * dz)) for i in range(bays)]
    PanelHeight = dz
    return Mullions, MullionWidths, Transoms, Chords, Posts, Diagonals, Base, Tops, ChordBase, ChordTops, PanelHeight


# ---------------------------------------------------------------- 5 - a barrel vault under wind

def vault(Span, Rise, Length, Strips, Divisions, Windward, Crown, Leeward):
    """A barrel vault spanning Span across x, Rise high, Length long along y: the arc of a circle
    through its two feet and its crown, cut into Strips strips along its length, each a mesh of quads
    Divisions long. A strip's faces all face the same way, so one pressure on a strip acts along one
    direction. The pressure coefficients of the windward quarter, the middle half and the leeward
    quarter, wind blowing along +x, are given to each strip by where its middle is, with the strip's
    outward Normal: a positive coefficient pushes on the vault, along -Normal, a negative one pulls it
    away. The feet are held along both long edges."""
    strips, divisions = max(4, int(Strips)), max(1, int(Divisions))
    r = (0.25 * Span * Span + Rise * Rise) / (2 * Rise)
    zc = Rise - r
    # Half the angle the arc spans, from the crown to a foot: past 90 degrees for more than a semicircle.
    half = math.atan2(0.5 * Span, r - Rise)

    def at(t, y):
        a = -half + 2 * half * t
        return P(0.5 * Span + r * math.sin(a), y, zc + r * math.cos(a))

    Strip, Names, Coefficients, Normals, Feet = [], [], [], [], []
    for s in range(strips):
        mesh = rg.Mesh()
        for k in range(divisions + 1):
            y = Length * k / divisions
            mesh.Vertices.Add(at(s / strips, y))
            mesh.Vertices.Add(at((s + 1) / strips, y))
        for k in range(divisions):
            mesh.Faces.AddFace(2 * k, 2 * k + 1, 2 * k + 3, 2 * k + 2)
        mesh.Normals.ComputeNormals()
        Strip.append(mesh)
        Names.append("Strip_{0}".format(s))
        middle = (s + 0.5) / strips
        Coefficients.append(Windward if middle < 0.25 else Leeward if middle > 0.75 else Crown)
        a = -half + 2 * half * middle
        Normals.append(rg.Vector3d(math.sin(a), 0, math.cos(a)))
    for k in range(divisions + 1):
        y = Length * k / divisions
        Feet += [at(0, y), at(1, y)]
    return Strip, Names, Coefficients, Normals, Feet


# ---------------------------------------------------------------- 6 - a facade held by wind trusses

def windtruss(Width, Height, Spacing, Depth, Trusses):
    """A tall glass facade Width wide and Height high in the plane y = 0, its mullions Spacing apart
    standing on their feet and held across the facade at the top, and at Trusses levels between by
    horizontal trusses behind it. Each truss spans the whole width between the building's columns at
    its two ends: its outer chord runs through the mullions, its inner chord Depth behind, with a
    post at every mullion and diagonals between, falling towards the middle. MullionWidths: the width
    of facade each piece of mullion catches the wind over, its spacing or half of it at the ends."""
    n = max(2, int(round(Width / Spacing)))
    s = Width / n
    trusses = max(1, int(Trusses))
    levels = [Height * (k + 1) / (trusses + 1) for k in range(trusses)]
    heights = [0.0] + levels + [Height]
    Mullions, MullionWidths, Chords, Posts, Diagonals, Base, Tops, TrussEnds = [], [], [], [], [], [], [], []
    for i in range(n + 1):
        x = i * s
        Mullions += [L(P(x, 0, heights[k]), P(x, 0, heights[k + 1])) for k in range(len(heights) - 1)]
        MullionWidths += [s / 2 if i in (0, n) else s] * (len(heights) - 1)
        Base.append(P(x, 0, 0))
        Tops.append(P(x, 0, Height))
    for z in levels:
        for i in range(n):
            x0, x1 = i * s, (i + 1) * s
            Chords += [L(P(x0, 0, z), P(x1, 0, z)), L(P(x0, Depth, z), P(x1, Depth, z))]
            if i < n // 2:
                Diagonals.append(L(P(x0, Depth, z), P(x1, 0, z)))
            else:
                Diagonals.append(L(P(x0, 0, z), P(x1, Depth, z)))
        Posts += [L(P(i * s, 0, z), P(i * s, Depth, z)) for i in range(n + 1)]
        TrussEnds += [P(0, 0, z), P(0, Depth, z), P(Width, 0, z), P(Width, Depth, z)]
    return Mullions, MullionWidths, Chords, Posts, Diagonals, Base, Tops, TrussEnds


# ---------------------------------------------------------------- 7 - a girder bridge on piers

def girder(SideSpan, MainSpan, PierHeight, Segment):
    """A continuous concrete deck over three spans - SideSpan, MainSpan, SideSpan - on two piers
    PierHeight tall. The deck is a slab 12 m wide on two girders 6 m apart, joined by a cross girder
    every other Segment; each pier is two round columns, one under each girder, braced by a strut
    halfway up and joined on top by a deeper cross girder, its cap. The deck is built into the piers
    and slides along on bearings at its two ends, held there across. Watch: the deck in the middle
    of the main span, whose movement the pictures plot."""
    H, g, w = PierHeight, 3.0, 6.0
    length = 2 * SideSpan + MainSpan
    piers = (SideSpan, SideSpan + MainSpan)
    xs = [0.0]
    for a, b in [(0.0, SideSpan), (SideSpan, SideSpan + MainSpan), (SideSpan + MainSpan, length)]:
        n = max(1, int(round((b - a) / Segment)))
        xs += [a + (b - a) * (i + 1) / n for i in range(n)]
    ys = [-w, -g, 0.0, g, w]
    Girders = []
    for y in (-g, g):
        Girders += chain([P(x, y, H) for x in xs])
    Slab = [grid_mesh(xs, ys, H)]
    CrossGirders, PierCaps = [], []
    for k, x in enumerate(xs):
        across = chain([P(x, y, H) for y in (-g, 0.0, g)])
        if any(abs(x - p) < 1e-6 for p in piers):
            PierCaps += across
        elif k % 2 == 0 or k == len(xs) - 1:
            CrossGirders += across
    Columns, Struts, Feet = [], [], []
    for x in piers:
        for y in (-g, g):
            Columns += pieces(P(x, y, 0), P(x, y, 0.5 * H), 3) + pieces(P(x, y, 0.5 * H), P(x, y, H), 3)
            Feet.append(P(x, y, 0))
        Struts += chain([P(x, y, 0.5 * H) for y in (-g, 0.0, g)])
    Bearings = [P(x, y, H) for x in (0.0, length) for y in (-g, g)]
    Watch = [P(0.5 * length, 0, H)]
    return Girders, CrossGirders, PierCaps, Columns, Struts, Slab, Feet, Bearings, Watch


# ---------------------------------------------------------------- 8 - a cable-stayed bridge

def cablestayed(Span, DeckHeight, PylonHeight, Width, Stays):
    """Two spans of Span each side of an H-shaped pylon: two legs Width apart, from the ground to
    PylonHeight above the deck, joined at the top. The deck is two edge girders joined by floor beams
    wherever a stay holds them, Stays a side in each span, the stays in two planes, fanning from the
    top quarter of each leg. The girders are built into the legs, and slide along their abutments.
    Watch: the deck in the middle of a span, and the top of the pylon."""
    n = max(2, int(Stays))
    w = 0.5 * Width
    top = DeckHeight + PylonHeight
    spacing = Span / (n + 1)
    xs = [-Span + k * spacing for k in range(2 * n + 3)]
    Girders, FloorBeams, Legs, CrossBeams, Cables, Feet, Bearings = [], [], [], [], [], [], []
    for y in (-w, w):
        Girders += [L(P(xs[k], y, DeckHeight), P(xs[k + 1], y, DeckHeight)) for k in range(len(xs) - 1)]
        Legs += pieces(P(0, y, 0), P(0, y, DeckHeight), 4)
        anchors = [DeckHeight + PylonHeight * (0.75 + 0.25 * j / (n - 1)) for j in range(n)]
        levels = [DeckHeight] + sorted(set(anchors))
        Legs += [L(P(0, y, levels[k]), P(0, y, levels[k + 1])) for k in range(len(levels) - 1)]
        Feet.append(P(0, y, 0))
        for side in (-1, 1):
            for j in range(n):
                # The outermost stay from the highest anchor, the innermost from the lowest.
                x = side * spacing * (j + 1)
                Cables.append(L(P(0, y, anchors[j]), P(x, y, DeckHeight)))
        Bearings += [P(-Span, y, DeckHeight), P(Span, y, DeckHeight)]
    FloorBeams += [L(P(x, -w, DeckHeight), P(x, w, DeckHeight)) for x in xs]
    CrossBeams += [L(P(0, -w, top), P(0, w, top))]
    Watch = [P(0.5 * Span, 0, DeckHeight), P(0, -w, top)]
    return Girders, FloorBeams, Legs, CrossBeams, Cables, Feet, Bearings, Watch


# ---------------------------------------------------------------- 9 - a deck arch bridge

def arch(Span, Rise, Columns, DeckAbove):
    """Two concrete arch ribs Span across and Rise high, parabolas springing from the ground 12 m
    apart and leaning in to 7 m apart at the crown, braced by a strut at every column. They carry a
    deck DeckAbove the crown on Columns pairs of spandrel columns, evenly spaced, built into both: a
    slab 11 m wide on two girders, joined by a floor beam on every pair of columns. The deck runs on
    to the abutments at its two ends, where it slides along, held across; the ribs are built in at
    their springings. Watch: the deck at the crown."""
    n = max(2, int(Columns))
    deck = Rise + DeckAbove
    spring, crown, g, w = 6.0, 3.5, 4.0, 5.5
    zs = lambda x: 4.0 * Rise * x * (Span - x) / (Span * Span)
    bs = lambda x: spring - (spring - crown) * zs(x) / Rise
    xs = [Span * k / (n + 1) for k in range(n + 2)]
    # The ribs and the deck, cut at every column and halfway between.
    ts = sorted(set([x for x in xs] + [0.5 * (xs[k] + xs[k + 1]) for k in range(len(xs) - 1)]))
    Ribs, Girders, SpandrelColumns = [], [], []
    for side in (-1, 1):
        Ribs += chain([P(t, side * bs(t), zs(t)) for t in ts])
        Girders += chain([P(t, side * g, deck) for t in ts])
        SpandrelColumns += [L(P(x, side * bs(x), zs(x)), P(x, side * g, deck)) for x in xs[1:-1]]
    Struts = [L(P(x, -bs(x), zs(x)), P(x, bs(x), zs(x))) for x in xs[1:-1]]
    FloorBeams = []
    for x in xs:
        FloorBeams += chain([P(x, y, deck) for y in (-g, 0.0, g)])
    Slab = [grid_mesh(ts, [-w, -g, 0.0, g, w], deck)]
    Springings = [P(x, y, 0) for x in (0.0, Span) for y in (-spring, spring)]
    Abutments = [P(x, y, deck) for x in (0.0, Span) for y in (-g, g)]
    Watch = [P(0.5 * Span, 0, deck)]
    return Ribs, Struts, Girders, FloorBeams, SpandrelColumns, Slab, Springings, Abutments, Watch


# ---------------------------------------------------------------- 10 - a building, and a tiny city of them

def _building(x0, y0, bay, height, floors, balconies=False, depth=1.5, split=1):
    """A steel frame on a grid of bay, x0, y0 its first corner: floors, from the first up, are the
    cells (i, j) each floor covers, every one inside the one under it, so that a column stands
    under every corner of a floor. Each floor has beams round its cells, cut split times a bay, and
    a slab mesh of quads on the beams' nodes; balconies: on every floor with the same floor over it,
    a slab depth deep along the south faces, on cantilevers at the columns and an edge beam."""
    Columns, Beams, Slabs, Feet = [], [], [], []
    n = max(1, int(split))
    pt = lambda i, j, k: P(x0 + i * bay, y0 + j * bay, k * height)
    corners = lambda cells: sorted(set((i + a, j + b) for (i, j) in cells for a in (0, 1) for b in (0, 1)))
    edges = lambda cells: sorted(set(e for (i, j) in cells for e in
                                     [((i, j), (i + 1, j)), ((i, j + 1), (i + 1, j + 1)), ((i, j), (i, j + 1)), ((i + 1, j), (i + 1, j + 1))]))
    Feet += [pt(i, j, 0) for (i, j) in corners(floors[0])]
    for k, cells in enumerate(floors, 1):
        Columns += [L(pt(i, j, k - 1), pt(i, j, k)) for (i, j) in corners(cells)]
        for a, b in edges(cells):
            Beams += pieces(pt(a[0], a[1], k), pt(b[0], b[1], k), n)
        mesh, at = rg.Mesh(), {}

        def v(point):
            key = (round(point.X, 6), round(point.Y, 6))
            if key not in at:
                at[key] = mesh.Vertices.Count
                mesh.Vertices.Add(point)
            return at[key]

        for (i, j) in sorted(cells):
            for a in range(n):
                for b in range(n):
                    q = [pt(i + (a + da) / n, j + (b + db) / n, k) for da, db in ((0, 0), (1, 0), (1, 1), (0, 1))]
                    mesh.Faces.AddFace(*[v(p) for p in q])
        if balconies and k < len(floors) and floors[k] == cells:
            out = rg.Vector3d(0, -depth, 0)
            south = [(i, j) for (i, j) in sorted(cells) if (i, j - 1) not in cells]
            for (i, j) in sorted(set(c for (i, j) in south for c in ((i, j), (i + 1, j)))):
                Beams.append(L(pt(i, j, k), pt(i, j, k) + out))
            for (i, j) in south:
                for a in range(n):
                    p, q = pt(i + a / n, j, k), pt(i + (a + 1) / n, j, k)
                    Beams.append(L(p + out, q + out))
                    mesh.Faces.AddFace(v(p + out), v(q + out), v(q), v(p))
        Slabs.append(mesh)
    return Columns, Beams, Slabs, Feet


def building(BaysX, BaysY, Bay, Storeys, StoreyHeight):
    """An office building: a steel frame BaysX by BaysY bays of Bay, Storeys storeys of StoreyHeight,
    columns built in at the ground, and a concrete slab at every floor on the beams, meshed twice a
    bay. Its mass is its members' and its slabs' own. Watch: a corner of the roof."""
    cells = _rect(max(1, int(BaysX)), max(1, int(BaysY)))
    storeys = max(1, int(Storeys))
    Columns, Beams, Slabs, Feet = _building(0.0, 0.0, Bay, StoreyHeight, [cells] * storeys, split=2)
    Watch = [P(0, 0, storeys * StoreyHeight)]
    return Columns, Beams, Slabs, Feet, Watch


def _rect(a, b):
    """The cells of a rectangle a bays by b."""
    return frozenset((i, j) for i in range(a) for j in range(b))


def _ell(a, b):
    """An L: the rectangle a by b without its far corner."""
    return _rect(a, b) - frozenset([(a - 1, b - 1)])


# The buildings of the city, row by row, low next to tall as a city grows: the footprint of each, in
# bays, its storeys, what tops it - a smaller footprint for its last few storeys - what it stands on
# - a wider one for its first few - and whether its south face has balconies.
CITY = [
    (_rect(3, 2), 2, None, None, False),
    (_ell(2, 2), 9, None, None, True),
    (_rect(2, 2), 4, (_rect(1, 1), 1), None, False),
    (_rect(2, 1), 16, None, None, True),
    (_ell(3, 2), 6, None, None, False),
    (_rect(2, 2), 12, None, None, True),
    (_rect(3, 1), 3, None, None, False),
    (_rect(2, 2), 20, (_rect(1, 1), 2), (_rect(3, 3), 2), False),
    (_rect(1, 2), 14, None, None, True),
    (_rect(2, 1), 5, (_rect(1, 1), 1), None, False),
    (_ell(2, 2), 10, (_rect(1, 1), 2), None, False),
    (_rect(2, 2), 2, None, None, False),
    (_rect(3, 1), 7, None, None, True),
    (_rect(2, 1), 18, None, (_rect(3, 2), 3), False),
    (_ell(2, 2), 3, None, None, False),
    (_rect(2, 2), 11, (_rect(2, 1), 2), None, True),
]


def city(Rows, ColumnsPerRow, Street, Bay, StoreyHeight):
    """A tiny city: Rows by ColumnsPerRow buildings of CITY, steel frames on a grid of Bay with a
    slab at every floor, Street between their plots of three bays square. Rectangles, Ls, towers
    on podiums and with penthouses, some with balconies: on the same ground each shakes in its own
    way, a low one stiff and quick, a tall one slow and soft, an L or a tower off its podium's
    middle twisting as it sways. Watch: a corner of each building's roof; Storeys: how many it has."""
    Columns, Beams, Slabs, Feet, Watch, Storeys = [], [], [], [], [], []
    rows, cols = max(1, int(Rows)), max(1, int(ColumnsPerRow))
    plot = 3 * Bay + Street
    for r in range(rows):
        for c in range(cols):
            cells, storeys, top, podium, balconies = CITY[(r * cols + c) % len(CITY)]
            low, high = podium[1] if podium else 0, top[1] if top else 0
            floors = ([podium[0]] * low if podium else []) + [cells] * (storeys - low - high) + \
                ([top[0]] * high if top else [])
            parts = _building(c * plot, r * plot, Bay, StoreyHeight, floors, balconies)
            Columns += parts[0]
            Beams += parts[1]
            Slabs += parts[2]
            Feet += parts[3]
            i, j = min(floors[-1])
            Watch.append(P(c * plot + i * Bay, r * plot + j * Bay, storeys * StoreyHeight))
            Storeys.append(storeys)
    return Columns, Beams, Slabs, Feet, Watch, Storeys


# ---------------------------------------------------------------- 12 - a footbridge's natural modes

def footbridge(Span, Width, Segment, Depth):
    """A footbridge of one span, Span long: a concrete deck Width wide and 200 mm thick on a steel box
    girder Depth deep down its middle, cut every Segment or so. The deck is meshed in quads, one
    across each half, its middle plane at Z = 0; the box's axis is under it, its top against the
    deck's underside, and each of its nodes is tied to the deck's node above by a rigid link, so that
    the two bend together. The box is held at both ends: a pinned bearing at the start, one sliding
    along at the far end. Box: its lines; Deck: the deck's mesh; Under and Over: each link's two
    nodes, the box's and the deck's; Pinned and Sliding: the box's two ends."""
    n = max(2, int(round(Span / Segment)))
    xs = [Span * i / n for i in range(n + 1)]
    z = -(0.1 + 0.5 * Depth)
    Box = chain([P(x, 0, z) for x in xs])
    Deck = [grid_mesh(xs, [-0.5 * Width, 0.0, 0.5 * Width], 0.0)]
    Under = [P(x, 0, z) for x in xs]
    Over = [P(x, 0, 0) for x in xs]
    return Box, Deck, Under, Over, [Under[0]], [Under[-1]]


# ---------------------------------------------------------------- 13 - sticks that draw a response spectrum

def sticks(Sticks, Shortest, Tallest, Spacing):
    """A row of Sticks steel sticks along x, Spacing apart, from Shortest to Tallest: each a
    cantilever from the ground to a mass at its top, an oscillator of one degree of freedom along
    the shaking. A cantilever's period goes as its height to the power 1.5, so their heights are
    spread for their periods to be spread evenly: along the row, x reads as the period axis of a
    response spectrum. Each stick is a model of its own, a branch of the trees: Lines, one line;
    Feet, where it is held; Tops, where its mass sits."""
    n = max(2, int(Sticks))
    low, high = Shortest ** 1.5, Tallest ** 1.5
    Lines, Feet, Tops = DataTree[object](), DataTree[object](), DataTree[object]()
    for i in range(n):
        h = (low + (high - low) * i / (n - 1)) ** (2.0 / 3.0)
        foot, top = P(i * Spacing, 0, 0), P(i * Spacing, 0, h)
        path = GH_Path(i)
        Lines.Add(L(foot, top), path)
        Feet.Add(foot, path)
        Tops.Add(top, path)
    return Lines, Feet, Tops


# How tall the spectrum stands behind the sticks: metres to 1 g of pseudo-acceleration.
SPECTRUM_SCALE = 8.0
# How far behind the sticks it stands, m.
SPECTRUM_BEHIND = 3.0


def spectrum(Periods, Displacements, Tops):
    """The response spectrum the sticks draw. Periods: each stick's, a branch each, from its Natural
    Vibration Analysis; Displacements: the sticks' displacements at every step of their
    transient analyses, from Nodal Displacements with History on, a branch a step. Sd is
    the most its top moved from the ground at any step, along x, in mm; PSa, its pseudo-acceleration, Sd times
    (2 pi / T) squared, in g. Spectrum and Grid draw them as a chart standing behind the sticks, its
    period axis along the row and its PSa SPECTRUM_SCALE m to the g: a line through each stick's
    PSa, and lines at every 0.25 g."""
    periods = [max(Periods.Branch(p)) for p in Periods.Paths if Periods.Branch(p).Count]
    n = len(periods)
    # Nodal Displacements gives a branch a step, every stick's nodes in it one after another, in the
    # order of the sticks; each stick's top moves the most.
    peaks = [0.0] * n
    for path in Displacements.Paths:
        moves = list(Displacements.Branch(path))
        each = len(moves) // n if n else 0
        for i in range(n if each else 0):
            peaks[i] = max([peaks[i]] + [abs(v.X) for v in moves[i * each:(i + 1) * each]])
    Period, Sd, PSa = [], [], []
    for T, peak in zip(periods, peaks):
        Period.append(T)
        Sd.append(1000.0 * peak)
        PSa.append((2 * math.pi / T) ** 2 * peak / 9.81)
    xs = [Tops.Branch(p)[0].X for p in Tops.Paths][:len(PSa)]
    y = SPECTRUM_BEHIND
    Spectrum = rg.Polyline([P(x, y, a * SPECTRUM_SCALE) for x, a in zip(xs, PSa)]).ToNurbsCurve()
    Grid = []
    if xs:
        for k in range(int(math.ceil(max(PSa) / 0.25)) + 1):
            z = 0.25 * k * SPECTRUM_SCALE
            Grid.append(L(P(xs[0], y, z), P(xs[-1], y, z)))
    return Period, Sd, PSa, Spectrum, Grid


# ---------------------------------------------------------------- 14 - a shell form-found to work in compression

# The plan of the shell, a cross of four legs 20 m from end to end, in 16 quads round its middle: the
# coarse net Kangaroo refines and pushes up. Its corners, from the middle out, x and y in m.
SHELL_QUADS = [
    ((-9.925, -1.207), (-9.925, 0.0), (-4.521, 0.0), (-5.356, -2.616)),
    ((-5.356, -2.616), (-4.521, 0.0), (0.0, -5.0), (-2.544, -5.451)),
    ((-2.544, -5.451), (0.0, -5.0), (0.0, -10.0), (-1.132, -10.0)),
    ((-4.521, 0.0), (-2.0, 0.0), (0.0, -2.0), (0.0, -5.0)),
]


def compressed_shell(Span):
    """A shell's net before it is form-found: a cross of four legs, Span from the end of one to the end
    of the one opposite, as one mesh of 16 quads, a quarter of them mirrored three ways. Ends: the
    straight edge at the end of each leg, where the shell stands."""
    k = Span / 20.0
    mesh, at = rg.Mesh(), {}

    def v(x, y):
        key = (round(x, 6), round(y, 6))
        if key not in at:
            at[key] = mesh.Vertices.Count
            mesh.Vertices.Add(P(k * x, k * y, 0.0))
        return at[key]

    for sx, sy in ((1, 1), (-1, 1), (1, -1), (-1, -1)):
        for quad in SHELL_QUADS:
            corners = [v(sx * x, sy * y) for x, y in quad]
            if sx * sy < 0:
                corners.reverse()
            mesh.Faces.AddFace(*corners)
    mesh.Normals.ComputeNormals()
    Ends = [L(P(-9.925 * k, -1.207 * k, 0), P(-9.925 * k, 1.207 * k, 0)),
            L(P(9.925 * k, -1.207 * k, 0), P(9.925 * k, 1.207 * k, 0)),
            L(P(-1.132 * k, -10 * k, 0), P(1.132 * k, -10 * k, 0)),
            L(P(-1.132 * k, 10 * k, 0), P(1.132 * k, 10 * k, 0))]
    return [mesh], Ends


# ---------------------------------------------------------------- the ground motion

# El Centro, 18 May 1940, the north-south component recorded at the Imperial Valley Irrigation District
# substation: a ground acceleration every 0.02 s, in g - the version OpenSees's examples use.
EL_CENTRO_DT = 0.02
EL_CENTRO = [
    0.00630, 0.00364, 0.00099, 0.00428, 0.00758, 0.01087, 0.00682, 0.00277, -0.00128, 0.00368,
    0.00864, 0.01360, 0.00727, 0.00094, 0.00420, 0.00221, 0.00021, 0.00444, 0.00867, 0.01290,
    0.01713, -0.00343, -0.02400, -0.00992, 0.00416, 0.00528, 0.01653, 0.02779, 0.03904, 0.02449,
    0.00995, 0.00961, 0.00926, 0.00892, -0.00486, -0.01864, -0.03242, -0.03365, -0.05723, -0.04534,
    -0.03346, -0.03201, -0.03056, -0.02911, -0.02766, -0.04116, -0.05466, -0.06816, -0.08166, -0.06846,
    -0.05527, -0.04208, -0.04259, -0.04311, -0.02428, -0.00545, 0.01338, 0.03221, 0.05104, 0.06987,
    0.08870, 0.04524, 0.00179, -0.04167, -0.08513, -0.12858, -0.17204, -0.12908, -0.08613, -0.08902,
    -0.09192, -0.09482, -0.09324, -0.09166, -0.09478, -0.09789, -0.12902, -0.07652, -0.02401, 0.02849,
    0.08099, 0.13350, 0.18600, 0.23850, 0.21993, 0.20135, 0.18277, 0.16420, 0.14562, 0.16143,
    0.17725, 0.13215, 0.08705, 0.04196, -0.00314, -0.04824, -0.09334, -0.13843, -0.18353, -0.22863,
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]


def elcentro(Duration, Scale):
    """The El Centro record's first Duration seconds, its accelerations times Scale, in m/s2: the
    Times and the Accelerations a Path Time Series takes, and how many steps of 0.02 s they make.
    Its peak, 0.32 g, comes 2.02 s in."""
    n = min(len(EL_CENTRO), int(round(Duration / EL_CENTRO_DT)) + 1)
    Times = [k * EL_CENTRO_DT for k in range(n)]
    Accelerations = [9.81 * Scale * a for a in EL_CENTRO[:n]]
    Steps = n - 1
    return Times, Accelerations, Steps


# ---------------------------------------------------------------- 15 - a tank's first hundred modes

def tank(Radius, Height, Around, Up, Modes, Columns, Spacing):
    """A cylindrical tank, Radius and Height, open at the top: a mesh of quads, Around round it and Up
    up it, standing on Z = 0, and the nodes of its base, where it is built in. Grid: one move a mode,
    Modes of them, Columns to a row, Spacing apart, that set each mode's copy of the tank in its place
    of a grid, the first at the back left, reading as a page does."""
    around, up = max(3, int(Around)), max(1, int(Up))
    mesh = rg.Mesh()
    for j in range(up + 1):
        for i in range(around):
            a = 2 * math.pi * i / around
            mesh.Vertices.Add(P(Radius * math.cos(a), Radius * math.sin(a), Height * j / up))
    for j in range(up):
        for i in range(around):
            k, n = j * around, (i + 1) % around
            mesh.Faces.AddFace(k + i, k + n, k + around + n, k + around + i)
    mesh.Normals.ComputeNormals()
    Base = [P(Radius * math.cos(2 * math.pi * i / around), Radius * math.sin(2 * math.pi * i / around), 0)
            for i in range(around)]
    columns = max(1, int(Columns))
    Grid = [rg.Vector3d(Spacing * (k % columns), -Spacing * (k // columns), 0) for k in range(max(1, int(Modes)))]
    return [mesh], Base, Grid


def mode_labels(Frequencies, Grid, Radius, Height):
    """A label over each mode's tank in the grid, its number and its frequency, from the tank's left
    edge, leaning back half way to lying flat, so that it reads from in front and from above, for
    Text Tag 3D."""
    Places, Texts = [], []
    for k, move in enumerate(Grid):
        if k >= len(Frequencies):
            break
        Places.append(rg.Plane(P(move.X - Radius, move.Y, Height + 1.0), rg.Vector3d.XAxis, rg.Vector3d(0, 1, 1)))
        Texts.append("{0}: {1:.1f} Hz".format(k + 1, Frequencies[k]))
    return Places, Texts


# ---------------------------------------------------------------- 16 - buildings that are not straight

def _key(p):
    return (round(p.X, 4), round(p.Y, 4), round(p.Z, 4))


class _Once(object):
    """Lines and points kept once each, however often they are drawn: round a ring, the last bay's
    far end is the first bay's near one."""

    def __init__(self):
        self.lines, self.points = set(), set()

    def line(self, into, a, b):
        k = frozenset([_key(a), _key(b)])
        if k not in self.lines and _key(a) != _key(b):
            self.lines.add(k)
            into.append(L(a, b))

    def point(self, into, p):
        if _key(p) not in self.points:
            self.points.add(_key(p))
            into.append(p)


def _unique(lines):
    """lines without the ones drawn twice, either way round."""
    kept, once = [], _Once()
    for line in lines:
        once.line(kept, line.From, line.To)
    return kept


def _mapped(floors, place, split):
    """A frame on a grid of cells, as _building, but with each point of the grid put where
    place(u, v, k) says on floor k, u and v the grid's coordinates: a building that twists, leans,
    curves or goes round as its floors go up. floors, from the first up, are the cells (i, j) each
    covers. Columns at every corner of a floor's cells, from the floor under it; beams round every
    cell, cut split times, following the grid's curves; a slab mesh of quads on the beams' nodes."""
    Columns, Beams, Slabs, Feet = [], [], [], []
    once = _Once()
    n = max(1, int(split))
    corners = lambda cells: sorted(set((i + a, j + b) for (i, j) in cells for a in (0, 1) for b in (0, 1)))
    edges = lambda cells: sorted(set(e for (i, j) in cells for e in
                                     [((i, j), (i + 1, j)), ((i, j + 1), (i + 1, j + 1)), ((i, j), (i, j + 1)), ((i + 1, j), (i + 1, j + 1))]))
    for (i, j) in corners(floors[0]):
        once.point(Feet, place(i, j, 0))
    for k, cells in enumerate(floors, 1):
        for (i, j) in corners(cells):
            once.line(Columns, place(i, j, k - 1), place(i, j, k))
        for a, b in edges(cells):
            for t in range(n):
                p = place(a[0] + (b[0] - a[0]) * t / n, a[1] + (b[1] - a[1]) * t / n, k)
                q = place(a[0] + (b[0] - a[0]) * (t + 1) / n, a[1] + (b[1] - a[1]) * (t + 1) / n, k)
                once.line(Beams, p, q)
        mesh, at = rg.Mesh(), {}

        def v(point):
            if _key(point) not in at:
                at[_key(point)] = mesh.Vertices.Count
                mesh.Vertices.Add(point)
            return at[_key(point)]

        for (i, j) in sorted(cells):
            for a in range(n):
                for b in range(n):
                    q = [place(i + (a + da) / n, j + (b + db) / n, k) for da, db in ((0, 0), (1, 0), (1, 1), (0, 1))]
                    mesh.Faces.AddFace(*[v(p) for p in q])
        mesh.Normals.ComputeNormals()
        Slabs.append(mesh)
    return Columns, Beams, Slabs, Feet


def twisting(Bays, Bay, Storeys, StoreyHeight, Twist):
    """A square tower Bays by Bays bays of Bay, each floor turned a little more than the one under it,
    Twist degrees in all from the ground to the roof: its columns lean round it from floor to floor,
    a concrete frame with a slab at every floor, meshed twice a bay. Watch: a corner of its roof."""
    b, s = max(1, int(Bays)), max(1, int(Storeys))

    def place(u, v, k):
        a = math.radians(Twist) * k / s
        x, y = (u - b / 2.0) * Bay, (v - b / 2.0) * Bay
        return P(x * math.cos(a) - y * math.sin(a), x * math.sin(a) + y * math.cos(a), k * StoreyHeight)

    Columns, Beams, Slabs, Feet = _mapped([_rect(b, b)] * s, place, 2)
    return Columns, Beams, Slabs, Feet, [place(0, 0, s)]


def leaning(BaysX, BaysY, Bay, Storeys, EastStoreys, StoreyHeight, Lean, Gap):
    """Two towers leaning towards each other over a street, Lean degrees off the vertical, their feet
    Gap apart across x: the west one Storeys tall, the east one EastStoreys, so that they sway out of
    step. Each BaysX by BaysY bays of Bay, a steel frame with a slab at every floor, meshed twice a
    bay, every floor moved over the one under it by the storey's height times the tangent of Lean.
    Watch: the top of each one's leaning face."""
    bx, by = max(1, int(BaysX)), max(1, int(BaysY))
    run = StoreyHeight * math.tan(math.radians(Lean))
    Columns, Beams, Slabs, Feet, Watch = [], [], [], [], []
    for side, storeys in ((-1, max(1, int(Storeys))), (1, max(1, int(EastStoreys)))):
        # The west tower leans east, the east one west: each one's inner face is at u = bx.
        def place(u, v, k, side=side):
            x = Gap / 2.0 + (bx - u) * Bay - k * run
            return P(side * x, (v - by / 2.0) * Bay, k * StoreyHeight)
        parts = _mapped([_rect(bx, by)] * storeys, place, 2)
        Columns += parts[0]
        Beams += parts[1]
        Slabs += parts[2]
        Feet += parts[3]
        Watch.append(place(bx, 0, storeys))
    return Columns, Beams, Slabs, Feet, Watch


def curving(Around, Radius, Core, Storeys, StoreyHeight, Bend):
    """A round tower whose floors move out along x and back as they go up, Bend at half its height:
    rings of columns at Core, half way and Radius, Around of each, a steel frame with ring and radial
    beams and a slab round the core at every floor. Watch: the roof's edge, on the side it bends to."""
    n, s = max(3, int(Around)), max(1, int(Storeys))
    height = s * StoreyHeight

    def place(u, v, k):
        a = 2 * math.pi * u / n
        r = Core + (Radius - Core) * v / 2.0
        z = k * StoreyHeight
        return P(Bend * math.sin(math.pi * z / height) + r * math.cos(a), r * math.sin(a), z)

    cells = frozenset((i, j) for i in range(n) for j in range(2))
    Columns, Beams, Slabs, Feet = _mapped([cells] * s, place, 1)
    return Columns, Beams, Slabs, Feet, [place(0, 2, s)]


def crescent(Bays, Depth, Bay, Radius, Sweep, Storeys, StoreyHeight):
    """A block curved in plan, Sweep degrees of a ring Radius across its inner face: Bays along it,
    Depth bays of Bay deep, a concrete frame with a slab at every floor, meshed twice a bay. Its
    middle is on the y axis, so that shaking along x twists it. Watch: a tip of its roof."""
    b, d, s = max(1, int(Bays)), max(1, int(Depth)), max(1, int(Storeys))

    def place(u, v, k):
        a = math.radians(Sweep) * (u / b - 0.5)
        r = Radius + v * Bay
        return P(r * math.sin(a), r * math.cos(a) - Radius, k * StoreyHeight)

    Columns, Beams, Slabs, Feet = _mapped([_rect(b, d)] * s, place, 2)
    return Columns, Beams, Slabs, Feet, [place(0, d, s)]


# ---------------------------------------------------------------- 17 - towers of a hundred storeys

def _floors(levels, masters, load, areas):
    """The trees a Rigid Diaphragm takes, a branch a floor - its nodes, and the one it is driven from -
    and the Mass Points that give each floor its mass, load kg/m2 of its area shared between its
    nodes."""
    Floors, Masters = DataTree[object](), DataTree[object]()
    MassPoints, Masses = [], []
    for k, (points, master, area) in enumerate(zip(levels, masters, areas)):
        Floors.AddRange(points, GH_Path(k))
        Masters.Add(master, GH_Path(k))
        m = load * area / len(points)
        for p in points:
            MassPoints.append(p)
            Masses.append(rg.Vector3d(m, m, m))
    return Floors, Masters, MassPoints, Masses


# Where each of the nine tubes stops, out of 108 storeys: (column, row) from the south-west, x east,
# y north. Two stop at the 50th floor, two at the 66th, three at the 90th; two go to the top.
BUNDLED_TOPS = {(0, 2): 50, (2, 0): 50, (0, 0): 66, (2, 2): 66, (1, 2): 90, (2, 1): 90, (1, 0): 90,
                (0, 1): 108, (1, 1): 108}
BUNDLED_BELTS = (29, 64, 88)


def bundled(Tube, Bays, Storeys, StoreyHeight, FloorMass):
    """A bundled tube, after the Willis Tower in Chicago: nine square tubes of Tube, three by three,
    each wall a frame of columns Bays to a side tied by deep spandrels, bundled up to the 50th floor
    and stopping at the 50th, 66th, 90th and the top of 108, as BUNDLED_TOPS, scaled to Storeys. Belt
    trusses, crossed braces in every bay of the walls, over two storeys at three floors. The floors are
    rigid diaphragms, FloorMass kg/m2 at their nodes. Watch: the roof, and the top of a 50-storey tube."""
    n, s = max(1, int(Bays)), max(1, int(Storeys))
    a = Tube / n
    top = dict((t, int(round(s * f / 108.0))) for t, f in BUNDLED_TOPS.items())
    belts = [int(round(s * f / 108.0)) for f in BUNDLED_BELTS]
    pt = lambda i, j, k: P(i * a, j * a, k * StoreyHeight)

    def walls(k):
        """The bays of the tubes' walls on floor k, as pairs of grid points."""
        bays = set()
        for (c, r), t in top.items():
            if t >= k:
                for m in range(n):
                    bays.add(((c * n + m, r * n), (c * n + m + 1, r * n)))
                    bays.add(((c * n + m, r * n + n), (c * n + m + 1, r * n + n)))
                    bays.add(((c * n, r * n + m), (c * n, r * n + m + 1)))
                    bays.add(((c * n + n, r * n + m), (c * n + n, r * n + m + 1)))
        return sorted(bays)

    Columns, Spandrels, Belts, Feet, levels, masters, areas = [], [], [], [], [], [], []
    for k in range(1, s + 1):
        bays = walls(k)
        nodes = sorted(set(p for bay in bays for p in bay))
        Columns += [L(pt(i, j, k - 1), pt(i, j, k)) for (i, j) in nodes]
        Spandrels += [L(pt(p[0], p[1], k), pt(q[0], q[1], k)) for p, q in bays]
        if any(b < k <= b + 2 for b in belts):
            for p, q in bays:
                Belts.append(L(pt(p[0], p[1], k - 1), pt(q[0], q[1], k)))
                Belts.append(L(pt(q[0], q[1], k - 1), pt(p[0], p[1], k)))
        if k == 1:
            Feet = [pt(i, j, 0) for (i, j) in nodes]
        levels.append([pt(i, j, k) for (i, j) in nodes])
        masters.append(pt(n, n, k))
        areas.append(sum(1 for t in top.values() if t >= k) * Tube * Tube)
    Floors, Masters, MassPoints, Masses = _floors(levels, masters, FloorMass, areas)
    Watch = [pt(n, n, s), pt(0, 3 * n, top[(0, 2)])]
    return Columns, Spandrels, Belts, Feet, Floors, Masters, MassPoints, Masses, Watch


def braced(Length, Width, TopLength, TopWidth, Storeys, StoreyHeight, XStoreys, FloorMass):
    """A braced tube, after the John Hancock Center in Chicago: a tapering box, Length by Width at the
    ground and TopLength by TopWidth at the roof, its four faces crossed by diagonals from corner to
    corner, an X every XStoreys storeys and half of one at the top, on columns eight bays along its
    long faces and five along its short ones, leaning in with it. The diagonals pass through every
    floor, where the spandrels meet them. The floors are rigid diaphragms, FloorMass kg/m2 at their
    nodes. Watch: a corner of the roof."""
    s, m = max(1, int(Storeys)), max(2, int(XStoreys))
    xs, rest = s // m, s - (s // m) * m
    hx = lambda k: (Length + (TopLength - Length) * k / float(s)) / 2.0
    hy = lambda k: (Width + (TopWidth - Width) * k / float(s)) / 2.0
    corner = lambda c, k: P((-1, 1, 1, -1)[c % 4] * hx(k), (-1, -1, 1, 1)[c % 4] * hy(k), k * StoreyHeight)
    face = lambda f, t, k: corner(f, k) + (corner(f + 1, k) - corner(f, k)) * t
    bays = (8, 5, 8, 5)

    def cross(k, x):
        """How far along a face, from its first corner, the X x's rising diagonal crosses floor k;
        the X above the last whole one is half an X, its diagonals meeting at the roof."""
        if x < xs:
            return (k - x * m) / float(m)
        return 0.5 * (k - xs * m) / rest if rest else 0.0

    Columns, Spandrels, Diagonals, Feet, levels, masters, areas = [], [], [], [], [], [], []
    for k in range(s + 1):
        t = cross(k, k // m)
        ring = []
        for f in range(4):
            stops = set(i / float(bays[f]) for i in range(bays[f])) | set(x for x in (t, 1 - t) if x < 1 - 1e-9)
            ring += [face(f, x, k) for x in sorted(round(x, 9) for x in stops)]
        if k == 0:
            Feet = [face(f, i / float(bays[f]), 0) for f in range(4) for i in range(bays[f])]
            continue
        for f in range(4):
            for i in range(bays[f]):
                Columns.append(L(face(f, i / float(bays[f]), k - 1), face(f, i / float(bays[f]), k)))
        Spandrels += [L(ring[i], ring[(i + 1) % len(ring)]) for i in range(len(ring))]
        # Each diagonal, floor by floor: from where it crosses the floor under to where it crosses this one.
        x = (k - 1) // m
        t0, t1 = cross(k - 1, x), cross(k, x)
        for f in range(4):
            Diagonals.append(L(face(f, t0, k - 1), face(f, t1, k)))
            Diagonals.append(L(face(f, 1 - t0, k - 1), face(f, 1 - t1, k)))
        levels.append(ring)
        masters.append(corner(0, k))
        areas.append(4 * hx(k) * hy(k))
    Floors, Masters, MassPoints, Masses = _floors(levels, masters, FloorMass, areas)
    return Columns, Spandrels, Diagonals, Feet, Floors, Masters, MassPoints, Masses, [corner(0, s)]


def _walls(pieces):
    """A mesh of wall panels, one quad a piece, each piece the pair of its foot's ends and the pair of
    its top's, its nodes shared where panels meet."""
    mesh, at = rg.Mesh(), {}

    def v(point):
        if _key(point) not in at:
            at[_key(point)] = mesh.Vertices.Count
            mesh.Vertices.Add(point)
        return at[_key(point)]

    for (a, b), (c, d) in pieces:
        mesh.Faces.AddFace(v(a), v(b), v(d), v(c))
    mesh.Normals.ComputeNormals()
    return mesh


def _level_points(lines, meshes, z):
    """Every end of lines and every vertex of meshes at height z, each once. A mesh keeps its
    vertices in single precision - 592 m up, one is 591.99998 - so heights match to a millimetre."""
    points, once = [], _Once()
    for line in lines:
        for p in (line.From, line.To):
            if abs(p.Z - z) < 1e-3:
                once.point(points, p)
    for mesh in meshes:
        for i in range(mesh.Vertices.Count):
            p = rg.Point3d(mesh.Vertices[i])
            if abs(p.Z - z) < 1e-3:
                once.point(points, P(p.X, p.Y, z))
    return points


def buttressed(Core, Corridor, WingWidth, Module, Modules, Storeys, StoreyHeight, Spire, FloorMass):
    """A buttressed core, after the Burj Khalifa in Dubai: three wings round a hexagonal core of
    concrete walls, Core from its middle to a corner, each wing two corridor walls Corridor apart
    running out Modules modules of Module, in panels two modules long, with a hammerhead wall across
    its end and columns down its faces, WingWidth wide, tied to the corridor walls by beams where
    two panels meet. The wings step back a module at a
    time, one wing after another round the tower, until only the core is left, which goes on to the
    roof of Storeys and carries a steel spire Spire tall. The floors are rigid diaphragms, FloorMass
    kg/m2 at their nodes. Watch: the spire's tip, and the roof."""
    s, m0, h = max(1, int(Storeys)), max(1, int(Modules)), StoreyHeight
    c, w = Corridor / 2.0, WingWidth / 2.0
    apothem = Core * math.cos(math.pi / 6)
    first, last = int(round(0.12 * s)), int(round(0.82 * s))
    steps = [first + int(round(i * (last - first) / float(max(1, 3 * m0 - 1)))) for i in range(3 * m0)]
    alive = lambda wing, k: m0 - sum(1 for i in range(wing, 3 * m0, 3) if steps[i] < k)
    hexagon = lambda i, k: P(Core * math.cos(math.pi * i / 3), Core * math.sin(math.pi * i / 3), k * h)

    def at(wing, along, across, k):
        a = math.radians(90 + 120 * wing)
        return P(along * math.cos(a) - across * math.sin(a), along * math.sin(a) + across * math.cos(a), k * h)

    station = lambda j: apothem + j * Module
    Walls, Columns, Beams, Spire_, Feet, levels, masters, areas = [], [], [], [], [], [], [], []
    for k in range(1, s + 1):
        plan = []   # the floor's wall pieces, as pairs of points at height 0
        for i in range(6):
            # The sides the wings meet - the 1st, 3rd and 5th - are cut where the corridor walls start.
            if i % 2 == 1:
                wing = (i // 2)
                cuts = [-Core / 2.0, -c, c, Core / 2.0]
                plan += [(at(wing, apothem, cuts[j], 0), at(wing, apothem, cuts[j + 1], 0)) for j in range(3)]
            else:
                plan.append((hexagon(i, 0), hexagon(i + 1, 0)))
        lines = []
        for wing in range(3):
            n = alive(wing, k)
            # The corridor walls in panels two modules long - a model of 160 storeys of walls is slow
            # enough as it is - and the beams across to the faces where two panels meet.
            for e in (-c, c):
                plan += [(at(wing, station(j), e, 0), at(wing, station(min(j + 2, n)), e, 0)) for j in range(0, n, 2)]
            if n > 0:
                cuts = [-w, -c, c, w]
                plan += [(at(wing, station(n), cuts[j], 0), at(wing, station(n), cuts[j + 1], 0)) for j in range(3)]
            for e in (-w, w):
                for j in range(1, n + 1):
                    Columns.append(L(at(wing, station(j), e, k - 1), at(wing, station(j), e, k)))
                    lines.append(Columns[-1])
                for j in range(1, n):
                    Beams.append(L(at(wing, station(j), e, k), at(wing, station(j + 1), e, k)))
                    lines.append(Beams[-1])
                    if j % 2 == 0:
                        Beams.append(L(at(wing, station(j), e, k), at(wing, station(j), e * c / w, k)))
                        lines.append(Beams[-1])
        up = rg.Vector3d(0, 0, h)
        panels = [((a + up * (k - 1), b + up * (k - 1)), (a + up * k, b + up * k)) for a, b in plan]
        Walls.append(_walls(panels))
        if k == 1:
            Feet = _level_points(lines, [Walls[0]], 0.0)
        levels.append(_level_points(lines, [Walls[-1]], k * h))
        masters.append(hexagon(0, k))
        areas.append(1.5 * math.sqrt(3) * Core * Core + sum(alive(i, k) * Module * WingWidth for i in range(3)))
    # The spire: a steel mast that starts eight storeys down inside the core, held at every floor by
    # spokes from the core's corners, and goes on over the roof in 10 m pieces.
    top, foot = P(0, 0, s * h), max(0, s - 8)
    for k in range(foot, s + 1):
        Beams += [L(hexagon(i, k), P(0, 0, k * h)) for i in range(6)]
    Spire_ = [L(P(0, 0, (k - 1) * h), P(0, 0, k * h)) for k in range(foot + 1, s + 1)] + \
        pieces(top, top + rg.Vector3d(0, 0, Spire), max(1, int(round(Spire / 10.0))))
    Floors, Masters, MassPoints, Masses = _floors(levels, masters, FloorMass, areas)
    Watch = [top + rg.Vector3d(0, 0, Spire), hexagon(0, s)]
    return Walls, Columns, Beams, Spire_, Feet, Floors, Masters, MassPoints, Masses, Watch


def outrigger(StoreyHeight, Width, Flare, DamperMass, DamperPeriod, DamperDamping, FloorMass):
    """Outriggers, after Taipei 101: a braced steel core of sixteen columns, 22 m square, and eight
    super columns, two on each face, 45 m apart across the tower, tied together by outrigger trusses
    two storeys deep at the foot of every one of eight modules of eight storeys. The modules flare
    out, from Width at the foot to Width plus Flare at the top, each on the one under it, over a base
    of 25 storeys that narrows as it rises and under a top of 12: 101 storeys in all. In the core, a
    damper - DamperMass tonnes hung from the 92nd floor, a spring and a dashpot that swing it at
    DamperPeriod with DamperDamping % of critical damping - sways against the tower. The floors are
    rigid diaphragms, FloorMass kg/m2 at their nodes. Watch: the roof, and the damper."""
    h, base, modules, height, top = StoreyHeight, 25, 8, 8, 12
    s = base + modules * height + top
    crown = base + modules * height
    C, F, T = 11.0, 22.5, 15.0
    xs = [-C, -C / 3, C / 3, C]
    z = lambda k: k * h

    def half(k, segment):
        """The half width of the tower's perimeter on floor k, of the segment it is drawn for: -1
        the base, 0 to 7 the modules, 8 the top."""
        if segment < 0:
            return Width + 10 - 10 * k / float(base)
        if segment < modules:
            return Width + Flare * (k - base - segment * height) / float(height)
        return T

    def ring(b, k):
        points = []
        for i in range(6):
            points.append(P(-b + 2 * b * i / 6.0, -b, z(k)))
        for i in range(6):
            points.append(P(b, -b + 2 * b * i / 6.0, z(k)))
        for i in range(6):
            points.append(P(b - 2 * b * i / 6.0, b, z(k)))
        for i in range(6):
            points.append(P(-b, b - 2 * b * i / 6.0, z(k)))
        return points

    def segments(k):
        """The segments a floor belongs to: two where one ends and the next begins."""
        if k < base:
            return [-1]
        if k >= crown:
            return [modules - 1, modules] if k == crown else [modules]
        j = (k - base) // height
        return [j - 1, j] if (k - base) % height == 0 and j > 0 else ([-1, 0] if k == base else [j])

    CoreColumns, CoreBeams, CoreBraces, Supers, Perimeter, Rings, Outriggers, Feet = [], [], [], [], [], [], [], []
    supers = [P(x, y, 0) for x in (-C, C) for y in (-F, F)] + [P(x, y, 0) for x in (-F, F) for y in (-C, C)]
    partner = lambda p: P(C if p.X > 0 else -C, C if p.Y > 0 else -C, 0)
    up = lambda p, k: P(p.X, p.Y, z(k))
    for k in range(1, s + 1):
        for x in xs:
            for y in xs:
                CoreColumns.append(L(P(x, y, z(k - 1)), P(x, y, z(k))))
        for line in range(4):
            for bay in range(3):
                for a, b in (((xs[bay], xs[line]), (xs[bay + 1], xs[line])), ((xs[line], xs[bay]), (xs[line], xs[bay + 1]))):
                    CoreBeams.append(L(P(a[0], a[1], z(k)), P(b[0], b[1], z(k))))
                    if (k + bay) % 2 == 0:
                        CoreBraces.append(L(P(a[0], a[1], z(k - 1)), P(b[0], b[1], z(k))))
                    else:
                        CoreBraces.append(L(P(b[0], b[1], z(k - 1)), P(a[0], a[1], z(k))))
        if k <= crown:
            Supers += [L(up(p, k - 1), up(p, k)) for p in supers]
        # The perimeter: columns from the floor under in the same segment, and a ring of beams on
        # every ring of the floor, with beams across where two segments meet.
        here = segments(k)
        below = segments(k - 1)
        for g in here:
            if g in below:
                Perimeter += [L(a, b) for a, b in zip(ring(half(k - 1, g), k - 1), ring(half(k, g), k))]
        rings = [ring(half(k, g), k) for g in here]
        for r in rings:
            Rings += [L(r[i], r[(i + 1) % 24]) for i in range(24)]
        if len(rings) == 2 and abs(half(k, here[0]) - half(k, here[1])) > 1e-6:
            Rings += [L(a, b) for a, b in zip(rings[0], rings[1])]
        # Outriggers: two storeys deep under the foot of every module but the first, and under the top.
        if any(k == base + j * height for j in range(1, modules + 1)):
            for p in supers:
                q = partner(p)
                mid = P((p.X + q.X) / 2, (p.Y + q.Y) / 2, 0)
                Outriggers += [L(up(q, k - 2), up(mid, k - 1)), L(up(mid, k - 1), up(p, k)),
                               L(up(p, k - 2), up(mid, k - 1)), L(up(mid, k - 1), up(q, k)),
                               L(up(q, k - 1), up(mid, k - 1)), L(up(mid, k - 1), up(p, k - 1)),
                               L(up(q, k), up(p, k)), L(up(q, k - 2), up(p, k - 2))]
    Feet = [P(x, y, 0) for x in xs for y in xs] + supers + ring(half(0, -1), 0)
    # The damper: hung from four beams across the core's middle bay on the 92nd floor, sitting half
    # a storey over the 88th, clear of every floor.
    hang = P(0, 0, z(92))
    mass = P(0, 0, z(88) + h / 2)
    Hangers = [L(P(x, y, z(92)), hang) for x in xs[1:3] for y in xs[1:3]]
    Damper = [L(hang, mass)]
    allLines = CoreColumns + CoreBeams + CoreBraces + Supers + Perimeter + Rings + Outriggers + Hangers
    byLevel = {}
    for line in allLines:
        for p in (line.From, line.To):
            k = int(round(p.Z / h))
            if k > 0 and abs(p.Z - z(k)) < 1e-6:
                byLevel.setdefault(k, {})[_key(p)] = p
    levels = [list(byLevel[k].values()) for k in range(1, s + 1)]
    masters = [P(C, C, z(k)) for k in range(1, s + 1)]
    areas = [max(4 * half(k, g) ** 2 for g in segments(k)) for k in range(1, s + 1)]
    Floors, Masters, MassPoints, Masses = _floors(levels, masters, FloorMass, areas)
    # The damper's spring and dashpot, from its mass and period: k = m w2, c = 2 zeta m w, in kN and t.
    omega = 2 * math.pi / DamperPeriod
    Stiffness = DamperMass * omega * omega
    Dashpot = 2 * DamperDamping / 100.0 * DamperMass * omega
    DamperMasses = rg.Vector3d(DamperMass * 1000, DamperMass * 1000, DamperMass * 1000)
    Watch = [P(C, C, z(s)), mass]
    CoreColumns, CoreBeams, CoreBraces, Supers, Perimeter, Rings, Outriggers, Hangers = [
        _unique(x) for x in (CoreColumns, CoreBeams, CoreBraces, Supers, Perimeter, Rings, Outriggers, Hangers)]
    return (CoreColumns, CoreBeams, CoreBraces, Supers, Perimeter, Rings, Outriggers, Hangers, Feet, Floors,
            Masters, MassPoints, Masses, Damper, mass, DamperMasses, Stiffness, Dashpot, Watch)


def diagrid(Radius, Bulge, Around, Storeys, StoreyHeight, NodeStoreys, Core, FloorMass):
    """A diagrid, after the Guangzhou International Finance Center: a tube of steel diagonals round a
    concrete core, its plan a triangle with rounded corners, Radius across at the ground and at the
    roof and Bulge times more half way up. The diagonals cross each other at nodes Around round it,
    every NodeStoreys storeys, and pass through every floor, where a ring beam meets them. The core
    is a hexagon of walls, Core from its middle to a corner. The floors are rigid diaphragms,
    FloorMass kg/m2 at their nodes. Watch: the roof."""
    n, s, m = max(3, int(Around)), max(1, int(Storeys)), max(1, int(NodeStoreys))
    h = StoreyHeight
    radius = lambda a, k: Radius * (1 + Bulge * math.sin(math.pi * k / float(s))) * (1 + 0.08 * math.cos(3 * a))
    on = lambda a, k: P(radius(a, k) * math.cos(a), radius(a, k) * math.sin(a), k * h)
    node = lambda i, x: 2 * math.pi * (i + 0.5 * (x % 2)) / n

    def angles(k, x):
        t = (k - x * m) / float(m)
        return [node(i, x) + d * t * math.pi / n for i in range(n) for d in (-1, 1)]

    hexagon = lambda i, k: P(Core * math.cos(math.pi * i / 3), Core * math.sin(math.pi * i / 3), k * h)
    Diagonals, Rings, Walls, levels, masters, areas = [], [], [], [], [], []
    for k in range(1, s + 1):
        x = (k - 1) // m
        for a0, a1 in zip(angles(k - 1, x), angles(k, x)):
            Diagonals.append(L(on(a0, k - 1), on(a1, k)))
        around = sorted(set(round(a % (2 * math.pi), 9) for a in angles(k, k // m)))
        ring = [on(a, k) for a in around]
        Rings += [L(ring[i], ring[(i + 1) % len(ring)]) for i in range(len(ring))]
        pieces_ = []
        for i in range(6):
            a, b, mid = hexagon(i, 0), hexagon(i + 1, 0), None
            mid = (a + b) / 2
            for p, q in ((a, mid), (mid, b)):
                pieces_.append(((p + rg.Vector3d(0, 0, (k - 1) * h), q + rg.Vector3d(0, 0, (k - 1) * h)),
                                (p + rg.Vector3d(0, 0, k * h), q + rg.Vector3d(0, 0, k * h))))
        Walls.append(_walls(pieces_))
        core = [hexagon(i, k) for i in range(6)] + [(hexagon(i, k) + hexagon(i + 1, k)) / 2 for i in range(6)]
        levels.append(ring + core)
        masters.append(hexagon(0, k))
        areas.append(0.5 * abs(sum(ring[i].X * ring[(i + 1) % len(ring)].Y - ring[(i + 1) % len(ring)].X * ring[i].Y
                                   for i in range(len(ring)))))
    Feet = [on(node(i, 0), 0) for i in range(n)] + [hexagon(i, 0) for i in range(6)] + \
        [(hexagon(i, 0) + hexagon(i + 1, 0)) / 2 for i in range(6)]
    Floors, Masters, MassPoints, Masses = _floors(levels, masters, FloorMass, areas)
    return Diagonals, Rings, Walls, Feet, Floors, Masters, MassPoints, Masses, [ring[0]]


def pushover(BayX, SecondBayX, BayY, GroundStorey, Storey):
    """A small concrete building that is not regular: an L in plan - three cells of a grid two bays by
    two, BayX and SecondBayX along x and BayY twice along y, without the cell at the back on the right -
    two storeys over the whole L, the ground one GroundStorey tall and taller than the rest, and a
    third storey, Storey tall like the second, over the front left cell only. Its columns are built in
    at the ground. Floors: every node above the ground; Forces: the push on each, along x at load
    factor 1, growing with its height, as a building sways in its first mode - every node standing for
    about the same mass, a floor's share is its number of nodes times its height; Roof: the corner of
    the top storey over the middle of the L, where the push is controlled."""
    xs = [0.0, BayX, BayX + SecondBayX]
    ys = [0.0, BayY, 2.0 * BayY]
    zs = [0.0, GroundStorey, GroundStorey + Storey, GroundStorey + 2.0 * Storey]
    ell = [(0, 0), (1, 0), (0, 1)]
    footprints = [ell, ell, [(0, 0)]]

    def corners(cells):
        seen = []
        for i, j in cells:
            for p in ((i, j), (i + 1, j), (i, j + 1), (i + 1, j + 1)):
                if p not in seen:
                    seen.append(p)
        return seen

    def edges(cells):
        seen = []
        for i, j in cells:
            for e in (((i, j), (i + 1, j)), ((i, j + 1), (i + 1, j + 1)), ((i, j), (i, j + 1)), ((i + 1, j), (i + 1, j + 1))):
                if e not in seen:
                    seen.append(e)
        return seen

    node = lambda p, k: P(xs[p[0]], ys[p[1]], zs[k])
    Columns, Beams, Floors, Forces = [], [], [], []
    for k, cells in enumerate(footprints):
        Columns += [L(node(p, k), node(p, k + 1)) for p in corners(cells)]
        Beams += [L(node(a, k + 1), node(b, k + 1)) for a, b in edges(cells)]
        Floors += [node(p, k + 1) for p in corners(cells)]
        Forces += [rg.Vector3d(2.0 * zs[k + 1] / zs[3], 0.0, 0.0) for p in corners(cells)]
    Feet = [node(p, 0) for p in corners(ell)]
    Roof = node((1, 1), 3)
    return Columns, Beams, Feet, Floors, Forces, Roof


def _nice(x):
    """A round number at or above x, for an axis: 1, 1.5, 2, 2.5, 3, 4, 5, 6 or 8 times a power of ten."""
    if x <= 0:
        return 1.0
    power = 10 ** math.floor(math.log10(x))
    for step in (1, 1.5, 2, 2.5, 3, 4, 5, 6, 8, 10):
        if step * power >= x - 1e-9:
            return step * power
    return 10 * power


def capacity_curve(Displacement, BaseShear, Steps, Point, Origin, Size):
    """The capacity curve, drawn in the XZ plane from Origin, Size across and Size high: base shear up,
    the control point's displacement along, in mm. Curve: the whole of it; SoFar: up to Point; Dot: a
    ring round Point on it; Axes: the two axes and their ticks; TagAt and Tags: where each label goes - a
    plane upright in the drawing's plane, so that Text Tag 3D stands the text up, facing whoever looks at
    the frame - and what it says; Step: Point's recorded step, for Model View."""
    n = len(Displacement)
    if n == 0 or len(BaseShear) != n:
        return None, None, None, [], [], [], 0
    i = max(0, min(n - 1, int(Point)))
    d = [x * 1000.0 for x in Displacement]
    top_d, top_v = _nice(max(abs(x) for x in d)), _nice(max(abs(v) for v in BaseShear))
    o = Origin
    at = lambda x, v: P(o.X + Size * x / top_d, o.Y, o.Z + Size * v / top_v)
    Curve = rg.Polyline([at(x, v) for x, v in zip(d, BaseShear)]).ToNurbsCurve()
    SoFar = rg.Polyline([at(x, v) for x, v in zip(d[:i + 1], BaseShear[:i + 1])]).ToNurbsCurve() if i > 0 else None
    tick = Size / 40.0
    Dot = rg.Circle(rg.Plane(at(d[i], BaseShear[i]), rg.Vector3d.XAxis, rg.Vector3d.ZAxis), tick).ToNurbsCurve()
    Axes = [L(at(0, 0), at(top_d, 0)), L(at(0, 0), at(0, top_v))]
    upright = lambda p: rg.Plane(p, rg.Vector3d.XAxis, rg.Vector3d.ZAxis)
    TagAt, Tags = [], []
    for k in range(5):
        x, v = top_d * k / 4, top_v * k / 4
        Axes += [L(at(x, 0), at(x, 0) + rg.Vector3d(0, 0, -tick)), L(at(0, v), at(0, v) + rg.Vector3d(-tick, 0, 0))]
        TagAt += [upright(at(x, 0) + rg.Vector3d(-tick, 0, -5 * tick)), upright(at(0, v) + rg.Vector3d(-9 * tick, 0, -tick))]
        Tags += ["{0:g}".format(round(x, 6)), "{0:g}".format(round(v, 6))]
    # The axes' names, and the point's values a line over the shear's, where they cannot run into it.
    TagAt += [upright(at(top_d * 0.3, 0) + rg.Vector3d(0, 0, -10 * tick)), upright(at(0, top_v) + rg.Vector3d(-tick, 0, 3 * tick)),
              upright(at(0, top_v) + rg.Vector3d(-tick, 0, 8 * tick))]
    shown = lambda x: 0 if abs(x) < 0.5 else x
    Tags += ["Roof displacement [mm]", "Base shear [kN]",
             "{0:.0f} mm, {1:.0f} kN".format(shown(d[i]), shown(BaseShear[i]))]
    Step = Steps[i] if i < len(Steps) else 0
    return Curve, SoFar, Dot, Axes, TagAt, Tags, Step


Curve, SoFar, Dot, Axes, TagAt, Tags, Step = capacity_curve(Displacement, BaseShear, Steps, Point, Origin, Size)
# ---------- end capacity_curve ----------
frame_pushed = ModelViewAlpaca4d(AlpacaModel=pushover.AlpacaModel, Step=capacity_curve.Step, FittedLoads=True)  # -> AlpacaModel, Geometry, Info, Values, Colors
capacity_curve_drawn = Curve([capacity_curve.Curve, capacity_curve.SoFar, capacity_curve.Dot, capacity_curve.Axes])
curve_labels = TextTag3D(Location=capacity_curve.TagAt, Text=capacity_curve.Tags, Size=0.7, Colour=RGB(42, 45, 49), Justification=7)
hinges = Panel(pushover.Hinges)
