# Grasshopper definition ResponseSpectrumSticks.gh (Grasshopper 1.0.7)
# plug-ins: Galapagos, Kangaroo2 Components, Alpaca4d

# ---- group: 1 - Geometry: a row of sticks from short to tall, their heights spread for their periods to be
sticks = Slider(30, range=2..60)
shortest_m = Slider(1, range=0.5..3)
tallest_m = Slider(10, range=3..15)
spacing_m = Slider(1.2, range=0.5..3)
response_spectrum_sticks = GhPythonScript(Sticks=sticks, Shortest=shortest_m, Tallest=tallest_m, Spacing=spacing_m)  # -> out, Lines, Feet, Tops; inputs Sticks: Int32
# ---------- response_spectrum_sticks: Python ----------
"""The geometry of the conventional structures of Structures.py, one function a structure.

Structures.py puts one of them into a GhPython component, whose inputs are the function's arguments
and whose outputs are what it returns, in order: lines for each kind of member, the points the
structure is held at, and the widths its loads are worked out from. Every member is a straight line
between two nodes, cut wherever another member meets it, so that the elements share their nodes.

Runs in GhPython (Rhino 7 and 8) and in Rhino 8's Python 3 component alike.
"""
from __future__ import division

import math
import Rhino.Geometry as rg
from Grasshopper import DataTree
from Grasshopper.Kernel.Data import GH_Path


def P(x, y, z):
    return rg.Point3d(x, y, z)


def L(a, b):
    return rg.Line(a, b)


def pieces(a, b, n):
    """The line from a to b in n pieces."""
    n = max(1, int(n))
    return [L(a + (b - a) * (i / n), a + (b - a) * ((i + 1) / n)) for i in range(n)]


def chain(points):
    """The lines between one point and the next."""
    return [L(points[k], points[k + 1]) for k in range(len(points) - 1)]


def grid_mesh(xs, ys, z):
    """A mesh of quads over xs by ys at height z, its vertices where the lines of xs and ys cross."""
    mesh = rg.Mesh()
    for y in ys:
        for x in xs:
            mesh.Vertices.Add(P(x, y, z))
    cols = len(xs)
    for r in range(len(ys) - 1):
        for c in range(cols - 1):
            a = r * cols + c
            mesh.Faces.AddFace(a, a + 1, a + cols + 1, a + cols)
    return mesh


# ---------------------------------------------------------------- 1 - a steel hall roofed by trusses

def hall(Span, Bays, Spacing, Eaves, Depth, Panels):
    """Frames of a Pratt truss on two columns, Spacing apart, joined by purlins at the truss's top nodes.
    The columns rise to the top chord, the bottom chord meeting them at the eaves, so that each frame
    stands on pinned feet. The two end bays are braced: crosses in the roof, between the top chords,
    and in the long walls, with a strut along each wall at the eaves. PurlinWidths: the width of roof
    each purlin carries, a panel, or half of one at the eaves."""
    n = max(2, int(Panels) // 2 * 2)
    bays = max(1, int(Bays))
    dx = Span / n
    top = Eaves + Depth
    Columns, Chords, Webs, Purlins, PurlinWidths, Bracing, Struts, Feet = [], [], [], [], [], [], [], []
    for i in range(bays + 1):
        y = i * Spacing
        for x in (0.0, Span):
            Columns += [L(P(x, y, 0), P(x, y, Eaves)), L(P(x, y, Eaves), P(x, y, top))]
            Feet.append(P(x, y, 0))
        for k in range(n):
            x0, x1 = k * dx, (k + 1) * dx
            Chords += [L(P(x0, y, Eaves), P(x1, y, Eaves)), L(P(x0, y, top), P(x1, y, top))]
            # Pratt: the diagonals fall towards the middle, in tension under the roof's weight.
            if k < n // 2:
                Webs.append(L(P(x0, y, top), P(x1, y, Eaves)))
            else:
                Webs.append(L(P(x0, y, Eaves), P(x1, y, top)))
        Webs += [L(P(k * dx, y, Eaves), P(k * dx, y, top)) for k in range(1, n)]
    for i in range(bays):
        y0, y1 = i * Spacing, (i + 1) * Spacing
        for k in range(n + 1):
            Purlins.append(L(P(k * dx, y0, top), P(k * dx, y1, top)))
            PurlinWidths.append(dx / 2 if k in (0, n) else dx)
        for x in (0.0, Span):
            Struts.append(L(P(x, y0, Eaves), P(x, y1, Eaves)))
        if i in (0, bays - 1):
            for k in range(n):
                Bracing += [L(P(k * dx, y0, top), P((k + 1) * dx, y1, top)),
                            L(P((k + 1) * dx, y0, top), P(k * dx, y1, top))]
            for x in (0.0, Span):
                Bracing += [L(P(x, y0, 0), P(x, y1, Eaves)), L(P(x, y1, 0), P(x, y0, Eaves))]
    return Columns, Chords, Webs, Purlins, PurlinWidths, Bracing, Struts, Feet


# ---------------------------------------------------------------- 2 - a steel tower with a stair

def tower(Width, Levels, Storey):
    """Four legs Width apart, a landing at every level and a crossed bracing on every face of every
    storey. A straight flight of stairs climbs each storey along a strip a metre wide across the
    middle, turning back at each landing: two stringers, from one side of the landing below to the
    other side of the landing above. A landing is its four edge beams and two cross beams along the
    strip, its Strip, which the stringers start and end on. The legs on the windward side, x = 0, are
    WindwardLegs, for the wind."""
    levels = max(1, int(Levels))
    w = Width
    y1, y2 = 0.5 * w - 0.5, 0.5 * w + 0.5
    corners = [(0, 0), (w, 0), (w, w), (0, w)]
    Legs, WindwardLegs, Bracing, Landings, Strip, Stringers, Feet = [], [], [], [], [], [], []
    for x, y in corners:
        Feet.append(P(x, y, 0))
        legs = pieces(P(x, y, 0), P(x, y, levels * Storey), levels)
        (WindwardLegs if x == 0 else Legs).extend(legs)
    for j in range(levels):
        z0, z1 = j * Storey, (j + 1) * Storey
        for k in range(4):
            (ax, ay), (bx, by) = corners[k], corners[(k + 1) % 4]
            Bracing += [L(P(ax, ay, z0), P(bx, by, z1)), L(P(bx, by, z0), P(ax, ay, z1))]
        # The landing at the top of the storey: the sides along y cut where the strip meets them.
        Landings += [L(P(0, 0, z1), P(w, 0, z1)), L(P(0, w, z1), P(w, w, z1))]
        for x in (0.0, w):
            Landings += [L(P(x, 0, z1), P(x, y1, z1)), L(P(x, y1, z1), P(x, y2, z1)), L(P(x, y2, z1), P(x, w, z1))]
        Strip += [L(P(0, y1, z1), P(w, y1, z1)), L(P(0, y2, z1), P(w, y2, z1))]
        # The flight: up along +x in even storeys, back along -x in odd ones.
        a, b = (0.0, w) if j % 2 == 0 else (w, 0.0)
        Stringers += [L(P(a, y, z0), P(b, y, z1)) for y in (y1, y2)]
    # The ground has no landing beams: the first flight starts on its own footing.
    Feet += [P(0.0, y, 0) for y in (y1, y2)]
    return Legs, WindwardLegs, Bracing, Landings, Strip, Stringers, Feet


# ---------------------------------------------------------------- 3 - a canopy on T-shaped frames

def canopy(Frames, Spacing, Height, Cantilever, Rise, Purlins):
    """A row of frames, Spacing apart: a column built in at its foot and an arm cantilevering each way
    from its head, rising Rise to its tip. Purlins join the frames at the head and at Purlins points
    along each arm. A cross between two columns in the middle bay holds the row lengthways.
    LeftWidths and RightWidths: the width of roof, on plan, each purlin carries on the left (-x) and
    the right (+x) of the frames, nothing on the other side: a purlin's share, or half at a tip or the
    head."""
    frames = max(2, int(Frames))
    m = max(1, int(Purlins))
    s = Cantilever / m
    Columns, Arms, Purlins, LeftWidths, RightWidths, Bracing, Feet = [], [], [], [], [], [], []
    for i in range(frames):
        y = i * Spacing
        Columns.append(L(P(0, y, 0), P(0, y, Height)))
        Feet.append(P(0, y, 0))
        for side in (-1, 1):
            Arms += pieces(P(0, y, Height), P(side * Cantilever, y, Height + Rise), m)
    for i in range(frames - 1):
        y0, y1 = i * Spacing, (i + 1) * Spacing
        Purlins.append(L(P(0, y0, Height), P(0, y1, Height)))
        LeftWidths.append(s / 2)
        RightWidths.append(s / 2)
        for side in (-1, 1):
            for k in range(1, m + 1):
                Purlins.append(L(P(side * k * s, y0, Height + k * Rise / m), P(side * k * s, y1, Height + k * Rise / m)))
                width = s / 2 if k == m else s
                LeftWidths.append(width if side < 0 else 0.0)
                RightWidths.append(width if side > 0 else 0.0)
    middle = (frames - 1) // 2
    y0, y1 = middle * Spacing, (middle + 1) * Spacing
    Bracing += [L(P(0, y0, 0), P(0, y1, Height)), L(P(0, y1, 0), P(0, y0, Height))]
    return Columns, Arms, Purlins, LeftWidths, RightWidths, Bracing, Feet


# ---------------------------------------------------------------- 4 - a facade stiffened by vertical trusses

def facade(Bays, BayWidth, Height, Levels, Depth, TrussEvery):
    """A glass wall Height tall in the plane y = 0, held only at its foot and its top, as a lobby's is:
    mullions every BayWidth and transoms between them at Levels heights. Behind every TrussEvery-th
    mullion a vertical truss stiffens it against the wind: the mullion is its outer chord, a tube
    Depth behind it the inner chord, with a post at every transom and diagonals zig-zagging between.
    The mullions stand on their feet and are held across the wall at the top; the inner chords too,
    and along the wall at the top as well, which nothing else holds them in.
    MullionWidths: the width of wall each piece of mullion catches the wind over, a bay or half of one
    at the ends. PanelHeight: the height of glass each transom carries."""
    bays, levels, every = max(1, int(Bays)), max(2, int(Levels)), max(1, int(TrussEvery))
    dz = Height / levels
    Mullions, MullionWidths, Transoms, Chords, Posts, Diagonals = [], [], [], [], [], []
    Base, Tops, ChordBase, ChordTops = [], [], [], []
    for i in range(bays + 1):
        x = i * BayWidth
        Mullions += pieces(P(x, 0, 0), P(x, 0, Height), levels)
        MullionWidths += [BayWidth / 2 if i in (0, bays) else BayWidth] * levels
        Base.append(P(x, 0, 0))
        Tops.append(P(x, 0, Height))
        if i % every:
            continue
        Chords += pieces(P(x, Depth, 0), P(x, Depth, Height), levels)
        Posts += [L(P(x, 0, k * dz), P(x, Depth, k * dz)) for k in range(levels + 1)]
        for k in range(levels):
            z0, z1 = k * dz, (k + 1) * dz
            Diagonals.append(L(P(x, 0, z0), P(x, Depth, z1)) if k % 2 == 0 else L(P(x, Depth, z0), P(x, 0, z1)))
        ChordBase.append(P(x, Depth, 0))
        ChordTops.append(P(x, Depth, Height))
    for k in range(1, levels):
        Transoms += [L(P(i * BayWidth, 0, k * dz), P((i + 1) * BayWidth, 0, k * dz)) for i in range(bays)]
    PanelHeight = dz
    return Mullions, MullionWidths, Transoms, Chords, Posts, Diagonals, Base, Tops, ChordBase, ChordTops, PanelHeight


# ---------------------------------------------------------------- 5 - a barrel vault under wind

def vault(Span, Rise, Length, Strips, Divisions, Windward, Crown, Leeward):
    """A barrel vault spanning Span across x, Rise high, Length long along y: the arc of a circle
    through its two feet and its crown, cut into Strips strips along its length, each a mesh of quads
    Divisions long. A strip's faces all face the same way, so one pressure on a strip acts along one
    direction. The pressure coefficients of the windward quarter, the middle half and the leeward
    quarter, wind blowing along +x, are given to each strip by where its middle is, with the strip's
    outward Normal: a positive coefficient pushes on the vault, along -Normal, a negative one pulls it
    away. The feet are held along both long edges."""
    strips, divisions = max(4, int(Strips)), max(1, int(Divisions))
    r = (0.25 * Span * Span + Rise * Rise) / (2 * Rise)
    zc = Rise - r
    # Half the angle the arc spans, from the crown to a foot: past 90 degrees for more than a semicircle.
    half = math.atan2(0.5 * Span, r - Rise)

    def at(t, y):
        a = -half + 2 * half * t
        return P(0.5 * Span + r * math.sin(a), y, zc + r * math.cos(a))

    Strip, Names, Coefficients, Normals, Feet = [], [], [], [], []
    for s in range(strips):
        mesh = rg.Mesh()
        for k in range(divisions + 1):
            y = Length * k / divisions
            mesh.Vertices.Add(at(s / strips, y))
            mesh.Vertices.Add(at((s + 1) / strips, y))
        for k in range(divisions):
            mesh.Faces.AddFace(2 * k, 2 * k + 1, 2 * k + 3, 2 * k + 2)
        mesh.Normals.ComputeNormals()
        Strip.append(mesh)
        Names.append("Strip_{0}".format(s))
        middle = (s + 0.5) / strips
        Coefficients.append(Windward if middle < 0.25 else Leeward if middle > 0.75 else Crown)
        a = -half + 2 * half * middle
        Normals.append(rg.Vector3d(math.sin(a), 0, math.cos(a)))
    for k in range(divisions + 1):
        y = Length * k / divisions
        Feet += [at(0, y), at(1, y)]
    return Strip, Names, Coefficients, Normals, Feet


# ---------------------------------------------------------------- 6 - a facade held by wind trusses

def windtruss(Width, Height, Spacing, Depth, Trusses):
    """A tall glass facade Width wide and Height high in the plane y = 0, its mullions Spacing apart
    standing on their feet and held across the facade at the top, and at Trusses levels between by
    horizontal trusses behind it. Each truss spans the whole width between the building's columns at
    its two ends: its outer chord runs through the mullions, its inner chord Depth behind, with a
    post at every mullion and diagonals between, falling towards the middle. MullionWidths: the width
    of facade each piece of mullion catches the wind over, its spacing or half of it at the ends."""
    n = max(2, int(round(Width / Spacing)))
    s = Width / n
    trusses = max(1, int(Trusses))
    levels = [Height * (k + 1) / (trusses + 1) for k in range(trusses)]
    heights = [0.0] + levels + [Height]
    Mullions, MullionWidths, Chords, Posts, Diagonals, Base, Tops, TrussEnds = [], [], [], [], [], [], [], []
    for i in range(n + 1):
        x = i * s
        Mullions += [L(P(x, 0, heights[k]), P(x, 0, heights[k + 1])) for k in range(len(heights) - 1)]
        MullionWidths += [s / 2 if i in (0, n) else s] * (len(heights) - 1)
        Base.append(P(x, 0, 0))
        Tops.append(P(x, 0, Height))
    for z in levels:
        for i in range(n):
            x0, x1 = i * s, (i + 1) * s
            Chords += [L(P(x0, 0, z), P(x1, 0, z)), L(P(x0, Depth, z), P(x1, Depth, z))]
            if i < n // 2:
                Diagonals.append(L(P(x0, Depth, z), P(x1, 0, z)))
            else:
                Diagonals.append(L(P(x0, 0, z), P(x1, Depth, z)))
        Posts += [L(P(i * s, 0, z), P(i * s, Depth, z)) for i in range(n + 1)]
        TrussEnds += [P(0, 0, z), P(0, Depth, z), P(Width, 0, z), P(Width, Depth, z)]
    return Mullions, MullionWidths, Chords, Posts, Diagonals, Base, Tops, TrussEnds


# ---------------------------------------------------------------- 7 - a girder bridge on piers

def girder(SideSpan, MainSpan, PierHeight, Segment):
    """A continuous concrete deck over three spans - SideSpan, MainSpan, SideSpan - on two piers
    PierHeight tall. The deck is a slab 12 m wide on two girders 6 m apart, joined by a cross girder
    every other Segment; each pier is two round columns, one under each girder, braced by a strut
    halfway up and joined on top by a deeper cross girder, its cap. The deck is built into the piers
    and slides along on bearings at its two ends, held there across. Watch: the deck in the middle
    of the main span, whose movement the pictures plot."""
    H, g, w = PierHeight, 3.0, 6.0
    length = 2 * SideSpan + MainSpan
    piers = (SideSpan, SideSpan + MainSpan)
    xs = [0.0]
    for a, b in [(0.0, SideSpan), (SideSpan, SideSpan + MainSpan), (SideSpan + MainSpan, length)]:
        n = max(1, int(round((b - a) / Segment)))
        xs += [a + (b - a) * (i + 1) / n for i in range(n)]
    ys = [-w, -g, 0.0, g, w]
    Girders = []
    for y in (-g, g):
        Girders += chain([P(x, y, H) for x in xs])
    Slab = [grid_mesh(xs, ys, H)]
    CrossGirders, PierCaps = [], []
    for k, x in enumerate(xs):
        across = chain([P(x, y, H) for y in (-g, 0.0, g)])
        if any(abs(x - p) < 1e-6 for p in piers):
            PierCaps += across
        elif k % 2 == 0 or k == len(xs) - 1:
            CrossGirders += across
    Columns, Struts, Feet = [], [], []
    for x in piers:
        for y in (-g, g):
            Columns += pieces(P(x, y, 0), P(x, y, 0.5 * H), 3) + pieces(P(x, y, 0.5 * H), P(x, y, H), 3)
            Feet.append(P(x, y, 0))
        Struts += chain([P(x, y, 0.5 * H) for y in (-g, 0.0, g)])
    Bearings = [P(x, y, H) for x in (0.0, length) for y in (-g, g)]
    Watch = [P(0.5 * length, 0, H)]
    return Girders, CrossGirders, PierCaps, Columns, Struts, Slab, Feet, Bearings, Watch


# ---------------------------------------------------------------- 8 - a cable-stayed bridge

def cablestayed(Span, DeckHeight, PylonHeight, Width, Stays):
    """Two spans of Span each side of an H-shaped pylon: two legs Width apart, from the ground to
    PylonHeight above the deck, joined at the top. The deck is two edge girders joined by floor beams
    wherever a stay holds them, Stays a side in each span, the stays in two planes, fanning from the
    top quarter of each leg. The girders are built into the legs, and slide along their abutments.
    Watch: the deck in the middle of a span, and the top of the pylon."""
    n = max(2, int(Stays))
    w = 0.5 * Width
    top = DeckHeight + PylonHeight
    spacing = Span / (n + 1)
    xs = [-Span + k * spacing for k in range(2 * n + 3)]
    Girders, FloorBeams, Legs, CrossBeams, Cables, Feet, Bearings = [], [], [], [], [], [], []
    for y in (-w, w):
        Girders += [L(P(xs[k], y, DeckHeight), P(xs[k + 1], y, DeckHeight)) for k in range(len(xs) - 1)]
        Legs += pieces(P(0, y, 0), P(0, y, DeckHeight), 4)
        anchors = [DeckHeight + PylonHeight * (0.75 + 0.25 * j / (n - 1)) for j in range(n)]
        levels = [DeckHeight] + sorted(set(anchors))
        Legs += [L(P(0, y, levels[k]), P(0, y, levels[k + 1])) for k in range(len(levels) - 1)]
        Feet.append(P(0, y, 0))
        for side in (-1, 1):
            for j in range(n):
                # The outermost stay from the highest anchor, the innermost from the lowest.
                x = side * spacing * (j + 1)
                Cables.append(L(P(0, y, anchors[j]), P(x, y, DeckHeight)))
        Bearings += [P(-Span, y, DeckHeight), P(Span, y, DeckHeight)]
    FloorBeams += [L(P(x, -w, DeckHeight), P(x, w, DeckHeight)) for x in xs]
    CrossBeams += [L(P(0, -w, top), P(0, w, top))]
    Watch = [P(0.5 * Span, 0, DeckHeight), P(0, -w, top)]
    return Girders, FloorBeams, Legs, CrossBeams, Cables, Feet, Bearings, Watch


# ---------------------------------------------------------------- 9 - a deck arch bridge

def arch(Span, Rise, Columns, DeckAbove):
    """Two concrete arch ribs Span across and Rise high, parabolas springing from the ground 12 m
    apart and leaning in to 7 m apart at the crown, braced by a strut at every column. They carry a
    deck DeckAbove the crown on Columns pairs of spandrel columns, evenly spaced, built into both: a
    slab 11 m wide on two girders, joined by a floor beam on every pair of columns. The deck runs on
    to the abutments at its two ends, where it slides along, held across; the ribs are built in at
    their springings. Watch: the deck at the crown."""
    n = max(2, int(Columns))
    deck = Rise + DeckAbove
    spring, crown, g, w = 6.0, 3.5, 4.0, 5.5
    zs = lambda x: 4.0 * Rise * x * (Span - x) / (Span * Span)
    bs = lambda x: spring - (spring - crown) * zs(x) / Rise
    xs = [Span * k / (n + 1) for k in range(n + 2)]
    # The ribs and the deck, cut at every column and halfway between.
    ts = sorted(set([x for x in xs] + [0.5 * (xs[k] + xs[k + 1]) for k in range(len(xs) - 1)]))
    Ribs, Girders, SpandrelColumns = [], [], []
    for side in (-1, 1):
        Ribs += chain([P(t, side * bs(t), zs(t)) for t in ts])
        Girders += chain([P(t, side * g, deck) for t in ts])
        SpandrelColumns += [L(P(x, side * bs(x), zs(x)), P(x, side * g, deck)) for x in xs[1:-1]]
    Struts = [L(P(x, -bs(x), zs(x)), P(x, bs(x), zs(x))) for x in xs[1:-1]]
    FloorBeams = []
    for x in xs:
        FloorBeams += chain([P(x, y, deck) for y in (-g, 0.0, g)])
    Slab = [grid_mesh(ts, [-w, -g, 0.0, g, w], deck)]
    Springings = [P(x, y, 0) for x in (0.0, Span) for y in (-spring, spring)]
    Abutments = [P(x, y, deck) for x in (0.0, Span) for y in (-g, g)]
    Watch = [P(0.5 * Span, 0, deck)]
    return Ribs, Struts, Girders, FloorBeams, SpandrelColumns, Slab, Springings, Abutments, Watch


# ---------------------------------------------------------------- 10 - a building, and a tiny city of them

def _building(x0, y0, bay, height, floors, balconies=False, depth=1.5, split=1):
    """A steel frame on a grid of bay, x0, y0 its first corner: floors, from the first up, are the
    cells (i, j) each floor covers, every one inside the one under it, so that a column stands
    under every corner of a floor. Each floor has beams round its cells, cut split times a bay, and
    a slab mesh of quads on the beams' nodes; balconies: on every floor with the same floor over it,
    a slab depth deep along the south faces, on cantilevers at the columns and an edge beam."""
    Columns, Beams, Slabs, Feet = [], [], [], []
    n = max(1, int(split))
    pt = lambda i, j, k: P(x0 + i * bay, y0 + j * bay, k * height)
    corners = lambda cells: sorted(set((i + a, j + b) for (i, j) in cells for a in (0, 1) for b in (0, 1)))
    edges = lambda cells: sorted(set(e for (i, j) in cells for e in
                                     [((i, j), (i + 1, j)), ((i, j + 1), (i + 1, j + 1)), ((i, j), (i, j + 1)), ((i + 1, j), (i + 1, j + 1))]))
    Feet += [pt(i, j, 0) for (i, j) in corners(floors[0])]
    for k, cells in enumerate(floors, 1):
        Columns += [L(pt(i, j, k - 1), pt(i, j, k)) for (i, j) in corners(cells)]
        for a, b in edges(cells):
            Beams += pieces(pt(a[0], a[1], k), pt(b[0], b[1], k), n)
        mesh, at = rg.Mesh(), {}

        def v(point):
            key = (round(point.X, 6), round(point.Y, 6))
            if key not in at:
                at[key] = mesh.Vertices.Count
                mesh.Vertices.Add(point)
            return at[key]

        for (i, j) in sorted(cells):
            for a in range(n):
                for b in range(n):
                    q = [pt(i + (a + da) / n, j + (b + db) / n, k) for da, db in ((0, 0), (1, 0), (1, 1), (0, 1))]
                    mesh.Faces.AddFace(*[v(p) for p in q])
        if balconies and k < len(floors) and floors[k] == cells:
            out = rg.Vector3d(0, -depth, 0)
            south = [(i, j) for (i, j) in sorted(cells) if (i, j - 1) not in cells]
            for (i, j) in sorted(set(c for (i, j) in south for c in ((i, j), (i + 1, j)))):
                Beams.append(L(pt(i, j, k), pt(i, j, k) + out))
            for (i, j) in south:
                for a in range(n):
                    p, q = pt(i + a / n, j, k), pt(i + (a + 1) / n, j, k)
                    Beams.append(L(p + out, q + out))
                    mesh.Faces.AddFace(v(p + out), v(q + out), v(q), v(p))
        Slabs.append(mesh)
    return Columns, Beams, Slabs, Feet


def building(BaysX, BaysY, Bay, Storeys, StoreyHeight):
    """An office building: a steel frame BaysX by BaysY bays of Bay, Storeys storeys of StoreyHeight,
    columns built in at the ground, and a concrete slab at every floor on the beams, meshed twice a
    bay. Its mass is its members' and its slabs' own. Watch: a corner of the roof."""
    cells = _rect(max(1, int(BaysX)), max(1, int(BaysY)))
    storeys = max(1, int(Storeys))
    Columns, Beams, Slabs, Feet = _building(0.0, 0.0, Bay, StoreyHeight, [cells] * storeys, split=2)
    Watch = [P(0, 0, storeys * StoreyHeight)]
    return Columns, Beams, Slabs, Feet, Watch


def _rect(a, b):
    """The cells of a rectangle a bays by b."""
    return frozenset((i, j) for i in range(a) for j in range(b))


def _ell(a, b):
    """An L: the rectangle a by b without its far corner."""
    return _rect(a, b) - frozenset([(a - 1, b - 1)])


# The buildings of the city, row by row, low next to tall as a city grows: the footprint of each, in
# bays, its storeys, what tops it - a smaller footprint for its last few storeys - what it stands on
# - a wider one for its first few - and whether its south face has balconies.
CITY = [
    (_rect(3, 2), 2, None, None, False),
    (_ell(2, 2), 9, None, None, True),
    (_rect(2, 2), 4, (_rect(1, 1), 1), None, False),
    (_rect(2, 1), 16, None, None, True),
    (_ell(3, 2), 6, None, None, False),
    (_rect(2, 2), 12, None, None, True),
    (_rect(3, 1), 3, None, None, False),
    (_rect(2, 2), 20, (_rect(1, 1), 2), (_rect(3, 3), 2), False),
    (_rect(1, 2), 14, None, None, True),
    (_rect(2, 1), 5, (_rect(1, 1), 1), None, False),
    (_ell(2, 2), 10, (_rect(1, 1), 2), None, False),
    (_rect(2, 2), 2, None, None, False),
    (_rect(3, 1), 7, None, None, True),
    (_rect(2, 1), 18, None, (_rect(3, 2), 3), False),
    (_ell(2, 2), 3, None, None, False),
    (_rect(2, 2), 11, (_rect(2, 1), 2), None, True),
]


def city(Rows, ColumnsPerRow, Street, Bay, StoreyHeight):
    """A tiny city: Rows by ColumnsPerRow buildings of CITY, steel frames on a grid of Bay with a
    slab at every floor, Street between their plots of three bays square. Rectangles, Ls, towers
    on podiums and with penthouses, some with balconies: on the same ground each shakes in its own
    way, a low one stiff and quick, a tall one slow and soft, an L or a tower off its podium's
    middle twisting as it sways. Watch: a corner of each building's roof; Storeys: how many it has."""
    Columns, Beams, Slabs, Feet, Watch, Storeys = [], [], [], [], [], []
    rows, cols = max(1, int(Rows)), max(1, int(ColumnsPerRow))
    plot = 3 * Bay + Street
    for r in range(rows):
        for c in range(cols):
            cells, storeys, top, podium, balconies = CITY[(r * cols + c) % len(CITY)]
            low, high = podium[1] if podium else 0, top[1] if top else 0
            floors = ([podium[0]] * low if podium else []) + [cells] * (storeys - low - high) + \
                ([top[0]] * high if top else [])
            parts = _building(c * plot, r * plot, Bay, StoreyHeight, floors, balconies)
            Columns += parts[0]
            Beams += parts[1]
            Slabs += parts[2]
            Feet += parts[3]
            i, j = min(floors[-1])
            Watch.append(P(c * plot + i * Bay, r * plot + j * Bay, storeys * StoreyHeight))
            Storeys.append(storeys)
    return Columns, Beams, Slabs, Feet, Watch, Storeys


# ---------------------------------------------------------------- 12 - a footbridge's natural modes

def footbridge(Span, Width, Segment, Depth):
    """A footbridge of one span, Span long: a concrete deck Width wide and 200 mm thick on a steel box
    girder Depth deep down its middle, cut every Segment or so. The deck is meshed in quads, one
    across each half, its middle plane at Z = 0; the box's axis is under it, its top against the
    deck's underside, and each of its nodes is tied to the deck's node above by a rigid link, so that
    the two bend together. The box is held at both ends: a pinned bearing at the start, one sliding
    along at the far end. Box: its lines; Deck: the deck's mesh; Under and Over: each link's two
    nodes, the box's and the deck's; Pinned and Sliding: the box's two ends."""
    n = max(2, int(round(Span / Segment)))
    xs = [Span * i / n for i in range(n + 1)]
    z = -(0.1 + 0.5 * Depth)
    Box = chain([P(x, 0, z) for x in xs])
    Deck = [grid_mesh(xs, [-0.5 * Width, 0.0, 0.5 * Width], 0.0)]
    Under = [P(x, 0, z) for x in xs]
    Over = [P(x, 0, 0) for x in xs]
    return Box, Deck, Under, Over, [Under[0]], [Under[-1]]


# ---------------------------------------------------------------- 13 - sticks that draw a response spectrum

def sticks(Sticks, Shortest, Tallest, Spacing):
    """A row of Sticks steel sticks along x, Spacing apart, from Shortest to Tallest: each a
    cantilever from the ground to a mass at its top, an oscillator of one degree of freedom along
    the shaking. A cantilever's period goes as its height to the power 1.5, so their heights are
    spread for their periods to be spread evenly: along the row, x reads as the period axis of a
    response spectrum. Each stick is a model of its own, a branch of the trees: Lines, one line;
    Feet, where it is held; Tops, where its mass sits."""
    n = max(2, int(Sticks))
    low, high = Shortest ** 1.5, Tallest ** 1.5
    Lines, Feet, Tops = DataTree[object](), DataTree[object](), DataTree[object]()
    for i in range(n):
        h = (low + (high - low) * i / (n - 1)) ** (2.0 / 3.0)
        foot, top = P(i * Spacing, 0, 0), P(i * Spacing, 0, h)
        path = GH_Path(i)
        Lines.Add(L(foot, top), path)
        Feet.Add(foot, path)
        Tops.Add(top, path)
    return Lines, Feet, Tops


# How tall the spectrum stands behind the sticks: metres to 1 g of pseudo-acceleration.
SPECTRUM_SCALE = 8.0
# How far behind the sticks it stands, m.
SPECTRUM_BEHIND = 3.0


def spectrum(Periods, Displacements, Tops):
    """The response spectrum the sticks draw. Periods: each stick's, a branch each, from its Natural
    Vibration Analysis; Displacements: the sticks' displacements at every step of their
    transient analyses, from Nodal Displacements with History on, a branch a step. Sd is
    the most its top moved from the ground at any step, along x, in mm; PSa, its pseudo-acceleration, Sd times
    (2 pi / T) squared, in g. Spectrum and Grid draw them as a chart standing behind the sticks, its
    period axis along the row and its PSa SPECTRUM_SCALE m to the g: a line through each stick's
    PSa, and lines at every 0.25 g."""
    periods = [max(Periods.Branch(p)) for p in Periods.Paths if Periods.Branch(p).Count]
    n = len(periods)
    # Nodal Displacements gives a branch a step, every stick's nodes in it one after another, in the
    # order of the sticks; each stick's top moves the most.
    peaks = [0.0] * n
    for path in Displacements.Paths:
        moves = list(Displacements.Branch(path))
        each = len(moves) // n if n else 0
        for i in range(n if each else 0):
            peaks[i] = max([peaks[i]] + [abs(v.X) for v in moves[i * each:(i + 1) * each]])
    Period, Sd, PSa = [], [], []
    for T, peak in zip(periods, peaks):
        Period.append(T)
        Sd.append(1000.0 * peak)
        PSa.append((2 * math.pi / T) ** 2 * peak / 9.81)
    xs = [Tops.Branch(p)[0].X for p in Tops.Paths][:len(PSa)]
    y = SPECTRUM_BEHIND
    Spectrum = rg.Polyline([P(x, y, a * SPECTRUM_SCALE) for x, a in zip(xs, PSa)]).ToNurbsCurve()
    Grid = []
    if xs:
        for k in range(int(math.ceil(max(PSa) / 0.25)) + 1):
            z = 0.25 * k * SPECTRUM_SCALE
            Grid.append(L(P(xs[0], y, z), P(xs[-1], y, z)))
    return Period, Sd, PSa, Spectrum, Grid


# ---------------------------------------------------------------- 14 - a shell form-found to work in compression

# The plan of the shell, a cross of four legs 20 m from end to end, in 16 quads round its middle: the
# coarse net Kangaroo refines and pushes up. Its corners, from the middle out, x and y in m.
SHELL_QUADS = [
    ((-9.925, -1.207), (-9.925, 0.0), (-4.521, 0.0), (-5.356, -2.616)),
    ((-5.356, -2.616), (-4.521, 0.0), (0.0, -5.0), (-2.544, -5.451)),
    ((-2.544, -5.451), (0.0, -5.0), (0.0, -10.0), (-1.132, -10.0)),
    ((-4.521, 0.0), (-2.0, 0.0), (0.0, -2.0), (0.0, -5.0)),
]


def compressed_shell(Span):
    """A shell's net before it is form-found: a cross of four legs, Span from the end of one to the end
    of the one opposite, as one mesh of 16 quads, a quarter of them mirrored three ways. Ends: the
    straight edge at the end of each leg, where the shell stands."""
    k = Span / 20.0
    mesh, at = rg.Mesh(), {}

    def v(x, y):
        key = (round(x, 6), round(y, 6))
        if key not in at:
            at[key] = mesh.Vertices.Count
            mesh.Vertices.Add(P(k * x, k * y, 0.0))
        return at[key]

    for sx, sy in ((1, 1), (-1, 1), (1, -1), (-1, -1)):
        for quad in SHELL_QUADS:
            corners = [v(sx * x, sy * y) for x, y in quad]
            if sx * sy < 0:
                corners.reverse()
            mesh.Faces.AddFace(*corners)
    mesh.Normals.ComputeNormals()
    Ends = [L(P(-9.925 * k, -1.207 * k, 0), P(-9.925 * k, 1.207 * k, 0)),
            L(P(9.925 * k, -1.207 * k, 0), P(9.925 * k, 1.207 * k, 0)),
            L(P(-1.132 * k, -10 * k, 0), P(1.132 * k, -10 * k, 0)),
            L(P(-1.132 * k, 10 * k, 0), P(1.132 * k, 10 * k, 0))]
    return [mesh], Ends


# ---------------------------------------------------------------- the ground motion

# El Centro, 18 May 1940, the north-south component recorded at the Imperial Valley Irrigation District
# substation: a ground acceleration every 0.02 s, in g - the version OpenSees's examples use.
EL_CENTRO_DT = 0.02
EL_CENTRO = [
    0.00630, 0.00364, 0.00099, 0.00428, 0.00758, 0.01087, 0.00682, 0.00277, -0.00128, 0.00368,
    0.00864, 0.01360, 0.00727, 0.00094, 0.00420, 0.00221, 0.00021, 0.00444, 0.00867, 0.01290,
    0.01713, -0.00343, -0.02400, -0.00992, 0.00416, 0.00528, 0.01653, 0.02779, 0.03904, 0.02449,
    0.00995, 0.00961, 0.00926, 0.00892, -0.00486, -0.01864, -0.03242, -0.03365, -0.05723, -0.04534,
    -0.03346, -0.03201, -0.03056, -0.02911, -0.02766, -0.04116, -0.05466, -0.06816, -0.08166, -0.06846,
    -0.05527, -0.04208, -0.04259, -0.04311, -0.02428, -0.00545, 0.01338, 0.03221, 0.05104, 0.06987,
    0.08870, 0.04524, 0.00179, -0.04167, -0.08513, -0.12858, -0.17204, -0.12908, -0.08613, -0.08902,
    -0.09192, -0.09482, -0.09324, -0.09166, -0.09478, -0.09789, -0.12902, -0.07652, -0.02401, 0.02849,
    0.08099, 0.13350, 0.18600, 0.23850, 0.21993, 0.20135, 0.18277, 0.16420, 0.14562, 0.16143,
    0.17725, 0.13215, 0.08705, 0.04196, -0.00314, -0.04824, -0.09334, -0.13843, -0.18353, -0.22863,
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]


def elcentro(Duration, Scale):
    """The El Centro record's first Duration seconds, its accelerations times Scale, in m/s2: the
    Times and the Accelerations a Path Time Series takes, and how many steps of 0.02 s they make.
    Its peak, 0.32 g, comes 2.02 s in."""
    n = min(len(EL_CENTRO), int(round(Duration / EL_CENTRO_DT)) + 1)
    Times = [k * EL_CENTRO_DT for k in range(n)]
    Accelerations = [9.81 * Scale * a for a in EL_CENTRO[:n]]
    Steps = n - 1
    return Times, Accelerations, Steps


Lines, Feet, Tops = sticks(Sticks, Shortest, Tallest, Spacing)
# ---------- end response_spectrum_sticks ----------

# ---- group: 4 - Ground motion: a mass on every top, and El Centro 1940 along x, copied for every stick
ground_motion_scale = Slider(1, range=0..3)
duration_s = Slider(12, range=2..31)
damping = Slider(5, range=0..10)
mass_kg = Slider(4000, range=500..20000)
mass_kg_2 = VectorXYZ(XComponent=mass_kg, YComponent=mass_kg, ZComponent=mass_kg)  # -> Vector, Length
el_centro_1940 = GhPythonScript(Duration=duration_s, Scale=ground_motion_scale)  # -> out, Times, Accelerations, Steps
# ---------- el_centro_1940: Python ----------
"""The geometry of the conventional structures of Structures.py, one function a structure.

Structures.py puts one of them into a GhPython component, whose inputs are the function's arguments
and whose outputs are what it returns, in order: lines for each kind of member, the points the
structure is held at, and the widths its loads are worked out from. Every member is a straight line
between two nodes, cut wherever another member meets it, so that the elements share their nodes.

Runs in GhPython (Rhino 7 and 8) and in Rhino 8's Python 3 component alike.
"""
from __future__ import division

import math
import Rhino.Geometry as rg
from Grasshopper import DataTree
from Grasshopper.Kernel.Data import GH_Path


def P(x, y, z):
    return rg.Point3d(x, y, z)


def L(a, b):
    return rg.Line(a, b)


def pieces(a, b, n):
    """The line from a to b in n pieces."""
    n = max(1, int(n))
    return [L(a + (b - a) * (i / n), a + (b - a) * ((i + 1) / n)) for i in range(n)]


def chain(points):
    """The lines between one point and the next."""
    return [L(points[k], points[k + 1]) for k in range(len(points) - 1)]


def grid_mesh(xs, ys, z):
    """A mesh of quads over xs by ys at height z, its vertices where the lines of xs and ys cross."""
    mesh = rg.Mesh()
    for y in ys:
        for x in xs:
            mesh.Vertices.Add(P(x, y, z))
    cols = len(xs)
    for r in range(len(ys) - 1):
        for c in range(cols - 1):
            a = r * cols + c
            mesh.Faces.AddFace(a, a + 1, a + cols + 1, a + cols)
    return mesh


# ---------------------------------------------------------------- 1 - a steel hall roofed by trusses

def hall(Span, Bays, Spacing, Eaves, Depth, Panels):
    """Frames of a Pratt truss on two columns, Spacing apart, joined by purlins at the truss's top nodes.
    The columns rise to the top chord, the bottom chord meeting them at the eaves, so that each frame
    stands on pinned feet. The two end bays are braced: crosses in the roof, between the top chords,
    and in the long walls, with a strut along each wall at the eaves. PurlinWidths: the width of roof
    each purlin carries, a panel, or half of one at the eaves."""
    n = max(2, int(Panels) // 2 * 2)
    bays = max(1, int(Bays))
    dx = Span / n
    top = Eaves + Depth
    Columns, Chords, Webs, Purlins, PurlinWidths, Bracing, Struts, Feet = [], [], [], [], [], [], [], []
    for i in range(bays + 1):
        y = i * Spacing
        for x in (0.0, Span):
            Columns += [L(P(x, y, 0), P(x, y, Eaves)), L(P(x, y, Eaves), P(x, y, top))]
            Feet.append(P(x, y, 0))
        for k in range(n):
            x0, x1 = k * dx, (k + 1) * dx
            Chords += [L(P(x0, y, Eaves), P(x1, y, Eaves)), L(P(x0, y, top), P(x1, y, top))]
            # Pratt: the diagonals fall towards the middle, in tension under the roof's weight.
            if k < n // 2:
                Webs.append(L(P(x0, y, top), P(x1, y, Eaves)))
            else:
                Webs.append(L(P(x0, y, Eaves), P(x1, y, top)))
        Webs += [L(P(k * dx, y, Eaves), P(k * dx, y, top)) for k in range(1, n)]
    for i in range(bays):
        y0, y1 = i * Spacing, (i + 1) * Spacing
        for k in range(n + 1):
            Purlins.append(L(P(k * dx, y0, top), P(k * dx, y1, top)))
            PurlinWidths.append(dx / 2 if k in (0, n) else dx)
        for x in (0.0, Span):
            Struts.append(L(P(x, y0, Eaves), P(x, y1, Eaves)))
        if i in (0, bays - 1):
            for k in range(n):
                Bracing += [L(P(k * dx, y0, top), P((k + 1) * dx, y1, top)),
                            L(P((k + 1) * dx, y0, top), P(k * dx, y1, top))]
            for x in (0.0, Span):
                Bracing += [L(P(x, y0, 0), P(x, y1, Eaves)), L(P(x, y1, 0), P(x, y0, Eaves))]
    return Columns, Chords, Webs, Purlins, PurlinWidths, Bracing, Struts, Feet


# ---------------------------------------------------------------- 2 - a steel tower with a stair

def tower(Width, Levels, Storey):
    """Four legs Width apart, a landing at every level and a crossed bracing on every face of every
    storey. A straight flight of stairs climbs each storey along a strip a metre wide across the
    middle, turning back at each landing: two stringers, from one side of the landing below to the
    other side of the landing above. A landing is its four edge beams and two cross beams along the
    strip, its Strip, which the stringers start and end on. The legs on the windward side, x = 0, are
    WindwardLegs, for the wind."""
    levels = max(1, int(Levels))
    w = Width
    y1, y2 = 0.5 * w - 0.5, 0.5 * w + 0.5
    corners = [(0, 0), (w, 0), (w, w), (0, w)]
    Legs, WindwardLegs, Bracing, Landings, Strip, Stringers, Feet = [], [], [], [], [], [], []
    for x, y in corners:
        Feet.append(P(x, y, 0))
        legs = pieces(P(x, y, 0), P(x, y, levels * Storey), levels)
        (WindwardLegs if x == 0 else Legs).extend(legs)
    for j in range(levels):
        z0, z1 = j * Storey, (j + 1) * Storey
        for k in range(4):
            (ax, ay), (bx, by) = corners[k], corners[(k + 1) % 4]
            Bracing += [L(P(ax, ay, z0), P(bx, by, z1)), L(P(bx, by, z0), P(ax, ay, z1))]
        # The landing at the top of the storey: the sides along y cut where the strip meets them.
        Landings += [L(P(0, 0, z1), P(w, 0, z1)), L(P(0, w, z1), P(w, w, z1))]
        for x in (0.0, w):
            Landings += [L(P(x, 0, z1), P(x, y1, z1)), L(P(x, y1, z1), P(x, y2, z1)), L(P(x, y2, z1), P(x, w, z1))]
        Strip += [L(P(0, y1, z1), P(w, y1, z1)), L(P(0, y2, z1), P(w, y2, z1))]
        # The flight: up along +x in even storeys, back along -x in odd ones.
        a, b = (0.0, w) if j % 2 == 0 else (w, 0.0)
        Stringers += [L(P(a, y, z0), P(b, y, z1)) for y in (y1, y2)]
    # The ground has no landing beams: the first flight starts on its own footing.
    Feet += [P(0.0, y, 0) for y in (y1, y2)]
    return Legs, WindwardLegs, Bracing, Landings, Strip, Stringers, Feet


# ---------------------------------------------------------------- 3 - a canopy on T-shaped frames

def canopy(Frames, Spacing, Height, Cantilever, Rise, Purlins):
    """A row of frames, Spacing apart: a column built in at its foot and an arm cantilevering each way
    from its head, rising Rise to its tip. Purlins join the frames at the head and at Purlins points
    along each arm. A cross between two columns in the middle bay holds the row lengthways.
    LeftWidths and RightWidths: the width of roof, on plan, each purlin carries on the left (-x) and
    the right (+x) of the frames, nothing on the other side: a purlin's share, or half at a tip or the
    head."""
    frames = max(2, int(Frames))
    m = max(1, int(Purlins))
    s = Cantilever / m
    Columns, Arms, Purlins, LeftWidths, RightWidths, Bracing, Feet = [], [], [], [], [], [], []
    for i in range(frames):
        y = i * Spacing
        Columns.append(L(P(0, y, 0), P(0, y, Height)))
        Feet.append(P(0, y, 0))
        for side in (-1, 1):
            Arms += pieces(P(0, y, Height), P(side * Cantilever, y, Height + Rise), m)
    for i in range(frames - 1):
        y0, y1 = i * Spacing, (i + 1) * Spacing
        Purlins.append(L(P(0, y0, Height), P(0, y1, Height)))
        LeftWidths.append(s / 2)
        RightWidths.append(s / 2)
        for side in (-1, 1):
            for k in range(1, m + 1):
                Purlins.append(L(P(side * k * s, y0, Height + k * Rise / m), P(side * k * s, y1, Height + k * Rise / m)))
                width = s / 2 if k == m else s
                LeftWidths.append(width if side < 0 else 0.0)
                RightWidths.append(width if side > 0 else 0.0)
    middle = (frames - 1) // 2
    y0, y1 = middle * Spacing, (middle + 1) * Spacing
    Bracing += [L(P(0, y0, 0), P(0, y1, Height)), L(P(0, y1, 0), P(0, y0, Height))]
    return Columns, Arms, Purlins, LeftWidths, RightWidths, Bracing, Feet


# ---------------------------------------------------------------- 4 - a facade stiffened by vertical trusses

def facade(Bays, BayWidth, Height, Levels, Depth, TrussEvery):
    """A glass wall Height tall in the plane y = 0, held only at its foot and its top, as a lobby's is:
    mullions every BayWidth and transoms between them at Levels heights. Behind every TrussEvery-th
    mullion a vertical truss stiffens it against the wind: the mullion is its outer chord, a tube
    Depth behind it the inner chord, with a post at every transom and diagonals zig-zagging between.
    The mullions stand on their feet and are held across the wall at the top; the inner chords too,
    and along the wall at the top as well, which nothing else holds them in.
    MullionWidths: the width of wall each piece of mullion catches the wind over, a bay or half of one
    at the ends. PanelHeight: the height of glass each transom carries."""
    bays, levels, every = max(1, int(Bays)), max(2, int(Levels)), max(1, int(TrussEvery))
    dz = Height / levels
    Mullions, MullionWidths, Transoms, Chords, Posts, Diagonals = [], [], [], [], [], []
    Base, Tops, ChordBase, ChordTops = [], [], [], []
    for i in range(bays + 1):
        x = i * BayWidth
        Mullions += pieces(P(x, 0, 0), P(x, 0, Height), levels)
        MullionWidths += [BayWidth / 2 if i in (0, bays) else BayWidth] * levels
        Base.append(P(x, 0, 0))
        Tops.append(P(x, 0, Height))
        if i % every:
            continue
        Chords += pieces(P(x, Depth, 0), P(x, Depth, Height), levels)
        Posts += [L(P(x, 0, k * dz), P(x, Depth, k * dz)) for k in range(levels + 1)]
        for k in range(levels):
            z0, z1 = k * dz, (k + 1) * dz
            Diagonals.append(L(P(x, 0, z0), P(x, Depth, z1)) if k % 2 == 0 else L(P(x, Depth, z0), P(x, 0, z1)))
        ChordBase.append(P(x, Depth, 0))
        ChordTops.append(P(x, Depth, Height))
    for k in range(1, levels):
        Transoms += [L(P(i * BayWidth, 0, k * dz), P((i + 1) * BayWidth, 0, k * dz)) for i in range(bays)]
    PanelHeight = dz
    return Mullions, MullionWidths, Transoms, Chords, Posts, Diagonals, Base, Tops, ChordBase, ChordTops, PanelHeight


# ---------------------------------------------------------------- 5 - a barrel vault under wind

def vault(Span, Rise, Length, Strips, Divisions, Windward, Crown, Leeward):
    """A barrel vault spanning Span across x, Rise high, Length long along y: the arc of a circle
    through its two feet and its crown, cut into Strips strips along its length, each a mesh of quads
    Divisions long. A strip's faces all face the same way, so one pressure on a strip acts along one
    direction. The pressure coefficients of the windward quarter, the middle half and the leeward
    quarter, wind blowing along +x, are given to each strip by where its middle is, with the strip's
    outward Normal: a positive coefficient pushes on the vault, along -Normal, a negative one pulls it
    away. The feet are held along both long edges."""
    strips, divisions = max(4, int(Strips)), max(1, int(Divisions))
    r = (0.25 * Span * Span + Rise * Rise) / (2 * Rise)
    zc = Rise - r
    # Half the angle the arc spans, from the crown to a foot: past 90 degrees for more than a semicircle.
    half = math.atan2(0.5 * Span, r - Rise)

    def at(t, y):
        a = -half + 2 * half * t
        return P(0.5 * Span + r * math.sin(a), y, zc + r * math.cos(a))

    Strip, Names, Coefficients, Normals, Feet = [], [], [], [], []
    for s in range(strips):
        mesh = rg.Mesh()
        for k in range(divisions + 1):
            y = Length * k / divisions
            mesh.Vertices.Add(at(s / strips, y))
            mesh.Vertices.Add(at((s + 1) / strips, y))
        for k in range(divisions):
            mesh.Faces.AddFace(2 * k, 2 * k + 1, 2 * k + 3, 2 * k + 2)
        mesh.Normals.ComputeNormals()
        Strip.append(mesh)
        Names.append("Strip_{0}".format(s))
        middle = (s + 0.5) / strips
        Coefficients.append(Windward if middle < 0.25 else Leeward if middle > 0.75 else Crown)
        a = -half + 2 * half * middle
        Normals.append(rg.Vector3d(math.sin(a), 0, math.cos(a)))
    for k in range(divisions + 1):
        y = Length * k / divisions
        Feet += [at(0, y), at(1, y)]
    return Strip, Names, Coefficients, Normals, Feet


# ---------------------------------------------------------------- 6 - a facade held by wind trusses

def windtruss(Width, Height, Spacing, Depth, Trusses):
    """A tall glass facade Width wide and Height high in the plane y = 0, its mullions Spacing apart
    standing on their feet and held across the facade at the top, and at Trusses levels between by
    horizontal trusses behind it. Each truss spans the whole width between the building's columns at
    its two ends: its outer chord runs through the mullions, its inner chord Depth behind, with a
    post at every mullion and diagonals between, falling towards the middle. MullionWidths: the width
    of facade each piece of mullion catches the wind over, its spacing or half of it at the ends."""
    n = max(2, int(round(Width / Spacing)))
    s = Width / n
    trusses = max(1, int(Trusses))
    levels = [Height * (k + 1) / (trusses + 1) for k in range(trusses)]
    heights = [0.0] + levels + [Height]
    Mullions, MullionWidths, Chords, Posts, Diagonals, Base, Tops, TrussEnds = [], [], [], [], [], [], [], []
    for i in range(n + 1):
        x = i * s
        Mullions += [L(P(x, 0, heights[k]), P(x, 0, heights[k + 1])) for k in range(len(heights) - 1)]
        MullionWidths += [s / 2 if i in (0, n) else s] * (len(heights) - 1)
        Base.append(P(x, 0, 0))
        Tops.append(P(x, 0, Height))
    for z in levels:
        for i in range(n):
            x0, x1 = i * s, (i + 1) * s
            Chords += [L(P(x0, 0, z), P(x1, 0, z)), L(P(x0, Depth, z), P(x1, Depth, z))]
            if i < n // 2:
                Diagonals.append(L(P(x0, Depth, z), P(x1, 0, z)))
            else:
                Diagonals.append(L(P(x0, 0, z), P(x1, Depth, z)))
        Posts += [L(P(i * s, 0, z), P(i * s, Depth, z)) for i in range(n + 1)]
        TrussEnds += [P(0, 0, z), P(0, Depth, z), P(Width, 0, z), P(Width, Depth, z)]
    return Mullions, MullionWidths, Chords, Posts, Diagonals, Base, Tops, TrussEnds


# ---------------------------------------------------------------- 7 - a girder bridge on piers

def girder(SideSpan, MainSpan, PierHeight, Segment):
    """A continuous concrete deck over three spans - SideSpan, MainSpan, SideSpan - on two piers
    PierHeight tall. The deck is a slab 12 m wide on two girders 6 m apart, joined by a cross girder
    every other Segment; each pier is two round columns, one under each girder, braced by a strut
    halfway up and joined on top by a deeper cross girder, its cap. The deck is built into the piers
    and slides along on bearings at its two ends, held there across. Watch: the deck in the middle
    of the main span, whose movement the pictures plot."""
    H, g, w = PierHeight, 3.0, 6.0
    length = 2 * SideSpan + MainSpan
    piers = (SideSpan, SideSpan + MainSpan)
    xs = [0.0]
    for a, b in [(0.0, SideSpan), (SideSpan, SideSpan + MainSpan), (SideSpan + MainSpan, length)]:
        n = max(1, int(round((b - a) / Segment)))
        xs += [a + (b - a) * (i + 1) / n for i in range(n)]
    ys = [-w, -g, 0.0, g, w]
    Girders = []
    for y in (-g, g):
        Girders += chain([P(x, y, H) for x in xs])
    Slab = [grid_mesh(xs, ys, H)]
    CrossGirders, PierCaps = [], []
    for k, x in enumerate(xs):
        across = chain([P(x, y, H) for y in (-g, 0.0, g)])
        if any(abs(x - p) < 1e-6 for p in piers):
            PierCaps += across
        elif k % 2 == 0 or k == len(xs) - 1:
            CrossGirders += across
    Columns, Struts, Feet = [], [], []
    for x in piers:
        for y in (-g, g):
            Columns += pieces(P(x, y, 0), P(x, y, 0.5 * H), 3) + pieces(P(x, y, 0.5 * H), P(x, y, H), 3)
            Feet.append(P(x, y, 0))
        Struts += chain([P(x, y, 0.5 * H) for y in (-g, 0.0, g)])
    Bearings = [P(x, y, H) for x in (0.0, length) for y in (-g, g)]
    Watch = [P(0.5 * length, 0, H)]
    return Girders, CrossGirders, PierCaps, Columns, Struts, Slab, Feet, Bearings, Watch


# ---------------------------------------------------------------- 8 - a cable-stayed bridge

def cablestayed(Span, DeckHeight, PylonHeight, Width, Stays):
    """Two spans of Span each side of an H-shaped pylon: two legs Width apart, from the ground to
    PylonHeight above the deck, joined at the top. The deck is two edge girders joined by floor beams
    wherever a stay holds them, Stays a side in each span, the stays in two planes, fanning from the
    top quarter of each leg. The girders are built into the legs, and slide along their abutments.
    Watch: the deck in the middle of a span, and the top of the pylon."""
    n = max(2, int(Stays))
    w = 0.5 * Width
    top = DeckHeight + PylonHeight
    spacing = Span / (n + 1)
    xs = [-Span + k * spacing for k in range(2 * n + 3)]
    Girders, FloorBeams, Legs, CrossBeams, Cables, Feet, Bearings = [], [], [], [], [], [], []
    for y in (-w, w):
        Girders += [L(P(xs[k], y, DeckHeight), P(xs[k + 1], y, DeckHeight)) for k in range(len(xs) - 1)]
        Legs += pieces(P(0, y, 0), P(0, y, DeckHeight), 4)
        anchors = [DeckHeight + PylonHeight * (0.75 + 0.25 * j / (n - 1)) for j in range(n)]
        levels = [DeckHeight] + sorted(set(anchors))
        Legs += [L(P(0, y, levels[k]), P(0, y, levels[k + 1])) for k in range(len(levels) - 1)]
        Feet.append(P(0, y, 0))
        for side in (-1, 1):
            for j in range(n):
                # The outermost stay from the highest anchor, the innermost from the lowest.
                x = side * spacing * (j + 1)
                Cables.append(L(P(0, y, anchors[j]), P(x, y, DeckHeight)))
        Bearings += [P(-Span, y, DeckHeight), P(Span, y, DeckHeight)]
    FloorBeams += [L(P(x, -w, DeckHeight), P(x, w, DeckHeight)) for x in xs]
    CrossBeams += [L(P(0, -w, top), P(0, w, top))]
    Watch = [P(0.5 * Span, 0, DeckHeight), P(0, -w, top)]
    return Girders, FloorBeams, Legs, CrossBeams, Cables, Feet, Bearings, Watch


# ---------------------------------------------------------------- 9 - a deck arch bridge

def arch(Span, Rise, Columns, DeckAbove):
    """Two concrete arch ribs Span across and Rise high, parabolas springing from the ground 12 m
    apart and leaning in to 7 m apart at the crown, braced by a strut at every column. They carry a
    deck DeckAbove the crown on Columns pairs of spandrel columns, evenly spaced, built into both: a
    slab 11 m wide on two girders, joined by a floor beam on every pair of columns. The deck runs on
    to the abutments at its two ends, where it slides along, held across; the ribs are built in at
    their springings. Watch: the deck at the crown."""
    n = max(2, int(Columns))
    deck = Rise + DeckAbove
    spring, crown, g, w = 6.0, 3.5, 4.0, 5.5
    zs = lambda x: 4.0 * Rise * x * (Span - x) / (Span * Span)
    bs = lambda x: spring - (spring - crown) * zs(x) / Rise
    xs = [Span * k / (n + 1) for k in range(n + 2)]
    # The ribs and the deck, cut at every column and halfway between.
    ts = sorted(set([x for x in xs] + [0.5 * (xs[k] + xs[k + 1]) for k in range(len(xs) - 1)]))
    Ribs, Girders, SpandrelColumns = [], [], []
    for side in (-1, 1):
        Ribs += chain([P(t, side * bs(t), zs(t)) for t in ts])
        Girders += chain([P(t, side * g, deck) for t in ts])
        SpandrelColumns += [L(P(x, side * bs(x), zs(x)), P(x, side * g, deck)) for x in xs[1:-1]]
    Struts = [L(P(x, -bs(x), zs(x)), P(x, bs(x), zs(x))) for x in xs[1:-1]]
    FloorBeams = []
    for x in xs:
        FloorBeams += chain([P(x, y, deck) for y in (-g, 0.0, g)])
    Slab = [grid_mesh(ts, [-w, -g, 0.0, g, w], deck)]
    Springings = [P(x, y, 0) for x in (0.0, Span) for y in (-spring, spring)]
    Abutments = [P(x, y, deck) for x in (0.0, Span) for y in (-g, g)]
    Watch = [P(0.5 * Span, 0, deck)]
    return Ribs, Struts, Girders, FloorBeams, SpandrelColumns, Slab, Springings, Abutments, Watch


# ---------------------------------------------------------------- 10 - a building, and a tiny city of them

def _building(x0, y0, bay, height, floors, balconies=False, depth=1.5, split=1):
    """A steel frame on a grid of bay, x0, y0 its first corner: floors, from the first up, are the
    cells (i, j) each floor covers, every one inside the one under it, so that a column stands
    under every corner of a floor. Each floor has beams round its cells, cut split times a bay, and
    a slab mesh of quads on the beams' nodes; balconies: on every floor with the same floor over it,
    a slab depth deep along the south faces, on cantilevers at the columns and an edge beam."""
    Columns, Beams, Slabs, Feet = [], [], [], []
    n = max(1, int(split))
    pt = lambda i, j, k: P(x0 + i * bay, y0 + j * bay, k * height)
    corners = lambda cells: sorted(set((i + a, j + b) for (i, j) in cells for a in (0, 1) for b in (0, 1)))
    edges = lambda cells: sorted(set(e for (i, j) in cells for e in
                                     [((i, j), (i + 1, j)), ((i, j + 1), (i + 1, j + 1)), ((i, j), (i, j + 1)), ((i + 1, j), (i + 1, j + 1))]))
    Feet += [pt(i, j, 0) for (i, j) in corners(floors[0])]
    for k, cells in enumerate(floors, 1):
        Columns += [L(pt(i, j, k - 1), pt(i, j, k)) for (i, j) in corners(cells)]
        for a, b in edges(cells):
            Beams += pieces(pt(a[0], a[1], k), pt(b[0], b[1], k), n)
        mesh, at = rg.Mesh(), {}

        def v(point):
            key = (round(point.X, 6), round(point.Y, 6))
            if key not in at:
                at[key] = mesh.Vertices.Count
                mesh.Vertices.Add(point)
            return at[key]

        for (i, j) in sorted(cells):
            for a in range(n):
                for b in range(n):
                    q = [pt(i + (a + da) / n, j + (b + db) / n, k) for da, db in ((0, 0), (1, 0), (1, 1), (0, 1))]
                    mesh.Faces.AddFace(*[v(p) for p in q])
        if balconies and k < len(floors) and floors[k] == cells:
            out = rg.Vector3d(0, -depth, 0)
            south = [(i, j) for (i, j) in sorted(cells) if (i, j - 1) not in cells]
            for (i, j) in sorted(set(c for (i, j) in south for c in ((i, j), (i + 1, j)))):
                Beams.append(L(pt(i, j, k), pt(i, j, k) + out))
            for (i, j) in south:
                for a in range(n):
                    p, q = pt(i + a / n, j, k), pt(i + (a + 1) / n, j, k)
                    Beams.append(L(p + out, q + out))
                    mesh.Faces.AddFace(v(p + out), v(q + out), v(q), v(p))
        Slabs.append(mesh)
    return Columns, Beams, Slabs, Feet


def building(BaysX, BaysY, Bay, Storeys, StoreyHeight):
    """An office building: a steel frame BaysX by BaysY bays of Bay, Storeys storeys of StoreyHeight,
    columns built in at the ground, and a concrete slab at every floor on the beams, meshed twice a
    bay. Its mass is its members' and its slabs' own. Watch: a corner of the roof."""
    cells = _rect(max(1, int(BaysX)), max(1, int(BaysY)))
    storeys = max(1, int(Storeys))
    Columns, Beams, Slabs, Feet = _building(0.0, 0.0, Bay, StoreyHeight, [cells] * storeys, split=2)
    Watch = [P(0, 0, storeys * StoreyHeight)]
    return Columns, Beams, Slabs, Feet, Watch


def _rect(a, b):
    """The cells of a rectangle a bays by b."""
    return frozenset((i, j) for i in range(a) for j in range(b))


def _ell(a, b):
    """An L: the rectangle a by b without its far corner."""
    return _rect(a, b) - frozenset([(a - 1, b - 1)])


# The buildings of the city, row by row, low next to tall as a city grows: the footprint of each, in
# bays, its storeys, what tops it - a smaller footprint for its last few storeys - what it stands on
# - a wider one for its first few - and whether its south face has balconies.
CITY = [
    (_rect(3, 2), 2, None, None, False),
    (_ell(2, 2), 9, None, None, True),
    (_rect(2, 2), 4, (_rect(1, 1), 1), None, False),
    (_rect(2, 1), 16, None, None, True),
    (_ell(3, 2), 6, None, None, False),
    (_rect(2, 2), 12, None, None, True),
    (_rect(3, 1), 3, None, None, False),
    (_rect(2, 2), 20, (_rect(1, 1), 2), (_rect(3, 3), 2), False),
    (_rect(1, 2), 14, None, None, True),
    (_rect(2, 1), 5, (_rect(1, 1), 1), None, False),
    (_ell(2, 2), 10, (_rect(1, 1), 2), None, False),
    (_rect(2, 2), 2, None, None, False),
    (_rect(3, 1), 7, None, None, True),
    (_rect(2, 1), 18, None, (_rect(3, 2), 3), False),
    (_ell(2, 2), 3, None, None, False),
    (_rect(2, 2), 11, (_rect(2, 1), 2), None, True),
]


def city(Rows, ColumnsPerRow, Street, Bay, StoreyHeight):
    """A tiny city: Rows by ColumnsPerRow buildings of CITY, steel frames on a grid of Bay with a
    slab at every floor, Street between their plots of three bays square. Rectangles, Ls, towers
    on podiums and with penthouses, some with balconies: on the same ground each shakes in its own
    way, a low one stiff and quick, a tall one slow and soft, an L or a tower off its podium's
    middle twisting as it sways. Watch: a corner of each building's roof; Storeys: how many it has."""
    Columns, Beams, Slabs, Feet, Watch, Storeys = [], [], [], [], [], []
    rows, cols = max(1, int(Rows)), max(1, int(ColumnsPerRow))
    plot = 3 * Bay + Street
    for r in range(rows):
        for c in range(cols):
            cells, storeys, top, podium, balconies = CITY[(r * cols + c) % len(CITY)]
            low, high = podium[1] if podium else 0, top[1] if top else 0
            floors = ([podium[0]] * low if podium else []) + [cells] * (storeys - low - high) + \
                ([top[0]] * high if top else [])
            parts = _building(c * plot, r * plot, Bay, StoreyHeight, floors, balconies)
            Columns += parts[0]
            Beams += parts[1]
            Slabs += parts[2]
            Feet += parts[3]
            i, j = min(floors[-1])
            Watch.append(P(c * plot + i * Bay, r * plot + j * Bay, storeys * StoreyHeight))
            Storeys.append(storeys)
    return Columns, Beams, Slabs, Feet, Watch, Storeys


# ---------------------------------------------------------------- 12 - a footbridge's natural modes

def footbridge(Span, Width, Segment, Depth):
    """A footbridge of one span, Span long: a concrete deck Width wide and 200 mm thick on a steel box
    girder Depth deep down its middle, cut every Segment or so. The deck is meshed in quads, one
    across each half, its middle plane at Z = 0; the box's axis is under it, its top against the
    deck's underside, and each of its nodes is tied to the deck's node above by a rigid link, so that
    the two bend together. The box is held at both ends: a pinned bearing at the start, one sliding
    along at the far end. Box: its lines; Deck: the deck's mesh; Under and Over: each link's two
    nodes, the box's and the deck's; Pinned and Sliding: the box's two ends."""
    n = max(2, int(round(Span / Segment)))
    xs = [Span * i / n for i in range(n + 1)]
    z = -(0.1 + 0.5 * Depth)
    Box = chain([P(x, 0, z) for x in xs])
    Deck = [grid_mesh(xs, [-0.5 * Width, 0.0, 0.5 * Width], 0.0)]
    Under = [P(x, 0, z) for x in xs]
    Over = [P(x, 0, 0) for x in xs]
    return Box, Deck, Under, Over, [Under[0]], [Under[-1]]


# ---------------------------------------------------------------- 13 - sticks that draw a response spectrum

def sticks(Sticks, Shortest, Tallest, Spacing):
    """A row of Sticks steel sticks along x, Spacing apart, from Shortest to Tallest: each a
    cantilever from the ground to a mass at its top, an oscillator of one degree of freedom along
    the shaking. A cantilever's period goes as its height to the power 1.5, so their heights are
    spread for their periods to be spread evenly: along the row, x reads as the period axis of a
    response spectrum. Each stick is a model of its own, a branch of the trees: Lines, one line;
    Feet, where it is held; Tops, where its mass sits."""
    n = max(2, int(Sticks))
    low, high = Shortest ** 1.5, Tallest ** 1.5
    Lines, Feet, Tops = DataTree[object](), DataTree[object](), DataTree[object]()
    for i in range(n):
        h = (low + (high - low) * i / (n - 1)) ** (2.0 / 3.0)
        foot, top = P(i * Spacing, 0, 0), P(i * Spacing, 0, h)
        path = GH_Path(i)
        Lines.Add(L(foot, top), path)
        Feet.Add(foot, path)
        Tops.Add(top, path)
    return Lines, Feet, Tops


# How tall the spectrum stands behind the sticks: metres to 1 g of pseudo-acceleration.
SPECTRUM_SCALE = 8.0
# How far behind the sticks it stands, m.
SPECTRUM_BEHIND = 3.0


def spectrum(Periods, Displacements, Tops):
    """The response spectrum the sticks draw. Periods: each stick's, a branch each, from its Natural
    Vibration Analysis; Displacements: the sticks' displacements at every step of their
    transient analyses, from Nodal Displacements with History on, a branch a step. Sd is
    the most its top moved from the ground at any step, along x, in mm; PSa, its pseudo-acceleration, Sd times
    (2 pi / T) squared, in g. Spectrum and Grid draw them as a chart standing behind the sticks, its
    period axis along the row and its PSa SPECTRUM_SCALE m to the g: a line through each stick's
    PSa, and lines at every 0.25 g."""
    periods = [max(Periods.Branch(p)) for p in Periods.Paths if Periods.Branch(p).Count]
    n = len(periods)
    # Nodal Displacements gives a branch a step, every stick's nodes in it one after another, in the
    # order of the sticks; each stick's top moves the most.
    peaks = [0.0] * n
    for path in Displacements.Paths:
        moves = list(Displacements.Branch(path))
        each = len(moves) // n if n else 0
        for i in range(n if each else 0):
            peaks[i] = max([peaks[i]] + [abs(v.X) for v in moves[i * each:(i + 1) * each]])
    Period, Sd, PSa = [], [], []
    for T, peak in zip(periods, peaks):
        Period.append(T)
        Sd.append(1000.0 * peak)
        PSa.append((2 * math.pi / T) ** 2 * peak / 9.81)
    xs = [Tops.Branch(p)[0].X for p in Tops.Paths][:len(PSa)]
    y = SPECTRUM_BEHIND
    Spectrum = rg.Polyline([P(x, y, a * SPECTRUM_SCALE) for x, a in zip(xs, PSa)]).ToNurbsCurve()
    Grid = []
    if xs:
        for k in range(int(math.ceil(max(PSa) / 0.25)) + 1):
            z = 0.25 * k * SPECTRUM_SCALE
            Grid.append(L(P(xs[0], y, z), P(xs[-1], y, z)))
    return Period, Sd, PSa, Spectrum, Grid


# ---------------------------------------------------------------- 14 - a shell form-found to work in compression

# The plan of the shell, a cross of four legs 20 m from end to end, in 16 quads round its middle: the
# coarse net Kangaroo refines and pushes up. Its corners, from the middle out, x and y in m.
SHELL_QUADS = [
    ((-9.925, -1.207), (-9.925, 0.0), (-4.521, 0.0), (-5.356, -2.616)),
    ((-5.356, -2.616), (-4.521, 0.0), (0.0, -5.0), (-2.544, -5.451)),
    ((-2.544, -5.451), (0.0, -5.0), (0.0, -10.0), (-1.132, -10.0)),
    ((-4.521, 0.0), (-2.0, 0.0), (0.0, -2.0), (0.0, -5.0)),
]


def compressed_shell(Span):
    """A shell's net before it is form-found: a cross of four legs, Span from the end of one to the end
    of the one opposite, as one mesh of 16 quads, a quarter of them mirrored three ways. Ends: the
    straight edge at the end of each leg, where the shell stands."""
    k = Span / 20.0
    mesh, at = rg.Mesh(), {}

    def v(x, y):
        key = (round(x, 6), round(y, 6))
        if key not in at:
            at[key] = mesh.Vertices.Count
            mesh.Vertices.Add(P(k * x, k * y, 0.0))
        return at[key]

    for sx, sy in ((1, 1), (-1, 1), (1, -1), (-1, -1)):
        for quad in SHELL_QUADS:
            corners = [v(sx * x, sy * y) for x, y in quad]
            if sx * sy < 0:
                corners.reverse()
            mesh.Faces.AddFace(*corners)
    mesh.Normals.ComputeNormals()
    Ends = [L(P(-9.925 * k, -1.207 * k, 0), P(-9.925 * k, 1.207 * k, 0)),
            L(P(9.925 * k, -1.207 * k, 0), P(9.925 * k, 1.207 * k, 0)),
            L(P(-1.132 * k, -10 * k, 0), P(1.132 * k, -10 * k, 0)),
            L(P(-1.132 * k, 10 * k, 0), P(1.132 * k, 10 * k, 0))]
    return [mesh], Ends


# ---------------------------------------------------------------- the ground motion

# El Centro, 18 May 1940, the north-south component recorded at the Imperial Valley Irrigation District
# substation: a ground acceleration every 0.02 s, in g - the version OpenSees's examples use.
EL_CENTRO_DT = 0.02
EL_CENTRO = [
    0.00630, 0.00364, 0.00099, 0.00428, 0.00758, 0.01087, 0.00682, 0.00277, -0.00128, 0.00368,
    0.00864, 0.01360, 0.00727, 0.00094, 0.00420, 0.00221, 0.00021, 0.00444, 0.00867, 0.01290,
    0.01713, -0.00343, -0.02400, -0.00992, 0.00416, 0.00528, 0.01653, 0.02779, 0.03904, 0.02449,
    0.00995, 0.00961, 0.00926, 0.00892, -0.00486, -0.01864, -0.03242, -0.03365, -0.05723, -0.04534,
    -0.03346, -0.03201, -0.03056, -0.02911, -0.02766, -0.04116, -0.05466, -0.06816, -0.08166, -0.06846,
    -0.05527, -0.04208, -0.04259, -0.04311, -0.02428, -0.00545, 0.01338, 0.03221, 0.05104, 0.06987,
    0.08870, 0.04524, 0.00179, -0.04167, -0.08513, -0.12858, -0.17204, -0.12908, -0.08613, -0.08902,
    -0.09192, -0.09482, -0.09324, -0.09166, -0.09478, -0.09789, -0.12902, -0.07652, -0.02401, 0.02849,
    0.08099, 0.13350, 0.18600, 0.23850, 0.21993, 0.20135, 0.18277, 0.16420, 0.14562, 0.16143,
    0.17725, 0.13215, 0.08705, 0.04196, -0.00314, -0.04824, -0.09334, -0.13843, -0.18353, -0.22863,
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]


def elcentro(Duration, Scale):
    """The El Centro record's first Duration seconds, its accelerations times Scale, in m/s2: the
    Times and the Accelerations a Path Time Series takes, and how many steps of 0.02 s they make.
    Its peak, 0.32 g, comes 2.02 s in."""
    n = min(len(EL_CENTRO), int(round(Duration / EL_CENTRO_DT)) + 1)
    Times = [k * EL_CENTRO_DT for k in range(n)]
    Accelerations = [9.81 * Scale * a for a in EL_CENTRO[:n]]
    Steps = n - 1
    return Times, Accelerations, Steps


Times, Accelerations, Steps = elcentro(Duration, Scale)
# ---------- end el_centro_1940 ----------
ground_acceleration = PathTimeSeriesAlpaca4d(Times=el_centro_1940.Times, Values=el_centro_1940.Accelerations, LoadFactor=1)  # -> TimeSeries, Graph
mass_on_top = MassPointAlpaca4d(Point=response_spectrum_sticks.Tops, TransMass=mass_kg_2.Vector, RotationalMass=Vector(0, 0, 0))
el_centro_along_x = LoadPatternAlpaca4d(Dof="X", TimeSeries=ground_acceleration.TimeSeries, Velocity=0, Factor=1, mode="UniformExcitation (Alpaca4d)")
a_pattern_a_stick = DuplicateData(Data=el_centro_along_x, Number=sticks, Order=True)
on_the_masses_branches = UnflattenTree(Tree=a_pattern_a_stick, Guide=mass_on_top)

# ---- group: 2 - Members: a steel tube, 219.1x8, built in at the ground
s355 = MaterialLibraryElasticAlpaca4d(
    MaterialName="S355",
    Colour=RGB(190, 194, 199),
    MaterialPresetElastic_Grade="S235",
    MaterialPresetElastic_Model="Uniaxial",
    MaterialPresetElastic_Type="Steel",
    menu=[dropdown(0), dropdown(1), dropdown(0)])
_219_1x8 = SteelSectionLibraryAlpaca4d(SectionName="219.1x8", Material=s355, menu=[dropdown(0), dropdown(1)])
sticks_2 = ForceBeamColumnAlpaca4d(Line=response_spectrum_sticks.Lines, Section=_219_1x8, Colour=RGB(1, 30, 254), mode="ForceBeamColumn (Alpaca4d)")

# ---- group: 3 - Supports: every stick built in at the ground
built_in = SupportAlpaca4d(
    Position=response_spectrum_sticks.Feet,
    Tx=True,
    Ty=True,
    Tz=True,
    Rx=True,
    Ry=True,
    Rz=True,
    mode="Support Rigid (Alpaca4d)")

# ---- group: 5 - Analysis: a model per stick - its period, damping of 5% at it, a transient analysis in 0.005 s steps
displacements_only = MPCORecorderAlpaca4d(
    FileName="recorder.mpco",
    menu=[checkbox(on), checkbox(off), checkbox(off), checkbox(off), checkbox(off), checkbox(off), checkbox(off), checkbox(off), checkbox(off), checkbox(off), checkbox(off), checkbox(off)])
response_spectrum_sticks_2 = AssembleModelAlpaca4d(
    Elements=sticks_2,
    Supports=built_in,
    LoadPatterns=[mass_on_top, on_the_masses_branches],
    Recorders=displacements_only,
    Tolerance=0.01)  # -> AlpacaModel, Mass
# Response spectrum sticks: Response spectrum sticks - a row of sticks shaken by one earthquake, which together draw its response spectrum.
# 
# Each stick is a steel tube built in at the ground with a mass on top: an oscillator with one way to swing, at its own period. Short ones are stiff and quick, tall ones soft and slow; their heights are spread so that their periods are spread evenly, from about 0.1 s to 3 s.
# 
# Each stick is a model of its own, a branch of the trees, so that each can have damping of exactly Damping % of critical at its own frequency, which its Natural Vibration Analysis gives. A transient analysis shakes every one with the same ground motion, El Centro 1940, 0.005 s at a time.
# 
# The most its top moves from the ground, Sd, is the spectral displacement at its period; times (2 pi / T) squared, the pseudo-acceleration PSa. Plotted against the periods, they are the earthquake's response spectrum: the curve a response spectrum analysis reads its accelerations from.
each_stick_s_period = NaturalVibrationAnalysisAlpaca4d(AlpacaModel=response_spectrum_sticks_2.AlpacaModel, VibrationModes=1, Solver="-fullGenLapack")  # -> AlpacaModel, Eigenvalues, Period, Frequencies, Log, EigenValueAnalysis, TotalMassOfStructure, TotalFreeMass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
alpham = Expression(z=damping, f=each_stick_s_period.Frequencies, Expression="0.0628319*z*f")
betak = Expression(z=damping, f=each_stick_s_period.Frequencies, Expression="0.0015915*z/f")
rayleigh = DampingAlpaca4d(AlphaM=alpham, BetaKCurr=0, BetaKInit=0, BetaKComm=betak)
newmark = IntegratorAlpaca4d(Gamma=0.5, Beta=0.25, mode="Newmark")
steps = Expression(n=el_centro_1940.Steps, Expression="4*n")
_0_005_s_steps = AnalysisStepAlpaca4d(NumIncr=steps, Dt=0.005)
transient = AnalysisSettingsAlpaca4d(
    Damping=rayleigh,
    Constraint="Transformation",
    Numberer="RCM",
    System="BandGen",
    Algorithm="Linear",
    Integrator=newmark,
    AnalysisType="Transient",
    AnalysisSteps=_0_005_s_steps,
    Cores=0)
run_analysis = RunAnalysisAlpaca4d(AlpacaModel=response_spectrum_sticks_2.AlpacaModel, Settings=transient, settings=True)  # -> AlpacaModel, Log

# ---- group: 6 - Results: the most each top moved, as a spectrum behind the sticks; the sticks at Step, drawn by Every stick
tops_every_step = NodalDisplacementsAlpaca4d(AlpacaModel=run_analysis.AlpacaModel, History=True, Step=0, NodeTag=2)  # -> Position, Displacement, Rotation, port, Velocity, AngularVelocity, Acceleration, AngularAcceleration
response_spectrum = GhPythonScript(Periods=each_stick_s_period.Period, Displacements=tops_every_step.Displacement, Tops=response_spectrum_sticks.Tops)  # -> out, Period, Sd, PSa, Spectrum, Grid; inputs Periods: tree, Displacements: tree of Vector3d, Tops: tree of Point3d
# ---------- response_spectrum: Python ----------
"""The geometry of the conventional structures of Structures.py, one function a structure.

Structures.py puts one of them into a GhPython component, whose inputs are the function's arguments
and whose outputs are what it returns, in order: lines for each kind of member, the points the
structure is held at, and the widths its loads are worked out from. Every member is a straight line
between two nodes, cut wherever another member meets it, so that the elements share their nodes.

Runs in GhPython (Rhino 7 and 8) and in Rhino 8's Python 3 component alike.
"""
from __future__ import division

import math
import Rhino.Geometry as rg
from Grasshopper import DataTree
from Grasshopper.Kernel.Data import GH_Path


def P(x, y, z):
    return rg.Point3d(x, y, z)


def L(a, b):
    return rg.Line(a, b)


def pieces(a, b, n):
    """The line from a to b in n pieces."""
    n = max(1, int(n))
    return [L(a + (b - a) * (i / n), a + (b - a) * ((i + 1) / n)) for i in range(n)]


def chain(points):
    """The lines between one point and the next."""
    return [L(points[k], points[k + 1]) for k in range(len(points) - 1)]


def grid_mesh(xs, ys, z):
    """A mesh of quads over xs by ys at height z, its vertices where the lines of xs and ys cross."""
    mesh = rg.Mesh()
    for y in ys:
        for x in xs:
            mesh.Vertices.Add(P(x, y, z))
    cols = len(xs)
    for r in range(len(ys) - 1):
        for c in range(cols - 1):
            a = r * cols + c
            mesh.Faces.AddFace(a, a + 1, a + cols + 1, a + cols)
    return mesh


# ---------------------------------------------------------------- 1 - a steel hall roofed by trusses

def hall(Span, Bays, Spacing, Eaves, Depth, Panels):
    """Frames of a Pratt truss on two columns, Spacing apart, joined by purlins at the truss's top nodes.
    The columns rise to the top chord, the bottom chord meeting them at the eaves, so that each frame
    stands on pinned feet. The two end bays are braced: crosses in the roof, between the top chords,
    and in the long walls, with a strut along each wall at the eaves. PurlinWidths: the width of roof
    each purlin carries, a panel, or half of one at the eaves."""
    n = max(2, int(Panels) // 2 * 2)
    bays = max(1, int(Bays))
    dx = Span / n
    top = Eaves + Depth
    Columns, Chords, Webs, Purlins, PurlinWidths, Bracing, Struts, Feet = [], [], [], [], [], [], [], []
    for i in range(bays + 1):
        y = i * Spacing
        for x in (0.0, Span):
            Columns += [L(P(x, y, 0), P(x, y, Eaves)), L(P(x, y, Eaves), P(x, y, top))]
            Feet.append(P(x, y, 0))
        for k in range(n):
            x0, x1 = k * dx, (k + 1) * dx
            Chords += [L(P(x0, y, Eaves), P(x1, y, Eaves)), L(P(x0, y, top), P(x1, y, top))]
            # Pratt: the diagonals fall towards the middle, in tension under the roof's weight.
            if k < n // 2:
                Webs.append(L(P(x0, y, top), P(x1, y, Eaves)))
            else:
                Webs.append(L(P(x0, y, Eaves), P(x1, y, top)))
        Webs += [L(P(k * dx, y, Eaves), P(k * dx, y, top)) for k in range(1, n)]
    for i in range(bays):
        y0, y1 = i * Spacing, (i + 1) * Spacing
        for k in range(n + 1):
            Purlins.append(L(P(k * dx, y0, top), P(k * dx, y1, top)))
            PurlinWidths.append(dx / 2 if k in (0, n) else dx)
        for x in (0.0, Span):
            Struts.append(L(P(x, y0, Eaves), P(x, y1, Eaves)))
        if i in (0, bays - 1):
            for k in range(n):
                Bracing += [L(P(k * dx, y0, top), P((k + 1) * dx, y1, top)),
                            L(P((k + 1) * dx, y0, top), P(k * dx, y1, top))]
            for x in (0.0, Span):
                Bracing += [L(P(x, y0, 0), P(x, y1, Eaves)), L(P(x, y1, 0), P(x, y0, Eaves))]
    return Columns, Chords, Webs, Purlins, PurlinWidths, Bracing, Struts, Feet


# ---------------------------------------------------------------- 2 - a steel tower with a stair

def tower(Width, Levels, Storey):
    """Four legs Width apart, a landing at every level and a crossed bracing on every face of every
    storey. A straight flight of stairs climbs each storey along a strip a metre wide across the
    middle, turning back at each landing: two stringers, from one side of the landing below to the
    other side of the landing above. A landing is its four edge beams and two cross beams along the
    strip, its Strip, which the stringers start and end on. The legs on the windward side, x = 0, are
    WindwardLegs, for the wind."""
    levels = max(1, int(Levels))
    w = Width
    y1, y2 = 0.5 * w - 0.5, 0.5 * w + 0.5
    corners = [(0, 0), (w, 0), (w, w), (0, w)]
    Legs, WindwardLegs, Bracing, Landings, Strip, Stringers, Feet = [], [], [], [], [], [], []
    for x, y in corners:
        Feet.append(P(x, y, 0))
        legs = pieces(P(x, y, 0), P(x, y, levels * Storey), levels)
        (WindwardLegs if x == 0 else Legs).extend(legs)
    for j in range(levels):
        z0, z1 = j * Storey, (j + 1) * Storey
        for k in range(4):
            (ax, ay), (bx, by) = corners[k], corners[(k + 1) % 4]
            Bracing += [L(P(ax, ay, z0), P(bx, by, z1)), L(P(bx, by, z0), P(ax, ay, z1))]
        # The landing at the top of the storey: the sides along y cut where the strip meets them.
        Landings += [L(P(0, 0, z1), P(w, 0, z1)), L(P(0, w, z1), P(w, w, z1))]
        for x in (0.0, w):
            Landings += [L(P(x, 0, z1), P(x, y1, z1)), L(P(x, y1, z1), P(x, y2, z1)), L(P(x, y2, z1), P(x, w, z1))]
        Strip += [L(P(0, y1, z1), P(w, y1, z1)), L(P(0, y2, z1), P(w, y2, z1))]
        # The flight: up along +x in even storeys, back along -x in odd ones.
        a, b = (0.0, w) if j % 2 == 0 else (w, 0.0)
        Stringers += [L(P(a, y, z0), P(b, y, z1)) for y in (y1, y2)]
    # The ground has no landing beams: the first flight starts on its own footing.
    Feet += [P(0.0, y, 0) for y in (y1, y2)]
    return Legs, WindwardLegs, Bracing, Landings, Strip, Stringers, Feet


# ---------------------------------------------------------------- 3 - a canopy on T-shaped frames

def canopy(Frames, Spacing, Height, Cantilever, Rise, Purlins):
    """A row of frames, Spacing apart: a column built in at its foot and an arm cantilevering each way
    from its head, rising Rise to its tip. Purlins join the frames at the head and at Purlins points
    along each arm. A cross between two columns in the middle bay holds the row lengthways.
    LeftWidths and RightWidths: the width of roof, on plan, each purlin carries on the left (-x) and
    the right (+x) of the frames, nothing on the other side: a purlin's share, or half at a tip or the
    head."""
    frames = max(2, int(Frames))
    m = max(1, int(Purlins))
    s = Cantilever / m
    Columns, Arms, Purlins, LeftWidths, RightWidths, Bracing, Feet = [], [], [], [], [], [], []
    for i in range(frames):
        y = i * Spacing
        Columns.append(L(P(0, y, 0), P(0, y, Height)))
        Feet.append(P(0, y, 0))
        for side in (-1, 1):
            Arms += pieces(P(0, y, Height), P(side * Cantilever, y, Height + Rise), m)
    for i in range(frames - 1):
        y0, y1 = i * Spacing, (i + 1) * Spacing
        Purlins.append(L(P(0, y0, Height), P(0, y1, Height)))
        LeftWidths.append(s / 2)
        RightWidths.append(s / 2)
        for side in (-1, 1):
            for k in range(1, m + 1):
                Purlins.append(L(P(side * k * s, y0, Height + k * Rise / m), P(side * k * s, y1, Height + k * Rise / m)))
                width = s / 2 if k == m else s
                LeftWidths.append(width if side < 0 else 0.0)
                RightWidths.append(width if side > 0 else 0.0)
    middle = (frames - 1) // 2
    y0, y1 = middle * Spacing, (middle + 1) * Spacing
    Bracing += [L(P(0, y0, 0), P(0, y1, Height)), L(P(0, y1, 0), P(0, y0, Height))]
    return Columns, Arms, Purlins, LeftWidths, RightWidths, Bracing, Feet


# ---------------------------------------------------------------- 4 - a facade stiffened by vertical trusses

def facade(Bays, BayWidth, Height, Levels, Depth, TrussEvery):
    """A glass wall Height tall in the plane y = 0, held only at its foot and its top, as a lobby's is:
    mullions every BayWidth and transoms between them at Levels heights. Behind every TrussEvery-th
    mullion a vertical truss stiffens it against the wind: the mullion is its outer chord, a tube
    Depth behind it the inner chord, with a post at every transom and diagonals zig-zagging between.
    The mullions stand on their feet and are held across the wall at the top; the inner chords too,
    and along the wall at the top as well, which nothing else holds them in.
    MullionWidths: the width of wall each piece of mullion catches the wind over, a bay or half of one
    at the ends. PanelHeight: the height of glass each transom carries."""
    bays, levels, every = max(1, int(Bays)), max(2, int(Levels)), max(1, int(TrussEvery))
    dz = Height / levels
    Mullions, MullionWidths, Transoms, Chords, Posts, Diagonals = [], [], [], [], [], []
    Base, Tops, ChordBase, ChordTops = [], [], [], []
    for i in range(bays + 1):
        x = i * BayWidth
        Mullions += pieces(P(x, 0, 0), P(x, 0, Height), levels)
        MullionWidths += [BayWidth / 2 if i in (0, bays) else BayWidth] * levels
        Base.append(P(x, 0, 0))
        Tops.append(P(x, 0, Height))
        if i % every:
            continue
        Chords += pieces(P(x, Depth, 0), P(x, Depth, Height), levels)
        Posts += [L(P(x, 0, k * dz), P(x, Depth, k * dz)) for k in range(levels + 1)]
        for k in range(levels):
            z0, z1 = k * dz, (k + 1) * dz
            Diagonals.append(L(P(x, 0, z0), P(x, Depth, z1)) if k % 2 == 0 else L(P(x, Depth, z0), P(x, 0, z1)))
        ChordBase.append(P(x, Depth, 0))
        ChordTops.append(P(x, Depth, Height))
    for k in range(1, levels):
        Transoms += [L(P(i * BayWidth, 0, k * dz), P((i + 1) * BayWidth, 0, k * dz)) for i in range(bays)]
    PanelHeight = dz
    return Mullions, MullionWidths, Transoms, Chords, Posts, Diagonals, Base, Tops, ChordBase, ChordTops, PanelHeight


# ---------------------------------------------------------------- 5 - a barrel vault under wind

def vault(Span, Rise, Length, Strips, Divisions, Windward, Crown, Leeward):
    """A barrel vault spanning Span across x, Rise high, Length long along y: the arc of a circle
    through its two feet and its crown, cut into Strips strips along its length, each a mesh of quads
    Divisions long. A strip's faces all face the same way, so one pressure on a strip acts along one
    direction. The pressure coefficients of the windward quarter, the middle half and the leeward
    quarter, wind blowing along +x, are given to each strip by where its middle is, with the strip's
    outward Normal: a positive coefficient pushes on the vault, along -Normal, a negative one pulls it
    away. The feet are held along both long edges."""
    strips, divisions = max(4, int(Strips)), max(1, int(Divisions))
    r = (0.25 * Span * Span + Rise * Rise) / (2 * Rise)
    zc = Rise - r
    # Half the angle the arc spans, from the crown to a foot: past 90 degrees for more than a semicircle.
    half = math.atan2(0.5 * Span, r - Rise)

    def at(t, y):
        a = -half + 2 * half * t
        return P(0.5 * Span + r * math.sin(a), y, zc + r * math.cos(a))

    Strip, Names, Coefficients, Normals, Feet = [], [], [], [], []
    for s in range(strips):
        mesh = rg.Mesh()
        for k in range(divisions + 1):
            y = Length * k / divisions
            mesh.Vertices.Add(at(s / strips, y))
            mesh.Vertices.Add(at((s + 1) / strips, y))
        for k in range(divisions):
            mesh.Faces.AddFace(2 * k, 2 * k + 1, 2 * k + 3, 2 * k + 2)
        mesh.Normals.ComputeNormals()
        Strip.append(mesh)
        Names.append("Strip_{0}".format(s))
        middle = (s + 0.5) / strips
        Coefficients.append(Windward if middle < 0.25 else Leeward if middle > 0.75 else Crown)
        a = -half + 2 * half * middle
        Normals.append(rg.Vector3d(math.sin(a), 0, math.cos(a)))
    for k in range(divisions + 1):
        y = Length * k / divisions
        Feet += [at(0, y), at(1, y)]
    return Strip, Names, Coefficients, Normals, Feet


# ---------------------------------------------------------------- 6 - a facade held by wind trusses

def windtruss(Width, Height, Spacing, Depth, Trusses):
    """A tall glass facade Width wide and Height high in the plane y = 0, its mullions Spacing apart
    standing on their feet and held across the facade at the top, and at Trusses levels between by
    horizontal trusses behind it. Each truss spans the whole width between the building's columns at
    its two ends: its outer chord runs through the mullions, its inner chord Depth behind, with a
    post at every mullion and diagonals between, falling towards the middle. MullionWidths: the width
    of facade each piece of mullion catches the wind over, its spacing or half of it at the ends."""
    n = max(2, int(round(Width / Spacing)))
    s = Width / n
    trusses = max(1, int(Trusses))
    levels = [Height * (k + 1) / (trusses + 1) for k in range(trusses)]
    heights = [0.0] + levels + [Height]
    Mullions, MullionWidths, Chords, Posts, Diagonals, Base, Tops, TrussEnds = [], [], [], [], [], [], [], []
    for i in range(n + 1):
        x = i * s
        Mullions += [L(P(x, 0, heights[k]), P(x, 0, heights[k + 1])) for k in range(len(heights) - 1)]
        MullionWidths += [s / 2 if i in (0, n) else s] * (len(heights) - 1)
        Base.append(P(x, 0, 0))
        Tops.append(P(x, 0, Height))
    for z in levels:
        for i in range(n):
            x0, x1 = i * s, (i + 1) * s
            Chords += [L(P(x0, 0, z), P(x1, 0, z)), L(P(x0, Depth, z), P(x1, Depth, z))]
            if i < n // 2:
                Diagonals.append(L(P(x0, Depth, z), P(x1, 0, z)))
            else:
                Diagonals.append(L(P(x0, 0, z), P(x1, Depth, z)))
        Posts += [L(P(i * s, 0, z), P(i * s, Depth, z)) for i in range(n + 1)]
        TrussEnds += [P(0, 0, z), P(0, Depth, z), P(Width, 0, z), P(Width, Depth, z)]
    return Mullions, MullionWidths, Chords, Posts, Diagonals, Base, Tops, TrussEnds


# ---------------------------------------------------------------- 7 - a girder bridge on piers

def girder(SideSpan, MainSpan, PierHeight, Segment):
    """A continuous concrete deck over three spans - SideSpan, MainSpan, SideSpan - on two piers
    PierHeight tall. The deck is a slab 12 m wide on two girders 6 m apart, joined by a cross girder
    every other Segment; each pier is two round columns, one under each girder, braced by a strut
    halfway up and joined on top by a deeper cross girder, its cap. The deck is built into the piers
    and slides along on bearings at its two ends, held there across. Watch: the deck in the middle
    of the main span, whose movement the pictures plot."""
    H, g, w = PierHeight, 3.0, 6.0
    length = 2 * SideSpan + MainSpan
    piers = (SideSpan, SideSpan + MainSpan)
    xs = [0.0]
    for a, b in [(0.0, SideSpan), (SideSpan, SideSpan + MainSpan), (SideSpan + MainSpan, length)]:
        n = max(1, int(round((b - a) / Segment)))
        xs += [a + (b - a) * (i + 1) / n for i in range(n)]
    ys = [-w, -g, 0.0, g, w]
    Girders = []
    for y in (-g, g):
        Girders += chain([P(x, y, H) for x in xs])
    Slab = [grid_mesh(xs, ys, H)]
    CrossGirders, PierCaps = [], []
    for k, x in enumerate(xs):
        across = chain([P(x, y, H) for y in (-g, 0.0, g)])
        if any(abs(x - p) < 1e-6 for p in piers):
            PierCaps += across
        elif k % 2 == 0 or k == len(xs) - 1:
            CrossGirders += across
    Columns, Struts, Feet = [], [], []
    for x in piers:
        for y in (-g, g):
            Columns += pieces(P(x, y, 0), P(x, y, 0.5 * H), 3) + pieces(P(x, y, 0.5 * H), P(x, y, H), 3)
            Feet.append(P(x, y, 0))
        Struts += chain([P(x, y, 0.5 * H) for y in (-g, 0.0, g)])
    Bearings = [P(x, y, H) for x in (0.0, length) for y in (-g, g)]
    Watch = [P(0.5 * length, 0, H)]
    return Girders, CrossGirders, PierCaps, Columns, Struts, Slab, Feet, Bearings, Watch


# ---------------------------------------------------------------- 8 - a cable-stayed bridge

def cablestayed(Span, DeckHeight, PylonHeight, Width, Stays):
    """Two spans of Span each side of an H-shaped pylon: two legs Width apart, from the ground to
    PylonHeight above the deck, joined at the top. The deck is two edge girders joined by floor beams
    wherever a stay holds them, Stays a side in each span, the stays in two planes, fanning from the
    top quarter of each leg. The girders are built into the legs, and slide along their abutments.
    Watch: the deck in the middle of a span, and the top of the pylon."""
    n = max(2, int(Stays))
    w = 0.5 * Width
    top = DeckHeight + PylonHeight
    spacing = Span / (n + 1)
    xs = [-Span + k * spacing for k in range(2 * n + 3)]
    Girders, FloorBeams, Legs, CrossBeams, Cables, Feet, Bearings = [], [], [], [], [], [], []
    for y in (-w, w):
        Girders += [L(P(xs[k], y, DeckHeight), P(xs[k + 1], y, DeckHeight)) for k in range(len(xs) - 1)]
        Legs += pieces(P(0, y, 0), P(0, y, DeckHeight), 4)
        anchors = [DeckHeight + PylonHeight * (0.75 + 0.25 * j / (n - 1)) for j in range(n)]
        levels = [DeckHeight] + sorted(set(anchors))
        Legs += [L(P(0, y, levels[k]), P(0, y, levels[k + 1])) for k in range(len(levels) - 1)]
        Feet.append(P(0, y, 0))
        for side in (-1, 1):
            for j in range(n):
                # The outermost stay from the highest anchor, the innermost from the lowest.
                x = side * spacing * (j + 1)
                Cables.append(L(P(0, y, anchors[j]), P(x, y, DeckHeight)))
        Bearings += [P(-Span, y, DeckHeight), P(Span, y, DeckHeight)]
    FloorBeams += [L(P(x, -w, DeckHeight), P(x, w, DeckHeight)) for x in xs]
    CrossBeams += [L(P(0, -w, top), P(0, w, top))]
    Watch = [P(0.5 * Span, 0, DeckHeight), P(0, -w, top)]
    return Girders, FloorBeams, Legs, CrossBeams, Cables, Feet, Bearings, Watch


# ---------------------------------------------------------------- 9 - a deck arch bridge

def arch(Span, Rise, Columns, DeckAbove):
    """Two concrete arch ribs Span across and Rise high, parabolas springing from the ground 12 m
    apart and leaning in to 7 m apart at the crown, braced by a strut at every column. They carry a
    deck DeckAbove the crown on Columns pairs of spandrel columns, evenly spaced, built into both: a
    slab 11 m wide on two girders, joined by a floor beam on every pair of columns. The deck runs on
    to the abutments at its two ends, where it slides along, held across; the ribs are built in at
    their springings. Watch: the deck at the crown."""
    n = max(2, int(Columns))
    deck = Rise + DeckAbove
    spring, crown, g, w = 6.0, 3.5, 4.0, 5.5
    zs = lambda x: 4.0 * Rise * x * (Span - x) / (Span * Span)
    bs = lambda x: spring - (spring - crown) * zs(x) / Rise
    xs = [Span * k / (n + 1) for k in range(n + 2)]
    # The ribs and the deck, cut at every column and halfway between.
    ts = sorted(set([x for x in xs] + [0.5 * (xs[k] + xs[k + 1]) for k in range(len(xs) - 1)]))
    Ribs, Girders, SpandrelColumns = [], [], []
    for side in (-1, 1):
        Ribs += chain([P(t, side * bs(t), zs(t)) for t in ts])
        Girders += chain([P(t, side * g, deck) for t in ts])
        SpandrelColumns += [L(P(x, side * bs(x), zs(x)), P(x, side * g, deck)) for x in xs[1:-1]]
    Struts = [L(P(x, -bs(x), zs(x)), P(x, bs(x), zs(x))) for x in xs[1:-1]]
    FloorBeams = []
    for x in xs:
        FloorBeams += chain([P(x, y, deck) for y in (-g, 0.0, g)])
    Slab = [grid_mesh(ts, [-w, -g, 0.0, g, w], deck)]
    Springings = [P(x, y, 0) for x in (0.0, Span) for y in (-spring, spring)]
    Abutments = [P(x, y, deck) for x in (0.0, Span) for y in (-g, g)]
    Watch = [P(0.5 * Span, 0, deck)]
    return Ribs, Struts, Girders, FloorBeams, SpandrelColumns, Slab, Springings, Abutments, Watch


# ---------------------------------------------------------------- 10 - a building, and a tiny city of them

def _building(x0, y0, bay, height, floors, balconies=False, depth=1.5, split=1):
    """A steel frame on a grid of bay, x0, y0 its first corner: floors, from the first up, are the
    cells (i, j) each floor covers, every one inside the one under it, so that a column stands
    under every corner of a floor. Each floor has beams round its cells, cut split times a bay, and
    a slab mesh of quads on the beams' nodes; balconies: on every floor with the same floor over it,
    a slab depth deep along the south faces, on cantilevers at the columns and an edge beam."""
    Columns, Beams, Slabs, Feet = [], [], [], []
    n = max(1, int(split))
    pt = lambda i, j, k: P(x0 + i * bay, y0 + j * bay, k * height)
    corners = lambda cells: sorted(set((i + a, j + b) for (i, j) in cells for a in (0, 1) for b in (0, 1)))
    edges = lambda cells: sorted(set(e for (i, j) in cells for e in
                                     [((i, j), (i + 1, j)), ((i, j + 1), (i + 1, j + 1)), ((i, j), (i, j + 1)), ((i + 1, j), (i + 1, j + 1))]))
    Feet += [pt(i, j, 0) for (i, j) in corners(floors[0])]
    for k, cells in enumerate(floors, 1):
        Columns += [L(pt(i, j, k - 1), pt(i, j, k)) for (i, j) in corners(cells)]
        for a, b in edges(cells):
            Beams += pieces(pt(a[0], a[1], k), pt(b[0], b[1], k), n)
        mesh, at = rg.Mesh(), {}

        def v(point):
            key = (round(point.X, 6), round(point.Y, 6))
            if key not in at:
                at[key] = mesh.Vertices.Count
                mesh.Vertices.Add(point)
            return at[key]

        for (i, j) in sorted(cells):
            for a in range(n):
                for b in range(n):
                    q = [pt(i + (a + da) / n, j + (b + db) / n, k) for da, db in ((0, 0), (1, 0), (1, 1), (0, 1))]
                    mesh.Faces.AddFace(*[v(p) for p in q])
        if balconies and k < len(floors) and floors[k] == cells:
            out = rg.Vector3d(0, -depth, 0)
            south = [(i, j) for (i, j) in sorted(cells) if (i, j - 1) not in cells]
            for (i, j) in sorted(set(c for (i, j) in south for c in ((i, j), (i + 1, j)))):
                Beams.append(L(pt(i, j, k), pt(i, j, k) + out))
            for (i, j) in south:
                for a in range(n):
                    p, q = pt(i + a / n, j, k), pt(i + (a + 1) / n, j, k)
                    Beams.append(L(p + out, q + out))
                    mesh.Faces.AddFace(v(p + out), v(q + out), v(q), v(p))
        Slabs.append(mesh)
    return Columns, Beams, Slabs, Feet


def building(BaysX, BaysY, Bay, Storeys, StoreyHeight):
    """An office building: a steel frame BaysX by BaysY bays of Bay, Storeys storeys of StoreyHeight,
    columns built in at the ground, and a concrete slab at every floor on the beams, meshed twice a
    bay. Its mass is its members' and its slabs' own. Watch: a corner of the roof."""
    cells = _rect(max(1, int(BaysX)), max(1, int(BaysY)))
    storeys = max(1, int(Storeys))
    Columns, Beams, Slabs, Feet = _building(0.0, 0.0, Bay, StoreyHeight, [cells] * storeys, split=2)
    Watch = [P(0, 0, storeys * StoreyHeight)]
    return Columns, Beams, Slabs, Feet, Watch


def _rect(a, b):
    """The cells of a rectangle a bays by b."""
    return frozenset((i, j) for i in range(a) for j in range(b))


def _ell(a, b):
    """An L: the rectangle a by b without its far corner."""
    return _rect(a, b) - frozenset([(a - 1, b - 1)])


# The buildings of the city, row by row, low next to tall as a city grows: the footprint of each, in
# bays, its storeys, what tops it - a smaller footprint for its last few storeys - what it stands on
# - a wider one for its first few - and whether its south face has balconies.
CITY = [
    (_rect(3, 2), 2, None, None, False),
    (_ell(2, 2), 9, None, None, True),
    (_rect(2, 2), 4, (_rect(1, 1), 1), None, False),
    (_rect(2, 1), 16, None, None, True),
    (_ell(3, 2), 6, None, None, False),
    (_rect(2, 2), 12, None, None, True),
    (_rect(3, 1), 3, None, None, False),
    (_rect(2, 2), 20, (_rect(1, 1), 2), (_rect(3, 3), 2), False),
    (_rect(1, 2), 14, None, None, True),
    (_rect(2, 1), 5, (_rect(1, 1), 1), None, False),
    (_ell(2, 2), 10, (_rect(1, 1), 2), None, False),
    (_rect(2, 2), 2, None, None, False),
    (_rect(3, 1), 7, None, None, True),
    (_rect(2, 1), 18, None, (_rect(3, 2), 3), False),
    (_ell(2, 2), 3, None, None, False),
    (_rect(2, 2), 11, (_rect(2, 1), 2), None, True),
]


def city(Rows, ColumnsPerRow, Street, Bay, StoreyHeight):
    """A tiny city: Rows by ColumnsPerRow buildings of CITY, steel frames on a grid of Bay with a
    slab at every floor, Street between their plots of three bays square. Rectangles, Ls, towers
    on podiums and with penthouses, some with balconies: on the same ground each shakes in its own
    way, a low one stiff and quick, a tall one slow and soft, an L or a tower off its podium's
    middle twisting as it sways. Watch: a corner of each building's roof; Storeys: how many it has."""
    Columns, Beams, Slabs, Feet, Watch, Storeys = [], [], [], [], [], []
    rows, cols = max(1, int(Rows)), max(1, int(ColumnsPerRow))
    plot = 3 * Bay + Street
    for r in range(rows):
        for c in range(cols):
            cells, storeys, top, podium, balconies = CITY[(r * cols + c) % len(CITY)]
            low, high = podium[1] if podium else 0, top[1] if top else 0
            floors = ([podium[0]] * low if podium else []) + [cells] * (storeys - low - high) + \
                ([top[0]] * high if top else [])
            parts = _building(c * plot, r * plot, Bay, StoreyHeight, floors, balconies)
            Columns += parts[0]
            Beams += parts[1]
            Slabs += parts[2]
            Feet += parts[3]
            i, j = min(floors[-1])
            Watch.append(P(c * plot + i * Bay, r * plot + j * Bay, storeys * StoreyHeight))
            Storeys.append(storeys)
    return Columns, Beams, Slabs, Feet, Watch, Storeys


# ---------------------------------------------------------------- 12 - a footbridge's natural modes

def footbridge(Span, Width, Segment, Depth):
    """A footbridge of one span, Span long: a concrete deck Width wide and 200 mm thick on a steel box
    girder Depth deep down its middle, cut every Segment or so. The deck is meshed in quads, one
    across each half, its middle plane at Z = 0; the box's axis is under it, its top against the
    deck's underside, and each of its nodes is tied to the deck's node above by a rigid link, so that
    the two bend together. The box is held at both ends: a pinned bearing at the start, one sliding
    along at the far end. Box: its lines; Deck: the deck's mesh; Under and Over: each link's two
    nodes, the box's and the deck's; Pinned and Sliding: the box's two ends."""
    n = max(2, int(round(Span / Segment)))
    xs = [Span * i / n for i in range(n + 1)]
    z = -(0.1 + 0.5 * Depth)
    Box = chain([P(x, 0, z) for x in xs])
    Deck = [grid_mesh(xs, [-0.5 * Width, 0.0, 0.5 * Width], 0.0)]
    Under = [P(x, 0, z) for x in xs]
    Over = [P(x, 0, 0) for x in xs]
    return Box, Deck, Under, Over, [Under[0]], [Under[-1]]


# ---------------------------------------------------------------- 13 - sticks that draw a response spectrum

def sticks(Sticks, Shortest, Tallest, Spacing):
    """A row of Sticks steel sticks along x, Spacing apart, from Shortest to Tallest: each a
    cantilever from the ground to a mass at its top, an oscillator of one degree of freedom along
    the shaking. A cantilever's period goes as its height to the power 1.5, so their heights are
    spread for their periods to be spread evenly: along the row, x reads as the period axis of a
    response spectrum. Each stick is a model of its own, a branch of the trees: Lines, one line;
    Feet, where it is held; Tops, where its mass sits."""
    n = max(2, int(Sticks))
    low, high = Shortest ** 1.5, Tallest ** 1.5
    Lines, Feet, Tops = DataTree[object](), DataTree[object](), DataTree[object]()
    for i in range(n):
        h = (low + (high - low) * i / (n - 1)) ** (2.0 / 3.0)
        foot, top = P(i * Spacing, 0, 0), P(i * Spacing, 0, h)
        path = GH_Path(i)
        Lines.Add(L(foot, top), path)
        Feet.Add(foot, path)
        Tops.Add(top, path)
    return Lines, Feet, Tops


# How tall the spectrum stands behind the sticks: metres to 1 g of pseudo-acceleration.
SPECTRUM_SCALE = 8.0
# How far behind the sticks it stands, m.
SPECTRUM_BEHIND = 3.0


def spectrum(Periods, Displacements, Tops):
    """The response spectrum the sticks draw. Periods: each stick's, a branch each, from its Natural
    Vibration Analysis; Displacements: the sticks' displacements at every step of their
    transient analyses, from Nodal Displacements with History on, a branch a step. Sd is
    the most its top moved from the ground at any step, along x, in mm; PSa, its pseudo-acceleration, Sd times
    (2 pi / T) squared, in g. Spectrum and Grid draw them as a chart standing behind the sticks, its
    period axis along the row and its PSa SPECTRUM_SCALE m to the g: a line through each stick's
    PSa, and lines at every 0.25 g."""
    periods = [max(Periods.Branch(p)) for p in Periods.Paths if Periods.Branch(p).Count]
    n = len(periods)
    # Nodal Displacements gives a branch a step, every stick's nodes in it one after another, in the
    # order of the sticks; each stick's top moves the most.
    peaks = [0.0] * n
    for path in Displacements.Paths:
        moves = list(Displacements.Branch(path))
        each = len(moves) // n if n else 0
        for i in range(n if each else 0):
            peaks[i] = max([peaks[i]] + [abs(v.X) for v in moves[i * each:(i + 1) * each]])
    Period, Sd, PSa = [], [], []
    for T, peak in zip(periods, peaks):
        Period.append(T)
        Sd.append(1000.0 * peak)
        PSa.append((2 * math.pi / T) ** 2 * peak / 9.81)
    xs = [Tops.Branch(p)[0].X for p in Tops.Paths][:len(PSa)]
    y = SPECTRUM_BEHIND
    Spectrum = rg.Polyline([P(x, y, a * SPECTRUM_SCALE) for x, a in zip(xs, PSa)]).ToNurbsCurve()
    Grid = []
    if xs:
        for k in range(int(math.ceil(max(PSa) / 0.25)) + 1):
            z = 0.25 * k * SPECTRUM_SCALE
            Grid.append(L(P(xs[0], y, z), P(xs[-1], y, z)))
    return Period, Sd, PSa, Spectrum, Grid


# ---------------------------------------------------------------- 14 - a shell form-found to work in compression

# The plan of the shell, a cross of four legs 20 m from end to end, in 16 quads round its middle: the
# coarse net Kangaroo refines and pushes up. Its corners, from the middle out, x and y in m.
SHELL_QUADS = [
    ((-9.925, -1.207), (-9.925, 0.0), (-4.521, 0.0), (-5.356, -2.616)),
    ((-5.356, -2.616), (-4.521, 0.0), (0.0, -5.0), (-2.544, -5.451)),
    ((-2.544, -5.451), (0.0, -5.0), (0.0, -10.0), (-1.132, -10.0)),
    ((-4.521, 0.0), (-2.0, 0.0), (0.0, -2.0), (0.0, -5.0)),
]


def compressed_shell(Span):
    """A shell's net before it is form-found: a cross of four legs, Span from the end of one to the end
    of the one opposite, as one mesh of 16 quads, a quarter of them mirrored three ways. Ends: the
    straight edge at the end of each leg, where the shell stands."""
    k = Span / 20.0
    mesh, at = rg.Mesh(), {}

    def v(x, y):
        key = (round(x, 6), round(y, 6))
        if key not in at:
            at[key] = mesh.Vertices.Count
            mesh.Vertices.Add(P(k * x, k * y, 0.0))
        return at[key]

    for sx, sy in ((1, 1), (-1, 1), (1, -1), (-1, -1)):
        for quad in SHELL_QUADS:
            corners = [v(sx * x, sy * y) for x, y in quad]
            if sx * sy < 0:
                corners.reverse()
            mesh.Faces.AddFace(*corners)
    mesh.Normals.ComputeNormals()
    Ends = [L(P(-9.925 * k, -1.207 * k, 0), P(-9.925 * k, 1.207 * k, 0)),
            L(P(9.925 * k, -1.207 * k, 0), P(9.925 * k, 1.207 * k, 0)),
            L(P(-1.132 * k, -10 * k, 0), P(1.132 * k, -10 * k, 0)),
            L(P(-1.132 * k, 10 * k, 0), P(1.132 * k, 10 * k, 0))]
    return [mesh], Ends


# ---------------------------------------------------------------- the ground motion

# El Centro, 18 May 1940, the north-south component recorded at the Imperial Valley Irrigation District
# substation: a ground acceleration every 0.02 s, in g - the version OpenSees's examples use.
EL_CENTRO_DT = 0.02
EL_CENTRO = [
    0.00630, 0.00364, 0.00099, 0.00428, 0.00758, 0.01087, 0.00682, 0.00277, -0.00128, 0.00368,
    0.00864, 0.01360, 0.00727, 0.00094, 0.00420, 0.00221, 0.00021, 0.00444, 0.00867, 0.01290,
    0.01713, -0.00343, -0.02400, -0.00992, 0.00416, 0.00528, 0.01653, 0.02779, 0.03904, 0.02449,
    0.00995, 0.00961, 0.00926, 0.00892, -0.00486, -0.01864, -0.03242, -0.03365, -0.05723, -0.04534,
    -0.03346, -0.03201, -0.03056, -0.02911, -0.02766, -0.04116, -0.05466, -0.06816, -0.08166, -0.06846,
    -0.05527, -0.04208, -0.04259, -0.04311, -0.02428, -0.00545, 0.01338, 0.03221, 0.05104, 0.06987,
    0.08870, 0.04524, 0.00179, -0.04167, -0.08513, -0.12858, -0.17204, -0.12908, -0.08613, -0.08902,
    -0.09192, -0.09482, -0.09324, -0.09166, -0.09478, -0.09789, -0.12902, -0.07652, -0.02401, 0.02849,
    0.08099, 0.13350, 0.18600, 0.23850, 0.21993, 0.20135, 0.18277, 0.16420, 0.14562, 0.16143,
    0.17725, 0.13215, 0.08705, 0.04196, -0.00314, -0.04824, -0.09334, -0.13843, -0.18353, -0.22863,
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]


def elcentro(Duration, Scale):
    """The El Centro record's first Duration seconds, its accelerations times Scale, in m/s2: the
    Times and the Accelerations a Path Time Series takes, and how many steps of 0.02 s they make.
    Its peak, 0.32 g, comes 2.02 s in."""
    n = min(len(EL_CENTRO), int(round(Duration / EL_CENTRO_DT)) + 1)
    Times = [k * EL_CENTRO_DT for k in range(n)]
    Accelerations = [9.81 * Scale * a for a in EL_CENTRO[:n]]
    Steps = n - 1
    return Times, Accelerations, Steps


Period, Sd, PSa, Spectrum, Grid = spectrum(Periods, Displacements, Tops)
# ---------- end response_spectrum ----------
step = Slider(500, range=0..6200)
sticks_shaking = ModelViewAlpaca4d(
    AlpacaModel=run_analysis.AlpacaModel,
    Step=step,
    Colors=[RGB(212, 227, 253), RGB(157, 193, 251), RGB(103, 159, 249), RGB(78, 126, 243), RGB(112, 95, 233), RGB(147, 63, 222), RGB(177, 67, 179), RGB(206, 87, 121), RGB(235, 108, 63)],
    Range=Domain(0, 280),
    FittedLoads=True)  # -> AlpacaModel, Geometry, Info, Values, Colors
period_s = Panel(response_spectrum.Period)
psa_g = Panel(response_spectrum.PSa)
sticks_shaking_title = Panel("Displacement [mm]")
every_stick = Mesh(sticks_shaking.Geometry)
first_stick_s_values = TreeBranch(Tree=sticks_shaking.Values, Path="{0;0;0}", MaintainPaths=True)
first_stick_s_colors = TreeBranch(Tree=sticks_shaking.Colors, Path="{0;0;0}", MaintainPaths=True)
sticks_shaking_legend = LegendAlpaca4d(Title=sticks_shaking_title, Values=first_stick_s_values, Colors=first_stick_s_colors, Position=0, Scale=2.4)
