# Grasshopper definition BesoBridge.gh (Grasshopper 1.0.7)
# plug-ins: Galapagos, Kangaroo2 Components, Alpaca4d

# ---- group: 1 - How fine: drag Bricks per metre
# BESO Topology: Bridge carved out of its block - a BESO Topology example.
# 
# The block of the Topology Optimisation example: steel, 16 m long, 2 m wide and 4 m high, pinned along both ends of its bottom, its top layer a deck kept solid under 10 kN/m2. BESO Topology starts from the whole block and takes 2% of what is left away each iteration - the bricks that work least go, and some come back - until a fifth of the block below the deck is left. Every brick is solid or void all along.
# 
# 1. Set Run to true. The run goes on its own thread: the Surface preview and the outputs follow it.
# 2. Volume comes down from 1 to VolumeFraction in about 80 iterations; then the design settles, and the run stops once the compliance has.
# 3. Drag Step back to go through the designs: each one is a bridge of the volume reached, from the whole block down - choose the one you want.
# 4. Once the run has stopped, enable Run Analysis and Legend: AlpacaModel is the design shown as a model, and the Model View after Run Analysis colours it by Von Mises stress.
# 
# Each SSP Brick is solved as OpenSees' eight point brick, and a void brick keeps a billionth of its stiffness. Above 500 bricks BESO Topology needs a license.
bricks_per_metre = Slider(3, range=1..4)
bricks_along = Expression(n=bricks_per_metre, Expression="16*n")
bricks_across = Expression(n=bricks_per_metre, Expression="2*n")
layer = Expression(n=bricks_per_metre, Expression="1/n")
domain_levels = Expression(n=bricks_per_metre, Expression="4*n")
deck_underside = Expression(n=bricks_per_metre, Expression="4-1/n")
nodes_across = Expression(n=bricks_per_metre, Expression="2*n+1")

# ---- group: 2 - The design domain, 16 x 2 x 4 m, and the deck on top, in layers of bricks
domain_levels_2 = Series(Start=0, Step=layer, Count=domain_levels)
deck_levels = Series(Start=deck_underside, Step=layer, Count=2)
plan = Rectangle3Pt(PointA=Point(0, 0, 0), PointB=Point(16, 0, 0), PointC=Point(16, 2, 0))  # -> Rectangle, Length
up_to_each_level = UnitZ(Factor=domain_levels_2)
up_to_the_deck = UnitZ(Factor=deck_levels)
plan_mesh = MeshPlane(Boundary=plan.Rectangle, WidthCount=bricks_along, HeightCount=bricks_across)  # -> Mesh, Area
domain_levels_3 = Move(Geometry=plan_mesh.Mesh, Motion=up_to_each_level)  # -> Geometry, Transform
deck_levels_2 = Move(Geometry=plan_mesh.Mesh, Motion=up_to_the_deck)  # -> Geometry, Transform
mesh_series_to_brick = MeshSeriesToBrickAlpaca4d(Meshes=domain_levels_3.Geometry, Closed=False)
mesh_series_to_brick_2 = MeshSeriesToBrickAlpaca4d(Meshes=deck_levels_2.Geometry, Closed=False)

# ---- group: 4 - Pinned ends, 10 kN/m2 on the deck
across = Series(Start=0, Step=layer, Count=nodes_across)
bottom_of_both_ends = ConstructPoint(XCoordinate=graft([0, 16]), YCoordinate=across, ZCoordinate=0)
up_to_the_top = UnitZ(Factor=4)
deck_top = Move(Geometry=plan_mesh.Mesh, Motion=up_to_the_top)  # -> Geometry, Transform
deck_nodes = DeconstructMesh(Mesh=deck_top.Geometry)  # -> Vertices, Faces, Colours, Normals
held = BooleanToggle(True)
free = BooleanToggle(False)
how_many = ListLength(List=deck_nodes.Vertices)
pinned_ends = SupportAlpaca4d(
    Position=flatten(bottom_of_both_ends),
    Tx=held,
    Ty=held,
    Tz=held,
    Rx=free,
    Ry=free,
    Rz=free,
    mode="Support Rigid (Alpaca4d)")
each_node_s_share = Expression(c=how_many, Expression="-320/c")
down = UnitZ(Factor=each_node_s_share)
deck_load = PointLoadAlpaca4d(Point=deck_nodes.Vertices, Force=down, Moment=Vector(0, 0, 0))
load_pattern = LoadPatternAlpaca4d(Loads=flatten(deck_load), Factor=1, mode="PlainPattern (Alpaca4d)")

# ---- group: 3 - Steel, and the bricks named Domain and Deck
steel = Panel("S355")
e_kn_m2 = Panel("210000000")
g_kn_m2 = Panel("80769231")
poisson = Panel("0.3")
density_kg_m3 = Panel("7850")
steel_2 = ND(MaterialName=steel, E=e_kn_m2, G=g_kn_m2, Ν=poisson, Rho=density_kg_m3, mode="ElasticIsotropic (Alpaca4d)")
elementid = Panel("Domain")
elementid_2 = Panel("Deck")
domain = SSPBrickAlpaca4d(Mesh=mesh_series_to_brick, Material=steel_2, ElementId=elementid)
deck = SSPBrickAlpaca4d(Mesh=mesh_series_to_brick_2, Material=steel_2, ElementId=elementid_2)

# ---- group: 5 - Assemble Model (enable Model View to see the domain)
assemble_model = AssembleModelAlpaca4d(Elements=flatten([domain, deck]), Supports=flatten(pinned_ends), LoadPatterns=flatten(load_pattern), Tolerance=0.01)  # -> AlpacaModel, Mass
modelview = ModelViewAlpaca4d(AlpacaModel=assemble_model.AlpacaModel, Step=0, FittedLoads=True)  # -> AlpacaModel, Geometry, Info, Values, Colors; disabled

# ---- group: 6 - BESO Topology: set Run to true
keep = Panel("Deck")
volumefraction = Slider(0.2, range=0.05..0.5)
iterations = Slider(200, range=10..300)
run = BooleanToggle(False)
step = Slider(300, range=0..300)
beso = BESOTopologyAlpaca4d(
    AlpacaModel=assemble_model.AlpacaModel,
    Keep=keep,
    VolumeFraction=volumefraction,
    Iterations=iterations,
    Run=run,
    EvolutionRate=0.02,
    Penalty=3,
    Tolerance=0.001,
    MinStiffness=1e-09,
    System="Auto",
    Step=step)  # -> Surface, Solid, Density, Element, Compliance, Volume, Converged, History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
compliance = Panel(beso.Compliance)
converged = Panel(beso.Converged)
volume = Panel(beso.Volume)
history = Panel(beso.History)

# ---- group: 7 - The design, analysed: once the run has stopped, enable Run Analysis and Legend
analysis_settings = AnalysisSettingsAlpaca4d(Constraint="Transformation", Numberer="RCM", System="Auto", Algorithm="Newton", AnalysisType="Static", Cores=0)
run_analysis = RunAnalysisAlpaca4d(AlpacaModel=beso.AlpacaModel, Settings=analysis_settings, settings=True)  # -> AlpacaModel, Log; disabled
modelview_2 = ModelViewAlpaca4d(AlpacaModel=run_analysis.AlpacaModel, Step=0, FittedLoads=True)  # -> AlpacaModel, Geometry, Info, Values, Colors
title = Panel("Von Mises stress [MPa]")
legend = LegendAlpaca4d(Title=title, Values=modelview_2.Values, Colors=modelview_2.Colors, Position=0, Scale=1.5)  # disabled
what_is_drawn = Panel(modelview_2.Info)
