# Grasshopper definition TopologyBridge.gh (Grasshopper 1.0.7)
# plug-ins: Galapagos, Kangaroo2 Components, Alpaca4d

# ---- group: 1 - How fine: drag Bricks per metre
# Topology Optimisation: Bridge - a Topology Optimisation example.
# 
# The design domain is a steel block 16 m long, 2 m wide and 4 m high, pinned along both ends of its bottom. Its top layer is the deck: it carries 10 kN/m2 and is kept solid, by its ElementId, through Keep. The optimisation finds the fifth of the rest that carries the deck stiffest: an arch from support to support rising into the deck at mid-span, with a column up to the deck near each end.
# 
# 1. Set Run to true. The run goes on its own thread: the Surface preview and the outputs follow it, about once a second, and Rhino stays free.
# 2. Set Run to false to pause, true to go on; raise Iterations to go further. Change anything else - VolumeFraction, Bricks per metre - and the run starts again.
# 3. Drag Step back to watch the run again, design by design: every iteration is kept.
# 4. Bricks per metre 3 gives 3 456 bricks, about 15 s on an M2 Pro; 4 gives 8 192, under a minute. At 2 the deck is a 0.5 m slab of solid steel, stiff enough to span most of the way, and the steel goes into two legs that shorten its span instead of an arch.
# 5. Once the run has stopped, enable Run Analysis and Legend (select both, right-click, Enable): AlpacaModel is the design as a model of its own - the solid bricks at full stiffness, the void ones gone, with the supports and loads that stand on them - and the Model View after Run Analysis colours it by Von Mises stress. Disable Run Analysis again before dragging Step, or every design shown is analysed.
# 
# Each SSP Brick is solved as OpenSees' eight point brick: the SSP Brick fixes part of its stiffness when it is built, so it cannot be softened. A void brick keeps a billionth of its stiffness; nothing is cut out of the mesh. Topology Optimisation needs a license.
bricks_per_metre = Slider(3, range=1..4)
bricks_along = Expression(n=bricks_per_metre, Expression="16*n")
bricks_across = Expression(n=bricks_per_metre, Expression="2*n")
layer = Expression(n=bricks_per_metre, Expression="1/n")
domain_levels = Expression(n=bricks_per_metre, Expression="4*n")
deck_underside = Expression(n=bricks_per_metre, Expression="4-1/n")
nodes_across = Expression(n=bricks_per_metre, Expression="2*n+1")

# ---- group: 2 - The design domain, 16 x 2 x 4 m, and the deck on top, in layers of bricks
domain_levels_2 = Series(Start=0, Step=layer, Count=domain_levels)
deck_levels = Series(Start=deck_underside, Step=layer, Count=2)
plan = Rectangle3Pt(PointA=Point(0, 0, 0), PointB=Point(16, 0, 0), PointC=Point(16, 2, 0))  # -> Rectangle, Length
up_to_each_level = UnitZ(Factor=domain_levels_2)
up_to_the_deck = UnitZ(Factor=deck_levels)
plan_mesh = MeshPlane(Boundary=plan.Rectangle, WidthCount=bricks_along, HeightCount=bricks_across)  # -> Mesh, Area
domain_levels_3 = Move(Geometry=plan_mesh.Mesh, Motion=up_to_each_level)  # -> Geometry, Transform
deck_levels_2 = Move(Geometry=plan_mesh.Mesh, Motion=up_to_the_deck)  # -> Geometry, Transform
mesh_series_to_brick = MeshSeriesToBrickAlpaca4d(Meshes=domain_levels_3.Geometry, Closed=False)
mesh_series_to_brick_2 = MeshSeriesToBrickAlpaca4d(Meshes=deck_levels_2.Geometry, Closed=False)

# ---- group: 4 - Pinned ends, 10 kN/m2 on the deck
across = Series(Start=0, Step=layer, Count=nodes_across)
bottom_of_both_ends = ConstructPoint(XCoordinate=graft([0, 16]), YCoordinate=across, ZCoordinate=0)
up_to_the_top = UnitZ(Factor=4)
deck_top = Move(Geometry=plan_mesh.Mesh, Motion=up_to_the_top)  # -> Geometry, Transform
deck_nodes = DeconstructMesh(Mesh=deck_top.Geometry)  # -> Vertices, Faces, Colours, Normals
held = BooleanToggle(True)
free = BooleanToggle(False)
how_many = ListLength(List=deck_nodes.Vertices)
pinned_ends = SupportAlpaca4d(
    Position=flatten(bottom_of_both_ends),
    Tx=held,
    Ty=held,
    Tz=held,
    Rx=free,
    Ry=free,
    Rz=free,
    mode="Support Rigid (Alpaca4d)")
each_node_s_share = Expression(c=how_many, Expression="-320/c")
down = UnitZ(Factor=each_node_s_share)
deck_load = PointLoadAlpaca4d(Point=deck_nodes.Vertices, Force=down, Moment=Vector(0, 0, 0))
load_pattern = LoadPatternAlpaca4d(Loads=flatten(deck_load), Factor=1, mode="PlainPattern (Alpaca4d)")

# ---- group: 3 - Steel, and the bricks named Domain and Deck
steel = Panel("S355")
e_kn_m2 = Panel("210000000")
g_kn_m2 = Panel("80769231")
poisson = Panel("0.3")
density_kg_m3 = Panel("7850")
steel_2 = ND(MaterialName=steel, E=e_kn_m2, G=g_kn_m2, Ν=poisson, Rho=density_kg_m3, mode="ElasticIsotropic (Alpaca4d)")
elementid = Panel("Domain")
elementid_2 = Panel("Deck")
domain = SSPBrickAlpaca4d(Mesh=mesh_series_to_brick, Material=steel_2, ElementId=elementid)
deck = SSPBrickAlpaca4d(Mesh=mesh_series_to_brick_2, Material=steel_2, ElementId=elementid_2)

# ---- group: 5 - Assemble Model (enable Model View to see the domain)
assemble_model = AssembleModelAlpaca4d(Elements=flatten([domain, deck]), Supports=flatten(pinned_ends), LoadPatterns=flatten(load_pattern), Tolerance=0.01)  # -> AlpacaModel, Mass
modelview = ModelViewAlpaca4d(AlpacaModel=assemble_model.AlpacaModel, Step=0, FittedLoads=True)  # -> AlpacaModel, Geometry, Info, Values, Colors; disabled

# ---- group: 6 - Topology Optimisation: set Run to true
keep = Panel("Deck")
volumefraction = Slider(0.2, range=0.05..0.5)
iterations = Slider(100, range=10..300)
run = BooleanToggle(False)
step = Slider(300, range=0..300)
topology = TopologyOptimisationAlpaca4d(
    AlpacaModel=assemble_model.AlpacaModel,
    Keep=keep,
    VolumeFraction=volumefraction,
    Iterations=iterations,
    Run=run,
    Penalty=3,
    Tolerance=0.01,
    MinStiffness=1e-09,
    Move=0.2,
    Threshold=0.5,
    System="Auto",
    Step=step)  # -> Surface, Solid, Density, Element, Compliance, Volume, Converged, History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
compliance = Panel(topology.Compliance)
converged = Panel(topology.Converged)
history = Panel(topology.History)

# ---- group: 7 - The design, analysed: once the run has stopped, enable Run Analysis and Legend
analysis_settings = AnalysisSettingsAlpaca4d(Constraint="Transformation", Numberer="RCM", System="Auto", Algorithm="Newton", AnalysisType="Static", Cores=0)
run_analysis = RunAnalysisAlpaca4d(AlpacaModel=topology.AlpacaModel, Settings=analysis_settings, settings=True)  # -> AlpacaModel, Log; disabled
modelview_2 = ModelViewAlpaca4d(AlpacaModel=run_analysis.AlpacaModel, Step=0, FittedLoads=True)  # -> AlpacaModel, Geometry, Info, Values, Colors
title = Panel("Von Mises stress [MPa]")
legend = LegendAlpaca4d(Title=title, Values=modelview_2.Values, Colors=modelview_2.Colors, Position=0, Scale=1.5)  # disabled
what_is_drawn = Panel(modelview_2.Info)
