# Grasshopper definition TopologyTrussNode.gh (Grasshopper 1.0.7)
# plug-ins: Galapagos, Kangaroo2 Components, Alpaca4d

# ---- group: 1 - How fine: Bricks per 10 cm, 1 to 3
# Space-truss node: Space-truss node - topology optimisation three ways.
# 
# The design domain is a cube of steel bricks, 1 m a side. The members that meet at it are stubs of bricks, 0.2 m long, named Member and kept solid through Keep; they are held or loaded at their ends (group 4). The same model goes to all three of Alpaca4d's topology optimisations:
# - Topology Optimisation (SIMP): densities between 0 and 1, the quickest;
# - BESO Topology: every brick solid or void, the volume coming down from the whole cube - drag Step BESO to see the node at every volume;
# - Multi-Material Topology: steel and aluminium, each up to its share.
# 
# 1. Set one Run to true at a time: each run goes on its own thread, and its design draws beside the others (group 7), SIMP on the left, BESO in the middle, Multi-material on the right.
# 2. Drag a Step slider back to watch that run again.
# 3. Once a run has stopped, enable its Run Analysis and Legend in group 8 to see its design in Von Mises stress, where the model is; disable them before analysing another.
# 4. Bricks per 10 cm 2 gives 8 000 bricks: SIMP and BESO take about a minute each on an M2 Pro, Multi-Material Topology a few. 1 is quick to try; 3, 27 000 bricks, is fine and slow.
# 
# Above 500 elements the three need a license.
bricks_per_10_cm = Slider(2, range=1..3)
bricks_per_metre = Expression(s=bricks_per_10_cm, Expression="10*s")
layer = Expression(n=bricks_per_metre, Expression="1/n")

# ---- group: 4 - Diagonals held at their feet; chords pulled (x) and pushed (y), unequally; the post loaded
# Loads, in kN: Chord +x, 450 kN in tension: (450, 0, 0)
# Chord -x, 250 kN in tension: (-250, 0, 0)
# Chord +y, 300 kN in compression: (0, -300, 0)
# Chord -y, 150 kN in compression: (0, 150, 0)
# Post, 600 kN down: (0, 0, -600)
width_m = Panel("""0.2
0.2
0.2
0.2""")
height_m = Panel("""0.2
0.2
0.2
0.2""")
width_m_2 = Panel("""0.2
0.2
0.2
0.2
0.2""")
height_m_2 = Panel("""0.2
0.2
0.2
0.2
0.2""")
along = Expression(l=width_m, n=bricks_per_metre, Expression="l*n")
across = Expression(l=height_m, n=bricks_per_metre, Expression="l*n")
along_2 = Expression(l=width_m_2, n=bricks_per_metre, Expression="l*n")
across_2 = Expression(l=height_m_2, n=bricks_per_metre, Expression="l*n")
held_ends = Rectangle3Pt(
    PointA=[Point(0, 0, -0.2), Point(0.8, 0, -0.2), Point(0, 0.8, -0.2), Point(0.8, 0.8, -0.2)],
    PointB=[Point(0.2, 0, -0.2), Point(1, 0, -0.2), Point(0.2, 0.8, -0.2), Point(1, 0.8, -0.2)],
    PointC=[Point(0.2, 0.2, -0.2), Point(1, 0.2, -0.2), Point(0.2, 1, -0.2), Point(1, 1, -0.2)])  # -> Rectangle, Length
loaded_ends = Rectangle3Pt(
    PointA=[Point(1.2, 0.4, 0.4), Point(-0.2, 0.4, 0.4), Point(0.4, 1.2, 0.4), Point(0.4, -0.2, 0.4), Point(0.4, 0.4, 1.2)],
    PointB=[Point(1.2, 0.6, 0.4), Point(-0.2, 0.6, 0.4), Point(0.6, 1.2, 0.4), Point(0.6, -0.2, 0.4), Point(0.6, 0.4, 1.2)],
    PointC=[Point(1.2, 0.6, 0.6), Point(-0.2, 0.6, 0.6), Point(0.6, 1.2, 0.6), Point(0.6, -0.2, 0.6), Point(0.6, 0.6, 1.2)])  # -> Rectangle, Length
held_ends_2 = MeshPlane(Boundary=held_ends.Rectangle, WidthCount=along, HeightCount=across)  # -> Mesh, Area
loaded_ends_2 = MeshPlane(Boundary=loaded_ends.Rectangle, WidthCount=along_2, HeightCount=across_2)  # -> Mesh, Area
held_ends_nodes = DeconstructMesh(Mesh=held_ends_2.Mesh)  # -> Vertices, Faces, Colours, Normals
loaded_ends_nodes = DeconstructMesh(Mesh=loaded_ends_2.Mesh)  # -> Vertices, Faces, Colours, Normals
held = BooleanToggle(True)
free = BooleanToggle(False)
nodes_on_each_end = ListLength(List=loaded_ends_nodes.Vertices)
x_kn = Panel("""450
-250
0
0
0""")
y_kn = Panel("""0
0
-300
150
0""")
z_kn = Panel("""0
0
0
0
-600""")
held_ends_3 = SupportAlpaca4d(
    Position=flatten(held_ends_nodes.Vertices),
    Tx=held,
    Ty=held,
    Tz=held,
    Rx=free,
    Ry=free,
    Rz=free,
    mode="Support Rigid (Alpaca4d)")
x_per_node = Expression(F=graft(x_kn), c=nodes_on_each_end, Expression="F/c")
y_per_node = Expression(F=graft(y_kn), c=nodes_on_each_end, Expression="F/c")
z_per_node = Expression(F=graft(z_kn), c=nodes_on_each_end, Expression="F/c")
each_node_s_share = VectorXYZ(XComponent=x_per_node, YComponent=y_per_node, ZComponent=z_per_node)  # -> Vector, Length
end_loads = PointLoadAlpaca4d(Point=loaded_ends_nodes.Vertices, Force=each_node_s_share.Vector, Moment=Vector(0, 0, 0))
load_pattern = LoadPatternAlpaca4d(Loads=flatten(end_loads), Factor=1, mode="PlainPattern (Alpaca4d)")

# ---- group: Steel, and aluminium for Multi-Material Topology
steel = Panel("S355")
e_kn_m2 = Panel("210000000")
g_kn_m2 = Panel("80769231")
poisson = Panel("0.3")
density_kg_m3 = Panel("7850")
aluminium = Panel("Aluminium")
e_kn_m2_2 = Panel("70000000")
g_kn_m2_2 = Panel("26300000")
poisson_2 = Panel("0.33")
density_kg_m3_2 = Panel("2700")
steel_2 = ND(MaterialName=steel, E=e_kn_m2, G=g_kn_m2, Ν=poisson, Rho=density_kg_m3, mode="ElasticIsotropic (Alpaca4d)")
aluminium_2 = ND(MaterialName=aluminium, E=e_kn_m2_2, G=g_kn_m2_2, Ν=poisson_2, Rho=density_kg_m3_2, mode="ElasticIsotropic (Alpaca4d)")

# ---- group: 3 - The members: stubs 0.2 m long, named Member, kept whatever the optimisation finds
along_x_m = Panel("""0.2
0.2
0.2
0.2
0.2
0.2
0.2
0.2
0.2""")
along_y_m = Panel("""0.2
0.2
0.2
0.2
0.2
0.2
0.2
0.2
0.2""")
along_z_m = Panel("""0.2
0.2
0.2
0.2
0.2
0.2
0.2
0.2
0.2""")
bricks_along = Expression(l=along_x_m, n=bricks_per_metre, Expression="l*n")
bricks_across = Expression(l=along_y_m, n=bricks_per_metre, Expression="l*n")
levels = Expression(l=along_z_m, n=bricks_per_metre, Expression="l*n+1")
stub_levels = Series(Start=0, Step=layer, Count=levels)
stub_plans = Rectangle3Pt(
    PointA=[Point(1, 0.4, 0.4), Point(-0.2, 0.4, 0.4), Point(0.4, 1, 0.4), Point(0.4, -0.2, 0.4), Point(0.4, 0.4, 1), Point(0, 0, -0.2), Point(0.8, 0, -0.2), Point(0, 0.8, -0.2), Point(0.8, 0.8, -0.2)],
    PointB=[Point(1.2, 0.4, 0.4), Point(0, 0.4, 0.4), Point(0.6, 1, 0.4), Point(0.6, -0.2, 0.4), Point(0.6, 0.4, 1), Point(0.2, 0, -0.2), Point(1, 0, -0.2), Point(0.2, 0.8, -0.2), Point(1, 0.8, -0.2)],
    PointC=[Point(1.2, 0.6, 0.4), Point(0, 0.6, 0.4), Point(0.6, 1.2, 0.4), Point(0.6, 0, 0.4), Point(0.6, 0.6, 1), Point(0.2, 0.2, -0.2), Point(1, 0.2, -0.2), Point(0.2, 1, -0.2), Point(1, 1, -0.2)])  # -> Rectangle, Length
up_to_each_level = UnitZ(Factor=stub_levels)
stub_plans_2 = MeshPlane(Boundary=stub_plans.Rectangle, WidthCount=bricks_along, HeightCount=bricks_across)  # -> Mesh, Area
stub_levels_2 = Move(Geometry=graft(stub_plans_2.Mesh), Motion=up_to_each_level)  # -> Geometry, Transform
mesh_series_to_brick = MeshSeriesToBrickAlpaca4d(Meshes=stub_levels_2.Geometry, Closed=False)
elementid = Panel("Member")
members = SSPBrickAlpaca4d(Mesh=flatten(mesh_series_to_brick), Material=steel_2, ElementId=elementid)

# ---- group: 2 - The node: a cube of steel bricks, 1 m a side
levels_2 = Expression(n=bricks_per_metre, Expression="n+1")
levels_3 = Series(Start=0, Step=layer, Count=levels_2)
plan = Rectangle3Pt(PointA=Point(0, 0, 0), PointB=Point(1, 0, 0), PointC=Point(1, 1, 0))  # -> Rectangle, Length
up_to_each_level_2 = UnitZ(Factor=levels_3)
plan_mesh = MeshPlane(Boundary=plan.Rectangle, WidthCount=bricks_per_metre, HeightCount=bricks_per_metre)  # -> Mesh, Area
levels_4 = Move(Geometry=plan_mesh.Mesh, Motion=up_to_each_level_2)  # -> Geometry, Transform
mesh_series_to_brick_2 = MeshSeriesToBrickAlpaca4d(Meshes=levels_4.Geometry, Closed=False)
elementid_2 = Panel("Node")
node = SSPBrickAlpaca4d(Mesh=mesh_series_to_brick_2, Material=steel_2, ElementId=elementid_2)

# ---- group: 5 - Assemble Model (enable Model View to see the supports and loads)
assemble_model = AssembleModelAlpaca4d(Elements=flatten([node, members]), Supports=flatten(held_ends_3), LoadPatterns=flatten(load_pattern), Tolerance=0.01)  # -> AlpacaModel, Mass
modelview = ModelViewAlpaca4d(AlpacaModel=assemble_model.AlpacaModel, Step=0, FittedLoads=True)  # -> AlpacaModel, Geometry, Info, Values, Colors; disabled

# ---- group: 6 - Three ways: set one Run to true at a time
keep = Panel("Member")
volumefraction = Slider(0.12, range=0.05..0.5)
iterations = Slider(200, range=10..300)
run_simp = BooleanToggle(False)
step_simp = Slider(300, range=0..300)
simp = TopologyOptimisationAlpaca4d(
    AlpacaModel=assemble_model.AlpacaModel,
    Keep=keep,
    VolumeFraction=volumefraction,
    Iterations=iterations,
    Run=run_simp,
    Penalty=3,
    Tolerance=0.01,
    MinStiffness=1e-09,
    Move=0.2,
    Threshold=0.5,
    System="Auto",
    Step=step_simp)  # -> Surface, Solid, Density, Element, Compliance, Volume, Converged, History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
iterations_2 = Slider(300, range=10..300)
run_beso = BooleanToggle(False)
step_beso = Slider(300, range=0..300)
beso = BESOTopologyAlpaca4d(
    AlpacaModel=assemble_model.AlpacaModel,
    Keep=keep,
    VolumeFraction=volumefraction,
    Iterations=iterations_2,
    Run=run_beso,
    EvolutionRate=0.02,
    Penalty=3,
    Tolerance=0.001,
    MinStiffness=1e-09,
    System="Auto",
    Step=step_beso)  # -> Surface, Solid, Density, Element, Compliance, Volume, Converged, History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
steel_share = Slider(0.04, range=0.01..0.3)
aluminium_share = Slider(0.08, range=0.01..0.5)
iterations_3 = Slider(300, range=10..500)
run_multi_material = BooleanToggle(False)
step_multi_material = Slider(500, range=0..500)
multitopology = MultiMaterialTopologyAlpaca4d(
    AlpacaModel=assemble_model.AlpacaModel,
    Keep=keep,
    Materials=[steel_2, aluminium_2],
    VolumeFractions=[steel_share, aluminium_share],
    Iterations=iterations_3,
    Run=run_multi_material,
    Penalty=3,
    PNorm=6,
    Tolerance=0.001,
    MinStiffness=1e-09,
    Move=0.1,
    Threshold=0.5,
    System="Auto",
    Step=step_multi_material)  # -> Surface, Colour, Solid, Material, Density, Element, Compliance, Volume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
compliance_simp = Panel(simp.Compliance)
compliance_beso = Panel(beso.Compliance)
compliance_multi_material = Panel(multitopology.Compliance)

# ---- group: 8 - Each design analysed: enable its Run Analysis and Legend once its run has stopped, one at a time
analysis_settings = AnalysisSettingsAlpaca4d(Constraint="Transformation", Numberer="RCM", System="Auto", Algorithm="Newton", AnalysisType="Static", Cores=0)
analyse_simp = RunAnalysisAlpaca4d(AlpacaModel=simp.AlpacaModel, Settings=analysis_settings, settings=True)  # -> AlpacaModel, Log; disabled
analyse_beso = RunAnalysisAlpaca4d(AlpacaModel=beso.AlpacaModel, Settings=analysis_settings, settings=True)  # -> AlpacaModel, Log; disabled
analyse_multi_material = RunAnalysisAlpaca4d(AlpacaModel=multitopology.AlpacaModel, Settings=analysis_settings, settings=True)  # -> AlpacaModel, Log; disabled
stress_simp = ModelViewAlpaca4d(AlpacaModel=analyse_simp.AlpacaModel, Step=0, FittedLoads=True)  # -> AlpacaModel, Geometry, Info, Values, Colors
stress_beso = ModelViewAlpaca4d(AlpacaModel=analyse_beso.AlpacaModel, Step=0, FittedLoads=True)  # -> AlpacaModel, Geometry, Info, Values, Colors
stress_multi_material = ModelViewAlpaca4d(AlpacaModel=analyse_multi_material.AlpacaModel, Step=0, FittedLoads=True)  # -> AlpacaModel, Geometry, Info, Values, Colors
title = Panel("Von Mises stress, SIMP")
legend_simp = LegendAlpaca4d(Title=title, Values=stress_simp.Values, Colors=stress_simp.Colors, Position=0, Scale=1.5)  # disabled
title_2 = Panel("Von Mises stress, BESO")
legend_beso = LegendAlpaca4d(Title=title_2, Values=stress_beso.Values, Colors=stress_beso.Colors, Position=0, Scale=1.5)  # disabled
title_3 = Panel("Von Mises stress, Multi-material")
legend_multi_material = LegendAlpaca4d(Title=title_3, Values=stress_multi_material.Values, Colors=stress_multi_material.Colors, Position=0, Scale=1.5)  # disabled

# ---- group: 7 - The three designs side by side: SIMP, Multi-material where the model is, BESO
along_x = UnitX(Factor=-2)
simp_beside = Move(Geometry=simp.Surface, Motion=along_x)  # -> Geometry, Transform
simp_name = XZPlane(Origin=Point(-1.5, 0.5, 1.4))
along_x_2 = UnitX(Factor=2)
beso_beside = Move(Geometry=beso.Surface, Motion=along_x_2)  # -> Geometry, Transform
beso_name = XZPlane(Origin=Point(2.5, 0.5, 1.4))
multi_material_name = XZPlane(Origin=Point(0.5, 0.5, 1.4))
simp_name_2 = TextTag3D(Location=simp_name, Text="SIMP", Size=0.09, Justification=7)
beso_name_2 = TextTag3D(Location=beso_name, Text="BESO", Size=0.09, Justification=7)
multi_material_name_2 = TextTag3D(Location=multi_material_name, Text="Multi-material", Size=0.09, Justification=7)
