# Grasshopper definition TopologyBenchmarks.gh (Grasshopper 1.0.7)
# plug-ins: Galapagos, Alpaca4d

# ---- group: 1 - top3d's material: E = 1, Poisson 0.3
# Topology Optimisation benchmarks: Topology Optimisation: top3d's benchmarks.
# 
# Two problems of top3d (Liu and Tovar 2014, 'An efficient 3D topology optimization code written in Matlab'), in its units and with its settings: 30% of the volume, penalty 3, a filter radius of 1.5, at most 200 iterations. Alpaca4d solves them with OpenSees; the panels give what its test bench and a numpy port of top3d give for the same problems.
# 
# 1. Set Run Cantilever to true. Its Surface draws as it goes; the run ends after 200 iterations, about 45 s on an Apple M2 Pro. Neither problem reaches top3d's tolerance of 0.01 before then; nor does top3d.
# 2. Compare 'Compliance, last iteration' with the panels under it. The first iterations agree with top3d to round-off; the cantilever's runs part by up to 0.2% while its design rearranges itself around iteration 70, and come back together.
# 3. The same for the simply supported beam, about 90 s.
# 4. Drag a Step slider back to watch the run again, design by design: every iteration is kept. Each step plays the next note of In the Hall of the Mountain King; right-click Topology Optimisation > Sound for Ode to Joy, a tone from the compliance, or none.
# 
# Expected: the cantilever as top flange, bottom flange and diagonal webs; the simply supported beam as a truss, its tie thickest at mid-span. Topology Optimisation needs a license.
material = Panel("top3d")
E = Panel("1")
G = Panel("0.384615384615385")
poisson = Panel("0.3")
density = Panel("0")
top3d_material = ND(MaterialName=material, E=E, G=G, Ν=poisson, Rho=density, mode="ElasticIsotropic (Alpaca4d)")

# ---- group: 2 - Cantilever, 60 x 4 x 20 bricks: top3d(60,20,4,0.3,3,1.5)
levels = Series(Start=0, Step=1, Count=21)
end_at_x_0 = ConstructPoint(
    XCoordinate=0,
    YCoordinate=graft([0, 1, 2, 3, 4]),
    ZCoordinate=[0, 1, 2, 3, 4, 5, 6, 7, 8, 9, 10, 11, 12, 13, 14, 15, 16, 17, 18, 19, 20])
cantilever_plan = Rectangle3Pt(PointA=Point(0, 0, 0), PointB=Point(60, 0, 0), PointC=Point(60, 4, 0))  # -> Rectangle, Length
up_to_each_level = UnitZ(Factor=levels)
bottom_of_the_free_end = ConstructPoint(XCoordinate=60, YCoordinate=[0, 1, 2, 3, 4], ZCoordinate=0)
plan_mesh = MeshPlane(Boundary=cantilever_plan.Rectangle, WidthCount=60, HeightCount=4)  # -> Mesh, Area
level_meshes = Move(Geometry=plan_mesh.Mesh, Motion=up_to_each_level)  # -> Geometry, Transform
mesh_series_to_brick = MeshSeriesToBrickAlpaca4d(Meshes=level_meshes.Geometry, Closed=False)
held_end = SupportAlpaca4d(Position=flatten(end_at_x_0), Tx=True, Ty=True, Tz=True, Rx=False, Ry=False, Rz=False)
unit_z = UnitZ(Factor=-1)
cantilever = SSPBrickAlpaca4d(Mesh=mesh_series_to_brick, Material=top3d_material)
tip_load = PointLoadAlpaca4d(Point=bottom_of_the_free_end, Force=unit_z, Moment=Vector(0, 0, 0))
load_pattern = LoadPatternAlpaca4d(Loads=flatten(tip_load), Factor=1, mode="PlainPattern (Alpaca4d)")

# ---- group: 3 - Simply supported beam, 120 x 4 x 20 bricks
levels_2 = Series(Start=0, Step=1, Count=21)
simply_supported_plan = Rectangle3Pt(PointA=Point(0, 0, 0), PointB=Point(120, 0, 0), PointC=Point(120, 4, 0))  # -> Rectangle, Length
up_to_each_level_2 = UnitZ(Factor=levels_2)
bottom_edge_at_x_0 = ConstructPoint(XCoordinate=0, YCoordinate=[0, 1, 2, 3, 4], ZCoordinate=0)
bottom_edge_at_x_120 = ConstructPoint(XCoordinate=120, YCoordinate=[0, 1, 2, 3, 4], ZCoordinate=0)
top_edge_at_mid_span = ConstructPoint(XCoordinate=60, YCoordinate=[0, 1, 2, 3, 4], ZCoordinate=20)
plan_mesh_2 = MeshPlane(Boundary=simply_supported_plan.Rectangle, WidthCount=120, HeightCount=4)  # -> Mesh, Area
level_meshes_2 = Move(Geometry=plan_mesh_2.Mesh, Motion=up_to_each_level_2)  # -> Geometry, Transform
mesh_series_to_brick_2 = MeshSeriesToBrickAlpaca4d(Meshes=level_meshes_2.Geometry, Closed=False)
pinned = SupportAlpaca4d(Position=flatten(bottom_edge_at_x_0), Tx=True, Ty=True, Tz=True, Rx=False, Ry=False, Rz=False)
rollers_free_along_x = SupportAlpaca4d(Position=flatten(bottom_edge_at_x_120), Tx=False, Ty=True, Tz=True, Rx=False, Ry=False, Rz=False)
unit_z_2 = UnitZ(Factor=-1)
simply_supported = SSPBrickAlpaca4d(Mesh=mesh_series_to_brick_2, Material=top3d_material)
mid_span_load = PointLoadAlpaca4d(Point=top_edge_at_mid_span, Force=unit_z_2, Moment=Vector(0, 0, 0))
load_pattern_2 = LoadPatternAlpaca4d(Loads=flatten(mid_span_load), Factor=1, mode="PlainPattern (Alpaca4d)")

# ---- group: 4 - Cantilever: set Run Cantilever to true (about 45 s)
cantilever_2 = AssembleModelAlpaca4d(Elements=flatten(cantilever), Supports=flatten(held_end), LoadPatterns=flatten(load_pattern), Tolerance=0.01)  # -> AlpacaModel, Mass
run_cantilever = BooleanToggle(False)
step_cantilever = Slider(200, range=0..200)
cantilever_3 = TopologyOptimisationAlpaca4d(
    AlpacaModel=cantilever_2.AlpacaModel,
    VolumeFraction=0.3,
    Iterations=200,
    Run=run_cantilever,
    Penalty=3,
    FilterRadius=1.5,
    Tolerance=0.01,
    MinStiffness=1e-09,
    Move=0.2,
    Threshold=0.5,
    System="Auto",
    Step=step_cantilever,
    TopologySoundMode="MountainKing")  # -> Surface, Solid, Density, Element, Compliance, Volume, Converged, History, Log, Step
last_compliance = ListItem(List=cantilever_3.Compliance, Index=-1, Wrap=True)
compliance_last_iteration = Panel(last_compliance)
iterations_run = ListLength(List=cantilever_3.Compliance)
iterations_run_2 = Panel(iterations_run)
expected_after_200_iterations = Panel("2415.86, 200 iterations")
top3d_reference_py = Panel("2415.82")
history = Panel(cantilever_3.History)

# ---- group: 5 - Simply supported: set Run Simply supported to true (about 90 s)
simply_supported_2 = AssembleModelAlpaca4d(
    Elements=flatten(simply_supported),
    Supports=flatten([pinned, rollers_free_along_x]),
    LoadPatterns=flatten(load_pattern_2),
    Tolerance=0.01)  # -> AlpacaModel, Mass
run_simply_supported = BooleanToggle(False)
step_simply_supported = Slider(200, range=0..200)
simply_supported_3 = TopologyOptimisationAlpaca4d(
    AlpacaModel=simply_supported_2.AlpacaModel,
    VolumeFraction=0.3,
    Iterations=200,
    Run=run_simply_supported,
    Penalty=3,
    FilterRadius=1.5,
    Tolerance=0.01,
    MinStiffness=1e-09,
    Move=0.2,
    Threshold=0.5,
    System="Auto",
    Step=step_simply_supported,
    TopologySoundMode="MountainKing")  # -> Surface, Solid, Density, Element, Compliance, Volume, Converged, History, Log, Step
last_compliance_2 = ListItem(List=simply_supported_3.Compliance, Index=-1, Wrap=True)
compliance_last_iteration_2 = Panel(last_compliance_2)
iterations_run_3 = ListLength(List=simply_supported_3.Compliance)
iterations_run_4 = Panel(iterations_run_3)
expected_after_200_iterations_2 = Panel("1203.026, 200 iterations")
top3d_reference_py_2 = Panel("1203.026")
history_2 = Panel(simply_supported_3.History)
