# Grasshopper definition TwoSpanBeamOptimiser.gh (Grasshopper 1.0.7)
# plug-ins: Galapagos, Kangaroo2 Components, Alpaca4d

# ---- group: 1 - The beam
# Section Optimiser: Two-span curved beam - a Section Optimiser example.
# 
# A curve about 30 m long rises and falls in a vertical plane. A point along it - Middle support at, from 0 to 1 along the reparameterized curve - shatters it into two segments, and each segment is divided into elements of about 25 cm, as many as its length holds. The beam is built in at both ends and pinned at the point between the segments. It carries its own weight ten times over - Gravity factor, the Factor of Gravity Load - and two point loads, 150 kN on the first span and 200 kN on the second, each moved along the curve by its slider to the node closest to it. The weight follows the sections the optimiser gives the beam, iteration by iteration.
# 
# It starts as an HEA300 in S235. One design group over the whole beam sizes it from the HEAs in the panel of 6, tried in the order the panel gives them. Uniform off, as it opens: each element takes the first that it can have, so the HEA varies along the beam - 7 names it wherever it changes. Uniform on: the whole beam takes the first that every element can have. Type other names into the panel - HEBs, IPEs - to size from those instead.
# 
# 8 draws the sized beam's deformed shape, extruded, 20 times its true size, coloured by displacement. Its bending moment and its shear are there too, with their previews off: turn one on to draw it. The optimiser checks resistance to EN 1993-1-1, not deflection.
# 
# Each element's buckling length, about both axes - LengthY and LengthZ in the Design menu - is the length of its span, the segment it is in. The top flange is taken as held sideways every 25 cm, wired into LengthLT. Slide it up to leave the beam free between its supports and lateral-torsional buckling takes over; checked element by element, that is only a rough guide.
span_m = Slider(28.7, range=2..60)
rise_m = Slider(4.5, range=0..10)
middle_support_at = Slider(0.5, range=0.05..0.95)
element_length_m = Slider(0.25, range=0.05..2)
starting_section = Panel("HEA300")
grade = ValueList({"S235", "S275", "S355", "S450"}, selected="S235")
first_load_at = Slider(0.25, range=0..1)
first_load_kn = Slider(150, range=0..500)
second_load_at = Slider(0.75, range=0..1)
second_load_kn = Slider(200, range=0..500)
gravity_factor = Slider(10, range=0..20)

# ---- group: 2 - Geometry
along_of_the_span = Panel("""0
0.25
0.5
0.75
1""")
height_of_the_rise = Panel("""0
0.7
1
0.55
0.25""")
X = Expression(a=along_of_the_span, S=span_m, Expression="a*S")
Z = Expression(h=height_of_the_rise, R=rise_m, Expression="h*R")
through = ConstructPoint(XCoordinate=X, YCoordinate=0, ZCoordinate=Z)
beam = Interpolate(Vertices=through, Degree=3, Periodic=False, KnotStyle=1)  # -> Curve, Length, Domain
middle_point = EvaluateCurve(Curve=reparameterize(beam.Curve), Parameter=middle_support_at)  # -> Point, Tangent, Angle
length_m = Panel(beam.Length)
on_the_curve = CurveClosestPoint(Point=middle_point.Point, Curve=beam.Curve)  # -> Point, Parameter, Distance
two_segments = Shatter(Curve=beam.Curve, Parameters=on_the_curve.Parameter)
segment_length = Length(Curve=two_segments)
elements_per_segment = Expression(L=segment_length, s=element_length_m, Expression="Max(1,Round(L/s))")
nodes = DivideCurve(Curve=two_segments, Count=elements_per_segment, Kinks=False)  # -> Points, Tangents, Parameters
pline = PolyLine(Vertices=nodes.Points, Closed=False)
elements = Explode(Curve=pline, Recursive=True)  # -> Segments, Vertices

# ---- group: 4 - Supports and loads
load_along = EvaluateCurve(Curve=reparameterize(beam.Curve), Parameter=[first_load_at, second_load_at])  # -> Point, Tangent, Angle
ends = EndPoints(Curve=beam.Curve)  # -> Start, End
free = BooleanToggle(False)
downwards = Expression(P=[first_load_kn, second_load_kn], Expression="-P")
nearest_node = ClosestPoint(Point=load_along.Point, Cloud=flatten(nodes.Points))  # -> ClosestPoint, CPIndex, Distance
fixed = SupportAlpaca4d(Position=[ends.Start, ends.End], Tx=True, Ty=True, Tz=True, Rx=True, Ry=True, Rz=True, mode="Support Rigid (Alpaca4d)")
pinned = SupportAlpaca4d(Position=on_the_curve.Point, Tx=True, Ty=True, Tz=True, Rx=free, Ry=free, Rz=free, mode="Support Rigid (Alpaca4d)")
down = UnitZ(Factor=downwards)
moving_load = PointLoadAlpaca4d(Point=nearest_node.ClosestPoint, Force=down, Moment=Vector(0, 0, 0))
self_weight = GravityLoadAlpaca4d(Factor=gravity_factor)
load_pattern = LoadPatternAlpaca4d(Loads=flatten([moving_load, self_weight]), Factor=1, mode="PlainPattern (Alpaca4d)")

# ---- group: 3 - Member
material_library_elastic = MaterialLibraryElasticAlpaca4d(
    MaterialName=grade,
    MaterialPresetElastic_Grade="S235",
    MaterialPresetElastic_Model="Uniaxial",
    MaterialPresetElastic_Type="Steel",
    menu=[dropdown(0), dropdown(1), dropdown(0)])
starting_section_2 = SteelSectionLibraryAlpaca4d(SectionName=starting_section, Material=material_library_elastic, menu=[dropdown(0), dropdown(1)])
elementid = Panel("Beam")
forcebeamcolumn = ForceBeamColumnAlpaca4d(
    Line=flatten(elements.Segments),
    Section=starting_section_2,
    Colour=RGB(1, 30, 254),
    ElementId=elementid,
    mode="ForceBeamColumn (Alpaca4d)")

# ---- group: 5 - Model
assemble_model = AssembleModelAlpaca4d(Elements=forcebeamcolumn, Supports=[fixed, pinned], LoadPatterns=load_pattern, Tolerance=0.01)  # -> AlpacaModel, Mass

# ---- group: 6 - Section Optimiser, one design group over the whole beam
sections_in_the_order_to_try_them = Panel("""HEA100
HEA120
HEA140
HEA160
HEA180
HEA200
HEA220
HEA240
HEA260
HEA280
HEA300
HEA320
HEA340
HEA360
HEA400
HEA450
HEA500
HEA550
HEA600
HEA650
HEA700
HEA800
HEA900
HEA1000""")
span_of_each_element = DuplicateData(Data=graft(segment_length), Number=graft(elements_per_segment), Order=True)
sections = SteelSectionLibraryAlpaca4d(SectionName=sections_in_the_order_to_try_them, Material=material_library_elastic, menu=[dropdown(0), dropdown(1)])
name = Panel("Whole beam")
uniform = BooleanToggle(False)
maxutilisation = Slider(1, range=0.5..1)
lateral_restraint_every_m = Slider(0.25, range=0.05..30)
iterations = Slider(20, range=1..50)
design_group = DesignGroupAlpaca4d(Name=name, ElementId=elementid, Sections=sections, Uniform=uniform)
whole_beam = SectionOptimiserAlpaca4d(
    AlpacaModel=assemble_model.AlpacaModel,
    DesignGroups=design_group,
    MaxUtilisation=maxutilisation,
    Iterations=iterations,
    Fabrication="Rolled",
    ΓM0=1,
    ΓM1=1,
    LengthY=flatten(span_of_each_element),
    LengthZ=flatten(span_of_each_element),
    LengthLT=lateral_restraint_every_m,
    System="Auto",
    Algorithm="Newton")  # -> AlpacaModel, Section, Utilisation, Element, Mass, Converged, Governing, Group, History, Log
section = Panel(whole_beam.Section)
utilisation = Panel(whole_beam.Utilisation)
governing = Panel(whole_beam.Governing)
modelview = ModelViewAlpaca4d(AlpacaModel=whole_beam.AlpacaModel, Step=0, FittedLoads=True)  # -> AlpacaModel, Geometry, Info, Values, Colors
converged = Panel(whole_beam.Converged)
mass = Panel(whole_beam.Mass)
history = Panel(whole_beam.History)

# ---- group: 7 - The HEA named where it changes
middles = CurveMiddle(Curve=flatten(elements.Segments))
numbered = CreateSet(List=section)  # -> Set, Map
up = UnitZ(Factor=0.4)
back = UnitX(Factor=-1)
end = Panel("-1")
with_an_end = Merge(Data1=flatten(numbered.Map), Data2=flatten(end))
above = Move(Geometry=middles, Motion=up)  # -> Geometry, Transform
the_one_before = ShiftList(List=with_an_end, Shift=-1, Wrap=True)
changes = Equality(FirstNumber=with_an_end, SecondNumber=the_one_before)  # -> Equality, Inequality
run_names = CullPattern(List=section, CullPattern=changes.Inequality)
run_starts = CullPattern(List=above.Geometry, CullPattern=changes.Inequality)
upright = ConstructPlane(Origin=run_starts, XAxis=up, YAxis=back)
hea = TextTag3D(Location=upright, Text=run_names, Size=0.2, Colour=RGB(42, 45, 49), Justification=4)

# ---- group: 8 - Deformed shape, bending moment and shear
deformed_shape = ModelViewAlpaca4d(AlpacaModel=whole_beam.AlpacaModel, Step=0, FittedLoads=True)  # -> AlpacaModel, Geometry, Info, Values, Colors
info = Panel(deformed_shape.Info)
title = Panel("Displacement [mm]")
legend = LegendAlpaca4d(Title=title, Values=deformed_shape.Values, Colors=deformed_shape.Colors, Position=0, Scale=1.5)
bending_moment = ModelViewAlpaca4d(AlpacaModel=whole_beam.AlpacaModel, Step=0, FittedLoads=True)  # -> AlpacaModel, Geometry, Info, Values, Colors
info_2 = Panel(bending_moment.Info)
shear = ModelViewAlpaca4d(AlpacaModel=whole_beam.AlpacaModel, Step=0, FittedLoads=True)  # -> AlpacaModel, Geometry, Info, Values, Colors
info_3 = Panel(shear.Info)
