# Grasshopper definition VerticalTrussFacade.gh (Grasshopper 1.0.7)
# plug-ins: Galapagos, Kangaroo2 Components, Alpaca4d

# ---- group: 1 - Geometry: mullions and transoms, and a vertical truss behind each mullion
# Vertical truss facade: Vertical truss facade - a glass wall stiffened by vertical trusses, as a lobby's is.
# 
# The wall is held only at its foot and its top, 10.8 m apart. Behind every mullion - or every second, third or fourth, with the slider - a vertical truss stiffens it against the wind: the mullion is its outer chord, a tube behind it the inner chord, with a post at every transom and diagonals between.
# 
# The wind is typed in kN/m2 and put on the mullions, each times the width of wall it catches. The glass hangs on the transoms, its weight in kN/m2 times the height of glass each carries.
bays = Slider(8, range=2..16)
bay_width_m = Slider(1.5, range=1..3)
height_m = Slider(10.8, range=6..16)
transom_levels = Slider(6, range=3..10)
truss_depth_m = Slider(0.9, range=0.4..2)
a_truss_every_mullions = Slider(1, range=1..4)
vertical_truss_facade = GhPythonScript(
    Bays=bays,
    BayWidth=bay_width_m,
    Height=height_m,
    Levels=transom_levels,
    Depth=truss_depth_m,
    TrussEvery=a_truss_every_mullions)  # -> out, Mullions, MullionWidths, Transoms, Chords, Posts, Diagonals, Base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; inputs Bays: Int32, Levels: Int32, TrussEvery: Int32
# ---------- vertical_truss_facade: Python ----------
"""The geometry of the conventional structures of Structures.py, one function a structure.

Structures.py puts one of them into a GhPython component, whose inputs are the function's arguments
and whose outputs are what it returns, in order: lines for each kind of member, the points the
structure is held at, and the widths its loads are worked out from. Every member is a straight line
between two nodes, cut wherever another member meets it, so that the elements share their nodes.

Runs in GhPython (Rhino 7 and 8) and in Rhino 8's Python 3 component alike.
"""
from __future__ import division

import math
import Rhino.Geometry as rg


def P(x, y, z):
    return rg.Point3d(x, y, z)


def L(a, b):
    return rg.Line(a, b)


def pieces(a, b, n):
    """The line from a to b in n pieces."""
    n = max(1, int(n))
    return [L(a + (b - a) * (i / n), a + (b - a) * ((i + 1) / n)) for i in range(n)]


# ---------------------------------------------------------------- 1 - a steel hall roofed by trusses

def hall(Span, Bays, Spacing, Eaves, Depth, Panels):
    """Frames of a Pratt truss on two columns, Spacing apart, joined by purlins at the truss's top nodes.
    The columns rise to the top chord, the bottom chord meeting them at the eaves, so that each frame
    stands on pinned feet. The two end bays are braced: crosses in the roof, between the top chords,
    and in the long walls, with a strut along each wall at the eaves. PurlinWidths: the width of roof
    each purlin carries, a panel, or half of one at the eaves."""
    n = max(2, int(Panels) // 2 * 2)
    bays = max(1, int(Bays))
    dx = Span / n
    top = Eaves + Depth
    Columns, Chords, Webs, Purlins, PurlinWidths, Bracing, Struts, Feet = [], [], [], [], [], [], [], []
    for i in range(bays + 1):
        y = i * Spacing
        for x in (0.0, Span):
            Columns += [L(P(x, y, 0), P(x, y, Eaves)), L(P(x, y, Eaves), P(x, y, top))]
            Feet.append(P(x, y, 0))
        for k in range(n):
            x0, x1 = k * dx, (k + 1) * dx
            Chords += [L(P(x0, y, Eaves), P(x1, y, Eaves)), L(P(x0, y, top), P(x1, y, top))]
            # Pratt: the diagonals fall towards the middle, in tension under the roof's weight.
            if k < n // 2:
                Webs.append(L(P(x0, y, top), P(x1, y, Eaves)))
            else:
                Webs.append(L(P(x0, y, Eaves), P(x1, y, top)))
        Webs += [L(P(k * dx, y, Eaves), P(k * dx, y, top)) for k in range(1, n)]
    for i in range(bays):
        y0, y1 = i * Spacing, (i + 1) * Spacing
        for k in range(n + 1):
            Purlins.append(L(P(k * dx, y0, top), P(k * dx, y1, top)))
            PurlinWidths.append(dx / 2 if k in (0, n) else dx)
        for x in (0.0, Span):
            Struts.append(L(P(x, y0, Eaves), P(x, y1, Eaves)))
        if i in (0, bays - 1):
            for k in range(n):
                Bracing += [L(P(k * dx, y0, top), P((k + 1) * dx, y1, top)),
                            L(P((k + 1) * dx, y0, top), P(k * dx, y1, top))]
            for x in (0.0, Span):
                Bracing += [L(P(x, y0, 0), P(x, y1, Eaves)), L(P(x, y1, 0), P(x, y0, Eaves))]
    return Columns, Chords, Webs, Purlins, PurlinWidths, Bracing, Struts, Feet


# ---------------------------------------------------------------- 2 - a steel tower with a stair

def tower(Width, Levels, Storey):
    """Four legs Width apart, a landing at every level and a crossed bracing on every face of every
    storey. A straight flight of stairs climbs each storey along a strip a metre wide across the
    middle, turning back at each landing: two stringers, from one side of the landing below to the
    other side of the landing above. A landing is its four edge beams and two cross beams along the
    strip, its Strip, which the stringers start and end on. The legs on the windward side, x = 0, are
    WindwardLegs, for the wind."""
    levels = max(1, int(Levels))
    w = Width
    y1, y2 = 0.5 * w - 0.5, 0.5 * w + 0.5
    corners = [(0, 0), (w, 0), (w, w), (0, w)]
    Legs, WindwardLegs, Bracing, Landings, Strip, Stringers, Feet = [], [], [], [], [], [], []
    for x, y in corners:
        Feet.append(P(x, y, 0))
        legs = pieces(P(x, y, 0), P(x, y, levels * Storey), levels)
        (WindwardLegs if x == 0 else Legs).extend(legs)
    for j in range(levels):
        z0, z1 = j * Storey, (j + 1) * Storey
        for k in range(4):
            (ax, ay), (bx, by) = corners[k], corners[(k + 1) % 4]
            Bracing += [L(P(ax, ay, z0), P(bx, by, z1)), L(P(bx, by, z0), P(ax, ay, z1))]
        # The landing at the top of the storey: the sides along y cut where the strip meets them.
        Landings += [L(P(0, 0, z1), P(w, 0, z1)), L(P(0, w, z1), P(w, w, z1))]
        for x in (0.0, w):
            Landings += [L(P(x, 0, z1), P(x, y1, z1)), L(P(x, y1, z1), P(x, y2, z1)), L(P(x, y2, z1), P(x, w, z1))]
        Strip += [L(P(0, y1, z1), P(w, y1, z1)), L(P(0, y2, z1), P(w, y2, z1))]
        # The flight: up along +x in even storeys, back along -x in odd ones.
        a, b = (0.0, w) if j % 2 == 0 else (w, 0.0)
        Stringers += [L(P(a, y, z0), P(b, y, z1)) for y in (y1, y2)]
    # The ground has no landing beams: the first flight starts on its own footing.
    Feet += [P(0.0, y, 0) for y in (y1, y2)]
    return Legs, WindwardLegs, Bracing, Landings, Strip, Stringers, Feet


# ---------------------------------------------------------------- 3 - a canopy on T-shaped frames

def canopy(Frames, Spacing, Height, Cantilever, Rise, Purlins):
    """A row of frames, Spacing apart: a column built in at its foot and an arm cantilevering each way
    from its head, rising Rise to its tip. Purlins join the frames at the head and at Purlins points
    along each arm. A cross between two columns in the middle bay holds the row lengthways.
    LeftWidths and RightWidths: the width of roof, on plan, each purlin carries on the left (-x) and
    the right (+x) of the frames, nothing on the other side: a purlin's share, or half at a tip or the
    head."""
    frames = max(2, int(Frames))
    m = max(1, int(Purlins))
    s = Cantilever / m
    Columns, Arms, Purlins, LeftWidths, RightWidths, Bracing, Feet = [], [], [], [], [], [], []
    for i in range(frames):
        y = i * Spacing
        Columns.append(L(P(0, y, 0), P(0, y, Height)))
        Feet.append(P(0, y, 0))
        for side in (-1, 1):
            Arms += pieces(P(0, y, Height), P(side * Cantilever, y, Height + Rise), m)
    for i in range(frames - 1):
        y0, y1 = i * Spacing, (i + 1) * Spacing
        Purlins.append(L(P(0, y0, Height), P(0, y1, Height)))
        LeftWidths.append(s / 2)
        RightWidths.append(s / 2)
        for side in (-1, 1):
            for k in range(1, m + 1):
                Purlins.append(L(P(side * k * s, y0, Height + k * Rise / m), P(side * k * s, y1, Height + k * Rise / m)))
                width = s / 2 if k == m else s
                LeftWidths.append(width if side < 0 else 0.0)
                RightWidths.append(width if side > 0 else 0.0)
    middle = (frames - 1) // 2
    y0, y1 = middle * Spacing, (middle + 1) * Spacing
    Bracing += [L(P(0, y0, 0), P(0, y1, Height)), L(P(0, y1, 0), P(0, y0, Height))]
    return Columns, Arms, Purlins, LeftWidths, RightWidths, Bracing, Feet


# ---------------------------------------------------------------- 4 - a facade stiffened by vertical trusses

def facade(Bays, BayWidth, Height, Levels, Depth, TrussEvery):
    """A glass wall Height tall in the plane y = 0, held only at its foot and its top, as a lobby's is:
    mullions every BayWidth and transoms between them at Levels heights. Behind every TrussEvery-th
    mullion a vertical truss stiffens it against the wind: the mullion is its outer chord, a tube
    Depth behind it the inner chord, with a post at every transom and diagonals zig-zagging between.
    The mullions stand on their feet and are held across the wall at the top; the inner chords too,
    and along the wall at the top as well, which nothing else holds them in.
    MullionWidths: the width of wall each piece of mullion catches the wind over, a bay or half of one
    at the ends. PanelHeight: the height of glass each transom carries."""
    bays, levels, every = max(1, int(Bays)), max(2, int(Levels)), max(1, int(TrussEvery))
    dz = Height / levels
    Mullions, MullionWidths, Transoms, Chords, Posts, Diagonals = [], [], [], [], [], []
    Base, Tops, ChordBase, ChordTops = [], [], [], []
    for i in range(bays + 1):
        x = i * BayWidth
        Mullions += pieces(P(x, 0, 0), P(x, 0, Height), levels)
        MullionWidths += [BayWidth / 2 if i in (0, bays) else BayWidth] * levels
        Base.append(P(x, 0, 0))
        Tops.append(P(x, 0, Height))
        if i % every:
            continue
        Chords += pieces(P(x, Depth, 0), P(x, Depth, Height), levels)
        Posts += [L(P(x, 0, k * dz), P(x, Depth, k * dz)) for k in range(levels + 1)]
        for k in range(levels):
            z0, z1 = k * dz, (k + 1) * dz
            Diagonals.append(L(P(x, 0, z0), P(x, Depth, z1)) if k % 2 == 0 else L(P(x, Depth, z0), P(x, 0, z1)))
        ChordBase.append(P(x, Depth, 0))
        ChordTops.append(P(x, Depth, Height))
    for k in range(1, levels):
        Transoms += [L(P(i * BayWidth, 0, k * dz), P((i + 1) * BayWidth, 0, k * dz)) for i in range(bays)]
    PanelHeight = dz
    return Mullions, MullionWidths, Transoms, Chords, Posts, Diagonals, Base, Tops, ChordBase, ChordTops, PanelHeight


# ---------------------------------------------------------------- 5 - a barrel vault under wind

def vault(Span, Rise, Length, Strips, Divisions, Windward, Crown, Leeward):
    """A barrel vault spanning Span across x, Rise high, Length long along y: the arc of a circle
    through its two feet and its crown, cut into Strips strips along its length, each a mesh of quads
    Divisions long. A strip's faces all face the same way, so one pressure on a strip acts along one
    direction. The pressure coefficients of the windward quarter, the middle half and the leeward
    quarter, wind blowing along +x, are given to each strip by where its middle is, with the strip's
    outward Normal: a positive coefficient pushes on the vault, along -Normal, a negative one pulls it
    away. The feet are held along both long edges."""
    strips, divisions = max(4, int(Strips)), max(1, int(Divisions))
    r = (0.25 * Span * Span + Rise * Rise) / (2 * Rise)
    zc = Rise - r
    # Half the angle the arc spans, from the crown to a foot: past 90 degrees for more than a semicircle.
    half = math.atan2(0.5 * Span, r - Rise)

    def at(t, y):
        a = -half + 2 * half * t
        return P(0.5 * Span + r * math.sin(a), y, zc + r * math.cos(a))

    Strip, Names, Coefficients, Normals, Feet = [], [], [], [], []
    for s in range(strips):
        mesh = rg.Mesh()
        for k in range(divisions + 1):
            y = Length * k / divisions
            mesh.Vertices.Add(at(s / strips, y))
            mesh.Vertices.Add(at((s + 1) / strips, y))
        for k in range(divisions):
            mesh.Faces.AddFace(2 * k, 2 * k + 1, 2 * k + 3, 2 * k + 2)
        mesh.Normals.ComputeNormals()
        Strip.append(mesh)
        Names.append("Strip_{0}".format(s))
        middle = (s + 0.5) / strips
        Coefficients.append(Windward if middle < 0.25 else Leeward if middle > 0.75 else Crown)
        a = -half + 2 * half * middle
        Normals.append(rg.Vector3d(math.sin(a), 0, math.cos(a)))
    for k in range(divisions + 1):
        y = Length * k / divisions
        Feet += [at(0, y), at(1, y)]
    return Strip, Names, Coefficients, Normals, Feet


# ---------------------------------------------------------------- 6 - a facade held by wind trusses

def windtruss(Width, Height, Spacing, Depth, Trusses):
    """A tall glass facade Width wide and Height high in the plane y = 0, its mullions Spacing apart
    standing on their feet and held across the facade at the top, and at Trusses levels between by
    horizontal trusses behind it. Each truss spans the whole width between the building's columns at
    its two ends: its outer chord runs through the mullions, its inner chord Depth behind, with a
    post at every mullion and diagonals between, falling towards the middle. MullionWidths: the width
    of facade each piece of mullion catches the wind over, its spacing or half of it at the ends."""
    n = max(2, int(round(Width / Spacing)))
    s = Width / n
    trusses = max(1, int(Trusses))
    levels = [Height * (k + 1) / (trusses + 1) for k in range(trusses)]
    heights = [0.0] + levels + [Height]
    Mullions, MullionWidths, Chords, Posts, Diagonals, Base, Tops, TrussEnds = [], [], [], [], [], [], [], []
    for i in range(n + 1):
        x = i * s
        Mullions += [L(P(x, 0, heights[k]), P(x, 0, heights[k + 1])) for k in range(len(heights) - 1)]
        MullionWidths += [s / 2 if i in (0, n) else s] * (len(heights) - 1)
        Base.append(P(x, 0, 0))
        Tops.append(P(x, 0, Height))
    for z in levels:
        for i in range(n):
            x0, x1 = i * s, (i + 1) * s
            Chords += [L(P(x0, 0, z), P(x1, 0, z)), L(P(x0, Depth, z), P(x1, Depth, z))]
            if i < n // 2:
                Diagonals.append(L(P(x0, Depth, z), P(x1, 0, z)))
            else:
                Diagonals.append(L(P(x0, 0, z), P(x1, Depth, z)))
        Posts += [L(P(i * s, 0, z), P(i * s, Depth, z)) for i in range(n + 1)]
        TrussEnds += [P(0, 0, z), P(0, Depth, z), P(Width, 0, z), P(Width, Depth, z)]
    return Mullions, MullionWidths, Chords, Posts, Diagonals, Base, Tops, TrussEnds


Mullions, MullionWidths, Transoms, Chords, Posts, Diagonals, Base, Tops, ChordBase, ChordTops, PanelHeight = facade(Bays, BayWidth, Height, Levels, Depth, TrussEvery)
# ---------- end vertical_truss_facade ----------

# ---- group: 2 - Members: hollow mullions and transoms, tube chords, posts and diagonals as trusses
s355 = MaterialLibraryElasticAlpaca4d(
    MaterialName="S355",
    Colour=RGB(190, 194, 199),
    MaterialPresetElastic_Grade="S235",
    MaterialPresetElastic_Model="Uniaxial",
    MaterialPresetElastic_Type="Steel",
    menu=[dropdown(0), dropdown(1), dropdown(0)])
_120x60x4 = SteelSectionLibraryAlpaca4d(SectionName="120x60x4", Material=s355, menu=[dropdown(0), dropdown(1)])
_100x50x4 = SteelSectionLibraryAlpaca4d(SectionName="100x50x4", Material=s355, menu=[dropdown(0), dropdown(1)])
_76_1x4 = SteelSectionLibraryAlpaca4d(SectionName="76.1x4", Material=s355, menu=[dropdown(0), dropdown(1)])
_48_3x4 = SteelSectionLibraryAlpaca4d(SectionName="48.3x4", Material=s355, menu=[dropdown(0), dropdown(1)])
_48_3x4_2 = SteelSectionLibraryAlpaca4d(SectionName="48.3x4", Material=s355, menu=[dropdown(0), dropdown(1)])
mullions = ForceBeamColumnAlpaca4d(
    Line=vertical_truss_facade.Mullions,
    Section=_120x60x4,
    ZAxis=Vector(1, 0, 0),
    Colour=RGB(1, 30, 254),
    mode="ForceBeamColumn (Alpaca4d)")
transoms = ForceBeamColumnAlpaca4d(Line=vertical_truss_facade.Transoms, Section=_100x50x4, Colour=RGB(1, 30, 254), mode="ForceBeamColumn (Alpaca4d)")
inner_chords = ForceBeamColumnAlpaca4d(Line=vertical_truss_facade.Chords, Section=_76_1x4, Colour=RGB(1, 30, 254), mode="ForceBeamColumn (Alpaca4d)")
posts = ForceBeamColumnAlpaca4d(
    Line=vertical_truss_facade.Posts,
    Section=_48_3x4,
    WorksIn="Both",
    Prestress=0,
    Colour=RGB(1, 30, 254),
    mode="Truss (Alpaca4d)")
diagonals = ForceBeamColumnAlpaca4d(
    Line=vertical_truss_facade.Diagonals,
    Section=_48_3x4_2,
    WorksIn="Both",
    Prestress=0,
    Colour=RGB(1, 30, 254),
    mode="Truss (Alpaca4d)")

# ---- group: 4 - Loads: own weight and the glass on the transoms, wind on the mullions
wind_kn_m2 = Slider(1.2, range=0..2.5)
glass_kn_m2 = Slider(0.5, range=0..1.5)
wind_kn_m = Expression(q=wind_kn_m2, w=vertical_truss_facade.MullionWidths, Expression="q*w")
glass_kn_m = Expression(q=glass_kn_m2, w=vertical_truss_facade.PanelHeight, Expression="-q*w")
wind = UnitY(Factor=wind_kn_m)
glass = UnitZ(Factor=glass_kn_m)
wind_2 = LinearLoadAlpaca4d(BeamId=flatten(mullions), Force=flatten(wind))
glass_2 = LinearLoadAlpaca4d(BeamId=flatten(transoms), Force=flatten(glass))
own_weight = GravityLoadAlpaca4d(Factor=1)
own_weight_2 = LoadPatternAlpaca4d(Loads=flatten([own_weight, glass_2]), Factor=1, mode="PlainPattern (Alpaca4d)")
wind_3 = LoadPatternAlpaca4d(Loads=flatten(wind_2), Factor=1, mode="PlainPattern (Alpaca4d)")

# ---- group: 3 - Supports: the wall held at its foot and its top only
feet = SupportAlpaca4d(
    Position=vertical_truss_facade.Base,
    Tx=True,
    Ty=True,
    Tz=True,
    Rx=False,
    Ry=False,
    Rz=True,
    mode="Support Rigid (Alpaca4d)")
tops = SupportAlpaca4d(
    Position=vertical_truss_facade.Tops,
    Tx=False,
    Ty=True,
    Tz=False,
    Rx=False,
    Ry=False,
    Rz=True,
    mode="Support Rigid (Alpaca4d)")
chord_feet = SupportAlpaca4d(
    Position=vertical_truss_facade.ChordBase,
    Tx=True,
    Ty=True,
    Tz=True,
    Rx=False,
    Ry=False,
    Rz=True,
    mode="Support Rigid (Alpaca4d)")
chord_tops = SupportAlpaca4d(
    Position=vertical_truss_facade.ChordTops,
    Tx=True,
    Ty=True,
    Tz=False,
    Rx=False,
    Ry=False,
    Rz=True,
    mode="Support Rigid (Alpaca4d)")

# ---- group: 5 - Analysis
vertical_truss_facade_2 = AssembleModelAlpaca4d(
    Elements=flatten([mullions, transoms, inner_chords, posts, diagonals]),
    Supports=flatten([feet, tops, chord_feet, chord_tops]),
    LoadPatterns=flatten([own_weight_2, wind_3]),
    Tolerance=0.01)  # -> AlpacaModel, Mass
analysis_settings = AnalysisSettingsAlpaca4d(Constraint="Transformation", Numberer="RCM", System="Auto", Algorithm="Newton", AnalysisType="Static", Cores=0)
run_analysis = RunAnalysisAlpaca4d(AlpacaModel=vertical_truss_facade_2.AlpacaModel, Settings=analysis_settings, settings=True)  # -> AlpacaModel, Log

# ---- group: 6 - Results: the deformed shape, drawn 200 times, and the loads
facade_deformed = ModelViewAlpaca4d(
    AlpacaModel=run_analysis.AlpacaModel,
    Step=0,
    Colors=[RGB(42, 45, 49), RGB(48, 68, 99), RGB(54, 91, 148), RGB(60, 113, 198), RGB(66, 136, 247), RGB(89, 115, 240), RGB(112, 95, 233), RGB(135, 74, 225), RGB(158, 53, 218)],
    FittedLoads=True)  # -> AlpacaModel, Geometry, Info, Values, Colors
vertical_truss_facade_at_rest = ModelViewAlpaca4d(AlpacaModel=vertical_truss_facade_2.AlpacaModel, Step=0, FittedLoads=True)  # -> AlpacaModel, Geometry, Info, Values, Colors
vertical_truss_facade_loads = ModelViewAlpaca4d(AlpacaModel=vertical_truss_facade_2.AlpacaModel, Step=0, FittedLoads=True)  # -> AlpacaModel, Geometry, Info, Values, Colors
facade_deformed_title = Panel("Displacement [mm]")
facade_deformed_legend = LegendAlpaca4d(Title=facade_deformed_title, Values=facade_deformed.Values, Colors=facade_deformed.Colors, Position=0, Scale=2.4)
