# Grasshopper definition HowToPictures.gh (Grasshopper 1.0.7)
# plug-ins: Galapagos, Kangaroo2 Components, Alpaca4d

# ---- group: Supports
feet = Point([Point(0, 0, 0), Point(3, 0, 0), Point(6, 0, 0), Point(9, 0, 0), Point(12, 0, 0), Point(15, 0, 0)])
tops = Point([Point(0, 0, 1.5), Point(3, 0, 1.5), Point(6, 0, 1.5), Point(9, 0, 1.5), Point(12, 0, 1.5), Point(15, 0, 1.5)])
columns = Line(StartPoint=feet, EndPoint=tops)
fixed = Point(Point(0, 0, 0))
pinned = Point(Point(3, 0, 0))
roller = Point(Point(6, 0, 0))
skewed = Point(Point(9, 0, 0))
springs = Point(Point(12, 0, 0))
compression_only = Point(Point(15, 0, 0))
material_library_elastic = MaterialLibraryElasticAlpaca4d(
    MaterialName="S355",
    MaterialPresetElastic_Grade="S235",
    MaterialPresetElastic_Model="Uniaxial",
    MaterialPresetElastic_Type="Steel",
    menu=[dropdown(0), dropdown(1), dropdown(0)])
section_library = SteelSectionLibraryAlpaca4d(SectionName="HEA200", Material=material_library_elastic, menu=[dropdown(0), dropdown(1)])
turned_30_deg = ConstructPlane(Origin=skewed, XAxis=Vector(0.866, 0, 0.5), YAxis=Vector(0, 1, 0))
forcebeamcolumn = ForceBeamColumnAlpaca4d(Line=columns, Section=section_library, Colour=RGB(1, 30, 254), mode="ForceBeamColumn (Alpaca4d)")
fixed_2 = SupportAlpaca4d(Position=fixed, Tx=True, Ty=True, Tz=True, Rx=True, Ry=True, Rz=True, mode="Support Rigid (Alpaca4d)")
pinned_2 = SupportAlpaca4d(Position=pinned, Tx=True, Ty=True, Tz=True, Rx=False, Ry=False, Rz=False, mode="Support Rigid (Alpaca4d)")
roller_2 = SupportAlpaca4d(Position=roller, Tx=False, Ty=True, Tz=True, Rx=False, Ry=False, Rz=True, mode="Support Rigid (Alpaca4d)")
skewed_2 = SupportAlpaca4d(Position=turned_30_deg, Tx=True, Ty=True, Tz=True, Rx=False, Ry=False, Rz=False, mode="Support Rigid (Alpaca4d)")
springs_2 = SupportAlpaca4d(Position=springs, Kx=500, Ky=500, Kz=500, mode="Spring Support Elastic (Alpaca4d)")
compression_only_2 = SupportAlpaca4d(Position=compression_only, Gap=0, mode="Spring Support Compression Only (Alpaca4d)")
gravity_load = GravityLoadAlpaca4d(Factor=1)
load_pattern = LoadPatternAlpaca4d(Loads=gravity_load, Factor=1, mode="PlainPattern (Alpaca4d)")
supports = AssembleModelAlpaca4d(
    Elements=forcebeamcolumn,
    Supports=[fixed_2, pinned_2, roller_2, skewed_2, springs_2, compression_only_2],
    LoadPatterns=load_pattern,
    Tolerance=0.01)  # -> AlpacaModel, Mass
supports_view = ModelViewAlpaca4d(AlpacaModel=supports.AlpacaModel, Step=0, FittedLoads=True)  # -> AlpacaModel, Geometry, Info, Values, Colors
name_at = Point([Point(0, 0, -0.9), Point(3, 0, -0.9), Point(6, 0, -0.9), Point(9, 0, -0.9), Point(12, 0, -0.9), Point(15, 0, -0.9)])
upright = ConstructPlane(Origin=name_at, XAxis=Vector(1, 0, 0), YAxis=Vector(0, 0, 1))
support_names = TextTag3D(
    Location=upright,
    Text=["Fixed", "Pinned", "Roller", "Skewed", "Springs", "Compression only"],
    Size=0.3,
    Colour=RGB(42, 45, 49),
    Justification=4)

# ---- group: Releases
column_feet = Point([Point(20, 0, 0), Point(26, 0, 0)])
column_heads = Point([Point(20, 0, 4), Point(26, 0, 4)])
beam_start = Point(Point(20, 0, 4))
beam_end = Point(Point(26, 0, 4))
columns_2 = Line(StartPoint=column_feet, EndPoint=column_heads)
beam = Line(StartPoint=beam_start, EndPoint=beam_end)
material_library_elastic_2 = MaterialLibraryElasticAlpaca4d(
    MaterialName="S355",
    MaterialPresetElastic_Grade="S235",
    MaterialPresetElastic_Model="Uniaxial",
    MaterialPresetElastic_Type="Steel",
    menu=[dropdown(0), dropdown(1), dropdown(0)])
section_library_2 = SteelSectionLibraryAlpaca4d(SectionName="HEA200", Material=material_library_elastic_2, menu=[dropdown(0), dropdown(1)])
pinned_3 = HingeReleaseAlpaca4d(Tx=True, Ty=True, Tz=True, Rx=True, Ry=False, Rz=False)
columns_3 = ForceBeamColumnAlpaca4d(Line=columns_2, Section=section_library_2, Colour=RGB(1, 30, 254), mode="ForceBeamColumn (Alpaca4d)")
pinned_beam = ForceBeamColumnAlpaca4d(
    Line=beam,
    Section=section_library_2,
    ReleaseI=pinned_3,
    ReleaseJ=pinned_3,
    Colour=RGB(235, 108, 63),
    ElementId="Beam",
    mode="WithHinges (Alpaca4d)")
built_in = SupportAlpaca4d(Position=column_feet, Tx=True, Ty=True, Tz=True, Rx=True, Ry=True, Rz=True, mode="Support Rigid (Alpaca4d)")
wind = PointLoadAlpaca4d(Point=beam_start, Force=Vector(10, 0, 0), Moment=Vector(0, 0, 0))
on_the_beam = LinearLoadAlpaca4d(BeamId="Beam", Force=Vector(0, 0, -5))
load_pattern_2 = LoadPatternAlpaca4d(Loads=[wind, on_the_beam], Factor=1, mode="PlainPattern (Alpaca4d)")
frame = AssembleModelAlpaca4d(Elements=[columns_3, pinned_beam], Supports=built_in, LoadPatterns=load_pattern_2, Tolerance=0.01)  # -> AlpacaModel, Mass
releases_view = ModelViewAlpaca4d(AlpacaModel=frame.AlpacaModel, Step=0, FittedLoads=True)  # -> AlpacaModel, Geometry, Info, Values, Colors

# ---- group: Wind
A = Point([Point(40, 0, 0), Point(48, 0, 0), Point(40, 0, 0), Point(40, 6, 0), Point(40, 0, 5)])
B = Point([Point(40, 6, 0), Point(48, 6, 0), Point(48, 0, 0), Point(48, 6, 0), Point(48, 0, 5)])
C = Point([Point(40, 6, 5), Point(48, 6, 5), Point(48, 0, 5), Point(48, 6, 5), Point(48, 6, 5)])
foot_from = Point([Point(40, 0, 0), Point(48, 0, 0), Point(40, 0, 0), Point(40, 6, 0)])
foot_to = Point([Point(40, 6, 0), Point(48, 6, 0), Point(48, 0, 0), Point(48, 6, 0)])
faces = Rectangle3Pt(PointA=A, PointB=B, PointC=C)  # -> Rectangle, Length
concrete = ND(MaterialName="Concrete", E=30000000, G=12500000, Ν=0.2, Rho=2500, mode="ElasticIsotropic (Alpaca4d)")
foot = Line(StartPoint=foot_from, EndPoint=foot_to)
faces_2 = MeshPlane(Boundary=faces.Rectangle, WidthCount=[6, 6, 8, 8, 8], HeightCount=[5, 5, 5, 5, 6])  # -> Mesh, Area
_200_mm = PlateFiberSectionAlpaca4d(Thickness=0.2, Material=concrete)
foot_nodes = DivideCurve(Curve=foot, Count=[6, 6, 8, 8], Kinks=False)  # -> Points, Tangents, Parameters
pinned_4 = SupportAlpaca4d(
    Position=flatten(foot_nodes.Points),
    Tx=True,
    Ty=True,
    Tz=True,
    Rx=False,
    Ry=False,
    Rz=False,
    mode="Support Rigid (Alpaca4d)")
asdq4_asdt3 = ASDShellAlpaca4d(
    Mesh=faces_2.Mesh,
    Section=_200_mm,
    IsCorotational=False,
    ElementId=["Wall_West", "Wall_East", "Wall_South", "Wall_North", "Roof"])
windward = MeshLoadAlpaca4d(ShellId="Wall_West", Force=Vector(0.8, 0, 0))
leeward = MeshLoadAlpaca4d(ShellId="Wall_East", Force=Vector(0.5, 0, 0))
wind_2 = LoadPatternAlpaca4d(Loads=[windward, leeward], Factor=1, mode="PlainPattern (Alpaca4d)")
box = AssembleModelAlpaca4d(Elements=flatten(asdq4_asdt3), Supports=pinned_4, LoadPatterns=wind_2, Tolerance=0.01)  # -> AlpacaModel, Mass
wind_view = ModelViewAlpaca4d(AlpacaModel=box.AlpacaModel, Step=0, FittedLoads=True)  # -> AlpacaModel, Geometry, Info, Values, Colors

# ---- group: Buckling
column_feet_2 = Point([Point(62, 0, 0), Point(68, 0, 0)])
column_heads_2 = Point([Point(62, 0, 8), Point(68, 0, 8)])
beam_start_2 = Point(Point(62, 0, 8))
beam_end_2 = Point(Point(68, 0, 8))
columns_4 = Line(StartPoint=column_feet_2, EndPoint=column_heads_2)
beam_2 = Line(StartPoint=beam_start_2, EndPoint=beam_end_2)
material_library_elastic_3 = MaterialLibraryElasticAlpaca4d(
    MaterialName="S355",
    MaterialPresetElastic_Grade="S235",
    MaterialPresetElastic_Model="Uniaxial",
    MaterialPresetElastic_Type="Steel",
    menu=[dropdown(0), dropdown(1), dropdown(0)])
section_library_3 = SteelSectionLibraryAlpaca4d(SectionName="HEA200", Material=material_library_elastic_3, menu=[dropdown(0), dropdown(1)])
frame_2 = ForceBeamColumnAlpaca4d(Line=[columns_4, beam_2], Section=section_library_3, Colour=RGB(1, 30, 254), mode="ForceBeamColumn (Alpaca4d)")
pinned_5 = SupportAlpaca4d(Position=column_feet_2, Tx=True, Ty=True, Tz=True, Rx=False, Ry=False, Rz=False, mode="Support Rigid (Alpaca4d)")
braced_out_of_plane = SupportAlpaca4d(Position=column_heads_2, Tx=False, Ty=True, Tz=False, Rx=False, Ry=False, Rz=False, mode="Support Rigid (Alpaca4d)")
column_loads = PointLoadAlpaca4d(Point=column_heads_2, Force=Vector(0, 0, -200), Moment=Vector(0, 0, 0))
load_pattern_3 = LoadPatternAlpaca4d(Loads=column_loads, Factor=1, mode="PlainPattern (Alpaca4d)")
frame_3 = AssembleModelAlpaca4d(Elements=frame_2, Supports=[pinned_5, braced_out_of_plane], LoadPatterns=load_pattern_3, Tolerance=0.01)  # -> AlpacaModel, Mass
linear_buckling = LinearBucklingAnalysisAlpaca4d(AlpacaModel=frame_3.AlpacaModel, BucklingModes=3, Divisions=1)  # -> AlpacaModel, LoadFactors, Log
buckling_view = ModelViewAlpaca4d(AlpacaModel=linear_buckling.AlpacaModel, Step=0, FittedLoads=True)  # -> AlpacaModel, Geometry, Info, Values, Colors
buckling_at_rest = ModelViewAlpaca4d(AlpacaModel=frame_3.AlpacaModel, Step=0, FittedLoads=True)  # -> AlpacaModel, Geometry, Info, Values, Colors
load_factors = Panel(linear_buckling.LoadFactors)

# ---- group: Loads
front_beams_from = Point([Point(84, 0, 3), Point(85, 0, 3), Point(86, 0, 3), Point(87, 0, 3), Point(88, 0, 3), Point(89, 0, 3)])
front_beams_to = Point([Point(85, 0, 3), Point(86, 0, 3), Point(87, 0, 3), Point(88, 0, 3), Point(89, 0, 3), Point(90, 0, 3)])
edge_beams_from = Point([Point(84, 4, 3), Point(85, 4, 3), Point(86, 4, 3), Point(87, 4, 3), Point(88, 4, 3), Point(89, 4, 3), Point(84, 0, 3), Point(84, 1, 3), Point(84, 2, 3), Point(84, 3, 3), Point(90, 0, 3), Point(90, 1, 3), Point(90, 2, 3), Point(90, 3, 3)])
edge_beams_to = Point([Point(85, 4, 3), Point(86, 4, 3), Point(87, 4, 3), Point(88, 4, 3), Point(89, 4, 3), Point(90, 4, 3), Point(84, 1, 3), Point(84, 2, 3), Point(84, 3, 3), Point(84, 4, 3), Point(90, 1, 3), Point(90, 2, 3), Point(90, 3, 3), Point(90, 4, 3)])
windward_column_from = Point([Point(84, 0, 0), Point(84, 0, 1), Point(84, 0, 2)])
windward_column_to = Point([Point(84, 0, 1), Point(84, 0, 2), Point(84, 0, 3)])
columns_from = Point([Point(90, 0, 0), Point(90, 0, 1), Point(90, 0, 2), Point(84, 4, 0), Point(84, 4, 1), Point(84, 4, 2), Point(90, 4, 0), Point(90, 4, 1), Point(90, 4, 2)])
columns_to = Point([Point(90, 0, 1), Point(90, 0, 2), Point(90, 0, 3), Point(84, 4, 1), Point(84, 4, 2), Point(84, 4, 3), Point(90, 4, 1), Point(90, 4, 2), Point(90, 4, 3)])
slab_a = Point(Point(84, 0, 3))
slab_b = Point(Point(90, 0, 3))
slab_c = Point(Point(90, 4, 3))
column_feet_3 = Point([Point(84, 0, 0), Point(90, 0, 0), Point(84, 4, 0), Point(90, 4, 0)])
front_middle = Point(Point(87, 0, 3))
back_corner = Point(Point(90, 4, 3))
mass_at = Point(Point(90, 0, 3))
front_beams = Line(StartPoint=front_beams_from, EndPoint=front_beams_to)
edge_beams = Line(StartPoint=edge_beams_from, EndPoint=edge_beams_to)
windward_column = Line(StartPoint=windward_column_from, EndPoint=windward_column_to)
columns_5 = Line(StartPoint=columns_from, EndPoint=columns_to)
slab = Rectangle3Pt(PointA=slab_a, PointB=slab_b, PointC=slab_c)  # -> Rectangle, Length
concrete_2 = ND(MaterialName="Concrete", E=30000000, G=12500000, Ν=0.2, Rho=2500, mode="ElasticIsotropic (Alpaca4d)")
material_library_elastic_4 = MaterialLibraryElasticAlpaca4d(
    MaterialName="S355",
    MaterialPresetElastic_Grade="S235",
    MaterialPresetElastic_Model="Uniaxial",
    MaterialPresetElastic_Type="Steel",
    menu=[dropdown(0), dropdown(1), dropdown(0)])
section_library_4 = SteelSectionLibraryAlpaca4d(SectionName="HEA200", Material=material_library_elastic_4, menu=[dropdown(0), dropdown(1)])
slab_2 = MeshPlane(Boundary=slab.Rectangle, WidthCount=6, HeightCount=4)  # -> Mesh, Area
_200_mm_2 = PlateFiberSectionAlpaca4d(Thickness=0.2, Material=concrete_2)
front_beams_2 = ForceBeamColumnAlpaca4d(Line=front_beams, Section=section_library_4, Colour=RGB(1, 30, 254), mode="ForceBeamColumn (Alpaca4d)")
edge_beams_2 = ForceBeamColumnAlpaca4d(Line=edge_beams, Section=section_library_4, Colour=RGB(1, 30, 254), mode="ForceBeamColumn (Alpaca4d)")
windward_column_2 = ForceBeamColumnAlpaca4d(Line=windward_column, Section=section_library_4, Colour=RGB(1, 30, 254), mode="ForceBeamColumn (Alpaca4d)")
columns_6 = ForceBeamColumnAlpaca4d(Line=columns_5, Section=section_library_4, Colour=RGB(1, 30, 254), mode="ForceBeamColumn (Alpaca4d)")
slab_3 = ASDShellAlpaca4d(Mesh=slab_2.Mesh, Section=_200_mm_2, IsCorotational=False)
built_in_2 = SupportAlpaca4d(Position=column_feet_3, Tx=True, Ty=True, Tz=True, Rx=True, Ry=True, Rz=True, mode="Support Rigid (Alpaca4d)")
own_weight = GravityLoadAlpaca4d(Factor=1)
_50_kn = PointLoadAlpaca4d(Point=front_middle, Force=Vector(0, 0, -50), Moment=Vector(0, 0, 0))
_20_kn_and_15_knm = PointLoadAlpaca4d(Point=back_corner, Force=Vector(0, 0, -20), Moment=Vector(0, 15, 0))
_10_kn_m = LinearLoadAlpaca4d(BeamId=front_beams_2, Force=Vector(0, 0, -10))
wind_5_kn_m = LinearLoadAlpaca4d(BeamId=windward_column_2, Force=Vector(5, 0, 0))
_3_kn_m2 = MeshLoadAlpaca4d(ShellId=slab_3, Force=Vector(0, 0, -3))
_2000_kg = MassPointAlpaca4d(Point=mass_at, TransMass=Vector(2000, 2000, 2000), RotationalMass=Vector(0, 0, 0))
own_weight_2 = LoadPatternAlpaca4d(Loads=own_weight, Factor=1, mode="PlainPattern (Alpaca4d)")
imposed = LoadPatternAlpaca4d(Loads=[_50_kn, _20_kn_and_15_knm, _10_kn_m, wind_5_kn_m, _3_kn_m2], Factor=1, mode="PlainPattern (Alpaca4d)")
every_load = AssembleModelAlpaca4d(
    Elements=[front_beams_2, edge_beams_2, windward_column_2, columns_6, slab_3],
    Supports=built_in_2,
    LoadPatterns=[own_weight_2, imposed, _2000_kg],
    Tolerance=0.01)  # -> AlpacaModel, Mass
own_weight_3 = AssembleModelAlpaca4d(
    Elements=[front_beams_2, edge_beams_2, windward_column_2, columns_6, slab_3],
    Supports=built_in_2,
    LoadPatterns=own_weight_2,
    Tolerance=0.01)  # -> AlpacaModel, Mass
every_load_view = ModelViewAlpaca4d(AlpacaModel=every_load.AlpacaModel, Step=0, FittedLoads=True)  # -> AlpacaModel, Geometry, Info, Values, Colors
own_weight_view = ModelViewAlpaca4d(AlpacaModel=own_weight_3.AlpacaModel, Step=0, FittedLoads=True)  # -> AlpacaModel, Geometry, Info, Values, Colors
