# Grasshopper definition candela-umbrella.gh (Grasshopper 1.0.7)
# plug-ins: Galapagos, Kangaroo2 Components, Alpaca4d

# ---- group: 1 - Candela umbrella: 12 x 12 m, in 2304 faces
nodes = Point([Point(-6, -6, 2.4), Point(-5.75, -6, 2.3), Point(-5.5, -6, 2.2), Point(-5.25, -6, 2.1), Point(-5, -6, 2), Point(-4.75, -6, 1.9)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])
held = Point([Point(-0.5, -0.5, 0.01666666667), Point(-0.25, -0.5, 0.008333333333), Point(0, -0.5, 0), Point(0.25, -0.5, 0.008333333333), Point(0.5, -0.5, 0.01666666667), Point(-0.5, -0.25, 0.008333333333), Point(-0.25, -0.25, 0.004166666667), Point(0, -0.25, 0), Point(0.25, -0.25, 0.004166666667), Point(0.5, -0.25, 0.008333333333), Point(-0.5, 0, 0), Point(-0.25, 0, 0), Point(0, 0, 0), Point(0.25, 0, 0), Point(0.5, 0, 0), Point(-0.5, 0.25, 0.008333333333), Point(-0.25, 0.25, 0.004166666667), Point(0, 0.25, 0), Point(0.25, 0.25, 0.004166666667), Point(0.5, 0.25, 0.008333333333), Point(-0.5, 0.5, 0.01666666667), Point(-0.25, 0.5, 0.008333333333), Point(0, 0.5, 0), Point(0.25, 0.5, 0.008333333333), Point(0.5, 0.5, 0.01666666667)])
quads = MeshQuad(
    CornerA=[0, 1, 2, 3, 4, 5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],
    CornerB=[1, 2, 3, 4, 5, 6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],
    CornerC=[50, 51, 52, 53, 54, 55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],
    CornerD=[49, 50, 51, 52, 53, 54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])
surface = ConstructMesh(Vertices=nodes, Faces=flatten(quads))

# ---- group: 4 - Built into one column over a head 1 m square
built_in = SupportAlpaca4d(Position=flatten(held), Tx=True, Ty=True, Tz=True, Rx=True, Ry=True, Rz=True, mode="Support Rigid (Alpaca4d)")

# ---- group: 5 - Its own weight
own_weight = GravityLoadAlpaca4d(Factor=1)
load_pattern = LoadPatternAlpaca4d(Loads=own_weight, Factor=1, mode="PlainPattern (Alpaca4d)")

# ---- group: 3 - A concrete shell, 80 mm
concrete = ND(MaterialName="Concrete", E=33000000, G=13750000, Ν=0.2, Rho=2500, mode="ElasticIsotropic (Alpaca4d)")
_80_mm = PlateFiberSectionAlpaca4d(Thickness=0.08, Material=concrete)
asdq4_asdt3 = ASDShellAlpaca4d(Mesh=surface, Section=_80_mm, IsCorotational=False)

# ---- group: 6 - Assembled and solved
assemble_model = AssembleModelAlpaca4d(Elements=flatten(asdq4_asdt3), Supports=flatten(built_in), LoadPatterns=flatten(load_pattern), Tolerance=0.01)  # -> AlpacaModel, Mass
analysis_settings = AnalysisSettingsAlpaca4d(Constraint="Transformation", Numberer="RCM", System="Auto", Algorithm="Newton", AnalysisType="Static", Cores=0)
run_analysis = RunAnalysisAlpaca4d(AlpacaModel=assemble_model.AlpacaModel, Settings=analysis_settings, settings=True)  # -> AlpacaModel, Log

# ---- group: 7 - Principal Stress Lines, in the membrane
seeds = Point([Point(2.9, 1.7, 0.3286666667), Point(-1.7, 2.9, 0.3286666667), Point(-2.9, -1.7, 0.3286666667), Point(1.7, -2.9, 0.3286666667)])
candela_umbrella = PrincipalStressLinesAlpaca4d(
    AlpacaModel=run_analysis.AlpacaModel,
    Step=0,
    Seed=seeds,
    StepTolerance=0,
    SingleLine=False,
    PoissonsRatio=0,
    BendingStressLines=False,
    Separation=0.35,
    TestDist=0.14,
    mode="PrincipalStressLines")  # -> StressLinesDir1, StressLinesDir2

# ---- group: 8 - For the pictures: the columns, the floor, a hall of copies
column_tops = Point(Point(0, 0, 0))
down_the_columns = UnitZ(Factor=-1)
column_axes = LineSDL(Start=column_tops, Direction=down_the_columns, Length=4)
floor_outline = Rectangle3Pt(PointA=Point(-37, -37, -4), PointB=Point(37, -37, -4), PointC=Point(37, 37, -4))  # -> Rectangle, Length
hall_places = Point([Point(-12.5, -12.5, 0), Point(-12.5, 0, 0), Point(-12.5, 12.5, 0), Point(0, -12.5, 0), Point(0, 0, 0), Point(0, 12.5, 0), Point(12.5, -12.5, 0), Point(12.5, 0, 0), Point(12.5, 12.5, 0)])
column_shafts = Pipe(Curve=column_axes, Radius=0.3, Caps=1)
floor = MeshPlane(Boundary=floor_outline.Rectangle, WidthCount=1, HeightCount=1)  # -> Mesh, Area
hall_sl1 = Move(Geometry=flatten(candela_umbrella.StressLinesDir1), Motion=graft(hall_places))  # -> Geometry, Transform
hall_sl2 = Move(Geometry=flatten(candela_umbrella.StressLinesDir2), Motion=graft(hall_places))  # -> Geometry, Transform
hall_surface = Move(Geometry=flatten(surface), Motion=graft(hall_places))  # -> Geometry, Transform
hall_columns = Move(Geometry=flatten(column_shafts), Motion=graft(hall_places))  # -> Geometry, Transform
