# Grasshopper definition groin-vault.gh (Grasshopper 1.0.7)
# plug-ins: Galapagos, Kangaroo2 Components, Alpaca4d

# ---- group: 1 - Groin vault: 12 x 12 m, in 4608 faces
nodes = Point([Point(-6, -6, 0), Point(-5.75, -6, 0.3263888889), Point(-5.5, -6, 0.6388888889), Point(-5.25, -6, 0.9375), Point(-5, -6, 1.222222222), Point(-4.75, -6, 1.493055556)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])
held = Point([Point(-6, -6, 0), Point(-5.75, -6, 0.3263888889), Point(5.75, -6, 0.3263888889), Point(6, -6, 0), Point(-6, -5.75, 0.3263888889), Point(6, -5.75, 0.3263888889), Point(-6, 5.75, 0.3263888889), Point(6, 5.75, 0.3263888889), Point(-6, 6, 0), Point(-5.75, 6, 0.3263888889), Point(5.75, 6, 0.3263888889), Point(6, 6, 0)])
triangles = MeshTriangle(
    CornerA=[0, 0, 1, 1, 2, 2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],
    CornerB=[1, 50, 2, 51, 3, 52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],
    CornerC=[50, 49, 51, 50, 52, 51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])
surface = ConstructMesh(Vertices=nodes, Faces=flatten(triangles))

# ---- group: 4 - Pinned at its four corners
pinned = SupportAlpaca4d(Position=flatten(held), Tx=True, Ty=True, Tz=True, Rx=False, Ry=False, Rz=False, mode="Support Rigid (Alpaca4d)")

# ---- group: 5 - Its own weight
own_weight = GravityLoadAlpaca4d(Factor=1)
load_pattern = LoadPatternAlpaca4d(Loads=own_weight, Factor=1, mode="PlainPattern (Alpaca4d)")

# ---- group: 3 - A concrete shell, 150 mm
concrete = ND(MaterialName="Concrete", E=33000000, G=13750000, Ν=0.2, Rho=2500, mode="ElasticIsotropic (Alpaca4d)")
_150_mm = PlateFiberSectionAlpaca4d(Thickness=0.15, Material=concrete)
asdq4_asdt3 = ASDShellAlpaca4d(Mesh=surface, Section=_150_mm, IsCorotational=False)

# ---- group: 6 - Assembled and solved
assemble_model = AssembleModelAlpaca4d(Elements=flatten(asdq4_asdt3), Supports=flatten(pinned), LoadPatterns=flatten(load_pattern), Tolerance=0.01)  # -> AlpacaModel, Mass
analysis_settings = AnalysisSettingsAlpaca4d(Constraint="Transformation", Numberer="RCM", System="Auto", Algorithm="Newton", AnalysisType="Static", Cores=0)
run_analysis = RunAnalysisAlpaca4d(AlpacaModel=assemble_model.AlpacaModel, Settings=analysis_settings, settings=True)  # -> AlpacaModel, Log

# ---- group: 7 - Principal Stress Lines, in the membrane
seeds = Point([Point(2.3, -0.9, 3.91), Point(0.9, 2.3, 3.91), Point(-2.3, 0.9, 3.91), Point(-0.9, -2.3, 3.91)])
groin_vault = PrincipalStressLinesAlpaca4d(
    AlpacaModel=run_analysis.AlpacaModel,
    Step=0,
    Seed=seeds,
    StepTolerance=0,
    SingleLine=False,
    PoissonsRatio=0,
    BendingStressLines=False,
    Separation=0.35,
    TestDist=0.14,
    mode="PrincipalStressLines")  # -> StressLinesDir1, StressLinesDir2

# ---- group: 8 - For the pictures: the floor
floor_outline = Rectangle3Pt(PointA=Point(-12, -12, 0), PointB=Point(12, -12, 0), PointC=Point(12, 12, 0))  # -> Rectangle, Length
floor = MeshPlane(Boundary=floor_outline.Rectangle, WidthCount=1, HeightCount=1)  # -> Mesh, Area
