# Grasshopper definition isler-shell.gh (Grasshopper 1.0.7)
# plug-ins: Galapagos, Kangaroo2 Components, Alpaca4d

# ---- group: 1 - Isler three-point shell: 24 m a side, in 768 faces
nodes = Point([Point(0, 0, 0), Point(0, 0.8660254038, 0), Point(-0.75, -0.4330127019, 0), Point(0, 1.732050808, 0), Point(-0.75, 0.4330127019, 0), Point(-1.5, -0.8660254038, 0)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])
held = Point([Point(0, 13.85640646, 0), Point(-0.75, 12.55736835, 0), Point(-11.25, -5.629165125, 0), Point(-12, -6.92820323, 0), Point(-10.5, -6.92820323, 0), Point(10.5, -6.92820323, 0), Point(12, -6.92820323, 0), Point(11.25, -5.629165125, 0), Point(0.75, 12.55736835, 0)])
triangles = MeshTriangle(
    CornerA=[0, 1, 1, 2, 3, 3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],
    CornerB=[1, 3, 4, 4, 6, 7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],
    CornerC=[2, 4, 2, 5, 7, 4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])
flat_net = ConstructMesh(Vertices=nodes, Faces=flatten(triangles))

# ---- group: 2 - Kangaroo: edges that keep their length, held, every node pushed up; the Zombie Solver
net = Show(G=flat_net)
edges = EdgeLengths(Mesh=flat_net, LengthFactor=1, Strength=1)
lift = Slider(0.008, range=0..0.024)
up = UnitZ(Factor=lift)
held_2 = Anchor(Point=held, Strength=10000)
net_nodes = DeconstructMesh(Mesh=flat_net)  # -> Vertices, Faces, Colours, Normals
push_up = Load(Point=net_nodes.Vertices, ForceVector=up, Weighting=1)
iterations = Slider(20000, range=1..20000)
zombie_solver = ZombieSolver(GoalObjects=flatten([net, edges, push_up, held_2]), Threshold=1e-10, Tolerance=0.0001, MaxIterations=iterations)  # -> I, V, O
iterations_used = Panel(zombie_solver.I)
surface = ListItem(List=zombie_solver.O, Index=0, Wrap=True)

# ---- group: 4 - Pinned at its three corners
pinned = SupportAlpaca4d(Position=flatten(held), Tx=True, Ty=True, Tz=True, Rx=False, Ry=False, Rz=False, mode="Support Rigid (Alpaca4d)")

# ---- group: 5 - Its own weight
own_weight = GravityLoadAlpaca4d(Factor=1)
load_pattern = LoadPatternAlpaca4d(Loads=own_weight, Factor=1, mode="PlainPattern (Alpaca4d)")

# ---- group: 3 - A concrete shell, 100 mm
concrete = ND(MaterialName="Concrete", E=33000000, G=13750000, Ν=0.2, Rho=2500, mode="ElasticIsotropic (Alpaca4d)")
_100_mm = PlateFiberSectionAlpaca4d(Thickness=0.1, Material=concrete)
asdq4_asdt3 = ASDShellAlpaca4d(Mesh=surface, Section=_100_mm, IsCorotational=False)

# ---- group: 6 - Assembled and solved
assemble_model = AssembleModelAlpaca4d(Elements=flatten(asdq4_asdt3), Supports=flatten(pinned), LoadPatterns=flatten(load_pattern), Tolerance=0.01)  # -> AlpacaModel, Mass
analysis_settings = AnalysisSettingsAlpaca4d(Constraint="Transformation", Numberer="RCM", System="Auto", Algorithm="Newton", AnalysisType="Static", Cores=0)
run_analysis = RunAnalysisAlpaca4d(AlpacaModel=assemble_model.AlpacaModel, Settings=analysis_settings, settings=True)  # -> AlpacaModel, Log

# ---- group: 7 - Principal Stress Lines, in the membrane
seeds = Point([Point(1.9, -2.6, 0), Point(1.30166605, 2.945448267, 0), Point(-3.20166605, -0.3454482672, 0)])
isler_three_point_shell = PrincipalStressLinesAlpaca4d(
    AlpacaModel=run_analysis.AlpacaModel,
    Step=0,
    Seed=seeds,
    StepTolerance=0,
    SingleLine=False,
    PoissonsRatio=0,
    BendingStressLines=False,
    Separation=0.5,
    TestDist=0.2,
    mode="PrincipalStressLines")  # -> StressLinesDir1, StressLinesDir2

# ---- group: 8 - For the pictures: the floor
floor_outline = Rectangle3Pt(PointA=Point(-24, -18.92820323, 0), PointB=Point(24, -18.92820323, 0), PointC=Point(24, 25.85640646, 0))  # -> Rectangle, Length
floor = MeshPlane(Boundary=floor_outline.Rectangle, WidthCount=1, HeightCount=1)  # -> Mesh, Area
