# Grasshopper definition StressLinesMusmeciBridge.gh (Grasshopper 1.0.7)
# plug-ins: Galapagos, Kangaroo2 Components, Alpaca4d

# ---- group: 1 - A flat net, 80 x 12 m in 80 x 12 quads, and its footings in pairs every 20 m
_80_x_12_m = Rectangle3Pt(PointA=Point(0, 0, 0), PointB=Point(80, 0, 0), PointC=Point(80, 12, 0))  # -> Rectangle, Length
footings = Point([Point(0, 0, 0), Point(0, 1, 0), Point(1, 0, 0), Point(0, 12, 0), Point(0, 11, 0), Point(1, 12, 0), Point(20, 0, 0), Point(20, 1, 0), Point(19, 0, 0), Point(21, 0, 0)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])
_80_x_12_quads = MeshPlane(Boundary=_80_x_12_m.Rectangle, WidthCount=80, HeightCount=12)  # -> Mesh, Area
nodes = DeconstructMesh(Mesh=_80_x_12_quads.Mesh)  # -> Vertices, Faces, Colours, Normals

# ---- group: 2 - Kangaroo: edges that keep their length, held at the footings, every node pushed up
lift = Slider(0.03, range=0..0.06)
up = UnitZ(Factor=lift)
net = Show(G=_80_x_12_quads.Mesh)
edges = EdgeLengths(Mesh=_80_x_12_quads.Mesh, LengthFactor=1, Strength=1)
push_up = Load(Point=nodes.Vertices, ForceVector=up, Weighting=1)
held = Anchor(Point=footings, Strength=10000)

# ---- group: 3 - Kangaroo's Zombie Solver finds the form
iterations = Slider(20000, range=1..20000)
zombie_solver = ZombieSolver(GoalObjects=flatten([net, edges, push_up, held]), Threshold=1e-10, Tolerance=0.0001, MaxIterations=iterations)  # -> I, V, O
iterations_used = Panel(zombie_solver.I)
form = ListItem(List=zombie_solver.O, Index=0, Wrap=True)

# ---- group: 4 - A concrete shell on the form, 300 mm, pinned at the footings, under its own weight
pinned = SupportAlpaca4d(Position=flatten(footings), Tx=True, Ty=True, Tz=True, Rx=False, Ry=False, Rz=False, mode="Support Rigid (Alpaca4d)")
own_weight = GravityLoadAlpaca4d(Factor=1)
concrete = ND(MaterialName="Concrete", E=33000000, G=13750000, Ν=0.2, Rho=2500, mode="ElasticIsotropic (Alpaca4d)")
_300_mm = PlateFiberSectionAlpaca4d(Thickness=0.3, Material=concrete)
asdq4_asdt3 = ASDShellAlpaca4d(Mesh=form, Section=_300_mm, IsCorotational=False)
analysis_settings = AnalysisSettingsAlpaca4d(Constraint="Transformation", Numberer="RCM", System="Auto", Algorithm="Newton", AnalysisType="Static", Cores=0)
load_pattern = LoadPatternAlpaca4d(Loads=own_weight, Factor=1, mode="PlainPattern (Alpaca4d)")
assemble_model = AssembleModelAlpaca4d(Elements=flatten(asdq4_asdt3), Supports=flatten(pinned), LoadPatterns=flatten(load_pattern), Tolerance=0.01)  # -> AlpacaModel, Mass
run_analysis = RunAnalysisAlpaca4d(AlpacaModel=assemble_model.AlpacaModel, Settings=analysis_settings, settings=True)  # -> AlpacaModel, Log

# ---- group: 5 - Principal Stress Lines, in the membrane
seed = Point(Point(27.4, 4.2, 30))
musmeci_bridge = PrincipalStressLinesAlpaca4d(
    AlpacaModel=run_analysis.AlpacaModel,
    Step=0,
    Seed=seed,
    StepTolerance=0,
    SingleLine=False,
    PoissonsRatio=0,
    BendingStressLines=False,
    Separation=1,
    TestDist=0.4,
    mode="PrincipalStressLines")  # -> StressLinesDir1, StressLinesDir2

# ---- group: 6 - For the pictures: a deck on the crowns, and the ground
deck_outline = Rectangle3Pt(PointA=Point(-6, 1, 0), PointB=Point(86, 1, 0), PointC=Point(86, 11, 0))  # -> Rectangle, Length
deck_depth = UnitZ(Factor=0.8)
ground_outline = Rectangle3Pt(PointA=Point(-40, -40, 0), PointB=Point(120, -40, 0), PointC=Point(120, 52, 0))  # -> Rectangle, Length
form_nodes = DeconstructMesh(Mesh=form)  # -> Vertices, Faces, Colours, Normals
node_heights = Deconstruct(Point=form_nodes.Vertices)  # -> XComponent, YComponent, ZComponent
lowest_to_highest = Bounds(Numbers=node_heights.ZComponent)
highest = DeconstructDomain(Domain=lowest_to_highest)  # -> Start, End
up_to_the_crowns = UnitZ(Factor=highest.End)
deck_sides = Extrude(Base=deck_outline.Rectangle, Direction=deck_depth)
deck_top = MeshPlane(Boundary=deck_outline.Rectangle, WidthCount=1, HeightCount=1)  # -> Mesh, Area
deck = Move(Geometry=flatten([deck_sides, deck_top.Mesh]), Motion=up_to_the_crowns)  # -> Geometry, Transform
ground = MeshPlane(Boundary=ground_outline.Rectangle, WidthCount=1, HeightCount=1)  # -> Mesh, Area
