# Grasshopper definition StressLinesNerviFlatSlab.gh (Grasshopper 1.0.7)
# plug-ins: Galapagos, Kangaroo2 Components, Alpaca4d

# ---- group: 3 - A uniform load
udl_kn_m2 = Slider(10, range=0..20)
minus = Expression(x=udl_kn_m2, Expression="-x")
down = UnitZ(Factor=minus)
uniform_load = MeshLoadAlpaca4d(Force=down)

# ---- group: 1 - The Nervi flat slab: concrete, 25 x 25 m, 200 mm, in 100 x 100 quads
_25_x_25_m = Rectangle3Pt(PointA=Point(-2.5, -2.5, 0), PointB=Point(22.5, -2.5, 0), PointC=Point(22.5, 22.5, 0))  # -> Rectangle, Length
_100_x_100_quads = MeshPlane(Boundary=_25_x_25_m.Rectangle, WidthCount=100, HeightCount=100)  # -> Mesh, Area
concrete = ND(MaterialName="Concrete", E=33000000, G=13750000, Ν=0.2, Rho=2500, mode="ElasticIsotropic (Alpaca4d)")
_200_mm = PlateFiberSectionAlpaca4d(Thickness=0.2, Material=concrete)
asdq4_asdt3 = ASDShellAlpaca4d(Mesh=_100_x_100_quads.Mesh, Section=_200_mm, IsCorotational=False)

# ---- group: 2 - On 5 x 5 columns, 5 m apart, pinned
column_lines = Series(Start=0, Step=5, Count=5)
columns = ConstructPoint(XCoordinate=column_lines, YCoordinate=graft(column_lines), ZCoordinate=0)
pinned = SupportAlpaca4d(Position=flatten(columns), Tx=True, Ty=True, Tz=True, Rx=False, Ry=False, Rz=False, mode="Support Rigid (Alpaca4d)")

# ---- group: 4 - Assembled and solved
analysis_settings = AnalysisSettingsAlpaca4d(Constraint="Transformation", Numberer="RCM", System="Auto", Algorithm="Newton", AnalysisType="Static", Cores=0)
load_pattern = LoadPatternAlpaca4d(Loads=uniform_load, Factor=1, mode="PlainPattern (Alpaca4d)")
assemble_model = AssembleModelAlpaca4d(Elements=flatten(asdq4_asdt3), Supports=flatten(pinned), LoadPatterns=flatten(load_pattern), Tolerance=0.01)  # -> AlpacaModel, Mass
run_analysis = RunAnalysisAlpaca4d(AlpacaModel=assemble_model.AlpacaModel, Settings=analysis_settings, settings=True)  # -> AlpacaModel, Log

# ---- group: 5 - Principal Stress Lines, in bending
seed = Point(Point(7.35, 6.85, 0))
nervi_flat_slab = PrincipalStressLinesAlpaca4d(
    AlpacaModel=run_analysis.AlpacaModel,
    Step=0,
    Seed=seed,
    StepTolerance=0,
    SingleLine=False,
    PoissonsRatio=0,
    BendingStressLines=True,
    Separation=0.8,
    TestDist=0.32,
    mode="PrincipalStressLines")  # -> StressLinesDir1, StressLinesDir2

# ---- group: 6 - For the pictures: the lines as ribs 300 mm deep, the columns down to a floor
rib_depth = UnitZ(Factor=-0.3)
smooth_sl1 = FitCurve(Curve=nervi_flat_slab.StressLinesDir1, Degree=3, Tolerance=0.005)
smooth_sl2 = FitCurve(Curve=nervi_flat_slab.StressLinesDir2, Degree=3, Tolerance=0.005)
down_the_columns = UnitZ(Factor=-1)
column_axes = LineSDL(Start=flatten(columns), Direction=down_the_columns, Length=4)
floor_outline = Rectangle3Pt(PointA=Point(-7.5, -7.5, -4), PointB=Point(27.5, -7.5, -4), PointC=Point(27.5, 27.5, -4))  # -> Rectangle, Length
ribs_sl1 = Extrude(Base=smooth_sl1, Direction=rib_depth)
ribs_sl2 = Extrude(Base=smooth_sl2, Direction=rib_depth)
column_shafts = Pipe(Curve=column_axes, Radius=0.22, Caps=1)
floor = MeshPlane(Boundary=floor_outline.Rectangle, WidthCount=1, HeightCount=1)  # -> Mesh, Area
