# Grasshopper definition StressLinesNerviUmbrella.gh (Grasshopper 1.0.7)
# plug-ins: Galapagos, Kangaroo2 Components, Alpaca4d

# ---- group: 3 - A uniform load
udl_kn_m2 = Slider(5, range=0..20)
minus = Expression(x=udl_kn_m2, Expression="-x")
down = UnitZ(Factor=minus)
uniform_load = MeshLoadAlpaca4d(Force=down)

# ---- group: 1 - The Nervi umbrella: concrete, 15 x 15 m, 200 mm, in 60 x 60 quads
_15_x_15_m = Rectangle3Pt(PointA=Point(0, 0, 0), PointB=Point(15, 0, 0), PointC=Point(15, 15, 0))  # -> Rectangle, Length
_60_x_60_quads = MeshPlane(Boundary=_15_x_15_m.Rectangle, WidthCount=60, HeightCount=60)  # -> Mesh, Area
concrete = ND(MaterialName="Concrete", E=33000000, G=13750000, Ν=0.2, Rho=2500, mode="ElasticIsotropic (Alpaca4d)")
_200_mm = PlateFiberSectionAlpaca4d(Thickness=0.2, Material=concrete)
asdq4_asdt3 = ASDShellAlpaca4d(Mesh=_60_x_60_quads.Mesh, Section=_200_mm, IsCorotational=False)

# ---- group: 2 - Built into one column over a head 1 m square
across_the_head = Series(Start=7, Step=0.25, Count=5)
column_head = ConstructPoint(XCoordinate=across_the_head, YCoordinate=graft(across_the_head), ZCoordinate=0)
built_in = SupportAlpaca4d(Position=flatten(column_head), Tx=True, Ty=True, Tz=True, Rx=True, Ry=True, Rz=True, mode="Support Rigid (Alpaca4d)")

# ---- group: 4 - Assembled and solved
analysis_settings = AnalysisSettingsAlpaca4d(Constraint="Transformation", Numberer="RCM", System="Auto", Algorithm="Newton", AnalysisType="Static", Cores=0)
load_pattern = LoadPatternAlpaca4d(Loads=uniform_load, Factor=1, mode="PlainPattern (Alpaca4d)")
assemble_model = AssembleModelAlpaca4d(Elements=flatten(asdq4_asdt3), Supports=flatten(built_in), LoadPatterns=flatten(load_pattern), Tolerance=0.01)  # -> AlpacaModel, Mass
run_analysis = RunAnalysisAlpaca4d(AlpacaModel=assemble_model.AlpacaModel, Settings=analysis_settings, settings=True)  # -> AlpacaModel, Log

# ---- group: 5 - Principal Stress Lines, in bending
seed = Point(Point(10.35, 9.15, 0))
nervi_umbrella = PrincipalStressLinesAlpaca4d(
    AlpacaModel=run_analysis.AlpacaModel,
    Step=0,
    Seed=seed,
    StepTolerance=0,
    SingleLine=False,
    PoissonsRatio=0,
    BendingStressLines=True,
    Separation=0.6,
    TestDist=0.24,
    mode="PrincipalStressLines")  # -> StressLinesDir1, StressLinesDir2

# ---- group: 6 - For the pictures: the lines as ribs 350 mm deep, the column, nine umbrellas as a hall
rib_depth = UnitZ(Factor=-0.35)
smooth_sl1 = FitCurve(Curve=nervi_umbrella.StressLinesDir1, Degree=3, Tolerance=0.005)
smooth_sl2 = FitCurve(Curve=nervi_umbrella.StressLinesDir2, Degree=3, Tolerance=0.005)
down_the_column = UnitZ(Factor=-1)
column_axis = LineSDL(Start=Point(7.5, 7.5, 0), Direction=down_the_column, Length=8)
hall_offsets = Series(Start=-16, Step=16, Count=3)
floor_outline = Rectangle3Pt(PointA=Point(-31, -31, -8), PointB=Point(46, -31, -8), PointC=Point(46, 46, -8))  # -> Rectangle, Length
places = ConstructPoint(XCoordinate=hall_offsets, YCoordinate=graft(hall_offsets), ZCoordinate=0)
ribs_sl1 = Extrude(Base=smooth_sl1, Direction=rib_depth)
ribs_sl2 = Extrude(Base=smooth_sl2, Direction=rib_depth)
column_shaft = Pipe(Curve=column_axis, Radius=0.45, Caps=1)
floor = MeshPlane(Boundary=floor_outline.Rectangle, WidthCount=1, HeightCount=1)  # -> Mesh, Area
hall_ribs_sl1 = Move(Geometry=flatten(ribs_sl1), Motion=graft(places))  # -> Geometry, Transform
hall_ribs_sl2 = Move(Geometry=flatten(ribs_sl2), Motion=graft(places))  # -> Geometry, Transform
hall_slabs = Move(Geometry=flatten(_60_x_60_quads.Mesh), Motion=graft(places))  # -> Geometry, Transform
hall_columns = Move(Geometry=flatten(column_shaft), Motion=graft(places))  # -> Geometry, Transform
