# Grasshopper definition StressLinesPlates.gh (Grasshopper 1.0.7)
# plug-ins: Galapagos, Kangaroo2 Components, Alpaca4d

# ---- group: A1 - Cantilever wall: 8 x 2.5 m, 48 x 15 quads, concrete 250 mm
cantilever_wall_8_x_2_5_m = Rectangle3Pt(PointA=Point(0, 0, 0), PointB=Point(8, 0, 0), PointC=Point(8, 0, 2.5))  # -> Rectangle, Length
_48_x_15_quads = MeshPlane(Boundary=cantilever_wall_8_x_2_5_m.Rectangle, WidthCount=48, HeightCount=15)  # -> Mesh, Area
concrete = ND(MaterialName="Concrete", E=33000000, G=13750000, Ν=0.2, Rho=2500, mode="ElasticIsotropic (Alpaca4d)")
_250_mm = PlateFiberSectionAlpaca4d(Thickness=0.25, Material=concrete)
asdq4_asdt3 = ASDShellAlpaca4d(Mesh=_48_x_15_quads.Mesh, Section=_250_mm, IsCorotational=False)

# ---- group: A2 - Built in along its left edge
left_edge = Line(StartPoint=Point(0, 0, 0), EndPoint=Point(0, 0, 2.5))
divide = DivideCurve(Curve=left_edge, Count=15, Kinks=False)  # -> Points, Tangents, Parameters
built_in = SupportAlpaca4d(Position=flatten(divide.Points), Tx=True, Ty=True, Tz=True, Rx=True, Ry=True, Rz=True, mode="Support Rigid (Alpaca4d)")

# ---- group: A3 - 50 kN/m along its top, on each node of the edge
top_edge = Line(StartPoint=Point(0, 0, 2.5), EndPoint=Point(8, 0, 2.5))
divide_2 = DivideCurve(Curve=top_edge, Count=48, Kinks=False)  # -> Points, Tangents, Parameters
_50_kn_m = PointLoadAlpaca4d(Point=flatten(divide_2.Points), Force=Vector(0, 0, -8.163265306), Moment=Vector(0, 0, 0))

# ---- group: B3 - 500 kN on a node of its top: the slider walks it along
b_load_node = Slider(25, range=0..50)
top_edge_2 = Line(StartPoint=Point(11, 0, 4), EndPoint=Point(21, 0, 4))
divide_3 = DivideCurve(Curve=top_edge_2, Count=50, Kinks=False)  # -> Points, Tangents, Parameters
loaded_node = ListItem(List=divide_3.Points, Index=b_load_node, Wrap=True)
_500_kn = PointLoadAlpaca4d(Point=loaded_node, Force=Vector(0, 0, -500), Moment=Vector(0, 0, 0))

# ---- group: C3 - A uniform load, and a point load the sliders set and walk along its middle
c_udl_kn_m2 = Slider(10, range=0..20)
c_point_load_kn = Slider(0, range=0..1000)
c_load_node = Slider(15, range=0..30)
minus = Expression(x=c_udl_kn_m2, Expression="-x")
minus_2 = Expression(x=c_point_load_kn, Expression="-x")
middle_line = Line(StartPoint=Point(0, -10, 0), EndPoint=Point(12, -10, 0))
down = UnitZ(Factor=minus)
down_2 = UnitZ(Factor=minus_2)
divide_4 = DivideCurve(Curve=middle_line, Count=30, Kinks=False)  # -> Points, Tangents, Parameters
loaded_node_2 = ListItem(List=divide_4.Points, Index=c_load_node, Wrap=True)
uniform_load = MeshLoadAlpaca4d(Force=down)
point_load = PointLoadAlpaca4d(Point=loaded_node_2, Force=down_2, Moment=Vector(0, 0, 0))

# ---- group: D1 - Cantilever shell: a barrel 7 m out and 6 m wide, rising 1.5 m, 35 x 30 quads, concrete 100 mm
plan_7_x_6_m = Rectangle3Pt(PointA=Point(15, -14, 0), PointB=Point(22, -14, 0), PointC=Point(22, -8, 0))  # -> Rectangle, Length
_35_x_30_quads = MeshPlane(Boundary=plan_7_x_6_m.Rectangle, WidthCount=35, HeightCount=30)  # -> Mesh, Area
nodes_and_faces = DeconstructMesh(Mesh=_35_x_30_quads.Mesh)  # -> Vertices, Faces, Colours, Normals
node_x_y = Deconstruct(Point=nodes_and_faces.Vertices)  # -> XComponent, YComponent, ZComponent
parabola = Expression(y=node_x_y.YComponent, Expression="1.5*(1-((y-(-11.0))/3.0)^2)")
lifted = ConstructPoint(XCoordinate=node_x_y.XComponent, YCoordinate=node_x_y.YComponent, ZCoordinate=parabola)
canopy = ConstructMesh(Vertices=lifted, Faces=nodes_and_faces.Faces)
concrete_2 = ND(MaterialName="Concrete", E=33000000, G=13750000, Ν=0.2, Rho=2500, mode="ElasticIsotropic (Alpaca4d)")
_100_mm = PlateFiberSectionAlpaca4d(Thickness=0.1, Material=concrete_2)
asdq4_asdt3_2 = ASDShellAlpaca4d(Mesh=canopy, Section=_100_mm, IsCorotational=False)

# ---- group: B1 - Deep beam: 10 x 4 m, 50 x 20 quads, concrete 300 mm
deep_beam_10_x_4_m = Rectangle3Pt(PointA=Point(11, 0, 0), PointB=Point(21, 0, 0), PointC=Point(21, 0, 4))  # -> Rectangle, Length
_50_x_20_quads = MeshPlane(Boundary=deep_beam_10_x_4_m.Rectangle, WidthCount=50, HeightCount=20)  # -> Mesh, Area
concrete_3 = ND(MaterialName="Concrete", E=33000000, G=13750000, Ν=0.2, Rho=2500, mode="ElasticIsotropic (Alpaca4d)")
_300_mm = PlateFiberSectionAlpaca4d(Thickness=0.3, Material=concrete_3)
asdq4_asdt3_3 = ASDShellAlpaca4d(Mesh=_50_x_20_quads.Mesh, Section=_300_mm, IsCorotational=False)

# ---- group: B2 - Borne on the bottom 0.4 m of each end: pinned, and sliding along
left_bearing = Line(StartPoint=Point(11, 0, 0), EndPoint=Point(11, 0, 0.4))
right_bearing = Line(StartPoint=Point(21, 0, 0), EndPoint=Point(21, 0, 0.4))
divide_5 = DivideCurve(Curve=left_bearing, Count=2, Kinks=False)  # -> Points, Tangents, Parameters
divide_6 = DivideCurve(Curve=right_bearing, Count=2, Kinks=False)  # -> Points, Tangents, Parameters
pinned = SupportAlpaca4d(
    Position=flatten(divide_5.Points),
    Tx=True,
    Ty=True,
    Tz=True,
    Rx=False,
    Ry=False,
    Rz=False,
    mode="Support Rigid (Alpaca4d)")
sliding = SupportAlpaca4d(
    Position=flatten(divide_6.Points),
    Tx=False,
    Ty=True,
    Tz=True,
    Rx=False,
    Ry=False,
    Rz=True,
    mode="Support Rigid (Alpaca4d)")

# ---- group: C1 - Slab: 12 x 8 m, 30 x 20 quads, concrete 250 mm
slab_12_x_8_m = Rectangle3Pt(PointA=Point(0, -14, 0), PointB=Point(12, -14, 0), PointC=Point(12, -6, 0))  # -> Rectangle, Length
_30_x_20_quads = MeshPlane(Boundary=slab_12_x_8_m.Rectangle, WidthCount=30, HeightCount=20)  # -> Mesh, Area
concrete_4 = ND(MaterialName="Concrete", E=33000000, G=13750000, Ν=0.2, Rho=2500, mode="ElasticIsotropic (Alpaca4d)")
_250_mm_2 = PlateFiberSectionAlpaca4d(Thickness=0.25, Material=concrete_4)
asdq4_asdt3_4 = ASDShellAlpaca4d(Mesh=_30_x_20_quads.Mesh, Section=_250_mm_2, IsCorotational=False)

# ---- group: C2 - Simply supported: pinned along all four edges
edges_along_x = Line(StartPoint=[Point(0, -14, 0), Point(0, -6, 0)], EndPoint=[Point(12, -14, 0), Point(12, -6, 0)])
edges_along_y = Line(StartPoint=[Point(0, -14, 0), Point(12, -14, 0)], EndPoint=[Point(0, -6, 0), Point(12, -6, 0)])
divide_7 = DivideCurve(Curve=edges_along_x, Count=30, Kinks=False)  # -> Points, Tangents, Parameters
divide_8 = DivideCurve(Curve=edges_along_y, Count=20, Kinks=False)  # -> Points, Tangents, Parameters
pinned_2 = SupportAlpaca4d(
    Position=flatten(divide_7.Points),
    Tx=True,
    Ty=True,
    Tz=True,
    Rx=False,
    Ry=False,
    Rz=False,
    mode="Support Rigid (Alpaca4d)")
pinned_3 = SupportAlpaca4d(
    Position=flatten(divide_8.Points),
    Tx=True,
    Ty=True,
    Tz=True,
    Rx=False,
    Ry=False,
    Rz=False,
    mode="Support Rigid (Alpaca4d)")

# ---- group: D2 - Built in along its root
at_the_root = Expression(x=node_x_y.XComponent, Expression="x<15.001")
root_nodes = CullPattern(List=lifted, CullPattern=at_the_root)
built_in_2 = SupportAlpaca4d(Position=flatten(root_nodes), Tx=True, Ty=True, Tz=True, Rx=True, Ry=True, Rz=True, mode="Support Rigid (Alpaca4d)")

# ---- group: A4 - One load pattern, assembled and solved
load_pattern = LoadPatternAlpaca4d(Loads=flatten(_50_kn_m), Factor=1, mode="PlainPattern (Alpaca4d)")
analysis_settings = AnalysisSettingsAlpaca4d(Constraint="Transformation", Numberer="RCM", System="Auto", Algorithm="Newton", AnalysisType="Static", Cores=0)
assemble_model = AssembleModelAlpaca4d(Elements=flatten(asdq4_asdt3), Supports=flatten(built_in), LoadPatterns=flatten(load_pattern), Tolerance=0.01)  # -> AlpacaModel, Mass
run_analysis = RunAnalysisAlpaca4d(AlpacaModel=assemble_model.AlpacaModel, Settings=analysis_settings, settings=True)  # -> AlpacaModel, Log

# ---- group: B4 - One load pattern, assembled and solved
load_pattern_2 = LoadPatternAlpaca4d(Loads=flatten(_500_kn), Factor=1, mode="PlainPattern (Alpaca4d)")
analysis_settings_2 = AnalysisSettingsAlpaca4d(Constraint="Transformation", Numberer="RCM", System="Auto", Algorithm="Newton", AnalysisType="Static", Cores=0)
assemble_model_2 = AssembleModelAlpaca4d(
    Elements=flatten(asdq4_asdt3_3),
    Supports=flatten([pinned, sliding]),
    LoadPatterns=flatten(load_pattern_2),
    Tolerance=0.01)  # -> AlpacaModel, Mass
run_analysis_2 = RunAnalysisAlpaca4d(AlpacaModel=assemble_model_2.AlpacaModel, Settings=analysis_settings_2, settings=True)  # -> AlpacaModel, Log

# ---- group: C4 - One load pattern, assembled and solved
load_pattern_3 = LoadPatternAlpaca4d(Loads=flatten([uniform_load, point_load]), Factor=1, mode="PlainPattern (Alpaca4d)")
analysis_settings_3 = AnalysisSettingsAlpaca4d(Constraint="Transformation", Numberer="RCM", System="Auto", Algorithm="Newton", AnalysisType="Static", Cores=0)
assemble_model_3 = AssembleModelAlpaca4d(
    Elements=flatten(asdq4_asdt3_4),
    Supports=flatten([pinned_2, pinned_3]),
    LoadPatterns=flatten(load_pattern_3),
    Tolerance=0.01)  # -> AlpacaModel, Mass
run_analysis_3 = RunAnalysisAlpaca4d(AlpacaModel=assemble_model_3.AlpacaModel, Settings=analysis_settings_3, settings=True)  # -> AlpacaModel, Log

# ---- group: D3 - Its own weight
own_weight = GravityLoadAlpaca4d(Factor=1)
load_pattern_4 = LoadPatternAlpaca4d(Loads=own_weight, Factor=1, mode="PlainPattern (Alpaca4d)")

# ---- group: A5 - Principal Stress Lines, in its plane
seed = Point(Point(4, 0, 1.25))
cantilever_wall = PrincipalStressLinesAlpaca4d(
    AlpacaModel=run_analysis.AlpacaModel,
    Step=0,
    Seed=seed,
    StepTolerance=0,
    SingleLine=False,
    PoissonsRatio=0,
    BendingStressLines=False,
    Separation=0.2,
    TestDist=0.08,
    mode="PrincipalStressLines")  # -> StressLinesDir1, StressLinesDir2

# ---- group: B5 - Principal Stress Lines, in its plane
seed_2 = Point(Point(16, 0, 2))
deep_beam = PrincipalStressLinesAlpaca4d(
    AlpacaModel=run_analysis_2.AlpacaModel,
    Step=0,
    Seed=seed_2,
    StepTolerance=0,
    SingleLine=False,
    PoissonsRatio=0,
    BendingStressLines=False,
    Separation=0.3,
    TestDist=0.12,
    mode="PrincipalStressLines")  # -> StressLinesDir1, StressLinesDir2

# ---- group: C5 - Principal Stress Lines, in bending
seed_3 = Point(Point(6, -10, 0))
slab = PrincipalStressLinesAlpaca4d(
    AlpacaModel=run_analysis_3.AlpacaModel,
    Step=0,
    Seed=seed_3,
    StepTolerance=0,
    SingleLine=False,
    PoissonsRatio=0,
    BendingStressLines=True,
    Separation=0.35,
    TestDist=0.14,
    mode="PrincipalStressLines")  # -> StressLinesDir1, StressLinesDir2

# ---- group: D4 - Assembled and solved
analysis_settings_4 = AnalysisSettingsAlpaca4d(Constraint="Transformation", Numberer="RCM", System="Auto", Algorithm="Newton", AnalysisType="Static", Cores=0)
assemble_model_4 = AssembleModelAlpaca4d(Elements=flatten(asdq4_asdt3_2), Supports=flatten(built_in_2), LoadPatterns=flatten(load_pattern_4), Tolerance=0.01)  # -> AlpacaModel, Mass
run_analysis_4 = RunAnalysisAlpaca4d(AlpacaModel=assemble_model_4.AlpacaModel, Settings=analysis_settings_4, settings=True)  # -> AlpacaModel, Log

# ---- group: D5 - Principal Stress Lines, in its surface
seed_4 = Point(Point(18.5, -11, 1.5))
cantilever_shell = PrincipalStressLinesAlpaca4d(
    AlpacaModel=run_analysis_4.AlpacaModel,
    Step=0,
    Seed=seed_4,
    StepTolerance=0,
    SingleLine=False,
    PoissonsRatio=0,
    BendingStressLines=False,
    Separation=0.25,
    TestDist=0.1,
    mode="PrincipalStressLines")  # -> StressLinesDir1, StressLinesDir2
