# Grasshopper definition StressLinesShell.gh (Grasshopper 1.0.7)
# plug-ins: Galapagos, Kangaroo2 Components, Alpaca4d

# ---- group: 1 - A flat net, 10 x 10 m in 24 x 24 quads
_10_x_10_m = Rectangle3Pt(PointA=Point(0, 0, 0), PointB=Point(10, 0, 0), PointC=Point(10, 10, 0))  # -> Rectangle, Length
corners = Point([Point(0, 0, 0), Point(0.4166666667, 0, 0), Point(0, 0.4166666667, 0), Point(10, 0, 0), Point(9.583333333, 0, 0), Point(10, 0.4166666667, 0), Point(10, 10, 0), Point(9.583333333, 10, 0), Point(10, 9.583333333, 0), Point(0, 10, 0), Point(0.4166666667, 10, 0), Point(0, 9.583333333, 0)])
_24_x_24_quads = MeshPlane(Boundary=_10_x_10_m.Rectangle, WidthCount=24, HeightCount=24)  # -> Mesh, Area
nodes = DeconstructMesh(Mesh=_24_x_24_quads.Mesh)  # -> Vertices, Faces, Colours, Normals

# ---- group: 2 - Kangaroo: edges that keep their length, held at the corners, every node pushed up
lift = Slider(0.0004, range=0..0.002)
up = UnitZ(Factor=lift)
net = Show(G=_24_x_24_quads.Mesh)
edges = EdgeLengths(Mesh=_24_x_24_quads.Mesh, LengthFactor=1, Strength=1)
push_up = Load(Point=nodes.Vertices, ForceVector=up, Weighting=1)
held = Anchor(Point=corners, Strength=10000)

# ---- group: 3 - Kangaroo's Zombie Solver finds the form
iterations = Slider(10000, range=1..10000)
zombie_solver = ZombieSolver(GoalObjects=flatten([net, edges, push_up, held]), Threshold=1e-10, Tolerance=0.0001, MaxIterations=iterations)  # -> I, V, O
iterations_used = Panel(zombie_solver.I)
form = ListItem(List=zombie_solver.O, Index=0, Wrap=True)

# ---- group: 4 - A concrete shell on the form, 80 mm, pinned at the corners, under its own weight
pinned = SupportAlpaca4d(Position=flatten(corners), Tx=True, Ty=True, Tz=True, Rx=False, Ry=False, Rz=False, mode="Support Rigid (Alpaca4d)")
own_weight = GravityLoadAlpaca4d(Factor=1)
concrete = ND(MaterialName="Concrete", E=33000000, G=13750000, Ν=0.2, Rho=2500, mode="ElasticIsotropic (Alpaca4d)")
_80_mm = PlateFiberSectionAlpaca4d(Thickness=0.08, Material=concrete)
asdq4_asdt3 = ASDShellAlpaca4d(Mesh=form, Section=_80_mm, IsCorotational=False)
analysis_settings = AnalysisSettingsAlpaca4d(Constraint="Transformation", Numberer="RCM", System="Auto", Algorithm="Newton", AnalysisType="Static", Cores=0)
load_pattern = LoadPatternAlpaca4d(Loads=own_weight, Factor=1, mode="PlainPattern (Alpaca4d)")
assemble_model = AssembleModelAlpaca4d(Elements=flatten(asdq4_asdt3), Supports=flatten(pinned), LoadPatterns=flatten(load_pattern), Tolerance=0.01)  # -> AlpacaModel, Mass
run_analysis = RunAnalysisAlpaca4d(AlpacaModel=assemble_model.AlpacaModel, Settings=analysis_settings, settings=True)  # -> AlpacaModel, Log

# ---- group: 5 - Principal Stress Lines, in the shell's surface
seed = Point(Point(3, 4, 10))
shell = PrincipalStressLinesAlpaca4d(
    AlpacaModel=run_analysis.AlpacaModel,
    Step=0,
    Seed=seed,
    StepTolerance=0,
    SingleLine=False,
    PoissonsRatio=0,
    BendingStressLines=False,
    Separation=0.35,
    TestDist=0.175,
    mode="PrincipalStressLines")  # -> StressLinesDir1, StressLinesDir2
