# Grasshopper definition corner-slab.gh (Grasshopper 1.0.7)
# plug-ins: Galapagos, Kangaroo2 Components, Alpaca4d

# ---- group: 1 - Slab on four corner columns: 12 x 12 m, in 2304 faces
nodes = Point([Point(0, 0, 0), Point(0.25, 0, 0), Point(0.5, 0, 0), Point(0.75, 0, 0), Point(1, 0, 0), Point(1.25, 0, 0)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])
held = Point([Point(0, 0, 0), Point(12, 0, 0), Point(12, 12, 0), Point(0, 12, 0)])
quads = MeshQuad(
    CornerA=[0, 1, 2, 3, 4, 5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],
    CornerB=[1, 2, 3, 4, 5, 6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],
    CornerC=[50, 51, 52, 53, 54, 55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],
    CornerD=[49, 50, 51, 52, 53, 54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])
surface = ConstructMesh(Vertices=nodes, Faces=flatten(quads))

# ---- group: 4 - Pinned on four corner columns
pinned = SupportAlpaca4d(Position=flatten(held), Tx=True, Ty=True, Tz=True, Rx=False, Ry=False, Rz=False, mode="Support Rigid (Alpaca4d)")

# ---- group: 5 - 10 kN/m2
_10_kn_m2 = MeshLoadAlpaca4d(Force=Vector(0, 0, -10))
load_pattern = LoadPatternAlpaca4d(Loads=_10_kn_m2, Factor=1, mode="PlainPattern (Alpaca4d)")

# ---- group: 3 - A concrete shell, 250 mm
concrete = ND(MaterialName="Concrete", E=33000000, G=13750000, Ν=0.2, Rho=2500, mode="ElasticIsotropic (Alpaca4d)")
_250_mm = PlateFiberSectionAlpaca4d(Thickness=0.25, Material=concrete)
asdq4_asdt3 = ASDShellAlpaca4d(Mesh=surface, Section=_250_mm, IsCorotational=False)

# ---- group: 6 - Assembled and solved
assemble_model = AssembleModelAlpaca4d(Elements=flatten(asdq4_asdt3), Supports=flatten(pinned), LoadPatterns=flatten(load_pattern), Tolerance=0.01)  # -> AlpacaModel, Mass
analysis_settings = AnalysisSettingsAlpaca4d(Constraint="Transformation", Numberer="RCM", System="Auto", Algorithm="Newton", AnalysisType="Static", Cores=0)
run_analysis = RunAnalysisAlpaca4d(AlpacaModel=assemble_model.AlpacaModel, Settings=analysis_settings, settings=True)  # -> AlpacaModel, Log

# ---- group: 7 - Principal Stress Lines, in bending
seeds = Point([Point(7.3, 4.1, 0), Point(7.9, 7.3, 0), Point(4.7, 7.9, 0), Point(4.1, 4.7, 0)])
slab_on_four_corner_columns = PrincipalStressLinesAlpaca4d(
    AlpacaModel=run_analysis.AlpacaModel,
    Step=0,
    Seed=seeds,
    StepTolerance=0,
    SingleLine=False,
    PoissonsRatio=0,
    BendingStressLines=True,
    Separation=0.45,
    TestDist=0.18,
    mode="PrincipalStressLines")  # -> StressLinesDir1, StressLinesDir2

# ---- group: 8 - For the pictures: the lines as ribs 300 mm deep, the columns, the floor
rib_depth = UnitZ(Factor=-0.3)
smooth_sl1 = FitCurve(Curve=slab_on_four_corner_columns.StressLinesDir1, Degree=3, Tolerance=0.005)
smooth_sl2 = FitCurve(Curve=slab_on_four_corner_columns.StressLinesDir2, Degree=3, Tolerance=0.005)
column_tops = Point([Point(0, 0, 0), Point(12, 0, 0), Point(12, 12, 0), Point(0, 12, 0)])
down_the_columns = UnitZ(Factor=-1)
column_axes = LineSDL(Start=column_tops, Direction=down_the_columns, Length=4)
floor_outline = Rectangle3Pt(PointA=Point(-6, -6, -4), PointB=Point(18, -6, -4), PointC=Point(18, 18, -4))  # -> Rectangle, Length
ribs_sl1 = Extrude(Base=smooth_sl1, Direction=rib_depth)
ribs_sl2 = Extrude(Base=smooth_sl2, Direction=rib_depth)
column_shafts = Pipe(Curve=column_axes, Radius=0.3, Caps=1)
floor = MeshPlane(Boundary=floor_outline.Rectangle, WidthCount=1, HeightCount=1)  # -> Mesh, Area
