# Grasshopper definition palazzetto.gh (Grasshopper 1.0.7)
# plug-ins: Galapagos, Kangaroo2 Components, Alpaca4d

# ---- group: 1 - Nervi Palazzetto: 30 m across, in 1920 faces
nodes = Point([Point(0, 0, 0), Point(0.75, 0, 0), Point(0.7483941924, 0.04905234692, 0), Point(0.743583646, 0.09789464417, 0), Point(0.7355889603, 0.1463177415, 0), Point(0.7244443697, 0.1941142838, 0)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])
held = Point([Point(14.25, 0, 0), Point(13.16528334, 5.453238911, 0), Point(10.07627163, 10.07627163, 0), Point(5.453238911, 13.16528334, 0), Point(0, 14.25, 0), Point(-5.453238911, 13.16528334, 0)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])
quads = MeshQuad(
    CornerA=[1, 2, 3, 4, 5, 6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],
    CornerB=[97, 98, 99, 100, 101, 102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],
    CornerC=[98, 99, 100, 101, 102, 103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],
    CornerD=[2, 3, 4, 5, 6, 7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])
triangles = MeshTriangle(
    CornerA=[0, 0, 0, 0, 0, 0, 0, 0, 0, 0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],
    CornerB=[1, 2, 3, 4, 5, 6, 7, 8, 9, 10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],
    CornerC=[2, 3, 4, 5, 6, 7, 8, 9, 10, 11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])
flat_net = ConstructMesh(Vertices=nodes, Faces=flatten([quads, triangles]))

# ---- group: 2 - Kangaroo: edges that keep their length, held, every node pushed up; the Zombie Solver
net = Show(G=flat_net)
edges = EdgeLengths(Mesh=flat_net, LengthFactor=1, Strength=1)
lift = Slider(0.0015, range=0..0.0045)
up = UnitZ(Factor=lift)
held_2 = Anchor(Point=held, Strength=10000)
net_nodes = DeconstructMesh(Mesh=flat_net)  # -> Vertices, Faces, Colours, Normals
push_up = Load(Point=net_nodes.Vertices, ForceVector=up, Weighting=1)
iterations = Slider(20000, range=1..20000)
zombie_solver = ZombieSolver(GoalObjects=flatten([net, edges, push_up, held_2]), Threshold=1e-10, Tolerance=0.0001, MaxIterations=iterations)  # -> I, V, O
iterations_used = Panel(zombie_solver.I)
surface = ListItem(List=zombie_solver.O, Index=0, Wrap=True)

# ---- group: 4 - Pinned on sixteen footings round its rim
pinned = SupportAlpaca4d(Position=flatten(held), Tx=True, Ty=True, Tz=True, Rx=False, Ry=False, Rz=False, mode="Support Rigid (Alpaca4d)")

# ---- group: 5 - Its own weight
own_weight = GravityLoadAlpaca4d(Factor=1)
load_pattern = LoadPatternAlpaca4d(Loads=own_weight, Factor=1, mode="PlainPattern (Alpaca4d)")

# ---- group: 3 - A concrete shell, 120 mm
concrete = ND(MaterialName="Concrete", E=33000000, G=13750000, Ν=0.2, Rho=2500, mode="ElasticIsotropic (Alpaca4d)")
_120_mm = PlateFiberSectionAlpaca4d(Thickness=0.12, Material=concrete)
asdq4_asdt3 = ASDShellAlpaca4d(Mesh=surface, Section=_120_mm, IsCorotational=False)

# ---- group: 6 - Assembled and solved
assemble_model = AssembleModelAlpaca4d(Elements=flatten(asdq4_asdt3), Supports=flatten(pinned), LoadPatterns=flatten(load_pattern), Tolerance=0.01)  # -> AlpacaModel, Mass
analysis_settings = AnalysisSettingsAlpaca4d(Constraint="Transformation", Numberer="RCM", System="Auto", Algorithm="Newton", AnalysisType="Static", Cores=0)
run_analysis = RunAnalysisAlpaca4d(AlpacaModel=assemble_model.AlpacaModel, Settings=analysis_settings, settings=True)  # -> AlpacaModel, Log

# ---- group: 7 - Principal Stress Lines, in the membrane
seeds = Point([Point(5.943657395, 1.372201431, 0), Point(4.966104662, 3.54228803, 0), Point(3.232507512, 5.173093387, 0), Point(1.006790396, 6.016342169, 0), Point(-1.372201431, 5.943657395, 0), Point(-3.54228803, 4.966104662, 0), Point(-5.173093387, 3.232507512, 0), Point(-6.016342169, 1.006790396, 0), Point(-5.943657395, -1.372201431, 0), Point(-4.966104662, -3.54228803, 0), Point(-3.232507512, -5.173093387, 0), Point(-1.006790396, -6.016342169, 0), Point(1.372201431, -5.943657395, 0), Point(3.54228803, -4.966104662, 0), Point(5.173093387, -3.232507512, 0), Point(6.016342169, -1.006790396, 0)])
nervi_palazzetto = PrincipalStressLinesAlpaca4d(
    AlpacaModel=run_analysis.AlpacaModel,
    Step=0,
    Seed=seeds,
    StepTolerance=0,
    SingleLine=False,
    PoissonsRatio=0,
    BendingStressLines=False,
    Separation=0.6,
    TestDist=0.24,
    mode="PrincipalStressLines")  # -> StressLinesDir1, StressLinesDir2

# ---- group: 8 - For the pictures: the floor
floor_outline = Rectangle3Pt(PointA=Point(-30, -30, 0), PointB=Point(30, -30, 0), PointC=Point(30, 30, 0))  # -> Rectangle, Length
floor = MeshPlane(Boundary=floor_outline.Rectangle, WidthCount=1, HeightCount=1)  # -> Mesh, Area
