# Grasshopper definition round-slab.gh (Grasshopper 1.0.7)
# plug-ins: Galapagos, Kangaroo2 Components, Alpaca4d

# ---- group: 1 - Round slab on eight columns: 20 m across, in 3840 faces
nodes = Point([Point(0, 0, 0), Point(0.25, 0, 0), Point(0.2494647308, 0.01635078231, 0), Point(0.2478612153, 0.03263154806, 0), Point(0.2451963201, 0.0487725805, 0), Point(0.2414814566, 0.06470476128, 0)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])
held = Point([Point(7, 0, 0), Point(4.949747468, 4.949747468, 0), Point(0, 7, 0), Point(-4.949747468, 4.949747468, 0), Point(-7, 0, 0), Point(-4.949747468, -4.949747468, 0), Point(0, -7, 0), Point(4.949747468, -4.949747468, 0)])
quads = MeshQuad(
    CornerA=[1, 2, 3, 4, 5, 6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],
    CornerB=[97, 98, 99, 100, 101, 102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],
    CornerC=[98, 99, 100, 101, 102, 103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],
    CornerD=[2, 3, 4, 5, 6, 7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])
triangles = MeshTriangle(
    CornerA=[0, 0, 0, 0, 0, 0, 0, 0, 0, 0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],
    CornerB=[1, 2, 3, 4, 5, 6, 7, 8, 9, 10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],
    CornerC=[2, 3, 4, 5, 6, 7, 8, 9, 10, 11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])
surface = ConstructMesh(Vertices=nodes, Faces=flatten([quads, triangles]))

# ---- group: 4 - Pinned on eight columns in a ring 14 m across
pinned = SupportAlpaca4d(Position=flatten(held), Tx=True, Ty=True, Tz=True, Rx=False, Ry=False, Rz=False, mode="Support Rigid (Alpaca4d)")

# ---- group: 5 - 10 kN/m2
_10_kn_m2 = MeshLoadAlpaca4d(Force=Vector(0, 0, -10))
load_pattern = LoadPatternAlpaca4d(Loads=_10_kn_m2, Factor=1, mode="PlainPattern (Alpaca4d)")

# ---- group: 3 - A concrete shell, 250 mm
concrete = ND(MaterialName="Concrete", E=33000000, G=13750000, Ν=0.2, Rho=2500, mode="ElasticIsotropic (Alpaca4d)")
_250_mm = PlateFiberSectionAlpaca4d(Thickness=0.25, Material=concrete)
asdq4_asdt3 = ASDShellAlpaca4d(Mesh=surface, Section=_250_mm, IsCorotational=False)

# ---- group: 6 - Assembled and solved
assemble_model = AssembleModelAlpaca4d(Elements=flatten(asdq4_asdt3), Supports=flatten(pinned), LoadPatterns=flatten(load_pattern), Tolerance=0.01)  # -> AlpacaModel, Mass
analysis_settings = AnalysisSettingsAlpaca4d(Constraint="Transformation", Numberer="RCM", System="Auto", Algorithm="Newton", AnalysisType="Static", Cores=0)
run_analysis = RunAnalysisAlpaca4d(AlpacaModel=assemble_model.AlpacaModel, Settings=analysis_settings, settings=True)  # -> AlpacaModel, Log

# ---- group: 7 - Principal Stress Lines, in bending
seeds = Point([Point(3.043044269, 0.5915078857, 0), Point(1.733498001, 2.570016475, 0), Point(-0.5915078857, 3.043044269, 0), Point(-2.570016475, 1.733498001, 0), Point(-3.043044269, -0.5915078857, 0), Point(-1.733498001, -2.570016475, 0), Point(0.5915078857, -3.043044269, 0), Point(2.570016475, -1.733498001, 0)])
round_slab_on_eight_columns = PrincipalStressLinesAlpaca4d(
    AlpacaModel=run_analysis.AlpacaModel,
    Step=0,
    Seed=seeds,
    StepTolerance=0,
    SingleLine=False,
    PoissonsRatio=0,
    BendingStressLines=True,
    Separation=0.5,
    TestDist=0.2,
    mode="PrincipalStressLines")  # -> StressLinesDir1, StressLinesDir2

# ---- group: 8 - For the pictures: the lines as ribs 300 mm deep, the columns, the floor
rib_depth = UnitZ(Factor=-0.3)
smooth_sl1 = FitCurve(Curve=round_slab_on_eight_columns.StressLinesDir1, Degree=3, Tolerance=0.005)
smooth_sl2 = FitCurve(Curve=round_slab_on_eight_columns.StressLinesDir2, Degree=3, Tolerance=0.005)
column_tops = Point([Point(7, 0, 0), Point(4.949747468, 4.949747468, 0), Point(0, 7, 0), Point(-4.949747468, 4.949747468, 0), Point(-7, 0, 0), Point(-4.949747468, -4.949747468, 0), Point(0, -7, 0), Point(4.949747468, -4.949747468, 0)])
down_the_columns = UnitZ(Factor=-1)
column_axes = LineSDL(Start=column_tops, Direction=down_the_columns, Length=5)
floor_outline = Rectangle3Pt(PointA=Point(-20, -20, -5), PointB=Point(20, -20, -5), PointC=Point(20, 20, -5))  # -> Rectangle, Length
ribs_sl1 = Extrude(Base=smooth_sl1, Direction=rib_depth)
ribs_sl2 = Extrude(Base=smooth_sl2, Direction=rib_depth)
column_shafts = Pipe(Curve=column_axes, Radius=0.35, Caps=1)
floor = MeshPlane(Boundary=floor_outline.Rectangle, WidthCount=1, HeightCount=1)  # -> Mesh, Area
