# Grasshopper definition TopologyTower.gh (Grasshopper 1.0.7)
# plug-ins: Galapagos, Alpaca4d

# ---- group: 3 - Held at the four bottom corners, loaded at the middle of the top
corner_nodes = ConstructPoint(XCoordinate=[0, 1, 15, 16], YCoordinate=graft([0, 1, 15, 16]), ZCoordinate=0)
middle_of_the_top = ConstructPoint(XCoordinate=[7, 8, 9], YCoordinate=graft([7, 8, 9]), ZCoordinate=16)
held_corners = SupportAlpaca4d(Position=flatten(corner_nodes), Tx=True, Ty=True, Tz=True, Rx=False, Ry=False, Rz=False)
unit_z = UnitZ(Factor=-1)
top_load = PointLoadAlpaca4d(Point=flatten(middle_of_the_top), Force=unit_z, Moment=Vector(0, 0, 0))
load_pattern = LoadPatternAlpaca4d(Loads=flatten(top_load), Factor=1, mode="PlainPattern (Alpaca4d)")

# ---- group: 1 - Material: E = 1, Poisson 0.3
material = Panel("top3d")
E = Panel("1")
G = Panel("0.384615384615385")
poisson = Panel("0.3")
density = Panel("0")
top3d_material = ND(MaterialName=material, E=E, G=G, Ν=poisson, Rho=density, mode="ElasticIsotropic (Alpaca4d)")

# ---- group: 2 - A cube of 16 x 16 x 16 bricks
levels = Series(Start=0, Step=1, Count=17)
cube_plan = Rectangle3Pt(PointA=Point(0, 0, 0), PointB=Point(16, 0, 0), PointC=Point(16, 16, 0))  # -> Rectangle, Length
up_to_each_level = UnitZ(Factor=levels)
plan_mesh = MeshPlane(Boundary=cube_plan.Rectangle, WidthCount=16, HeightCount=16)  # -> Mesh, Area
level_meshes = Move(Geometry=plan_mesh.Mesh, Motion=up_to_each_level)  # -> Geometry, Transform
mesh_series_to_brick = MeshSeriesToBrickAlpaca4d(Meshes=level_meshes.Geometry, Closed=False)
cube = SSPBrickAlpaca4d(Mesh=mesh_series_to_brick, Material=top3d_material)

# ---- group: 4 - Topology Optimisation: 8% of the volume, set Run to true
tower = AssembleModelAlpaca4d(Elements=flatten(cube), Supports=flatten(held_corners), LoadPatterns=flatten(load_pattern), Tolerance=0.01)  # -> AlpacaModel, Mass
run = BooleanToggle(False)
step = Slider(100, range=0..100)
tower_2 = TopologyOptimisationAlpaca4d(
    AlpacaModel=tower.AlpacaModel,
    VolumeFraction=0.08,
    Iterations=100,
    Run=run,
    Penalty=3,
    FilterRadius=1.5,
    Tolerance=0.01,
    MinStiffness=1e-09,
    Move=0.2,
    Threshold=0.5,
    System="Auto",
    Step=step)  # -> Surface, Solid, Density, Element, Compliance, Volume, Converged, History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
history = Panel(tower_2.History)
